# Dynamo graph xin2.dyn (Dynamo 3.0.3.7597)

restart = BoolSelector(false)  # graph input
python_script = Python(IN[0]=restart)  # CPython3
# ---------- python_script.python (2 lines) ----------
import sys
OUT = sys.version, sys.path
# ----------------------------------------
python_paths = CodeBlock(i=python_script) { i[1]; }
python_paths_2 = Watch(python_paths)  # graph output
python_version = CodeBlock(i=python_script) { i[0]; }
python_version_2 = Watch(python_version)  # graph output
python_script_2 = Python(IN[0]=restart)  # CPython3; frozen; unwired: IN[1]
# ---------- python_script_2.python (26 lines) ----------
# 加载 Python Standard 和 DesignScript 库
import sys
import clr
clr.AddReference('ProtoGeometry')
from Autodesk.DesignScript.Geometry import *
sys.path.append("C:/Users/Lenovo/anaconda3/envs/revitenv/Lib/site-packages")
import numpy as np
import torch
import cv2
from ultralytics import YOLO

# 该节点的输入内容将存储为 IN 变量中的一个列表。
dataEnteringNode = IN                            
# 将代码放在该行下面                          
yolo_seg = YOLO("E:/yanjiu/hou_pracs_on/Testings/Saves/yolov8l-seg.pt",task = "seg")

filepath = "E:/yanjiu/revitss/tests/jiedao.jpg"
newpath = "E:/yanjiu/revitss/tests/jiedao_seg.jpg"

seg_result = yolo_seg(source = filepath,save = False,conf = 0.3,iou = 0.45,imgsz = 640)
cv2.imwrite(newpath,seg_result[0].plot())



# 将输出内容指定给 OUT 变量。
OUT = torch.__version__
# ----------------------------------------
python_version_3 = Watch(python_script_2)  # graph output
imagepath = Filename("E:\yanjiu\revitss\tests\jiedao.jpg")
file_from_path = FileObject(path=imagepath)
readFromFile = Image.ReadFromFile(file=file_from_path)
watch_image = WatchImageCore(image=readFromFile)  # frozen
python_script_3 = Python(IN[0]=readFromFile, IN[1]=imagepath)  # CPython3; frozen
# ---------- python_script_3.python (28 lines) ----------
# 加载 Python Standard 和 DesignScript 库
import sys
import clr
clr.AddReference('ProtoGeometry')
from Autodesk.DesignScript.Geometry import *
sys.path.append("C:/Users/Lenovo/anaconda3/envs/revitenv/Lib/site-packages")
import numpy as np
import torch
import cv2
from ultralytics import YOLO

# 该节点的输入内容将存储为 IN 变量中的一个列表。
dataEnteringNode = IN 
piximage = IN[0]
pixpath = IN[1]                           
# 将代码放在该行下面                          
yolo_seg = YOLO("E:/yanjiu/hou_pracs_on/Testings/Saves/yolov8l-seg.pt",task = "seg")

filepath = "E:/yanjiu/revitss/tests/jiedao.jpg"
newpath = "E:/yanjiu/revitss/tests/jiedao_seg.jpg"

seg_result = yolo_seg(source = pixpath,save = False,conf = 0.3,iou = 0.45,imgsz = 640)
cv2.imwrite(newpath,seg_result[0].plot())



# 将输出内容指定给 OUT 变量。
OUT = newpath
# ----------------------------------------
file_from_path_2 = FileObject(path=python_script_3)
readFromFile_2 = Image.ReadFromFile(file=file_from_path_2)
watch_image_2 = WatchImageCore(image=readFromFile_2)
imagepath_2 = Filename("..\tests\2室2厅1厨1卫-74.38㎡-南 北-103103288208.jpg")
file_from_path_3 = FileObject(path=imagepath_2)
readFromFile_3 = Image.ReadFromFile(file=file_from_path_3)
watch_image_3 = WatchImageCore(image=readFromFile_3)
modelpath = Filename("E:\yanjiu\hou_pracs_on\Testings\Saves\best_detect1.pt")
python_script_4 = Python(IN[0]=modelpath, IN[1]=imagepath_2)  # CPython3; frozen
# ---------- python_script_4.python (104 lines) ----------
# 加载 Python Standard 和 DesignScript 库
import sys
import clr
clr.AddReference('ProtoGeometry')
from Autodesk.DesignScript.Geometry import *
import Autodesk.DesignScript.Geometry as DS
import Revit
from Revit.Elements import *
import System
sys.path.append("C:/Users/Lenovo/anaconda3/envs/revitenv/Lib/site-packages")
clr.AddReference('RevitAPI')
clr.AddReference('RevitAPIUI')
from Autodesk.Revit.DB import *
from Autodesk.Revit.UI import *

clr.AddReference('RevitServices')
from RevitServices.Persistence import DocumentManager
from RevitServices.Transactions import TransactionManager

clr.AddReference('RevitNodes')
import Revit
clr.ImportExtensions(Revit.Elements)
clr.ImportExtensions(Revit.GeometryConversion)
#
import numpy as np
import torch
import cv2
from ultralytics import YOLO

dataEnteringNode = IN 
dect_Model = IN[0]
pixpath = IN[1]
#params
origin = XYZ(0, 0, 0)   
widthFt = 10.0
pixelWidth = 1600   
pixelHeight = 1200                          
#                         
yolo_dect = YOLO(dect_Model,task = "detect")
newpath = "E:/yanjiu/revitss/tests/jjianzhu_dect.jpg"

dect_result = yolo_dect(source = pixpath,save = False,conf = 0.3,iou = 0.45,imgsz = 640)
cv2.imwrite(newpath,dect_result[0].plot())
#tempouts = []
#tempouts.append(newpath)
#tempouts.extend(dect_result)
scaleX = widthFt / pixelWidth
scaleY = widthFt * (pixelHeight / pixelWidth) / pixelHeight  

result = dect_result[0]        
boxes = result.boxes
xyxy = boxes.xyxy.cpu().numpy() 

doc = DocumentManager.Instance.CurrentDBDocument
app = doc.Application
TransactionManager.Instance.EnsureInTransaction(doc)

created_lines = []
dyn_lines = [] 
dyn_faces = [] 

def pix_to_revit(x, y):
    revit_x = origin.X + x * scaleX
    revit_y = origin.Y + (pixelHeight - y) * scaleY  # 翻转 Y 轴
    return XYZ(revit_x, revit_y, origin.Z)
plane = Plane.CreateByNormalAndOrigin(XYZ.BasisZ, origin)
sketch_plane = SketchPlane.Create(doc, plane)

for bbox in xyxy:
    x1, y1, x2, y2 = bbox  # 左上角 (x1,y1), 右下角 (x2,y2)
    
    # 计算四个角点的 Revit 坐标
    pt1 = pix_to_revit(x1, y1)  # 左上
    pt2 = pix_to_revit(x2, y1)  # 右上
    pt3 = pix_to_revit(x2, y2)  # 右下
    pt4 = pix_to_revit(x1, y2)  # 左下
    
    # 创建四条线
    lines = [
        Line.CreateBound(pt1, pt2),
        Line.CreateBound(pt2, pt3),
        Line.CreateBound(pt3, pt4),
        Line.CreateBound(pt4, pt1)
    ]
    
    # 创建模型线并添加到列表
    for line in lines:
        model_curve = doc.Create.NewModelCurve(line, sketch_plane)
        created_lines.append(model_curve)
        start_dyn = line.GetEndPoint(0).ToPoint()
        end_dyn = line.GetEndPoint(1).ToPoint()
        dyn_line = DS.Line.ByStartPointEndPoint(start_dyn, end_dyn)
        dyn_lines.append(dyn_line)
    poly = DS.PolyCurve.ByJoinedCurves(dyn_lines, 0.001)
    if poly.IsClosed:
        surface = DS.Surface.ByPatch(poly)
        dyn_faces.append(surface)
    

TransactionManager.Instance.TransactionTaskDone()
doc.Regenerate()
# Outss
#OUT = [created_lines, dyn_lines]
OUT = dyn_faces
# ----------------------------------------
imagepath_3 = Filename("..\tests\2室2厅1厨1卫-74.8㎡-南 西-103110719609.jpg")
scale = DoubleInput(57)
seg_WWTD_Modelpath = Filename("..\..\hou_pracs_on\Testings\Saves\best_WWTD_seg.pt")
number = DoubleInput(9.94)
exe_path = Filename("C:\Users\Lenovo\anaconda3\envs\revitenv\python.exe")
script_path = Filename("..\..\hou_pracs_on\revit_paddleocr_tests\jsons\ocr_runner.py")
string = StringInput("E:\yanjiu\hou_pracs_on\revit_paddleocr_tests\jsons")
json_path = Filename("..\..\hou_pracs_on\revit_paddleocr_tests\jsons\Test1.json")
read_length_export2Json = Python(IN[0]=imagepath_2, IN[1]=exe_path, IN[2]=script_path, IN[3]=string, IN[4]=json_path)  # CPython3
# ---------- read_length_export2Json.python (217 lines) ----------
# 加载 Python Standard 和 DesignScript 库
import sys
import clr
clr.AddReference('ProtoGeometry')
from Autodesk.DesignScript.Geometry import *

import os
import json
import subprocess
import shutil
import re

# IN[0] = 原始图片长路径（不能动）
# IN[1] = revitenv python.exe 路径
# IN[2] = ocr_runner.py 路径
# IN[3] = 临时工作目录，例如 E:\temp_ocr
# IN[4] = json 输出路径，例如 E:\temp_ocr\ocr_result.json

src_image_path = IN[0]
python_exe = IN[1]
script_path = IN[2]
work_dir = IN[3]
output_json = IN[4]

def ensure_dir(path):
    if not os.path.exists(path):
        os.makedirs(path)

def classify_text(text):
    t = (text or "").strip()

    room_keywords = ["客厅", "卧室", "厨房", "卫生间", "阳台", "餐厅", "书房", "主卧", "次卧"]
    if any(k in t for k in room_keywords):
        return "room_name"

    if re.match(r'^\d+(\.\d+)?\s*(m²|m2|㎡)$', t, re.I):
        return "area"

    if re.match(r'^\d+(\.\d+)?$', t):
        return "number"

    # 含尺寸链常见符号/字母/数字
    if re.search(r'[\dKk→—\-米]+', t):
        nums = extract_dimension_numbers(t)
        if len(nums) >= 2:
            return "dimension_chain"
        elif len(nums) == 1:
            return "dimension_like"

    return "other"

def normalize_area_text(text):
    t = (text or "").strip()
    t = t.replace("㎡", "m²")
    t = re.sub(r'(?i)m2', 'm²', t)
    return t

def extract_dimension_numbers(text):
    """
    从类似 'K1280→1325→1905—→K3390—715' 中提取数字序列
    返回 [1280,1325,1905,3390,715]
    """
    if not text:
        return []
    nums = re.findall(r'\d+(?:\.\d+)?', text)
    result = []
    for n in nums:
        try:
            if "." in n:
                result.append(float(n))
            else:
                result.append(int(n))
        except:
            pass
    return result

def is_valid_item(item):
    text = (item.get("text") or "").strip()
    score = float(item.get("score", 0))
    kind = item.get("kind", "other")

    if not text:
        return False

    # 不同类型不同阈值
    if kind == "room_name":
        return score >= 0.75
    elif kind == "area":
        return score >= 0.75
    elif kind == "number":
        return score >= 0.85
    elif kind == "dimension_chain":
        # 尺寸链可以稍微放宽，因为经常混入符号
        return score >= 0.70 or len(item.get("dimension_numbers", [])) >= 2
    elif kind == "dimension_like":
        return score >= 0.75
    else:
        return score >= 0.75

def poly_center(poly):
    try:
        xs = [p[0] for p in poly]
        ys = [p[1] for p in poly]
        return [sum(xs) / float(len(xs)), sum(ys) / float(len(ys))]
    except:
        return None

try:
    ensure_dir(work_dir)

    # 固定复制输出图像
    test_image_path = os.path.join(work_dir, "Test1.jpg")

    # 直接复制文件，最稳
    shutil.copyfile(src_image_path, test_image_path)

    # 调外部 python
    cmd = [python_exe, script_path, test_image_path, output_json]

    p = subprocess.Popen(
        cmd,
        stdout=subprocess.PIPE,
        stderr=subprocess.PIPE,
        shell=False
    )
    stdout, stderr = p.communicate()

    stdout_text = stdout.decode("utf-8", errors="ignore")
    stderr_text = stderr.decode("utf-8", errors="ignore")

    if not os.path.exists(output_json):
        OUT = {
            "ok": False,
            "error": "output_json not found",
            "src_image_path": src_image_path,
            "test_image_path": test_image_path,
            "cmd": cmd,
            "stdout": stdout_text,
            "stderr": stderr_text
        }
    else:
        with open(output_json, "r", encoding="utf-8") as f:
            data = json.load(f)

        if not data.get("ok", False):
            OUT = {
                "ok": False,
                "src_image_path": src_image_path,
                "test_image_path": test_image_path,
                "cmd": cmd,
                "stdout": stdout_text,
                "stderr": stderr_text,
                "json": data
            }
        else:
            items = data.get("items", [])
            processed_items = []

            for item in items:
                text = (item.get("text") or "").strip()
                score = float(item.get("score", 0))
                poly = item.get("poly", None)

                clean_text = normalize_area_text(text)
                kind = classify_text(clean_text)
                dim_nums = extract_dimension_numbers(clean_text)
                center = poly_center(poly) if isinstance(poly, list) else None

                item2 = {
                    "text": text,
                    "clean_text": clean_text,
                    "score": score,
                    "poly": poly,
                    "center": center,
                    "kind": kind,
                    "dimension_numbers": dim_nums
                }

                item2["valid"] = is_valid_item(item2)
                processed_items.append(item2)

            valid_items = [x for x in processed_items if x["valid"]]
            invalid_items = [x for x in processed_items if not x["valid"]]

            room_items = [x for x in valid_items if x["kind"] == "room_name"]
            area_items = [x for x in valid_items if x["kind"] == "area"]
            number_items = [x for x in valid_items if x["kind"] == "number"]
            dimension_chain_items = [x for x in valid_items if x["kind"] == "dimension_chain"]
            dimension_like_items = [x for x in valid_items if x["kind"] == "dimension_like"]
            other_items = [x for x in valid_items if x["kind"] == "other"]

            OUT = {
                "ok": True,
                "src_image_path": src_image_path,
                "test_image_path": test_image_path,
                "output_json": output_json,
                "cmd": cmd,
                "stdout": stdout_text,
                "stderr": stderr_text,
                "all_items": processed_items,
                "valid_items": valid_items,
                "invalid_items": invalid_items,
                "room_items": room_items,
                "area_items": area_items,
                "number_items": number_items,
                "dimension_chain_items": dimension_chain_items,
                "dimension_like_items": dimension_like_items,
                "other_items": other_items
            }
            OUT = output_json

except Exception as e:
    OUT = {
        "ok": False,
        "error": str(e),
        "src_image_path": src_image_path
    }
# ----------------------------------------
layout_Process_data_JsonPath = Filename("..\..\hou_pracs_on\revit_paddleocr_tests\jsons\Test1_dims.json")
wash_json_2_Length = Python(IN[0]=read_length_export2Json, IN[1]=layout_Process_data_JsonPath)  # CPython3
# ---------- wash_json_2_Length.python (265 lines) ----------
# 加载 Python Standard 和 DesignScript 库
import sys
import clr
clr.AddReference('ProtoGeometry')
from Autodesk.DesignScript.Geometry import *
#-----------------------
import json
import re
import os

ocr_json_path = IN[0]
result_json_path = IN[1]

def ensure_dir_of_file(file_path):
    folder = os.path.dirname(file_path)
    if folder and not os.path.exists(folder):
        os.makedirs(folder)

def get_poly(item):
    return item.get("poly", None)

def get_center(item):
    poly = get_poly(item)
    if poly:
        xs = [p[0] for p in poly]
        ys = [p[1] for p in poly]
        return sum(xs) / float(len(xs)), sum(ys) / float(len(ys))
    return None, None

def get_width_height(item):
    poly = get_poly(item)
    if not poly:
        return None, None
    xs = [p[0] for p in poly]
    ys = [p[1] for p in poly]
    return max(xs) - min(xs), max(ys) - min(ys)

def infer_axis(item):
    w, h = get_width_height(item)
    if w is None or h is None:
        return "unknown"
    if w >= h * 1.5:
        return "horizontal"
    elif h >= w * 1.5:
        return "vertical"
    else:
        return "unknown"

def extract_numbers_from_text(text):
    nums = re.findall(r'\d+(?:\.\d+)?', text or "")
    result = []
    for n in nums:
        try:
            v = float(n)
            if 100 <= v <= 50000:
                # 尽量转 int，便于后续使用
                if abs(v - int(v)) < 1e-6:
                    result.append(int(v))
                else:
                    result.append(v)
        except:
            pass
    return result

def classify_text(text):
    nums = extract_numbers_from_text(text)
    if len(nums) >= 2:
        return "dimension_chain"
    elif len(nums) == 1:
        return "number"
    return "other"

def is_valid_dimension_item(item):
    text = str(item.get("text", "")).strip()
    score = float(item.get("score", 0))
    kind = classify_text(text)
    nums = extract_numbers_from_text(text)

    if len(nums) == 0:
        return False

    if kind in ["number", "dimension_chain"] and score >= 0.75:
        return True

    return False

def build_processed_items(items):
    result = []
    for item in items:
        text = str(item.get("text", "")).strip()
        nums = extract_numbers_from_text(text)
        kind = classify_text(text)
        center = get_center(item)

        result.append({
            "text": text,
            "score": float(item.get("score", 0)),
            "poly": item.get("poly", None),
            "center": center,
            "kind": kind,
            "dimension_numbers": nums,
            "valid": is_valid_dimension_item(item)
        })
    return result

def group_items(items, axis, tol=60):
    groups = []

    for item in items:
        x, y = item.get("center", (None, None))
        if x is None:
            continue

        coord = y if axis == "horizontal" else x

        found = None
        for g in groups:
            if abs(g["coord"] - coord) <= tol:
                found = g
                break

        if found is None:
            found = {"axis": axis, "coord": coord, "items": []}
            groups.append(found)

        found["items"].append(item)

    # 更新组坐标
    for g in groups:
        vals = []
        for it in g["items"]:
            x, y = it.get("center", (None, None))
            vals.append(y if axis == "horizontal" else x)
        if vals:
            g["coord"] = sum(vals) / float(len(vals))

    return groups

def dedup_group_numbers(group, axis):
    entries = []

    for item in group["items"]:
        nums = item.get("dimension_numbers", [])
        x, y = item.get("center", (None, None))
        pos = x if axis == "horizontal" else y

        for n in nums:
            entries.append({
                "value": n,
                "pos": pos,
                "text": item.get("text", "")
            })

    entries = sorted(entries, key=lambda e: e["pos"] if e["pos"] is not None else 0)

    deduped = []
    for e in entries:
        duplicated = False
        for d in deduped:
            same_value = (d["value"] == e["value"])
            close_pos = False
            if d["pos"] is not None and e["pos"] is not None:
                close_pos = abs(d["pos"] - e["pos"]) <= 20
            if same_value and close_pos:
                duplicated = True
                break
        if not duplicated:
            deduped.append(e)

    return deduped

def summarize_group(group, axis):
    deduped = dedup_group_numbers(group, axis)
    values = [e["value"] for e in deduped]

    texts = []
    seen = set()
    for item in group["items"]:
        t = item.get("text", "")
        if t not in seen:
            texts.append(t)
            seen.add(t)

    return {
        "axis": axis,
        "coord": group["coord"],
        "count": len(group["items"]),
        "values": values,
        "sum": sum(values) if values else None,
        "texts": texts
    }

try:
    with open(ocr_json_path, "r", encoding="utf-8") as f:
        data = json.load(f)

    if not data.get("ok", False):
        result_data = {
            "ok": False,
            "error": "ocr json not ok",
            "source_json": ocr_json_path
        }
    else:
        raw_items = data.get("items", [])
        items = build_processed_items(raw_items)

        dim_items = [it for it in items if it["valid"]]

        horizontal_items = [it for it in dim_items if infer_axis(it) == "horizontal"]
        vertical_items = [it for it in dim_items if infer_axis(it) == "vertical"]

        horizontal_groups = [summarize_group(g, "horizontal") for g in group_items(horizontal_items, "horizontal", 60)]
        vertical_groups = [summarize_group(g, "vertical") for g in group_items(vertical_items, "vertical", 60)]

        horizontal_groups = [g for g in horizontal_groups if g["sum"] is not None]
        vertical_groups = [g for g in vertical_groups if g["sum"] is not None]

        horizontal_groups = sorted(horizontal_groups, key=lambda g: g["sum"], reverse=True)
        vertical_groups = sorted(vertical_groups, key=lambda g: g["sum"], reverse=True)

        horizontal_main = horizontal_groups[0] if horizontal_groups else None
        vertical_main = vertical_groups[0] if vertical_groups else None

        result_data = {
            "ok": True,
            "source_json": ocr_json_path,
            "result": {
                "horizontal_length": horizontal_main["sum"] if horizontal_main else None,
                "vertical_length": vertical_main["sum"] if vertical_main else None,
                "horizontal_candidates": [g["sum"] for g in horizontal_groups],
                "vertical_candidates": [g["sum"] for g in vertical_groups],
                "horizontal_segments": horizontal_main["values"] if horizontal_main else [],
                "vertical_segments": vertical_main["values"] if vertical_main else [],
                "horizontal_coord": horizontal_main["coord"] if horizontal_main else None,
                "vertical_coord": vertical_main["coord"] if vertical_main else None
            },
            "debug": {
                "horizontal_groups": horizontal_groups,
                "vertical_groups": vertical_groups
            }
        }

    ensure_dir_of_file(result_json_path)
    with open(result_json_path, "w", encoding="utf-8") as f:
        json.dump(result_data, f, ensure_ascii=False, indent=2)

    # Dynamo 输出尽量简单
    OUT = result_json_path

except Exception as e:
    err = {
        "ok": False,
        "error": str(e),
        "source_json": ocr_json_path,
        "result_json_path": result_json_path
    }

    try:
        ensure_dir_of_file(result_json_path)
        with open(result_json_path, "w", encoding="utf-8") as f:
            json.dump(err, f, ensure_ascii=False, indent=2)
    except:
        pass

    OUT = result_json_path
# ----------------------------------------
python_version_4 = Watch(wash_json_2_Length)  # graph output
seg_meta_Json_Path = Filename("..\..\hou_pracs_on\revit_paddleocr_tests\jsons\seg_meta.json")
python_script_5 = Python(IN[0]=seg_WWTD_Modelpath, IN[1]=imagepath_2, IN[2]=number, IN[3]=scale, IN[4]=python_version_4, IN[5]=seg_meta_Json_Path)  # CPython3
# ---------- python_script_5.python (1528 lines) ----------
# 加载 Python Standard 和 DesignScript 库
#---------------------------
import sys
import clr
clr.AddReference('ProtoGeometry')
from Autodesk.DesignScript.Geometry import *
import Autodesk.DesignScript.Geometry as DS
import Revit
from Revit.Elements import *
import System
sys.path.append("C:/Users/Lenovo/anaconda3/envs/revitenv/Lib/site-packages")
clr.AddReference('RevitAPI')
clr.AddReference('RevitAPIUI')
from Autodesk.Revit.DB import *
from Autodesk.Revit.UI import *

clr.AddReference('RevitServices')
from RevitServices.Persistence import DocumentManager
from RevitServices.Transactions import TransactionManager

clr.AddReference('RevitNodes')
import Revit
clr.ImportExtensions(Revit.Elements)
clr.ImportExtensions(Revit.GeometryConversion)

import re
import math
import json
import os
import traceback
import numpy as np
import torch
import cv2

from scipy.spatial import Voronoi
from scipy import ndimage
from shapely.geometry import Polygon, LineString, MultiLineString
from shapely.ops import linemerge
from shapely.ops import unary_union, split
from shapely.geometry import Point as ShpPoint
from shapely.geometry import Polygon as ShpPolygon
from shapely.geometry import MultiPolygon as ShpMultiPolygon
from shapely.geometry import Point as ShpPoint
from shapely.geometry import MultiLineString
from shapely.ops import linemerge
from skimage.morphology import skeletonize
from ultralytics import YOLO

dataEnteringNode = IN 

# =========================
# 输入
# =========================
dect_Model = IN[0]
pixpath = IN[1]
height = IN[2]
scale = IN[3]
dims_json_path = IN[4]
seg_meta_json_path = IN[5]

# =========================
# 参数
# =========================
origin = XYZ(0, 0, 0)   
widthFt = scale
pixelWidth = 1600   
pixelHeight = 1200 
DENSIFY_DIST = 0.5  
EPS = 1e-6

TARGET_WALL_TYPE_NAME = "基本墙 200mm"
TARGET_LEVEL_NAME = "标高 2"

newpath = "E:/yanjiu/revitss/tests/jjianzhu_seg.jpg"

scaleX = widthFt / pixelWidth if pixelWidth > 0 else 0.0
scaleY = widthFt * (pixelHeight / pixelWidth) / pixelHeight if pixelWidth > 0 and pixelHeight > 0 else 0.0

bbox_info_global = None
scale_x_ft_per_px_global = None
scale_y_ft_per_px_global = None

logs = []

# =========================
# 工具函数
# =========================
def ensure_dir_of_file(file_path):
    folder = os.path.dirname(file_path)
    if folder and not os.path.exists(folder):
        os.makedirs(folder)

def pix_to_revit(x, y):
    global bbox_info_global, scale_x_ft_per_px_global, scale_y_ft_per_px_global

    try:
        if bbox_info_global is not None and scale_x_ft_per_px_global is not None and scale_y_ft_per_px_global is not None:
            min_x = bbox_info_global["min_x"]
            min_y = bbox_info_global["min_y"]
            bbox_h = bbox_info_global["height"]

            local_x = x - min_x
            local_y = y - min_y

            revit_x = origin.X + local_x * scale_x_ft_per_px_global
            revit_y = origin.Y + (bbox_h - local_y) * scale_y_ft_per_px_global
            return XYZ(revit_x, revit_y, origin.Z)
    except:
        pass

    revit_x = origin.X + x * scaleX
    revit_y = origin.Y + (pixelHeight - y) * scaleY
    return XYZ(revit_x, revit_y, origin.Z)

def sanitize_name(name):
    if not name:
        return "Unknown"
    cleaned = re.sub(r'[\x00-\x1f\x7f]', '', name)
    if not cleaned.strip():
        return "Unnamed"
    return cleaned

def get_mask_bbox(binary_mask, logs):
    if binary_mask is None:
        logs.append("get_mask_bbox失败: binary_mask is None")
        return None

    ys, xs = np.where(binary_mask > 0)
    if len(xs) == 0 or len(ys) == 0:
        logs.append("get_mask_bbox失败: 墙体mask为空")
        return None

    min_x = int(np.min(xs))
    max_x = int(np.max(xs))
    min_y = int(np.min(ys))
    max_y = int(np.max(ys))

    bbox = {
        "min_x": min_x,
        "min_y": min_y,
        "max_x": max_x,
        "max_y": max_y,
        "width": int(max_x - min_x + 1),
        "height": int(max_y - min_y + 1)
    }
    logs.append("结构mask bbox: {}".format(str(bbox)))
    return bbox

# =========================
# 结构类配置
# =========================
STRUCTURE_CLASS_KEYWORDS = [
    "wall",
    "墙",
    "墙体",
    "basic wall",
    "door",
    "门",
    "tdoor",
    "double door",
    "window",
    "窗",
    "窗户"
]

STRUCTURE_CLASS_EXACT = set([
    "wall",
    "door",
    "window",
    "tdoor"
])

EXPAND_CLASSES = set([
    "door",
    "window",
    "tdoor"
])

def normalize_class_name(name):
    if name is None:
        return ""
    return str(name).strip().lower()

def is_structure_wall_like_class(name):
    n = normalize_class_name(name)
    if not n:
        return False

    if n in STRUCTURE_CLASS_EXACT:
        return True

    for kw in STRUCTURE_CLASS_KEYWORDS:
        if kw.lower() in n:
            return True
    return False

def ensure_polygon(geom):
    if geom is None or geom.is_empty:
        return None
    try:
        if not geom.is_valid:
            geom = geom.buffer(0)
    except:
        pass
    if geom is None or geom.is_empty:
        return None

    if isinstance(geom, ShpPolygon):
        return geom

    if isinstance(geom, ShpMultiPolygon):
        polys = [g for g in geom.geoms if g is not None and not g.is_empty]
        if not polys:
            return None
        polys.sort(key=lambda p: p.area, reverse=True)
        return polys[0]

    return None

def line_long_enough(line_geom, min_len=0.1):
    if line_geom is None or line_geom.is_empty:
        return False
    try:
        return line_geom.length >= min_len
    except:
        return False

def snap_line_to_axis(line_geom):
    if line_geom is None or line_geom.is_empty:
        return None
    coords = list(line_geom.coords)
    if len(coords) < 2:
        return None
    x1, y1 = coords[0]
    x2, y2 = coords[-1]
    dx = x2 - x1
    dy = y2 - y1
    if abs(dx) >= abs(dy):
        ym = 0.5 * (y1 + y2)
        return LineString([(x1, ym), (x2, ym)])
    else:
        xm = 0.5 * (x1 + x2)
        return LineString([(xm, y1), (xm, y2)])

def get_line_orientation_from_geom(line_geom):
    coords = list(line_geom.coords)
    x1, y1 = coords[0]
    x2, y2 = coords[-1]
    if abs(y2 - y1) <= abs(x2 - x1):
        return "h"
    return "v"

def get_line_orientation(seg):
    return get_line_orientation_from_geom(seg['line'])

def line_length(line_geom):
    try:
        return line_geom.length
    except:
        return 0.0

def copy_segments(segments):
    out = []
    for s in segments:
        out.append({
            'line': s['line'],
            'thickness': s['thickness'],
            'name': s['name']
        })
    return out

def longest_linestring_from_intersection(inter):
    if inter is None or inter.is_empty:
        return None
    if inter.geom_type == "LineString":
        return inter
    if inter.geom_type == "MultiLineString":
        lines = [g for g in inter.geoms if g.length > 1e-4]
        if not lines:
            return None
        lines.sort(key=lambda g: g.length, reverse=True)
        return lines[0]
    return None

def merge_close_vertices(segments, delta):
    pts = []
    for seg in segments:
        coords = list(seg['line'].coords)
        pts.append(coords[0])
        pts.append(coords[-1])

    if not pts:
        return segments

    clusters = []
    for p in pts:
        assigned = False
        for cluster in clusters:
            cx, cy, plist = cluster
            d2 = (p[0]-cx)**2 + (p[1]-cy)**2
            if d2 < delta * delta:
                plist.append(p)
                nx = sum(pp[0] for pp in plist) / len(plist)
                ny = sum(pp[1] for pp in plist) / len(plist)
                cluster[0] = nx
                cluster[1] = ny
                assigned = True
                break
        if not assigned:
            clusters.append([p[0], p[1], [p]])

    def snap_point(p):
        best = p
        best_d = 1e18
        for cx, cy, plist in clusters:
            d2 = (p[0]-cx)**2 + (p[1]-cy)**2
            if d2 < best_d:
                best_d = d2
                best = (cx, cy)
        return best

    new_segments = []
    for seg in segments:
        coords = list(seg['line'].coords)
        p1 = snap_point(coords[0])
        p2 = snap_point(coords[-1])
        if ((p1[0]-p2[0])**2 + (p1[1]-p2[1])**2) ** 0.5 < 0.1:
            continue
        new_line = LineString([p1, p2])
        new_line = snap_line_to_axis(new_line)
        if new_line is None:
            continue
        new_segments.append({
            'line': new_line,
            'thickness': seg['thickness'],
            'name': seg['name']
        })
    return new_segments

def point_to_segment_distance(pt, a, b):
    px, py = pt
    ax, ay = a
    bx, by = b
    dx = bx - ax
    dy = by - ay
    if abs(dx) < EPS and abs(dy) < EPS:
        return ((px-ax)**2 + (py-ay)**2)**0.5, a, 0.0

    t = ((px-ax)*dx + (py-ay)*dy) / (dx*dx + dy*dy)
    t_clamped = max(0.0, min(1.0, t))
    qx = ax + t_clamped * dx
    qy = ay + t_clamped * dy
    dist = ((px-qx)**2 + (py-qy)**2)**0.5
    return dist, (qx, qy), t_clamped

def split_segments_by_near_vertices(segments, delta):
    if not segments:
        return segments

    vertices = []
    for seg in segments:
        coords = list(seg['line'].coords)
        vertices.append(coords[0])
        vertices.append(coords[-1])

    new_segments = []
    for idx, seg in enumerate(segments):
        coords = list(seg['line'].coords)
        a = coords[0]
        b = coords[-1]
        split_pts = []

        for v in vertices:
            if v == a or v == b:
                continue
            dist, proj, t = point_to_segment_distance(v, a, b)
            if dist < delta and t > 0.01 and t < 0.99:
                split_pts.append((t, v))

        if not split_pts:
            new_segments.append(seg)
        else:
            split_pts.sort(key=lambda x: x[0])
            chain = [a] + [v for _, v in split_pts] + [b]
            for p1, p2 in zip(chain[:-1], chain[1:]):
                if ((p1[0]-p2[0])**2 + (p1[1]-p2[1])**2) ** 0.5 < 0.1:
                    continue
                new_line = snap_line_to_axis(LineString([p1, p2]))
                if new_line is None:
                    continue
                new_segments.append({
                    'line': new_line,
                    'thickness': seg['thickness'],
                    'name': seg['name']
                })
    return new_segments

def merge_collinear_segments_strict(segments, coord_tol=0.08, gap_tol=0.25):
    if not segments:
        return segments

    horizontal = []
    vertical = []
    others = []

    for seg in segments:
        coords = list(seg['line'].coords)
        x1, y1 = coords[0]
        x2, y2 = coords[-1]

        if abs(y2 - y1) <= coord_tol:
            y = 0.5 * (y1 + y2)
            xmin, xmax = min(x1, x2), max(x1, x2)
            horizontal.append((y, xmin, xmax, seg))
        elif abs(x2 - x1) <= coord_tol:
            x = 0.5 * (x1 + x2)
            ymin, ymax = min(y1, y2), max(y1, y2)
            vertical.append((x, ymin, ymax, seg))
        else:
            others.append(seg)

    merged = []

    horizontal.sort(key=lambda t: (round(t[0], 2), t[1]))
    used = [False] * len(horizontal)
    for i in range(len(horizontal)):
        if used[i]:
            continue
        y, x1, x2, seg = horizontal[i]
        thick = seg['thickness']
        name = seg['name']

        for j in range(i + 1, len(horizontal)):
            if used[j]:
                continue
            y2, xx1, xx2, seg2 = horizontal[j]
            if abs(y2 - y) <= coord_tol and xx1 <= x2 + gap_tol:
                x2 = max(x2, xx2)
                thick = 0.5 * (thick + seg2['thickness'])
                used[j] = True

        merged.append({
            'line': LineString([(x1, y), (x2, y)]),
            'thickness': thick,
            'name': name
        })

    vertical.sort(key=lambda t: (round(t[0], 2), t[1]))
    used = [False] * len(vertical)
    for i in range(len(vertical)):
        if used[i]:
            continue
        x, y1, y2, seg = vertical[i]
        thick = seg['thickness']
        name = seg['name']

        for j in range(i + 1, len(vertical)):
            if used[j]:
                continue
            x2, yy1, yy2, seg2 = vertical[j]
            if abs(x2 - x) <= coord_tol and yy1 <= y2 + gap_tol:
                y2 = max(y2, yy2)
                thick = 0.5 * (thick + seg2['thickness'])
                used[j] = True

        merged.append({
            'line': LineString([(x, y1), (x, y2)]),
            'thickness': thick,
            'name': name
        })

    merged.extend(others)
    return merged

def optimize_wall_centerlines(candidates, iter_count=1, enable_merge_collinear=True):
    if not candidates:
        return []

    segs = candidates[:]

    if enable_merge_collinear:
        segs = merge_collinear_segments_strict(segs, coord_tol=0.08, gap_tol=0.35)

    for _ in range(iter_count):
        if not segs:
            break

        avg_t = sum(s['thickness'] for s in segs) / max(len(segs), 1)
        delta = 0.20 * avg_t
        if delta < 0.03:
            delta = 0.03
        if delta > 0.12:
            delta = 0.12

        segs = merge_close_vertices(segs, delta)
        segs = split_segments_by_near_vertices(segs, delta)

    cleaned = []
    for s in segs:
        try:
            if s['line'] is None or s['line'].is_empty:
                continue
            if s['line'].length < 0.08:
                continue
            cleaned.append(s)
        except:
            continue

    return cleaned

# =========================
# mask 构建与清理
# =========================
def build_global_structure_mask(result, pixelWidth, pixelHeight, logs):
    wall_mask = np.zeros((pixelHeight, pixelWidth), dtype=np.uint8)
    class_counter = {}

    if result.masks is None:
        logs.append("result.masks is None")
        return wall_mask, class_counter

    masks_xy = result.masks.xy
    cls_ids = result.boxes.cls.cpu().numpy().astype(int)
    names = result.names

    logs.append("总mask数量: {}".format(len(masks_xy)))

    expand_kernel = cv2.getStructuringElement(cv2.MORPH_RECT, (5, 5))

    for i, contour_pts in enumerate(masks_xy):
        try:
            if i >= len(cls_ids):
                continue

            class_id = cls_ids[i]
            class_name = names[class_id]
            class_name_norm = normalize_class_name(class_name)

            if not is_structure_wall_like_class(class_name):
                continue

            pts = np.array(contour_pts, dtype=np.int32)
            if len(pts) < 3:
                continue

            pts[:, 0] = np.clip(pts[:, 0], 0, pixelWidth - 1)
            pts[:, 1] = np.clip(pts[:, 1], 0, pixelHeight - 1)

            if class_name_norm in EXPAND_CLASSES:
                temp = np.zeros((pixelHeight, pixelWidth), dtype=np.uint8)
                cv2.fillPoly(temp, [pts], 255)
                temp = cv2.dilate(temp, expand_kernel, iterations=1)
                wall_mask[temp > 0] = 255
            else:
                cv2.fillPoly(wall_mask, [pts], 255)

            class_counter[class_name_norm] = class_counter.get(class_name_norm, 0) + 1

        except Exception as e:
            logs.append("合成结构mask失败 idx={}: {}".format(i, str(e)))
            continue

    logs.append("参与墙体生成的类别统计: {}".format(str(class_counter)))
    return wall_mask, class_counter

def clean_wall_mask(binary_mask, logs):
    mask = binary_mask.copy()

    kernel_bridge = cv2.getStructuringElement(cv2.MORPH_RECT, (3, 3))
    kernel_close_big = cv2.getStructuringElement(cv2.MORPH_RECT, (7, 7))
    kernel_close_small = cv2.getStructuringElement(cv2.MORPH_RECT, (5, 5))

    mask = cv2.dilate(mask, kernel_bridge, iterations=1)
    mask = cv2.morphologyEx(mask, cv2.MORPH_CLOSE, kernel_close_big)
    mask = cv2.morphologyEx(mask, cv2.MORPH_CLOSE, kernel_close_small)
    mask = cv2.erode(mask, kernel_bridge, iterations=1)

    num_labels, labels, stats, _ = cv2.connectedComponentsWithStats(mask, connectivity=8)
    cleaned = np.zeros_like(mask)

    for i in range(1, num_labels):
        area = stats[i, cv2.CC_STAT_AREA]
        if area >= 30:
            cleaned[labels == i] = 255

    logs.append("结构mask清理完成(补缝增强版)")
    return cleaned

def estimate_wall_width_pixels(binary_mask, logs):
    if binary_mask is None or binary_mask.max() == 0:
        logs.append("墙宽估计失败：mask为空")
        return 6.0

    dist = cv2.distanceTransform(binary_mask, cv2.DIST_L2, 5)
    vals = dist[dist > 0]
    if len(vals) == 0:
        logs.append("墙宽估计失败：distanceTransform为空")
        return 6.0

    wall_width_px = max(2.0, 2.0 * np.median(vals))
    logs.append("估计墙宽像素值: {:.2f}".format(wall_width_px))
    return wall_width_px

def skeletonize_wall_mask(binary_mask, logs):
    try:
        from skimage.morphology import skeletonize
        skel = skeletonize(binary_mask > 0)
        logs.append("使用 skimage.skeletonize 成功")
        return skel.astype(np.uint8)
    except Exception as e:
        logs.append("skimage骨架失败，改用fallback: {}".format(str(e)))
        return skeletonize_fallback(binary_mask, logs)

def skeletonize_fallback(binary_mask, logs):
    img = (binary_mask > 0).astype(np.uint8) * 255
    size = np.size(img)
    skel = np.zeros(img.shape, np.uint8)

    element = cv2.getStructuringElement(cv2.MORPH_CROSS, (3, 3))
    done = False

    while not done:
        eroded = cv2.erode(img, element)
        temp = cv2.dilate(eroded, element)
        temp = cv2.subtract(img, temp)
        skel = cv2.bitwise_or(skel, temp)
        img = eroded.copy()

        zeros = size - cv2.countNonZero(img)
        if zeros == size:
            done = True

    logs.append("fallback skeletonize 成功")
    return (skel > 0).astype(np.uint8)

def get_neighbors_8(x, y, w, h):
    nbs = []
    for dy in [-1, 0, 1]:
        for dx in [-1, 0, 1]:
            if dx == 0 and dy == 0:
                continue
            nx = x + dx
            ny = y + dy
            if 0 <= nx < w and 0 <= ny < h:
                nbs.append((nx, ny))
    return nbs

def extract_skeleton_graph(skel, logs):
    h, w = skel.shape
    skel_pts = set()
    for y in range(h):
        xs = np.where(skel[y] > 0)[0]
        for x in xs:
            skel_pts.add((x, y))

    if not skel_pts:
        logs.append("骨架为空")
        return [], []

    degree = {}
    for (x, y) in skel_pts:
        cnt = 0
        for nx, ny in get_neighbors_8(x, y, w, h):
            if (nx, ny) in skel_pts:
                cnt += 1
        degree[(x, y)] = cnt

    nodes = [p for p, d in degree.items() if d != 2]

    if not nodes:
        nodes = list(skel_pts)

    node_set = set(nodes)
    visited_edges = set()
    edges = []

    for node in nodes:
        x0, y0 = node
        for nx, ny in get_neighbors_8(x0, y0, w, h):
            if (nx, ny) not in skel_pts:
                continue

            edge_key = tuple(sorted([node, (nx, ny)]))
            if edge_key in visited_edges:
                continue

            path = [node, (nx, ny)]
            prev = node
            curr = (nx, ny)

            while True:
                visited_edges.add(tuple(sorted([prev, curr])))

                if curr in node_set and curr != node:
                    break

                nbrs = []
                for tx, ty in get_neighbors_8(curr[0], curr[1], w, h):
                    if (tx, ty) in skel_pts and (tx, ty) != prev:
                        nbrs.append((tx, ty))

                if len(nbrs) == 0:
                    break
                if len(nbrs) > 1:
                    break

                nxt = nbrs[0]
                path.append(nxt)
                prev = curr
                curr = nxt

            if len(path) >= 2:
                edges.append(path)

    logs.append("骨架图提取完成: nodes={}, edges={}".format(len(nodes), len(edges)))
    return nodes, edges

def split_path_by_direction(path, turn_threshold=2):
    if not path or len(path) < 3:
        return [path] if path else []

    segments = []
    current = [path[0], path[1]]

    def major_dir(p1, p2):
        dx = p2[0] - p1[0]
        dy = p2[1] - p1[1]
        if abs(dx) >= abs(dy):
            return "h"
        else:
            return "v"

    prev_dir = major_dir(path[0], path[1])

    for i in range(2, len(path)):
        d = major_dir(path[i-1], path[i])

        if d == prev_dir:
            current.append(path[i])
        else:
            if len(current) <= turn_threshold and segments:
                segments[-1].extend(current[1:])
                current = [segments[-1][-1], path[i]]
            else:
                segments.append(current)
                current = [path[i-1], path[i]]
            prev_dir = d

    if current:
        if len(current) <= turn_threshold and segments:
            segments[-1].extend(current[1:])
        else:
            segments.append(current)

    cleaned = []
    for seg in segments:
        if seg and len(seg) >= 2:
            cleaned.append(seg)

    return cleaned

def fit_axis_line_from_mask(sub_path, wall_mask, pixelWidth, pixelHeight, min_len_px=8):
    if not sub_path or len(sub_path) < 2:
        return None

    xs = [p[0] for p in sub_path]
    ys = [p[1] for p in sub_path]

    x_min = max(0, int(min(xs)))
    x_max = min(pixelWidth - 1, int(max(xs)))
    y_min = max(0, int(min(ys)))
    y_max = min(pixelHeight - 1, int(max(ys)))

    dx = x_max - x_min
    dy = y_max - y_min

    if dx >= dy:
        mids = []
        for x in range(x_min, x_max + 1):
            ys_in = np.where(wall_mask[:, x] > 0)[0]
            ys_local = ys_in[(ys_in >= y_min - 8) & (ys_in <= y_max + 8)]
            if len(ys_local) >= 2:
                y_top = np.min(ys_local)
                y_bot = np.max(ys_local)
                y_mid = 0.5 * (y_top + y_bot)
                mids.append((x, y_mid))

        if len(mids) < 2:
            return None

        xs2 = [p[0] for p in mids]
        ys2 = [p[1] for p in mids]

        x1 = min(xs2)
        x2 = max(xs2)
        y = float(np.median(ys2))

        if (x2 - x1) < min_len_px:
            return None

        return ((x1, y), (x2, y), "h")

    else:
        mids = []
        for y in range(y_min, y_max + 1):
            xs_in = np.where(wall_mask[y, :] > 0)[0]
            xs_local = xs_in[(xs_in >= x_min - 8) & (xs_in <= x_max + 8)]
            if len(xs_local) >= 2:
                x_left = np.min(xs_local)
                x_right = np.max(xs_local)
                x_mid = 0.5 * (x_left + x_right)
                mids.append((x_mid, y))

        if len(mids) < 2:
            return None

        xs2 = [p[0] for p in mids]
        ys2 = [p[1] for p in mids]

        y1 = min(ys2)
        y2 = max(ys2)
        x = float(np.median(xs2))

        if (y2 - y1) < min_len_px:
            return None

        return ((x, y1), (x, y2), "v")

def pixel_line_to_revit_linestring(p1, p2):
    rp1 = pix_to_revit(p1[0], p1[1])
    rp2 = pix_to_revit(p2[0], p2[1])
    if rp1.DistanceTo(rp2) < 0.1:
        return None
    return LineString([(rp1.X, rp1.Y), (rp2.X, rp2.Y)])

def simplify_path_to_axis_lines(path, wall_mask, pixelWidth, pixelHeight, logs, min_len_px=8):
    result_lines = []

    sub_paths = split_path_by_direction(path, turn_threshold=2)
    for sub in sub_paths:
        try:
            fitted = fit_axis_line_from_mask(
                sub, wall_mask, pixelWidth, pixelHeight, min_len_px=min_len_px
            )
            if fitted is None:
                continue

            p1, p2, ori = fitted
            line_geom = pixel_line_to_revit_linestring(p1, p2)
            if line_geom is None:
                continue

            if line_geom.length < 0.08:
                continue

            result_lines.append(line_geom)

        except Exception as e:
            logs.append("子段拟合失败: {}".format(str(e)))
            continue

    return result_lines

def extract_wall_centerlines_from_global_mask(result, pixelWidth, pixelHeight, logs):
    wall_mask, class_counter = build_global_structure_mask(result, pixelWidth, pixelHeight, logs)
    if wall_mask.max() == 0:
        logs.append("没有结构类mask被写入全局墙图")
        return [], 0.3, class_counter, wall_mask

    cleaned_mask = clean_wall_mask(wall_mask, logs)
    wall_width_px = estimate_wall_width_pixels(cleaned_mask, logs)

    skel = skeletonize_wall_mask(cleaned_mask, logs)
    nodes, edges = extract_skeleton_graph(skel, logs)

    if not edges:
        logs.append("骨架没有边")
        wall_width_ft = wall_width_px * (scale_x_ft_per_px_global if scale_x_ft_per_px_global else scaleX)
        return [], wall_width_ft, class_counter, cleaned_mask

    wall_width_ft = wall_width_px * (scale_x_ft_per_px_global if scale_x_ft_per_px_global else scaleX)
    candidates = []

    for idx, path in enumerate(edges):
        try:
            line_list = simplify_path_to_axis_lines(
                path, cleaned_mask, pixelWidth, pixelHeight, logs,
                min_len_px=max(3, int(wall_width_px * 0.5))
            )

            for line_geom in line_list:
                candidates.append({
                    'line': line_geom,
                    'thickness': wall_width_ft,
                    'name': "Wall"
                })

        except Exception as e:
            logs.append("路径{}转中心线失败: {}".format(idx, str(e)))
            continue

    logs.append("全局提取中心线候选数量: {}".format(len(candidates)))
    return candidates, wall_width_ft, class_counter, cleaned_mask

# =========================
# 第二版增强：几何补缝与对齐
# =========================
def bridge_near_orthogonal_gaps(segments, gap_tol=0.6, axis_tol=0.25):
    if not segments:
        return segments

    segs = copy_segments(segments)

    for i in range(len(segs)):
        for j in range(i + 1, len(segs)):
            si = segs[i]
            sj = segs[j]
            if si is None or sj is None:
                continue

            oi = get_line_orientation(si)
            oj = get_line_orientation(sj)

            if oi == oj:
                continue

            if oi == "v" and oj == "h":
                tmp = si
                si = sj
                sj = tmp
                idx_h = j
                idx_v = i
            else:
                idx_h = i
                idx_v = j

            coords_h = list(si['line'].coords)
            coords_v = list(sj['line'].coords)

            hx1, hy1 = coords_h[0]
            hx2, hy2 = coords_h[-1]
            vx1, vy1 = coords_v[0]
            vx2, vy2 = coords_v[-1]

            y_h = 0.5 * (hy1 + hy2)
            x_v = 0.5 * (vx1 + vx2)

            hminx, hmaxx = min(hx1, hx2), max(hx1, hx2)
            vminy, vmaxy = min(vy1, vy2), max(vy1, vy2)

            inter_pt = (x_v, y_h)

            h_endpts = [(hx1, hy1), (hx2, hy2)]
            v_endpts = [(vx1, vy1), (vx2, vy2)]

            h_dists = [((p[0]-inter_pt[0])**2 + (p[1]-inter_pt[1])**2)**0.5 for p in h_endpts]
            v_dists = [((p[0]-inter_pt[0])**2 + (p[1]-inter_pt[1])**2)**0.5 for p in v_endpts]

            h_min_idx = int(np.argmin(h_dists))
            v_min_idx = int(np.argmin(v_dists))

            h_min_dist = h_dists[h_min_idx]
            v_min_dist = v_dists[v_min_idx]

            cond_h = (x_v >= hminx - axis_tol and x_v <= hmaxx + gap_tol)
            cond_v = (y_h >= vminy - axis_tol and y_h <= vmaxy + gap_tol)

            if h_min_dist <= gap_tol and v_min_dist <= gap_tol and cond_h and cond_v:
                other_h = h_endpts[1 - h_min_idx]
                other_v = v_endpts[1 - v_min_idx]

                new_h = snap_line_to_axis(LineString([other_h, inter_pt]))
                new_v = snap_line_to_axis(LineString([other_v, inter_pt]))

                if new_h is not None and new_h.length >= 0.08:
                    segs[idx_h]['line'] = new_h
                if new_v is not None and new_v.length >= 0.08:
                    segs[idx_v]['line'] = new_v

    cleaned = []
    for s in segs:
        try:
            if s['line'] is None or s['line'].is_empty:
                continue
            if s['line'].length < 0.08:
                continue
            cleaned.append(s)
        except:
            continue
    return cleaned

def align_parallel_segments(segments, coord_tol=0.35):
    """
    将接近共线的水平段/竖直段拉齐到同一坐标轴
    水平：对齐 y
    竖直：对齐 x
    """
    if not segments:
        return segments

    segs = copy_segments(segments)

    horizontal_groups = []
    vertical_groups = []

    for idx, s in enumerate(segs):
        coords = list(s['line'].coords)
        x1, y1 = coords[0]
        x2, y2 = coords[-1]
        ori = get_line_orientation(s)

        if ori == "h":
            y = 0.5 * (y1 + y2)
            added = False
            for g in horizontal_groups:
                if abs(g['coord'] - y) <= coord_tol:
                    g['indices'].append(idx)
                    g['values'].append(y)
                    g['coord'] = float(np.median(g['values']))
                    added = True
                    break
            if not added:
                horizontal_groups.append({
                    'coord': y,
                    'indices': [idx],
                    'values': [y]
                })
        else:
            x = 0.5 * (x1 + x2)
            added = False
            for g in vertical_groups:
                if abs(g['coord'] - x) <= coord_tol:
                    g['indices'].append(idx)
                    g['values'].append(x)
                    g['coord'] = float(np.median(g['values']))
                    added = True
                    break
            if not added:
                vertical_groups.append({
                    'coord': x,
                    'indices': [idx],
                    'values': [x]
                })

    for g in horizontal_groups:
        target_y = g['coord']
        for idx in g['indices']:
            coords = list(segs[idx]['line'].coords)
            x1, y1 = coords[0]
            x2, y2 = coords[-1]
            segs[idx]['line'] = LineString([(x1, target_y), (x2, target_y)])

    for g in vertical_groups:
        target_x = g['coord']
        for idx in g['indices']:
            coords = list(segs[idx]['line'].coords)
            x1, y1 = coords[0]
            x2, y2 = coords[-1]
            segs[idx]['line'] = LineString([(target_x, y1), (target_x, y2)])

    return segs

def bridge_parallel_gaps(segments, coord_tol=0.25, gap_tol=0.8):
    """
    平行且接近共线的短缝桥接
    - 水平对水平：y接近，x方向中间差一小截 -> 合并成一条
    - 竖直对竖直：x接近，y方向中间差一小截 -> 合并成一条
    """
    if not segments:
        return segments

    segs = copy_segments(segments)
    used = [False] * len(segs)
    result = []

    # 先水平
    horiz = []
    vert = []
    other = []

    for idx, s in enumerate(segs):
        ori = get_line_orientation(s)
        coords = list(s['line'].coords)
        x1, y1 = coords[0]
        x2, y2 = coords[-1]

        if ori == "h":
            y = 0.5 * (y1 + y2)
            xmin = min(x1, x2)
            xmax = max(x1, x2)
            horiz.append((idx, y, xmin, xmax, s))
        else:
            x = 0.5 * (x1 + x2)
            ymin = min(y1, y2)
            ymax = max(y1, y2)
            vert.append((idx, x, ymin, ymax, s))

    horiz.sort(key=lambda t: (round(t[1], 3), t[2]))
    consumed = set()
    for i in range(len(horiz)):
        if i in consumed:
            continue
        idx_i, y_i, x1_i, x2_i, seg_i = horiz[i]
        cur_y = y_i
        cur_x1 = x1_i
        cur_x2 = x2_i
        cur_thick = seg_i['thickness']
        cur_name = seg_i['name']

        for j in range(i + 1, len(horiz)):
            if j in consumed:
                continue
            idx_j, y_j, x1_j, x2_j, seg_j = horiz[j]

            if abs(y_j - cur_y) <= coord_tol:
                gap = x1_j - cur_x2
                overlap = min(cur_x2, x2_j) - max(cur_x1, x1_j)
                if gap <= gap_tol or overlap >= -coord_tol:
                    cur_x1 = min(cur_x1, x1_j)
                    cur_x2 = max(cur_x2, x2_j)
                    cur_y = float(np.median([cur_y, y_j]))
                    cur_thick = 0.5 * (cur_thick + seg_j['thickness'])
                    consumed.add(j)

        result.append({
            'line': LineString([(cur_x1, cur_y), (cur_x2, cur_y)]),
            'thickness': cur_thick,
            'name': cur_name
        })

    vert.sort(key=lambda t: (round(t[1], 3), t[2]))
    consumed = set()
    for i in range(len(vert)):
        if i in consumed:
            continue
        idx_i, x_i, y1_i, y2_i, seg_i = vert[i]
        cur_x = x_i
        cur_y1 = y1_i
        cur_y2 = y2_i
        cur_thick = seg_i['thickness']
        cur_name = seg_i['name']

        for j in range(i + 1, len(vert)):
            if j in consumed:
                continue
            idx_j, x_j, y1_j, y2_j, seg_j = vert[j]

            if abs(x_j - cur_x) <= coord_tol:
                gap = y1_j - cur_y2
                overlap = min(cur_y2, y2_j) - max(cur_y1, y1_j)
                if gap <= gap_tol or overlap >= -coord_tol:
                    cur_y1 = min(cur_y1, y1_j)
                    cur_y2 = max(cur_y2, y2_j)
                    cur_x = float(np.median([cur_x, x_j]))
                    cur_thick = 0.5 * (cur_thick + seg_j['thickness'])
                    consumed.add(j)

        result.append({
            'line': LineString([(cur_x, cur_y1), (cur_x, cur_y2)]),
            'thickness': cur_thick,
            'name': cur_name
        })

    return result

def snap_near_endpoints(segments, snap_tol=0.25):
    """
    对近距离端点做统一吸附
    """
    if not segments:
        return segments

    pts = []
    for idx, seg in enumerate(segments):
        coords = list(seg['line'].coords)
        pts.append((idx, 0, coords[0]))
        pts.append((idx, 1, coords[-1]))

    clusters = []
    for item in pts:
        idx, end_flag, p = item
        assigned = False
        for c in clusters:
            cx, cy = c['center']
            if ((p[0]-cx)**2 + (p[1]-cy)**2)**0.5 <= snap_tol:
                c['items'].append(item)
                xs = [it[2][0] for it in c['items']]
                ys = [it[2][1] for it in c['items']]
                c['center'] = (float(np.mean(xs)), float(np.mean(ys)))
                assigned = True
                break
        if not assigned:
            clusters.append({
                'center': (p[0], p[1]),
                'items': [item]
            })

    segs = copy_segments(segments)

    for c in clusters:
        center = c['center']
        for idx, end_flag, p in c['items']:
            coords = list(segs[idx]['line'].coords)
            if end_flag == 0:
                new_line = LineString([center, coords[-1]])
            else:
                new_line = LineString([coords[0], center])

            new_line = snap_line_to_axis(new_line)
            if new_line is not None and new_line.length >= 0.08:
                segs[idx]['line'] = new_line

    return segs

def clean_duplicate_segments(segments, coord_tol=0.05):
    if not segments:
        return segments

    uniq = []
    keys = set()

    for s in segments:
        try:
            coords = list(s['line'].coords)
            x1, y1 = coords[0]
            x2, y2 = coords[-1]

            p1 = (round(x1 / coord_tol), round(y1 / coord_tol))
            p2 = (round(x2 / coord_tol), round(y2 / coord_tol))
            key = tuple(sorted([p1, p2]))

            if key in keys:
                continue
            keys.add(key)
            uniq.append(s)
        except:
            continue

    return uniq

def run_geometry_enhancement_v2(segments, logs):
    if not segments:
        return segments

    segs = copy_segments(segments)
    logs.append("V2增强-输入墙段数: {}".format(len(segs)))

    segs = align_parallel_segments(segs, coord_tol=0.35)
    logs.append("V2增强-平行对齐后: {}".format(len(segs)))

    segs = bridge_parallel_gaps(segs, coord_tol=0.25, gap_tol=0.8)
    logs.append("V2增强-平行短缝桥接后: {}".format(len(segs)))

    segs = bridge_near_orthogonal_gaps(segs, gap_tol=0.6, axis_tol=0.25)
    logs.append("V2增强-正交补缝后: {}".format(len(segs)))

    segs = snap_near_endpoints(segs, snap_tol=0.25)
    logs.append("V2增强-端点吸附后: {}".format(len(segs)))

    segs = merge_collinear_segments_strict(segs, coord_tol=0.08, gap_tol=0.35)
    logs.append("V2增强-严格共线合并后: {}".format(len(segs)))

    segs = clean_duplicate_segments(segs, coord_tol=0.05)
    logs.append("V2增强-去重后: {}".format(len(segs)))

    cleaned = []
    for s in segs:
        try:
            if s['line'] is None or s['line'].is_empty:
                continue
            if s['line'].length < 0.08:
                continue
            cleaned.append(s)
        except:
            continue

    logs.append("V2增强-最终墙段数: {}".format(len(cleaned)))
    return cleaned

# =========================
# 运行YOLO分割
# =========================
yolo_seg = YOLO(dect_Model, task="seg")
seg_result = yolo_seg(source=pixpath, save=False, conf=0.3, iou=0.45, imgsz=640)
cv2.imwrite(newpath, seg_result[0].plot())

result = seg_result[0]
boxes = result.boxes
xyxy = boxes.xyxy.cpu().numpy() if boxes is not None else np.empty((0,4))
cls_ids = boxes.cls.cpu().numpy().astype(int) if boxes is not None else np.array([], dtype=int)
names = result.names

# =========================
# 读取OCR尺寸JSON
# =========================
dims_data = None
horizontal_length_mm = None
vertical_length_mm = None

try:
    with open(dims_json_path, "r", encoding="utf-8") as f:
        dims_data = json.load(f)

    if dims_data.get("ok", False):
        if "result" in dims_data:
            horizontal_length_mm = dims_data["result"].get("horizontal_length", None)
            vertical_length_mm = dims_data["result"].get("vertical_length", None)
        else:
            horizontal_length_mm = dims_data.get("horizontal_length", None)
            vertical_length_mm = dims_data.get("vertical_length", None)

    logs.append("读取dims_json成功: horizontal={} mm, vertical={} mm".format(
        str(horizontal_length_mm), str(vertical_length_mm)
    ))
except Exception as e:
    logs.append("读取dims_json失败: {}".format(str(e)))

# =========================
# 先做结构mask -> bbox -> scale
# =========================
global_structure_mask, structure_class_counter = build_global_structure_mask(result, pixelWidth, pixelHeight, logs)
cleaned_global_structure_mask = clean_wall_mask(global_structure_mask, logs)
bbox_info = get_mask_bbox(cleaned_global_structure_mask, logs)

scale_x_mm_per_px = None
scale_y_mm_per_px = None
scale_avg_mm_per_px = None
scale_x_ft_per_px = None
scale_y_ft_per_px = None
scale_avg_ft_per_px = None

if bbox_info is not None and horizontal_length_mm is not None and vertical_length_mm is not None:
    try:
        bbox_w = bbox_info["width"]
        bbox_h = bbox_info["height"]

        if bbox_w > 0 and bbox_h > 0:
            scale_x_mm_per_px = float(horizontal_length_mm) / float(bbox_w)
            scale_y_mm_per_px = float(vertical_length_mm) / float(bbox_h)
            scale_avg_mm_per_px = (scale_x_mm_per_px + scale_y_mm_per_px) / 2.0

            mm_to_ft = 1.0 / 304.8
            scale_x_ft_per_px = scale_x_mm_per_px * mm_to_ft
            scale_y_ft_per_px = scale_y_mm_per_px * mm_to_ft
            scale_avg_ft_per_px = scale_avg_mm_per_px * mm_to_ft

            bbox_info_global = bbox_info
            scale_x_ft_per_px_global = scale_x_ft_per_px
            scale_y_ft_per_px_global = scale_y_ft_per_px

            logs.append("scale_x_mm_per_px={:.6f}".format(scale_x_mm_per_px))
            logs.append("scale_y_mm_per_px={:.6f}".format(scale_y_mm_per_px))
            logs.append("scale_avg_mm_per_px={:.6f}".format(scale_avg_mm_per_px))
            logs.append("scale_x_ft_per_px={:.6f}".format(scale_x_ft_per_px))
            logs.append("scale_y_ft_per_px={:.6f}".format(scale_y_ft_per_px))
        else:
            logs.append("bbox宽高无效，无法计算scale")
    except Exception as e:
        logs.append("scale计算失败: {}".format(str(e)))
else:
    logs.append("bbox或真实尺寸缺失，使用fallback整图scale")

# =========================
# Revit文档对象
# =========================
doc = DocumentManager.Instance.CurrentDBDocument
app = doc.Application

wall_type = None
wall_type_collector = FilteredElementCollector(doc).OfClass(WallType)

for wt in wall_type_collector:
    if wt.Kind == WallKind.Basic:
        name_param = wt.get_Parameter(BuiltInParameter.SYMBOL_NAME_PARAM)
        if name_param and name_param.AsString() == TARGET_WALL_TYPE_NAME:
            wall_type = wt
            break

if wall_type is None:
    for wt in wall_type_collector:
        if wt.Kind == WallKind.Basic:
            wall_type = wt
            break

if wall_type is None:
    raise Exception("项目中找不到任何基本墙类型！")

level = None
level_collector = FilteredElementCollector(doc).OfClass(Level)
for lvl in level_collector:
    name_param = lvl.get_Parameter(BuiltInParameter.LEVEL_NAME)
    if name_param and name_param.AsString() == TARGET_LEVEL_NAME:
        level = lvl
        break

if level is None:
    level = level_collector.FirstElement()
    if level is None:
        raise Exception("项目中找不到任何标高！")

TransactionManager.Instance.EnsureInTransaction(doc)

created_walls = []
wall_candidates = []

wallHeight = height

plane = Plane.CreateByNormalAndOrigin(XYZ.BasisZ, origin)
sketch_plane = SketchPlane.Create(doc, plane)

# =========================
# 提取中心线并创建墙
# =========================
if result.masks is not None:
    logs.append("YOLO类别映射: {}".format(str(result.names)))

    wall_candidates, default_wall_thickness, used_class_counter, final_mask_used = extract_wall_centerlines_from_global_mask(
        result, pixelWidth, pixelHeight, logs
    )

    logs.append("初始墙候选数量: {}".format(len(wall_candidates)))

    optimized_walls = optimize_wall_centerlines(
        wall_candidates,
        iter_count=1,
        enable_merge_collinear=False
    )

    logs.append("初步优化后墙数量: {}".format(len(optimized_walls)))

    # 第二版增强
    optimized_walls = run_geometry_enhancement_v2(optimized_walls, logs)

    for idx, w in enumerate(optimized_walls):
        try:
            line_geom = w['line']
            thickness_val = w['thickness']
            name = "Wall"

            coords = list(line_geom.coords)
            if len(coords) < 2:
                logs.append("墙{}失败：coords不足".format(idx))
                continue

            start_pt = XYZ(coords[0][0], coords[0][1], 0)
            end_pt = XYZ(coords[-1][0], coords[-1][1], 0)

            if start_pt.DistanceTo(end_pt) < 0.1:
                logs.append("墙{}失败：线太短".format(idx))
                continue

            revit_line = Line.CreateBound(start_pt, end_pt)

            logs.append("准备创建墙{}: len={:.3f}, thickness={:.3f}".format(
                idx, revit_line.Length, thickness_val
            ))

            wall = Wall.Create(doc, revit_line, wall_type.Id, level.Id, wallHeight, 0, False, False)

            try:
                param = wall.get_Parameter(BuiltInParameter.WALL_ATTR_WIDTH_PARAM)
                if param and not param.IsReadOnly:
                    param.Set(thickness_val)
            except Exception as e2:
                logs.append("墙{}宽度设置失败(可忽略): {}".format(idx, str(e2)))

            try:
                wall.Name = sanitize_name(name)
            except:
                pass

            created_walls.append(wall.ToDSType(True))
            logs.append("墙{}创建成功".format(idx))

        except Exception as e:
            logs.append("墙{}创建失败: {}".format(idx, str(e)))
            logs.append(traceback.format_exc())
            continue
else:
    logs.append("result.masks is None，没有分割mask")

# =========================
# 提交事务
# =========================
TransactionManager.Instance.TransactionTaskDone()
doc.Regenerate()

# =========================
# 写 seg_meta_json
# =========================
seg_meta = {
    "ok": True,
    "image_path": pixpath,
    "seg_vis_path": newpath,
    "dims_json_path": dims_json_path,
    "wall_bbox_px": bbox_info,
    "real_size_mm": {
        "horizontal_length": horizontal_length_mm,
        "vertical_length": vertical_length_mm
    },
    "scale": {
        "scale_x_mm_per_px": scale_x_mm_per_px,
        "scale_y_mm_per_px": scale_y_mm_per_px,
        "scale_avg_mm_per_px": scale_avg_mm_per_px,
        "scale_x_ft_per_px": scale_x_ft_per_px,
        "scale_y_ft_per_px": scale_y_ft_per_px,
        "scale_avg_ft_per_px": scale_avg_ft_per_px
    },
    "structure_mask_classes_used": structure_class_counter,
    "debug": {
        "pixelWidth": pixelWidth,
        "pixelHeight": pixelHeight,
        "wall_count": len(created_walls),
        "mask_count": len(result.masks.xy) if result.masks is not None else 0,
        "class_names": result.names,
        "log_count": len(logs)
    }
}

try:
    ensure_dir_of_file(seg_meta_json_path)
    with open(seg_meta_json_path, "w", encoding="utf-8") as f:
        json.dump(seg_meta, f, ensure_ascii=False, indent=2)
    logs.append("seg_meta_json已写出: {}".format(seg_meta_json_path))
except Exception as e:
    logs.append("seg_meta_json写出失败: {}".format(str(e)))

OUT = newpath, created_walls, seg_meta_json_path, logs
# ----------------------------------------
python_version_5 = Watch(python_script_5)  # graph output
python_version_6 = CodeBlock(i=python_version_5) { i[2]; }
python_version_7 = Watch(python_version_6)  # graph output
python_script_6 = Python(IN[0]=modelpath, IN[1]=imagepath_2, IN[2]=scale, IN[3]=python_version_7)  # CPython3
# ---------- python_script_6.python (539 lines) ----------
# 加载 PythonStandard 和 DesignScript 库
#----------------------
import sys
import clr
clr.AddReference('ProtoGeometry')
from Autodesk.DesignScript.Geometry import *
import Autodesk.DesignScript.Geometry as DS
import Revit
from Revit.Elements import *
import System
sys.path.append("C:/Users/Lenovo/anaconda3/envs/revitenv/Lib/site-packages")
clr.AddReference('RevitAPI')
clr.AddReference('RevitAPIUI')
from Autodesk.Revit.DB import *
from Autodesk.Revit.UI import *

clr.AddReference('RevitServices')
from RevitServices.Persistence import DocumentManager
from RevitServices.Transactions import TransactionManager

clr.AddReference('RevitNodes')
import Revit
clr.ImportExtensions(Revit.Elements)
clr.ImportExtensions(Revit.GeometryConversion)

import re
import json
import os
import numpy as np
import torch
import cv2
from ultralytics import YOLO

dataEnteringNode = IN 

# =========================
# 输入
# =========================
dect_Model = IN[0]
pixpath = IN[1]
scale = IN[2]              # fallback
seg_meta_json_path = IN[3] # 读取分割得到的缩放与bbox信息

# =========================
# 参数
# =========================
origin = XYZ(0, 0, 0)   
widthFt = scale
pixelWidth = 1600   
pixelHeight = 1200

newpath = "E:/yanjiu/revitss/tests/jjianzhu_dect.jpg"

# fallback比例
scaleX = widthFt / pixelWidth if pixelWidth > 0 else 0.0
scaleY = widthFt * (pixelHeight / pixelWidth) / pixelHeight if pixelWidth > 0 and pixelHeight > 0 else 0.0

# seg_meta读取到的参数
bbox_info = None
bbox_min_x = None
bbox_min_y = None
bbox_width = None
bbox_height = None
scale_x_ft_per_px = None
scale_y_ft_per_px = None

logs = []

# =========================
# 窗参数
# =========================
TARGET_WINDOW_FAMILY_NAME = "Window_test"   # 窗族名
TARGET_WINDOW_CLASS_NAME = "window"         # 检测类别名，统一转小写判断

DEFAULT_WINDOW_HEIGHT_MM = 1500.0           # 固定窗高
DEFAULT_SILL_HEIGHT_MM = 900.0              # 底高度
WINDOW_SHRINK_EACH_SIDE_MM = 120.0          # 每端向内收120mm
MIN_WINDOW_WIDTH_MM = 300.0                 # 最小窗宽，避免过小

# =========================
# 双开门参数
# =========================
TARGET_DOOR_FAMILY_NAME = "TwoSideDoor"     # 双开门族名
TARGET_DOOR_CLASS_NAME = "twosidedoor"      # 检测bbox类别名，代码里统一lower，所以这里写小写

DOOR_SHRINK_EACH_SIDE_MM = 100.0            # 双开门两边各向内收100mm左右
MIN_DOOR_WIDTH_MM = 500.0                   # 最小门宽，避免过小

MM_TO_FT = 1.0 / 304.8

# =========================
# 工具函数
# =========================
def sanitize_name(name):
    if not name:
        return "Unknown"
    cleaned = re.sub(r'[\x00-\x1f\x7f]', '', str(name))
    if not cleaned.strip():
        return "Unnamed"
    return cleaned

def mm_to_ft(mm):
    return float(mm) * MM_TO_FT

def load_seg_meta(seg_meta_json_path, logs):
    if seg_meta_json_path is None:
        logs.append("seg_meta_json_path为空")
        return None

    try:
        with open(seg_meta_json_path, "r", encoding="utf-8") as f:
            data = json.load(f)
        logs.append("读取seg_meta_json成功: {}".format(seg_meta_json_path))
        return data
    except Exception as e:
        logs.append("读取seg_meta_json失败: {}".format(str(e)))
        return None

def pix_to_revit(x, y):
    global bbox_min_x, bbox_min_y, bbox_width, bbox_height
    global scale_x_ft_per_px, scale_y_ft_per_px
    global origin, scaleX, scaleY, pixelHeight

    try:
        if bbox_min_x is not None and bbox_min_y is not None and bbox_height is not None \
           and scale_x_ft_per_px is not None and scale_y_ft_per_px is not None:

            local_x = x - bbox_min_x
            local_y = y - bbox_min_y

            revit_x = origin.X + local_x * scale_x_ft_per_px
            revit_y = origin.Y + (bbox_height - local_y) * scale_y_ft_per_px
            return XYZ(revit_x, revit_y, origin.Z)
    except:
        pass

    revit_x = origin.X + x * scaleX
    revit_y = origin.Y + (pixelHeight - y) * scaleY
    return XYZ(revit_x, revit_y, origin.Z)

def get_px_to_ft_x():
    global scale_x_ft_per_px, scaleX
    return scale_x_ft_per_px if scale_x_ft_per_px is not None else scaleX

def get_px_to_ft_y():
    global scale_y_ft_per_px, scaleY
    return scale_y_ft_per_px if scale_y_ft_per_px is not None else scaleY

def get_wall_curve(wall):
    try:
        loc = wall.Location
        if loc and hasattr(loc, "Curve"):
            return loc.Curve
    except:
        pass
    return None

def point_to_curve_distance_2d(pt, curve):
    try:
        proj = curve.Project(pt)
        if proj:
            q = proj.XYZPoint
            dx = pt.X - q.X
            dy = pt.Y - q.Y
            return (dx * dx + dy * dy) ** 0.5, q
    except:
        pass
    return None, None

def get_wall_orientation(curve):
    p0 = curve.GetEndPoint(0)
    p1 = curve.GetEndPoint(1)
    dx = abs(p1.X - p0.X)
    dy = abs(p1.Y - p0.Y)
    if dx >= dy:
        return "h"
    else:
        return "v"

def get_nearest_wall(doc, pt, max_dist_ft=3.0):
    nearest_wall = None
    nearest_curve = None
    nearest_proj_pt = None
    best_dist = 1e18

    walls = FilteredElementCollector(doc).OfClass(Wall).ToElements()
    for wall in walls:
        try:
            curve = get_wall_curve(wall)
            if curve is None:
                continue

            dist, proj_pt = point_to_curve_distance_2d(pt, curve)
            if dist is None:
                continue

            if dist < best_dist and dist <= max_dist_ft:
                best_dist = dist
                nearest_wall = wall
                nearest_curve = curve
                nearest_proj_pt = proj_pt

        except:
            continue

    return nearest_wall, nearest_curve, nearest_proj_pt, best_dist

def get_window_symbol(doc, family_name):
    collector = FilteredElementCollector(doc).OfClass(FamilySymbol).OfCategory(BuiltInCategory.OST_Windows)
    for sym in collector:
        try:
            fam = sym.Family
            if fam and fam.Name == family_name:
                return sym
        except:
            continue
    return None

def get_door_symbol(doc, family_name):
    collector = FilteredElementCollector(doc).OfClass(FamilySymbol).OfCategory(BuiltInCategory.OST_Doors)
    for sym in collector:
        try:
            fam = sym.Family
            if fam and fam.Name == family_name:
                return sym
        except:
            continue
    return None

def set_param_if_exists(elem, param_name, value, logs, label):
    try:
        p = elem.LookupParameter(param_name)
        if p and (not p.IsReadOnly):
            p.Set(value)
            logs.append("{} 参数设置成功: {}={:.4f}".format(label, param_name, value))
            return True
        else:
            logs.append("{} 参数不存在或只读: {}".format(label, param_name))
    except Exception as e:
        logs.append("{} 参数设置失败: {} -> {}".format(label, param_name, str(e)))
    return False

def create_debug_bbox(doc, sketch_plane, pt1, pt2, pt3, pt4):
    lines = [
        Line.CreateBound(pt1, pt2),
        Line.CreateBound(pt2, pt3),
        Line.CreateBound(pt3, pt4),
        Line.CreateBound(pt4, pt1)
    ]
    created = []
    for line in lines:
        try:
            mc = doc.Create.NewModelCurve(line, sketch_plane)
            created.append(mc)
        except:
            pass
    return created

def calc_bbox_length_along_wall_mm(x1, y1, x2, y2, wall_ori):
    """
    根据墙方向计算检测框沿墙方向的真实长度，单位mm。
    h墙：取bbox水平像素宽度
    v墙：取bbox竖向像素高度
    """
    bbox_w_px = abs(x2 - x1)
    bbox_h_px = abs(y2 - y1)

    if wall_ori == "h":
        raw_width_ft = bbox_w_px * get_px_to_ft_x()
    else:
        raw_width_ft = bbox_h_px * get_px_to_ft_y()

    return raw_width_ft * 304.8

# =========================
# 读取seg_meta
# =========================
seg_meta = load_seg_meta(seg_meta_json_path, logs)

if seg_meta and seg_meta.get("ok", False):
    try:
        bbox_info = seg_meta.get("wall_bbox_px", None)
        scale_info = seg_meta.get("scale", {})

        if bbox_info:
            bbox_min_x = bbox_info.get("min_x", None)
            bbox_min_y = bbox_info.get("min_y", None)
            bbox_width = bbox_info.get("width", None)
            bbox_height = bbox_info.get("height", None)

        scale_x_ft_per_px = scale_info.get("scale_x_ft_per_px", None)
        scale_y_ft_per_px = scale_info.get("scale_y_ft_per_px", None)

        dbg = seg_meta.get("debug", {})
        if "pixelWidth" in dbg and "pixelHeight" in dbg:
            pixelWidth = dbg.get("pixelWidth", pixelWidth)
            pixelHeight = dbg.get("pixelHeight", pixelHeight)

        logs.append("bbox_info={}".format(str(bbox_info)))
        logs.append("scale_x_ft_per_px={}".format(str(scale_x_ft_per_px)))
        logs.append("scale_y_ft_per_px={}".format(str(scale_y_ft_per_px)))
        logs.append("pixelWidth={}, pixelHeight={}".format(pixelWidth, pixelHeight))
    except Exception as e:
        logs.append("解析seg_meta失败: {}".format(str(e)))
else:
    logs.append("seg_meta无效，使用fallback整图scale")

# =========================
# 运行YOLO检测
# =========================
yolo_dect = YOLO(dect_Model, task="detect")
dect_result = yolo_dect(source=pixpath, save=False, conf=0.3, iou=0.45, imgsz=640)
cv2.imwrite(newpath, dect_result[0].plot())

result = dect_result[0]
boxes = result.boxes
xyxy = boxes.xyxy.cpu().numpy() if boxes is not None else np.empty((0, 4))
cls_ids = boxes.cls.cpu().numpy().astype(int) if boxes is not None else np.array([], dtype=int)
names = result.names

logs.append("检测框数量: {}".format(len(xyxy)))
logs.append("类别映射: {}".format(str(names)))

# =========================
# Revit文档对象
# =========================
doc = DocumentManager.Instance.CurrentDBDocument
app = doc.Application
TransactionManager.Instance.EnsureInTransaction(doc)

created_lines = []
created_windows = []
created_doors = []

plane = Plane.CreateByNormalAndOrigin(XYZ.BasisZ, origin)
sketch_plane = SketchPlane.Create(doc, plane)

# =========================
# 查找窗族类型
# =========================
window_symbol = get_window_symbol(doc, TARGET_WINDOW_FAMILY_NAME)
if window_symbol is None:
    logs.append("未找到窗族类型: {}".format(TARGET_WINDOW_FAMILY_NAME))
else:
    logs.append("找到窗族类型: {}".format(TARGET_WINDOW_FAMILY_NAME))
    try:
        if not window_symbol.IsActive:
            window_symbol.Activate()
            doc.Regenerate()
            logs.append("窗族类型已激活")
    except Exception as e:
        logs.append("窗族类型激活失败: {}".format(str(e)))

# =========================
# 查找双开门族类型
# =========================
door_symbol = get_door_symbol(doc, TARGET_DOOR_FAMILY_NAME)
if door_symbol is None:
    logs.append("未找到双开门族类型: {}".format(TARGET_DOOR_FAMILY_NAME))
else:
    logs.append("找到双开门族类型: {}".format(TARGET_DOOR_FAMILY_NAME))
    try:
        if not door_symbol.IsActive:
            door_symbol.Activate()
            doc.Regenerate()
            logs.append("双开门族类型已激活")
    except Exception as e:
        logs.append("双开门族类型激活失败: {}".format(str(e)))

# 取一个Level，供创建窗/门实例使用
level = FilteredElementCollector(doc).OfClass(Level).FirstElement()
if level is None:
    logs.append("未找到Level，无法创建窗或门实例")

# =========================
# 遍历检测结果
# =========================
for i, bbox in enumerate(xyxy):
    try:
        x1, y1, x2, y2 = bbox
        class_id = cls_ids[i]
        class_name = sanitize_name(names[class_id]).lower()

        # 可选：先画debug框
        pt1 = pix_to_revit(x1, y1)
        pt2 = pix_to_revit(x2, y1)
        pt3 = pix_to_revit(x2, y2)
        pt4 = pix_to_revit(x1, y2)
        dbg_lines = create_debug_bbox(doc, sketch_plane, pt1, pt2, pt3, pt4)
        created_lines.extend(dbg_lines)

        # 只处理 window 和 TwoSideDoor
        if class_name != TARGET_WINDOW_CLASS_NAME and class_name != TARGET_DOOR_CLASS_NAME:
            logs.append("检测项{}跳过: class={}".format(i, class_name))
            continue

        if level is None:
            logs.append("检测项{}跳过: 缺少Level".format(i))
            continue

        # 中心点
        cx = 0.5 * (x1 + x2)
        cy = 0.5 * (y1 + y2)
        center_pt = pix_to_revit(cx, cy)

        # 找最近墙
        host_wall, wall_curve, proj_pt, wall_dist = get_nearest_wall(doc, center_pt, max_dist_ft=3.0)
        if host_wall is None or wall_curve is None or proj_pt is None:
            logs.append("检测项{}失败: 未找到合适宿主墙".format(i))
            continue

        wall_ori = get_wall_orientation(wall_curve)

        # 插入点优先用投影点
        insert_pt = XYZ(proj_pt.X, proj_pt.Y, proj_pt.Z)

        # =========================
        # 处理窗
        # =========================
        if class_name == TARGET_WINDOW_CLASS_NAME:

            if window_symbol is None:
                logs.append("检测项{}跳过: 缺少窗族类型".format(i))
                continue

            raw_width_mm = calc_bbox_length_along_wall_mm(x1, y1, x2, y2, wall_ori)

            # 两端向内收
            final_width_mm = raw_width_mm - 2.0 * WINDOW_SHRINK_EACH_SIDE_MM
            final_width_mm = max(final_width_mm, MIN_WINDOW_WIDTH_MM)

            final_width_ft = mm_to_ft(final_width_mm)
            final_height_ft = mm_to_ft(DEFAULT_WINDOW_HEIGHT_MM)
            sill_height_ft = mm_to_ft(DEFAULT_SILL_HEIGHT_MM)

            # 创建窗实例
            try:
                win = doc.Create.NewFamilyInstance(
                    insert_pt,
                    window_symbol,
                    host_wall,
                    level,
                    StructuralType.NonStructural
                )
            except:
                # 有些版本/族可能只接受不带level的重载
                win = doc.Create.NewFamilyInstance(
                    insert_pt,
                    window_symbol,
                    host_wall,
                    StructuralType.NonStructural
                )

            doc.Regenerate()

            # 设置窗参数
            set_param_if_exists(win, "AI_Width", final_width_ft, logs, "窗{}".format(i))
            set_param_if_exists(win, "AI_Height", final_height_ft, logs, "窗{}".format(i))
            set_param_if_exists(win, "底高度", sill_height_ft, logs, "窗{}".format(i))

            created_windows.append(win.ToDSType(True))

            logs.append(
                "窗{}创建成功: class={}, wall_ori={}, raw_width_mm={:.1f}, final_width_mm={:.1f}, height_mm={:.1f}, sill_mm={:.1f}".format(
                    i,
                    class_name,
                    wall_ori,
                    raw_width_mm,
                    final_width_mm,
                    DEFAULT_WINDOW_HEIGHT_MM,
                    DEFAULT_SILL_HEIGHT_MM
                )
            )

        # =========================
        # 处理双开门 TwoSideDoor
        # =========================
        elif class_name == TARGET_DOOR_CLASS_NAME:

            if door_symbol is None:
                logs.append("检测项{}跳过: 缺少双开门族类型".format(i))
                continue

            raw_width_mm = calc_bbox_length_along_wall_mm(x1, y1, x2, y2, wall_ori)

            # 双开门宽度：bbox沿墙方向长度，两边各内收100mm左右
            final_door_width_mm = raw_width_mm - 2.0 * DOOR_SHRINK_EACH_SIDE_MM
            final_door_width_mm = max(final_door_width_mm, MIN_DOOR_WIDTH_MM)

            final_door_width_ft = mm_to_ft(final_door_width_mm)

            # 创建双开门实例
            try:
                door = doc.Create.NewFamilyInstance(
                    insert_pt,
                    door_symbol,
                    host_wall,
                    level,
                    StructuralType.NonStructural
                )
            except:
                door = doc.Create.NewFamilyInstance(
                    insert_pt,
                    door_symbol,
                    host_wall,
                    StructuralType.NonStructural
                )

            doc.Regenerate()

            # 只设置AI_Width，AI_Height保持族默认值
            set_param_if_exists(door, "AI_Width", final_door_width_ft, logs, "双开门{}".format(i))

            created_doors.append(door.ToDSType(True))

            logs.append(
                "双开门{}创建成功: class={}, wall_ori={}, raw_width_mm={:.1f}, final_width_mm={:.1f}, AI_Height保持默认".format(
                    i,
                    class_name,
                    wall_ori,
                    raw_width_mm,
                    final_door_width_mm
                )
            )

    except Exception as e:
        logs.append("检测项{}处理失败: {}".format(i, str(e)))
        continue

# =========================
# 提交事务
# =========================
TransactionManager.Instance.TransactionTaskDone()
doc.Regenerate()

# =========================
# 输出
# =========================
OUT = newpath, created_windows, created_doors, created_lines, logs
# ----------------------------------------
python_version_8 = CodeBlock(i=python_script_6) { i[0]; }
file_from_path_4 = FileObject(path=python_version_8)
readFromFile_4 = Image.ReadFromFile(file=file_from_path_4)
watch_image_4 = WatchImageCore(image=readFromFile_4)
file_from_path_5 = FileObject(path=imagepath_2)
readFromFile_5 = Image.ReadFromFile(file=file_from_path_5)
watch_image_5 = WatchImageCore(image=readFromFile_5)
imagepath_bug_on = Filename("..\tests\3室2厅1厨1卫-83.73㎡-东 南-103104489220.jpg")
modelpath_2 = Filename("..\..\hou_pracs_on\Testings\Saves\best_seg2.pt")
python_script_7 = Python(IN[0]=modelpath_2, IN[1]=imagepath_2, IN[2]=number)  # CPython3; frozen
# ---------- python_script_7.python (133 lines) ----------
# 加载Python Standard 和 DesignScript 库
import sys
import clr
clr.AddReference('ProtoGeometry')
from Autodesk.DesignScript.Geometry import *
import Autodesk.DesignScript.Geometry as DS
import Revit
from Revit.Elements import *
import System
sys.path.append("C:/Users/Lenovo/anaconda3/envs/revitenv/Lib/site-packages")
clr.AddReference('RevitAPI')
clr.AddReference('RevitAPIUI')
from Autodesk.Revit.DB import *
from Autodesk.Revit.UI import *

clr.AddReference('RevitServices')
from RevitServices.Persistence import DocumentManager
from RevitServices.Transactions import TransactionManager

clr.AddReference('RevitNodes')
import Revit
clr.ImportExtensions(Revit.Elements)
clr.ImportExtensions(Revit.GeometryConversion)
#
import re
import numpy as np
import torch
import cv2
from ultralytics import YOLO

dataEnteringNode = IN 
dect_Model = IN[0]
pixpath = IN[1]
height = IN[2]
#params
origin = XYZ(0, 0, 0)   
widthFt = 10.0
pixelWidth = 1600   
pixelHeight = 1200                          
#                         
yolo_seg = YOLO(dect_Model,task = "seg")
newpath = "E:/yanjiu/revitss/tests/jjianzhu_seg.jpg"

seg_result = yolo_seg(source = pixpath,save = False,conf = 0.3,iou = 0.45,imgsz = 640)
cv2.imwrite(newpath,seg_result[0].plot())
#tempouts = []
#tempouts.append(newpath)
#tempouts.extend(dect_result)
scaleX = widthFt / pixelWidth
scaleY = widthFt * (pixelHeight / pixelWidth) / pixelHeight  

result = seg_result[0]        
boxes = result.boxes
xyxy = boxes.xyxy.cpu().numpy() 
cls_ids = boxes.cls.cpu().numpy().astype(int)  # 类别索引 (N,)
names = result.names  

doc = DocumentManager.Instance.CurrentDBDocument
app = doc.Application
TransactionManager.Instance.EnsureInTransaction(doc)

created_lines = []
dyn_lines = []
dyn_faces = [] 
created_shapes = []


def pix_to_revit(x, y):
    revit_x = origin.X + x * scaleX
    revit_y = origin.Y + (pixelHeight - y) * scaleY  # 翻转 Y 轴
    return XYZ(revit_x, revit_y, origin.Z)
def sanitize_name(name):
    # 如果名称为空，返回默认名称
    if not name:
        return "Unknown"
    # 移除控制字符（ASCII 0-31，除了tab? 但最好全部移除）
    # 允许常见字符：字母、数字、空格、下划线、连字符、中文等
    # 保留所有打印字符，移除控制字符
    cleaned = re.sub(r'[\x00-\x1f\x7f]', '', name)
    # 如果清理后为空，则返回默认名
    if not cleaned.strip():
        return "Unnamed"
    return cleaned

plane = Plane.CreateByNormalAndOrigin(XYZ.BasisZ, origin)
sketch_plane = SketchPlane.Create(doc, plane)

result = seg_result[0]
if result.masks is not None:
    masks_xy = result.masks.xy               # 列表，每个元素是 (N,2) 的像素坐标
    cls_ids = result.boxes.cls.cpu().numpy().astype(int)   
    names = result.names
    
    for i, contour_pts in enumerate(masks_xy):
        # 将像素点转换为 Revit 点
        revit_pts = [pix_to_revit(pt[0], pt[1]) for pt in contour_pts]
        
        if len(revit_pts) < 3:
            continue
            
        # 创建 CurveLoop
        curve_loop = CurveLoop()
        for j in range(len(revit_pts) - 1):
            line = Line.CreateBound(revit_pts[j], revit_pts[j+1])
            curve_loop.Append(line)
        # 闭合：最后一点到第一点
        line_close = Line.CreateBound(revit_pts[-1], revit_pts[0])
        curve_loop.Append(line_close)
        thickness = height
        
        try:
            solid = GeometryCreationUtilities.CreateExtrusionGeometry(
                [curve_loop], XYZ.BasisZ, thickness)
        except:
            # 如果轮廓无效（如自交），跳过此对象
            continue
        
        direct_shape = DirectShape.CreateElement(doc, ElementId(BuiltInCategory.OST_GenericModel))
        direct_shape.SetShape([solid])
        
        class_id = cls_ids[i]
        class_name = names[class_id]
        safe_name = sanitize_name(class_name)
        direct_shape.Name = safe_name
        
        created_shapes.append(direct_shape)

# others upgrades
TransactionManager.Instance.TransactionTaskDone()
doc.Regenerate()
# Outs
#OUT = [created_lines, dyn_lines]
OUT = newpath,created_shapes
# ----------------------------------------
python_script_8 = Python(IN[0]=modelpath, IN[1]=imagepath_2, IN[2]=scale)  # CPython3; frozen
# ---------- python_script_8.python (142 lines) ----------
# 加载PythonStandard 和 DesignScript 库
import sys
import clr
clr.AddReference('ProtoGeometry')
from Autodesk.DesignScript.Geometry import *
import Autodesk.DesignScript.Geometry as DS
import Revit
from Revit.Elements import *
import System
sys.path.append("C:/Users/Lenovo/anaconda3/envs/revitenv/Lib/site-packages")
clr.AddReference('RevitAPI')
clr.AddReference('RevitAPIUI')
from Autodesk.Revit.DB import *
from Autodesk.Revit.UI import *

clr.AddReference('RevitServices')
from RevitServices.Persistence import DocumentManager
from RevitServices.Transactions import TransactionManager

clr.AddReference('RevitNodes')
import Revit
clr.ImportExtensions(Revit.Elements)
clr.ImportExtensions(Revit.GeometryConversion)
#
import re
import numpy as np
import torch
import cv2
from ultralytics import YOLO

dataEnteringNode = IN 
dect_Model = IN[0]
pixpath = IN[1]
scale = IN[2]
#params
origin = XYZ(0, 0, 0)   
widthFt = scale
pixelWidth = 1600   
pixelHeight = 1200                          
#                         
yolo_dect = YOLO(dect_Model,task = "detect")
newpath = "E:/yanjiu/revitss/tests/jjianzhu_dect.jpg"

dect_result = yolo_dect(source = pixpath,save = False,conf = 0.3,iou = 0.45,imgsz = 640)
cv2.imwrite(newpath,dect_result[0].plot())
#tempouts = []
#tempouts.append(newpath)
#tempouts.extend(dect_result)
scaleX = widthFt / pixelWidth
scaleY = widthFt * (pixelHeight / pixelWidth) / pixelHeight  

result = dect_result[0]        
boxes = result.boxes
xyxy = boxes.xyxy.cpu().numpy() 
cls_ids = boxes.cls.cpu().numpy().astype(int)  # 类别索引 (N,)
names = result.names  

doc = DocumentManager.Instance.CurrentDBDocument
app = doc.Application
TransactionManager.Instance.EnsureInTransaction(doc)

created_lines = []
dyn_lines = []
dyn_faces = [] 
created_shapes = []

def pix_to_revit(x, y):
    revit_x = origin.X + x * scaleX
    revit_y = origin.Y + (pixelHeight - y) * scaleY  # 翻转 Y 轴
    return XYZ(revit_x, revit_y, origin.Z)
def sanitize_name(name):
    # 如果名称为空，返回默认名称
    if not name:
        return "Unknown"
    # 移除控制字符（ASCII 0-31，除了tab? 但最好全部移除）
    # 允许常见字符：字母、数字、空格、下划线、连字符、中文等
    # 保留所有打印字符，移除控制字符
    cleaned = re.sub(r'[\x00-\x1f\x7f]', '', name)
    # 如果清理后为空，则返回默认名
    if not cleaned.strip():
        return "Unnamed"
    return cleaned

plane = Plane.CreateByNormalAndOrigin(XYZ.BasisZ, origin)
sketch_plane = SketchPlane.Create(doc, plane)

for i, bbox in enumerate(xyxy):
    x1, y1, x2, y2 = bbox  # 左上角 (x1,y1), 右下角 (x2,y2)
    
    # 计算四个角点的 Revit 坐标
    pt1 = pix_to_revit(x1, y1)  # 左上
    pt2 = pix_to_revit(x2, y1)  # 右上
    pt3 = pix_to_revit(x2, y2)  # 右下
    pt4 = pix_to_revit(x1, y2)  # 左下
   
    dyn_pt1 = pt1.ToPoint()
    dyn_pt2 = pt2.ToPoint()
    dyn_pt3 = pt3.ToPoint()
    dyn_pt4 = pt4.ToPoint()
    # 创建四条线
    lines = [
        Line.CreateBound(pt1, pt2),
        Line.CreateBound(pt2, pt3),
        Line.CreateBound(pt3, pt4),
        Line.CreateBound(pt4, pt1)
    ]
    
    # 创建模型线并添加到列表
    for line in lines:
        model_curve = doc.Create.NewModelCurve(line, sketch_plane)
        created_lines.append(model_curve)
        start_dyn = line.GetEndPoint(0).ToPoint()
        end_dyn = line.GetEndPoint(1).ToPoint()
        dyn_line = DS.Line.ByStartPointEndPoint(start_dyn, end_dyn)
        dyn_lines.append(dyn_line)
    points = [dyn_pt1, dyn_pt2, dyn_pt3, dyn_pt4]
    poly = DS.PolyCurve.ByPoints(points, connectLastToFirst=True)
    if poly.IsClosed:
        surface = DS.Surface.ByPatch(poly)
        dyn_faces.append(surface)
    curve_loop = CurveLoop()
    curve_loop.Append(Line.CreateBound(pt1, pt2))
    curve_loop.Append(Line.CreateBound(pt2, pt3))
    curve_loop.Append(Line.CreateBound(pt3, pt4))
    curve_loop.Append(Line.CreateBound(pt4, pt1))
    
    thickness = 0.001  # 可根据需要调整
    solid = GeometryCreationUtilities.CreateExtrusionGeometry(
        [curve_loop], XYZ.BasisZ, thickness)
    direct_shape = DirectShape.CreateElement(doc, ElementId(BuiltInCategory.OST_GenericModel))
    direct_shape.SetShape([solid])
    class_id = cls_ids[i]
    class_name = names[class_id]
    safe_name = sanitize_name(class_name)
    direct_shape.Name = "YOLO_" + safe_name
    created_shapes.append(direct_shape)    

TransactionManager.Instance.TransactionTaskDone()
doc.Regenerate()
# Outs
#OUT = [created_lines, dyn_lines]
OUT = newpath,created_shapes
# ----------------------------------------
python_version_9 = Watch(python_script_8)  # graph output
python_version_10 = CodeBlock(i=python_version_9) { i[1][18]; }
geometry = Element.Geometry(element=python_version_10)  # frozen
isClosed = Curve.IsClosed(curve=geometry)
python_paths_3 = Watch(isClosed)  # graph output
family_types = FamilyTypes("Cabinet:Cabinet")
python_script_9 = Python(IN[0]=family_types)  # CPython3; frozen
# ---------- python_script_9.python (34 lines) ----------
#加载PythonStandard和DesignScript库
import sys
import clr
clr.AddReference( 'ProtoGeometry')
from Autodesk.DesignScript.Geometry import *
#加载RevitAPI
clr.AddReference('RevitAPI')
from Autodesk.Revit.DB import *
#加载RevitNodes
clr.AddReference('RevitNodes')
import Revit
clr.ImportExtensions(Revit.Elements)
#加载Revitservices
clr.AddReference('RevitServices')
from RevitServices.Persistence import DocumentManager
from RevitServices.Transactions import TransactionManager
#该节点的输入内容将存储为IN变量中的一个列表。
famtype=UnwrapElement(IN[0])
#将代码放在该行下面
doc = DocumentManager.Instance.CurrentDBDocument
TransactionManager.Instance.EnsureInTransaction(doc)
if not famtype.IsActive:
    famtype.Activate()
faminstances = []

for x in range(0,16000,1600):
    
    x = UnitUtils.ConvertToInternalUnits(x, UnitTypeId.Millimeters)
    f = doc.Create.NewFamilyInstance(XYZ(0,x,0), famtype, Structure.StructuralType.NonStructural)
    faminstances.append(f.ToDSType(True))

TransactionManager.Instance.TransactionTaskDone()
#将输出内容指定给OUT变量。
OUT = faminstances
# ----------------------------------------
number_2 = DoubleInput(1)
string_from_object = FromObject(object=number_2)
number_3 = DoubleInput(2)
string_from_object_2 = FromObject(object=number_3)  # frozen
list_create = List.Create(item0=string_from_object, item1=string_from_object_2)
family_types_2 = FamilyTypes("桌:1830 x 915mm")
list_create_2 = List.Create(item0=family_types, item1=family_types_2)
byKeysValues = DesignScript.Builtin.Dictionary.ByKeysValues(keys=list_create, values=list_create_2)
watch = Watch(byKeysValues)
file_from_path_6 = FileObject(path=imagepath_2)
readFromFile_6 = Image.ReadFromFile(file=file_from_path_6)
watch_image_6 = WatchImageCore(image=readFromFile_6)
modelpath_3 = Filename("..\..\hou_pracs_on\Testings\Saves\best_dir2.pt")
furnture_Info_Json_Path = Filename("..\..\hou_pracs_on\revit_paddleocr_tests\jsons\pose_class_config.json")
python_script_10 = Python(IN[0]=modelpath_3, IN[1]=imagepath_2, IN[2]=scale, IN[5]=python_version_7, IN[6]=furnture_Info_Json_Path)  # CPython3; unwired: IN[3], IN[4]
# ---------- python_script_10.python (1672 lines) ----------
# -*- coding: utf-8 -*-
#-------------------------
import sys
import clr
import math
import json
import numpy as np
import cv2

clr.AddReference('ProtoGeometry')
from Autodesk.DesignScript.Geometry import *

clr.AddReference('RevitAPI')
clr.AddReference('RevitAPIUI')
from Autodesk.Revit.DB import *
from Autodesk.Revit.DB.Structure import StructuralType

clr.AddReference('RevitServices')
from RevitServices.Persistence import DocumentManager
from RevitServices.Transactions import TransactionManager

clr.AddReference('RevitNodes')
import Revit
clr.ImportExtensions(Revit.Elements)
clr.ImportExtensions(Revit.GeometryConversion)

sys.path.append("C:/Users/Lenovo/anaconda3/envs/revitenv/Lib/site-packages")
from ultralytics import YOLO


# ============================================================
# 输入
# ============================================================
pose_Model = IN[0]
pixpath = IN[1]
scale = IN[2]
target_family_name = IN[3] if len(IN) > 3 else "Bed"
target_type_name = IN[4] if len(IN) > 4 else "Only_Bed"
seg_meta_json_path = IN[5] if len(IN) > 5 else None
class_config_json_path = IN[6] if len(IN) > 6 else None


# ============================================================
# 全局参数
# ============================================================
origin = XYZ(0, 0, 0)
widthFt = scale
pixelWidth = 1600
pixelHeight = 1200

bbox_min_x = None
bbox_min_y = None
bbox_width = None
bbox_height = None
scale_x_ft_per_px = None
scale_y_ft_per_px = None

logs = []


# ============================================================
# 默认配置
# ============================================================
DEFAULT_CLASS_CONFIG = {
    "Bed": {
        "family_name": "Bed",
        "type_name": "Bed",
        "rotate": True,
        "kp_start_idx": 0,
        "kp_end_idx": 1,
        "area_filter": True,
        "family_default_axis": "Y",
        "placement_mode": "free"
    },
    "BedSingle": {
        "family_name": "BedSingle",
        "type_name": "BedSingle",
        "rotate": True,
        "kp_start_idx": 0,
        "kp_end_idx": 1,
        "area_filter": False,
        "family_default_axis": "Y",
        "placement_mode": "free"
    },
    "CookingCounter": {
        "family_name": "CookingCounter",
        "type_name": "CookingCounter",
        "rotate": True,
        "kp_start_idx": 0,
        "kp_end_idx": 1,
        "area_filter": False,
        "family_default_axis": "Y",
        "placement_mode": "free"
    },
    "Cabinet": {
        "family_name": "Cabinet",
        "type_name": "Cabinet",
        "rotate": True,
        "kp_start_idx": 0,
        "kp_end_idx": 1,
        "area_filter": False,
        "family_default_axis": "Y",
        "placement_mode": "free"
    },
    "DiningTable": {
        "family_name": "DiningTable",
        "type_name": "DiningTable",
        "rotate": True,
        "kp_start_idx": 0,
        "kp_end_idx": 1,
        "area_filter": False,
        "family_default_axis": "Y",
        "placement_mode": "free"
    },
    "DiningTables": {
        "family_name": "DiningTables",
        "type_name": "DiningTables",
        "rotate": False,
        "area_filter": False,
        "placement_mode": "free"
    },
    "Sofa": {
        "family_name": "Sofa",
        "type_name": "Sofa",
        "rotate": True,
        "kp_start_idx": 0,
        "kp_end_idx": 1,
        "area_filter": False,
        "family_default_axis": "Y",
        "placement_mode": "free"
    },
    "TVStand": {
        "family_name": "TVStand",
        "type_name": "TVStand",
        "rotate": True,
        "kp_start_idx": 0,
        "kp_end_idx": 1,
        "area_filter": False,
        "family_default_axis": "Y",
        "placement_mode": "free"
    },
    "Toilet": {
        "family_name": "Toilet",
        "type_name": "Toilet",
        "rotate": True,
        "kp_start_idx": 0,
        "kp_end_idx": 1,
        "area_filter": False,
        "family_default_axis": "Y",
        "placement_mode": "free"
    },
    "LeftDoor": {
        "family_name": "LeftDoor",
        "type_name": "LeftDoor",
        "rotate": False,
        "kp_start_idx": 0,
        "kp_end_idx": 1,
        "area_filter": False,
        "placement_mode": "door_hosted",

        "door_max_host_wall_dist_ft": 4.0,
        "door_min_perp_score": 0.35,
        "door_min_end_clearance_ft": 0.45,
        "door_end_clearance_ratio": 0.25,

        "door_insert_reference": "bbox_center",
        "door_insert_offset_along_ft": 0.0,
        "door_insert_offset_normal_ft": 0.0,

        "door_try_candidate_count": 8,
        "door_geometry_match": True
    },
    "RightDoor": {
        "family_name": "RightDoor",
        "type_name": "RightDoor",
        "rotate": False,
        "kp_start_idx": 0,
        "kp_end_idx": 1,
        "area_filter": False,
        "placement_mode": "door_hosted",

        "door_max_host_wall_dist_ft": 4.0,
        "door_min_perp_score": 0.35,
        "door_min_end_clearance_ft": 0.45,
        "door_end_clearance_ratio": 0.25,

        "door_insert_reference": "bbox_center",
        "door_insert_offset_along_ft": 0.0,
        "door_insert_offset_normal_ft": 0.0,

        "door_try_candidate_count": 8,
        "door_geometry_match": True
    }
}


# ============================================================
# 基础工具
# ============================================================
def norm_str(s):
    if s is None:
        return ""
    return str(s).strip().lower()


def load_json_file(json_path, logs, label):
    if not json_path:
        logs.append("{}为空".format(label))
        return None
    try:
        with open(json_path, "r", encoding="utf-8") as f:
            data = json.load(f)
        logs.append("读取{}成功: {}".format(label, json_path))
        return data
    except Exception as e:
        logs.append("读取{}失败: {}".format(label, str(e)))
        return None


def load_class_config(class_config_json_path, logs):
    data = load_json_file(class_config_json_path, logs, "class_config_json_path")
    if isinstance(data, dict) and len(data) > 0:
        logs.append("使用外部CLASS_CONFIG，共{}类".format(len(data)))
        return data
    logs.append("使用内置DEFAULT_CLASS_CONFIG，共{}类".format(len(DEFAULT_CLASS_CONFIG)))
    return DEFAULT_CLASS_CONFIG


def load_seg_meta(seg_meta_json_path, logs):
    return load_json_file(seg_meta_json_path, logs, "seg_meta_json_path")


def pix_to_revit(x, y):
    global bbox_min_x, bbox_min_y, bbox_height
    global scale_x_ft_per_px, scale_y_ft_per_px
    global origin, widthFt, pixelWidth, pixelHeight

    try:
        if bbox_min_x is not None and bbox_min_y is not None and bbox_height is not None and \
           scale_x_ft_per_px is not None and scale_y_ft_per_px is not None:
            local_x = x - bbox_min_x
            local_y = y - bbox_min_y
            revit_x = origin.X + local_x * scale_x_ft_per_px
            revit_y = origin.Y + (bbox_height - local_y) * scale_y_ft_per_px
            return XYZ(revit_x, revit_y, origin.Z)
    except:
        pass

    scaleX = widthFt / pixelWidth if pixelWidth > 0 else 0.0
    scaleY = widthFt * (float(pixelHeight) / float(pixelWidth)) / pixelHeight if pixelWidth > 0 and pixelHeight > 0 else 0.0
    revit_x = origin.X + x * scaleX
    revit_y = origin.Y + (pixelHeight - y) * scaleY
    return XYZ(revit_x, revit_y, origin.Z)


def get_level(doc):
    av = doc.ActiveView
    try:
        if hasattr(av, "GenLevel") and av.GenLevel:
            return av.GenLevel
    except:
        pass

    levels = FilteredElementCollector(doc).OfClass(Level).ToElements()
    if levels and len(levels) > 0:
        return levels[0]
    return None


def build_symbol_lookup(doc):
    lookup = {}
    collector = FilteredElementCollector(doc).OfClass(FamilySymbol)

    for fs in collector:
        try:
            fam_name = fs.Family.Name if fs.Family else ""
            p = fs.get_Parameter(BuiltInParameter.SYMBOL_NAME_PARAM)
            typ_name = p.AsString() if p else fs.Name
            lookup[(norm_str(fam_name), norm_str(typ_name))] = fs
        except:
            pass

    return lookup


def get_symbol_from_lookup(symbol_lookup, family_name, type_name):
    return symbol_lookup.get((norm_str(family_name), norm_str(type_name)), None)


def ensure_symbol_active(doc, symbol):
    if symbol and not symbol.IsActive:
        symbol.Activate()
        doc.Regenerate()


def xyz_sub(a, b):
    return XYZ(a.X - b.X, a.Y - b.Y, a.Z - b.Z)


def xyz_add(a, b):
    return XYZ(a.X + b.X, a.Y + b.Y, a.Z + b.Z)


def xyz_mul(v, s):
    return XYZ(v.X * s, v.Y * s, v.Z * s)


def xyz_len2d(v):
    return math.sqrt(v.X * v.X + v.Y * v.Y)


def xyz_norm2d(v):
    l = xyz_len2d(v)
    if l < 1e-9:
        return None
    return XYZ(v.X / l, v.Y / l, 0)


def dot2d(a, b):
    return a.X * b.X + a.Y * b.Y


def dist2d(a, b):
    dx = a.X - b.X
    dy = a.Y - b.Y
    return math.sqrt(dx * dx + dy * dy)


def clamp(v, a, b):
    return max(a, min(b, v))


def rotate_instance(doc, instance, center_pt, angle):
    axis_end = XYZ(center_pt.X, center_pt.Y, center_pt.Z + 1.0)
    axis = Line.CreateBound(center_pt, axis_end)
    ElementTransformUtils.RotateElement(doc, instance.Id, axis, angle)


def create_family_instance(doc, center_pt, symbol, level):
    try:
        return doc.Create.NewFamilyInstance(
            center_pt,
            symbol,
            level,
            StructuralType.NonStructural
        )
    except:
        return doc.Create.NewFamilyInstance(
            center_pt,
            symbol,
            doc.ActiveView
        )


def get_angle_from_keypoints(start_pt, end_pt, family_default_axis="Y"):
    vec = XYZ(start_pt.X - end_pt.X, start_pt.Y - end_pt.Y, 0)
    if vec.GetLength() < 1e-6:
        return None

    angle = math.atan2(vec.Y, vec.X)

    if family_default_axis == "Y":
        angle -= math.pi / 2.0

    return angle


def compute_class_area_threshold(boxes, cls_ids, names, class_name, scale_ratio=0.33):
    areas = []

    for i, bbox in enumerate(boxes):
        cls_name = names[int(cls_ids[i])] if len(cls_ids) > i else ""
        if cls_name != class_name:
            continue
        x1, y1, x2, y2 = bbox
        areas.append(max(0, x2 - x1) * max(0, y2 - y1))

    if len(areas) == 0:
        return 0.0, 0.0

    median_area = float(np.median(areas))
    return median_area, median_area * scale_ratio


# ============================================================
# 墙工具
# ============================================================
def get_wall_curve(wall):
    try:
        loc = wall.Location
        if loc and hasattr(loc, "Curve"):
            return loc.Curve
    except:
        pass
    return None


def get_wall_direction_unit(curve):
    try:
        p0 = curve.GetEndPoint(0)
        p1 = curve.GetEndPoint(1)
        return xyz_norm2d(xyz_sub(p1, p0))
    except:
        return None


def get_wall_normal_unit_2d(wall_dir):
    if wall_dir is None:
        return None
    return XYZ(-wall_dir.Y, wall_dir.X, 0)


def get_curve_length_2d(curve):
    try:
        p0 = curve.GetEndPoint(0)
        p1 = curve.GetEndPoint(1)
        return dist2d(p0, p1)
    except:
        try:
            return curve.Length
        except:
            return 0.0


def point_to_line_segment_projection_2d(pt, p0, p1):
    vx = p1.X - p0.X
    vy = p1.Y - p0.Y
    wx = pt.X - p0.X
    wy = pt.Y - p0.Y

    vv = vx * vx + vy * vy
    if vv < 1e-9:
        return {
            "proj": XYZ(p0.X, p0.Y, 0),
            "dist": dist2d(pt, p0),
            "t_raw": 0.0,
            "t": 0.0,
            "inside": False,
            "length": 0.0,
            "end_clearance": 0.0
        }

    t_raw = (wx * vx + wy * vy) / vv
    t = clamp(t_raw, 0.0, 1.0)

    proj = XYZ(p0.X + t * vx, p0.Y + t * vy, 0)
    length = math.sqrt(vv)
    inside = t_raw >= -0.02 and t_raw <= 1.02

    if inside:
        end_clearance = min(t * length, (1.0 - t) * length)
    else:
        end_clearance = -min(abs(t_raw), abs(t_raw - 1.0)) * length

    return {
        "proj": proj,
        "dist": dist2d(pt, proj),
        "t_raw": t_raw,
        "t": t,
        "inside": inside,
        "length": length,
        "end_clearance": end_clearance
    }


def get_wall_projection_info_2d(curve, pt):
    try:
        p0 = curve.GetEndPoint(0)
        p1 = curve.GetEndPoint(1)
        return point_to_line_segment_projection_2d(pt, p0, p1)
    except:
        try:
            proj_result = curve.Project(pt)
            if proj_result:
                q = proj_result.XYZPoint
                return {
                    "proj": XYZ(q.X, q.Y, 0),
                    "dist": dist2d(pt, q),
                    "t_raw": None,
                    "t": None,
                    "inside": True,
                    "length": curve.Length,
                    "end_clearance": 999.0
                }
        except:
            pass

    return None


# ============================================================
# 门宽
# ============================================================
def get_symbol_width_ft(symbol):
    cand_names = ["AI_Width", "Width", "宽度"]

    for n in cand_names:
        try:
            p = symbol.LookupParameter(n)
            if p and p.StorageType == StorageType.Double:
                val = p.AsDouble()
                if val and val > 1e-6:
                    return val
        except:
            pass

    builtin_candidates = [
        BuiltInParameter.DOOR_WIDTH,
        BuiltInParameter.FAMILY_WIDTH_PARAM
    ]

    for bip in builtin_candidates:
        try:
            p = symbol.get_Parameter(bip)
            if p:
                val = p.AsDouble()
                if val and val > 1e-6:
                    return val
        except:
            pass

    return None


def place_hosted_door_instance(doc, level, symbol, wall, insert_pt):
    try:
        return doc.Create.NewFamilyInstance(
            insert_pt,
            symbol,
            wall,
            level,
            StructuralType.NonStructural
        )
    except:
        return doc.Create.NewFamilyInstance(
            insert_pt,
            symbol,
            wall,
            StructuralType.NonStructural
        )


# ============================================================
# flip 工具
# ============================================================
def can_flip_hand(inst):
    try:
        return inst.CanFlipHand
    except:
        return False


def can_flip_facing(inst):
    try:
        return inst.CanFlipFacing
    except:
        return False


def get_flip_state(inst):
    hand = False
    facing = False

    try:
        hand = inst.HandFlipped
    except:
        pass

    try:
        facing = inst.FacingFlipped
    except:
        pass

    return hand, facing


def set_flip_state(inst, target_hand, target_facing):
    changed = []

    try:
        cur_hand = inst.HandFlipped
    except:
        cur_hand = False

    if cur_hand != target_hand:
        if can_flip_hand(inst):
            inst.flipHand()
            changed.append("flipHand")
        else:
            return False, changed

    try:
        cur_facing = inst.FacingFlipped
    except:
        cur_facing = False

    if cur_facing != target_facing:
        if can_flip_facing(inst):
            inst.flipFacing()
            changed.append("flipFacing")
        else:
            return False, changed

    return True, changed


def get_candidate_flip_states(inst):
    cur_hand, cur_facing = get_flip_state(inst)

    raw = [
        (cur_hand, cur_facing),
        (not cur_hand, cur_facing),
        (cur_hand, not cur_facing),
        (not cur_hand, not cur_facing)
    ]

    states = []
    seen = set()

    for h, f in raw:
        if (h, f) in seen:
            continue

        if h != cur_hand and not can_flip_hand(inst):
            continue

        if f != cur_facing and not can_flip_facing(inst):
            continue

        states.append((h, f))
        seen.add((h, f))

    return states


# ============================================================
# 实例真实平面几何读取
# ============================================================
def segment_midpoint_2d(p0, p1):
    return XYZ((p0.X + p1.X) * 0.5, (p0.Y + p1.Y) * 0.5, 0)


def segment_dir_2d(p0, p1):
    return xyz_norm2d(XYZ(p1.X - p0.X, p1.Y - p0.Y, 0))


def safe_transform_point(trf, p):
    try:
        return trf.OfPoint(p)
    except:
        return p


def extract_instance_plan_segments_recursive(geom_elem, trf, out_segments):
    if geom_elem is None:
        return

    for g in geom_elem:
        try:
            if isinstance(g, GeometryInstance):
                try:
                    sym_trf = trf.Multiply(g.Transform)
                    sym_geom = g.GetSymbolGeometry()
                    extract_instance_plan_segments_recursive(sym_geom, sym_trf, out_segments)
                except:
                    pass

                try:
                    inst_geom = g.GetInstanceGeometry()
                    extract_instance_plan_segments_recursive(inst_geom, trf, out_segments)
                except:
                    pass

            elif isinstance(g, Line):
                p0 = safe_transform_point(trf, g.GetEndPoint(0))
                p1 = safe_transform_point(trf, g.GetEndPoint(1))
                out_segments.append((XYZ(p0.X, p0.Y, 0), XYZ(p1.X, p1.Y, 0), "Line"))

            elif isinstance(g, Arc):
                p0 = safe_transform_point(trf, g.GetEndPoint(0))
                p1 = safe_transform_point(trf, g.GetEndPoint(1))
                out_segments.append((XYZ(p0.X, p0.Y, 0), XYZ(p1.X, p1.Y, 0), "ArcChord"))

            elif isinstance(g, Curve):
                try:
                    p0 = safe_transform_point(trf, g.GetEndPoint(0))
                    p1 = safe_transform_point(trf, g.GetEndPoint(1))
                    out_segments.append((XYZ(p0.X, p0.Y, 0), XYZ(p1.X, p1.Y, 0), "CurveChord"))
                except:
                    pass

            elif isinstance(g, Solid):
                try:
                    for edge in g.Edges:
                        c = edge.AsCurve()
                        p0 = safe_transform_point(trf, c.GetEndPoint(0))
                        p1 = safe_transform_point(trf, c.GetEndPoint(1))
                        out_segments.append((XYZ(p0.X, p0.Y, 0), XYZ(p1.X, p1.Y, 0), "SolidEdge"))
                except:
                    pass

        except:
            continue


def get_instance_plan_segments(doc, inst):
    opts = Options()
    opts.ComputeReferences = False
    opts.IncludeNonVisibleObjects = True

    try:
        opts.DetailLevel = ViewDetailLevel.Fine
    except:
        pass

    try:
        opts.View = doc.ActiveView
    except:
        pass

    segments = []

    try:
        geom = inst.get_Geometry(opts)
        extract_instance_plan_segments_recursive(geom, Transform.Identity, segments)
    except:
        pass

    return segments


def filter_door_leaf_candidate_segments(segments, insert_pt, wall_dir, leaf_dir, door_width_ft):
    candidates = []

    min_len = max(0.4, door_width_ft * 0.20)
    max_len = max(door_width_ft * 1.80, 6.0)
    max_mid_dist = max(door_width_ft * 2.00, 6.0)

    for p0, p1, typ in segments:
        length = dist2d(p0, p1)

        if length < min_len or length > max_len:
            continue

        d = segment_dir_2d(p0, p1)
        if d is None:
            continue

        mid = segment_midpoint_2d(p0, p1)
        mid_dist = dist2d(mid, insert_pt)

        if mid_dist > max_mid_dist:
            continue

        parallel_to_wall = abs(dot2d(d, wall_dir))
        parallel_to_leaf = abs(dot2d(d, leaf_dir))

        if parallel_to_leaf + 0.15 < parallel_to_wall:
            continue

        candidates.append({
            "p0": p0,
            "p1": p1,
            "type": typ,
            "length": length,
            "mid_dist": mid_dist,
            "parallel_to_wall": parallel_to_wall,
            "parallel_to_leaf": parallel_to_leaf
        })

    return candidates


def score_leaf_segment_against_keypoints(seg_info, hinge_pt, leaf_end_pt, leaf_dir, door_width_ft):
    p0 = seg_info["p0"]
    p1 = seg_info["p1"]

    d0 = dist2d(p0, hinge_pt)
    d1 = dist2d(p1, hinge_pt)

    if d0 <= d1:
        hinge_candidate = p0
        end_candidate = p1
        dir_vec = segment_dir_2d(p0, p1)
        hinge_dist = d0
    else:
        hinge_candidate = p1
        end_candidate = p0
        dir_vec = segment_dir_2d(p1, p0)
        hinge_dist = d1

    if dir_vec is None:
        return -1e9, None

    dir_score = dot2d(dir_vec, leaf_dir)
    end_dist = dist2d(end_candidate, leaf_end_pt)

    norm = max(door_width_ft, 1.0)
    hinge_score = 1.0 - clamp(hinge_dist / norm, 0.0, 2.0)
    end_score = 1.0 - clamp(end_dist / norm, 0.0, 2.0)

    total = dir_score * 10.0 + hinge_score * 3.0 + end_score * 1.5 + seg_info["parallel_to_leaf"] * 1.0

    dbg = {
        "segment_type": seg_info["type"],
        "segment_p0_xyz": [p0.X, p0.Y, p0.Z],
        "segment_p1_xyz": [p1.X, p1.Y, p1.Z],
        "segment_length": seg_info["length"],
        "segment_mid_dist": seg_info["mid_dist"],
        "parallel_to_wall": seg_info["parallel_to_wall"],
        "parallel_to_leaf": seg_info["parallel_to_leaf"],
        "hinge_candidate_xyz": [hinge_candidate.X, hinge_candidate.Y, hinge_candidate.Z],
        "end_candidate_xyz": [end_candidate.X, end_candidate.Y, end_candidate.Z],
        "hinge_dist": hinge_dist,
        "end_dist": end_dist,
        "dir_vec_xyz": [dir_vec.X, dir_vec.Y, dir_vec.Z],
        "target_leaf_dir_xyz": [leaf_dir.X, leaf_dir.Y, leaf_dir.Z],
        "dir_score_dot": dir_score,
        "hinge_score": hinge_score,
        "end_score": end_score,
        "total_score": total
    }

    return total, dbg


def evaluate_door_actual_geometry_state(doc, inst, insert_pt, wall_dir, hinge_pt, leaf_end_pt, leaf_dir, door_width_ft):
    segments = get_instance_plan_segments(doc, inst)

    candidates = filter_door_leaf_candidate_segments(
        segments,
        insert_pt,
        wall_dir,
        leaf_dir,
        door_width_ft
    )

    best_score = -1e9
    best_dbg = None

    for c in candidates:
        score, dbg = score_leaf_segment_against_keypoints(
            c,
            hinge_pt,
            leaf_end_pt,
            leaf_dir,
            door_width_ft
        )

        if score > best_score:
            best_score = score
            best_dbg = dbg

    if best_dbg is None:
        best_dbg = {
            "reason": "no_leaf_segment_candidate",
            "raw_segment_count": len(segments),
            "candidate_count": len(candidates),
            "total_score": -1e9
        }
    else:
        best_dbg["raw_segment_count"] = len(segments)
        best_dbg["candidate_count"] = len(candidates)

    return best_score, best_dbg


# ============================================================
# 门宿主墙候选评分
# ============================================================
def get_best_door_host_wall_candidates(
    doc,
    bbox_center_pt,
    hinge_pt,
    leaf_end_pt,
    leaf_dir,
    door_width_ft,
    cfg
):
    max_dist_ft = float(cfg.get("door_max_host_wall_dist_ft", 4.0))
    min_perp_score = float(cfg.get("door_min_perp_score", 0.35))
    min_end_clearance_ft = float(cfg.get("door_min_end_clearance_ft", 0.45))
    end_clearance_ratio = float(cfg.get("door_end_clearance_ratio", 0.25))

    min_clearance = max(min_end_clearance_ft, door_width_ft * end_clearance_ratio)

    candidates = []

    walls = FilteredElementCollector(doc).OfClass(Wall).ToElements()

    for wall in walls:
        try:
            curve = get_wall_curve(wall)
            if curve is None:
                continue

            wall_dir = get_wall_direction_unit(curve)
            if wall_dir is None:
                continue

            wall_nrm = get_wall_normal_unit_2d(wall_dir)
            if wall_nrm is None:
                continue

            wall_len = get_curve_length_2d(curve)
            if wall_len < max(door_width_ft * 0.75, 1.0):
                continue

            hinge_info = get_wall_projection_info_2d(curve, hinge_pt)
            bbox_info = get_wall_projection_info_2d(curve, bbox_center_pt)
            end_info = get_wall_projection_info_2d(curve, leaf_end_pt)

            if hinge_info is None or bbox_info is None:
                continue

            hinge_dist = hinge_info["dist"]
            bbox_dist = bbox_info["dist"]
            end_dist = end_info["dist"] if end_info else 999.0

            if hinge_dist > max_dist_ft and bbox_dist > max_dist_ft:
                continue

            perp_score = 1.0 - abs(dot2d(wall_dir, leaf_dir))

            if perp_score < min_perp_score:
                continue

            # 默认插入点参考 bbox 中心投影；如果 bbox 因走廊偏差太大，也允许配置用 hinge。
            insert_ref = cfg.get("door_insert_reference", "bbox_center")
            if insert_ref == "hinge":
                insert_info = hinge_info
            elif insert_ref == "mid_kp":
                mid_kp = XYZ((hinge_pt.X + leaf_end_pt.X) * 0.5, (hinge_pt.Y + leaf_end_pt.Y) * 0.5, 0)
                tmp = get_wall_projection_info_2d(curve, mid_kp)
                insert_info = tmp if tmp else bbox_info
            else:
                insert_info = bbox_info

            if insert_info is None:
                continue

            insert_proj = insert_info["proj"]
            insert_inside = insert_info["inside"]
            insert_end_clearance = insert_info["end_clearance"]

            inside_score = 1.0 if insert_inside else -4.0

            # 靠近墙端会导致 cut wall 失败，但不直接全部剔除，先降权。
            clearance_score = clamp(insert_end_clearance / max(min_clearance, 1e-6), 0.0, 1.0)

            if insert_inside and insert_end_clearance < min_clearance:
                end_penalty = -4.0
            elif not insert_inside:
                end_penalty = -8.0
            else:
                end_penalty = 0.0

            # hinge 点比 bbox 中心更可靠，尤其是走廊门。
            score = (
                perp_score * 10.0
                - hinge_dist * 3.5
                - bbox_dist * 1.0
                - min(end_dist, max_dist_ft) * 0.25
                + inside_score * 3.0
                + clearance_score * 2.5
                + end_penalty
            )

            candidates.append({
                "wall": wall,
                "curve": curve,
                "wall_dir": wall_dir,
                "wall_nrm": wall_nrm,
                "wall_len": wall_len,
                "hinge_dist": hinge_dist,
                "bbox_dist": bbox_dist,
                "end_dist": end_dist,
                "hinge_proj": hinge_info["proj"],
                "bbox_proj": bbox_info["proj"],
                "insert_proj": insert_proj,
                "insert_inside": insert_inside,
                "insert_end_clearance": insert_end_clearance,
                "perp_score": perp_score,
                "clearance_score": clearance_score,
                "score": score,
                "wall_id": wall.Id.IntegerValue
            })

        except:
            continue

    candidates.sort(key=lambda x: x["score"], reverse=True)
    return candidates


def serialize_wall_candidate(c):
    return {
        "wall_id": c["wall_id"],
        "score": c["score"],
        "perp_score": c["perp_score"],
        "hinge_dist": c["hinge_dist"],
        "bbox_dist": c["bbox_dist"],
        "end_dist": c["end_dist"],
        "wall_len": c["wall_len"],
        "insert_inside": c["insert_inside"],
        "insert_end_clearance": c["insert_end_clearance"],
        "clearance_score": c["clearance_score"],
        "hinge_proj_xyz": [c["hinge_proj"].X, c["hinge_proj"].Y, c["hinge_proj"].Z],
        "bbox_proj_xyz": [c["bbox_proj"].X, c["bbox_proj"].Y, c["bbox_proj"].Z],
        "insert_proj_xyz": [c["insert_proj"].X, c["insert_proj"].Y, c["insert_proj"].Z],
        "wall_dir_xyz": [c["wall_dir"].X, c["wall_dir"].Y, c["wall_dir"].Z],
        "wall_normal_xyz": [c["wall_nrm"].X, c["wall_nrm"].Y, c["wall_nrm"].Z]
    }


def build_insert_point_from_candidate(c, cfg):
    offset_along_ft = float(cfg.get("door_insert_offset_along_ft", 0.0))
    offset_normal_ft = float(cfg.get("door_insert_offset_normal_ft", 0.0))

    insert_pt = xyz_add(
        xyz_add(c["insert_proj"], xyz_mul(c["wall_dir"], offset_along_ft)),
        xyz_mul(c["wall_nrm"], offset_normal_ft)
    )

    return insert_pt


# ============================================================
# 临时试放：候选墙 + flip + 真实几何评分
# ============================================================
def test_place_door_on_candidate(
    doc,
    level,
    symbol,
    candidate,
    insert_pt,
    hinge_pt,
    leaf_end_pt,
    leaf_dir,
    door_width_ft
):
    sub = SubTransaction(doc)
    inst = None

    result = {
        "candidate": serialize_wall_candidate(candidate),
        "insert_xyz": [insert_pt.X, insert_pt.Y, insert_pt.Z],
        "ok": False,
        "error": None,
        "best_score": -1e9,
        "best_state": None,
        "best_eval_debug": None,
        "state_evals": []
    }

    try:
        sub.Start()

        inst = place_hosted_door_instance(
            doc,
            level,
            symbol,
            candidate["wall"],
            insert_pt
        )

        doc.Regenerate()

        flip_states = get_candidate_flip_states(inst)
        if len(flip_states) == 0:
            flip_states = [get_flip_state(inst)]

        best_score = -1e9
        best_state = get_flip_state(inst)
        best_eval_dbg = None
        state_evals = []

        for target_hand, target_facing in flip_states:
            ok, changed = set_flip_state(inst, target_hand, target_facing)
            doc.Regenerate()

            if not ok:
                state_evals.append({
                    "tested_state": {
                        "target_hand_flipped": target_hand,
                        "target_facing_flipped": target_facing,
                        "changed_ops": changed
                    },
                    "reason": "set_flip_state_failed"
                })
                continue

            score, eval_dbg = evaluate_door_actual_geometry_state(
                doc,
                inst,
                insert_pt,
                candidate["wall_dir"],
                hinge_pt,
                leaf_end_pt,
                leaf_dir,
                door_width_ft
            )

            eval_dbg["tested_state"] = {
                "target_hand_flipped": target_hand,
                "target_facing_flipped": target_facing,
                "changed_ops": changed
            }

            try:
                eval_dbg["hand_orientation_xyz"] = [
                    inst.HandOrientation.X,
                    inst.HandOrientation.Y,
                    inst.HandOrientation.Z
                ]
            except:
                eval_dbg["hand_orientation_xyz"] = None

            try:
                eval_dbg["facing_orientation_xyz"] = [
                    inst.FacingOrientation.X,
                    inst.FacingOrientation.Y,
                    inst.FacingOrientation.Z
                ]
            except:
                eval_dbg["facing_orientation_xyz"] = None

            try:
                eval_dbg["hand_flipped"] = inst.HandFlipped
            except:
                eval_dbg["hand_flipped"] = None

            try:
                eval_dbg["facing_flipped"] = inst.FacingFlipped
            except:
                eval_dbg["facing_flipped"] = None

            state_evals.append(eval_dbg)

            if score > best_score:
                best_score = score
                best_state = (target_hand, target_facing)
                best_eval_dbg = eval_dbg

        result["ok"] = True
        result["best_score"] = best_score
        result["best_state"] = best_state
        result["best_eval_debug"] = best_eval_dbg
        result["state_evals"] = state_evals

        sub.RollBack()

    except Exception as e:
        result["ok"] = False
        result["error"] = str(e)

        try:
            if sub.HasStarted():
                sub.RollBack()
        except:
            pass

    return result


def create_final_door_on_candidate(
    doc,
    level,
    symbol,
    candidate,
    insert_pt,
    best_state
):
    inst = place_hosted_door_instance(
        doc,
        level,
        symbol,
        candidate["wall"],
        insert_pt
    )
    doc.Regenerate()

    if best_state is not None:
        set_flip_state(inst, best_state[0], best_state[1])
        doc.Regenerate()

    return inst


# ============================================================
# 门处理：宿主墙候选评分 + 真实几何匹配 + 失败回退
# ============================================================
def process_door_instance(
    doc,
    level,
    symbol,
    cls_name,
    bbox,
    kp_start_pt,
    kp_end_pt,
    cfg,
    logs,
    debug_tag="door"
):
    x1, y1, x2, y2 = bbox
    cx = (x1 + x2) * 0.5
    cy = (y1 + y2) * 0.5

    bbox_center_pt = pix_to_revit(cx, cy)

    if kp_start_pt is None or kp_end_pt is None:
        raise Exception("门缺少关键点，无法放置")

    # 默认 kp_start = DoorS / hinge，kp_end = DoorE / leaf end
    hinge_pt = kp_start_pt
    leaf_end_pt = kp_end_pt

    leaf_dir = xyz_norm2d(xyz_sub(leaf_end_pt, hinge_pt))
    if leaf_dir is None:
        raise Exception("门关键点方向无效")

    door_width_ft = get_symbol_width_ft(symbol)

    if door_width_ft is None or door_width_ft < 1e-6:
        pt_x1 = pix_to_revit(x1, y1)
        pt_x2 = pix_to_revit(x2, y1)
        pt_y2 = pix_to_revit(x1, y2)

        bbox_w_ft = abs(pt_x2.X - pt_x1.X)
        bbox_h_ft = abs(pt_y2.Y - pt_x1.Y)

        door_width_ft = min(max(min(bbox_w_ft, bbox_h_ft), 2.0), 4.0)
        logs.append("{} 使用bbox估计门宽: {:.3f} ft".format(debug_tag, door_width_ft))
    else:
        logs.append("{} 读取门族默认宽度: {:.3f} ft".format(debug_tag, door_width_ft))

    candidates = get_best_door_host_wall_candidates(
        doc,
        bbox_center_pt,
        hinge_pt,
        leaf_end_pt,
        leaf_dir,
        door_width_ft,
        cfg
    )

    try_count = int(cfg.get("door_try_candidate_count", 8))
    candidates_to_try = candidates[:max(1, try_count)]

    if len(candidates_to_try) == 0:
        raise Exception("未找到合格门宿主墙候选")

    test_results = []
    best_test = None
    best_candidate = None
    best_insert_pt = None

    for c in candidates_to_try:
        insert_pt = build_insert_point_from_candidate(c, cfg)

        test_result = test_place_door_on_candidate(
            doc,
            level,
            symbol,
            c,
            insert_pt,
            hinge_pt,
            leaf_end_pt,
            leaf_dir,
            door_width_ft
        )

        test_results.append(test_result)

        if not test_result["ok"]:
            continue

        # 组合评分：
        # 墙候选本身分 + 实际门板几何分。
        # 如果实际几何读不到，best_score 会很低，不会被选中。
        combined_score = c["score"] + test_result["best_score"] * 1.5
        test_result["combined_score"] = combined_score

        if best_test is None or combined_score > best_test.get("combined_score", -1e9):
            best_test = test_result
            best_candidate = c
            best_insert_pt = insert_pt

    if best_test is None or best_candidate is None or best_insert_pt is None:
        raise Exception("所有候选墙试放失败: {}".format(str(test_results)))

    # 正式创建最终门
    final_inst = None
    final_error = None

    # 先试最佳；若正式创建仍失败，继续按综合分排序的其他候选回退
    ok_tests = []
    for idx, tr in enumerate(test_results):
        if tr.get("ok", False):
            ok_tests.append((idx, tr.get("combined_score", -1e9), tr))

    ok_tests.sort(key=lambda x: x[1], reverse=True)

    final_candidate = None
    final_insert_pt = None
    final_test = None

    for idx, score, tr in ok_tests:
        c = candidates_to_try[idx]
        insert_pt = build_insert_point_from_candidate(c, cfg)
        best_state = tr.get("best_state", None)

        try:
            final_inst = create_final_door_on_candidate(
                doc,
                level,
                symbol,
                c,
                insert_pt,
                best_state
            )

            final_candidate = c
            final_insert_pt = insert_pt
            final_test = tr
            final_error = None
            break

        except Exception as e:
            final_error = str(e)
            try:
                if final_inst is not None:
                    doc.Delete(final_inst.Id)
                    doc.Regenerate()
            except:
                pass
            final_inst = None
            continue

    if final_inst is None:
        raise Exception("正式创建门失败: {}".format(final_error))

    return final_inst, {
        "match_method": "host_wall_candidates_plus_actual_instance_plan_geometry",
        "door_width_ft": door_width_ft,
        "bbox_px": [float(x1), float(y1), float(x2), float(y2)],
        "bbox_center_xyz": [bbox_center_pt.X, bbox_center_pt.Y, bbox_center_pt.Z],
        "kp_start_xyz": [kp_start_pt.X, kp_start_pt.Y, kp_start_pt.Z],
        "kp_end_xyz": [kp_end_pt.X, kp_end_pt.Y, kp_end_pt.Z],
        "hinge_pt_xyz": [hinge_pt.X, hinge_pt.Y, hinge_pt.Z],
        "leaf_end_pt_xyz": [leaf_end_pt.X, leaf_end_pt.Y, leaf_end_pt.Z],
        "leaf_dir_xyz": [leaf_dir.X, leaf_dir.Y, leaf_dir.Z],
        "candidate_count": len(candidates),
        "tried_candidate_count": len(candidates_to_try),
        "top_candidates": [serialize_wall_candidate(c) for c in candidates_to_try],
        "test_results": test_results,
        "selected_candidate": serialize_wall_candidate(final_candidate),
        "selected_insert_xyz": [final_insert_pt.X, final_insert_pt.Y, final_insert_pt.Z],
        "selected_best_state": final_test.get("best_state", None),
        "selected_best_score": final_test.get("best_score", None),
        "selected_combined_score": final_test.get("combined_score", None),
        "selected_best_eval_debug": final_test.get("best_eval_debug", None),
        "selected_state_evals": final_test.get("state_evals", None),
        "final_instance_id": final_inst.Id.IntegerValue
    }


# ============================================================
# 读取配置
# ============================================================
CLASS_CONFIG = load_class_config(class_config_json_path, logs)


# ============================================================
# 读取 seg_meta
# ============================================================
seg_meta = load_seg_meta(seg_meta_json_path, logs)

if seg_meta and seg_meta.get("ok", False):
    try:
        bbox_info = seg_meta.get("wall_bbox_px", None)
        scale_info = seg_meta.get("scale", {})
        dbg = seg_meta.get("debug", {})

        if bbox_info:
            bbox_min_x = bbox_info.get("min_x", None)
            bbox_min_y = bbox_info.get("min_y", None)
            bbox_width = bbox_info.get("width", None)
            bbox_height = bbox_info.get("height", None)

        scale_x_ft_per_px = scale_info.get("scale_x_ft_per_px", None)
        scale_y_ft_per_px = scale_info.get("scale_y_ft_per_px", None)

        if "pixelWidth" in dbg and "pixelHeight" in dbg:
            pixelWidth = dbg.get("pixelWidth", pixelWidth)
            pixelHeight = dbg.get("pixelHeight", pixelHeight)

        logs.append("bbox_info={}".format(str(bbox_info)))
        logs.append("scale_x_ft_per_px={}".format(str(scale_x_ft_per_px)))
        logs.append("scale_y_ft_per_px={}".format(str(scale_y_ft_per_px)))
        logs.append("pixelWidth={}, pixelHeight={}".format(pixelWidth, pixelHeight))

    except Exception as e:
        logs.append("解析seg_meta失败: {}".format(str(e)))
else:
    logs.append("seg_meta无效，使用fallback整图scale")


# ============================================================
# YOLO Pose
# ============================================================
yolo_pose = YOLO(pose_Model, task="pose")
newpath = "E:/yanjiu/revitss/tests/jjianzhu_pose.jpg"

pose_results = yolo_pose(
    source=pixpath,
    save=False,
    conf=0.3,
    iou=0.45,
    imgsz=640
)

cv2.imwrite(newpath, pose_results[0].plot())

result = pose_results[0]
boxes = result.boxes.xyxy.cpu().numpy() if result.boxes is not None else []
cls_ids = result.boxes.cls.cpu().numpy().astype(int) if result.boxes is not None else []
confs = result.boxes.conf.cpu().numpy() if result.boxes is not None else []
names = result.names

kps_xy = None
if result.keypoints is not None and result.keypoints.xy is not None:
    kps_xy = result.keypoints.xy.cpu().numpy()


# ============================================================
# Revit 文档
# ============================================================
doc = DocumentManager.Instance.CurrentDBDocument

TransactionManager.Instance.EnsureInTransaction(doc)

level = get_level(doc)
symbol_lookup = build_symbol_lookup(doc)

bed_median_area, bed_min_area = compute_class_area_threshold(
    boxes,
    cls_ids,
    names,
    "Bed",
    0.33
)

created_instances = []
debug_info = []
missing_family_types = []
skipped_unconfigured_classes = []


# 预激活符号
for cls_name, cfg in CLASS_CONFIG.items():
    symbol = get_symbol_from_lookup(
        symbol_lookup,
        cfg.get("family_name"),
        cfg.get("type_name")
    )
    if symbol:
        ensure_symbol_active(doc, symbol)


# ============================================================
# 主循环
# ============================================================
for i, bbox in enumerate(boxes):
    cls_name = names[int(cls_ids[i])] if len(cls_ids) > i else ""
    conf = confs[i] if len(confs) > i else 0.0

    if cls_name not in CLASS_CONFIG:
        skipped_unconfigured_classes.append({
            "index": i,
            "class": cls_name,
            "reason": "class_not_configured"
        })
        continue

    cfg = CLASS_CONFIG[cls_name]

    family_name = cfg.get("family_name")
    type_name = cfg.get("type_name")
    need_rotate = cfg.get("rotate", False)
    family_default_axis = cfg.get("family_default_axis", "Y")
    placement_mode = cfg.get("placement_mode", "free")

    symbol = get_symbol_from_lookup(symbol_lookup, family_name, type_name)

    if symbol is None:
        missing_family_types.append({
            "index": i,
            "class": cls_name,
            "family_name": family_name,
            "type_name": type_name,
            "reason": "family_symbol_not_found"
        })
        continue

    x1, y1, x2, y2 = bbox
    cx = (x1 + x2) * 0.5
    cy = (y1 + y2) * 0.5
    center_pt = pix_to_revit(cx, cy)

    area = max(0, x2 - x1) * max(0, y2 - y1)

    if cfg.get("area_filter", False):
        if cls_name == "Bed" and bed_min_area > 0 and area < bed_min_area:
            debug_info.append({
                "index": i,
                "class": cls_name,
                "reason": "filtered_small_area",
                "area": float(area),
                "threshold": float(bed_min_area)
            })
            continue

    start_pt = None
    end_pt = None

    if kps_xy is not None and i < len(kps_xy):
        kp_start_idx = cfg.get("kp_start_idx", None)
        kp_end_idx = cfg.get("kp_end_idx", None)

        kp = kps_xy[i]

        if kp_start_idx is not None and kp_end_idx is not None and len(kp) > max(kp_start_idx, kp_end_idx):
            sx, sy = kp[kp_start_idx]
            ex, ey = kp[kp_end_idx]
            start_pt = pix_to_revit(sx, sy)
            end_pt = pix_to_revit(ex, ey)

    # ------------------------------
    # 门：宿主墙候选评分 + 试放回退 + 实际几何匹配
    # ------------------------------
    if placement_mode == "door_hosted":
        try:
            inst, door_dbg = process_door_instance(
                doc,
                level,
                symbol,
                cls_name,
                bbox,
                start_pt,
                end_pt,
                cfg,
                logs,
                debug_tag="door_{}_{}".format(i, cls_name)
            )

            created_instances.append(inst.ToDSType(False))

            debug_info.append({
                "index": i,
                "class": cls_name,
                "family_name": family_name,
                "type_name": type_name,
                "placement_mode": "door_hosted",
                "bbox_px": [float(x1), float(y1), float(x2), float(y2)],
                "area": float(area),
                "conf": float(conf),
                "door_debug": door_dbg
            })

        except Exception as e:
            debug_info.append({
                "index": i,
                "class": cls_name,
                "family_name": family_name,
                "type_name": type_name,
                "placement_mode": "door_hosted",
                "reason": "door_place_failed",
                "error": str(e),
                "bbox_px": [float(x1), float(y1), float(x2), float(y2)],
                "kp_start_xyz": [start_pt.X, start_pt.Y, start_pt.Z] if start_pt else None,
                "kp_end_xyz": [end_pt.X, end_pt.Y, end_pt.Z] if end_pt else None
            })

        continue

    # ------------------------------
    # 普通自由族
    # ------------------------------
    try:
        instance = create_family_instance(doc, center_pt, symbol, level)
    except Exception as e:
        debug_info.append({
            "index": i,
            "class": cls_name,
            "reason": "create_instance_failed",
            "error": str(e)
        })
        continue

    rotated = False
    angle = None

    if need_rotate:
        if start_pt is not None and end_pt is not None:
            angle = get_angle_from_keypoints(start_pt, end_pt, family_default_axis)

            if angle is not None:
                try:
                    rotate_instance(doc, instance, center_pt, angle)
                    rotated = True
                except Exception as e:
                    debug_info.append({
                        "index": i,
                        "class": cls_name,
                        "reason": "rotate_failed",
                        "error": str(e)
                    })
            else:
                debug_info.append({
                    "index": i,
                    "class": cls_name,
                    "reason": "zero_direction_vector"
                })
        else:
            debug_info.append({
                "index": i,
                "class": cls_name,
                "reason": "no_keypoints_for_rotation"
            })

    created_instances.append(instance.ToDSType(False))

    debug_info.append({
        "index": i,
        "class": cls_name,
        "family_name": family_name,
        "type_name": type_name,
        "placement_mode": "free",
        "center_xyz": [center_pt.X, center_pt.Y, center_pt.Z],
        "bbox_px": [float(x1), float(y1), float(x2), float(y2)],
        "area": float(area),
        "rotated": rotated,
        "angle_rad": angle,
        "angle_deg": angle * 180.0 / math.pi if angle is not None else None,
        "conf": float(conf),
        "kp_start_xyz": [start_pt.X, start_pt.Y, start_pt.Z] if start_pt else None,
        "kp_end_xyz": [end_pt.X, end_pt.Y, end_pt.Z] if end_pt else None
    })


# ============================================================
# 提交
# ============================================================
TransactionManager.Instance.TransactionTaskDone()
doc.Regenerate()


OUT = {
    "preview_image": newpath,
    "created_instances": created_instances,
    "debug_info": debug_info,
    "missing_family_types": missing_family_types,
    "skipped_unconfigured_classes": skipped_unconfigured_classes,
    "bed_area_threshold": {
        "median_area": bed_median_area,
        "min_area": bed_min_area
    },
    "seg_meta_json_path": seg_meta_json_path,
    "class_config_json_path": class_config_json_path,
    "logs": logs
}
# ----------------------------------------
python_version_11 = Watch(python_script_10)  # graph output
python_version_12 = CodeBlock(i=python_version_11) { i["preview_image"]; }
file_from_path_7 = FileObject(path=python_version_12)
readFromFile_7 = Image.ReadFromFile(file=file_from_path_7)
watch_image_7 = WatchImageCore(image=readFromFile_7)
python_script_11 = Python(IN[0]=modelpath_2, IN[1]=imagepath_2, IN[2]=number, IN[3]=scale)  # CPython3; frozen
# ---------- python_script_11.python (996 lines) ----------
# 加载 Python  Standard 和 DesignScript 库
import sys
import clr
clr.AddReference('ProtoGeometry')
from Autodesk.DesignScript.Geometry import *
import Autodesk.DesignScript.Geometry as DS
import Revit
from Revit.Elements import *
import System
sys.path.append("C:/Users/Lenovo/anaconda3/envs/revitenv/Lib/site-packages")
clr.AddReference('RevitAPI')
clr.AddReference('RevitAPIUI')
from Autodesk.Revit.DB import *
from Autodesk.Revit.UI import *

clr.AddReference('RevitServices')
from RevitServices.Persistence import DocumentManager
from RevitServices.Transactions import TransactionManager

clr.AddReference('RevitNodes')
import Revit
clr.ImportExtensions(Revit.Elements)
clr.ImportExtensions(Revit.GeometryConversion)
#
import re
import math
from scipy.spatial import Voronoi
from shapely.geometry import Polygon, LineString, MultiLineString
from shapely.ops import linemerge
from shapely.ops import unary_union, split
from shapely.geometry import Point as ShpPoint
from scipy import ndimage
from skimage.morphology import skeletonize

import traceback
from shapely.geometry import Polygon as ShpPolygon
from shapely.geometry import MultiPolygon as ShpMultiPolygon
from shapely.geometry import Point as ShpPoint
from shapely.geometry import MultiLineString
from shapely.ops import linemerge
import numpy as np
import torch
import cv2
from ultralytics import YOLO

dataEnteringNode = IN 
dect_Model = IN[0]
pixpath = IN[1]
height = IN[2]
scale = IN[3]
#params
origin = XYZ(0, 0, 0)   
widthFt = scale
pixelWidth = 1600   
pixelHeight = 1200 
DENSIFY_DIST = 0.5  
EPS = 1e-6
#
TARGET_WALL_TYPE_NAME = "基本墙 200mm"   # 项目中存在的墙类型名称
TARGET_LEVEL_NAME = "标高 2"                            
#                         
yolo_seg = YOLO(dect_Model,task = "seg")
newpath = "E:/yanjiu/revitss/tests/jjianzhu_seg.jpg"

seg_result = yolo_seg(source = pixpath,save = False,conf = 0.3,iou = 0.45,imgsz = 640)
cv2.imwrite(newpath,seg_result[0].plot())
#tempouts = []
#tempouts.append(newpath)
#tempouts.extend(dect_result)
scaleX = widthFt / pixelWidth
scaleY = widthFt * (pixelHeight / pixelWidth) / pixelHeight  

result = seg_result[0]        
boxes = result.boxes
xyxy = boxes.xyxy.cpu().numpy() 
cls_ids = boxes.cls.cpu().numpy().astype(int)  # 类别索引 (N,)
names = result.names  

doc = DocumentManager.Instance.CurrentDBDocument
app = doc.Application
TransactionManager.Instance.EnsureInTransaction(doc)

# 按名称查找
wall_type = None
wall_type_collector = FilteredElementCollector(doc).OfClass(WallType)

# 先按名称查找基本 墙
for wt in wall_type_collector:
    if wt.Kind == WallKind.Basic:  # 只考虑基本墙
        name_param = wt.get_Parameter(BuiltInParameter.SYMBOL_NAME_PARAM)
        if name_param and name_param.AsString() == TARGET_WALL_TYPE_NAME:
            wall_type = wt
            break

# 如果没找到指定名称的基本墙，则取第一个基本墙
if wall_type is None:
    for wt in wall_type_collector:
        if wt.Kind == WallKind.Basic:
            wall_type = wt
            break

if wall_type is None:
    raise Exception("项目中找不到任何基本墙类型！")

# --- 获取目标标高 ---
level = None
level_collector = FilteredElementCollector(doc).OfClass(Level)
for lvl in level_collector:
    # 标高名称参数
    name_param = lvl.get_Parameter(BuiltInParameter.LEVEL_NAME)
    if name_param and name_param.AsString() == TARGET_LEVEL_NAME:
        level = lvl
        break
if level is None:
    level = level_collector.FirstElement()
    if level is None:
        raise Exception("项目中找不到任何标高！")


TransactionManager.Instance.EnsureInTransaction(doc)

created_lines = []
dyn_lines = []
dyn_faces = [] 
created_shapes = []
created_walls = []
wall_candidates = []

logs = []

thickness = height
wallHeight = height

def pix_to_revit(x, y):
    revit_x = origin.X + x * scaleX
    revit_y = origin.Y + (pixelHeight - y) * scaleY  # 翻转 Y 轴
    return XYZ(revit_x, revit_y, origin.Z)
def sanitize_name(name):
    # 如果名称为空，返回默认名称
    if not name:
        return "Unknown"
    # 移除控制字符（ASCII 0-31，除了tab? 但最好全部移除）
    # 允许常见字符：字母、数字、空格、下划线、连字符、中文等
    # 保留所有打印字符，移除控制字符
    cleaned = re.sub(r'[\x00-\x1f\x7f]', '', name)
    # 如果清理后为空，则返回默认名
    if not cleaned.strip():
        return "Unnamed"
    return cleaned
##
EPS = 1e-6

# 你必须根据自己的模型类别名修改这里
# 比如如果你的墙类别是 "wall" 或 "墙体" 或 "wall_line"，就在这里加上
WALL_CLASS_NAMES = set(["wall", "Wall", "墙体"])
WALL_CLASS_KEYWORDS = [
    "wall",
    "Wall",
    "basic wall",
    "bearing wall",
    "non-bearing wall",
    "shear wall",
    "墙",
    "墙体",
    "基本墙",
    "基本墙 200mm",
    "承重墙",
    "非承重墙",
    "剪力墙"
]

def normalize_class_name(name):
    if name is None:
        return ""
    return str(name).strip().lower()

def is_wall_class(name):
    n = normalize_class_name(name)
    if not n:
        return False
    for kw in WALL_CLASS_KEYWORDS:
        if kw.lower() in n:
            return True
    return False
    

def ensure_polygon(geom):
    """
    将 geometry 尽量转成一个有效 Polygon
    如果是 MultiPolygon，则取面积最大的一个
    """
    if geom is None or geom.is_empty:
        return None
    try:
        if not geom.is_valid:
            geom = geom.buffer(0)
    except:
        pass
    if geom is None or geom.is_empty:
        return None

    if isinstance(geom, ShpPolygon):
        return geom

    if isinstance(geom, ShpMultiPolygon):
        polys = [g for g in geom.geoms if g is not None and not g.is_empty]
        if not polys:
            return None
        polys.sort(key=lambda p: p.area, reverse=True)
        return polys[0]

    return None

def contour_to_polygon(contour_pts):
    """
    contour_pts: YOLO mask contour pixel points
    转成shapely polygon（Revit坐标系）
    """
    revit_pts = [pix_to_revit(pt[0], pt[1]) for pt in contour_pts]
    if len(revit_pts) < 3:
        return None
    coords = [(p.X, p.Y) for p in revit_pts]
    if coords[0] != coords[-1]:
        coords.append(coords[0])
    poly = ShpPolygon(coords)
    poly = ensure_polygon(poly)
    return poly

def line_long_enough(line_geom, min_len=0.1):
    if line_geom is None or line_geom.is_empty:
        return False
    try:
        return line_geom.length >= min_len
    except:
        return False

def snap_line_to_axis(line_geom):
    """
    对线段做水平/垂直吸附，作为 Lalignment 的工程近似
    """
    if line_geom is None or line_geom.is_empty:
        return None
    coords = list(line_geom.coords)
    if len(coords) < 2:
        return None
    x1, y1 = coords[0]
    x2, y2 = coords[-1]
    dx = x2 - x1
    dy = y2 - y1
    if abs(dx) >= abs(dy):
        ym = 0.5 * (y1 + y2)
        return LineString([(x1, ym), (x2, ym)])
    else:
        xm = 0.5 * (x1 + x2)
        return LineString([(xm, y1), (xm, y2)])

def longest_linestring_from_intersection(inter):
    """
    从 intersection 结果中取最长的 LineString
    """
    if inter is None or inter.is_empty:
        return None
    if inter.geom_type == "LineString":
        return inter
    if inter.geom_type == "MultiLineString":
        lines = [g for g in inter.geoms if g.length > 1e-4]
        if not lines:
            return None
        lines.sort(key=lambda g: g.length, reverse=True)
        return lines[0]
    return None

def estimate_centerline_from_polygon(poly):
    """
    稳定版中心线初始化：
    1) 取最小外接旋转矩形
    2) 判断主方向
    3) 通过polygon质心沿主方向打一条长线
    4) 与polygon求交得到中心段
    5) 用 area / centerline_length 估计厚度
    """
    if poly is None or poly.is_empty:
        return None, None

    poly = ensure_polygon(poly)
    if poly is None:
        return None, None

    if poly.area < 1e-5:
        return None, None

    try:
        mrr = poly.minimum_rotated_rectangle
    except:
        return None, None

    mrr = ensure_polygon(mrr)
    if mrr is None:
        return None, None

    rect_coords = list(mrr.exterior.coords)[:-1]
    if len(rect_coords) != 4:
        return None, None

    edges = []
    for i in range(4):
        p1 = rect_coords[i]
        p2 = rect_coords[(i + 1) % 4]
        length = ((p2[0]-p1[0])**2 + (p2[1]-p1[1])**2) ** 0.5
        edges.append((p1, p2, length))

    # 按边长排序
    edges_sorted = sorted(edges, key=lambda e: e[2], reverse=True)
    long_edge = edges_sorted[0]
    short_edge = edges_sorted[-1]

    long_len = long_edge[2]
    short_len = short_edge[2]

    if long_len < 0.1:
        return None, None

    # 主方向
    p1, p2, _ = long_edge
    dx = p2[0] - p1[0]
    dy = p2[1] - p1[1]
    norm = (dx*dx + dy*dy) ** 0.5
    if norm < EPS:
        return None, None
    ux = dx / norm
    uy = dy / norm

    # 过质心打一条足够长的线
    c = poly.centroid
    minx, miny, maxx, maxy = poly.bounds
    diag = ((maxx-minx)**2 + (maxy-miny)**2) ** 0.5 + 10.0

    raw_line = LineString([
        (c.x - ux * diag, c.y - uy * diag),
        (c.x + ux * diag, c.y + uy * diag)
    ])

    # 与polygon相交，取最长线段作为中心线
    inter = raw_line.intersection(poly)
    centerline = longest_linestring_from_intersection(inter)
    if centerline is None:
        return None, None

    centerline = snap_line_to_axis(centerline)
    if centerline is None or centerline.length < 0.1:
        return None, None

    # 厚度估计：面积 / 中心线长度
    thickness = poly.area / max(centerline.length, EPS)

    # 防止异常值
    if thickness < 0.05:
        thickness = 0.05
    if thickness > 2.0:
        thickness = 2.0

    return centerline, thickness

def merge_close_vertices(segments, delta):
    """
    论文4.5 condition x:
    两节点距离 < δx，则合并
    对线段端点进行统一吸附
    """
    pts = []
    for seg in segments:
        coords = list(seg['line'].coords)
        pts.append(coords[0])
        pts.append(coords[-1])

    if not pts:
        return segments

    clusters = []
    for p in pts:
        assigned = False
        for cluster in clusters:
            cx, cy, plist = cluster
            d2 = (p[0]-cx)**2 + (p[1]-cy)**2
            if d2 < delta * delta:
                plist.append(p)
                nx = sum(pp[0] for pp in plist) / len(plist)
                ny = sum(pp[1] for pp in plist) / len(plist)
                cluster[0] = nx
                cluster[1] = ny
                assigned = True
                break
        if not assigned:
            clusters.append([p[0], p[1], [p]])

    def snap_point(p):
        best = p
        best_d = 1e18
        for cx, cy, plist in clusters:
            d2 = (p[0]-cx)**2 + (p[1]-cy)**2
            if d2 < best_d:
                best_d = d2
                best = (cx, cy)
        return best

    new_segments = []
    for seg in segments:
        coords = list(seg['line'].coords)
        p1 = snap_point(coords[0])
        p2 = snap_point(coords[-1])
        if ((p1[0]-p2[0])**2 + (p1[1]-p2[1])**2) ** 0.5 < 0.1:
            continue
        new_line = LineString([p1, p2])
        new_segments.append({
            'line': snap_line_to_axis(new_line),
            'thickness': seg['thickness'],
            'name': seg['name']
        })
    return new_segments

def point_to_segment_distance(pt, a, b):
    """
    点到线段距离
    """
    px, py = pt
    ax, ay = a
    bx, by = b
    dx = bx - ax
    dy = by - ay
    if abs(dx) < EPS and abs(dy) < EPS:
        return ((px-ax)**2 + (py-ay)**2)**0.5, a, 0.0

    t = ((px-ax)*dx + (py-ay)*dy) / (dx*dx + dy*dy)
    t_clamped = max(0.0, min(1.0, t))
    qx = ax + t_clamped * dx
    qy = ay + t_clamped * dy
    dist = ((px-qx)**2 + (py-qy)**2)**0.5
    return dist, (qx, qy), t_clamped

def split_segments_by_near_vertices(segments, delta):
    """
    论文4.5 condition y:
    若顶点到边距离 < δy，则把点插入边
    """
    if not segments:
        return segments

    vertices = []
    for seg in segments:
        coords = list(seg['line'].coords)
        vertices.append(coords[0])
        vertices.append(coords[-1])

    new_segments = []
    for idx, seg in enumerate(segments):
        coords = list(seg['line'].coords)
        a = coords[0]
        b = coords[-1]
        split_pts = []

        for v in vertices:
            if v == a or v == b:
                continue
            dist, proj, t = point_to_segment_distance(v, a, b)
            if dist < delta and t > 0.01 and t < 0.99:
                split_pts.append((t, v))

        if not split_pts:
            new_segments.append(seg)
        else:
            split_pts.sort(key=lambda x: x[0])
            chain = [a] + [v for _, v in split_pts] + [b]
            for p1, p2 in zip(chain[:-1], chain[1:]):
                if ((p1[0]-p2[0])**2 + (p1[1]-p2[1])**2) ** 0.5 < 0.1:
                    continue
                new_line = snap_line_to_axis(LineString([p1, p2]))
                new_segments.append({
                    'line': new_line,
                    'thickness': seg['thickness'],
                    'name': seg['name']
                })
    return new_segments

def merge_collinear_segments(segments, gap_tol=0.3):
    """
    合并同一直线上的相邻短线段
    """
    if not segments:
        return segments

    horizontal = []
    vertical = []
    others = []

    for seg in segments:
        coords = list(seg['line'].coords)
        x1, y1 = coords[0]
        x2, y2 = coords[-1]
        if abs(y2 - y1) < 1e-6:
            xmin = min(x1, x2)
            xmax = max(x1, x2)
            horizontal.append((y1, xmin, xmax, seg))
        elif abs(x2 - x1) < 1e-6:
            ymin = min(y1, y2)
            ymax = max(y1, y2)
            vertical.append((x1, ymin, ymax, seg))
        else:
            others.append(seg)

    result = []

    # 水平
    by_y = {}
    for y, xmin, xmax, seg in horizontal:
        yk = round(y, 3)
        by_y.setdefault(yk, []).append((xmin, xmax, seg))

    for yk, arr in by_y.items():
        arr.sort(key=lambda x: x[0])
        cur_x1, cur_x2, cur_seg = arr[0]
        thick = cur_seg['thickness']
        name = cur_seg['name']
        for nx1, nx2, nseg in arr[1:]:
            if nx1 <= cur_x2 + gap_tol:
                cur_x2 = max(cur_x2, nx2)
                thick = (thick + nseg['thickness']) / 2.0
            else:
                result.append({
                    'line': LineString([(cur_x1, yk), (cur_x2, yk)]),
                    'thickness': thick,
                    'name': name
                })
                cur_x1, cur_x2, cur_seg = nx1, nx2, nseg
                thick = cur_seg['thickness']
                name = cur_seg['name']
        result.append({
            'line': LineString([(cur_x1, yk), (cur_x2, yk)]),
            'thickness': thick,
            'name': name
        })

    # 垂直
    by_x = {}
    for x, ymin, ymax, seg in vertical:
        xk = round(x, 3)
        by_x.setdefault(xk, []).append((ymin, ymax, seg))

    for xk, arr in by_x.items():
        arr.sort(key=lambda x: x[0])
        cur_y1, cur_y2, cur_seg = arr[0]
        thick = cur_seg['thickness']
        name = cur_seg['name']
        for ny1, ny2, nseg in arr[1:]:
            if ny1 <= cur_y2 + gap_tol:
                cur_y2 = max(cur_y2, ny2)
                thick = (thick + nseg['thickness']) / 2.0
            else:
                result.append({
                    'line': LineString([(xk, cur_y1), (xk, cur_y2)]),
                    'thickness': thick,
                    'name': name
                })
                cur_y1, cur_y2, cur_seg = ny1, ny2, nseg
                thick = cur_seg['thickness']
                name = cur_seg['name']
        result.append({
            'line': LineString([(xk, cur_y1), (xk, cur_y2)]),
            'thickness': thick,
            'name': name
        })

    result.extend(others)
    return result

def optimize_wall_centerlines(candidates, iter_count=1, enable_merge_collinear=False):
    """
    更保守的4.5实现：
    - condition x: 近节点合并
    - condition y: 点靠近边则插入边
    - 默认不做共线合并，避免把不同墙段错误合并
    """
    if not candidates:
        return []

    segs = candidates[:]

    for _ in range(iter_count):
        if not segs:
            break

        avg_t = sum(s['thickness'] for s in segs) / max(len(segs), 1)

        # 这里把delta调小，避免误合并
        delta = 0.25 * avg_t
        if delta < 0.03:
            delta = 0.03
        if delta > 0.15:
            delta = 0.15

        segs = merge_close_vertices(segs, delta)
        segs = split_segments_by_near_vertices(segs, delta)

        if enable_merge_collinear:
            segs = merge_collinear_segments(segs, gap_tol=delta * 0.5)

    cleaned = []
    for s in segs:
        try:
            if s['line'] is None or s['line'].is_empty:
                continue
            if s['line'].length < 0.1:
                continue
            cleaned.append(s)
        except:
            continue

    return cleaned


def get_wall_type_by_name(doc, type_name):
    wall_type_collector = FilteredElementCollector(doc).OfClass(WallType)
    found = None
    for wt in wall_type_collector:
        if wt.Kind == WallKind.Basic:
            name_param = wt.get_Parameter(BuiltInParameter.SYMBOL_NAME_PARAM)
            if name_param and name_param.AsString() == type_name:
                found = wt
                break
    if found:
        return found
    for wt in wall_type_collector:
        if wt.Kind == WallKind.Basic:
            return wt
    return None
#@#
def build_global_wall_mask(result, pixelWidth, pixelHeight, logs):
    """
    将所有墙类mask合成为一张整体二值图
    返回 uint8 二值图，墙=255，背景=0
    """
    wall_mask = np.zeros((pixelHeight, pixelWidth), dtype=np.uint8)

    if result.masks is None:
        logs.append("result.masks is None")
        return wall_mask

    masks_xy = result.masks.xy
    cls_ids = result.boxes.cls.cpu().numpy().astype(int)
    names = result.names

    logs.append("总mask数量: {}".format(len(masks_xy)))

    for i, contour_pts in enumerate(masks_xy):
        try:
            if i >= len(cls_ids):
                continue
            class_id = cls_ids[i]
            class_name = names[class_id]

            if not is_wall_class(class_name):
                continue

            pts = np.array(contour_pts, dtype=np.int32)
            if len(pts) < 3:
                continue

            # 限制在图像范围内
            pts[:, 0] = np.clip(pts[:, 0], 0, pixelWidth - 1)
            pts[:, 1] = np.clip(pts[:, 1], 0, pixelHeight - 1)

            cv2.fillPoly(wall_mask, [pts], 255)

        except Exception as e:
            logs.append("合成墙mask失败 idx={}: {}".format(i, str(e)))
            continue

    return wall_mask
#--
def clean_wall_mask(binary_mask, logs):
    """
    形态学清理：
    - 闭运算补缝
    - 开运算去噪
    - 移除小连通域
    """
    mask = binary_mask.copy()

    kernel_close = cv2.getStructuringElement(cv2.MORPH_RECT, (5, 5))
    kernel_open = cv2.getStructuringElement(cv2.MORPH_RECT, (3, 3))

    mask = cv2.morphologyEx(mask, cv2.MORPH_CLOSE, kernel_close)
    mask = cv2.morphologyEx(mask, cv2.MORPH_OPEN, kernel_open)

    num_labels, labels, stats, _ = cv2.connectedComponentsWithStats(mask, connectivity=8)
    cleaned = np.zeros_like(mask)

    for i in range(1, num_labels):
        area = stats[i, cv2.CC_STAT_AREA]
        if area >= 50:  # 可调
            cleaned[labels == i] = 255

    logs.append("墙mask清理完成")
    return cleaned


def estimate_wall_width_pixels(binary_mask, logs):
    """
    用距离变换估计墙宽像素值
    厚度 ~= 2 * skeleton点处的距离变换值
    简化做法：用墙区域整体距离变换的中位数*2
    """
    if binary_mask is None or binary_mask.max() == 0:
        logs.append("墙宽估计失败：mask为空")
        return 6.0

    dist = cv2.distanceTransform(binary_mask, cv2.DIST_L2, 5)
    vals = dist[dist > 0]
    if len(vals) == 0:
        logs.append("墙宽估计失败：distanceTransform为空")
        return 6.0

    wall_width_px = max(2.0, 2.0 * np.median(vals))
    logs.append("估计墙宽像素值: {:.2f}".format(wall_width_px))
    return wall_width_px
#-
def skeletonize_wall_mask(binary_mask, logs):
    """
    骨架提取，返回0/1图
    """
    try:
        from skimage.morphology import skeletonize
        skel = skeletonize(binary_mask > 0)
        logs.append("使用 skimage.skeletonize 成功")
        return skel.astype(np.uint8)
    except Exception as e:
        logs.append("skimage骨架失败，改用fallback: {}".format(str(e)))
        return skeletonize_fallback(binary_mask, logs)
#-
def get_neighbors_8(x, y, w, h):
    nbs = []
    for dy in [-1, 0, 1]:
        for dx in [-1, 0, 1]:
            if dx == 0 and dy == 0:
                continue
            nx = x + dx
            ny = y + dy
            if 0 <= nx < w and 0 <= ny < h:
                nbs.append((nx, ny))
    return nbs


def extract_skeleton_graph(skel, logs):
    """
    从骨架图提取节点和边
    节点 = 度数 != 2 的骨架像素（端点或交点）
    边 = 节点之间的像素路径
    """
    h, w = skel.shape
    skel_pts = set()
    for y in range(h):
        xs = np.where(skel[y] > 0)[0]
        for x in xs:
            skel_pts.add((x, y))

    if not skel_pts:
        logs.append("骨架为空")
        return [], []

    degree = {}
    for (x, y) in skel_pts:
        cnt = 0
        for nx, ny in get_neighbors_8(x, y, w, h):
            if (nx, ny) in skel_pts:
                cnt += 1
        degree[(x, y)] = cnt

    nodes = [p for p, d in degree.items() if d != 2]

    # 如果没有明显节点（纯单线），取骨架端点或任意两个端点
    if not nodes:
        nodes = list(skel_pts)

    node_set = set(nodes)
    visited_edges = set()
    edges = []

    for node in nodes:
        x0, y0 = node
        for nx, ny in get_neighbors_8(x0, y0, w, h):
            if (nx, ny) not in skel_pts:
                continue

            edge_key = tuple(sorted([node, (nx, ny)]))
            if edge_key in visited_edges:
                continue

            path = [node, (nx, ny)]
            prev = node
            curr = (nx, ny)

            while True:
                visited_edges.add(tuple(sorted([prev, curr])))

                if curr in node_set and curr != node:
                    break

                nbrs = []
                for tx, ty in get_neighbors_8(curr[0], curr[1], w, h):
                    if (tx, ty) in skel_pts and (tx, ty) != prev:
                        nbrs.append((tx, ty))

                if len(nbrs) == 0:
                    break
                if len(nbrs) > 1:
                    # 到交点了
                    break

                nxt = nbrs[0]
                path.append(nxt)
                prev = curr
                curr = nxt

            if len(path) >= 2:
                edges.append(path)

    logs.append("骨架图提取完成: nodes={}, edges={}".format(len(nodes), len(edges)))
    return nodes, edges
#-
def simplify_path_to_axis_line(path, wall_width_px, logs):
    """
    将骨架路径简化成水平/垂直中心线
    """
    if not path or len(path) < 2:
        return None

    xs = [p[0] for p in path]
    ys = [p[1] for p in path]

    x1, x2 = min(xs), max(xs)
    y1, y2 = min(ys), max(ys)

    dx = x2 - x1
    dy = y2 - y1

    # 太短则跳过
    if max(dx, dy) < max(3, wall_width_px):
        return None

    if dx >= dy:
        # 水平墙
        y_mean = sum(ys) / float(len(ys))
        p1 = pix_to_revit(x1, y_mean)
        p2 = pix_to_revit(x2, y_mean)
    else:
        # 垂直墙
        x_mean = sum(xs) / float(len(xs))
        p1 = pix_to_revit(x_mean, y1)
        p2 = pix_to_revit(x_mean, y2)

    if p1.DistanceTo(p2) < 0.1:
        return None

    return LineString([(p1.X, p1.Y), (p2.X, p2.Y)])
#-
def extract_wall_centerlines_from_global_mask(result, pixelWidth, pixelHeight, logs):
    """
    全局墙图 -> 骨架 -> 中心线候选
    """
    wall_mask = build_global_wall_mask(result, pixelWidth, pixelHeight, logs)
    if wall_mask.max() == 0:
        logs.append("没有墙类mask被写入全局墙图")
        return [], 0.3

    cleaned_mask = clean_wall_mask(wall_mask, logs)
    wall_width_px = estimate_wall_width_pixels(cleaned_mask, logs)

    skel = skeletonize_wall_mask(cleaned_mask, logs)
    nodes, edges = extract_skeleton_graph(skel, logs)

    if not edges:
        logs.append("骨架没有边")
        return [], wall_width_px

    candidates = []
    wall_width_ft = wall_width_px * scaleX  # 像素厚度转Revit长度

    for idx, path in enumerate(edges):
        try:
            line_geom = simplify_path_to_axis_line(path, wall_width_px, logs)
            if line_geom is None:
                continue
            if line_geom.length < 0.2:
                continue

            candidates.append({
                'line': line_geom,
                'thickness': wall_width_ft,
                'name': "Wall"
            })
        except Exception as e:
            logs.append("路径{}转中心线失败: {}".format(idx, str(e)))
            continue

    logs.append("全局提取中心线候选数量: {}".format(len(candidates)))
    return candidates, wall_width_ft


#@#




plane = Plane.CreateByNormalAndOrigin(XYZ.BasisZ, origin)
sketch_plane = SketchPlane.Create(doc, plane)
#
DEFAULT_WALL_WIDTH = 0.3  # 英尺：你后面最好用真实墙宽估计替换它

if result.masks is not None:
    logs.append("YOLO类别映射: {}".format(str(result.names)))

    wall_candidates, default_wall_thickness = extract_wall_centerlines_from_global_mask(
        result, pixelWidth, pixelHeight, logs
    )

    logs.append("初始墙候选数量: {}".format(len(wall_candidates)))

    # 这里先做保守版4.5优化：只做节点合并、点插边，不做激进共线合并
    optimized_walls = optimize_wall_centerlines(
        wall_candidates,
        iter_count=1,
        enable_merge_collinear=False
    )

    logs.append("优化后墙数量: {}".format(len(optimized_walls)))

    for idx, w in enumerate(optimized_walls):
        try:
            line_geom = w['line']
            thickness_val = w['thickness']
            name = w['name']

            coords = list(line_geom.coords)
            if len(coords) < 2:
                logs.append("墙{}失败：coords不足".format(idx))
                continue

            start_pt = XYZ(coords[0][0], coords[0][1], 0)
            end_pt = XYZ(coords[-1][0], coords[-1][1], 0)

            if start_pt.DistanceTo(end_pt) < 0.1:
                logs.append("墙{}失败：线太短".format(idx))
                continue

            revit_line = Line.CreateBound(start_pt, end_pt)

            logs.append("准备创建墙{}: len={:.3f}, thickness={:.3f}".format(
                idx, revit_line.Length, thickness_val
            ))

            wall = Wall.Create(doc, revit_line, wall_type.Id, level.Id, wallHeight, 0, False, False)

            try:
                param = wall.get_Parameter(BuiltInParameter.WALL_ATTR_WIDTH_PARAM)
                if param and not param.IsReadOnly:
                    param.Set(thickness_val)
            except Exception as e2:
                logs.append("墙{}宽度设置失败(可忽略): {}".format(idx, str(e2)))

            try:
                wall.Name = name
            except:
                pass

            created_walls.append(wall.ToDSType(True))
            logs.append("墙{}创建成功".format(idx))

        except Exception as e:
            logs.append("墙{}创建失败: {}".format(idx, str(e)))
            logs.append(traceback.format_exc())
            continue
else:
    logs.append("result.masks is None，没有分割mask")
            

        
        
        



# others upgrades __
TransactionManager.Instance.TransactionTaskDone()
doc.Regenerate()
# Outs
#OUT = [created_lines, dyn_lines]
OUT = created_walls,logs
# ----------------------------------------
python_version_13 = Watch(python_script_11)  # graph output
python_script_12 = Python(IN[0]=modelpath_2, IN[1]=imagepath_2, IN[2]=number, IN[3]=scale)  # CPython3; frozen
# ---------- python_script_12.python (1198 lines) ----------
# 加载 Python Standard 和 DesignScript 库
import sys
import clr
clr.AddReference('ProtoGeometry')
from Autodesk.DesignScript.Geometry import *
import Autodesk.DesignScript.Geometry as DS
import Revit
from Revit.Elements import *
import System
sys.path.append("C:/Users/Lenovo/anaconda3/envs/revitenv/Lib/site-packages")
clr.AddReference('RevitAPI')
clr.AddReference('RevitAPIUI')
from Autodesk.Revit.DB import *
from Autodesk.Revit.UI import *

clr.AddReference('RevitServices')
from RevitServices.Persistence import DocumentManager
from RevitServices.Transactions import TransactionManager

clr.AddReference('RevitNodes')
import Revit
clr.ImportExtensions(Revit.Elements)
clr.ImportExtensions(Revit.GeometryConversion)
#
import re
import math
from scipy.spatial import Voronoi
from shapely.geometry import Polygon, LineString, MultiLineString
from shapely.ops import linemerge
from shapely.ops import unary_union, split
from shapely.geometry import Point as ShpPoint
from scipy import ndimage
from skimage.morphology import skeletonize

import traceback
from shapely.geometry import Polygon as ShpPolygon
from shapely.geometry import MultiPolygon as ShpMultiPolygon
from shapely.geometry import Point as ShpPoint
from shapely.geometry import MultiLineString
from shapely.ops import linemerge
import numpy as np
import torch
import cv2
from ultralytics import YOLO

dataEnteringNode = IN 
dect_Model = IN[0]
pixpath = IN[1]
height = IN[2]
scale = IN[3]
#params
origin = XYZ(0, 0, 0)   
widthFt = scale
pixelWidth = 1600   
pixelHeight = 1200 
DENSIFY_DIST = 0.5  
EPS = 1e-6
#
TARGET_WALL_TYPE_NAME = "基本墙 200mm"   # 项目中存在的墙类型名称
TARGET_LEVEL_NAME = "标高 2"                            
#                         
yolo_seg = YOLO(dect_Model,task = "seg")
newpath = "E:/yanjiu/revitss/tests/jjianzhu_seg.jpg"

seg_result = yolo_seg(source = pixpath,save = False,conf = 0.3,iou = 0.45,imgsz = 640)
cv2.imwrite(newpath,seg_result[0].plot())
#tempouts = []
#tempouts.append(newpath)
#tempouts.extend(dect_result)
scaleX = widthFt / pixelWidth
scaleY = widthFt * (pixelHeight / pixelWidth) / pixelHeight  

result = seg_result[0]        
boxes = result.boxes
xyxy = boxes.xyxy.cpu().numpy() 
cls_ids = boxes.cls.cpu().numpy().astype(int)  # 类别索引 (N,)
names = result.names  

doc = DocumentManager.Instance.CurrentDBDocument
app = doc.Application
TransactionManager.Instance.EnsureInTransaction(doc)

# 按名称查找
wall_type = None
wall_type_collector = FilteredElementCollector(doc).OfClass(WallType)

# 先按名称查找基本 墙
for wt in wall_type_collector:
    if wt.Kind == WallKind.Basic:  # 只考虑基本墙
        name_param = wt.get_Parameter(BuiltInParameter.SYMBOL_NAME_PARAM)
        if name_param and name_param.AsString() == TARGET_WALL_TYPE_NAME:
            wall_type = wt
            break

# 如果没找到指定名称的基本墙，则取第一个基本墙
if wall_type is None:
    for wt in wall_type_collector:
        if wt.Kind == WallKind.Basic:
            wall_type = wt
            break

if wall_type is None:
    raise Exception("项目中找不到任何基本墙类型！")

# --- 获取目标标高 ---
level = None
level_collector = FilteredElementCollector(doc).OfClass(Level)
for lvl in level_collector:
    # 标高名称参数
    name_param = lvl.get_Parameter(BuiltInParameter.LEVEL_NAME)
    if name_param and name_param.AsString() == TARGET_LEVEL_NAME:
        level = lvl
        break
if level is None:
    level = level_collector.FirstElement()
    if level is None:
        raise Exception("项目中找不到任何标高！")


TransactionManager.Instance.EnsureInTransaction(doc)

created_lines = []
dyn_lines = []
dyn_faces = [] 
created_shapes = []
created_walls = []
wall_candidates = []

logs = []

thickness = height
wallHeight = height

def pix_to_revit(x, y):
    revit_x = origin.X + x * scaleX
    revit_y = origin.Y + (pixelHeight - y) * scaleY  # 翻转 Y 轴
    return XYZ(revit_x, revit_y, origin.Z)
def sanitize_name(name):
    # 如果名称为空，返回默认名称
    if not name:
        return "Unknown"
    # 移除控制字符（ASCII 0-31，除了tab? 但最好全部移除）
    # 允许常见字符：字母、数字、空格、下划线、连字符、中文等
    # 保留所有打印字符，移除控制字符
    cleaned = re.sub(r'[\x00-\x1f\x7f]', '', name)
    # 如果清理后为空，则返回默认名
    if not cleaned.strip():
        return "Unnamed"
    return cleaned
##
EPS = 1e-6

# 你必须根据自己的模型类别名修改这里
# 比如如果你的墙类别是 "wall" 或 "墙体" 或 "wall_line"，就在这里加上
WALL_CLASS_NAMES = set(["wall", "Wall", "墙体"])
WALL_CLASS_KEYWORDS = [
    "wall",
    "Wall",
    "basic wall",
    "bearing wall",
    "non-bearing wall",
    "shear wall",
    "墙",
    "墙体",
    "基本墙",
    "基本墙 200mm",
    "承重墙",
    "非承重墙",
    "剪力墙"
]

def normalize_class_name(name):
    if name is None:
        return ""
    return str(name).strip().lower()

def is_wall_class(name):
    n = normalize_class_name(name)
    if not n:
        return False
    for kw in WALL_CLASS_KEYWORDS:
        if kw.lower() in n:
            return True
    return False
    

def ensure_polygon(geom):
    """
    将 geometry 尽量转成一个有效 Polygon
    如果是 MultiPolygon，则取面积最大的一个
    """
    if geom is None or geom.is_empty:
        return None
    try:
        if not geom.is_valid:
            geom = geom.buffer(0)
    except:
        pass
    if geom is None or geom.is_empty:
        return None

    if isinstance(geom, ShpPolygon):
        return geom

    if isinstance(geom, ShpMultiPolygon):
        polys = [g for g in geom.geoms if g is not None and not g.is_empty]
        if not polys:
            return None
        polys.sort(key=lambda p: p.area, reverse=True)
        return polys[0]

    return None

def contour_to_polygon(contour_pts):
    """
    contour_pts: YOLO mask contour pixel points
    转成shapely polygon（Revit坐标系）
    """
    revit_pts = [pix_to_revit(pt[0], pt[1]) for pt in contour_pts]
    if len(revit_pts) < 3:
        return None
    coords = [(p.X, p.Y) for p in revit_pts]
    if coords[0] != coords[-1]:
        coords.append(coords[0])
    poly = ShpPolygon(coords)
    poly = ensure_polygon(poly)
    return poly

def line_long_enough(line_geom, min_len=0.1):
    if line_geom is None or line_geom.is_empty:
        return False
    try:
        return line_geom.length >= min_len
    except:
        return False

def snap_line_to_axis(line_geom):
    """
    对线段做水平/垂直吸附，作为 Lalignment 的工程近似
    """
    if line_geom is None or line_geom.is_empty:
        return None
    coords = list(line_geom.coords)
    if len(coords) < 2:
        return None
    x1, y1 = coords[0]
    x2, y2 = coords[-1]
    dx = x2 - x1
    dy = y2 - y1
    if abs(dx) >= abs(dy):
        ym = 0.5 * (y1 + y2)
        return LineString([(x1, ym), (x2, ym)])
    else:
        xm = 0.5 * (x1 + x2)
        return LineString([(xm, y1), (xm, y2)])

def longest_linestring_from_intersection(inter):
    """
    从 intersection 结果中取最长的 LineString
    """
    if inter is None or inter.is_empty:
        return None
    if inter.geom_type == "LineString":
        return inter
    if inter.geom_type == "MultiLineString":
        lines = [g for g in inter.geoms if g.length > 1e-4]
        if not lines:
            return None
        lines.sort(key=lambda g: g.length, reverse=True)
        return lines[0]
    return None

def estimate_centerline_from_polygon(poly):
    """
    稳定版中心线初始化：
    1) 取最小外接旋转矩形
    2) 判断主方向
    3) 通过polygon质心沿主方向打一条长线
    4) 与polygon求交得到中心段
    5) 用 area / centerline_length 估计厚度
    """
    if poly is None or poly.is_empty:
        return None, None

    poly = ensure_polygon(poly)
    if poly is None:
        return None, None

    if poly.area < 1e-5:
        return None, None

    try:
        mrr = poly.minimum_rotated_rectangle
    except:
        return None, None

    mrr = ensure_polygon(mrr)
    if mrr is None:
        return None, None

    rect_coords = list(mrr.exterior.coords)[:-1]
    if len(rect_coords) != 4:
        return None, None

    edges = []
    for i in range(4):
        p1 = rect_coords[i]
        p2 = rect_coords[(i + 1) % 4]
        length = ((p2[0]-p1[0])**2 + (p2[1]-p1[1])**2) ** 0.5
        edges.append((p1, p2, length))

    # 按边长排序
    edges_sorted = sorted(edges, key=lambda e: e[2], reverse=True)
    long_edge = edges_sorted[0]
    short_edge = edges_sorted[-1]

    long_len = long_edge[2]
    short_len = short_edge[2]

    if long_len < 0.1:
        return None, None

    # 主方向
    p1, p2, _ = long_edge
    dx = p2[0] - p1[0]
    dy = p2[1] - p1[1]
    norm = (dx*dx + dy*dy) ** 0.5
    if norm < EPS:
        return None, None
    ux = dx / norm
    uy = dy / norm

    # 过质心打一条足够长的线
    c = poly.centroid
    minx, miny, maxx, maxy = poly.bounds
    diag = ((maxx-minx)**2 + (maxy-miny)**2) ** 0.5 + 10.0

    raw_line = LineString([
        (c.x - ux * diag, c.y - uy * diag),
        (c.x + ux * diag, c.y + uy * diag)
    ])

    # 与polygon相交，取最长线段作为中心线
    inter = raw_line.intersection(poly)
    centerline = longest_linestring_from_intersection(inter)
    if centerline is None:
        return None, None

    centerline = snap_line_to_axis(centerline)
    if centerline is None or centerline.length < 0.1:
        return None, None

    # 厚度估计：面积 / 中心线长度
    thickness = poly.area / max(centerline.length, EPS)

    # 防止异常值
    if thickness < 0.05:
        thickness = 0.05
    if thickness > 2.0:
        thickness = 2.0

    return centerline, thickness

def merge_close_vertices(segments, delta):
    """
    论文4.5 condition x:
    两节点距离 < δx，则合并
    对线段端点进行统一吸附
    """
    pts = []
    for seg in segments:
        coords = list(seg['line'].coords)
        pts.append(coords[0])
        pts.append(coords[-1])

    if not pts:
        return segments

    clusters = []
    for p in pts:
        assigned = False
        for cluster in clusters:
            cx, cy, plist = cluster
            d2 = (p[0]-cx)**2 + (p[1]-cy)**2
            if d2 < delta * delta:
                plist.append(p)
                nx = sum(pp[0] for pp in plist) / len(plist)
                ny = sum(pp[1] for pp in plist) / len(plist)
                cluster[0] = nx
                cluster[1] = ny
                assigned = True
                break
        if not assigned:
            clusters.append([p[0], p[1], [p]])

    def snap_point(p):
        best = p
        best_d = 1e18
        for cx, cy, plist in clusters:
            d2 = (p[0]-cx)**2 + (p[1]-cy)**2
            if d2 < best_d:
                best_d = d2
                best = (cx, cy)
        return best

    new_segments = []
    for seg in segments:
        coords = list(seg['line'].coords)
        p1 = snap_point(coords[0])
        p2 = snap_point(coords[-1])
        if ((p1[0]-p2[0])**2 + (p1[1]-p2[1])**2) ** 0.5 < 0.1:
            continue
        new_line = LineString([p1, p2])
        new_segments.append({
            'line': snap_line_to_axis(new_line),
            'thickness': seg['thickness'],
            'name': seg['name']
        })
    return new_segments

def point_to_segment_distance(pt, a, b):
    """
    点到线段距离
    """
    px, py = pt
    ax, ay = a
    bx, by = b
    dx = bx - ax
    dy = by - ay
    if abs(dx) < EPS and abs(dy) < EPS:
        return ((px-ax)**2 + (py-ay)**2)**0.5, a, 0.0

    t = ((px-ax)*dx + (py-ay)*dy) / (dx*dx + dy*dy)
    t_clamped = max(0.0, min(1.0, t))
    qx = ax + t_clamped * dx
    qy = ay + t_clamped * dy
    dist = ((px-qx)**2 + (py-qy)**2)**0.5
    return dist, (qx, qy), t_clamped

def split_segments_by_near_vertices(segments, delta):
    """
    论文4.5 condition y:
    若顶点到边距离 < δy，则把点插入边
    """
    if not segments:
        return segments

    vertices = []
    for seg in segments:
        coords = list(seg['line'].coords)
        vertices.append(coords[0])
        vertices.append(coords[-1])

    new_segments = []
    for idx, seg in enumerate(segments):
        coords = list(seg['line'].coords)
        a = coords[0]
        b = coords[-1]
        split_pts = []

        for v in vertices:
            if v == a or v == b:
                continue
            dist, proj, t = point_to_segment_distance(v, a, b)
            if dist < delta and t > 0.01 and t < 0.99:
                split_pts.append((t, v))

        if not split_pts:
            new_segments.append(seg)
        else:
            split_pts.sort(key=lambda x: x[0])
            chain = [a] + [v for _, v in split_pts] + [b]
            for p1, p2 in zip(chain[:-1], chain[1:]):
                if ((p1[0]-p2[0])**2 + (p1[1]-p2[1])**2) ** 0.5 < 0.1:
                    continue
                new_line = snap_line_to_axis(LineString([p1, p2]))
                new_segments.append({
                    'line': new_line,
                    'thickness': seg['thickness'],
                    'name': seg['name']
                })
    return new_segments

def merge_collinear_segments(segments, gap_tol=0.3):
    """
    合并同一直线上的相邻短线段
    """
    if not segments:
        return segments

    horizontal = []
    vertical = []
    others = []

    for seg in segments:
        coords = list(seg['line'].coords)
        x1, y1 = coords[0]
        x2, y2 = coords[-1]
        if abs(y2 - y1) < 1e-6:
            xmin = min(x1, x2)
            xmax = max(x1, x2)
            horizontal.append((y1, xmin, xmax, seg))
        elif abs(x2 - x1) < 1e-6:
            ymin = min(y1, y2)
            ymax = max(y1, y2)
            vertical.append((x1, ymin, ymax, seg))
        else:
            others.append(seg)

    result = []

    # 水平
    by_y = {}
    for y, xmin, xmax, seg in horizontal:
        yk = round(y, 3)
        by_y.setdefault(yk, []).append((xmin, xmax, seg))

    for yk, arr in by_y.items():
        arr.sort(key=lambda x: x[0])
        cur_x1, cur_x2, cur_seg = arr[0]
        thick = cur_seg['thickness']
        name = cur_seg['name']
        for nx1, nx2, nseg in arr[1:]:
            if nx1 <= cur_x2 + gap_tol:
                cur_x2 = max(cur_x2, nx2)
                thick = (thick + nseg['thickness']) / 2.0
            else:
                result.append({
                    'line': LineString([(cur_x1, yk), (cur_x2, yk)]),
                    'thickness': thick,
                    'name': name
                })
                cur_x1, cur_x2, cur_seg = nx1, nx2, nseg
                thick = cur_seg['thickness']
                name = cur_seg['name']
        result.append({
            'line': LineString([(cur_x1, yk), (cur_x2, yk)]),
            'thickness': thick,
            'name': name
        })

    # 垂直
    by_x = {}
    for x, ymin, ymax, seg in vertical:
        xk = round(x, 3)
        by_x.setdefault(xk, []).append((ymin, ymax, seg))

    for xk, arr in by_x.items():
        arr.sort(key=lambda x: x[0])
        cur_y1, cur_y2, cur_seg = arr[0]
        thick = cur_seg['thickness']
        name = cur_seg['name']
        for ny1, ny2, nseg in arr[1:]:
            if ny1 <= cur_y2 + gap_tol:
                cur_y2 = max(cur_y2, ny2)
                thick = (thick + nseg['thickness']) / 2.0
            else:
                result.append({
                    'line': LineString([(xk, cur_y1), (xk, cur_y2)]),
                    'thickness': thick,
                    'name': name
                })
                cur_y1, cur_y2, cur_seg = ny1, ny2, nseg
                thick = cur_seg['thickness']
                name = cur_seg['name']
        result.append({
            'line': LineString([(xk, cur_y1), (xk, cur_y2)]),
            'thickness': thick,
            'name': name
        })

    result.extend(others)
    return result

def optimize_wall_centerlines(candidates, iter_count=1, enable_merge_collinear=True):
    if not candidates:
        return []

    segs = candidates[:]

    # 先严格共线合并一次，把被切碎的小段拼回去
    if enable_merge_collinear:
        segs = merge_collinear_segments_strict(segs, coord_tol=0.08, gap_tol=0.35)

    for _ in range(iter_count):
        if not segs:
            break

        avg_t = sum(s['thickness'] for s in segs) / max(len(segs), 1)
        delta = 0.20 * avg_t
        if delta < 0.03:
            delta = 0.03
        if delta > 0.12:
            delta = 0.12

        segs = merge_close_vertices(segs, delta)
        segs = split_segments_by_near_vertices(segs, delta)

    cleaned = []
    for s in segs:
        try:
            if s['line'] is None or s['line'].is_empty:
                continue
            if s['line'].length < 0.08:
                continue
            cleaned.append(s)
        except:
            continue

    return cleaned



def get_wall_type_by_name(doc, type_name):
    wall_type_collector = FilteredElementCollector(doc).OfClass(WallType)
    found = None
    for wt in wall_type_collector:
        if wt.Kind == WallKind.Basic:
            name_param = wt.get_Parameter(BuiltInParameter.SYMBOL_NAME_PARAM)
            if name_param and name_param.AsString() == type_name:
                found = wt
                break
    if found:
        return found
    for wt in wall_type_collector:
        if wt.Kind == WallKind.Basic:
            return wt
    return None
#@#
def build_global_wall_mask(result, pixelWidth, pixelHeight, logs):
    """
    将所有墙类mask合成为一张整体二值图
    返回 uint8 二值图，墙=255，背景=0
    """
    wall_mask = np.zeros((pixelHeight, pixelWidth), dtype=np.uint8)

    if result.masks is None:
        logs.append("result.masks is None")
        return wall_mask

    masks_xy = result.masks.xy
    cls_ids = result.boxes.cls.cpu().numpy().astype(int)
    names = result.names

    logs.append("总mask数量: {}".format(len(masks_xy)))

    for i, contour_pts in enumerate(masks_xy):
        try:
            if i >= len(cls_ids):
                continue
            class_id = cls_ids[i]
            class_name = names[class_id]

            if not is_wall_class(class_name):
                continue

            pts = np.array(contour_pts, dtype=np.int32)
            if len(pts) < 3:
                continue

            # 限制在图像范围内
            pts[:, 0] = np.clip(pts[:, 0], 0, pixelWidth - 1)
            pts[:, 1] = np.clip(pts[:, 1], 0, pixelHeight - 1)

            cv2.fillPoly(wall_mask, [pts], 255)

        except Exception as e:
            logs.append("合成墙mask失败 idx={}: {}".format(i, str(e)))
            continue

    return wall_mask
#--
def clean_wall_mask(binary_mask, logs):
    """
    形态学清理：
    - 闭运算补缝
    - 开运算去噪
    - 移除小连通域
    """
    mask = binary_mask.copy()

    kernel_close = cv2.getStructuringElement(cv2.MORPH_RECT, (5, 5))
    kernel_open = cv2.getStructuringElement(cv2.MORPH_RECT, (3, 3))

    mask = cv2.morphologyEx(mask, cv2.MORPH_CLOSE, kernel_close)
    mask = cv2.morphologyEx(mask, cv2.MORPH_OPEN, kernel_open)

    num_labels, labels, stats, _ = cv2.connectedComponentsWithStats(mask, connectivity=8)
    cleaned = np.zeros_like(mask)

    for i in range(1, num_labels):
        area = stats[i, cv2.CC_STAT_AREA]
        if area >= 50:  # 可调
            cleaned[labels == i] = 255

    logs.append("墙mask清理完成")
    return cleaned


def estimate_wall_width_pixels(binary_mask, logs):
    """
    用距离变换估计墙宽像素值
    厚度 ~= 2 * skeleton点处的距离变换值
    简化做法：用墙区域整体距离变换的中位数*2
    """
    if binary_mask is None or binary_mask.max() == 0:
        logs.append("墙宽估计失败：mask为空")
        return 6.0

    dist = cv2.distanceTransform(binary_mask, cv2.DIST_L2, 5)
    vals = dist[dist > 0]
    if len(vals) == 0:
        logs.append("墙宽估计失败：distanceTransform为空")
        return 6.0

    wall_width_px = max(2.0, 2.0 * np.median(vals))
    logs.append("估计墙宽像素值: {:.2f}".format(wall_width_px))
    return wall_width_px
#-
def skeletonize_wall_mask(binary_mask, logs):
    """
    骨架提取，返回0/1图
    """
    try:
        from skimage.morphology import skeletonize
        skel = skeletonize(binary_mask > 0)
        logs.append("使用 skimage.skeletonize 成功")
        return skel.astype(np.uint8)
    except Exception as e:
        logs.append("skimage骨架失败，改用fallback: {}".format(str(e)))
        return skeletonize_fallback(binary_mask, logs)
#-
def get_neighbors_8(x, y, w, h):
    nbs = []
    for dy in [-1, 0, 1]:
        for dx in [-1, 0, 1]:
            if dx == 0 and dy == 0:
                continue
            nx = x + dx
            ny = y + dy
            if 0 <= nx < w and 0 <= ny < h:
                nbs.append((nx, ny))
    return nbs


def extract_skeleton_graph(skel, logs):
    """
    从骨架图提取节点和边
    节点 = 度数 != 2 的骨架像素（端点或交点）
    边 = 节点之间的像素路径
    """
    h, w = skel.shape
    skel_pts = set()
    for y in range(h):
        xs = np.where(skel[y] > 0)[0]
        for x in xs:
            skel_pts.add((x, y))

    if not skel_pts:
        logs.append("骨架为空")
        return [], []

    degree = {}
    for (x, y) in skel_pts:
        cnt = 0
        for nx, ny in get_neighbors_8(x, y, w, h):
            if (nx, ny) in skel_pts:
                cnt += 1
        degree[(x, y)] = cnt

    nodes = [p for p, d in degree.items() if d != 2]

    # 如果没有明显节点（纯单线），取骨架端点或任意两个端点
    if not nodes:
        nodes = list(skel_pts)

    node_set = set(nodes)
    visited_edges = set()
    edges = []

    for node in nodes:
        x0, y0 = node
        for nx, ny in get_neighbors_8(x0, y0, w, h):
            if (nx, ny) not in skel_pts:
                continue

            edge_key = tuple(sorted([node, (nx, ny)]))
            if edge_key in visited_edges:
                continue

            path = [node, (nx, ny)]
            prev = node
            curr = (nx, ny)

            while True:
                visited_edges.add(tuple(sorted([prev, curr])))

                if curr in node_set and curr != node:
                    break

                nbrs = []
                for tx, ty in get_neighbors_8(curr[0], curr[1], w, h):
                    if (tx, ty) in skel_pts and (tx, ty) != prev:
                        nbrs.append((tx, ty))

                if len(nbrs) == 0:
                    break
                if len(nbrs) > 1:
                    # 到交点了
                    break

                nxt = nbrs[0]
                path.append(nxt)
                prev = curr
                curr = nxt

            if len(path) >= 2:
                edges.append(path)

    logs.append("骨架图提取完成: nodes={}, edges={}".format(len(nodes), len(edges)))
    return nodes, edges
#-
def simplify_path_to_axis_lines(path, wall_mask, pixelWidth, pixelHeight, logs, min_len_px=8):
    """
    一条骨架路径 -> 多条更精确的水平/垂直中心线
    关键：先按拐点拆段，再对每段做局部中线拟合
    """
    result_lines = []

    sub_paths = split_path_by_direction(path, turn_threshold=2)
    for sub in sub_paths:
        try:
            fitted = fit_axis_line_from_mask(
                sub, wall_mask, pixelWidth, pixelHeight, min_len_px=min_len_px
            )
            if fitted is None:
                continue

            p1, p2, ori = fitted
            line_geom = pixel_line_to_revit_linestring(p1, p2)
            if line_geom is None:
                continue

            if line_geom.length < 0.08:
                continue

            result_lines.append(line_geom)

        except Exception as e:
            logs.append("子段拟合失败: {}".format(str(e)))
            continue

    return result_lines

#-
def extract_wall_centerlines_from_global_mask(result, pixelWidth, pixelHeight, logs):
    wall_mask = build_global_wall_mask(result, pixelWidth, pixelHeight, logs)
    if wall_mask.max() == 0:
        logs.append("没有墙类mask被写入全局墙图")
        return [], 0.3

    cleaned_mask = clean_wall_mask(wall_mask, logs)
    wall_width_px = estimate_wall_width_pixels(cleaned_mask, logs)

    skel = skeletonize_wall_mask(cleaned_mask, logs)
    nodes, edges = extract_skeleton_graph(skel, logs)

    if not edges:
        logs.append("骨架没有边")
        return [], wall_width_px * scaleX

    wall_width_ft = wall_width_px * scaleX
    candidates = []

    for idx, path in enumerate(edges):
        try:
            line_list = simplify_path_to_axis_lines(
                path, cleaned_mask, pixelWidth, pixelHeight, logs, min_len_px=max(6, int(wall_width_px))
            )

            for line_geom in line_list:
                candidates.append({
                    'line': line_geom,
                    'thickness': wall_width_ft,
                    'name': "Wall"
                })

        except Exception as e:
            logs.append("路径{}转中心线失败: {}".format(idx, str(e)))
            continue

    logs.append("全局提取中心线候选数量: {}".format(len(candidates)))
    return candidates, wall_width_ft
#-
def merge_collinear_segments_strict(segments, coord_tol=0.08, gap_tol=0.25):
    if not segments:
        return segments

    horizontal = []
    vertical = []
    others = []

    for seg in segments:
        coords = list(seg['line'].coords)
        x1, y1 = coords[0]
        x2, y2 = coords[-1]

        if abs(y2 - y1) <= coord_tol:
            y = 0.5 * (y1 + y2)
            xmin, xmax = min(x1, x2), max(x1, x2)
            horizontal.append((y, xmin, xmax, seg))
        elif abs(x2 - x1) <= coord_tol:
            x = 0.5 * (x1 + x2)
            ymin, ymax = min(y1, y2), max(y1, y2)
            vertical.append((x, ymin, ymax, seg))
        else:
            others.append(seg)

    merged = []

    # merge horizontal
    horizontal.sort(key=lambda t: (round(t[0], 2), t[1]))
    used = [False] * len(horizontal)
    for i in range(len(horizontal)):
        if used[i]:
            continue
        y, x1, x2, seg = horizontal[i]
        thick = seg['thickness']
        name = seg['name']

        for j in range(i + 1, len(horizontal)):
            if used[j]:
                continue
            y2, xx1, xx2, seg2 = horizontal[j]
            if abs(y2 - y) <= coord_tol and xx1 <= x2 + gap_tol:
                x2 = max(x2, xx2)
                thick = 0.5 * (thick + seg2['thickness'])
                used[j] = True

        merged.append({
            'line': LineString([(x1, y), (x2, y)]),
            'thickness': thick,
            'name': name
        })

    # merge vertical
    vertical.sort(key=lambda t: (round(t[0], 2), t[1]))
    used = [False] * len(vertical)
    for i in range(len(vertical)):
        if used[i]:
            continue
        x, y1, y2, seg = vertical[i]
        thick = seg['thickness']
        name = seg['name']

        for j in range(i + 1, len(vertical)):
            if used[j]:
                continue
            x2, yy1, yy2, seg2 = vertical[j]
            if abs(x2 - x) <= coord_tol and yy1 <= y2 + gap_tol:
                y2 = max(y2, yy2)
                thick = 0.5 * (thick + seg2['thickness'])
                used[j] = True

        merged.append({
            'line': LineString([(x, y1), (x, y2)]),
            'thickness': thick,
            'name': name
        })

    merged.extend(others)
    return merged

#-
def split_path_by_direction(path, turn_threshold=2):
    """
    将骨架路径按方向变化拆分成多个近似直线子段
    path: [(x,y), ...]
    返回: [sub_path1, sub_path2, ...]
    """
    if not path or len(path) < 3:
        return [path] if path else []

    segments = []
    current = [path[0], path[1]]

    def major_dir(p1, p2):
        dx = p2[0] - p1[0]
        dy = p2[1] - p1[1]
        if abs(dx) >= abs(dy):
            return "h"
        else:
            return "v"

    prev_dir = major_dir(path[0], path[1])

    for i in range(2, len(path)):
        d = major_dir(path[i-1], path[i])

        if d == prev_dir:
            current.append(path[i])
        else:
            # 防止锯齿导致频繁切换：长度太短则并回去
            if len(current) <= turn_threshold and segments:
                segments[-1].extend(current[1:])
                current = [segments[-1][-1], path[i]]
            else:
                segments.append(current)
                current = [path[i-1], path[i]]
            prev_dir = d

    if current:
        if len(current) <= turn_threshold and segments:
            segments[-1].extend(current[1:])
        else:
            segments.append(current)

    # 去掉太短段
    cleaned = []
    for seg in segments:
        if seg and len(seg) >= 2:
            cleaned.append(seg)

    return cleaned

#-
def fit_axis_line_from_mask(sub_path, wall_mask, pixelWidth, pixelHeight, min_len_px=8):
    """
    对单个骨架子段，从墙mask边界反推更准确的中心线
    返回: ((x1,y1),(x2,y2), orientation) 或 None
    """
    if not sub_path or len(sub_path) < 2:
        return None

    xs = [p[0] for p in sub_path]
    ys = [p[1] for p in sub_path]

    x_min = max(0, int(min(xs)))
    x_max = min(pixelWidth - 1, int(max(xs)))
    y_min = max(0, int(min(ys)))
    y_max = min(pixelHeight - 1, int(max(ys)))

    dx = x_max - x_min
    dy = y_max - y_min

    # 判断主方向
    if dx >= dy:
        # 水平段：逐列扫描上下边界，取中心
        mids = []
        for x in range(x_min, x_max + 1):
            ys_in = np.where(wall_mask[:, x] > 0)[0]
            ys_local = ys_in[(ys_in >= y_min - 8) & (ys_in <= y_max + 8)]
            if len(ys_local) >= 2:
                y_top = np.min(ys_local)
                y_bot = np.max(ys_local)
                y_mid = 0.5 * (y_top + y_bot)
                mids.append((x, y_mid))

        if len(mids) < 2:
            return None

        xs2 = [p[0] for p in mids]
        ys2 = [p[1] for p in mids]

        x1 = min(xs2)
        x2 = max(xs2)
        y = float(np.median(ys2))

        if (x2 - x1) < min_len_px:
            return None

        return ((x1, y), (x2, y), "h")

    else:
        # 垂直段：逐行扫描左右边界，取中心
        mids = []
        for y in range(y_min, y_max + 1):
            xs_in = np.where(wall_mask[y, :] > 0)[0]
            xs_local = xs_in[(xs_in >= x_min - 8) & (xs_in <= x_max + 8)]
            if len(xs_local) >= 2:
                x_left = np.min(xs_local)
                x_right = np.max(xs_local)
                x_mid = 0.5 * (x_left + x_right)
                mids.append((x_mid, y))

        if len(mids) < 2:
            return None

        xs2 = [p[0] for p in mids]
        ys2 = [p[1] for p in mids]

        y1 = min(ys2)
        y2 = max(ys2)
        x = float(np.median(xs2))

        if (y2 - y1) < min_len_px:
            return None

        return ((x, y1), (x, y2), "v")
#-
def pixel_line_to_revit_linestring(p1, p2):
    rp1 = pix_to_revit(p1[0], p1[1])
    rp2 = pix_to_revit(p2[0], p2[1])
    if rp1.DistanceTo(rp2) < 0.1:
        return None
    return LineString([(rp1.X, rp1.Y), (rp2.X, rp2.Y)])

#-

#@#




plane = Plane.CreateByNormalAndOrigin(XYZ.BasisZ, origin)
sketch_plane = SketchPlane.Create(doc, plane)
#
DEFAULT_WALL_WIDTH = 0.3  # 英尺：你后面最好用真实墙宽估计替换它

if result.masks is not None:
    logs.append("YOLO类别映射: {}".format(str(result.names)))

    wall_candidates, default_wall_thickness = extract_wall_centerlines_from_global_mask(
        result, pixelWidth, pixelHeight, logs
    )

    logs.append("初始墙候选数量: {}".format(len(wall_candidates)))

    # 这里先做保守版4.5优化：只做节点合并、点插边，不做激进共线合并
    optimized_walls = optimize_wall_centerlines(
        wall_candidates,
        iter_count=1,
        enable_merge_collinear=False
    )

    logs.append("优化后墙数量: {}".format(len(optimized_walls)))

    for idx, w in enumerate(optimized_walls):
        try:
            line_geom = w['line']
            thickness_val = w['thickness']
            name = w['name']

            coords = list(line_geom.coords)
            if len(coords) < 2:
                logs.append("墙{}失败：coords不足".format(idx))
                continue

            start_pt = XYZ(coords[0][0], coords[0][1], 0)
            end_pt = XYZ(coords[-1][0], coords[-1][1], 0)

            if start_pt.DistanceTo(end_pt) < 0.1:
                logs.append("墙{}失败：线太短".format(idx))
                continue

            revit_line = Line.CreateBound(start_pt, end_pt)

            logs.append("准备创建墙{}: len={:.3f}, thickness={:.3f}".format(
                idx, revit_line.Length, thickness_val
            ))

            wall = Wall.Create(doc, revit_line, wall_type.Id, level.Id, wallHeight, 0, False, False)

            try:
                param = wall.get_Parameter(BuiltInParameter.WALL_ATTR_WIDTH_PARAM)
                if param and not param.IsReadOnly:
                    param.Set(thickness_val)
            except Exception as e2:
                logs.append("墙{}宽度设置失败(可忽略): {}".format(idx, str(e2)))

            try:
                wall.Name = name
            except:
                pass

            created_walls.append(wall.ToDSType(True))
            logs.append("墙{}创建成功".format(idx))

        except Exception as e:
            logs.append("墙{}创建失败: {}".format(idx, str(e)))
            logs.append(traceback.format_exc())
            continue
else:
    logs.append("result.masks is None，没有分割mask")
            

        
        
        



# others upgrades __
TransactionManager.Instance.TransactionTaskDone()
doc.Regenerate()
# Outs
#OUT = [created_lines, dyn_lines]
OUT = newpath,created_walls,logs
# ----------------------------------------
python_version_14 = Watch(python_script_12)  # graph output
python_script_13 = Python()  # CPython3; frozen; unwired: IN[0]
# ---------- python_script_13.python (30 lines) ----------
import clr
clr.AddReference('RevitAPI')
from Autodesk.Revit.DB import *

clr.AddReference('RevitServices')
from RevitServices.Persistence import DocumentManager

doc = DocumentManager.Instance.CurrentDBDocument

symbols_info = []

collector = FilteredElementCollector(doc).OfClass(FamilySymbol)

for fs in collector:
    try:
        cat_name = fs.Category.Name if fs.Category else "NoCategory"
        fam_name = fs.Family.Name if fs.Family else "NoFamily"
        
        type_name = ""
        p = fs.get_Parameter(BuiltInParameter.SYMBOL_NAME_PARAM)
        if p:
            type_name = p.AsString()
        else:
            type_name = fs.Name

        symbols_info.append((cat_name, fam_name, type_name, fs.Id.IntegerValue))
    except Exception as e:
        symbols_info.append(("ERROR", str(e)))

OUT = symbols_info
# ----------------------------------------
python_version_15 = Watch(python_script_13)  # graph output
python_script_14 = Python(IN[0]=modelpath_3, IN[1]=imagepath_2, IN[2]=scale)  # CPython3; frozen
# ---------- python_script_14.python (494 lines) ----------
# 加载 PythonStandard 和 DesignScript 库
import sys
import clr
clr.AddReference('ProtoGeometry')
from Autodesk.DesignScript.Geometry import *
import Autodesk.DesignScript.Geometry as DS
import Revit
from Revit.Elements import *
import System
sys.path.append("C:/Users/Lenovo/anaconda3/envs/revitenv/Lib/site-packages")
clr.AddReference('RevitAPI')
clr.AddReference('RevitAPIUI')
from Autodesk.Revit.DB import *
from Autodesk.Revit.UI import *

clr.AddReference('RevitServices')
from RevitServices.Persistence import DocumentManager
from RevitServices.Transactions import TransactionManager

clr.AddReference('RevitNodes')
import Revit
clr.ImportExtensions(Revit.Elements)
clr.ImportExtensions(Revit.GeometryConversion)
#
import math
import re
import numpy as np
import torch
import cv2
from ultralytics import YOLO

dataEnteringNode = IN 
pose_Model = IN[0]
pixpath = IN[1]
scale = IN[2]
target_family_name = IN[3] if len(IN) > 3 else "Bed"
target_type_name = IN[4] if len(IN) > 4 else "Only_Bed"
#params
origin = XYZ(0, 0, 0)   
widthFt = scale
pixelWidth = 1600   
pixelHeight = 1200                          
#配置      
CLASS_CONFIG = {
    "Bed": {
        "family_name": "Bed",
        "type_name": "Bed",   # 如果你想放 Only_Bed，就改成 "Only_Bed"
        "rotate": True,
        "kp_start_idx": 0,
        "kp_end_idx": 1,
        "area_filter": True,
        "family_default_axis": "Y"
    },
    "CookingCounter": {
        "family_name": "CookingCounter",
        "type_name": "CookingCounter",
        "rotate": True,
        "kp_start_idx": 0,
        "kp_end_idx": 1,
        "area_filter": False,
        "family_default_axis": "Y"
    },
    "Cabinet": {
        "family_name": "Cabinet",
        "type_name": "Cabinet",
        "rotate": True,
        "kp_start_idx": 0,
        "kp_end_idx": 1,
        "area_filter": False,
        "family_default_axis": "Y"
    },
    "DiningTable": {
        "family_name": "DiningTable",
        "type_name": "DiningTable",
        "rotate": True,
        "kp_start_idx": 0,
        "kp_end_idx": 1,
        "area_filter": False,
        "family_default_axis": "Y"
    },
    "DiningTables": {
        "family_name": "DiningTables",
        "type_name": "DiningTables",
        "rotate": False,
        "area_filter": False,
        "family_default_axis": "Y"
    },
    "Sofa": {
        "family_name": "Sofa",
        "type_name": "Sofa",
        "rotate": True,
        "kp_start_idx": 0,
        "kp_end_idx": 1,
        "area_filter": False,
        "family_default_axis": "Y"
    },
    "TVStand": {
        "family_name": "TVStand",
        "type_name": "TVStand",
        "rotate": True,
        "kp_start_idx": 0,
        "kp_end_idx": 1,
        "area_filter": False,
        "family_default_axis": "Y"
    },
    "Toilet": {
        "family_name": "Toilet",
        "type_name": "Toilet",
        "rotate": True,
        "kp_start_idx": 0,
        "kp_end_idx": 1,
        "area_filter": False,
        "family_default_axis": "Y"
    }
}
#--funcs
def norm_str(s):
    if s is None:
        return ""
    return str(s).strip().lower()
#-

def sanitize_name(name):
    # 如果名称为空，返回默认名称
    if not name:
        return "Unknown"
    # 移除控制字符（ASCII 0-31，除了tab? 但最好全部移除）
    # 允许常见字符：字母、数字、空格、下划线、连字符、中文等
    # 保留所有打印字符，移除控制字符
    cleaned = re.sub(r'[\x00-\x1f\x7f]', '', name)
    # 如果清理后为空，则返回默认名
    if not cleaned.strip():
        return "Unnamed"
    return cleaned
#-
def pix_to_revit(x, y):
    scaleX = widthFt / pixelWidth
    scaleY = widthFt * (float(pixelHeight) / float(pixelWidth)) / pixelHeight
    revit_x = origin.X + x * scaleX
    revit_y = origin.Y + (pixelHeight - y) * scaleY
    return XYZ(revit_x, revit_y, origin.Z)
    
def get_level(doc):
    av = doc.ActiveView
    try:
        if hasattr(av, "GenLevel") and av.GenLevel:
            return av.GenLevel
    except:
        pass
    levels = FilteredElementCollector(doc).OfClass(Level).ToElements()
    if levels and len(levels) > 0:
        return levels[0]
    return None

def find_family_symbol(doc, family_name=None, type_name=None):
    collector = FilteredElementCollector(doc).OfClass(FamilySymbol)
    
    for fs in collector:
        try:
            fam_name = fs.Family.Name if fs.Family else None
            
            p = fs.get_Parameter(BuiltInParameter.SYMBOL_NAME_PARAM)
            typ_name = p.AsString() if p else fs.Name

            family_ok = True if family_name is None else (fam_name == family_name)
            type_ok = True if type_name is None else (typ_name == type_name)

            if family_ok and type_ok:
                return fs
        except:
            pass
    return None


def angle_from_vector(vec, family_default_axis="X"):
    """
    vec: XYZ，目标朝向向量（平面内）
    family_default_axis:
        "X" 表示族默认朝向为 +X
        "Y" 表示族默认朝向为 +Y
    """
    vx = vec.X
    vy = vec.Y
    angle = math.atan2(vy, vx)

    if family_default_axis == "Y":
        angle -= math.pi / 2.0

    return angle
#--
def build_symbol_lookup(doc):
    lookup = {}
    collector = FilteredElementCollector(doc).OfClass(FamilySymbol)
    for fs in collector:
        try:
            fam_name = fs.Family.Name if fs.Family else ""
            p = fs.get_Parameter(BuiltInParameter.SYMBOL_NAME_PARAM)
            typ_name = p.AsString() if p else fs.Name
            key = (norm_str(fam_name), norm_str(typ_name))
            lookup[key] = fs
        except:
            pass
    return lookup
#-
def get_symbol_from_lookup(symbol_lookup, family_name, type_name):
    key = (norm_str(family_name), norm_str(type_name))
    if key in symbol_lookup:
        return symbol_lookup[key]
    return None

def compute_class_area_threshold(boxes, cls_ids, names, class_name, scale_ratio=0.33):
    areas = []
    for i, bbox in enumerate(boxes):
        cls_name = names[int(cls_ids[i])] if len(cls_ids) > i else ""
        if cls_name != class_name:
            continue

        x1, y1, x2, y2 = bbox
        area = max(0, (x2 - x1)) * max(0, (y2 - y1))
        areas.append(area)

    if len(areas) == 0:
        return 0.0, 0.0

    median_area = float(np.median(areas))
    min_area = median_area * scale_ratio
    return median_area, min_area

def ensure_symbol_active(doc, symbol):
    if symbol and not symbol.IsActive:
        symbol.Activate()
        doc.Regenerate()

def create_family_instance(doc, center_pt, symbol, level):
    try:
        instance = doc.Create.NewFamilyInstance(
            center_pt,
            symbol,
            level,
            StructuralType.NonStructural
        )
    except:
        instance = doc.Create.NewFamilyInstance(
            center_pt,
            symbol,
            doc.ActiveView
        )
    return instance

def get_angle_from_keypoints(start_pt, end_pt, family_default_axis="Y"):
    vec = XYZ(
        start_pt.X - end_pt.X,
        start_pt.Y - end_pt.Y,
        0
    )

    if vec.GetLength() < 1e-6:
        return None

    angle = math.atan2(vec.Y, vec.X)

    if family_default_axis == "Y":
        angle -= math.pi / 2.0

    return angle

def rotate_instance(doc, instance, center_pt, angle):
    axis_end = XYZ(center_pt.X, center_pt.Y, center_pt.Z + 1.0)
    axis = Line.CreateBound(center_pt, axis_end)
    ElementTransformUtils.RotateElement(doc, instance.Id, axis, angle)


#配置                   
yolo_pose = YOLO(pose_Model, task="pose")
newpath = "E:/yanjiu/revitss/tests/jjianzhu_pose.jpg"

pose_results = yolo_pose(
    source=pixpath,
    save=False,
    conf=0.3,
    iou=0.45,
    imgsz=640)
cv2.imwrite(newpath,pose_results[0].plot())

#scaleX = widthFt / pixelWidth
#scaleY = widthFt * (pixelHeight / pixelWidth) / pixelHeight  

result = pose_results[0]       
boxes = result.boxes.xyxy.cpu().numpy() if result.boxes is not None else []
cls_ids = result.boxes.cls.cpu().numpy().astype(int) if result.boxes is not None else []
confs = result.boxes.conf.cpu().numpy() if result.boxes is not None else []
names = result.names
kps_xy = None
if result.keypoints is not None and result.keypoints.xy is not None:
    kps_xy = result.keypoints.xy.cpu().numpy()

doc = DocumentManager.Instance.CurrentDBDocument
app = doc.Application
TransactionManager.Instance.EnsureInTransaction(doc)
level = get_level(doc)
symbol_lookup = build_symbol_lookup(doc)
bed_median_area, bed_min_area = compute_class_area_threshold(
    boxes, cls_ids, names, "Bed", 0.33
)

#process areas
bed_indices = []
bed_areas = []
for i, bbox in enumerate(boxes):
    cls_name = names[int(cls_ids[i])] if len(cls_ids) > i else ""
    if cls_name != "Bed":
        continue

    x1, y1, x2, y2 = bbox
    area = max(0, (x2 - x1)) * max(0, (y2 - y1))
    bed_indices.append(i)
    bed_areas.append(area)

if len(bed_areas) > 0:
    median_bed_area = float(np.median(bed_areas))
    min_area_threshold = median_bed_area * 0.33
else:
    median_bed_area = 0.0
    min_area_threshold = 0.0


#---
created_lines = []
dyn_lines = []
dyn_faces = [] 
created_shapes = []
created_instances = []
debug_info = []
missing_family_types = []
skipped_unconfigured_classes = []
#-


##
plane = Plane.CreateByNormalAndOrigin(XYZ.BasisZ, origin)
sketch_plane = SketchPlane.Create(doc, plane)
for cls_name, cfg in CLASS_CONFIG.items():
    symbol = get_symbol_from_lookup(
        symbol_lookup,
        cfg.get("family_name"),
        cfg.get("type_name")
    )
    if symbol:
        ensure_symbol_active(doc, symbol)
#-
for i, bbox in enumerate(boxes):
    cls_name = names[int(cls_ids[i])] if len(cls_ids) > i else ""
    conf = confs[i] if len(confs) > i else 0.0

    # 1. 配置中未定义的类，跳过
    if cls_name not in CLASS_CONFIG:
        skipped_unconfigured_classes.append({
            "index": i,
            "class": cls_name,
            "reason": "class_not_configured"
        })
        continue

    cfg = CLASS_CONFIG[cls_name]
    family_name = cfg.get("family_name")
    type_name = cfg.get("type_name")
    need_rotate = cfg.get("rotate", False)
    family_default_axis = cfg.get("family_default_axis", "Y")

    # 2. 查找对应族类型
    symbol = get_symbol_from_lookup(symbol_lookup, family_name, type_name)
    if symbol is None:
        missing_family_types.append({
            "index": i,
            "class": cls_name,
            "family_name": family_name,
            "type_name": type_name,
            "reason": "family_symbol_not_found"
        })
        continue

    # 3. 中心点
    x1, y1, x2, y2 = bbox
    cx = (x1 + x2) / 2.0
    cy = (y1 + y2) / 2.0
    center_pt = pix_to_revit(cx, cy)

    # 4. 面积过滤（目前只给 Bed）
    area = max(0, (x2 - x1)) * max(0, (y2 - y1))
    if cfg.get("area_filter", False):
        if cls_name == "Bed" and bed_min_area > 0 and area < bed_min_area:
            debug_info.append({
                "index": i,
                "class": cls_name,
                "reason": "filtered_small_area",
                "area": area,
                "threshold": bed_min_area
            })
            continue

    # 5. 先创建实例
    try:
        instance = create_family_instance(doc, center_pt, symbol, level)
    except Exception as e:
        debug_info.append({
            "index": i,
            "class": cls_name,
            "reason": "create_instance_failed",
            "error": str(e)
        })
        continue

    rotated = False
    angle = None

    # 6. 如果该类需要旋转，尝试读取关键点
    if need_rotate:
        kp_start_idx = cfg.get("kp_start_idx", None)
        kp_end_idx = cfg.get("kp_end_idx", None)

        if kps_xy is not None and i < len(kps_xy) and kp_start_idx is not None and kp_end_idx is not None:
            kp = kps_xy[i]

            if len(kp) > max(kp_start_idx, kp_end_idx):
                sx, sy = kp[kp_start_idx]
                ex, ey = kp[kp_end_idx]

                start_pt = pix_to_revit(sx, sy)
                end_pt = pix_to_revit(ex, ey)

                angle = get_angle_from_keypoints(
                    start_pt,
                    end_pt,
                    family_default_axis
                )

                if angle is not None:
                    try:
                        rotate_instance(doc, instance, center_pt, angle)
                        rotated = True
                    except Exception as e:
                        debug_info.append({
                            "index": i,
                            "class": cls_name,
                            "reason": "rotate_failed",
                            "error": str(e)
                        })
                else:
                    debug_info.append({
                        "index": i,
                        "class": cls_name,
                        "reason": "zero_direction_vector"
                    })
            else:
                debug_info.append({
                    "index": i,
                    "class": cls_name,
                    "reason": "insufficient_keypoints"
                })
        else:
            debug_info.append({
                "index": i,
                "class": cls_name,
                "reason": "no_keypoints_for_rotation"
            })

    created_instances.append(instance.ToDSType(False))
    debug_info.append({
        "index": i,
        "class": cls_name,
        "family_name": family_name,
        "type_name": type_name,
        "center": center_pt,
        "area": area,
        "rotated": rotated,
        "angle_rad": angle,
        "angle_deg": angle * 180.0 / math.pi if angle is not None else None,
        "conf": conf
    })

TransactionManager.Instance.TransactionTaskDone()
doc.Regenerate()

OUT = {
    "preview_image": newpath,
    "created_instances": created_instances,
    "debug_info": debug_info,
    "missing_family_types": missing_family_types,
    "skipped_unconfigured_classes": skipped_unconfigured_classes,
    "bed_area_threshold": {
        "median_area": bed_median_area,
        "min_area": bed_min_area
    }
}
# ----------------------------------------
python_script_15 = Python(IN[0]=modelpath_2, IN[1]=imagepath_2, IN[2]=number, IN[3]=scale, IN[4]=python_version_4, IN[5]=seg_meta_Json_Path)  # CPython3; frozen
# ---------- python_script_15.python (1309 lines) ----------
# 加载 Python Standard和 DesignScript 库
#--------------------
import sys
import clr
clr.AddReference('ProtoGeometry')
from Autodesk.DesignScript.Geometry import *
import Autodesk.DesignScript.Geometry as DS
import Revit
from Revit.Elements import *
import System
sys.path.append("C:/Users/Lenovo/anaconda3/envs/revitenv/Lib/site-packages")
clr.AddReference('RevitAPI')
clr.AddReference('RevitAPIUI')
from Autodesk.Revit.DB import *
from Autodesk.Revit.UI import *

clr.AddReference('RevitServices')
from RevitServices.Persistence import DocumentManager
from RevitServices.Transactions import TransactionManager

clr.AddReference('RevitNodes')
import Revit
clr.ImportExtensions(Revit.Elements)
clr.ImportExtensions(Revit.GeometryConversion)

import re
import math
import json
import os
import traceback
import numpy as np
import torch
import cv2

from scipy.spatial import Voronoi
from scipy import ndimage
from shapely.geometry import Polygon, LineString, MultiLineString
from shapely.ops import linemerge
from shapely.ops import unary_union, split
from shapely.geometry import Point as ShpPoint
from shapely.geometry import Polygon as ShpPolygon
from shapely.geometry import MultiPolygon as ShpMultiPolygon
from shapely.geometry import Point as ShpPoint
from shapely.geometry import MultiLineString
from shapely.ops import linemerge
from skimage.morphology import skeletonize
from ultralytics import YOLO

dataEnteringNode = IN 

# =========================
# 输入
# =========================
dect_Model = IN[0]
pixpath = IN[1]
height = IN[2]
scale = IN[3]   # 保留作fallback
dims_json_path = IN[4]   # 新增：OCR尺寸结果json
seg_meta_json_path = IN[5]  # 新增：本节点输出json

#debug_scale
scale = 10
# =========================
# 参数
# =========================
origin = XYZ(0, 0, 0)   
widthFt = scale
pixelWidth = 1600   
pixelHeight = 1200 
DENSIFY_DIST = 0.5  
EPS = 1e-6

TARGET_WALL_TYPE_NAME = "基本墙 200mm"
TARGET_LEVEL_NAME = "标高 2"

newpath = "E:/yanjiu/revitss/tests/jjianzhu_seg.jpg"

# fallback 初始比例（当dims_json失败时使用）
scaleX = widthFt / pixelWidth if pixelWidth > 0 else 0.0
scaleY = widthFt * (pixelHeight / pixelWidth) / pixelHeight if pixelWidth > 0 and pixelHeight > 0 else 0.0

# 全局比例和bbox，供 pix_to_revit 使用
bbox_info_global = None
scale_x_ft_per_px_global = None
scale_y_ft_per_px_global = None

logs = []

# =========================
# 工具函数
# =========================
def ensure_dir_of_file(file_path):
    folder = os.path.dirname(file_path)
    if folder and not os.path.exists(folder):
        os.makedirs(folder)

def pix_to_revit(x, y):
    """
    优先使用：墙体bbox局部坐标 + OCR真实尺寸得到的比例
    fallback：原来的整图scale
    """
    global bbox_info_global, scale_x_ft_per_px_global, scale_y_ft_per_px_global

    try:
        if bbox_info_global is not None and scale_x_ft_per_px_global is not None and scale_y_ft_per_px_global is not None:
            min_x = bbox_info_global["min_x"]
            min_y = bbox_info_global["min_y"]
            bbox_h = bbox_info_global["height"]

            local_x = x - min_x
            local_y = y - min_y

            revit_x = origin.X + local_x * scale_x_ft_per_px_global
            revit_y = origin.Y + (bbox_h - local_y) * scale_y_ft_per_px_global
            return XYZ(revit_x, revit_y, origin.Z)
    except:
        pass

    revit_x = origin.X + x * scaleX
    revit_y = origin.Y + (pixelHeight - y) * scaleY
    return XYZ(revit_x, revit_y, origin.Z)

def sanitize_name(name):
    if not name:
        return "Unknown"
    cleaned = re.sub(r'[\x00-\x1f\x7f]', '', name)
    if not cleaned.strip():
        return "Unnamed"
    return cleaned

def get_mask_bbox(binary_mask, logs):
    """
    提取二值墙体mask的外接框
    """
    if binary_mask is None:
        logs.append("get_mask_bbox失败: binary_mask is None")
        return None

    ys, xs = np.where(binary_mask > 0)
    if len(xs) == 0 or len(ys) == 0:
        logs.append("get_mask_bbox失败: 墙体mask为空")
        return None

    min_x = int(np.min(xs))
    max_x = int(np.max(xs))
    min_y = int(np.min(ys))
    max_y = int(np.max(ys))

    bbox = {
        "min_x": min_x,
        "min_y": min_y,
        "max_x": max_x,
        "max_y": max_y,
        "width": int(max_x - min_x + 1),
        "height": int(max_y - min_y + 1)
    }
    logs.append("墙体mask bbox: {}".format(str(bbox)))
    return bbox

# 你必须根据自己的模型类别名修改这里
WALL_CLASS_NAMES = set(["wall", "Wall", "墙体"])
WALL_CLASS_KEYWORDS = [
    "wall",
    "Wall",
    "basic wall",
    "bearing wall",
    "non-bearing wall",
    "shear wall",
    "墙",
    "墙体",
    "基本墙",
    "基本墙 200mm",
    "承重墙",
    "非承重墙",
    "剪力墙"
]

def normalize_class_name(name):
    if name is None:
        return ""
    return str(name).strip().lower()

def is_wall_class(name):
    n = normalize_class_name(name)
    if not n:
        return False
    for kw in WALL_CLASS_KEYWORDS:
        if kw.lower() in n:
            return True
    return False

def ensure_polygon(geom):
    """
    将 geometry 尽量转成一个有效 Polygon
    如果是 MultiPolygon，则取面积最大的一个
    """
    if geom is None or geom.is_empty:
        return None
    try:
        if not geom.is_valid:
            geom = geom.buffer(0)
    except:
        pass
    if geom is None or geom.is_empty:
        return None

    if isinstance(geom, ShpPolygon):
        return geom

    if isinstance(geom, ShpMultiPolygon):
        polys = [g for g in geom.geoms if g is not None and not g.is_empty]
        if not polys:
            return None
        polys.sort(key=lambda p: p.area, reverse=True)
        return polys[0]

    return None

def contour_to_polygon(contour_pts):
    """
    contour_pts: YOLO mask contour pixel points
    转成shapely polygon（Revit坐标系）
    """
    revit_pts = [pix_to_revit(pt[0], pt[1]) for pt in contour_pts]
    if len(revit_pts) < 3:
        return None
    coords = [(p.X, p.Y) for p in revit_pts]
    if coords[0] != coords[-1]:
        coords.append(coords[0])
    poly = ShpPolygon(coords)
    poly = ensure_polygon(poly)
    return poly

def line_long_enough(line_geom, min_len=0.1):
    if line_geom is None or line_geom.is_empty:
        return False
    try:
        return line_geom.length >= min_len
    except:
        return False

def snap_line_to_axis(line_geom):
    """
    对线段做水平/垂直吸附
    """
    if line_geom is None or line_geom.is_empty:
        return None
    coords = list(line_geom.coords)
    if len(coords) < 2:
        return None
    x1, y1 = coords[0]
    x2, y2 = coords[-1]
    dx = x2 - x1
    dy = y2 - y1
    if abs(dx) >= abs(dy):
        ym = 0.5 * (y1 + y2)
        return LineString([(x1, ym), (x2, ym)])
    else:
        xm = 0.5 * (x1 + x2)
        return LineString([(xm, y1), (xm, y2)])

def longest_linestring_from_intersection(inter):
    """
    从 intersection 结果中取最长的 LineString
    """
    if inter is None or inter.is_empty:
        return None
    if inter.geom_type == "LineString":
        return inter
    if inter.geom_type == "MultiLineString":
        lines = [g for g in inter.geoms if g.length > 1e-4]
        if not lines:
            return None
        lines.sort(key=lambda g: g.length, reverse=True)
        return lines[0]
    return None

def estimate_centerline_from_polygon(poly):
    """
    稳定版中心线初始化
    """
    if poly is None or poly.is_empty:
        return None, None

    poly = ensure_polygon(poly)
    if poly is None:
        return None, None

    if poly.area < 1e-5:
        return None, None

    try:
        mrr = poly.minimum_rotated_rectangle
    except:
        return None, None

    mrr = ensure_polygon(mrr)
    if mrr is None:
        return None, None

    rect_coords = list(mrr.exterior.coords)[:-1]
    if len(rect_coords) != 4:
        return None, None

    edges = []
    for i in range(4):
        p1 = rect_coords[i]
        p2 = rect_coords[(i + 1) % 4]
        length = ((p2[0]-p1[0])**2 + (p2[1]-p1[1])**2) ** 0.5
        edges.append((p1, p2, length))

    edges_sorted = sorted(edges, key=lambda e: e[2], reverse=True)
    long_edge = edges_sorted[0]

    long_len = long_edge[2]
    if long_len < 0.1:
        return None, None

    p1, p2, _ = long_edge
    dx = p2[0] - p1[0]
    dy = p2[1] - p1[1]
    norm = (dx*dx + dy*dy) ** 0.5
    if norm < EPS:
        return None, None
    ux = dx / norm
    uy = dy / norm

    c = poly.centroid
    minx, miny, maxx, maxy = poly.bounds
    diag = ((maxx-minx)**2 + (maxy-miny)**2) ** 0.5 + 10.0

    raw_line = LineString([
        (c.x - ux * diag, c.y - uy * diag),
        (c.x + ux * diag, c.y + uy * diag)
    ])

    inter = raw_line.intersection(poly)
    centerline = longest_linestring_from_intersection(inter)
    if centerline is None:
        return None, None

    centerline = snap_line_to_axis(centerline)
    if centerline is None or centerline.length < 0.1:
        return None, None

    thickness = poly.area / max(centerline.length, EPS)

    if thickness < 0.05:
        thickness = 0.05
    if thickness > 2.0:
        thickness = 2.0

    return centerline, thickness

def merge_close_vertices(segments, delta):
    pts = []
    for seg in segments:
        coords = list(seg['line'].coords)
        pts.append(coords[0])
        pts.append(coords[-1])

    if not pts:
        return segments

    clusters = []
    for p in pts:
        assigned = False
        for cluster in clusters:
            cx, cy, plist = cluster
            d2 = (p[0]-cx)**2 + (p[1]-cy)**2
            if d2 < delta * delta:
                plist.append(p)
                nx = sum(pp[0] for pp in plist) / len(plist)
                ny = sum(pp[1] for pp in plist) / len(plist)
                cluster[0] = nx
                cluster[1] = ny
                assigned = True
                break
        if not assigned:
            clusters.append([p[0], p[1], [p]])

    def snap_point(p):
        best = p
        best_d = 1e18
        for cx, cy, plist in clusters:
            d2 = (p[0]-cx)**2 + (p[1]-cy)**2
            if d2 < best_d:
                best_d = d2
                best = (cx, cy)
        return best

    new_segments = []
    for seg in segments:
        coords = list(seg['line'].coords)
        p1 = snap_point(coords[0])
        p2 = snap_point(coords[-1])
        if ((p1[0]-p2[0])**2 + (p1[1]-p2[1])**2) ** 0.5 < 0.1:
            continue
        new_line = LineString([p1, p2])
        new_segments.append({
            'line': snap_line_to_axis(new_line),
            'thickness': seg['thickness'],
            'name': seg['name']
        })
    return new_segments

def point_to_segment_distance(pt, a, b):
    px, py = pt
    ax, ay = a
    bx, by = b
    dx = bx - ax
    dy = by - ay
    if abs(dx) < EPS and abs(dy) < EPS:
        return ((px-ax)**2 + (py-ay)**2)**0.5, a, 0.0

    t = ((px-ax)*dx + (py-ay)*dy) / (dx*dx + dy*dy)
    t_clamped = max(0.0, min(1.0, t))
    qx = ax + t_clamped * dx
    qy = ay + t_clamped * dy
    dist = ((px-qx)**2 + (py-qy)**2)**0.5
    return dist, (qx, qy), t_clamped

def split_segments_by_near_vertices(segments, delta):
    if not segments:
        return segments

    vertices = []
    for seg in segments:
        coords = list(seg['line'].coords)
        vertices.append(coords[0])
        vertices.append(coords[-1])

    new_segments = []
    for idx, seg in enumerate(segments):
        coords = list(seg['line'].coords)
        a = coords[0]
        b = coords[-1]
        split_pts = []

        for v in vertices:
            if v == a or v == b:
                continue
            dist, proj, t = point_to_segment_distance(v, a, b)
            if dist < delta and t > 0.01 and t < 0.99:
                split_pts.append((t, v))

        if not split_pts:
            new_segments.append(seg)
        else:
            split_pts.sort(key=lambda x: x[0])
            chain = [a] + [v for _, v in split_pts] + [b]
            for p1, p2 in zip(chain[:-1], chain[1:]):
                if ((p1[0]-p2[0])**2 + (p1[1]-p2[1])**2) ** 0.5 < 0.1:
                    continue
                new_line = snap_line_to_axis(LineString([p1, p2]))
                new_segments.append({
                    'line': new_line,
                    'thickness': seg['thickness'],
                    'name': seg['name']
                })
    return new_segments

def merge_collinear_segments(segments, gap_tol=0.3):
    if not segments:
        return segments

    horizontal = []
    vertical = []
    others = []

    for seg in segments:
        coords = list(seg['line'].coords)
        x1, y1 = coords[0]
        x2, y2 = coords[-1]
        if abs(y2 - y1) < 1e-6:
            xmin = min(x1, x2)
            xmax = max(x1, x2)
            horizontal.append((y1, xmin, xmax, seg))
        elif abs(x2 - x1) < 1e-6:
            ymin = min(y1, y2)
            ymax = max(y1, y2)
            vertical.append((x1, ymin, ymax, seg))
        else:
            others.append(seg)

    result = []

    by_y = {}
    for y, xmin, xmax, seg in horizontal:
        yk = round(y, 3)
        by_y.setdefault(yk, []).append((xmin, xmax, seg))

    for yk, arr in by_y.items():
        arr.sort(key=lambda x: x[0])
        cur_x1, cur_x2, cur_seg = arr[0]
        thick = cur_seg['thickness']
        name = cur_seg['name']
        for nx1, nx2, nseg in arr[1:]:
            if nx1 <= cur_x2 + gap_tol:
                cur_x2 = max(cur_x2, nx2)
                thick = (thick + nseg['thickness']) / 2.0
            else:
                result.append({
                    'line': LineString([(cur_x1, yk), (cur_x2, yk)]),
                    'thickness': thick,
                    'name': name
                })
                cur_x1, cur_x2, cur_seg = nx1, nx2, nseg
                thick = cur_seg['thickness']
                name = cur_seg['name']
        result.append({
            'line': LineString([(cur_x1, yk), (cur_x2, yk)]),
            'thickness': thick,
            'name': name
        })

    by_x = {}
    for x, ymin, ymax, seg in vertical:
        xk = round(x, 3)
        by_x.setdefault(xk, []).append((ymin, ymax, seg))

    for xk, arr in by_x.items():
        arr.sort(key=lambda x: x[0])
        cur_y1, cur_y2, cur_seg = arr[0]
        thick = cur_seg['thickness']
        name = cur_seg['name']
        for ny1, ny2, nseg in arr[1:]:
            if ny1 <= cur_y2 + gap_tol:
                cur_y2 = max(cur_y2, ny2)
                thick = (thick + nseg['thickness']) / 2.0
            else:
                result.append({
                    'line': LineString([(xk, cur_y1), (xk, cur_y2)]),
                    'thickness': thick,
                    'name': name
                })
                cur_y1, cur_y2, cur_seg = ny1, ny2, nseg
                thick = cur_seg['thickness']
                name = cur_seg['name']
        result.append({
            'line': LineString([(xk, cur_y1), (xk, cur_y2)]),
            'thickness': thick,
            'name': name
        })

    result.extend(others)
    return result

def optimize_wall_centerlines(candidates, iter_count=1, enable_merge_collinear=True):
    if not candidates:
        return []

    segs = candidates[:]

    if enable_merge_collinear:
        segs = merge_collinear_segments_strict(segs, coord_tol=0.08, gap_tol=0.35)

    for _ in range(iter_count):
        if not segs:
            break

        avg_t = sum(s['thickness'] for s in segs) / max(len(segs), 1)
        delta = 0.20 * avg_t
        if delta < 0.03:
            delta = 0.03
        if delta > 0.12:
            delta = 0.12

        segs = merge_close_vertices(segs, delta)
        segs = split_segments_by_near_vertices(segs, delta)

    cleaned = []
    for s in segs:
        try:
            if s['line'] is None or s['line'].is_empty:
                continue
            if s['line'].length < 0.08:
                continue
            cleaned.append(s)
        except:
            continue

    return cleaned

def get_wall_type_by_name(doc, type_name):
    wall_type_collector = FilteredElementCollector(doc).OfClass(WallType)
    found = None
    for wt in wall_type_collector:
        if wt.Kind == WallKind.Basic:
            name_param = wt.get_Parameter(BuiltInParameter.SYMBOL_NAME_PARAM)
            if name_param and name_param.AsString() == type_name:
                found = wt
                break
    if found:
        return found
    for wt in wall_type_collector:
        if wt.Kind == WallKind.Basic:
            return wt
    return None

def build_global_wall_mask(result, pixelWidth, pixelHeight, logs):
    wall_mask = np.zeros((pixelHeight, pixelWidth), dtype=np.uint8)

    if result.masks is None:
        logs.append("result.masks is None")
        return wall_mask

    masks_xy = result.masks.xy
    cls_ids = result.boxes.cls.cpu().numpy().astype(int)
    names = result.names

    logs.append("总mask数量: {}".format(len(masks_xy)))

    for i, contour_pts in enumerate(masks_xy):
        try:
            if i >= len(cls_ids):
                continue
            class_id = cls_ids[i]
            class_name = names[class_id]

            if not is_wall_class(class_name):
                continue

            pts = np.array(contour_pts, dtype=np.int32)
            if len(pts) < 3:
                continue

            pts[:, 0] = np.clip(pts[:, 0], 0, pixelWidth - 1)
            pts[:, 1] = np.clip(pts[:, 1], 0, pixelHeight - 1)

            cv2.fillPoly(wall_mask, [pts], 255)

        except Exception as e:
            logs.append("合成墙mask失败 idx={}: {}".format(i, str(e)))
            continue

    return wall_mask

def clean_wall_mask(binary_mask, logs):
    mask = binary_mask.copy()

    kernel_close = cv2.getStructuringElement(cv2.MORPH_RECT, (5, 5))
    kernel_open = cv2.getStructuringElement(cv2.MORPH_RECT, (3, 3))

    mask = cv2.morphologyEx(mask, cv2.MORPH_CLOSE, kernel_close)
    mask = cv2.morphologyEx(mask, cv2.MORPH_OPEN, kernel_open)

    num_labels, labels, stats, _ = cv2.connectedComponentsWithStats(mask, connectivity=8)
    cleaned = np.zeros_like(mask)

    for i in range(1, num_labels):
        area = stats[i, cv2.CC_STAT_AREA]
        if area >= 50:
            cleaned[labels == i] = 255

    logs.append("墙mask清理完成")
    return cleaned

def estimate_wall_width_pixels(binary_mask, logs):
    if binary_mask is None or binary_mask.max() == 0:
        logs.append("墙宽估计失败：mask为空")
        return 6.0

    dist = cv2.distanceTransform(binary_mask, cv2.DIST_L2, 5)
    vals = dist[dist > 0]
    if len(vals) == 0:
        logs.append("墙宽估计失败：distanceTransform为空")
        return 6.0

    wall_width_px = max(2.0, 2.0 * np.median(vals))
    logs.append("估计墙宽像素值: {:.2f}".format(wall_width_px))
    return wall_width_px

def skeletonize_wall_mask(binary_mask, logs):
    try:
        from skimage.morphology import skeletonize
        skel = skeletonize(binary_mask > 0)
        logs.append("使用 skimage.skeletonize 成功")
        return skel.astype(np.uint8)
    except Exception as e:
        logs.append("skimage骨架失败，改用fallback: {}".format(str(e)))
        return skeletonize_fallback(binary_mask, logs)

def skeletonize_fallback(binary_mask, logs):
    img = (binary_mask > 0).astype(np.uint8) * 255
    size = np.size(img)
    skel = np.zeros(img.shape, np.uint8)

    element = cv2.getStructuringElement(cv2.MORPH_CROSS, (3, 3))
    done = False

    while not done:
        eroded = cv2.erode(img, element)
        temp = cv2.dilate(eroded, element)
        temp = cv2.subtract(img, temp)
        skel = cv2.bitwise_or(skel, temp)
        img = eroded.copy()

        zeros = size - cv2.countNonZero(img)
        if zeros == size:
            done = True

    logs.append("fallback skeletonize 成功")
    return (skel > 0).astype(np.uint8)

def get_neighbors_8(x, y, w, h):
    nbs = []
    for dy in [-1, 0, 1]:
        for dx in [-1, 0, 1]:
            if dx == 0 and dy == 0:
                continue
            nx = x + dx
            ny = y + dy
            if 0 <= nx < w and 0 <= ny < h:
                nbs.append((nx, ny))
    return nbs

def extract_skeleton_graph(skel, logs):
    h, w = skel.shape
    skel_pts = set()
    for y in range(h):
        xs = np.where(skel[y] > 0)[0]
        for x in xs:
            skel_pts.add((x, y))

    if not skel_pts:
        logs.append("骨架为空")
        return [], []

    degree = {}
    for (x, y) in skel_pts:
        cnt = 0
        for nx, ny in get_neighbors_8(x, y, w, h):
            if (nx, ny) in skel_pts:
                cnt += 1
        degree[(x, y)] = cnt

    nodes = [p for p, d in degree.items() if d != 2]

    if not nodes:
        nodes = list(skel_pts)

    node_set = set(nodes)
    visited_edges = set()
    edges = []

    for node in nodes:
        x0, y0 = node
        for nx, ny in get_neighbors_8(x0, y0, w, h):
            if (nx, ny) not in skel_pts:
                continue

            edge_key = tuple(sorted([node, (nx, ny)]))
            if edge_key in visited_edges:
                continue

            path = [node, (nx, ny)]
            prev = node
            curr = (nx, ny)

            while True:
                visited_edges.add(tuple(sorted([prev, curr])))

                if curr in node_set and curr != node:
                    break

                nbrs = []
                for tx, ty in get_neighbors_8(curr[0], curr[1], w, h):
                    if (tx, ty) in skel_pts and (tx, ty) != prev:
                        nbrs.append((tx, ty))

                if len(nbrs) == 0:
                    break
                if len(nbrs) > 1:
                    break

                nxt = nbrs[0]
                path.append(nxt)
                prev = curr
                curr = nxt

            if len(path) >= 2:
                edges.append(path)

    logs.append("骨架图提取完成: nodes={}, edges={}".format(len(nodes), len(edges)))
    return nodes, edges

def simplify_path_to_axis_lines(path, wall_mask, pixelWidth, pixelHeight, logs, min_len_px=8):
    result_lines = []

    sub_paths = split_path_by_direction(path, turn_threshold=2)
    for sub in sub_paths:
        try:
            fitted = fit_axis_line_from_mask(
                sub, wall_mask, pixelWidth, pixelHeight, min_len_px=min_len_px
            )
            if fitted is None:
                continue

            p1, p2, ori = fitted
            line_geom = pixel_line_to_revit_linestring(p1, p2)
            if line_geom is None:
                continue

            if line_geom.length < 0.08:
                continue

            result_lines.append(line_geom)

        except Exception as e:
            logs.append("子段拟合失败: {}".format(str(e)))
            continue

    return result_lines

def extract_wall_centerlines_from_global_mask(result, pixelWidth, pixelHeight, logs):
    wall_mask = build_global_wall_mask(result, pixelWidth, pixelHeight, logs)
    if wall_mask.max() == 0:
        logs.append("没有墙类mask被写入全局墙图")
        return [], 0.3

    cleaned_mask = clean_wall_mask(wall_mask, logs)
    wall_width_px = estimate_wall_width_pixels(cleaned_mask, logs)

    skel = skeletonize_wall_mask(cleaned_mask, logs)
    nodes, edges = extract_skeleton_graph(skel, logs)

    if not edges:
        logs.append("骨架没有边")
        # 优先使用真实比例
        wall_width_ft = wall_width_px * (scale_x_ft_per_px_global if scale_x_ft_per_px_global else scaleX)
        return [], wall_width_ft

    wall_width_ft = wall_width_px * (scale_x_ft_per_px_global if scale_x_ft_per_px_global else scaleX)
    candidates = []

    for idx, path in enumerate(edges):
        try:
            line_list = simplify_path_to_axis_lines(
                path, cleaned_mask, pixelWidth, pixelHeight, logs, min_len_px=max(6, int(wall_width_px))
            )

            for line_geom in line_list:
                candidates.append({
                    'line': line_geom,
                    'thickness': wall_width_ft,
                    'name': "Wall"
                })

        except Exception as e:
            logs.append("路径{}转中心线失败: {}".format(idx, str(e)))
            continue

    logs.append("全局提取中心线候选数量: {}".format(len(candidates)))
    return candidates, wall_width_ft

def merge_collinear_segments_strict(segments, coord_tol=0.08, gap_tol=0.25):
    if not segments:
        return segments

    horizontal = []
    vertical = []
    others = []

    for seg in segments:
        coords = list(seg['line'].coords)
        x1, y1 = coords[0]
        x2, y2 = coords[-1]

        if abs(y2 - y1) <= coord_tol:
            y = 0.5 * (y1 + y2)
            xmin, xmax = min(x1, x2), max(x1, x2)
            horizontal.append((y, xmin, xmax, seg))
        elif abs(x2 - x1) <= coord_tol:
            x = 0.5 * (x1 + x2)
            ymin, ymax = min(y1, y2), max(y1, y2)
            vertical.append((x, ymin, ymax, seg))
        else:
            others.append(seg)

    merged = []

    horizontal.sort(key=lambda t: (round(t[0], 2), t[1]))
    used = [False] * len(horizontal)
    for i in range(len(horizontal)):
        if used[i]:
            continue
        y, x1, x2, seg = horizontal[i]
        thick = seg['thickness']
        name = seg['name']

        for j in range(i + 1, len(horizontal)):
            if used[j]:
                continue
            y2, xx1, xx2, seg2 = horizontal[j]
            if abs(y2 - y) <= coord_tol and xx1 <= x2 + gap_tol:
                x2 = max(x2, xx2)
                thick = 0.5 * (thick + seg2['thickness'])
                used[j] = True

        merged.append({
            'line': LineString([(x1, y), (x2, y)]),
            'thickness': thick,
            'name': name
        })

    vertical.sort(key=lambda t: (round(t[0], 2), t[1]))
    used = [False] * len(vertical)
    for i in range(len(vertical)):
        if used[i]:
            continue
        x, y1, y2, seg = vertical[i]
        thick = seg['thickness']
        name = seg['name']

        for j in range(i + 1, len(vertical)):
            if used[j]:
                continue
            x2, yy1, yy2, seg2 = vertical[j]
            if abs(x2 - x) <= coord_tol and yy1 <= y2 + gap_tol:
                y2 = max(y2, yy2)
                thick = 0.5 * (thick + seg2['thickness'])
                used[j] = True

        merged.append({
            'line': LineString([(x, y1), (x, y2)]),
            'thickness': thick,
            'name': name
        })

    merged.extend(others)
    return merged

def split_path_by_direction(path, turn_threshold=2):
    if not path or len(path) < 3:
        return [path] if path else []

    segments = []
    current = [path[0], path[1]]

    def major_dir(p1, p2):
        dx = p2[0] - p1[0]
        dy = p2[1] - p1[1]
        if abs(dx) >= abs(dy):
            return "h"
        else:
            return "v"

    prev_dir = major_dir(path[0], path[1])

    for i in range(2, len(path)):
        d = major_dir(path[i-1], path[i])

        if d == prev_dir:
            current.append(path[i])
        else:
            if len(current) <= turn_threshold and segments:
                segments[-1].extend(current[1:])
                current = [segments[-1][-1], path[i]]
            else:
                segments.append(current)
                current = [path[i-1], path[i]]
            prev_dir = d

    if current:
        if len(current) <= turn_threshold and segments:
            segments[-1].extend(current[1:])
        else:
            segments.append(current)

    cleaned = []
    for seg in segments:
        if seg and len(seg) >= 2:
            cleaned.append(seg)

    return cleaned

def fit_axis_line_from_mask(sub_path, wall_mask, pixelWidth, pixelHeight, min_len_px=8):
    if not sub_path or len(sub_path) < 2:
        return None

    xs = [p[0] for p in sub_path]
    ys = [p[1] for p in sub_path]

    x_min = max(0, int(min(xs)))
    x_max = min(pixelWidth - 1, int(max(xs)))
    y_min = max(0, int(min(ys)))
    y_max = min(pixelHeight - 1, int(max(ys)))

    dx = x_max - x_min
    dy = y_max - y_min

    if dx >= dy:
        mids = []
        for x in range(x_min, x_max + 1):
            ys_in = np.where(wall_mask[:, x] > 0)[0]
            ys_local = ys_in[(ys_in >= y_min - 8) & (ys_in <= y_max + 8)]
            if len(ys_local) >= 2:
                y_top = np.min(ys_local)
                y_bot = np.max(ys_local)
                y_mid = 0.5 * (y_top + y_bot)
                mids.append((x, y_mid))

        if len(mids) < 2:
            return None

        xs2 = [p[0] for p in mids]
        ys2 = [p[1] for p in mids]

        x1 = min(xs2)
        x2 = max(xs2)
        y = float(np.median(ys2))

        if (x2 - x1) < min_len_px:
            return None

        return ((x1, y), (x2, y), "h")

    else:
        mids = []
        for y in range(y_min, y_max + 1):
            xs_in = np.where(wall_mask[y, :] > 0)[0]
            xs_local = xs_in[(xs_in >= x_min - 8) & (xs_in <= x_max + 8)]
            if len(xs_local) >= 2:
                x_left = np.min(xs_local)
                x_right = np.max(xs_local)
                x_mid = 0.5 * (x_left + x_right)
                mids.append((x_mid, y))

        if len(mids) < 2:
            return None

        xs2 = [p[0] for p in mids]
        ys2 = [p[1] for p in mids]

        y1 = min(ys2)
        y2 = max(ys2)
        x = float(np.median(xs2))

        if (y2 - y1) < min_len_px:
            return None

        return ((x, y1), (x, y2), "v")

def pixel_line_to_revit_linestring(p1, p2):
    rp1 = pix_to_revit(p1[0], p1[1])
    rp2 = pix_to_revit(p2[0], p2[1])
    if rp1.DistanceTo(rp2) < 0.1:
        return None
    return LineString([(rp1.X, rp1.Y), (rp2.X, rp2.Y)])

# =========================
# 运行YOLO分割
# =========================
yolo_seg = YOLO(dect_Model, task="seg")
seg_result = yolo_seg(source=pixpath, save=False, conf=0.3, iou=0.45, imgsz=640)
cv2.imwrite(newpath, seg_result[0].plot())

result = seg_result[0]
boxes = result.boxes
xyxy = boxes.xyxy.cpu().numpy() if boxes is not None else np.empty((0,4))
cls_ids = boxes.cls.cpu().numpy().astype(int) if boxes is not None else np.array([], dtype=int)
names = result.names

# =========================
# 读取OCR尺寸JSON
# =========================
dims_data = None
horizontal_length_mm = None
vertical_length_mm = None

try:
    with open(dims_json_path, "r", encoding="utf-8") as f:
        dims_data = json.load(f)

    if dims_data.get("ok", False):
        # 兼容两种结构：1) result包裹 2) 直接平铺
        if "result" in dims_data:
            horizontal_length_mm = dims_data["result"].get("horizontal_length", None)
            vertical_length_mm = dims_data["result"].get("vertical_length", None)
        else:
            horizontal_length_mm = dims_data.get("horizontal_length", None)
            vertical_length_mm = dims_data.get("vertical_length", None)

    logs.append("读取dims_json成功: horizontal={} mm, vertical={} mm".format(
        str(horizontal_length_mm), str(vertical_length_mm)
    ))
except Exception as e:
    logs.append("读取dims_json失败: {}".format(str(e)))

# =========================
# 先做全局墙mask -> bbox -> scale
# =========================
global_wall_mask = build_global_wall_mask(result, pixelWidth, pixelHeight, logs)
cleaned_global_wall_mask = clean_wall_mask(global_wall_mask, logs)
bbox_info = get_mask_bbox(cleaned_global_wall_mask, logs)

scale_x_mm_per_px = None
scale_y_mm_per_px = None
scale_avg_mm_per_px = None
scale_x_ft_per_px = None
scale_y_ft_per_px = None
scale_avg_ft_per_px = None

if bbox_info is not None and horizontal_length_mm is not None and vertical_length_mm is not None:
    try:
        bbox_w = bbox_info["width"]
        bbox_h = bbox_info["height"]

        if bbox_w > 0 and bbox_h > 0:
            scale_x_mm_per_px = float(horizontal_length_mm) / float(bbox_w)
            scale_y_mm_per_px = float(vertical_length_mm) / float(bbox_h)
            scale_avg_mm_per_px = (scale_x_mm_per_px + scale_y_mm_per_px) / 2.0

            mm_to_ft = 1.0 / 304.8
            scale_x_ft_per_px = scale_x_mm_per_px * mm_to_ft
            scale_y_ft_per_px = scale_y_mm_per_px * mm_to_ft
            scale_avg_ft_per_px = scale_avg_mm_per_px * mm_to_ft

            bbox_info_global = bbox_info
            scale_x_ft_per_px_global = scale_x_ft_per_px
            scale_y_ft_per_px_global = scale_y_ft_per_px

            logs.append("scale_x_mm_per_px={:.6f}".format(scale_x_mm_per_px))
            logs.append("scale_y_mm_per_px={:.6f}".format(scale_y_mm_per_px))
            logs.append("scale_avg_mm_per_px={:.6f}".format(scale_avg_mm_per_px))
            logs.append("scale_x_ft_per_px={:.6f}".format(scale_x_ft_per_px))
            logs.append("scale_y_ft_per_px={:.6f}".format(scale_y_ft_per_px))
        else:
            logs.append("bbox宽高无效，无法计算scale")
    except Exception as e:
        logs.append("scale计算失败: {}".format(str(e)))
else:
    logs.append("bbox或真实尺寸缺失，使用fallback整图scale")

# =========================
# Revit文档对象
# =========================
doc = DocumentManager.Instance.CurrentDBDocument
app = doc.Application

# --- 获取墙类型 ---
wall_type = None
wall_type_collector = FilteredElementCollector(doc).OfClass(WallType)

for wt in wall_type_collector:
    if wt.Kind == WallKind.Basic:
        name_param = wt.get_Parameter(BuiltInParameter.SYMBOL_NAME_PARAM)
        if name_param and name_param.AsString() == TARGET_WALL_TYPE_NAME:
            wall_type = wt
            break

if wall_type is None:
    for wt in wall_type_collector:
        if wt.Kind == WallKind.Basic:
            wall_type = wt
            break

if wall_type is None:
    raise Exception("项目中找不到任何基本墙类型！")

# --- 获取标高 ---
level = None
level_collector = FilteredElementCollector(doc).OfClass(Level)
for lvl in level_collector:
    name_param = lvl.get_Parameter(BuiltInParameter.LEVEL_NAME)
    if name_param and name_param.AsString() == TARGET_LEVEL_NAME:
        level = lvl
        break

if level is None:
    level = level_collector.FirstElement()
    if level is None:
        raise Exception("项目中找不到任何标高！")

TransactionManager.Instance.EnsureInTransaction(doc)

created_lines = []
dyn_lines = []
dyn_faces = [] 
created_shapes = []
created_walls = []
wall_candidates = []

thickness = height
wallHeight = height

plane = Plane.CreateByNormalAndOrigin(XYZ.BasisZ, origin)
sketch_plane = SketchPlane.Create(doc, plane)

DEFAULT_WALL_WIDTH = 0.3

# =========================
# 提取中心线并创建墙
# =========================
if result.masks is not None:
    logs.append("YOLO类别映射: {}".format(str(result.names)))

    wall_candidates, default_wall_thickness = extract_wall_centerlines_from_global_mask(
        result, pixelWidth, pixelHeight, logs
    )

    logs.append("初始墙候选数量: {}".format(len(wall_candidates)))

    optimized_walls = optimize_wall_centerlines(
        wall_candidates,
        iter_count=1,
        enable_merge_collinear=False
    )

    logs.append("优化后墙数量: {}".format(len(optimized_walls)))

    for idx, w in enumerate(optimized_walls):
        try:
            line_geom = w['line']
            thickness_val = w['thickness']
            name = w['name']

            coords = list(line_geom.coords)
            if len(coords) < 2:
                logs.append("墙{}失败：coords不足".format(idx))
                continue

            start_pt = XYZ(coords[0][0], coords[0][1], 0)
            end_pt = XYZ(coords[-1][0], coords[-1][1], 0)

            if start_pt.DistanceTo(end_pt) < 0.1:
                logs.append("墙{}失败：线太短".format(idx))
                continue

            revit_line = Line.CreateBound(start_pt, end_pt)

            logs.append("准备创建墙{}: len={:.3f}, thickness={:.3f}".format(
                idx, revit_line.Length, thickness_val
            ))

            wall = Wall.Create(doc, revit_line, wall_type.Id, level.Id, wallHeight, 0, False, False)

            try:
                param = wall.get_Parameter(BuiltInParameter.WALL_ATTR_WIDTH_PARAM)
                if param and not param.IsReadOnly:
                    param.Set(thickness_val)
            except Exception as e2:
                logs.append("墙{}宽度设置失败(可忽略): {}".format(idx, str(e2)))

            try:
                wall.Name = sanitize_name(name)
            except:
                pass

            created_walls.append(wall.ToDSType(True))
            logs.append("墙{}创建成功".format(idx))

        except Exception as e:
            logs.append("墙{}创建失败: {}".format(idx, str(e)))
            logs.append(traceback.format_exc())
            continue
else:
    logs.append("result.masks is None，没有分割mask")

# =========================
# 提交事务
# =========================
TransactionManager.Instance.TransactionTaskDone()
doc.Regenerate()

# =========================
# 写 seg_meta_json
# =========================
seg_meta = {
    "ok": True,
    "image_path": pixpath,
    "seg_vis_path": newpath,
    "dims_json_path": dims_json_path,
    "wall_bbox_px": bbox_info,
    "real_size_mm": {
        "horizontal_length": horizontal_length_mm,
        "vertical_length": vertical_length_mm
    },
    "scale": {
        "scale_x_mm_per_px": scale_x_mm_per_px,
        "scale_y_mm_per_px": scale_y_mm_per_px,
        "scale_avg_mm_per_px": scale_avg_mm_per_px,
        "scale_x_ft_per_px": scale_x_ft_per_px,
        "scale_y_ft_per_px": scale_y_ft_per_px,
        "scale_avg_ft_per_px": scale_avg_ft_per_px
    },
    "debug": {
        "pixelWidth": pixelWidth,
        "pixelHeight": pixelHeight,
        "wall_count": len(created_walls),
        "mask_count": len(result.masks.xy) if result.masks is not None else 0,
        "class_names": result.names,
        "log_count": len(logs)
    }
}

try:
    ensure_dir_of_file(seg_meta_json_path)
    with open(seg_meta_json_path, "w", encoding="utf-8") as f:
        json.dump(seg_meta, f, ensure_ascii=False, indent=2)
    logs.append("seg_meta_json已写出: {}".format(seg_meta_json_path))
except Exception as e:
    logs.append("seg_meta_json写出失败: {}".format(str(e)))

# =========================
# 输出
# =========================
OUT = newpath, created_walls, seg_meta_json_path, logs
# ----------------------------------------
python_version_16 = Watch(python_script_15)  # graph output
python_version_17 = CodeBlock(i=python_version_5) { i[0]; }
file_from_path_8 = FileObject(path=python_version_17)
readFromFile_8 = Image.ReadFromFile(file=file_from_path_8)
watch_image_8 = WatchImageCore(image=readFromFile_8)
python_script_16 = Python(IN[0]=modelpath_3, IN[1]=imagepath_2, IN[2]=scale)  # CPython3; frozen
# ---------- python_script_16.python (283 lines) ----------
# 加载  PythonStandard 和 DesignScript 库
import sys
import clr
clr.AddReference('ProtoGeometry')
from Autodesk.DesignScript.Geometry import *
import Autodesk.DesignScript.Geometry as DS
import Revit
from Revit.Elements import *
import System
sys.path.append("C:/Users/Lenovo/anaconda3/envs/revitenv/Lib/site-packages")
clr.AddReference('RevitAPI')
clr.AddReference('RevitAPIUI')
from Autodesk.Revit.DB import *
from Autodesk.Revit.UI import *

clr.AddReference('RevitServices')
from RevitServices.Persistence import DocumentManager
from RevitServices.Transactions import TransactionManager

clr.AddReference('RevitNodes')
import Revit
clr.ImportExtensions(Revit.Elements)
clr.ImportExtensions(Revit.GeometryConversion)
#
import math
import re
import numpy as np
import torch
import cv2
from ultralytics import YOLO

dataEnteringNode = IN 
pose_Model = IN[0]
pixpath = IN[1]
scale = IN[2]
target_family_name = IN[3] if len(IN) > 3 else "Bed"
target_type_name = IN[4] if len(IN) > 4 else "Only_Bed"
#params
origin = XYZ(0, 0, 0)   
widthFt = scale
pixelWidth = 1600   
pixelHeight = 1200                          
#                         
yolo_pose = YOLO(pose_Model, task="pose")
newpath = "E:/yanjiu/revitss/tests/jjianzhu_pose.jpg"

pose_results = yolo_pose(
    source=pixpath,
    save=False,
    conf=0.3,
    iou=0.45,
    imgsz=640)
cv2.imwrite(newpath,pose_results[0].plot())

scaleX = widthFt / pixelWidth
scaleY = widthFt * (pixelHeight / pixelWidth) / pixelHeight  

result = pose_results[0]       
boxes = result.boxes.xyxy.cpu().numpy() if result.boxes is not None else []
cls_ids = result.boxes.cls.cpu().numpy().astype(int) if result.boxes is not None else []
names = result.names
kps_xy = None
if result.keypoints is not None and result.keypoints.xy is not None:
    kps_xy = result.keypoints.xy.cpu().numpy()

doc = DocumentManager.Instance.CurrentDBDocument
app = doc.Application
TransactionManager.Instance.EnsureInTransaction(doc)

#process areas
bed_indices = []
bed_areas = []
for i, bbox in enumerate(boxes):
    cls_name = names[int(cls_ids[i])] if len(cls_ids) > i else ""
    if cls_name != "Bed":
        continue

    x1, y1, x2, y2 = bbox
    area = max(0, (x2 - x1)) * max(0, (y2 - y1))
    bed_indices.append(i)
    bed_areas.append(area)

if len(bed_areas) > 0:
    median_bed_area = float(np.median(bed_areas))
    min_area_threshold = median_bed_area * 0.33
else:
    median_bed_area = 0.0
    min_area_threshold = 0.0


#---
created_lines = []
dyn_lines = []
dyn_faces = [] 
created_shapes = []

def pix_to_revit(x, y):
    revit_x = origin.X + x * scaleX
    revit_y = origin.Y + (pixelHeight - y) * scaleY  # 翻转 Y 轴
    return XYZ(revit_x, revit_y, origin.Z)
def sanitize_name(name):
    # 如果名称为空，返回默认名称
    if not name:
        return "Unknown"
    # 移除控制字符（ASCII 0-31，除了tab? 但最好全部移除）
    # 允许常见字符：字母、数字、空格、下划线、连字符、中文等
    # 保留所有打印字符，移除控制字符
    cleaned = re.sub(r'[\x00-\x1f\x7f]', '', name)
    # 如果清理后为空，则返回默认名
    if not cleaned.strip():
        return "Unnamed"
    return cleaned
#-
def pix_to_revit(x, y):
    revit_x = origin.X + x * scaleX
    revit_y = origin.Y + (pixelHeight - y) * scaleY
    return XYZ(revit_x, revit_y, origin.Z)

def get_level(doc):
    av = doc.ActiveView
    try:
        if hasattr(av, "GenLevel") and av.GenLevel:
            return av.GenLevel
    except:
        pass

    levels = FilteredElementCollector(doc).OfClass(Level).ToElements()
    if levels and len(levels) > 0:
        return levels[0]
    return None

def find_family_symbol(doc, family_name=None, type_name=None):
    collector = FilteredElementCollector(doc).OfClass(FamilySymbol)
    
    for fs in collector:
        try:
            fam_name = fs.Family.Name if fs.Family else None
            
            p = fs.get_Parameter(BuiltInParameter.SYMBOL_NAME_PARAM)
            typ_name = p.AsString() if p else fs.Name

            family_ok = True if family_name is None else (fam_name == family_name)
            type_ok = True if type_name is None else (typ_name == type_name)

            if family_ok and type_ok:
                return fs
        except:
            pass
    return None


def angle_from_vector(vec, family_default_axis="X"):
    """
    vec: XYZ，目标朝向向量（平面内）
    family_default_axis:
        "X" 表示族默认朝向为 +X
        "Y" 表示族默认朝向为 +Y
    """
    vx = vec.X
    vy = vec.Y
    angle = math.atan2(vy, vx)

    if family_default_axis == "Y":
        angle -= math.pi / 2.0

    return angle



##
plane = Plane.CreateByNormalAndOrigin(XYZ.BasisZ, origin)
sketch_plane = SketchPlane.Create(doc, plane)
BEDS_IDX = 0
BEDE_IDX = 1

# 如果你的模型里还有多个类别，建议只处理 Bed 类
# 假设类别名叫 "Bed"
TARGET_CLASS_NAME = "Bed"

symbol = find_family_symbol(doc, target_family_name, target_type_name)
level = get_level(doc)

created_instances = []
debug_info = []

if symbol is None:
    OUT = "未找到族类型或族名称：{}".format(family_name)
else:
    TransactionManager.Instance.EnsureInTransaction(doc)

    if not symbol.IsActive:
        symbol.Activate()
        doc.Regenerate()

    for i, bbox in enumerate(boxes):
        # 过滤床类别
        cls_name = names[int(cls_ids[i])] if len(cls_ids) > i else ""
        if cls_name != TARGET_CLASS_NAME:
            continue

        x1, y1, x2, y2 = bbox
        cx = (x1 + x2) / 2.0
        cy = (y1 + y2) / 2.0
        center_pt = pix_to_revit(cx, cy)
        area = max(0, (x2 - x1)) * max(0, (y2 - y1))
        if area < min_area_threshold:
            debug_info.append({
            "index": i,
            "reason": "filtered_small_area",
            "area": area,
            "threshold": min_area_threshold
        })
            continue

        # 取关键点
        if kps_xy is None or i >= len(kps_xy):
            debug_info.append("第{}个目标无关键点".format(i))
            continue

        kp = kps_xy[i]

        if len(kp) <= max(BEDS_IDX, BEDE_IDX):
            debug_info.append("第{}个目标关键点数量不足".format(i))
            continue

        sx, sy = kp[BEDS_IDX]
        ex, ey = kp[BEDE_IDX]

        bedS_pt = pix_to_revit(sx, sy)
        bedE_pt = pix_to_revit(ex, ey)

        # 朝向：终点 -> 起点，即 BedE -> BedS
        vec = XYZ(
    bedS_pt.X - bedE_pt.X,
    bedS_pt.Y - bedE_pt.Y,
    0
)


        # 排除零向量
        if vec.GetLength() < 1e-6:
            debug_info.append("第{}个床关键点方向向量过短，跳过旋转".format(i))
            vec = XYZ.BasisX

        angle = math.atan2(vec.Y, vec.X) - math.pi / 2.0

        # 创建床族实 例
        # 普通模型家具通常这样创建
        try:
            instance = doc.Create.NewFamilyInstance(
                center_pt,
                symbol,
                level,
                StructuralType.NonStructural
            )
        except:
            # 某些基于视图的族可能需要这种方式
            instance = doc.Create.NewFamilyInstance(
                center_pt,
                symbol,
                doc.ActiveView
            )

        # 旋转
        axis_end = XYZ(center_pt.X, center_pt.Y, center_pt.Z + 1.0)
        axis = Line.CreateBound(center_pt, axis_end)
        ElementTransformUtils.RotateElement(doc, instance.Id, axis, angle)
         

        created_instances.append(instance.ToDSType(False))
        debug_info.append({
            "index": i,
            "class": cls_name,
            "center": center_pt,
            "BedS": bedS_pt,
            "BedE": bedE_pt,
            "angle_rad": angle,
            "angle_deg": angle * 180.0 / math.pi
        })

    TransactionManager.Instance.TransactionTaskDone()
doc.Regenerate()
OUT = newpath,created_instances, debug_info
# ----------------------------------------
python_version_18 = Watch(python_script_16)  # graph output
python_version_19 = Watch(python_version_17)  # graph output
readFromFile_9 = Image.ReadFromFile(file=file_from_path_8)
python_script_17 = Python(IN[0]=modelpath, IN[1]=imagepath_2, IN[2]=scale, IN[3]=python_version_7)  # CPython3; frozen
# ---------- python_script_17.python (259 lines) ----------
# 加载 PythonStandard 和 DesignScript 库
import sys
import clr
clr.AddReference('ProtoGeometry')
from Autodesk.DesignScript.Geometry import *
import Autodesk.DesignScript.Geometry as DS
import Revit
from Revit.Elements import *
import System
sys.path.append("C:/Users/Lenovo/anaconda3/envs/revitenv/Lib/site-packages")
clr.AddReference('RevitAPI')
clr.AddReference('RevitAPIUI')
from Autodesk.Revit.DB import *
from Autodesk.Revit.UI import *

clr.AddReference('RevitServices')
from RevitServices.Persistence import DocumentManager
from RevitServices.Transactions import TransactionManager

clr.AddReference('RevitNodes')
import Revit
clr.ImportExtensions(Revit.Elements)
clr.ImportExtensions(Revit.GeometryConversion)

import re
import json
import os
import numpy as np
import torch
import cv2
from ultralytics import YOLO

dataEnteringNode = IN 

# =========================
# 输入
# =========================
dect_Model = IN[0]
pixpath = IN[1]
scale = IN[2]              # 保留作fallback
seg_meta_json_path = IN[3] # 新增：读取分割得到的缩放与bbox信息

# =========================
# 参数
# =========================
origin = XYZ(0, 0, 0)   
widthFt = scale
pixelWidth = 1600   
pixelHeight = 1200

newpath = "E:/yanjiu/revitss/tests/jjianzhu_dect.jpg"

# fallback 比例（只有在seg_meta读取失败时才使用）
scaleX = widthFt / pixelWidth if pixelWidth > 0 else 0.0
scaleY = widthFt * (pixelHeight / pixelWidth) / pixelHeight if pixelWidth > 0 and pixelHeight > 0 else 0.0

# seg_meta读取到的参数
bbox_info = None
bbox_min_x = None
bbox_min_y = None
bbox_width = None
bbox_height = None
scale_x_ft_per_px = None
scale_y_ft_per_px = None

logs = []

# =========================
# 工具函数
# =========================
def sanitize_name(name):
    if not name:
        return "Unknown"
    cleaned = re.sub(r'[\x00-\x1f\x7f]', '', str(name))
    if not cleaned.strip():
        return "Unnamed"
    return cleaned

def load_seg_meta(seg_meta_json_path, logs):
    if seg_meta_json_path is None:
        logs.append("seg_meta_json_path为空")
        return None

    try:
        with open(seg_meta_json_path, "r", encoding="utf-8") as f:
            data = json.load(f)
        logs.append("读取seg_meta_json成功: {}".format(seg_meta_json_path))
        return data
    except Exception as e:
        logs.append("读取seg_meta_json失败: {}".format(str(e)))
        return None

def pix_to_revit(x, y):
    """
    优先使用seg_meta中的 bbox + scale
    与墙体分割/建墙使用同一坐标映射方式
    """
    global bbox_min_x, bbox_min_y, bbox_width, bbox_height
    global scale_x_ft_per_px, scale_y_ft_per_px
    global origin, scaleX, scaleY, pixelHeight

    try:
        if bbox_min_x is not None and bbox_min_y is not None and bbox_height is not None \
           and scale_x_ft_per_px is not None and scale_y_ft_per_px is not None:

            local_x = x - bbox_min_x
            local_y = y - bbox_min_y

            revit_x = origin.X + local_x * scale_x_ft_per_px
            revit_y = origin.Y + (bbox_height - local_y) * scale_y_ft_per_px
            return XYZ(revit_x, revit_y, origin.Z)
    except:
        pass

    # fallback：原整图映射
    revit_x = origin.X + x * scaleX
    revit_y = origin.Y + (pixelHeight - y) * scaleY
    return XYZ(revit_x, revit_y, origin.Z)

# =========================
# 读取seg_meta
# =========================
seg_meta = load_seg_meta(seg_meta_json_path, logs)

if seg_meta and seg_meta.get("ok", False):
    try:
        bbox_info = seg_meta.get("wall_bbox_px", None)
        scale_info = seg_meta.get("scale", {})

        if bbox_info:
            bbox_min_x = bbox_info.get("min_x", None)
            bbox_min_y = bbox_info.get("min_y", None)
            bbox_width = bbox_info.get("width", None)
            bbox_height = bbox_info.get("height", None)

        scale_x_ft_per_px = scale_info.get("scale_x_ft_per_px", None)
        scale_y_ft_per_px = scale_info.get("scale_y_ft_per_px", None)

        dbg = seg_meta.get("debug", {})
        if "pixelWidth" in dbg and "pixelHeight" in dbg:
            pixelWidth = dbg.get("pixelWidth", pixelWidth)
            pixelHeight = dbg.get("pixelHeight", pixelHeight)

        logs.append("bbox_info={}".format(str(bbox_info)))
        logs.append("scale_x_ft_per_px={}".format(str(scale_x_ft_per_px)))
        logs.append("scale_y_ft_per_px={}".format(str(scale_y_ft_per_px)))
        logs.append("pixelWidth={}, pixelHeight={}".format(pixelWidth, pixelHeight))
    except Exception as e:
        logs.append("解析seg_meta失败: {}".format(str(e)))
else:
    logs.append("seg_meta无效，使用fallback整图scale")

# =========================
# 运行YOLO检测
# =========================
yolo_dect = YOLO(dect_Model, task="detect")
dect_result = yolo_dect(source=pixpath, save=False, conf=0.3, iou=0.45, imgsz=640)
cv2.imwrite(newpath, dect_result[0].plot())

result = dect_result[0]
boxes = result.boxes
xyxy = boxes.xyxy.cpu().numpy() if boxes is not None else np.empty((0, 4))
cls_ids = boxes.cls.cpu().numpy().astype(int) if boxes is not None else np.array([], dtype=int)
names = result.names

logs.append("检测框数量: {}".format(len(xyxy)))
logs.append("类别映射: {}".format(str(names)))

# =========================
# Revit文档对象
# =========================
doc = DocumentManager.Instance.CurrentDBDocument
app = doc.Application
TransactionManager.Instance.EnsureInTransaction(doc)

created_lines = []
dyn_lines = []
dyn_faces = [] 
created_shapes = []

plane = Plane.CreateByNormalAndOrigin(XYZ.BasisZ, origin)
sketch_plane = SketchPlane.Create(doc, plane)

# =========================
# 创建检测框
# =========================
for i, bbox in enumerate(xyxy):
    try:
        x1, y1, x2, y2 = bbox

        pt1 = pix_to_revit(x1, y1)  # 左上
        pt2 = pix_to_revit(x2, y1)  # 右上
        pt3 = pix_to_revit(x2, y2)  # 右下
        pt4 = pix_to_revit(x1, y2)  # 左下

        dyn_pt1 = pt1.ToPoint()
        dyn_pt2 = pt2.ToPoint()
        dyn_pt3 = pt3.ToPoint()
        dyn_pt4 = pt4.ToPoint()

        lines = [
            Line.CreateBound(pt1, pt2),
            Line.CreateBound(pt2, pt3),
            Line.CreateBound(pt3, pt4),
            Line.CreateBound(pt4, pt1)
        ]

        for line in lines:
            model_curve = doc.Create.NewModelCurve(line, sketch_plane)
            created_lines.append(model_curve)

            start_dyn = line.GetEndPoint(0).ToPoint()
            end_dyn = line.GetEndPoint(1).ToPoint()
            dyn_line = DS.Line.ByStartPointEndPoint(start_dyn, end_dyn)
            dyn_lines.append(dyn_line)

        points = [dyn_pt1, dyn_pt2, dyn_pt3, dyn_pt4]
        poly = DS.PolyCurve.ByPoints(points, connectLastToFirst=True)
        if poly.IsClosed:
            surface = DS.Surface.ByPatch(poly)
            dyn_faces.append(surface)

        curve_loop = CurveLoop()
        curve_loop.Append(Line.CreateBound(pt1, pt2))
        curve_loop.Append(Line.CreateBound(pt2, pt3))
        curve_loop.Append(Line.CreateBound(pt3, pt4))
        curve_loop.Append(Line.CreateBound(pt4, pt1))

        thickness = 0.001
        solid = GeometryCreationUtilities.CreateExtrusionGeometry(
            [curve_loop], XYZ.BasisZ, thickness)

        direct_shape = DirectShape.CreateElement(doc, ElementId(BuiltInCategory.OST_GenericModel))
        direct_shape.SetShape([solid])

        class_id = cls_ids[i]
        class_name = names[class_id]
        safe_name = sanitize_name(class_name)
        direct_shape.Name = "YOLO_" + safe_name
        created_shapes.append(direct_shape)

        logs.append("检测框{}创建成功: class={}, bbox=({}, {}, {}, {})".format(
            i, safe_name, x1, y1, x2, y2
        ))

    except Exception as e:
        logs.append("检测框{}创建失败: {}".format(i, str(e)))
        continue

# =========================
# 提交事务
# =========================
TransactionManager.Instance.TransactionTaskDone()
doc.Regenerate()

# =========================
# 输出
# =========================
OUT = newpath, created_shapes, logs
# ----------------------------------------
python_script_18 = Python(IN[0]=modelpath, IN[1]=imagepath_2, IN[2]=scale, IN[3]=python_version_7)  # CPython3; frozen
# ---------- python_script_18.python (414 lines) ----------
# 加载 PythonStandard 和 DesignScript 库
#----------------------
import sys
import clr
clr.AddReference('ProtoGeometry')
from Autodesk.DesignScript.Geometry import *
import Autodesk.DesignScript.Geometry as DS
import Revit
from Revit.Elements import *
import System
sys.path.append("C:/Users/Lenovo/anaconda3/envs/revitenv/Lib/site-packages")
clr.AddReference('RevitAPI')
clr.AddReference('RevitAPIUI')
from Autodesk.Revit.DB import *
from Autodesk.Revit.UI import *

clr.AddReference('RevitServices')
from RevitServices.Persistence import DocumentManager
from RevitServices.Transactions import TransactionManager

clr.AddReference('RevitNodes')
import Revit
clr.ImportExtensions(Revit.Elements)
clr.ImportExtensions(Revit.GeometryConversion)

import re
import json
import os
import numpy as np
import torch
import cv2
from ultralytics import YOLO

dataEnteringNode = IN 

# =========================
# 输入
# =========================
dect_Model = IN[0]
pixpath = IN[1]
scale = IN[2]              # fallback
seg_meta_json_path = IN[3] # 读取分割得到的缩放与bbox信息

# =========================
# 参数
# =========================
origin = XYZ(0, 0, 0)   
widthFt = scale
pixelWidth = 1600   
pixelHeight = 1200

newpath = "E:/yanjiu/revitss/tests/jjianzhu_dect.jpg"

# fallback比例
scaleX = widthFt / pixelWidth if pixelWidth > 0 else 0.0
scaleY = widthFt * (pixelHeight / pixelWidth) / pixelHeight if pixelWidth > 0 and pixelHeight > 0 else 0.0

# seg_meta读取到的参数
bbox_info = None
bbox_min_x = None
bbox_min_y = None
bbox_width = None
bbox_height = None
scale_x_ft_per_px = None
scale_y_ft_per_px = None

logs = []

# =========================
# 窗参数
# =========================
TARGET_WINDOW_FAMILY_NAME = "Window_test"   # 你的窗族名
TARGET_WINDOW_CLASS_NAME = "window"         # 检测类别名

DEFAULT_WINDOW_HEIGHT_MM = 1500.0           # 固定窗高
DEFAULT_SILL_HEIGHT_MM = 900.0              # 底高度
WINDOW_SHRINK_EACH_SIDE_MM = 120.0          # 每端向内收120mm
MIN_WINDOW_WIDTH_MM = 300.0                 # 最小窗宽，避免过小

MM_TO_FT = 1.0 / 304.8

# =========================
# 工具函数
# =========================
def sanitize_name(name):
    if not name:
        return "Unknown"
    cleaned = re.sub(r'[\x00-\x1f\x7f]', '', str(name))
    if not cleaned.strip():
        return "Unnamed"
    return cleaned

def mm_to_ft(mm):
    return float(mm) * MM_TO_FT

def load_seg_meta(seg_meta_json_path, logs):
    if seg_meta_json_path is None:
        logs.append("seg_meta_json_path为空")
        return None

    try:
        with open(seg_meta_json_path, "r", encoding="utf-8") as f:
            data = json.load(f)
        logs.append("读取seg_meta_json成功: {}".format(seg_meta_json_path))
        return data
    except Exception as e:
        logs.append("读取seg_meta_json失败: {}".format(str(e)))
        return None

def pix_to_revit(x, y):
    global bbox_min_x, bbox_min_y, bbox_width, bbox_height
    global scale_x_ft_per_px, scale_y_ft_per_px
    global origin, scaleX, scaleY, pixelHeight

    try:
        if bbox_min_x is not None and bbox_min_y is not None and bbox_height is not None \
           and scale_x_ft_per_px is not None and scale_y_ft_per_px is not None:

            local_x = x - bbox_min_x
            local_y = y - bbox_min_y

            revit_x = origin.X + local_x * scale_x_ft_per_px
            revit_y = origin.Y + (bbox_height - local_y) * scale_y_ft_per_px
            return XYZ(revit_x, revit_y, origin.Z)
    except:
        pass

    revit_x = origin.X + x * scaleX
    revit_y = origin.Y + (pixelHeight - y) * scaleY
    return XYZ(revit_x, revit_y, origin.Z)

def get_px_to_ft_x():
    global scale_x_ft_per_px, scaleX
    return scale_x_ft_per_px if scale_x_ft_per_px is not None else scaleX

def get_px_to_ft_y():
    global scale_y_ft_per_px, scaleY
    return scale_y_ft_per_px if scale_y_ft_per_px is not None else scaleY

def get_wall_curve(wall):
    try:
        loc = wall.Location
        if loc and hasattr(loc, "Curve"):
            return loc.Curve
    except:
        pass
    return None

def point_to_curve_distance_2d(pt, curve):
    try:
        proj = curve.Project(pt)
        if proj:
            q = proj.XYZPoint
            dx = pt.X - q.X
            dy = pt.Y - q.Y
            return (dx * dx + dy * dy) ** 0.5, q
    except:
        pass
    return None, None

def get_wall_orientation(curve):
    p0 = curve.GetEndPoint(0)
    p1 = curve.GetEndPoint(1)
    dx = abs(p1.X - p0.X)
    dy = abs(p1.Y - p0.Y)
    if dx >= dy:
        return "h"
    else:
        return "v"

def get_nearest_wall(doc, pt, max_dist_ft=3.0):
    nearest_wall = None
    nearest_curve = None
    nearest_proj_pt = None
    best_dist = 1e18

    walls = FilteredElementCollector(doc).OfClass(Wall).ToElements()
    for wall in walls:
        try:
            curve = get_wall_curve(wall)
            if curve is None:
                continue

            dist, proj_pt = point_to_curve_distance_2d(pt, curve)
            if dist is None:
                continue

            if dist < best_dist and dist <= max_dist_ft:
                best_dist = dist
                nearest_wall = wall
                nearest_curve = curve
                nearest_proj_pt = proj_pt

        except:
            continue

    return nearest_wall, nearest_curve, nearest_proj_pt, best_dist

def get_window_symbol(doc, family_name):
    collector = FilteredElementCollector(doc).OfClass(FamilySymbol).OfCategory(BuiltInCategory.OST_Windows)
    for sym in collector:
        try:
            fam = sym.Family
            if fam and fam.Name == family_name:
                return sym
        except:
            continue
    return None

def set_param_if_exists(elem, param_name, value, logs, label):
    try:
        p = elem.LookupParameter(param_name)
        if p and (not p.IsReadOnly):
            p.Set(value)
            logs.append("{} 参数设置成功: {}={:.4f}".format(label, param_name, value))
            return True
    except Exception as e:
        logs.append("{} 参数设置失败: {} -> {}".format(label, param_name, str(e)))
    return False

def create_debug_bbox(doc, sketch_plane, pt1, pt2, pt3, pt4):
    lines = [
        Line.CreateBound(pt1, pt2),
        Line.CreateBound(pt2, pt3),
        Line.CreateBound(pt3, pt4),
        Line.CreateBound(pt4, pt1)
    ]
    created = []
    for line in lines:
        try:
            mc = doc.Create.NewModelCurve(line, sketch_plane)
            created.append(mc)
        except:
            pass
    return created

# =========================
# 读取seg_meta
# =========================
seg_meta = load_seg_meta(seg_meta_json_path, logs)

if seg_meta and seg_meta.get("ok", False):
    try:
        bbox_info = seg_meta.get("wall_bbox_px", None)
        scale_info = seg_meta.get("scale", {})

        if bbox_info:
            bbox_min_x = bbox_info.get("min_x", None)
            bbox_min_y = bbox_info.get("min_y", None)
            bbox_width = bbox_info.get("width", None)
            bbox_height = bbox_info.get("height", None)

        scale_x_ft_per_px = scale_info.get("scale_x_ft_per_px", None)
        scale_y_ft_per_px = scale_info.get("scale_y_ft_per_px", None)

        dbg = seg_meta.get("debug", {})
        if "pixelWidth" in dbg and "pixelHeight" in dbg:
            pixelWidth = dbg.get("pixelWidth", pixelWidth)
            pixelHeight = dbg.get("pixelHeight", pixelHeight)

        logs.append("bbox_info={}".format(str(bbox_info)))
        logs.append("scale_x_ft_per_px={}".format(str(scale_x_ft_per_px)))
        logs.append("scale_y_ft_per_px={}".format(str(scale_y_ft_per_px)))
        logs.append("pixelWidth={}, pixelHeight={}".format(pixelWidth, pixelHeight))
    except Exception as e:
        logs.append("解析seg_meta失败: {}".format(str(e)))
else:
    logs.append("seg_meta无效，使用fallback整图scale")

# =========================
# 运行YOLO检测
# =========================
yolo_dect = YOLO(dect_Model, task="detect")
dect_result = yolo_dect(source=pixpath, save=False, conf=0.3, iou=0.45, imgsz=640)
cv2.imwrite(newpath, dect_result[0].plot())

result = dect_result[0]
boxes = result.boxes
xyxy = boxes.xyxy.cpu().numpy() if boxes is not None else np.empty((0, 4))
cls_ids = boxes.cls.cpu().numpy().astype(int) if boxes is not None else np.array([], dtype=int)
names = result.names

logs.append("检测框数量: {}".format(len(xyxy)))
logs.append("类别映射: {}".format(str(names)))

# =========================
# Revit文档对象
# =========================
doc = DocumentManager.Instance.CurrentDBDocument
app = doc.Application
TransactionManager.Instance.EnsureInTransaction(doc)

created_lines = []
created_windows = []

plane = Plane.CreateByNormalAndOrigin(XYZ.BasisZ, origin)
sketch_plane = SketchPlane.Create(doc, plane)

# 查找窗族类型
window_symbol = get_window_symbol(doc, TARGET_WINDOW_FAMILY_NAME)
if window_symbol is None:
    logs.append("未找到窗族类型: {}".format(TARGET_WINDOW_FAMILY_NAME))
else:
    logs.append("找到窗族类型: {}".format(TARGET_WINDOW_FAMILY_NAME))
    try:
        if not window_symbol.IsActive:
            window_symbol.Activate()
            doc.Regenerate()
            logs.append("窗族类型已激活")
    except Exception as e:
        logs.append("窗族类型激活失败: {}".format(str(e)))

# 取一个Level，供创建窗实例使用
level = FilteredElementCollector(doc).OfClass(Level).FirstElement()
if level is None:
    logs.append("未找到Level，无法创建窗实例")

# =========================
# 遍历检测结果
# =========================
for i, bbox in enumerate(xyxy):
    try:
        x1, y1, x2, y2 = bbox
        class_id = cls_ids[i]
        class_name = sanitize_name(names[class_id]).lower()

        # 可选：先画debug框
        pt1 = pix_to_revit(x1, y1)
        pt2 = pix_to_revit(x2, y1)
        pt3 = pix_to_revit(x2, y2)
        pt4 = pix_to_revit(x1, y2)
        dbg_lines = create_debug_bbox(doc, sketch_plane, pt1, pt2, pt3, pt4)
        created_lines.extend(dbg_lines)

        # 只处理 window 类
        if class_name != TARGET_WINDOW_CLASS_NAME:
            logs.append("检测项{}跳过: class={}".format(i, class_name))
            continue

        if window_symbol is None or level is None:
            logs.append("检测项{}跳过: 缺少窗族类型或Level".format(i))
            continue

        # 窗中心点
        cx = 0.5 * (x1 + x2)
        cy = 0.5 * (y1 + y2)
        center_pt = pix_to_revit(cx, cy)

        # 找最近墙
        host_wall, wall_curve, proj_pt, wall_dist = get_nearest_wall(doc, center_pt, max_dist_ft=3.0)
        if host_wall is None or wall_curve is None or proj_pt is None:
            logs.append("检测项{}失败: 未找到合适宿主墙".format(i))
            continue

        wall_ori = get_wall_orientation(wall_curve)

        # 根据墙方向取沿墙方向的bbox尺寸
        bbox_w_px = abs(x2 - x1)
        bbox_h_px = abs(y2 - y1)

        if wall_ori == "h":
            raw_width_ft = bbox_w_px * get_px_to_ft_x()
        else:
            raw_width_ft = bbox_h_px * get_px_to_ft_y()

        raw_width_mm = raw_width_ft * 304.8

        # 两端向内收
        final_width_mm = raw_width_mm - 2.0 * WINDOW_SHRINK_EACH_SIDE_MM
        final_width_mm = max(final_width_mm, MIN_WINDOW_WIDTH_MM)

        final_width_ft = mm_to_ft(final_width_mm)
        final_height_ft = mm_to_ft(DEFAULT_WINDOW_HEIGHT_MM)
        sill_height_ft = mm_to_ft(DEFAULT_SILL_HEIGHT_MM)

        # 插入点优先用投影点
        insert_pt = XYZ(proj_pt.X, proj_pt.Y, proj_pt.Z)

        # 创建窗实例
        try:
            win = doc.Create.NewFamilyInstance(insert_pt, window_symbol, host_wall, level, StructuralType.NonStructural)
        except:
            # 有些版本/族可能只接受不带level的重载
            win = doc.Create.NewFamilyInstance(insert_pt, window_symbol, host_wall, StructuralType.NonStructural)

        doc.Regenerate()

        # 设置参数
        set_param_if_exists(win, "AI_Width", final_width_ft, logs, "窗{}".format(i))
        set_param_if_exists(win, "AI_Height", final_height_ft, logs, "窗{}".format(i))
        set_param_if_exists(win, "底高度", sill_height_ft, logs, "窗{}".format(i))

        created_windows.append(win.ToDSType(True))

        logs.append(
            "窗{}创建成功: class={}, wall_ori={}, raw_width_mm={:.1f}, final_width_mm={:.1f}, height_mm={:.1f}, sill_mm={:.1f}".format(
                i, class_name, wall_ori, raw_width_mm, final_width_mm, DEFAULT_WINDOW_HEIGHT_MM, DEFAULT_SILL_HEIGHT_MM
            )
        )

    except Exception as e:
        logs.append("检测项{}处理失败: {}".format(i, str(e)))
        continue

# =========================
# 提交事务
# =========================
TransactionManager.Instance.TransactionTaskDone()
doc.Regenerate()

# =========================
# 输出
# =========================
OUT = newpath, created_windows, created_lines, logs
# ----------------------------------------
python_paths_4 = Watch(python_script_18)  # graph output
python_script_19 = Python(IN[0]=modelpath_3, IN[1]=imagepath_2, IN[2]=scale, IN[5]=python_version_7)  # CPython3; frozen; unwired: IN[3], IN[4]
# ---------- python_script_19.python (587 lines) ----------
# 加载 PythonStandard  和 DesignScript 库
import sys
import clr
clr.AddReference('ProtoGeometry')
from Autodesk.DesignScript.Geometry import *
import Autodesk.DesignScript.Geometry as DS
import Revit
from Revit.Elements import *
import System
sys.path.append("C:/Users/Lenovo/anaconda3/envs/revitenv/Lib/site-packages")
clr.AddReference('RevitAPI')
clr.AddReference('RevitAPIUI')
from Autodesk.Revit.DB import *
from Autodesk.Revit.UI import *

clr.AddReference('RevitServices')
from RevitServices.Persistence import DocumentManager
from RevitServices.Transactions import TransactionManager

clr.AddReference('RevitNodes')
import Revit
clr.ImportExtensions(Revit.Elements)
clr.ImportExtensions(Revit.GeometryConversion)

import math
import re
import json
import os
import numpy as np
import torch
import cv2
from ultralytics import YOLO

dataEnteringNode = IN 

# =========================
# 输入
# =========================
pose_Model = IN[0]
pixpath = IN[1]
scale = IN[2]   # 保留作fallback
target_family_name = IN[3] if len(IN) > 3 else "Bed"
target_type_name = IN[4] if len(IN) > 4 else "Only_Bed"
seg_meta_json_path = IN[5] if len(IN) > 5 else None

# =========================
# 参数
# =========================
origin = XYZ(0, 0, 0)   
widthFt = scale
pixelWidth = 1600   
pixelHeight = 1200

# 读取seg_meta后填充
bbox_info = None
bbox_min_x = None
bbox_min_y = None
bbox_width = None
bbox_height = None
scale_x_ft_per_px = None
scale_y_ft_per_px = None

logs = []

# =========================
# 配置
# =========================
CLASS_CONFIG = {
    "Bed": {
        "family_name": "Bed",
        "type_name": "Bed",
        "rotate": True,
        "kp_start_idx": 0,
        "kp_end_idx": 1,
        "area_filter": True,
        "family_default_axis": "Y"
    },
    "CookingCounter": {
        "family_name": "CookingCounter",
        "type_name": "CookingCounter",
        "rotate": True,
        "kp_start_idx": 0,
        "kp_end_idx": 1,
        "area_filter": False,
        "family_default_axis": "Y"
    },
    "Cabinet": {
        "family_name": "Cabinet",
        "type_name": "Cabinet",
        "rotate": True,
        "kp_start_idx": 0,
        "kp_end_idx": 1,
        "area_filter": False,
        "family_default_axis": "Y"
    },
    "DiningTable": {
        "family_name": "DiningTable",
        "type_name": "DiningTable",
        "rotate": True,
        "kp_start_idx": 0,
        "kp_end_idx": 1,
        "area_filter": False,
        "family_default_axis": "Y"
    },
    "DiningTables": {
        "family_name": "DiningTables",
        "type_name": "DiningTables",
        "rotate": False,
        "area_filter": False,
        "family_default_axis": "Y"
    },
    "Sofa": {
        "family_name": "Sofa",
        "type_name": "Sofa",
        "rotate": True,
        "kp_start_idx": 0,
        "kp_end_idx": 1,
        "area_filter": False,
        "family_default_axis": "Y"
    },
    "TVStand": {
        "family_name": "TVStand",
        "type_name": "TVStand",
        "rotate": True,
        "kp_start_idx": 0,
        "kp_end_idx": 1,
        "area_filter": False,
        "family_default_axis": "Y"
    },
    "Toilet": {
        "family_name": "Toilet",
        "type_name": "Toilet",
        "rotate": True,
        "kp_start_idx": 0,
        "kp_end_idx": 1,
        "area_filter": False,
        "family_default_axis": "Y"
    }
}

# =========================
# 工具函数
# =========================
def norm_str(s):
    if s is None:
        return ""
    return str(s).strip().lower()

def sanitize_name(name):
    if not name:
        return "Unknown"
    cleaned = re.sub(r'[\x00-\x1f\x7f]', '', str(name))
    if not cleaned.strip():
        return "Unnamed"
    return cleaned

def load_seg_meta(seg_meta_json_path, logs):
    if not seg_meta_json_path:
        logs.append("seg_meta_json_path为空，将使用fallback scale")
        return None
    try:
        with open(seg_meta_json_path, "r", encoding="utf-8") as f:
            data = json.load(f)
        logs.append("读取seg_meta_json成功: {}".format(seg_meta_json_path))
        return data
    except Exception as e:
        logs.append("读取seg_meta_json失败: {}".format(str(e)))
        return None

def pix_to_revit(x, y):
    """
    优先使用seg_meta中的 bbox + scale
    与墙体和检测节点保持一致
    """
    global bbox_min_x, bbox_min_y, bbox_width, bbox_height
    global scale_x_ft_per_px, scale_y_ft_per_px
    global origin, widthFt, pixelWidth, pixelHeight

    try:
        if bbox_min_x is not None and bbox_min_y is not None and bbox_height is not None \
           and scale_x_ft_per_px is not None and scale_y_ft_per_px is not None:

            local_x = x - bbox_min_x
            local_y = y - bbox_min_y

            revit_x = origin.X + local_x * scale_x_ft_per_px
            revit_y = origin.Y + (bbox_height - local_y) * scale_y_ft_per_px
            return XYZ(revit_x, revit_y, origin.Z)
    except:
        pass

    # fallback
    scaleX = widthFt / pixelWidth if pixelWidth > 0 else 0.0
    scaleY = widthFt * (float(pixelHeight) / float(pixelWidth)) / pixelHeight if pixelWidth > 0 and pixelHeight > 0 else 0.0
    revit_x = origin.X + x * scaleX
    revit_y = origin.Y + (pixelHeight - y) * scaleY
    return XYZ(revit_x, revit_y, origin.Z)

def get_level(doc):
    av = doc.ActiveView
    try:
        if hasattr(av, "GenLevel") and av.GenLevel:
            return av.GenLevel
    except:
        pass
    levels = FilteredElementCollector(doc).OfClass(Level).ToElements()
    if levels and len(levels) > 0:
        return levels[0]
    return None

def find_family_symbol(doc, family_name=None, type_name=None):
    collector = FilteredElementCollector(doc).OfClass(FamilySymbol)
    for fs in collector:
        try:
            fam_name = fs.Family.Name if fs.Family else None
            p = fs.get_Parameter(BuiltInParameter.SYMBOL_NAME_PARAM)
            typ_name = p.AsString() if p else fs.Name

            family_ok = True if family_name is None else (fam_name == family_name)
            type_ok = True if type_name is None else (typ_name == type_name)

            if family_ok and type_ok:
                return fs
        except:
            pass
    return None

def angle_from_vector(vec, family_default_axis="X"):
    vx = vec.X
    vy = vec.Y
    angle = math.atan2(vy, vx)

    if family_default_axis == "Y":
        angle -= math.pi / 2.0

    return angle

def build_symbol_lookup(doc):
    lookup = {}
    collector = FilteredElementCollector(doc).OfClass(FamilySymbol)
    for fs in collector:
        try:
            fam_name = fs.Family.Name if fs.Family else ""
            p = fs.get_Parameter(BuiltInParameter.SYMBOL_NAME_PARAM)
            typ_name = p.AsString() if p else fs.Name
            key = (norm_str(fam_name), norm_str(typ_name))
            lookup[key] = fs
        except:
            pass
    return lookup

def get_symbol_from_lookup(symbol_lookup, family_name, type_name):
    key = (norm_str(family_name), norm_str(type_name))
    if key in symbol_lookup:
        return symbol_lookup[key]
    return None

def compute_class_area_threshold(boxes, cls_ids, names, class_name, scale_ratio=0.33):
    areas = []
    for i, bbox in enumerate(boxes):
        cls_name = names[int(cls_ids[i])] if len(cls_ids) > i else ""
        if cls_name != class_name:
            continue

        x1, y1, x2, y2 = bbox
        area = max(0, (x2 - x1)) * max(0, (y2 - y1))
        areas.append(area)

    if len(areas) == 0:
        return 0.0, 0.0

    median_area = float(np.median(areas))
    min_area = median_area * scale_ratio
    return median_area, min_area

def ensure_symbol_active(doc, symbol):
    if symbol and not symbol.IsActive:
        symbol.Activate()
        doc.Regenerate()

def create_family_instance(doc, center_pt, symbol, level):
    try:
        instance = doc.Create.NewFamilyInstance(
            center_pt,
            symbol,
            level,
            StructuralType.NonStructural
        )
    except:
        instance = doc.Create.NewFamilyInstance(
            center_pt,
            symbol,
            doc.ActiveView
        )
    return instance

def get_angle_from_keypoints(start_pt, end_pt, family_default_axis="Y"):
    vec = XYZ(
        start_pt.X - end_pt.X,
        start_pt.Y - end_pt.Y,
        0
    )

    if vec.GetLength() < 1e-6:
        return None

    angle = math.atan2(vec.Y, vec.X)

    if family_default_axis == "Y":
        angle -= math.pi / 2.0

    return angle

def rotate_instance(doc, instance, center_pt, angle):
    axis_end = XYZ(center_pt.X, center_pt.Y, center_pt.Z + 1.0)
    axis = Line.CreateBound(center_pt, axis_end)
    ElementTransformUtils.RotateElement(doc, instance.Id, axis, angle)

# =========================
# 读取seg_meta
# =========================
seg_meta = load_seg_meta(seg_meta_json_path, logs)

if seg_meta and seg_meta.get("ok", False):
    try:
        bbox_info = seg_meta.get("wall_bbox_px", None)
        scale_info = seg_meta.get("scale", {})
        dbg = seg_meta.get("debug", {})

        if bbox_info:
            bbox_min_x = bbox_info.get("min_x", None)
            bbox_min_y = bbox_info.get("min_y", None)
            bbox_width = bbox_info.get("width", None)
            bbox_height = bbox_info.get("height", None)

        scale_x_ft_per_px = scale_info.get("scale_x_ft_per_px", None)
        scale_y_ft_per_px = scale_info.get("scale_y_ft_per_px", None)

        if "pixelWidth" in dbg and "pixelHeight" in dbg:
            pixelWidth = dbg.get("pixelWidth", pixelWidth)
            pixelHeight = dbg.get("pixelHeight", pixelHeight)

        logs.append("bbox_info={}".format(str(bbox_info)))
        logs.append("scale_x_ft_per_px={}".format(str(scale_x_ft_per_px)))
        logs.append("scale_y_ft_per_px={}".format(str(scale_y_ft_per_px)))
        logs.append("pixelWidth={}, pixelHeight={}".format(pixelWidth, pixelHeight))
    except Exception as e:
        logs.append("解析seg_meta失败: {}".format(str(e)))
else:
    logs.append("seg_meta无效，使用fallback整图scale")

# =========================
# 运行姿态估计
# =========================
yolo_pose = YOLO(pose_Model, task="pose")
newpath = "E:/yanjiu/revitss/tests/jjianzhu_pose.jpg"

pose_results = yolo_pose(
    source=pixpath,
    save=False,
    conf=0.3,
    iou=0.45,
    imgsz=640
)
cv2.imwrite(newpath, pose_results[0].plot())

result = pose_results[0]
boxes = result.boxes.xyxy.cpu().numpy() if result.boxes is not None else []
cls_ids = result.boxes.cls.cpu().numpy().astype(int) if result.boxes is not None else []
confs = result.boxes.conf.cpu().numpy() if result.boxes is not None else []
names = result.names
kps_xy = None
if result.keypoints is not None and result.keypoints.xy is not None:
    kps_xy = result.keypoints.xy.cpu().numpy()

# =========================
# Revit对象
# =========================
doc = DocumentManager.Instance.CurrentDBDocument
app = doc.Application
TransactionManager.Instance.EnsureInTransaction(doc)

level = get_level(doc)
symbol_lookup = build_symbol_lookup(doc)

bed_median_area, bed_min_area = compute_class_area_threshold(
    boxes, cls_ids, names, "Bed", 0.33
)

# process areas
bed_indices = []
bed_areas = []
for i, bbox in enumerate(boxes):
    cls_name = names[int(cls_ids[i])] if len(cls_ids) > i else ""
    if cls_name != "Bed":
        continue

    x1, y1, x2, y2 = bbox
    area = max(0, (x2 - x1)) * max(0, (y2 - y1))
    bed_indices.append(i)
    bed_areas.append(area)

if len(bed_areas) > 0:
    median_bed_area = float(np.median(bed_areas))
    min_area_threshold = median_bed_area * 0.33
else:
    median_bed_area = 0.0
    min_area_threshold = 0.0

created_lines = []
dyn_lines = []
dyn_faces = [] 
created_shapes = []
created_instances = []
debug_info = []
missing_family_types = []
skipped_unconfigured_classes = []

plane = Plane.CreateByNormalAndOrigin(XYZ.BasisZ, origin)
sketch_plane = SketchPlane.Create(doc, plane)

for cls_name, cfg in CLASS_CONFIG.items():
    symbol = get_symbol_from_lookup(
        symbol_lookup,
        cfg.get("family_name"),
        cfg.get("type_name")
    )
    if symbol:
        ensure_symbol_active(doc, symbol)

# =========================
# 放置实例
# =========================
for i, bbox in enumerate(boxes):
    cls_name = names[int(cls_ids[i])] if len(cls_ids) > i else ""
    conf = confs[i] if len(confs) > i else 0.0

    # 1. 配置中未定义的类，跳过
    if cls_name not in CLASS_CONFIG:
        skipped_unconfigured_classes.append({
            "index": i,
            "class": cls_name,
            "reason": "class_not_configured"
        })
        continue

    cfg = CLASS_CONFIG[cls_name]
    family_name = cfg.get("family_name")
    type_name = cfg.get("type_name")
    need_rotate = cfg.get("rotate", False)
    family_default_axis = cfg.get("family_default_axis", "Y")

    # 2. 查找对应族类型
    symbol = get_symbol_from_lookup(symbol_lookup, family_name, type_name)
    if symbol is None:
        missing_family_types.append({
            "index": i,
            "class": cls_name,
            "family_name": family_name,
            "type_name": type_name,
            "reason": "family_symbol_not_found"
        })
        continue

    # 3. 中心点
    x1, y1, x2, y2 = bbox
    cx = (x1 + x2) / 2.0
    cy = (y1 + y2) / 2.0
    center_pt = pix_to_revit(cx, cy)

    # 4. 面积过滤
    area = max(0, (x2 - x1)) * max(0, (y2 - y1))
    if cfg.get("area_filter", False):
        if cls_name == "Bed" and bed_min_area > 0 and area < bed_min_area:
            debug_info.append({
                "index": i,
                "class": cls_name,
                "reason": "filtered_small_area",
                "area": area,
                "threshold": bed_min_area
            })
            continue

    # 5. 创建实例
    try:
        instance = create_family_instance(doc, center_pt, symbol, level)
    except Exception as e:
        debug_info.append({
            "index": i,
            "class": cls_name,
            "reason": "create_instance_failed",
            "error": str(e)
        })
        continue

    rotated = False
    angle = None
    start_pt = None
    end_pt = None

    # 6. 如果该类需要旋转，尝试读取关键点
    if need_rotate:
        kp_start_idx = cfg.get("kp_start_idx", None)
        kp_end_idx = cfg.get("kp_end_idx", None)

        if kps_xy is not None and i < len(kps_xy) and kp_start_idx is not None and kp_end_idx is not None:
            kp = kps_xy[i]

            if len(kp) > max(kp_start_idx, kp_end_idx):
                sx, sy = kp[kp_start_idx]
                ex, ey = kp[kp_end_idx]

                start_pt = pix_to_revit(sx, sy)
                end_pt = pix_to_revit(ex, ey)

                angle = get_angle_from_keypoints(
                    start_pt,
                    end_pt,
                    family_default_axis
                )

                if angle is not None:
                    try:
                        rotate_instance(doc, instance, center_pt, angle)
                        rotated = True
                    except Exception as e:
                        debug_info.append({
                            "index": i,
                            "class": cls_name,
                            "reason": "rotate_failed",
                            "error": str(e)
                        })
                else:
                    debug_info.append({
                        "index": i,
                        "class": cls_name,
                        "reason": "zero_direction_vector"
                    })
            else:
                debug_info.append({
                    "index": i,
                    "class": cls_name,
                    "reason": "insufficient_keypoints"
                })
        else:
            debug_info.append({
                "index": i,
                "class": cls_name,
                "reason": "no_keypoints_for_rotation"
            })

    created_instances.append(instance.ToDSType(False))
    debug_info.append({
        "index": i,
        "class": cls_name,
        "family_name": family_name,
        "type_name": type_name,
        "center_xyz": [center_pt.X, center_pt.Y, center_pt.Z],
        "bbox_px": [float(x1), float(y1), float(x2), float(y2)],
        "area": area,
        "rotated": rotated,
        "angle_rad": angle,
        "angle_deg": angle * 180.0 / math.pi if angle is not None else None,
        "conf": float(conf),
        "kp_start_xyz": [start_pt.X, start_pt.Y, start_pt.Z] if start_pt else None,
        "kp_end_xyz": [end_pt.X, end_pt.Y, end_pt.Z] if end_pt else None
    })

# =========================
# 提交事务
# =========================
TransactionManager.Instance.TransactionTaskDone()
doc.Regenerate()

OUT = {
    "preview_image": newpath,
    "created_instances": created_instances,
    "debug_info": debug_info,
    "missing_family_types": missing_family_types,
    "skipped_unconfigured_classes": skipped_unconfigured_classes,
    "bed_area_threshold": {
        "median_area": bed_median_area,
        "min_area": bed_min_area
    },
    "seg_meta_json_path": seg_meta_json_path,
    "logs": logs
}
# ----------------------------------------
python_script_20 = Python(IN[0]=seg_WWTD_Modelpath, IN[1]=imagepath_2, IN[2]=number, IN[3]=scale, IN[4]=python_version_4, IN[5]=seg_meta_Json_Path)  # CPython3; frozen
# ---------- python_script_20.python (1295 lines) ----------
# 加载 Python Standard和 DesignScript 库
#--------------------
import sys
import clr
clr.AddReference('ProtoGeometry')
from Autodesk.DesignScript.Geometry import *
import Autodesk.DesignScript.Geometry as DS
import Revit
from Revit.Elements import *
import System
sys.path.append("C:/Users/Lenovo/anaconda3/envs/revitenv/Lib/site-packages")
clr.AddReference('RevitAPI')
clr.AddReference('RevitAPIUI')
from Autodesk.Revit.DB import *
from Autodesk.Revit.UI import *

clr.AddReference('RevitServices')
from RevitServices.Persistence import DocumentManager
from RevitServices.Transactions import TransactionManager

clr.AddReference('RevitNodes')
import Revit
clr.ImportExtensions(Revit.Elements)
clr.ImportExtensions(Revit.GeometryConversion)

import re
import math
import json
import os
import traceback
import numpy as np
import torch
import cv2

from scipy.spatial import Voronoi
from scipy import ndimage
from shapely.geometry import Polygon, LineString, MultiLineString
from shapely.ops import linemerge
from shapely.ops import unary_union, split
from shapely.geometry import Point as ShpPoint
from shapely.geometry import Polygon as ShpPolygon
from shapely.geometry import MultiPolygon as ShpMultiPolygon
from shapely.geometry import Point as ShpPoint
from shapely.geometry import MultiLineString
from shapely.ops import linemerge
from skimage.morphology import skeletonize
from ultralytics import YOLO

dataEnteringNode = IN 

# =========================
# 输入
# =========================
dect_Model = IN[0]
pixpath = IN[1]
height = IN[2]
scale = IN[3]
dims_json_path = IN[4]
seg_meta_json_path = IN[5]

# =========================
# 参数
# =========================
origin = XYZ(0, 0, 0)   
widthFt = scale
pixelWidth = 1600   
pixelHeight = 1200 
DENSIFY_DIST = 0.5  
EPS = 1e-6

TARGET_WALL_TYPE_NAME = "基本墙 200mm"
TARGET_LEVEL_NAME = "标高 2"

newpath = "E:/yanjiu/revitss/tests/jjianzhu_seg.jpg"

scaleX = widthFt / pixelWidth if pixelWidth > 0 else 0.0
scaleY = widthFt * (pixelHeight / pixelWidth) / pixelHeight if pixelWidth > 0 and pixelHeight > 0 else 0.0

bbox_info_global = None
scale_x_ft_per_px_global = None
scale_y_ft_per_px_global = None

logs = []

# =========================
# 工具函数
# =========================
def ensure_dir_of_file(file_path):
    folder = os.path.dirname(file_path)
    if folder and not os.path.exists(folder):
        os.makedirs(folder)

def pix_to_revit(x, y):
    global bbox_info_global, scale_x_ft_per_px_global, scale_y_ft_per_px_global

    try:
        if bbox_info_global is not None and scale_x_ft_per_px_global is not None and scale_y_ft_per_px_global is not None:
            min_x = bbox_info_global["min_x"]
            min_y = bbox_info_global["min_y"]
            bbox_h = bbox_info_global["height"]

            local_x = x - min_x
            local_y = y - min_y

            revit_x = origin.X + local_x * scale_x_ft_per_px_global
            revit_y = origin.Y + (bbox_h - local_y) * scale_y_ft_per_px_global
            return XYZ(revit_x, revit_y, origin.Z)
    except:
        pass

    revit_x = origin.X + x * scaleX
    revit_y = origin.Y + (pixelHeight - y) * scaleY
    return XYZ(revit_x, revit_y, origin.Z)

def sanitize_name(name):
    if not name:
        return "Unknown"
    cleaned = re.sub(r'[\x00-\x1f\x7f]', '', name)
    if not cleaned.strip():
        return "Unnamed"
    return cleaned

def get_mask_bbox(binary_mask, logs):
    if binary_mask is None:
        logs.append("get_mask_bbox失败: binary_mask is None")
        return None

    ys, xs = np.where(binary_mask > 0)
    if len(xs) == 0 or len(ys) == 0:
        logs.append("get_mask_bbox失败: 墙体mask为空")
        return None

    min_x = int(np.min(xs))
    max_x = int(np.max(xs))
    min_y = int(np.min(ys))
    max_y = int(np.max(ys))

    bbox = {
        "min_x": min_x,
        "min_y": min_y,
        "max_x": max_x,
        "max_y": max_y,
        "width": int(max_x - min_x + 1),
        "height": int(max_y - min_y + 1)
    }
    logs.append("结构mask bbox: {}".format(str(bbox)))
    return bbox

# =========================
# 结构类配置：Wall / Door / Window / TDoor 都参与“墙体生成”
# =========================
STRUCTURE_CLASS_KEYWORDS = [
    "wall",
    "墙",
    "墙体",
    "basic wall",
    "door",
    "门",
    "tdoor",
    "double door",
    "window",
    "窗",
    "窗户"
]

STRUCTURE_CLASS_EXACT = set([
    "wall",
    "door",
    "window",
    "tdoor"
])

def normalize_class_name(name):
    if name is None:
        return ""
    return str(name).strip().lower()

def is_structure_wall_like_class(name):
    n = normalize_class_name(name)
    if not n:
        return False

    if n in STRUCTURE_CLASS_EXACT:
        return True

    for kw in STRUCTURE_CLASS_KEYWORDS:
        if kw.lower() in n:
            return True
    return False

def ensure_polygon(geom):
    if geom is None or geom.is_empty:
        return None
    try:
        if not geom.is_valid:
            geom = geom.buffer(0)
    except:
        pass
    if geom is None or geom.is_empty:
        return None

    if isinstance(geom, ShpPolygon):
        return geom

    if isinstance(geom, ShpMultiPolygon):
        polys = [g for g in geom.geoms if g is not None and not g.is_empty]
        if not polys:
            return None
        polys.sort(key=lambda p: p.area, reverse=True)
        return polys[0]

    return None

def contour_to_polygon(contour_pts):
    revit_pts = [pix_to_revit(pt[0], pt[1]) for pt in contour_pts]
    if len(revit_pts) < 3:
        return None
    coords = [(p.X, p.Y) for p in revit_pts]
    if coords[0] != coords[-1]:
        coords.append(coords[0])
    poly = ShpPolygon(coords)
    poly = ensure_polygon(poly)
    return poly

def line_long_enough(line_geom, min_len=0.1):
    if line_geom is None or line_geom.is_empty:
        return False
    try:
        return line_geom.length >= min_len
    except:
        return False

def snap_line_to_axis(line_geom):
    if line_geom is None or line_geom.is_empty:
        return None
    coords = list(line_geom.coords)
    if len(coords) < 2:
        return None
    x1, y1 = coords[0]
    x2, y2 = coords[-1]
    dx = x2 - x1
    dy = y2 - y1
    if abs(dx) >= abs(dy):
        ym = 0.5 * (y1 + y2)
        return LineString([(x1, ym), (x2, ym)])
    else:
        xm = 0.5 * (x1 + x2)
        return LineString([(xm, y1), (xm, y2)])

def longest_linestring_from_intersection(inter):
    if inter is None or inter.is_empty:
        return None
    if inter.geom_type == "LineString":
        return inter
    if inter.geom_type == "MultiLineString":
        lines = [g for g in inter.geoms if g.length > 1e-4]
        if not lines:
            return None
        lines.sort(key=lambda g: g.length, reverse=True)
        return lines[0]
    return None

def estimate_centerline_from_polygon(poly):
    if poly is None or poly.is_empty:
        return None, None

    poly = ensure_polygon(poly)
    if poly is None:
        return None, None

    if poly.area < 1e-5:
        return None, None

    try:
        mrr = poly.minimum_rotated_rectangle
    except:
        return None, None

    mrr = ensure_polygon(mrr)
    if mrr is None:
        return None, None

    rect_coords = list(mrr.exterior.coords)[:-1]
    if len(rect_coords) != 4:
        return None, None

    edges = []
    for i in range(4):
        p1 = rect_coords[i]
        p2 = rect_coords[(i + 1) % 4]
        length = ((p2[0]-p1[0])**2 + (p2[1]-p1[1])**2) ** 0.5
        edges.append((p1, p2, length))

    edges_sorted = sorted(edges, key=lambda e: e[2], reverse=True)
    long_edge = edges_sorted[0]

    long_len = long_edge[2]
    if long_len < 0.1:
        return None, None

    p1, p2, _ = long_edge
    dx = p2[0] - p1[0]
    dy = p2[1] - p1[1]
    norm = (dx*dx + dy*dy) ** 0.5
    if norm < EPS:
        return None, None
    ux = dx / norm
    uy = dy / norm

    c = poly.centroid
    minx, miny, maxx, maxy = poly.bounds
    diag = ((maxx-minx)**2 + (maxy-miny)**2) ** 0.5 + 10.0

    raw_line = LineString([
        (c.x - ux * diag, c.y - uy * diag),
        (c.x + ux * diag, c.y + uy * diag)
    ])

    inter = raw_line.intersection(poly)
    centerline = longest_linestring_from_intersection(inter)
    if centerline is None:
        return None, None

    centerline = snap_line_to_axis(centerline)
    if centerline is None or centerline.length < 0.1:
        return None, None

    thickness = poly.area / max(centerline.length, EPS)

    if thickness < 0.05:
        thickness = 0.05
    if thickness > 2.0:
        thickness = 2.0

    return centerline, thickness

def merge_close_vertices(segments, delta):
    pts = []
    for seg in segments:
        coords = list(seg['line'].coords)
        pts.append(coords[0])
        pts.append(coords[-1])

    if not pts:
        return segments

    clusters = []
    for p in pts:
        assigned = False
        for cluster in clusters:
            cx, cy, plist = cluster
            d2 = (p[0]-cx)**2 + (p[1]-cy)**2
            if d2 < delta * delta:
                plist.append(p)
                nx = sum(pp[0] for pp in plist) / len(plist)
                ny = sum(pp[1] for pp in plist) / len(plist)
                cluster[0] = nx
                cluster[1] = ny
                assigned = True
                break
        if not assigned:
            clusters.append([p[0], p[1], [p]])

    def snap_point(p):
        best = p
        best_d = 1e18
        for cx, cy, plist in clusters:
            d2 = (p[0]-cx)**2 + (p[1]-cy)**2
            if d2 < best_d:
                best_d = d2
                best = (cx, cy)
        return best

    new_segments = []
    for seg in segments:
        coords = list(seg['line'].coords)
        p1 = snap_point(coords[0])
        p2 = snap_point(coords[-1])
        if ((p1[0]-p2[0])**2 + (p1[1]-p2[1])**2) ** 0.5 < 0.1:
            continue
        new_line = LineString([p1, p2])
        new_segments.append({
            'line': snap_line_to_axis(new_line),
            'thickness': seg['thickness'],
            'name': seg['name']
        })
    return new_segments

def point_to_segment_distance(pt, a, b):
    px, py = pt
    ax, ay = a
    bx, by = b
    dx = bx - ax
    dy = by - ay
    if abs(dx) < EPS and abs(dy) < EPS:
        return ((px-ax)**2 + (py-ay)**2)**0.5, a, 0.0

    t = ((px-ax)*dx + (py-ay)*dy) / (dx*dx + dy*dy)
    t_clamped = max(0.0, min(1.0, t))
    qx = ax + t_clamped * dx
    qy = ay + t_clamped * dy
    dist = ((px-qx)**2 + (py-qy)**2)**0.5
    return dist, (qx, qy), t_clamped

def split_segments_by_near_vertices(segments, delta):
    if not segments:
        return segments

    vertices = []
    for seg in segments:
        coords = list(seg['line'].coords)
        vertices.append(coords[0])
        vertices.append(coords[-1])

    new_segments = []
    for idx, seg in enumerate(segments):
        coords = list(seg['line'].coords)
        a = coords[0]
        b = coords[-1]
        split_pts = []

        for v in vertices:
            if v == a or v == b:
                continue
            dist, proj, t = point_to_segment_distance(v, a, b)
            if dist < delta and t > 0.01 and t < 0.99:
                split_pts.append((t, v))

        if not split_pts:
            new_segments.append(seg)
        else:
            split_pts.sort(key=lambda x: x[0])
            chain = [a] + [v for _, v in split_pts] + [b]
            for p1, p2 in zip(chain[:-1], chain[1:]):
                if ((p1[0]-p2[0])**2 + (p1[1]-p2[1])**2) ** 0.5 < 0.1:
                    continue
                new_line = snap_line_to_axis(LineString([p1, p2]))
                new_segments.append({
                    'line': new_line,
                    'thickness': seg['thickness'],
                    'name': seg['name']
                })
    return new_segments

def merge_collinear_segments(segments, gap_tol=0.3):
    if not segments:
        return segments

    horizontal = []
    vertical = []
    others = []

    for seg in segments:
        coords = list(seg['line'].coords)
        x1, y1 = coords[0]
        x2, y2 = coords[-1]
        if abs(y2 - y1) < 1e-6:
            xmin = min(x1, x2)
            xmax = max(x1, x2)
            horizontal.append((y1, xmin, xmax, seg))
        elif abs(x2 - x1) < 1e-6:
            ymin = min(y1, y2)
            ymax = max(y1, y2)
            vertical.append((x1, ymin, ymax, seg))
        else:
            others.append(seg)

    result = []

    by_y = {}
    for y, xmin, xmax, seg in horizontal:
        yk = round(y, 3)
        by_y.setdefault(yk, []).append((xmin, xmax, seg))

    for yk, arr in by_y.items():
        arr.sort(key=lambda x: x[0])
        cur_x1, cur_x2, cur_seg = arr[0]
        thick = cur_seg['thickness']
        name = cur_seg['name']
        for nx1, nx2, nseg in arr[1:]:
            if nx1 <= cur_x2 + gap_tol:
                cur_x2 = max(cur_x2, nx2)
                thick = (thick + nseg['thickness']) / 2.0
            else:
                result.append({
                    'line': LineString([(cur_x1, yk), (cur_x2, yk)]),
                    'thickness': thick,
                    'name': name
                })
                cur_x1, cur_x2, cur_seg = nx1, nx2, nseg
                thick = cur_seg['thickness']
                name = cur_seg['name']
        result.append({
            'line': LineString([(cur_x1, yk), (cur_x2, yk)]),
            'thickness': thick,
            'name': name
        })

    by_x = {}
    for x, ymin, ymax, seg in vertical:
        xk = round(x, 3)
        by_x.setdefault(xk, []).append((ymin, ymax, seg))

    for xk, arr in by_x.items():
        arr.sort(key=lambda x: x[0])
        cur_y1, cur_y2, cur_seg = arr[0]
        thick = cur_seg['thickness']
        name = cur_seg['name']
        for ny1, ny2, nseg in arr[1:]:
            if ny1 <= cur_y2 + gap_tol:
                cur_y2 = max(cur_y2, ny2)
                thick = (thick + nseg['thickness']) / 2.0
            else:
                result.append({
                    'line': LineString([(xk, cur_y1), (xk, cur_y2)]),
                    'thickness': thick,
                    'name': name
                })
                cur_y1, cur_y2, cur_seg = ny1, ny2, nseg
                thick = cur_seg['thickness']
                name = cur_seg['name']
        result.append({
            'line': LineString([(xk, cur_y1), (xk, cur_y2)]),
            'thickness': thick,
            'name': name
        })

    result.extend(others)
    return result

def optimize_wall_centerlines(candidates, iter_count=1, enable_merge_collinear=True):
    if not candidates:
        return []

    segs = candidates[:]

    if enable_merge_collinear:
        segs = merge_collinear_segments_strict(segs, coord_tol=0.08, gap_tol=0.35)

    for _ in range(iter_count):
        if not segs:
            break

        avg_t = sum(s['thickness'] for s in segs) / max(len(segs), 1)
        delta = 0.20 * avg_t
        if delta < 0.03:
            delta = 0.03
        if delta > 0.12:
            delta = 0.12

        segs = merge_close_vertices(segs, delta)
        segs = split_segments_by_near_vertices(segs, delta)

    cleaned = []
    for s in segs:
        try:
            if s['line'] is None or s['line'].is_empty:
                continue
            if s['line'].length < 0.08:
                continue
            cleaned.append(s)
        except:
            continue

    return cleaned

def get_wall_type_by_name(doc, type_name):
    wall_type_collector = FilteredElementCollector(doc).OfClass(WallType)
    found = None
    for wt in wall_type_collector:
        if wt.Kind == WallKind.Basic:
            name_param = wt.get_Parameter(BuiltInParameter.SYMBOL_NAME_PARAM)
            if name_param and name_param.AsString() == type_name:
                found = wt
                break
    if found:
        return found
    for wt in wall_type_collector:
        if wt.Kind == WallKind.Basic:
            return wt
    return None

def build_global_structure_mask(result, pixelWidth, pixelHeight, logs):
    """
    把 Wall / Door / Window / TDoor 全部合成到同一张“结构墙体mask”
    目的是让门窗区域也参与墙体恢复，从而后续宿主开洞
    """
    wall_mask = np.zeros((pixelHeight, pixelWidth), dtype=np.uint8)
    class_counter = {}

    if result.masks is None:
        logs.append("result.masks is None")
        return wall_mask, class_counter

    masks_xy = result.masks.xy
    cls_ids = result.boxes.cls.cpu().numpy().astype(int)
    names = result.names

    logs.append("总mask数量: {}".format(len(masks_xy)))

    for i, contour_pts in enumerate(masks_xy):
        try:
            if i >= len(cls_ids):
                continue

            class_id = cls_ids[i]
            class_name = names[class_id]
            class_name_norm = normalize_class_name(class_name)

            if not is_structure_wall_like_class(class_name):
                continue

            pts = np.array(contour_pts, dtype=np.int32)
            if len(pts) < 3:
                continue

            pts[:, 0] = np.clip(pts[:, 0], 0, pixelWidth - 1)
            pts[:, 1] = np.clip(pts[:, 1], 0, pixelHeight - 1)

            cv2.fillPoly(wall_mask, [pts], 255)

            class_counter[class_name_norm] = class_counter.get(class_name_norm, 0) + 1

        except Exception as e:
            logs.append("合成结构mask失败 idx={}: {}".format(i, str(e)))
            continue

    logs.append("参与墙体生成的类别统计: {}".format(str(class_counter)))
    return wall_mask, class_counter

def clean_wall_mask(binary_mask, logs):
    mask = binary_mask.copy()

    kernel_close = cv2.getStructuringElement(cv2.MORPH_RECT, (5, 5))
    kernel_open = cv2.getStructuringElement(cv2.MORPH_RECT, (3, 3))

    mask = cv2.morphologyEx(mask, cv2.MORPH_CLOSE, kernel_close)
    mask = cv2.morphologyEx(mask, cv2.MORPH_OPEN, kernel_open)

    num_labels, labels, stats, _ = cv2.connectedComponentsWithStats(mask, connectivity=8)
    cleaned = np.zeros_like(mask)

    for i in range(1, num_labels):
        area = stats[i, cv2.CC_STAT_AREA]
        if area >= 50:
            cleaned[labels == i] = 255

    logs.append("结构mask清理完成")
    return cleaned

def estimate_wall_width_pixels(binary_mask, logs):
    if binary_mask is None or binary_mask.max() == 0:
        logs.append("墙宽估计失败：mask为空")
        return 6.0

    dist = cv2.distanceTransform(binary_mask, cv2.DIST_L2, 5)
    vals = dist[dist > 0]
    if len(vals) == 0:
        logs.append("墙宽估计失败：distanceTransform为空")
        return 6.0

    wall_width_px = max(2.0, 2.0 * np.median(vals))
    logs.append("估计墙宽像素值: {:.2f}".format(wall_width_px))
    return wall_width_px

def skeletonize_wall_mask(binary_mask, logs):
    try:
        from skimage.morphology import skeletonize
        skel = skeletonize(binary_mask > 0)
        logs.append("使用 skimage.skeletonize 成功")
        return skel.astype(np.uint8)
    except Exception as e:
        logs.append("skimage骨架失败，改用fallback: {}".format(str(e)))
        return skeletonize_fallback(binary_mask, logs)

def skeletonize_fallback(binary_mask, logs):
    img = (binary_mask > 0).astype(np.uint8) * 255
    size = np.size(img)
    skel = np.zeros(img.shape, np.uint8)

    element = cv2.getStructuringElement(cv2.MORPH_CROSS, (3, 3))
    done = False

    while not done:
        eroded = cv2.erode(img, element)
        temp = cv2.dilate(eroded, element)
        temp = cv2.subtract(img, temp)
        skel = cv2.bitwise_or(skel, temp)
        img = eroded.copy()

        zeros = size - cv2.countNonZero(img)
        if zeros == size:
            done = True

    logs.append("fallback skeletonize 成功")
    return (skel > 0).astype(np.uint8)

def get_neighbors_8(x, y, w, h):
    nbs = []
    for dy in [-1, 0, 1]:
        for dx in [-1, 0, 1]:
            if dx == 0 and dy == 0:
                continue
            nx = x + dx
            ny = y + dy
            if 0 <= nx < w and 0 <= ny < h:
                nbs.append((nx, ny))
    return nbs

def extract_skeleton_graph(skel, logs):
    h, w = skel.shape
    skel_pts = set()
    for y in range(h):
        xs = np.where(skel[y] > 0)[0]
        for x in xs:
            skel_pts.add((x, y))

    if not skel_pts:
        logs.append("骨架为空")
        return [], []

    degree = {}
    for (x, y) in skel_pts:
        cnt = 0
        for nx, ny in get_neighbors_8(x, y, w, h):
            if (nx, ny) in skel_pts:
                cnt += 1
        degree[(x, y)] = cnt

    nodes = [p for p, d in degree.items() if d != 2]

    if not nodes:
        nodes = list(skel_pts)

    node_set = set(nodes)
    visited_edges = set()
    edges = []

    for node in nodes:
        x0, y0 = node
        for nx, ny in get_neighbors_8(x0, y0, w, h):
            if (nx, ny) not in skel_pts:
                continue

            edge_key = tuple(sorted([node, (nx, ny)]))
            if edge_key in visited_edges:
                continue

            path = [node, (nx, ny)]
            prev = node
            curr = (nx, ny)

            while True:
                visited_edges.add(tuple(sorted([prev, curr])))

                if curr in node_set and curr != node:
                    break

                nbrs = []
                for tx, ty in get_neighbors_8(curr[0], curr[1], w, h):
                    if (tx, ty) in skel_pts and (tx, ty) != prev:
                        nbrs.append((tx, ty))

                if len(nbrs) == 0:
                    break
                if len(nbrs) > 1:
                    break

                nxt = nbrs[0]
                path.append(nxt)
                prev = curr
                curr = nxt

            if len(path) >= 2:
                edges.append(path)

    logs.append("骨架图提取完成: nodes={}, edges={}".format(len(nodes), len(edges)))
    return nodes, edges

def simplify_path_to_axis_lines(path, wall_mask, pixelWidth, pixelHeight, logs, min_len_px=8):
    result_lines = []

    sub_paths = split_path_by_direction(path, turn_threshold=2)
    for sub in sub_paths:
        try:
            fitted = fit_axis_line_from_mask(
                sub, wall_mask, pixelWidth, pixelHeight, min_len_px=min_len_px
            )
            if fitted is None:
                continue

            p1, p2, ori = fitted
            line_geom = pixel_line_to_revit_linestring(p1, p2)
            if line_geom is None:
                continue

            if line_geom.length < 0.08:
                continue

            result_lines.append(line_geom)

        except Exception as e:
            logs.append("子段拟合失败: {}".format(str(e)))
            continue

    return result_lines

def extract_wall_centerlines_from_global_mask(result, pixelWidth, pixelHeight, logs):
    wall_mask, class_counter = build_global_structure_mask(result, pixelWidth, pixelHeight, logs)
    if wall_mask.max() == 0:
        logs.append("没有结构类mask被写入全局墙图")
        return [], 0.3, class_counter, wall_mask

    cleaned_mask = clean_wall_mask(wall_mask, logs)
    wall_width_px = estimate_wall_width_pixels(cleaned_mask, logs)

    skel = skeletonize_wall_mask(cleaned_mask, logs)
    nodes, edges = extract_skeleton_graph(skel, logs)

    if not edges:
        logs.append("骨架没有边")
        wall_width_ft = wall_width_px * (scale_x_ft_per_px_global if scale_x_ft_per_px_global else scaleX)
        return [], wall_width_ft, class_counter, cleaned_mask

    wall_width_ft = wall_width_px * (scale_x_ft_per_px_global if scale_x_ft_per_px_global else scaleX)
    candidates = []

    for idx, path in enumerate(edges):
        try:
            line_list = simplify_path_to_axis_lines(
                path, cleaned_mask, pixelWidth, pixelHeight, logs, min_len_px=max(6, int(wall_width_px))
            )

            for line_geom in line_list:
                candidates.append({
                    'line': line_geom,
                    'thickness': wall_width_ft,
                    'name': "Wall"
                })

        except Exception as e:
            logs.append("路径{}转中心线失败: {}".format(idx, str(e)))
            continue

    logs.append("全局提取中心线候选数量: {}".format(len(candidates)))
    return candidates, wall_width_ft, class_counter, cleaned_mask

def merge_collinear_segments_strict(segments, coord_tol=0.08, gap_tol=0.25):
    if not segments:
        return segments

    horizontal = []
    vertical = []
    others = []

    for seg in segments:
        coords = list(seg['line'].coords)
        x1, y1 = coords[0]
        x2, y2 = coords[-1]

        if abs(y2 - y1) <= coord_tol:
            y = 0.5 * (y1 + y2)
            xmin, xmax = min(x1, x2), max(x1, x2)
            horizontal.append((y, xmin, xmax, seg))
        elif abs(x2 - x1) <= coord_tol:
            x = 0.5 * (x1 + x2)
            ymin, ymax = min(y1, y2), max(y1, y2)
            vertical.append((x, ymin, ymax, seg))
        else:
            others.append(seg)

    merged = []

    horizontal.sort(key=lambda t: (round(t[0], 2), t[1]))
    used = [False] * len(horizontal)
    for i in range(len(horizontal)):
        if used[i]:
            continue
        y, x1, x2, seg = horizontal[i]
        thick = seg['thickness']
        name = seg['name']

        for j in range(i + 1, len(horizontal)):
            if used[j]:
                continue
            y2, xx1, xx2, seg2 = horizontal[j]
            if abs(y2 - y) <= coord_tol and xx1 <= x2 + gap_tol:
                x2 = max(x2, xx2)
                thick = 0.5 * (thick + seg2['thickness'])
                used[j] = True

        merged.append({
            'line': LineString([(x1, y), (x2, y)]),
            'thickness': thick,
            'name': name
        })

    vertical.sort(key=lambda t: (round(t[0], 2), t[1]))
    used = [False] * len(vertical)
    for i in range(len(vertical)):
        if used[i]:
            continue
        x, y1, y2, seg = vertical[i]
        thick = seg['thickness']
        name = seg['name']

        for j in range(i + 1, len(vertical)):
            if used[j]:
                continue
            x2, yy1, yy2, seg2 = vertical[j]
            if abs(x2 - x) <= coord_tol and yy1 <= y2 + gap_tol:
                y2 = max(y2, yy2)
                thick = 0.5 * (thick + seg2['thickness'])
                used[j] = True

        merged.append({
            'line': LineString([(x, y1), (x, y2)]),
            'thickness': thick,
            'name': name
        })

    merged.extend(others)
    return merged

def split_path_by_direction(path, turn_threshold=2):
    if not path or len(path) < 3:
        return [path] if path else []

    segments = []
    current = [path[0], path[1]]

    def major_dir(p1, p2):
        dx = p2[0] - p1[0]
        dy = p2[1] - p1[1]
        if abs(dx) >= abs(dy):
            return "h"
        else:
            return "v"

    prev_dir = major_dir(path[0], path[1])

    for i in range(2, len(path)):
        d = major_dir(path[i-1], path[i])

        if d == prev_dir:
            current.append(path[i])
        else:
            if len(current) <= turn_threshold and segments:
                segments[-1].extend(current[1:])
                current = [segments[-1][-1], path[i]]
            else:
                segments.append(current)
                current = [path[i-1], path[i]]
            prev_dir = d

    if current:
        if len(current) <= turn_threshold and segments:
            segments[-1].extend(current[1:])
        else:
            segments.append(current)

    cleaned = []
    for seg in segments:
        if seg and len(seg) >= 2:
            cleaned.append(seg)

    return cleaned

def fit_axis_line_from_mask(sub_path, wall_mask, pixelWidth, pixelHeight, min_len_px=8):
    if not sub_path or len(sub_path) < 2:
        return None

    xs = [p[0] for p in sub_path]
    ys = [p[1] for p in sub_path]

    x_min = max(0, int(min(xs)))
    x_max = min(pixelWidth - 1, int(max(xs)))
    y_min = max(0, int(min(ys)))
    y_max = min(pixelHeight - 1, int(max(ys)))

    dx = x_max - x_min
    dy = y_max - y_min

    if dx >= dy:
        mids = []
        for x in range(x_min, x_max + 1):
            ys_in = np.where(wall_mask[:, x] > 0)[0]
            ys_local = ys_in[(ys_in >= y_min - 8) & (ys_in <= y_max + 8)]
            if len(ys_local) >= 2:
                y_top = np.min(ys_local)
                y_bot = np.max(ys_local)
                y_mid = 0.5 * (y_top + y_bot)
                mids.append((x, y_mid))

        if len(mids) < 2:
            return None

        xs2 = [p[0] for p in mids]
        ys2 = [p[1] for p in mids]

        x1 = min(xs2)
        x2 = max(xs2)
        y = float(np.median(ys2))

        if (x2 - x1) < min_len_px:
            return None

        return ((x1, y), (x2, y), "h")

    else:
        mids = []
        for y in range(y_min, y_max + 1):
            xs_in = np.where(wall_mask[y, :] > 0)[0]
            xs_local = xs_in[(xs_in >= x_min - 8) & (xs_in <= x_max + 8)]
            if len(xs_local) >= 2:
                x_left = np.min(xs_local)
                x_right = np.max(xs_local)
                x_mid = 0.5 * (x_left + x_right)
                mids.append((x_mid, y))

        if len(mids) < 2:
            return None

        xs2 = [p[0] for p in mids]
        ys2 = [p[1] for p in mids]

        y1 = min(ys2)
        y2 = max(ys2)
        x = float(np.median(xs2))

        if (y2 - y1) < min_len_px:
            return None

        return ((x, y1), (x, y2), "v")

def pixel_line_to_revit_linestring(p1, p2):
    rp1 = pix_to_revit(p1[0], p1[1])
    rp2 = pix_to_revit(p2[0], p2[1])
    if rp1.DistanceTo(rp2) < 0.1:
        return None
    return LineString([(rp1.X, rp1.Y), (rp2.X, rp2.Y)])

# =========================
# 运行YOLO分割
# =========================
yolo_seg = YOLO(dect_Model, task="seg")
seg_result = yolo_seg(source=pixpath, save=False, conf=0.3, iou=0.45, imgsz=640)
cv2.imwrite(newpath, seg_result[0].plot())

result = seg_result[0]
boxes = result.boxes
xyxy = boxes.xyxy.cpu().numpy() if boxes is not None else np.empty((0,4))
cls_ids = boxes.cls.cpu().numpy().astype(int) if boxes is not None else np.array([], dtype=int)
names = result.names

# =========================
# 读取OCR尺寸JSON
# =========================
dims_data = None
horizontal_length_mm = None
vertical_length_mm = None

try:
    with open(dims_json_path, "r", encoding="utf-8") as f:
        dims_data = json.load(f)

    if dims_data.get("ok", False):
        if "result" in dims_data:
            horizontal_length_mm = dims_data["result"].get("horizontal_length", None)
            vertical_length_mm = dims_data["result"].get("vertical_length", None)
        else:
            horizontal_length_mm = dims_data.get("horizontal_length", None)
            vertical_length_mm = dims_data.get("vertical_length", None)

    logs.append("读取dims_json成功: horizontal={} mm, vertical={} mm".format(
        str(horizontal_length_mm), str(vertical_length_mm)
    ))
except Exception as e:
    logs.append("读取dims_json失败: {}".format(str(e)))

# =========================
# 先做结构mask -> bbox -> scale
# =========================
global_structure_mask, structure_class_counter = build_global_structure_mask(result, pixelWidth, pixelHeight, logs)
cleaned_global_structure_mask = clean_wall_mask(global_structure_mask, logs)
bbox_info = get_mask_bbox(cleaned_global_structure_mask, logs)

scale_x_mm_per_px = None
scale_y_mm_per_px = None
scale_avg_mm_per_px = None
scale_x_ft_per_px = None
scale_y_ft_per_px = None
scale_avg_ft_per_px = None

if bbox_info is not None and horizontal_length_mm is not None and vertical_length_mm is not None:
    try:
        bbox_w = bbox_info["width"]
        bbox_h = bbox_info["height"]

        if bbox_w > 0 and bbox_h > 0:
            scale_x_mm_per_px = float(horizontal_length_mm) / float(bbox_w)
            scale_y_mm_per_px = float(vertical_length_mm) / float(bbox_h)
            scale_avg_mm_per_px = (scale_x_mm_per_px + scale_y_mm_per_px) / 2.0

            mm_to_ft = 1.0 / 304.8
            scale_x_ft_per_px = scale_x_mm_per_px * mm_to_ft
            scale_y_ft_per_px = scale_y_mm_per_px * mm_to_ft
            scale_avg_ft_per_px = scale_avg_mm_per_px * mm_to_ft

            bbox_info_global = bbox_info
            scale_x_ft_per_px_global = scale_x_ft_per_px
            scale_y_ft_per_px_global = scale_y_ft_per_px

            logs.append("scale_x_mm_per_px={:.6f}".format(scale_x_mm_per_px))
            logs.append("scale_y_mm_per_px={:.6f}".format(scale_y_mm_per_px))
            logs.append("scale_avg_mm_per_px={:.6f}".format(scale_avg_mm_per_px))
            logs.append("scale_x_ft_per_px={:.6f}".format(scale_x_ft_per_px))
            logs.append("scale_y_ft_per_px={:.6f}".format(scale_y_ft_per_px))
        else:
            logs.append("bbox宽高无效，无法计算scale")
    except Exception as e:
        logs.append("scale计算失败: {}".format(str(e)))
else:
    logs.append("bbox或真实尺寸缺失，使用fallback整图scale")

# =========================
# Revit文档对象
# =========================
doc = DocumentManager.Instance.CurrentDBDocument
app = doc.Application

wall_type = None
wall_type_collector = FilteredElementCollector(doc).OfClass(WallType)

for wt in wall_type_collector:
    if wt.Kind == WallKind.Basic:
        name_param = wt.get_Parameter(BuiltInParameter.SYMBOL_NAME_PARAM)
        if name_param and name_param.AsString() == TARGET_WALL_TYPE_NAME:
            wall_type = wt
            break

if wall_type is None:
    for wt in wall_type_collector:
        if wt.Kind == WallKind.Basic:
            wall_type = wt
            break

if wall_type is None:
    raise Exception("项目中找不到任何基本墙类型！")

level = None
level_collector = FilteredElementCollector(doc).OfClass(Level)
for lvl in level_collector:
    name_param = lvl.get_Parameter(BuiltInParameter.LEVEL_NAME)
    if name_param and name_param.AsString() == TARGET_LEVEL_NAME:
        level = lvl
        break

if level is None:
    level = level_collector.FirstElement()
    if level is None:
        raise Exception("项目中找不到任何标高！")

TransactionManager.Instance.EnsureInTransaction(doc)

created_lines = []
dyn_lines = []
dyn_faces = [] 
created_shapes = []
created_walls = []
wall_candidates = []

thickness = height
wallHeight = height

plane = Plane.CreateByNormalAndOrigin(XYZ.BasisZ, origin)
sketch_plane = SketchPlane.Create(doc, plane)

DEFAULT_WALL_WIDTH = 0.3

# =========================
# 提取中心线并创建墙
# =========================
if result.masks is not None:
    logs.append("YOLO类别映射: {}".format(str(result.names)))

    wall_candidates, default_wall_thickness, used_class_counter, final_mask_used = extract_wall_centerlines_from_global_mask(
        result, pixelWidth, pixelHeight, logs
    )

    logs.append("初始墙候选数量: {}".format(len(wall_candidates)))

    optimized_walls = optimize_wall_centerlines(
        wall_candidates,
        iter_count=1,
        enable_merge_collinear=False
    )

    logs.append("优化后墙数量: {}".format(len(optimized_walls)))

    for idx, w in enumerate(optimized_walls):
        try:
            line_geom = w['line']
            thickness_val = w['thickness']
            name = "Wall"  # 统一输出名称，避免后续混乱

            coords = list(line_geom.coords)
            if len(coords) < 2:
                logs.append("墙{}失败：coords不足".format(idx))
                continue

            start_pt = XYZ(coords[0][0], coords[0][1], 0)
            end_pt = XYZ(coords[-1][0], coords[-1][1], 0)

            if start_pt.DistanceTo(end_pt) < 0.1:
                logs.append("墙{}失败：线太短".format(idx))
                continue

            revit_line = Line.CreateBound(start_pt, end_pt)

            logs.append("准备创建墙{}: len={:.3f}, thickness={:.3f}".format(
                idx, revit_line.Length, thickness_val
            ))

            wall = Wall.Create(doc, revit_line, wall_type.Id, level.Id, wallHeight, 0, False, False)

            try:
                param = wall.get_Parameter(BuiltInParameter.WALL_ATTR_WIDTH_PARAM)
                if param and not param.IsReadOnly:
                    param.Set(thickness_val)
            except Exception as e2:
                logs.append("墙{}宽度设置失败(可忽略): {}".format(idx, str(e2)))

            try:
                wall.Name = sanitize_name(name)
            except:
                pass

            created_walls.append(wall.ToDSType(True))
            logs.append("墙{}创建成功".format(idx))

        except Exception as e:
            logs.append("墙{}创建失败: {}".format(idx, str(e)))
            logs.append(traceback.format_exc())
            continue
else:
    logs.append("result.masks is None，没有分割mask")

# =========================
# 提交事务
# =========================
TransactionManager.Instance.TransactionTaskDone()
doc.Regenerate()

# =========================
# 写 seg_meta_json
# =========================
seg_meta = {
    "ok": True,
    "image_path": pixpath,
    "seg_vis_path": newpath,
    "dims_json_path": dims_json_path,
    "wall_bbox_px": bbox_info,
    "real_size_mm": {
        "horizontal_length": horizontal_length_mm,
        "vertical_length": vertical_length_mm
    },
    "scale": {
        "scale_x_mm_per_px": scale_x_mm_per_px,
        "scale_y_mm_per_px": scale_y_mm_per_px,
        "scale_avg_mm_per_px": scale_avg_mm_per_px,
        "scale_x_ft_per_px": scale_x_ft_per_px,
        "scale_y_ft_per_px": scale_y_ft_per_px,
        "scale_avg_ft_per_px": scale_avg_ft_per_px
    },
    "structure_mask_classes_used": structure_class_counter,
    "debug": {
        "pixelWidth": pixelWidth,
        "pixelHeight": pixelHeight,
        "wall_count": len(created_walls),
        "mask_count": len(result.masks.xy) if result.masks is not None else 0,
        "class_names": result.names,
        "log_count": len(logs)
    }
}

try:
    ensure_dir_of_file(seg_meta_json_path)
    with open(seg_meta_json_path, "w", encoding="utf-8") as f:
        json.dump(seg_meta, f, ensure_ascii=False, indent=2)
    logs.append("seg_meta_json已写出: {}".format(seg_meta_json_path))
except Exception as e:
    logs.append("seg_meta_json写出失败: {}".format(str(e)))

OUT = newpath, created_walls, seg_meta_json_path, logs
# ----------------------------------------
python_version_20 = Watch(python_script_20)  # graph output
python_script_21 = Python(IN[0]=seg_WWTD_Modelpath, IN[1]=imagepath_2, IN[2]=number, IN[3]=scale, IN[4]=python_version_4, IN[5]=seg_meta_Json_Path)  # CPython3; frozen
# ---------- python_script_21.python (1448 lines) ----------
# 加载 Python Standard  和 DesignScript 库
#-------------------
import sys
import clr
clr.AddReference('ProtoGeometry')
from Autodesk.DesignScript.Geometry import *
import Autodesk.DesignScript.Geometry as DS
import Revit
from Revit.Elements import *
import System
sys.path.append("C:/Users/Lenovo/anaconda3/envs/revitenv/Lib/site-packages")
clr.AddReference('RevitAPI')
clr.AddReference('RevitAPIUI')
from Autodesk.Revit.DB import *
from Autodesk.Revit.UI import *

clr.AddReference('RevitServices')
from RevitServices.Persistence import DocumentManager
from RevitServices.Transactions import TransactionManager

clr.AddReference('RevitNodes')
import Revit
clr.ImportExtensions(Revit.Elements)
clr.ImportExtensions(Revit.GeometryConversion)

import re
import math
import json
import os
import traceback
import numpy as np
import torch
import cv2

from scipy.spatial import Voronoi
from scipy import ndimage
from shapely.geometry import Polygon, LineString, MultiLineString
from shapely.ops import linemerge
from shapely.ops import unary_union, split
from shapely.geometry import Point as ShpPoint
from shapely.geometry import Polygon as ShpPolygon
from shapely.geometry import MultiPolygon as ShpMultiPolygon
from shapely.geometry import Point as ShpPoint
from shapely.geometry import MultiLineString
from shapely.ops import linemerge
from skimage.morphology import skeletonize
from ultralytics import YOLO

dataEnteringNode = IN 

# =========================
# 输入
# =========================
dect_Model = IN[0]
pixpath = IN[1]
height = IN[2]
scale = IN[3]
dims_json_path = IN[4]
seg_meta_json_path = IN[5]

# =========================
# 参数
# =========================
origin = XYZ(0, 0, 0)   
widthFt = scale
pixelWidth = 1600   
pixelHeight = 1200 
DENSIFY_DIST = 0.5  
EPS = 1e-6

TARGET_WALL_TYPE_NAME = "基本墙 200mm"
TARGET_LEVEL_NAME = "标高 2"

newpath = "E:/yanjiu/revitss/tests/jjianzhu_seg.jpg"

scaleX = widthFt / pixelWidth if pixelWidth > 0 else 0.0
scaleY = widthFt * (pixelHeight / pixelWidth) / pixelHeight if pixelWidth > 0 and pixelHeight > 0 else 0.0

bbox_info_global = None
scale_x_ft_per_px_global = None
scale_y_ft_per_px_global = None

logs = []

# =========================
# 工具函数
# =========================
def ensure_dir_of_file(file_path):
    folder = os.path.dirname(file_path)
    if folder and not os.path.exists(folder):
        os.makedirs(folder)

def pix_to_revit(x, y):
    global bbox_info_global, scale_x_ft_per_px_global, scale_y_ft_per_px_global

    try:
        if bbox_info_global is not None and scale_x_ft_per_px_global is not None and scale_y_ft_per_px_global is not None:
            min_x = bbox_info_global["min_x"]
            min_y = bbox_info_global["min_y"]
            bbox_h = bbox_info_global["height"]

            local_x = x - min_x
            local_y = y - min_y

            revit_x = origin.X + local_x * scale_x_ft_per_px_global
            revit_y = origin.Y + (bbox_h - local_y) * scale_y_ft_per_px_global
            return XYZ(revit_x, revit_y, origin.Z)
    except:
        pass

    revit_x = origin.X + x * scaleX
    revit_y = origin.Y + (pixelHeight - y) * scaleY
    return XYZ(revit_x, revit_y, origin.Z)

def sanitize_name(name):
    if not name:
        return "Unknown"
    cleaned = re.sub(r'[\x00-\x1f\x7f]', '', name)
    if not cleaned.strip():
        return "Unnamed"
    return cleaned

def get_mask_bbox(binary_mask, logs):
    if binary_mask is None:
        logs.append("get_mask_bbox失败: binary_mask is None")
        return None

    ys, xs = np.where(binary_mask > 0)
    if len(xs) == 0 or len(ys) == 0:
        logs.append("get_mask_bbox失败: 墙体mask为空")
        return None

    min_x = int(np.min(xs))
    max_x = int(np.max(xs))
    min_y = int(np.min(ys))
    max_y = int(np.max(ys))

    bbox = {
        "min_x": min_x,
        "min_y": min_y,
        "max_x": max_x,
        "max_y": max_y,
        "width": int(max_x - min_x + 1),
        "height": int(max_y - min_y + 1)
    }
    logs.append("结构mask bbox: {}".format(str(bbox)))
    return bbox

# =========================
# 结构类配置
# =========================
STRUCTURE_CLASS_KEYWORDS = [
    "wall",
    "墙",
    "墙体",
    "basic wall",
    "door",
    "门",
    "tdoor",
    "double door",
    "window",
    "窗",
    "窗户"
]

STRUCTURE_CLASS_EXACT = set([
    "wall",
    "door",
    "window",
    "tdoor"
])

EXPAND_CLASSES = set([
    "door",
    "window",
    "tdoor"
])

def normalize_class_name(name):
    if name is None:
        return ""
    return str(name).strip().lower()

def is_structure_wall_like_class(name):
    n = normalize_class_name(name)
    if not n:
        return False

    if n in STRUCTURE_CLASS_EXACT:
        return True

    for kw in STRUCTURE_CLASS_KEYWORDS:
        if kw.lower() in n:
            return True
    return False

def ensure_polygon(geom):
    if geom is None or geom.is_empty:
        return None
    try:
        if not geom.is_valid:
            geom = geom.buffer(0)
    except:
        pass
    if geom is None or geom.is_empty:
        return None

    if isinstance(geom, ShpPolygon):
        return geom

    if isinstance(geom, ShpMultiPolygon):
        polys = [g for g in geom.geoms if g is not None and not g.is_empty]
        if not polys:
            return None
        polys.sort(key=lambda p: p.area, reverse=True)
        return polys[0]

    return None

def contour_to_polygon(contour_pts):
    revit_pts = [pix_to_revit(pt[0], pt[1]) for pt in contour_pts]
    if len(revit_pts) < 3:
        return None
    coords = [(p.X, p.Y) for p in revit_pts]
    if coords[0] != coords[-1]:
        coords.append(coords[0])
    poly = ShpPolygon(coords)
    poly = ensure_polygon(poly)
    return poly

def line_long_enough(line_geom, min_len=0.1):
    if line_geom is None or line_geom.is_empty:
        return False
    try:
        return line_geom.length >= min_len
    except:
        return False

def snap_line_to_axis(line_geom):
    if line_geom is None or line_geom.is_empty:
        return None
    coords = list(line_geom.coords)
    if len(coords) < 2:
        return None
    x1, y1 = coords[0]
    x2, y2 = coords[-1]
    dx = x2 - x1
    dy = y2 - y1
    if abs(dx) >= abs(dy):
        ym = 0.5 * (y1 + y2)
        return LineString([(x1, ym), (x2, ym)])
    else:
        xm = 0.5 * (x1 + x2)
        return LineString([(xm, y1), (xm, y2)])

def longest_linestring_from_intersection(inter):
    if inter is None or inter.is_empty:
        return None
    if inter.geom_type == "LineString":
        return inter
    if inter.geom_type == "MultiLineString":
        lines = [g for g in inter.geoms if g.length > 1e-4]
        if not lines:
            return None
        lines.sort(key=lambda g: g.length, reverse=True)
        return lines[0]
    return None

def estimate_centerline_from_polygon(poly):
    if poly is None or poly.is_empty:
        return None, None

    poly = ensure_polygon(poly)
    if poly is None:
        return None, None

    if poly.area < 1e-5:
        return None, None

    try:
        mrr = poly.minimum_rotated_rectangle
    except:
        return None, None

    mrr = ensure_polygon(mrr)
    if mrr is None:
        return None, None

    rect_coords = list(mrr.exterior.coords)[:-1]
    if len(rect_coords) != 4:
        return None, None

    edges = []
    for i in range(4):
        p1 = rect_coords[i]
        p2 = rect_coords[(i + 1) % 4]
        length = ((p2[0]-p1[0])**2 + (p2[1]-p1[1])**2) ** 0.5
        edges.append((p1, p2, length))

    edges_sorted = sorted(edges, key=lambda e: e[2], reverse=True)
    long_edge = edges_sorted[0]

    long_len = long_edge[2]
    if long_len < 0.1:
        return None, None

    p1, p2, _ = long_edge
    dx = p2[0] - p1[0]
    dy = p2[1] - p1[1]
    norm = (dx*dx + dy*dy) ** 0.5
    if norm < EPS:
        return None, None
    ux = dx / norm
    uy = dy / norm

    c = poly.centroid
    minx, miny, maxx, maxy = poly.bounds
    diag = ((maxx-minx)**2 + (maxy-miny)**2) ** 0.5 + 10.0

    raw_line = LineString([
        (c.x - ux * diag, c.y - uy * diag),
        (c.x + ux * diag, c.y + uy * diag)
    ])

    inter = raw_line.intersection(poly)
    centerline = longest_linestring_from_intersection(inter)
    if centerline is None:
        return None, None

    centerline = snap_line_to_axis(centerline)
    if centerline is None or centerline.length < 0.1:
        return None, None

    thickness = poly.area / max(centerline.length, EPS)

    if thickness < 0.05:
        thickness = 0.05
    if thickness > 2.0:
        thickness = 2.0

    return centerline, thickness

def merge_close_vertices(segments, delta):
    pts = []
    for seg in segments:
        coords = list(seg['line'].coords)
        pts.append(coords[0])
        pts.append(coords[-1])

    if not pts:
        return segments

    clusters = []
    for p in pts:
        assigned = False
        for cluster in clusters:
            cx, cy, plist = cluster
            d2 = (p[0]-cx)**2 + (p[1]-cy)**2
            if d2 < delta * delta:
                plist.append(p)
                nx = sum(pp[0] for pp in plist) / len(plist)
                ny = sum(pp[1] for pp in plist) / len(plist)
                cluster[0] = nx
                cluster[1] = ny
                assigned = True
                break
        if not assigned:
            clusters.append([p[0], p[1], [p]])

    def snap_point(p):
        best = p
        best_d = 1e18
        for cx, cy, plist in clusters:
            d2 = (p[0]-cx)**2 + (p[1]-cy)**2
            if d2 < best_d:
                best_d = d2
                best = (cx, cy)
        return best

    new_segments = []
    for seg in segments:
        coords = list(seg['line'].coords)
        p1 = snap_point(coords[0])
        p2 = snap_point(coords[-1])
        if ((p1[0]-p2[0])**2 + (p1[1]-p2[1])**2) ** 0.5 < 0.1:
            continue
        new_line = LineString([p1, p2])
        new_line = snap_line_to_axis(new_line)
        if new_line is None:
            continue
        new_segments.append({
            'line': new_line,
            'thickness': seg['thickness'],
            'name': seg['name']
        })
    return new_segments

def point_to_segment_distance(pt, a, b):
    px, py = pt
    ax, ay = a
    bx, by = b
    dx = bx - ax
    dy = by - ay
    if abs(dx) < EPS and abs(dy) < EPS:
        return ((px-ax)**2 + (py-ay)**2)**0.5, a, 0.0

    t = ((px-ax)*dx + (py-ay)*dy) / (dx*dx + dy*dy)
    t_clamped = max(0.0, min(1.0, t))
    qx = ax + t_clamped * dx
    qy = ay + t_clamped * dy
    dist = ((px-qx)**2 + (py-qy)**2)**0.5
    return dist, (qx, qy), t_clamped

def split_segments_by_near_vertices(segments, delta):
    if not segments:
        return segments

    vertices = []
    for seg in segments:
        coords = list(seg['line'].coords)
        vertices.append(coords[0])
        vertices.append(coords[-1])

    new_segments = []
    for idx, seg in enumerate(segments):
        coords = list(seg['line'].coords)
        a = coords[0]
        b = coords[-1]
        split_pts = []

        for v in vertices:
            if v == a or v == b:
                continue
            dist, proj, t = point_to_segment_distance(v, a, b)
            if dist < delta and t > 0.01 and t < 0.99:
                split_pts.append((t, v))

        if not split_pts:
            new_segments.append(seg)
        else:
            split_pts.sort(key=lambda x: x[0])
            chain = [a] + [v for _, v in split_pts] + [b]
            for p1, p2 in zip(chain[:-1], chain[1:]):
                if ((p1[0]-p2[0])**2 + (p1[1]-p2[1])**2) ** 0.5 < 0.1:
                    continue
                new_line = snap_line_to_axis(LineString([p1, p2]))
                if new_line is None:
                    continue
                new_segments.append({
                    'line': new_line,
                    'thickness': seg['thickness'],
                    'name': seg['name']
                })
    return new_segments

def merge_collinear_segments(segments, gap_tol=0.3):
    if not segments:
        return segments

    horizontal = []
    vertical = []
    others = []

    for seg in segments:
        coords = list(seg['line'].coords)
        x1, y1 = coords[0]
        x2, y2 = coords[-1]
        if abs(y2 - y1) < 1e-6:
            xmin = min(x1, x2)
            xmax = max(x1, x2)
            horizontal.append((y1, xmin, xmax, seg))
        elif abs(x2 - x1) < 1e-6:
            ymin = min(y1, y2)
            ymax = max(y1, y2)
            vertical.append((x1, ymin, ymax, seg))
        else:
            others.append(seg)

    result = []

    by_y = {}
    for y, xmin, xmax, seg in horizontal:
        yk = round(y, 3)
        by_y.setdefault(yk, []).append((xmin, xmax, seg))

    for yk, arr in by_y.items():
        arr.sort(key=lambda x: x[0])
        cur_x1, cur_x2, cur_seg = arr[0]
        thick = cur_seg['thickness']
        name = cur_seg['name']
        for nx1, nx2, nseg in arr[1:]:
            if nx1 <= cur_x2 + gap_tol:
                cur_x2 = max(cur_x2, nx2)
                thick = (thick + nseg['thickness']) / 2.0
            else:
                result.append({
                    'line': LineString([(cur_x1, yk), (cur_x2, yk)]),
                    'thickness': thick,
                    'name': name
                })
                cur_x1, cur_x2, cur_seg = nx1, nx2, nseg
                thick = cur_seg['thickness']
                name = cur_seg['name']
        result.append({
            'line': LineString([(cur_x1, yk), (cur_x2, yk)]),
            'thickness': thick,
            'name': name
        })

    by_x = {}
    for x, ymin, ymax, seg in vertical:
        xk = round(x, 3)
        by_x.setdefault(xk, []).append((ymin, ymax, seg))

    for xk, arr in by_x.items():
        arr.sort(key=lambda x: x[0])
        cur_y1, cur_y2, cur_seg = arr[0]
        thick = cur_seg['thickness']
        name = cur_seg['name']
        for ny1, ny2, nseg in arr[1:]:
            if ny1 <= cur_y2 + gap_tol:
                cur_y2 = max(cur_y2, ny2)
                thick = (thick + nseg['thickness']) / 2.0
            else:
                result.append({
                    'line': LineString([(xk, cur_y1), (xk, cur_y2)]),
                    'thickness': thick,
                    'name': name
                })
                cur_y1, cur_y2, cur_seg = ny1, ny2, nseg
                thick = cur_seg['thickness']
                name = cur_seg['name']
        result.append({
            'line': LineString([(xk, cur_y1), (xk, cur_y2)]),
            'thickness': thick,
            'name': name
        })

    result.extend(others)
    return result

def merge_collinear_segments_strict(segments, coord_tol=0.08, gap_tol=0.25):
    if not segments:
        return segments

    horizontal = []
    vertical = []
    others = []

    for seg in segments:
        coords = list(seg['line'].coords)
        x1, y1 = coords[0]
        x2, y2 = coords[-1]

        if abs(y2 - y1) <= coord_tol:
            y = 0.5 * (y1 + y2)
            xmin, xmax = min(x1, x2), max(x1, x2)
            horizontal.append((y, xmin, xmax, seg))
        elif abs(x2 - x1) <= coord_tol:
            x = 0.5 * (x1 + x2)
            ymin, ymax = min(y1, y2), max(y1, y2)
            vertical.append((x, ymin, ymax, seg))
        else:
            others.append(seg)

    merged = []

    horizontal.sort(key=lambda t: (round(t[0], 2), t[1]))
    used = [False] * len(horizontal)
    for i in range(len(horizontal)):
        if used[i]:
            continue
        y, x1, x2, seg = horizontal[i]
        thick = seg['thickness']
        name = seg['name']

        for j in range(i + 1, len(horizontal)):
            if used[j]:
                continue
            y2, xx1, xx2, seg2 = horizontal[j]
            if abs(y2 - y) <= coord_tol and xx1 <= x2 + gap_tol:
                x2 = max(x2, xx2)
                thick = 0.5 * (thick + seg2['thickness'])
                used[j] = True

        merged.append({
            'line': LineString([(x1, y), (x2, y)]),
            'thickness': thick,
            'name': name
        })

    vertical.sort(key=lambda t: (round(t[0], 2), t[1]))
    used = [False] * len(vertical)
    for i in range(len(vertical)):
        if used[i]:
            continue
        x, y1, y2, seg = vertical[i]
        thick = seg['thickness']
        name = seg['name']

        for j in range(i + 1, len(vertical)):
            if used[j]:
                continue
            x2, yy1, yy2, seg2 = vertical[j]
            if abs(x2 - x) <= coord_tol and yy1 <= y2 + gap_tol:
                y2 = max(y2, yy2)
                thick = 0.5 * (thick + seg2['thickness'])
                used[j] = True

        merged.append({
            'line': LineString([(x, y1), (x, y2)]),
            'thickness': thick,
            'name': name
        })

    merged.extend(others)
    return merged

def optimize_wall_centerlines(candidates, iter_count=1, enable_merge_collinear=True):
    if not candidates:
        return []

    segs = candidates[:]

    if enable_merge_collinear:
        segs = merge_collinear_segments_strict(segs, coord_tol=0.08, gap_tol=0.35)

    for _ in range(iter_count):
        if not segs:
            break

        avg_t = sum(s['thickness'] for s in segs) / max(len(segs), 1)
        delta = 0.20 * avg_t
        if delta < 0.03:
            delta = 0.03
        if delta > 0.12:
            delta = 0.12

        segs = merge_close_vertices(segs, delta)
        segs = split_segments_by_near_vertices(segs, delta)

    cleaned = []
    for s in segs:
        try:
            if s['line'] is None or s['line'].is_empty:
                continue
            if s['line'].length < 0.08:
                continue
            cleaned.append(s)
        except:
            continue

    return cleaned

def get_wall_type_by_name(doc, type_name):
    wall_type_collector = FilteredElementCollector(doc).OfClass(WallType)
    found = None
    for wt in wall_type_collector:
        if wt.Kind == WallKind.Basic:
            name_param = wt.get_Parameter(BuiltInParameter.SYMBOL_NAME_PARAM)
            if name_param and name_param.AsString() == type_name:
                found = wt
                break
    if found:
        return found
    for wt in wall_type_collector:
        if wt.Kind == WallKind.Basic:
            return wt
    return None

# =========================
# 新增：结构mask合成（对 Door / Window / TDoor 单独膨胀）
# =========================
def build_global_structure_mask(result, pixelWidth, pixelHeight, logs):
    wall_mask = np.zeros((pixelHeight, pixelWidth), dtype=np.uint8)
    class_counter = {}

    if result.masks is None:
        logs.append("result.masks is None")
        return wall_mask, class_counter

    masks_xy = result.masks.xy
    cls_ids = result.boxes.cls.cpu().numpy().astype(int)
    names = result.names

    logs.append("总mask数量: {}".format(len(masks_xy)))

    expand_kernel = cv2.getStructuringElement(cv2.MORPH_RECT, (5, 5))

    for i, contour_pts in enumerate(masks_xy):
        try:
            if i >= len(cls_ids):
                continue

            class_id = cls_ids[i]
            class_name = names[class_id]
            class_name_norm = normalize_class_name(class_name)

            if not is_structure_wall_like_class(class_name):
                continue

            pts = np.array(contour_pts, dtype=np.int32)
            if len(pts) < 3:
                continue

            pts[:, 0] = np.clip(pts[:, 0], 0, pixelWidth - 1)
            pts[:, 1] = np.clip(pts[:, 1], 0, pixelHeight - 1)

            if class_name_norm in EXPAND_CLASSES:
                temp = np.zeros((pixelHeight, pixelWidth), dtype=np.uint8)
                cv2.fillPoly(temp, [pts], 255)
                temp = cv2.dilate(temp, expand_kernel, iterations=1)
                wall_mask[temp > 0] = 255
            else:
                cv2.fillPoly(wall_mask, [pts], 255)

            class_counter[class_name_norm] = class_counter.get(class_name_norm, 0) + 1

        except Exception as e:
            logs.append("合成结构mask失败 idx={}: {}".format(i, str(e)))
            continue

    logs.append("参与墙体生成的类别统计: {}".format(str(class_counter)))
    return wall_mask, class_counter

# =========================
# 新增：增强版 mask 清理
# =========================
def clean_wall_mask(binary_mask, logs):
    mask = binary_mask.copy()

    kernel_bridge = cv2.getStructuringElement(cv2.MORPH_RECT, (3, 3))
    kernel_close_big = cv2.getStructuringElement(cv2.MORPH_RECT, (7, 7))
    kernel_close_small = cv2.getStructuringElement(cv2.MORPH_RECT, (5, 5))

    # 先轻微膨胀促进连接
    mask = cv2.dilate(mask, kernel_bridge, iterations=1)

    # 两次闭运算，优先补缝
    mask = cv2.morphologyEx(mask, cv2.MORPH_CLOSE, kernel_close_big)
    mask = cv2.morphologyEx(mask, cv2.MORPH_CLOSE, kernel_close_small)

    # 轻微回缩
    mask = cv2.erode(mask, kernel_bridge, iterations=1)

    num_labels, labels, stats, _ = cv2.connectedComponentsWithStats(mask, connectivity=8)
    cleaned = np.zeros_like(mask)

    for i in range(1, num_labels):
        area = stats[i, cv2.CC_STAT_AREA]
        if area >= 30:
            cleaned[labels == i] = 255

    logs.append("结构mask清理完成(补缝增强版)")
    return cleaned

def estimate_wall_width_pixels(binary_mask, logs):
    if binary_mask is None or binary_mask.max() == 0:
        logs.append("墙宽估计失败：mask为空")
        return 6.0

    dist = cv2.distanceTransform(binary_mask, cv2.DIST_L2, 5)
    vals = dist[dist > 0]
    if len(vals) == 0:
        logs.append("墙宽估计失败：distanceTransform为空")
        return 6.0

    wall_width_px = max(2.0, 2.0 * np.median(vals))
    logs.append("估计墙宽像素值: {:.2f}".format(wall_width_px))
    return wall_width_px

def skeletonize_wall_mask(binary_mask, logs):
    try:
        from skimage.morphology import skeletonize
        skel = skeletonize(binary_mask > 0)
        logs.append("使用 skimage.skeletonize 成功")
        return skel.astype(np.uint8)
    except Exception as e:
        logs.append("skimage骨架失败，改用fallback: {}".format(str(e)))
        return skeletonize_fallback(binary_mask, logs)

def skeletonize_fallback(binary_mask, logs):
    img = (binary_mask > 0).astype(np.uint8) * 255
    size = np.size(img)
    skel = np.zeros(img.shape, np.uint8)

    element = cv2.getStructuringElement(cv2.MORPH_CROSS, (3, 3))
    done = False

    while not done:
        eroded = cv2.erode(img, element)
        temp = cv2.dilate(eroded, element)
        temp = cv2.subtract(img, temp)
        skel = cv2.bitwise_or(skel, temp)
        img = eroded.copy()

        zeros = size - cv2.countNonZero(img)
        if zeros == size:
            done = True

    logs.append("fallback skeletonize 成功")
    return (skel > 0).astype(np.uint8)

def get_neighbors_8(x, y, w, h):
    nbs = []
    for dy in [-1, 0, 1]:
        for dx in [-1, 0, 1]:
            if dx == 0 and dy == 0:
                continue
            nx = x + dx
            ny = y + dy
            if 0 <= nx < w and 0 <= ny < h:
                nbs.append((nx, ny))
    return nbs

def extract_skeleton_graph(skel, logs):
    h, w = skel.shape
    skel_pts = set()
    for y in range(h):
        xs = np.where(skel[y] > 0)[0]
        for x in xs:
            skel_pts.add((x, y))

    if not skel_pts:
        logs.append("骨架为空")
        return [], []

    degree = {}
    for (x, y) in skel_pts:
        cnt = 0
        for nx, ny in get_neighbors_8(x, y, w, h):
            if (nx, ny) in skel_pts:
                cnt += 1
        degree[(x, y)] = cnt

    nodes = [p for p, d in degree.items() if d != 2]

    if not nodes:
        nodes = list(skel_pts)

    node_set = set(nodes)
    visited_edges = set()
    edges = []

    for node in nodes:
        x0, y0 = node
        for nx, ny in get_neighbors_8(x0, y0, w, h):
            if (nx, ny) not in skel_pts:
                continue

            edge_key = tuple(sorted([node, (nx, ny)]))
            if edge_key in visited_edges:
                continue

            path = [node, (nx, ny)]
            prev = node
            curr = (nx, ny)

            while True:
                visited_edges.add(tuple(sorted([prev, curr])))

                if curr in node_set and curr != node:
                    break

                nbrs = []
                for tx, ty in get_neighbors_8(curr[0], curr[1], w, h):
                    if (tx, ty) in skel_pts and (tx, ty) != prev:
                        nbrs.append((tx, ty))

                if len(nbrs) == 0:
                    break
                if len(nbrs) > 1:
                    break

                nxt = nbrs[0]
                path.append(nxt)
                prev = curr
                curr = nxt

            if len(path) >= 2:
                edges.append(path)

    logs.append("骨架图提取完成: nodes={}, edges={}".format(len(nodes), len(edges)))
    return nodes, edges

def split_path_by_direction(path, turn_threshold=2):
    if not path or len(path) < 3:
        return [path] if path else []

    segments = []
    current = [path[0], path[1]]

    def major_dir(p1, p2):
        dx = p2[0] - p1[0]
        dy = p2[1] - p1[1]
        if abs(dx) >= abs(dy):
            return "h"
        else:
            return "v"

    prev_dir = major_dir(path[0], path[1])

    for i in range(2, len(path)):
        d = major_dir(path[i-1], path[i])

        if d == prev_dir:
            current.append(path[i])
        else:
            if len(current) <= turn_threshold and segments:
                segments[-1].extend(current[1:])
                current = [segments[-1][-1], path[i]]
            else:
                segments.append(current)
                current = [path[i-1], path[i]]
            prev_dir = d

    if current:
        if len(current) <= turn_threshold and segments:
            segments[-1].extend(current[1:])
        else:
            segments.append(current)

    cleaned = []
    for seg in segments:
        if seg and len(seg) >= 2:
            cleaned.append(seg)

    return cleaned

def fit_axis_line_from_mask(sub_path, wall_mask, pixelWidth, pixelHeight, min_len_px=8):
    if not sub_path or len(sub_path) < 2:
        return None

    xs = [p[0] for p in sub_path]
    ys = [p[1] for p in sub_path]

    x_min = max(0, int(min(xs)))
    x_max = min(pixelWidth - 1, int(max(xs)))
    y_min = max(0, int(min(ys)))
    y_max = min(pixelHeight - 1, int(max(ys)))

    dx = x_max - x_min
    dy = y_max - y_min

    if dx >= dy:
        mids = []
        for x in range(x_min, x_max + 1):
            ys_in = np.where(wall_mask[:, x] > 0)[0]
            ys_local = ys_in[(ys_in >= y_min - 8) & (ys_in <= y_max + 8)]
            if len(ys_local) >= 2:
                y_top = np.min(ys_local)
                y_bot = np.max(ys_local)
                y_mid = 0.5 * (y_top + y_bot)
                mids.append((x, y_mid))

        if len(mids) < 2:
            return None

        xs2 = [p[0] for p in mids]
        ys2 = [p[1] for p in mids]

        x1 = min(xs2)
        x2 = max(xs2)
        y = float(np.median(ys2))

        if (x2 - x1) < min_len_px:
            return None

        return ((x1, y), (x2, y), "h")

    else:
        mids = []
        for y in range(y_min, y_max + 1):
            xs_in = np.where(wall_mask[y, :] > 0)[0]
            xs_local = xs_in[(xs_in >= x_min - 8) & (xs_in <= x_max + 8)]
            if len(xs_local) >= 2:
                x_left = np.min(xs_local)
                x_right = np.max(xs_local)
                x_mid = 0.5 * (x_left + x_right)
                mids.append((x_mid, y))

        if len(mids) < 2:
            return None

        xs2 = [p[0] for p in mids]
        ys2 = [p[1] for p in mids]

        y1 = min(ys2)
        y2 = max(ys2)
        x = float(np.median(xs2))

        if (y2 - y1) < min_len_px:
            return None

        return ((x, y1), (x, y2), "v")

def pixel_line_to_revit_linestring(p1, p2):
    rp1 = pix_to_revit(p1[0], p1[1])
    rp2 = pix_to_revit(p2[0], p2[1])
    if rp1.DistanceTo(rp2) < 0.1:
        return None
    return LineString([(rp1.X, rp1.Y), (rp2.X, rp2.Y)])

def simplify_path_to_axis_lines(path, wall_mask, pixelWidth, pixelHeight, logs, min_len_px=8):
    result_lines = []

    sub_paths = split_path_by_direction(path, turn_threshold=2)
    for sub in sub_paths:
        try:
            fitted = fit_axis_line_from_mask(
                sub, wall_mask, pixelWidth, pixelHeight, min_len_px=min_len_px
            )
            if fitted is None:
                continue

            p1, p2, ori = fitted
            line_geom = pixel_line_to_revit_linestring(p1, p2)
            if line_geom is None:
                continue

            if line_geom.length < 0.08:
                continue

            result_lines.append(line_geom)

        except Exception as e:
            logs.append("子段拟合失败: {}".format(str(e)))
            continue

    return result_lines

def extract_wall_centerlines_from_global_mask(result, pixelWidth, pixelHeight, logs):
    wall_mask, class_counter = build_global_structure_mask(result, pixelWidth, pixelHeight, logs)
    if wall_mask.max() == 0:
        logs.append("没有结构类mask被写入全局墙图")
        return [], 0.3, class_counter, wall_mask

    cleaned_mask = clean_wall_mask(wall_mask, logs)
    wall_width_px = estimate_wall_width_pixels(cleaned_mask, logs)

    skel = skeletonize_wall_mask(cleaned_mask, logs)
    nodes, edges = extract_skeleton_graph(skel, logs)

    if not edges:
        logs.append("骨架没有边")
        wall_width_ft = wall_width_px * (scale_x_ft_per_px_global if scale_x_ft_per_px_global else scaleX)
        return [], wall_width_ft, class_counter, cleaned_mask

    wall_width_ft = wall_width_px * (scale_x_ft_per_px_global if scale_x_ft_per_px_global else scaleX)
    candidates = []

    for idx, path in enumerate(edges):
        try:
            # 这里降低短段过滤门槛
            line_list = simplify_path_to_axis_lines(
                path, cleaned_mask, pixelWidth, pixelHeight, logs,
                min_len_px=max(3, int(wall_width_px * 0.5))
            )

            for line_geom in line_list:
                candidates.append({
                    'line': line_geom,
                    'thickness': wall_width_ft,
                    'name': "Wall"
                })

        except Exception as e:
            logs.append("路径{}转中心线失败: {}".format(idx, str(e)))
            continue

    logs.append("全局提取中心线候选数量: {}".format(len(candidates)))
    return candidates, wall_width_ft, class_counter, cleaned_mask

# =========================
# 新增：端点补缝
# =========================
def get_line_orientation(seg):
    coords = list(seg['line'].coords)
    x1, y1 = coords[0]
    x2, y2 = coords[-1]
    if abs(y2 - y1) <= abs(x2 - x1):
        return "h"
    return "v"

def bridge_near_orthogonal_gaps(segments, gap_tol=0.6, axis_tol=0.25):
    """
    对接近相交但没接上的水平/竖直墙线做补缝
    """
    if not segments:
        return segments

    segs = []
    for s in segments:
        segs.append({
            'line': s['line'],
            'thickness': s['thickness'],
            'name': s['name']
        })

    for i in range(len(segs)):
        for j in range(i + 1, len(segs)):
            si = segs[i]
            sj = segs[j]
            if si is None or sj is None:
                continue

            oi = get_line_orientation(si)
            oj = get_line_orientation(sj)

            if oi == oj:
                continue

            # 统一成 si 水平, sj 竖直
            if oi == "v" and oj == "h":
                temp = si
                si = sj
                sj = temp

            coords_h = list(si['line'].coords)
            coords_v = list(sj['line'].coords)

            hx1, hy1 = coords_h[0]
            hx2, hy2 = coords_h[-1]
            vx1, vy1 = coords_v[0]
            vx2, vy2 = coords_v[-1]

            y_h = 0.5 * (hy1 + hy2)
            x_v = 0.5 * (vx1 + vx2)

            hminx, hmaxx = min(hx1, hx2), max(hx1, hx2)
            vminy, vmaxy = min(vy1, vy2), max(vy1, vy2)

            inter_pt = (x_v, y_h)

            h_endpts = [(hx1, hy1), (hx2, hy2)]
            v_endpts = [(vx1, vy1), (vx2, vy2)]

            h_dists = [((p[0]-inter_pt[0])**2 + (p[1]-inter_pt[1])**2)**0.5 for p in h_endpts]
            v_dists = [((p[0]-inter_pt[0])**2 + (p[1]-inter_pt[1])**2)**0.5 for p in v_endpts]

            h_min_idx = int(np.argmin(h_dists))
            v_min_idx = int(np.argmin(v_dists))

            h_min_dist = h_dists[h_min_idx]
            v_min_dist = v_dists[v_min_idx]

            cond_h = (x_v >= hminx - axis_tol and x_v <= hmaxx + gap_tol)
            cond_v = (y_h >= vminy - axis_tol and y_h <= vmaxy + gap_tol)

            if h_min_dist <= gap_tol and v_min_dist <= gap_tol and cond_h and cond_v:
                other_h = h_endpts[1 - h_min_idx]
                new_h = LineString([other_h, inter_pt])
                new_h = snap_line_to_axis(new_h)

                other_v = v_endpts[1 - v_min_idx]
                new_v = LineString([other_v, inter_pt])
                new_v = snap_line_to_axis(new_v)

                if new_h is not None and new_h.length >= 0.08:
                    si['line'] = new_h
                if new_v is not None and new_v.length >= 0.08:
                    sj['line'] = new_v

                # 写回原对象
                if get_line_orientation(segs[i]) == "h":
                    segs[i] = si
                    segs[j] = sj
                else:
                    segs[i] = sj
                    segs[j] = si

    cleaned = []
    for s in segs:
        if s is None:
            continue
        try:
            if s['line'] is None or s['line'].is_empty:
                continue
            if s['line'].length < 0.08:
                continue
            cleaned.append(s)
        except:
            continue

    return cleaned

# =========================
# 运行YOLO分割
# =========================
yolo_seg = YOLO(dect_Model, task="seg")
seg_result = yolo_seg(source=pixpath, save=False, conf=0.3, iou=0.45, imgsz=640)
cv2.imwrite(newpath, seg_result[0].plot())

result = seg_result[0]
boxes = result.boxes
xyxy = boxes.xyxy.cpu().numpy() if boxes is not None else np.empty((0,4))
cls_ids = boxes.cls.cpu().numpy().astype(int) if boxes is not None else np.array([], dtype=int)
names = result.names

# =========================
# 读取OCR尺寸JSON
# =========================
dims_data = None
horizontal_length_mm = None
vertical_length_mm = None

try:
    with open(dims_json_path, "r", encoding="utf-8") as f:
        dims_data = json.load(f)

    if dims_data.get("ok", False):
        if "result" in dims_data:
            horizontal_length_mm = dims_data["result"].get("horizontal_length", None)
            vertical_length_mm = dims_data["result"].get("vertical_length", None)
        else:
            horizontal_length_mm = dims_data.get("horizontal_length", None)
            vertical_length_mm = dims_data.get("vertical_length", None)

    logs.append("读取dims_json成功: horizontal={} mm, vertical={} mm".format(
        str(horizontal_length_mm), str(vertical_length_mm)
    ))
except Exception as e:
    logs.append("读取dims_json失败: {}".format(str(e)))

# =========================
# 先做结构mask -> bbox -> scale
# =========================
global_structure_mask, structure_class_counter = build_global_structure_mask(result, pixelWidth, pixelHeight, logs)
cleaned_global_structure_mask = clean_wall_mask(global_structure_mask, logs)
bbox_info = get_mask_bbox(cleaned_global_structure_mask, logs)

scale_x_mm_per_px = None
scale_y_mm_per_px = None
scale_avg_mm_per_px = None
scale_x_ft_per_px = None
scale_y_ft_per_px = None
scale_avg_ft_per_px = None

if bbox_info is not None and horizontal_length_mm is not None and vertical_length_mm is not None:
    try:
        bbox_w = bbox_info["width"]
        bbox_h = bbox_info["height"]

        if bbox_w > 0 and bbox_h > 0:
            scale_x_mm_per_px = float(horizontal_length_mm) / float(bbox_w)
            scale_y_mm_per_px = float(vertical_length_mm) / float(bbox_h)
            scale_avg_mm_per_px = (scale_x_mm_per_px + scale_y_mm_per_px) / 2.0

            mm_to_ft = 1.0 / 304.8
            scale_x_ft_per_px = scale_x_mm_per_px * mm_to_ft
            scale_y_ft_per_px = scale_y_mm_per_px * mm_to_ft
            scale_avg_ft_per_px = scale_avg_mm_per_px * mm_to_ft

            bbox_info_global = bbox_info
            scale_x_ft_per_px_global = scale_x_ft_per_px
            scale_y_ft_per_px_global = scale_y_ft_per_px

            logs.append("scale_x_mm_per_px={:.6f}".format(scale_x_mm_per_px))
            logs.append("scale_y_mm_per_px={:.6f}".format(scale_y_mm_per_px))
            logs.append("scale_avg_mm_per_px={:.6f}".format(scale_avg_mm_per_px))
            logs.append("scale_x_ft_per_px={:.6f}".format(scale_x_ft_per_px))
            logs.append("scale_y_ft_per_px={:.6f}".format(scale_y_ft_per_px))
        else:
            logs.append("bbox宽高无效，无法计算scale")
    except Exception as e:
        logs.append("scale计算失败: {}".format(str(e)))
else:
    logs.append("bbox或真实尺寸缺失，使用fallback整图scale")

# =========================
# Revit文档对象
# =========================
doc = DocumentManager.Instance.CurrentDBDocument
app = doc.Application

wall_type = None
wall_type_collector = FilteredElementCollector(doc).OfClass(WallType)

for wt in wall_type_collector:
    if wt.Kind == WallKind.Basic:
        name_param = wt.get_Parameter(BuiltInParameter.SYMBOL_NAME_PARAM)
        if name_param and name_param.AsString() == TARGET_WALL_TYPE_NAME:
            wall_type = wt
            break

if wall_type is None:
    for wt in wall_type_collector:
        if wt.Kind == WallKind.Basic:
            wall_type = wt
            break

if wall_type is None:
    raise Exception("项目中找不到任何基本墙类型！")

level = None
level_collector = FilteredElementCollector(doc).OfClass(Level)
for lvl in level_collector:
    name_param = lvl.get_Parameter(BuiltInParameter.LEVEL_NAME)
    if name_param and name_param.AsString() == TARGET_LEVEL_NAME:
        level = lvl
        break

if level is None:
    level = level_collector.FirstElement()
    if level is None:
        raise Exception("项目中找不到任何标高！")

TransactionManager.Instance.EnsureInTransaction(doc)

created_lines = []
dyn_lines = []
dyn_faces = [] 
created_shapes = []
created_walls = []
wall_candidates = []

thickness = height
wallHeight = height

plane = Plane.CreateByNormalAndOrigin(XYZ.BasisZ, origin)
sketch_plane = SketchPlane.Create(doc, plane)

DEFAULT_WALL_WIDTH = 0.3

# =========================
# 提取中心线并创建墙
# =========================
if result.masks is not None:
    logs.append("YOLO类别映射: {}".format(str(result.names)))

    wall_candidates, default_wall_thickness, used_class_counter, final_mask_used = extract_wall_centerlines_from_global_mask(
        result, pixelWidth, pixelHeight, logs
    )

    logs.append("初始墙候选数量: {}".format(len(wall_candidates)))

    optimized_walls = optimize_wall_centerlines(
        wall_candidates,
        iter_count=1,
        enable_merge_collinear=False
    )

    logs.append("优化后墙数量: {}".format(len(optimized_walls)))

    # 新增：端点补缝
    optimized_walls = bridge_near_orthogonal_gaps(
        optimized_walls,
        gap_tol=0.6,
        axis_tol=0.25
    )

    logs.append("补缝后墙数量: {}".format(len(optimized_walls)))

    for idx, w in enumerate(optimized_walls):
        try:
            line_geom = w['line']
            thickness_val = w['thickness']
            name = "Wall"

            coords = list(line_geom.coords)
            if len(coords) < 2:
                logs.append("墙{}失败：coords不足".format(idx))
                continue

            start_pt = XYZ(coords[0][0], coords[0][1], 0)
            end_pt = XYZ(coords[-1][0], coords[-1][1], 0)

            if start_pt.DistanceTo(end_pt) < 0.1:
                logs.append("墙{}失败：线太短".format(idx))
                continue

            revit_line = Line.CreateBound(start_pt, end_pt)

            logs.append("准备创建墙{}: len={:.3f}, thickness={:.3f}".format(
                idx, revit_line.Length, thickness_val
            ))

            wall = Wall.Create(doc, revit_line, wall_type.Id, level.Id, wallHeight, 0, False, False)

            try:
                param = wall.get_Parameter(BuiltInParameter.WALL_ATTR_WIDTH_PARAM)
                if param and not param.IsReadOnly:
                    param.Set(thickness_val)
            except Exception as e2:
                logs.append("墙{}宽度设置失败(可忽略): {}".format(idx, str(e2)))

            try:
                wall.Name = sanitize_name(name)
            except:
                pass

            created_walls.append(wall.ToDSType(True))
            logs.append("墙{}创建成功".format(idx))

        except Exception as e:
            logs.append("墙{}创建失败: {}".format(idx, str(e)))
            logs.append(traceback.format_exc())
            continue
else:
    logs.append("result.masks is None，没有分割mask")

# =========================
# 提交事务
# =========================
TransactionManager.Instance.TransactionTaskDone()
doc.Regenerate()

# =========================
# 写 seg_meta_json
# =========================
seg_meta = {
    "ok": True,
    "image_path": pixpath,
    "seg_vis_path": newpath,
    "dims_json_path": dims_json_path,
    "wall_bbox_px": bbox_info,
    "real_size_mm": {
        "horizontal_length": horizontal_length_mm,
        "vertical_length": vertical_length_mm
    },
    "scale": {
        "scale_x_mm_per_px": scale_x_mm_per_px,
        "scale_y_mm_per_px": scale_y_mm_per_px,
        "scale_avg_mm_per_px": scale_avg_mm_per_px,
        "scale_x_ft_per_px": scale_x_ft_per_px,
        "scale_y_ft_per_px": scale_y_ft_per_px,
        "scale_avg_ft_per_px": scale_avg_ft_per_px
    },
    "structure_mask_classes_used": structure_class_counter,
    "debug": {
        "pixelWidth": pixelWidth,
        "pixelHeight": pixelHeight,
        "wall_count": len(created_walls),
        "mask_count": len(result.masks.xy) if result.masks is not None else 0,
        "class_names": result.names,
        "log_count": len(logs)
    }
}

try:
    ensure_dir_of_file(seg_meta_json_path)
    with open(seg_meta_json_path, "w", encoding="utf-8") as f:
        json.dump(seg_meta, f, ensure_ascii=False, indent=2)
    logs.append("seg_meta_json已写出: {}".format(seg_meta_json_path))
except Exception as e:
    logs.append("seg_meta_json写出失败: {}".format(str(e)))

OUT = newpath, created_walls, seg_meta_json_path, logs
# ----------------------------------------
python_version_21 = Watch(python_script_21)  # graph output
python_script_22 = Python(IN[0]=modelpath_3, IN[1]=imagepath_2, IN[2]=scale, IN[5]=python_version_7, IN[6]=furnture_Info_Json_Path)  # CPython3; frozen; unwired: IN[3], IN[4]
# ---------- python_script_22.python (1335 lines) ----------
# -*- coding: utf-8 -*-
#--------------
import sys
import clr
import math
import json
import numpy as np
import cv2

clr.AddReference('ProtoGeometry')
from Autodesk.DesignScript.Geometry import *

clr.AddReference('RevitAPI')
clr.AddReference('RevitAPIUI')
from Autodesk.Revit.DB import *
from Autodesk.Revit.DB.Structure import StructuralType

clr.AddReference('RevitServices')
from RevitServices.Persistence import DocumentManager
from RevitServices.Transactions import TransactionManager

clr.AddReference('RevitNodes')
import Revit
clr.ImportExtensions(Revit.Elements)
clr.ImportExtensions(Revit.GeometryConversion)

sys.path.append("C:/Users/Lenovo/anaconda3/envs/revitenv/Lib/site-packages")
from ultralytics import YOLO


# ============================================================
# 输入
# ============================================================
pose_Model = IN[0]
pixpath = IN[1]
scale = IN[2]
target_family_name = IN[3] if len(IN) > 3 else "Bed"
target_type_name = IN[4] if len(IN) > 4 else "Only_Bed"
seg_meta_json_path = IN[5] if len(IN) > 5 else None
class_config_json_path = IN[6] if len(IN) > 6 else None


# ============================================================
# 全局参数
# ============================================================
origin = XYZ(0, 0, 0)
widthFt = scale
pixelWidth = 1600
pixelHeight = 1200

bbox_min_x = None
bbox_min_y = None
bbox_width = None
bbox_height = None
scale_x_ft_per_px = None
scale_y_ft_per_px = None

logs = []


# ============================================================
# 默认配置
# ============================================================
DEFAULT_CLASS_CONFIG = {
    "Bed": {
        "family_name": "Bed",
        "type_name": "Bed",
        "rotate": True,
        "kp_start_idx": 0,
        "kp_end_idx": 1,
        "area_filter": True,
        "family_default_axis": "Y",
        "placement_mode": "free"
    },
    "BedSingle": {
        "family_name": "BedSingle",
        "type_name": "BedSingle",
        "rotate": True,
        "kp_start_idx": 0,
        "kp_end_idx": 1,
        "area_filter": False,
        "family_default_axis": "Y",
        "placement_mode": "free"
    },
    "CookingCounter": {
        "family_name": "CookingCounter",
        "type_name": "CookingCounter",
        "rotate": True,
        "kp_start_idx": 0,
        "kp_end_idx": 1,
        "area_filter": False,
        "family_default_axis": "Y",
        "placement_mode": "free"
    },
    "Cabinet": {
        "family_name": "Cabinet",
        "type_name": "Cabinet",
        "rotate": True,
        "kp_start_idx": 0,
        "kp_end_idx": 1,
        "area_filter": False,
        "family_default_axis": "Y",
        "placement_mode": "free"
    },
    "DiningTable": {
        "family_name": "DiningTable",
        "type_name": "DiningTable",
        "rotate": True,
        "kp_start_idx": 0,
        "kp_end_idx": 1,
        "area_filter": False,
        "family_default_axis": "Y",
        "placement_mode": "free"
    },
    "DiningTables": {
        "family_name": "DiningTables",
        "type_name": "DiningTables",
        "rotate": False,
        "area_filter": False,
        "placement_mode": "free"
    },
    "Sofa": {
        "family_name": "Sofa",
        "type_name": "Sofa",
        "rotate": True,
        "kp_start_idx": 0,
        "kp_end_idx": 1,
        "area_filter": False,
        "family_default_axis": "Y",
        "placement_mode": "free"
    },
    "TVStand": {
        "family_name": "TVStand",
        "type_name": "TVStand",
        "rotate": True,
        "kp_start_idx": 0,
        "kp_end_idx": 1,
        "area_filter": False,
        "family_default_axis": "Y",
        "placement_mode": "free"
    },
    "Toilet": {
        "family_name": "Toilet",
        "type_name": "Toilet",
        "rotate": True,
        "kp_start_idx": 0,
        "kp_end_idx": 1,
        "area_filter": False,
        "family_default_axis": "Y",
        "placement_mode": "free"
    },
    "LeftDoor": {
        "family_name": "LeftDoor",
        "type_name": "LeftDoor",
        "rotate": False,
        "kp_start_idx": 0,
        "kp_end_idx": 1,
        "area_filter": False,
        "placement_mode": "door_hosted",
        "door_insert_offset_along_ft": 0.0,
        "door_insert_offset_normal_ft": 0.0,
        "door_max_host_wall_dist_ft": 3.0,
        "door_geometry_match": True
    },
    "RightDoor": {
        "family_name": "RightDoor",
        "type_name": "RightDoor",
        "rotate": False,
        "kp_start_idx": 0,
        "kp_end_idx": 1,
        "area_filter": False,
        "placement_mode": "door_hosted",
        "door_insert_offset_along_ft": 0.0,
        "door_insert_offset_normal_ft": 0.0,
        "door_max_host_wall_dist_ft": 3.0,
        "door_geometry_match": True
    }
}


# ============================================================
# 基础工具
# ============================================================
def norm_str(s):
    if s is None:
        return ""
    return str(s).strip().lower()


def load_json_file(json_path, logs, label):
    if not json_path:
        logs.append("{}为空".format(label))
        return None
    try:
        with open(json_path, "r", encoding="utf-8") as f:
            data = json.load(f)
        logs.append("读取{}成功: {}".format(label, json_path))
        return data
    except Exception as e:
        logs.append("读取{}失败: {}".format(label, str(e)))
        return None


def load_class_config(class_config_json_path, logs):
    data = load_json_file(class_config_json_path, logs, "class_config_json_path")
    if isinstance(data, dict) and len(data) > 0:
        logs.append("使用外部CLASS_CONFIG，共{}类".format(len(data)))
        return data
    logs.append("使用内置DEFAULT_CLASS_CONFIG，共{}类".format(len(DEFAULT_CLASS_CONFIG)))
    return DEFAULT_CLASS_CONFIG


def load_seg_meta(seg_meta_json_path, logs):
    return load_json_file(seg_meta_json_path, logs, "seg_meta_json_path")


def pix_to_revit(x, y):
    global bbox_min_x, bbox_min_y, bbox_height
    global scale_x_ft_per_px, scale_y_ft_per_px
    global origin, widthFt, pixelWidth, pixelHeight

    try:
        if bbox_min_x is not None and bbox_min_y is not None and bbox_height is not None and \
           scale_x_ft_per_px is not None and scale_y_ft_per_px is not None:
            local_x = x - bbox_min_x
            local_y = y - bbox_min_y
            revit_x = origin.X + local_x * scale_x_ft_per_px
            revit_y = origin.Y + (bbox_height - local_y) * scale_y_ft_per_px
            return XYZ(revit_x, revit_y, origin.Z)
    except:
        pass

    scaleX = widthFt / pixelWidth if pixelWidth > 0 else 0.0
    scaleY = widthFt * (float(pixelHeight) / float(pixelWidth)) / pixelHeight if pixelWidth > 0 and pixelHeight > 0 else 0.0
    revit_x = origin.X + x * scaleX
    revit_y = origin.Y + (pixelHeight - y) * scaleY
    return XYZ(revit_x, revit_y, origin.Z)


def get_level(doc):
    av = doc.ActiveView
    try:
        if hasattr(av, "GenLevel") and av.GenLevel:
            return av.GenLevel
    except:
        pass

    levels = FilteredElementCollector(doc).OfClass(Level).ToElements()
    if levels and len(levels) > 0:
        return levels[0]

    return None


def build_symbol_lookup(doc):
    lookup = {}
    collector = FilteredElementCollector(doc).OfClass(FamilySymbol)

    for fs in collector:
        try:
            fam_name = fs.Family.Name if fs.Family else ""
            p = fs.get_Parameter(BuiltInParameter.SYMBOL_NAME_PARAM)
            typ_name = p.AsString() if p else fs.Name
            lookup[(norm_str(fam_name), norm_str(typ_name))] = fs
        except:
            pass

    return lookup


def get_symbol_from_lookup(symbol_lookup, family_name, type_name):
    key = (norm_str(family_name), norm_str(type_name))
    return symbol_lookup.get(key, None)


def ensure_symbol_active(doc, symbol):
    if symbol and not symbol.IsActive:
        symbol.Activate()
        doc.Regenerate()


def xyz_sub(a, b):
    return XYZ(a.X - b.X, a.Y - b.Y, a.Z - b.Z)


def xyz_add(a, b):
    return XYZ(a.X + b.X, a.Y + b.Y, a.Z + b.Z)


def xyz_mul(v, s):
    return XYZ(v.X * s, v.Y * s, v.Z * s)


def xyz_len2d(v):
    return math.sqrt(v.X * v.X + v.Y * v.Y)


def xyz_norm2d(v):
    l = xyz_len2d(v)
    if l < 1e-9:
        return None
    return XYZ(v.X / l, v.Y / l, 0)


def dot2d(a, b):
    return a.X * b.X + a.Y * b.Y


def dist2d(a, b):
    dx = a.X - b.X
    dy = a.Y - b.Y
    return math.sqrt(dx * dx + dy * dy)


def clamp(v, a, b):
    return max(a, min(b, v))


def angle_of_vector_2d(v):
    return math.atan2(v.Y, v.X)


def normalize_angle(angle):
    while angle > math.pi:
        angle -= 2.0 * math.pi
    while angle < -math.pi:
        angle += 2.0 * math.pi
    return angle


def rotate_instance(doc, instance, center_pt, angle):
    axis_end = XYZ(center_pt.X, center_pt.Y, center_pt.Z + 1.0)
    axis = Line.CreateBound(center_pt, axis_end)
    ElementTransformUtils.RotateElement(doc, instance.Id, axis, angle)


def create_family_instance(doc, center_pt, symbol, level):
    try:
        return doc.Create.NewFamilyInstance(
            center_pt,
            symbol,
            level,
            StructuralType.NonStructural
        )
    except:
        return doc.Create.NewFamilyInstance(
            center_pt,
            symbol,
            doc.ActiveView
        )


def get_angle_from_keypoints(start_pt, end_pt, family_default_axis="Y"):
    vec = XYZ(start_pt.X - end_pt.X, start_pt.Y - end_pt.Y, 0)
    if vec.GetLength() < 1e-6:
        return None

    angle = math.atan2(vec.Y, vec.X)

    if family_default_axis == "Y":
        angle -= math.pi / 2.0

    return angle


def compute_class_area_threshold(boxes, cls_ids, names, class_name, scale_ratio=0.33):
    areas = []

    for i, bbox in enumerate(boxes):
        cls_name = names[int(cls_ids[i])] if len(cls_ids) > i else ""
        if cls_name != class_name:
            continue

        x1, y1, x2, y2 = bbox
        areas.append(max(0, x2 - x1) * max(0, y2 - y1))

    if len(areas) == 0:
        return 0.0, 0.0

    median_area = float(np.median(areas))
    return median_area, median_area * scale_ratio


# ============================================================
# 墙相关
# ============================================================
def get_wall_curve(wall):
    try:
        loc = wall.Location
        if loc and hasattr(loc, "Curve"):
            return loc.Curve
    except:
        pass
    return None


def point_to_curve_distance_2d(pt, curve):
    try:
        proj = curve.Project(pt)
        if proj:
            q = proj.XYZPoint
            dx = pt.X - q.X
            dy = pt.Y - q.Y
            return math.sqrt(dx * dx + dy * dy), q
    except:
        pass

    return None, None


def get_nearest_wall(doc, pt, max_dist_ft=3.0):
    nearest_wall = None
    nearest_curve = None
    nearest_proj_pt = None
    best_dist = 1e18

    walls = FilteredElementCollector(doc).OfClass(Wall).ToElements()

    for wall in walls:
        try:
            curve = get_wall_curve(wall)
            if curve is None:
                continue

            dist, proj_pt = point_to_curve_distance_2d(pt, curve)
            if dist is None:
                continue

            if dist < best_dist and dist <= max_dist_ft:
                best_dist = dist
                nearest_wall = wall
                nearest_curve = curve
                nearest_proj_pt = proj_pt
        except:
            continue

    return nearest_wall, nearest_curve, nearest_proj_pt, best_dist


def get_wall_direction_unit(curve):
    p0 = curve.GetEndPoint(0)
    p1 = curve.GetEndPoint(1)
    return xyz_norm2d(xyz_sub(p1, p0))


def get_wall_normal_unit_2d(wall_dir):
    if wall_dir is None:
        return None
    return XYZ(-wall_dir.Y, wall_dir.X, 0)


# ============================================================
# 门族宽度
# ============================================================
def get_symbol_width_ft(symbol):
    cand_names = ["AI_Width", "Width", "宽度"]

    for n in cand_names:
        try:
            p = symbol.LookupParameter(n)
            if p and p.StorageType == StorageType.Double:
                val = p.AsDouble()
                if val and val > 1e-6:
                    return val
        except:
            pass

    builtin_candidates = [
        BuiltInParameter.DOOR_WIDTH,
        BuiltInParameter.FAMILY_WIDTH_PARAM
    ]

    for bip in builtin_candidates:
        try:
            p = symbol.get_Parameter(bip)
            if p:
                val = p.AsDouble()
                if val and val > 1e-6:
                    return val
        except:
            pass

    return None


def place_hosted_door_instance(doc, level, symbol, wall, insert_pt):
    try:
        return doc.Create.NewFamilyInstance(
            insert_pt,
            symbol,
            wall,
            level,
            StructuralType.NonStructural
        )
    except:
        return doc.Create.NewFamilyInstance(
            insert_pt,
            symbol,
            wall,
            StructuralType.NonStructural
        )


# ============================================================
# flip 工具
# ============================================================
def can_flip_hand(inst):
    try:
        return inst.CanFlipHand
    except:
        return False


def can_flip_facing(inst):
    try:
        return inst.CanFlipFacing
    except:
        return False


def get_flip_state(inst):
    hand = False
    facing = False

    try:
        hand = inst.HandFlipped
    except:
        pass

    try:
        facing = inst.FacingFlipped
    except:
        pass

    return hand, facing


def set_flip_state(inst, target_hand, target_facing):
    changed = []

    try:
        cur_hand = inst.HandFlipped
    except:
        cur_hand = False

    try:
        cur_facing = inst.FacingFlipped
    except:
        cur_facing = False

    if cur_hand != target_hand:
        if can_flip_hand(inst):
            inst.flipHand()
            changed.append("flipHand")
        else:
            return False, changed

    try:
        cur_facing = inst.FacingFlipped
    except:
        cur_facing = False

    if cur_facing != target_facing:
        if can_flip_facing(inst):
            inst.flipFacing()
            changed.append("flipFacing")
        else:
            return False, changed

    return True, changed


def get_candidate_flip_states(inst):
    cur_hand, cur_facing = get_flip_state(inst)

    raw = [
        (cur_hand, cur_facing),
        (not cur_hand, cur_facing),
        (cur_hand, not cur_facing),
        (not cur_hand, not cur_facing)
    ]

    states = []
    seen = set()

    for h, f in raw:
        if (h, f) in seen:
            continue

        if h != cur_hand and not can_flip_hand(inst):
            continue

        if f != cur_facing and not can_flip_facing(inst):
            continue

        states.append((h, f))
        seen.add((h, f))

    return states


# ============================================================
# 实例真实平面几何读取
# ============================================================
def segment_midpoint_2d(p0, p1):
    return XYZ((p0.X + p1.X) * 0.5, (p0.Y + p1.Y) * 0.5, 0)


def segment_dir_2d(p0, p1):
    return xyz_norm2d(XYZ(p1.X - p0.X, p1.Y - p0.Y, 0))


def safe_transform_point(trf, p):
    try:
        return trf.OfPoint(p)
    except:
        return p


def extract_instance_plan_segments_recursive(geom_elem, trf, out_segments):
    if geom_elem is None:
        return

    for g in geom_elem:
        try:
            if isinstance(g, GeometryInstance):
                try:
                    sym_trf = trf.Multiply(g.Transform)
                    sym_geom = g.GetSymbolGeometry()
                    extract_instance_plan_segments_recursive(sym_geom, sym_trf, out_segments)
                except:
                    pass

                try:
                    inst_geom = g.GetInstanceGeometry()
                    extract_instance_plan_segments_recursive(inst_geom, trf, out_segments)
                except:
                    pass

            elif isinstance(g, Line):
                p0 = safe_transform_point(trf, g.GetEndPoint(0))
                p1 = safe_transform_point(trf, g.GetEndPoint(1))
                out_segments.append((XYZ(p0.X, p0.Y, 0), XYZ(p1.X, p1.Y, 0), "Line"))

            elif isinstance(g, Arc):
                p0 = safe_transform_point(trf, g.GetEndPoint(0))
                p1 = safe_transform_point(trf, g.GetEndPoint(1))
                out_segments.append((XYZ(p0.X, p0.Y, 0), XYZ(p1.X, p1.Y, 0), "ArcChord"))

            elif isinstance(g, Curve):
                try:
                    p0 = safe_transform_point(trf, g.GetEndPoint(0))
                    p1 = safe_transform_point(trf, g.GetEndPoint(1))
                    out_segments.append((XYZ(p0.X, p0.Y, 0), XYZ(p1.X, p1.Y, 0), "CurveChord"))
                except:
                    pass

            elif isinstance(g, Solid):
                try:
                    for edge in g.Edges:
                        c = edge.AsCurve()
                        p0 = safe_transform_point(trf, c.GetEndPoint(0))
                        p1 = safe_transform_point(trf, c.GetEndPoint(1))
                        out_segments.append((XYZ(p0.X, p0.Y, 0), XYZ(p1.X, p1.Y, 0), "SolidEdge"))
                except:
                    pass

        except:
            continue


def get_instance_plan_segments(doc, inst):
    opts = Options()
    opts.ComputeReferences = False
    opts.IncludeNonVisibleObjects = True

    try:
        opts.DetailLevel = ViewDetailLevel.Fine
    except:
        pass

    try:
        opts.View = doc.ActiveView
    except:
        pass

    segments = []

    try:
        geom = inst.get_Geometry(opts)
        extract_instance_plan_segments_recursive(geom, Transform.Identity, segments)
    except:
        pass

    return segments


def filter_door_leaf_candidate_segments(segments, insert_pt, wall_dir, leaf_dir, door_width_ft):
    candidates = []

    min_len = max(0.4, door_width_ft * 0.20)
    max_len = max(door_width_ft * 1.80, 6.0)
    max_mid_dist = max(door_width_ft * 2.00, 6.0)

    for p0, p1, typ in segments:
        length = dist2d(p0, p1)

        if length < min_len or length > max_len:
            continue

        d = segment_dir_2d(p0, p1)
        if d is None:
            continue

        mid = segment_midpoint_2d(p0, p1)
        mid_dist = dist2d(mid, insert_pt)

        if mid_dist > max_mid_dist:
            continue

        parallel_to_wall = abs(dot2d(d, wall_dir))
        parallel_to_leaf = abs(dot2d(d, leaf_dir))

        # 门板线更应接近 DoorS->DoorE，而不是墙轴。
        # 允许 0.15 容差，避免族线条有误差。
        if parallel_to_leaf + 0.15 < parallel_to_wall:
            continue

        candidates.append({
            "p0": p0,
            "p1": p1,
            "type": typ,
            "length": length,
            "mid_dist": mid_dist,
            "parallel_to_wall": parallel_to_wall,
            "parallel_to_leaf": parallel_to_leaf
        })

    return candidates


def score_leaf_segment_against_keypoints(seg_info, hinge_pt, leaf_end_pt, leaf_dir, door_width_ft):
    p0 = seg_info["p0"]
    p1 = seg_info["p1"]

    d0 = dist2d(p0, hinge_pt)
    d1 = dist2d(p1, hinge_pt)

    if d0 <= d1:
        hinge_candidate = p0
        end_candidate = p1
        dir_vec = segment_dir_2d(p0, p1)
        hinge_dist = d0
    else:
        hinge_candidate = p1
        end_candidate = p0
        dir_vec = segment_dir_2d(p1, p0)
        hinge_dist = d1

    if dir_vec is None:
        return -1e9, None

    dir_score = dot2d(dir_vec, leaf_dir)
    end_dist = dist2d(end_candidate, leaf_end_pt)

    norm = max(door_width_ft, 1.0)
    hinge_score = 1.0 - clamp(hinge_dist / norm, 0.0, 2.0)
    end_score = 1.0 - clamp(end_dist / norm, 0.0, 2.0)

    total = dir_score * 10.0 + hinge_score * 3.0 + end_score * 1.5 + seg_info["parallel_to_leaf"] * 1.0

    dbg = {
        "segment_type": seg_info["type"],
        "segment_p0_xyz": [p0.X, p0.Y, p0.Z],
        "segment_p1_xyz": [p1.X, p1.Y, p1.Z],
        "segment_length": seg_info["length"],
        "segment_mid_dist": seg_info["mid_dist"],
        "parallel_to_wall": seg_info["parallel_to_wall"],
        "parallel_to_leaf": seg_info["parallel_to_leaf"],
        "hinge_candidate_xyz": [hinge_candidate.X, hinge_candidate.Y, hinge_candidate.Z],
        "end_candidate_xyz": [end_candidate.X, end_candidate.Y, end_candidate.Z],
        "hinge_dist": hinge_dist,
        "end_dist": end_dist,
        "dir_vec_xyz": [dir_vec.X, dir_vec.Y, dir_vec.Z],
        "target_leaf_dir_xyz": [leaf_dir.X, leaf_dir.Y, leaf_dir.Z],
        "dir_score_dot": dir_score,
        "hinge_score": hinge_score,
        "end_score": end_score,
        "total_score": total
    }

    return total, dbg


def evaluate_door_actual_geometry_state(doc, inst, insert_pt, wall_dir, hinge_pt, leaf_end_pt, leaf_dir, door_width_ft):
    segments = get_instance_plan_segments(doc, inst)

    candidates = filter_door_leaf_candidate_segments(
        segments,
        insert_pt,
        wall_dir,
        leaf_dir,
        door_width_ft
    )

    best_score = -1e9
    best_dbg = None

    for c in candidates:
        score, dbg = score_leaf_segment_against_keypoints(
            c,
            hinge_pt,
            leaf_end_pt,
            leaf_dir,
            door_width_ft
        )

        if score > best_score:
            best_score = score
            best_dbg = dbg

    if best_dbg is None:
        best_dbg = {
            "reason": "no_leaf_segment_candidate",
            "raw_segment_count": len(segments),
            "candidate_count": len(candidates),
            "total_score": -1e9
        }
    else:
        best_dbg["raw_segment_count"] = len(segments)
        best_dbg["candidate_count"] = len(candidates)

    return best_score, best_dbg


# ============================================================
# 门处理：真实几何匹配版
# ============================================================
def process_door_instance(
    doc,
    level,
    symbol,
    cls_name,
    bbox,
    kp_start_pt,
    kp_end_pt,
    cfg,
    logs,
    debug_tag="door"
):
    x1, y1, x2, y2 = bbox
    cx = (x1 + x2) * 0.5
    cy = (y1 + y2) * 0.5

    bbox_center_pt = pix_to_revit(cx, cy)

    max_wall_dist = float(cfg.get("door_max_host_wall_dist_ft", 3.0))

    host_wall, wall_curve, bbox_proj_pt, wall_dist = get_nearest_wall(
        doc,
        bbox_center_pt,
        max_dist_ft=max_wall_dist
    )

    if host_wall is None or wall_curve is None or bbox_proj_pt is None:
        raise Exception("未找到门宿主墙")

    if kp_start_pt is None or kp_end_pt is None:
        raise Exception("门缺少关键点，无法放置")

    wall_dir = get_wall_direction_unit(wall_curve)
    if wall_dir is None:
        raise Exception("墙方向无效")

    wall_nrm = get_wall_normal_unit_2d(wall_dir)
    if wall_nrm is None:
        raise Exception("墙法向无效")

    # 默认：关键点0是铰链端 DoorS，关键点1是门板自由端 DoorE
    hinge_pt = kp_start_pt
    leaf_end_pt = kp_end_pt

    leaf_dir = xyz_norm2d(xyz_sub(leaf_end_pt, hinge_pt))
    if leaf_dir is None:
        raise Exception("门关键点方向无效")

    offset_along_ft = float(cfg.get("door_insert_offset_along_ft", 0.0))
    offset_normal_ft = float(cfg.get("door_insert_offset_normal_ft", 0.0))

    insert_pt = xyz_add(
        xyz_add(bbox_proj_pt, xyz_mul(wall_dir, offset_along_ft)),
        xyz_mul(wall_nrm, offset_normal_ft)
    )

    door_width_ft = get_symbol_width_ft(symbol)

    if door_width_ft is None or door_width_ft < 1e-6:
        pt_x1 = pix_to_revit(x1, y1)
        pt_x2 = pix_to_revit(x2, y1)
        pt_y2 = pix_to_revit(x1, y2)

        bbox_w_ft = abs(pt_x2.X - pt_x1.X)
        bbox_h_ft = abs(pt_y2.Y - pt_x1.Y)

        door_width_ft = min(max(min(bbox_w_ft, bbox_h_ft), 2.0), 4.0)
        logs.append("{} 使用bbox估计门宽: {:.3f} ft".format(debug_tag, door_width_ft))
    else:
        logs.append("{} 读取门族默认宽度: {:.3f} ft".format(debug_tag, door_width_ft))

    inst = place_hosted_door_instance(
        doc,
        level,
        symbol,
        host_wall,
        insert_pt
    )
    doc.Regenerate()

    flip_states = get_candidate_flip_states(inst)
    if len(flip_states) == 0:
        flip_states = [get_flip_state(inst)]

    best_score = -1e9
    best_state = get_flip_state(inst)
    best_eval_dbg = None
    state_evals = []

    for target_hand, target_facing in flip_states:
        ok, changed = set_flip_state(inst, target_hand, target_facing)
        doc.Regenerate()

        if not ok:
            state_evals.append({
                "tested_state": {
                    "target_hand_flipped": target_hand,
                    "target_facing_flipped": target_facing,
                    "changed_ops": changed
                },
                "reason": "set_flip_state_failed"
            })
            continue

        score, eval_dbg = evaluate_door_actual_geometry_state(
            doc,
            inst,
            insert_pt,
            wall_dir,
            hinge_pt,
            leaf_end_pt,
            leaf_dir,
            door_width_ft
        )

        eval_dbg["tested_state"] = {
            "target_hand_flipped": target_hand,
            "target_facing_flipped": target_facing,
            "changed_ops": changed
        }

        try:
            eval_dbg["hand_orientation_xyz"] = [
                inst.HandOrientation.X,
                inst.HandOrientation.Y,
                inst.HandOrientation.Z
            ]
        except:
            eval_dbg["hand_orientation_xyz"] = None

        try:
            eval_dbg["facing_orientation_xyz"] = [
                inst.FacingOrientation.X,
                inst.FacingOrientation.Y,
                inst.FacingOrientation.Z
            ]
        except:
            eval_dbg["facing_orientation_xyz"] = None

        try:
            eval_dbg["hand_flipped"] = inst.HandFlipped
        except:
            eval_dbg["hand_flipped"] = None

        try:
            eval_dbg["facing_flipped"] = inst.FacingFlipped
        except:
            eval_dbg["facing_flipped"] = None

        state_evals.append(eval_dbg)

        if score > best_score:
            best_score = score
            best_state = (target_hand, target_facing)
            best_eval_dbg = eval_dbg

    final_ok, final_changed = set_flip_state(
        inst,
        best_state[0],
        best_state[1]
    )
    doc.Regenerate()

    return inst, {
        "host_wall_id": host_wall.Id.IntegerValue,
        "wall_dist_ft": wall_dist,
        "door_width_ft": door_width_ft,
        "bbox_px": [float(x1), float(y1), float(x2), float(y2)],
        "bbox_center_xyz": [bbox_center_pt.X, bbox_center_pt.Y, bbox_center_pt.Z],
        "bbox_proj_xyz": [bbox_proj_pt.X, bbox_proj_pt.Y, bbox_proj_pt.Z],
        "insert_xyz": [insert_pt.X, insert_pt.Y, insert_pt.Z],
        "kp_start_xyz": [kp_start_pt.X, kp_start_pt.Y, kp_start_pt.Z],
        "kp_end_xyz": [kp_end_pt.X, kp_end_pt.Y, kp_end_pt.Z],
        "hinge_pt_xyz": [hinge_pt.X, hinge_pt.Y, hinge_pt.Z],
        "leaf_end_pt_xyz": [leaf_end_pt.X, leaf_end_pt.Y, leaf_end_pt.Z],
        "leaf_dir_xyz": [leaf_dir.X, leaf_dir.Y, leaf_dir.Z],
        "wall_dir_xyz": [wall_dir.X, wall_dir.Y, wall_dir.Z],
        "wall_normal_xyz": [wall_nrm.X, wall_nrm.Y, wall_nrm.Z],
        "door_insert_offset_along_ft": offset_along_ft,
        "door_insert_offset_normal_ft": offset_normal_ft,
        "match_method": "actual_instance_plan_geometry",
        "flip_candidates": flip_states,
        "state_evals": state_evals,
        "best_state": {
            "hand_flipped": best_state[0],
            "facing_flipped": best_state[1],
            "apply_ok": final_ok,
            "apply_changed": final_changed,
            "best_score": best_score
        },
        "best_eval_debug": best_eval_dbg
    }


# ============================================================
# 读取配置
# ============================================================
CLASS_CONFIG = load_class_config(class_config_json_path, logs)


# ============================================================
# 读取 seg_meta
# ============================================================
seg_meta = load_seg_meta(seg_meta_json_path, logs)

if seg_meta and seg_meta.get("ok", False):
    try:
        bbox_info = seg_meta.get("wall_bbox_px", None)
        scale_info = seg_meta.get("scale", {})
        dbg = seg_meta.get("debug", {})

        if bbox_info:
            bbox_min_x = bbox_info.get("min_x", None)
            bbox_min_y = bbox_info.get("min_y", None)
            bbox_width = bbox_info.get("width", None)
            bbox_height = bbox_info.get("height", None)

        scale_x_ft_per_px = scale_info.get("scale_x_ft_per_px", None)
        scale_y_ft_per_px = scale_info.get("scale_y_ft_per_px", None)

        if "pixelWidth" in dbg and "pixelHeight" in dbg:
            pixelWidth = dbg.get("pixelWidth", pixelWidth)
            pixelHeight = dbg.get("pixelHeight", pixelHeight)

        logs.append("bbox_info={}".format(str(bbox_info)))
        logs.append("scale_x_ft_per_px={}".format(str(scale_x_ft_per_px)))
        logs.append("scale_y_ft_per_px={}".format(str(scale_y_ft_per_px)))
        logs.append("pixelWidth={}, pixelHeight={}".format(pixelWidth, pixelHeight))

    except Exception as e:
        logs.append("解析seg_meta失败: {}".format(str(e)))
else:
    logs.append("seg_meta无效，使用fallback整图scale")


# ============================================================
# YOLO Pose
# ============================================================
yolo_pose = YOLO(pose_Model, task="pose")
newpath = "E:/yanjiu/revitss/tests/jjianzhu_pose.jpg"

pose_results = yolo_pose(
    source=pixpath,
    save=False,
    conf=0.3,
    iou=0.45,
    imgsz=640
)

cv2.imwrite(newpath, pose_results[0].plot())

result = pose_results[0]
boxes = result.boxes.xyxy.cpu().numpy() if result.boxes is not None else []
cls_ids = result.boxes.cls.cpu().numpy().astype(int) if result.boxes is not None else []
confs = result.boxes.conf.cpu().numpy() if result.boxes is not None else []
names = result.names

kps_xy = None
if result.keypoints is not None and result.keypoints.xy is not None:
    kps_xy = result.keypoints.xy.cpu().numpy()


# ============================================================
# Revit 文档
# ============================================================
doc = DocumentManager.Instance.CurrentDBDocument

TransactionManager.Instance.EnsureInTransaction(doc)

level = get_level(doc)
symbol_lookup = build_symbol_lookup(doc)

bed_median_area, bed_min_area = compute_class_area_threshold(
    boxes,
    cls_ids,
    names,
    "Bed",
    0.33
)

created_instances = []
debug_info = []
missing_family_types = []
skipped_unconfigured_classes = []


# 预激活符号
for cls_name, cfg in CLASS_CONFIG.items():
    symbol = get_symbol_from_lookup(
        symbol_lookup,
        cfg.get("family_name"),
        cfg.get("type_name")
    )
    if symbol:
        ensure_symbol_active(doc, symbol)


# ============================================================
# 主循环
# ============================================================
for i, bbox in enumerate(boxes):
    cls_name = names[int(cls_ids[i])] if len(cls_ids) > i else ""
    conf = confs[i] if len(confs) > i else 0.0

    if cls_name not in CLASS_CONFIG:
        skipped_unconfigured_classes.append({
            "index": i,
            "class": cls_name,
            "reason": "class_not_configured"
        })
        continue

    cfg = CLASS_CONFIG[cls_name]

    family_name = cfg.get("family_name")
    type_name = cfg.get("type_name")
    need_rotate = cfg.get("rotate", False)
    family_default_axis = cfg.get("family_default_axis", "Y")
    placement_mode = cfg.get("placement_mode", "free")

    symbol = get_symbol_from_lookup(symbol_lookup, family_name, type_name)

    if symbol is None:
        missing_family_types.append({
            "index": i,
            "class": cls_name,
            "family_name": family_name,
            "type_name": type_name,
            "reason": "family_symbol_not_found"
        })
        continue

    x1, y1, x2, y2 = bbox
    cx = (x1 + x2) * 0.5
    cy = (y1 + y2) * 0.5
    center_pt = pix_to_revit(cx, cy)

    area = max(0, x2 - x1) * max(0, y2 - y1)

    if cfg.get("area_filter", False):
        if cls_name == "Bed" and bed_min_area > 0 and area < bed_min_area:
            debug_info.append({
                "index": i,
                "class": cls_name,
                "reason": "filtered_small_area",
                "area": float(area),
                "threshold": float(bed_min_area)
            })
            continue

    start_pt = None
    end_pt = None

    if kps_xy is not None and i < len(kps_xy):
        kp_start_idx = cfg.get("kp_start_idx", None)
        kp_end_idx = cfg.get("kp_end_idx", None)

        kp = kps_xy[i]

        if kp_start_idx is not None and kp_end_idx is not None and len(kp) > max(kp_start_idx, kp_end_idx):
            sx, sy = kp[kp_start_idx]
            ex, ey = kp[kp_end_idx]
            start_pt = pix_to_revit(sx, sy)
            end_pt = pix_to_revit(ex, ey)

    # ------------------------------
    # 门：真实几何匹配
    # ------------------------------
    if placement_mode == "door_hosted":
        try:
            inst, door_dbg = process_door_instance(
                doc,
                level,
                symbol,
                cls_name,
                bbox,
                start_pt,
                end_pt,
                cfg,
                logs,
                debug_tag="door_{}_{}".format(i, cls_name)
            )

            created_instances.append(inst.ToDSType(False))

            debug_info.append({
                "index": i,
                "class": cls_name,
                "family_name": family_name,
                "type_name": type_name,
                "placement_mode": "door_hosted",
                "bbox_px": [float(x1), float(y1), float(x2), float(y2)],
                "area": float(area),
                "conf": float(conf),
                "door_debug": door_dbg
            })

        except Exception as e:
            debug_info.append({
                "index": i,
                "class": cls_name,
                "placement_mode": "door_hosted",
                "reason": "door_place_failed",
                "error": str(e),
                "bbox_px": [float(x1), float(y1), float(x2), float(y2)],
                "kp_start_xyz": [start_pt.X, start_pt.Y, start_pt.Z] if start_pt else None,
                "kp_end_xyz": [end_pt.X, end_pt.Y, end_pt.Z] if end_pt else None
            })

        continue

    # ------------------------------
    # 普通自由族
    # ------------------------------
    try:
        instance = create_family_instance(doc, center_pt, symbol, level)
    except Exception as e:
        debug_info.append({
            "index": i,
            "class": cls_name,
            "reason": "create_instance_failed",
            "error": str(e)
        })
        continue

    rotated = False
    angle = None

    if need_rotate:
        if start_pt is not None and end_pt is not None:
            angle = get_angle_from_keypoints(start_pt, end_pt, family_default_axis)

            if angle is not None:
                try:
                    rotate_instance(doc, instance, center_pt, angle)
                    rotated = True
                except Exception as e:
                    debug_info.append({
                        "index": i,
                        "class": cls_name,
                        "reason": "rotate_failed",
                        "error": str(e)
                    })
            else:
                debug_info.append({
                    "index": i,
                    "class": cls_name,
                    "reason": "zero_direction_vector"
                })
        else:
            debug_info.append({
                "index": i,
                "class": cls_name,
                "reason": "no_keypoints_for_rotation"
            })

    created_instances.append(instance.ToDSType(False))

    debug_info.append({
        "index": i,
        "class": cls_name,
        "family_name": family_name,
        "type_name": type_name,
        "placement_mode": "free",
        "center_xyz": [center_pt.X, center_pt.Y, center_pt.Z],
        "bbox_px": [float(x1), float(y1), float(x2), float(y2)],
        "area": float(area),
        "rotated": rotated,
        "angle_rad": angle,
        "angle_deg": angle * 180.0 / math.pi if angle is not None else None,
        "conf": float(conf),
        "kp_start_xyz": [start_pt.X, start_pt.Y, start_pt.Z] if start_pt else None,
        "kp_end_xyz": [end_pt.X, end_pt.Y, end_pt.Z] if end_pt else None
    })


# ============================================================
# 提交
# ============================================================
TransactionManager.Instance.TransactionTaskDone()
doc.Regenerate()


OUT = {
    "preview_image": newpath,
    "created_instances": created_instances,
    "debug_info": debug_info,
    "missing_family_types": missing_family_types,
    "skipped_unconfigured_classes": skipped_unconfigured_classes,
    "bed_area_threshold": {
        "median_area": bed_median_area,
        "min_area": bed_min_area
    },
    "seg_meta_json_path": seg_meta_json_path,
    "class_config_json_path": class_config_json_path,
    "logs": logs
}
# ----------------------------------------
python_version_22 = Watch(python_script_10)  # graph output
imagepath_4 = Filename("..\tests\2室2厅1厨1卫-93.64㎡-南 北-103100368214.jpg")
python_script_23 = Python(IN[0]=seg_WWTD_Modelpath, IN[1]=imagepath_2, IN[2]=number, IN[3]=scale, IN[4]=python_version_4, IN[5]=seg_meta_Json_Path)  # CPython3; frozen
# ---------- python_script_23.python (1528 lines) ----------
# 加载 Python Standard 和 DesignScript 库
#-----------------------
import sys
import clr
clr.AddReference('ProtoGeometry')
from Autodesk.DesignScript.Geometry import *
import Autodesk.DesignScript.Geometry as DS
import Revit
from Revit.Elements import *
import System
sys.path.append("C:/Users/Lenovo/anaconda3/envs/revitenv/Lib/site-packages")
clr.AddReference('RevitAPI')
clr.AddReference('RevitAPIUI')
from Autodesk.Revit.DB import *
from Autodesk.Revit.UI import *

clr.AddReference('RevitServices')
from RevitServices.Persistence import DocumentManager
from RevitServices.Transactions import TransactionManager

clr.AddReference('RevitNodes')
import Revit
clr.ImportExtensions(Revit.Elements)
clr.ImportExtensions(Revit.GeometryConversion)

import re
import math
import json
import os
import traceback
import numpy as np
import torch
import cv2

from scipy.spatial import Voronoi
from scipy import ndimage
from shapely.geometry import Polygon, LineString, MultiLineString
from shapely.ops import linemerge
from shapely.ops import unary_union, split
from shapely.geometry import Point as ShpPoint
from shapely.geometry import Polygon as ShpPolygon
from shapely.geometry import MultiPolygon as ShpMultiPolygon
from shapely.geometry import Point as ShpPoint
from shapely.geometry import MultiLineString
from shapely.ops import linemerge
from skimage.morphology import skeletonize
from ultralytics import YOLO

dataEnteringNode = IN 

# =========================
# 输入
# =========================
dect_Model = IN[0]
pixpath = IN[1]
height = IN[2]
scale = IN[3]
dims_json_path = IN[4]
seg_meta_json_path = IN[5]

# =========================
# 参数
# =========================
origin = XYZ(0, 0, 0)   
widthFt = scale
pixelWidth = 1600   
pixelHeight = 1200 
DENSIFY_DIST = 0.5  
EPS = 1e-6

TARGET_WALL_TYPE_NAME = "基本墙 200mm"
TARGET_LEVEL_NAME = "标高 2"

newpath = "E:/yanjiu/revitss/tests/jjianzhu_seg.jpg"

scaleX = widthFt / pixelWidth if pixelWidth > 0 else 0.0
scaleY = widthFt * (pixelHeight / pixelWidth) / pixelHeight if pixelWidth > 0 and pixelHeight > 0 else 0.0

bbox_info_global = None
scale_x_ft_per_px_global = None
scale_y_ft_per_px_global = None

logs = []

# =========================
# 工具函数
# =========================
def ensure_dir_of_file(file_path):
    folder = os.path.dirname(file_path)
    if folder and not os.path.exists(folder):
        os.makedirs(folder)

def pix_to_revit(x, y):
    global bbox_info_global, scale_x_ft_per_px_global, scale_y_ft_per_px_global

    try:
        if bbox_info_global is not None and scale_x_ft_per_px_global is not None and scale_y_ft_per_px_global is not None:
            min_x = bbox_info_global["min_x"]
            min_y = bbox_info_global["min_y"]
            bbox_h = bbox_info_global["height"]

            local_x = x - min_x
            local_y = y - min_y

            revit_x = origin.X + local_x * scale_x_ft_per_px_global
            revit_y = origin.Y + (bbox_h - local_y) * scale_y_ft_per_px_global
            return XYZ(revit_x, revit_y, origin.Z)
    except:
        pass

    revit_x = origin.X + x * scaleX
    revit_y = origin.Y + (pixelHeight - y) * scaleY
    return XYZ(revit_x, revit_y, origin.Z)

def sanitize_name(name):
    if not name:
        return "Unknown"
    cleaned = re.sub(r'[\x00-\x1f\x7f]', '', name)
    if not cleaned.strip():
        return "Unnamed"
    return cleaned

def get_mask_bbox(binary_mask, logs):
    if binary_mask is None:
        logs.append("get_mask_bbox失败: binary_mask is None")
        return None

    ys, xs = np.where(binary_mask > 0)
    if len(xs) == 0 or len(ys) == 0:
        logs.append("get_mask_bbox失败: 墙体mask为空")
        return None

    min_x = int(np.min(xs))
    max_x = int(np.max(xs))
    min_y = int(np.min(ys))
    max_y = int(np.max(ys))

    bbox = {
        "min_x": min_x,
        "min_y": min_y,
        "max_x": max_x,
        "max_y": max_y,
        "width": int(max_x - min_x + 1),
        "height": int(max_y - min_y + 1)
    }
    logs.append("结构mask bbox: {}".format(str(bbox)))
    return bbox

# =========================
# 结构类配置
# =========================
STRUCTURE_CLASS_KEYWORDS = [
    "wall",
    "墙",
    "墙体",
    "basic wall",
    "door",
    "门",
    "tdoor",
    "double door",
    "window",
    "窗",
    "窗户"
]

STRUCTURE_CLASS_EXACT = set([
    "wall",
    "door",
    "window",
    "tdoor"
])

EXPAND_CLASSES = set([
    "door",
    "window",
    "tdoor"
])

def normalize_class_name(name):
    if name is None:
        return ""
    return str(name).strip().lower()

def is_structure_wall_like_class(name):
    n = normalize_class_name(name)
    if not n:
        return False

    if n in STRUCTURE_CLASS_EXACT:
        return True

    for kw in STRUCTURE_CLASS_KEYWORDS:
        if kw.lower() in n:
            return True
    return False

def ensure_polygon(geom):
    if geom is None or geom.is_empty:
        return None
    try:
        if not geom.is_valid:
            geom = geom.buffer(0)
    except:
        pass
    if geom is None or geom.is_empty:
        return None

    if isinstance(geom, ShpPolygon):
        return geom

    if isinstance(geom, ShpMultiPolygon):
        polys = [g for g in geom.geoms if g is not None and not g.is_empty]
        if not polys:
            return None
        polys.sort(key=lambda p: p.area, reverse=True)
        return polys[0]

    return None

def line_long_enough(line_geom, min_len=0.1):
    if line_geom is None or line_geom.is_empty:
        return False
    try:
        return line_geom.length >= min_len
    except:
        return False

def snap_line_to_axis(line_geom):
    if line_geom is None or line_geom.is_empty:
        return None
    coords = list(line_geom.coords)
    if len(coords) < 2:
        return None
    x1, y1 = coords[0]
    x2, y2 = coords[-1]
    dx = x2 - x1
    dy = y2 - y1
    if abs(dx) >= abs(dy):
        ym = 0.5 * (y1 + y2)
        return LineString([(x1, ym), (x2, ym)])
    else:
        xm = 0.5 * (x1 + x2)
        return LineString([(xm, y1), (xm, y2)])

def get_line_orientation_from_geom(line_geom):
    coords = list(line_geom.coords)
    x1, y1 = coords[0]
    x2, y2 = coords[-1]
    if abs(y2 - y1) <= abs(x2 - x1):
        return "h"
    return "v"

def get_line_orientation(seg):
    return get_line_orientation_from_geom(seg['line'])

def line_length(line_geom):
    try:
        return line_geom.length
    except:
        return 0.0

def copy_segments(segments):
    out = []
    for s in segments:
        out.append({
            'line': s['line'],
            'thickness': s['thickness'],
            'name': s['name']
        })
    return out

def longest_linestring_from_intersection(inter):
    if inter is None or inter.is_empty:
        return None
    if inter.geom_type == "LineString":
        return inter
    if inter.geom_type == "MultiLineString":
        lines = [g for g in inter.geoms if g.length > 1e-4]
        if not lines:
            return None
        lines.sort(key=lambda g: g.length, reverse=True)
        return lines[0]
    return None

def merge_close_vertices(segments, delta):
    pts = []
    for seg in segments:
        coords = list(seg['line'].coords)
        pts.append(coords[0])
        pts.append(coords[-1])

    if not pts:
        return segments

    clusters = []
    for p in pts:
        assigned = False
        for cluster in clusters:
            cx, cy, plist = cluster
            d2 = (p[0]-cx)**2 + (p[1]-cy)**2
            if d2 < delta * delta:
                plist.append(p)
                nx = sum(pp[0] for pp in plist) / len(plist)
                ny = sum(pp[1] for pp in plist) / len(plist)
                cluster[0] = nx
                cluster[1] = ny
                assigned = True
                break
        if not assigned:
            clusters.append([p[0], p[1], [p]])

    def snap_point(p):
        best = p
        best_d = 1e18
        for cx, cy, plist in clusters:
            d2 = (p[0]-cx)**2 + (p[1]-cy)**2
            if d2 < best_d:
                best_d = d2
                best = (cx, cy)
        return best

    new_segments = []
    for seg in segments:
        coords = list(seg['line'].coords)
        p1 = snap_point(coords[0])
        p2 = snap_point(coords[-1])
        if ((p1[0]-p2[0])**2 + (p1[1]-p2[1])**2) ** 0.5 < 0.1:
            continue
        new_line = LineString([p1, p2])
        new_line = snap_line_to_axis(new_line)
        if new_line is None:
            continue
        new_segments.append({
            'line': new_line,
            'thickness': seg['thickness'],
            'name': seg['name']
        })
    return new_segments

def point_to_segment_distance(pt, a, b):
    px, py = pt
    ax, ay = a
    bx, by = b
    dx = bx - ax
    dy = by - ay
    if abs(dx) < EPS and abs(dy) < EPS:
        return ((px-ax)**2 + (py-ay)**2)**0.5, a, 0.0

    t = ((px-ax)*dx + (py-ay)*dy) / (dx*dx + dy*dy)
    t_clamped = max(0.0, min(1.0, t))
    qx = ax + t_clamped * dx
    qy = ay + t_clamped * dy
    dist = ((px-qx)**2 + (py-qy)**2)**0.5
    return dist, (qx, qy), t_clamped

def split_segments_by_near_vertices(segments, delta):
    if not segments:
        return segments

    vertices = []
    for seg in segments:
        coords = list(seg['line'].coords)
        vertices.append(coords[0])
        vertices.append(coords[-1])

    new_segments = []
    for idx, seg in enumerate(segments):
        coords = list(seg['line'].coords)
        a = coords[0]
        b = coords[-1]
        split_pts = []

        for v in vertices:
            if v == a or v == b:
                continue
            dist, proj, t = point_to_segment_distance(v, a, b)
            if dist < delta and t > 0.01 and t < 0.99:
                split_pts.append((t, v))

        if not split_pts:
            new_segments.append(seg)
        else:
            split_pts.sort(key=lambda x: x[0])
            chain = [a] + [v for _, v in split_pts] + [b]
            for p1, p2 in zip(chain[:-1], chain[1:]):
                if ((p1[0]-p2[0])**2 + (p1[1]-p2[1])**2) ** 0.5 < 0.1:
                    continue
                new_line = snap_line_to_axis(LineString([p1, p2]))
                if new_line is None:
                    continue
                new_segments.append({
                    'line': new_line,
                    'thickness': seg['thickness'],
                    'name': seg['name']
                })
    return new_segments

def merge_collinear_segments_strict(segments, coord_tol=0.08, gap_tol=0.25):
    if not segments:
        return segments

    horizontal = []
    vertical = []
    others = []

    for seg in segments:
        coords = list(seg['line'].coords)
        x1, y1 = coords[0]
        x2, y2 = coords[-1]

        if abs(y2 - y1) <= coord_tol:
            y = 0.5 * (y1 + y2)
            xmin, xmax = min(x1, x2), max(x1, x2)
            horizontal.append((y, xmin, xmax, seg))
        elif abs(x2 - x1) <= coord_tol:
            x = 0.5 * (x1 + x2)
            ymin, ymax = min(y1, y2), max(y1, y2)
            vertical.append((x, ymin, ymax, seg))
        else:
            others.append(seg)

    merged = []

    horizontal.sort(key=lambda t: (round(t[0], 2), t[1]))
    used = [False] * len(horizontal)
    for i in range(len(horizontal)):
        if used[i]:
            continue
        y, x1, x2, seg = horizontal[i]
        thick = seg['thickness']
        name = seg['name']

        for j in range(i + 1, len(horizontal)):
            if used[j]:
                continue
            y2, xx1, xx2, seg2 = horizontal[j]
            if abs(y2 - y) <= coord_tol and xx1 <= x2 + gap_tol:
                x2 = max(x2, xx2)
                thick = 0.5 * (thick + seg2['thickness'])
                used[j] = True

        merged.append({
            'line': LineString([(x1, y), (x2, y)]),
            'thickness': thick,
            'name': name
        })

    vertical.sort(key=lambda t: (round(t[0], 2), t[1]))
    used = [False] * len(vertical)
    for i in range(len(vertical)):
        if used[i]:
            continue
        x, y1, y2, seg = vertical[i]
        thick = seg['thickness']
        name = seg['name']

        for j in range(i + 1, len(vertical)):
            if used[j]:
                continue
            x2, yy1, yy2, seg2 = vertical[j]
            if abs(x2 - x) <= coord_tol and yy1 <= y2 + gap_tol:
                y2 = max(y2, yy2)
                thick = 0.5 * (thick + seg2['thickness'])
                used[j] = True

        merged.append({
            'line': LineString([(x, y1), (x, y2)]),
            'thickness': thick,
            'name': name
        })

    merged.extend(others)
    return merged

def optimize_wall_centerlines(candidates, iter_count=1, enable_merge_collinear=True):
    if not candidates:
        return []

    segs = candidates[:]

    if enable_merge_collinear:
        segs = merge_collinear_segments_strict(segs, coord_tol=0.08, gap_tol=0.35)

    for _ in range(iter_count):
        if not segs:
            break

        avg_t = sum(s['thickness'] for s in segs) / max(len(segs), 1)
        delta = 0.20 * avg_t
        if delta < 0.03:
            delta = 0.03
        if delta > 0.12:
            delta = 0.12

        segs = merge_close_vertices(segs, delta)
        segs = split_segments_by_near_vertices(segs, delta)

    cleaned = []
    for s in segs:
        try:
            if s['line'] is None or s['line'].is_empty:
                continue
            if s['line'].length < 0.08:
                continue
            cleaned.append(s)
        except:
            continue

    return cleaned

# =========================
# mask 构建与清理
# =========================
def build_global_structure_mask(result, pixelWidth, pixelHeight, logs):
    wall_mask = np.zeros((pixelHeight, pixelWidth), dtype=np.uint8)
    class_counter = {}

    if result.masks is None:
        logs.append("result.masks is None")
        return wall_mask, class_counter

    masks_xy = result.masks.xy
    cls_ids = result.boxes.cls.cpu().numpy().astype(int)
    names = result.names

    logs.append("总mask数量: {}".format(len(masks_xy)))

    expand_kernel = cv2.getStructuringElement(cv2.MORPH_RECT, (5, 5))

    for i, contour_pts in enumerate(masks_xy):
        try:
            if i >= len(cls_ids):
                continue

            class_id = cls_ids[i]
            class_name = names[class_id]
            class_name_norm = normalize_class_name(class_name)

            if not is_structure_wall_like_class(class_name):
                continue

            pts = np.array(contour_pts, dtype=np.int32)
            if len(pts) < 3:
                continue

            pts[:, 0] = np.clip(pts[:, 0], 0, pixelWidth - 1)
            pts[:, 1] = np.clip(pts[:, 1], 0, pixelHeight - 1)

            if class_name_norm in EXPAND_CLASSES:
                temp = np.zeros((pixelHeight, pixelWidth), dtype=np.uint8)
                cv2.fillPoly(temp, [pts], 255)
                temp = cv2.dilate(temp, expand_kernel, iterations=1)
                wall_mask[temp > 0] = 255
            else:
                cv2.fillPoly(wall_mask, [pts], 255)

            class_counter[class_name_norm] = class_counter.get(class_name_norm, 0) + 1

        except Exception as e:
            logs.append("合成结构mask失败 idx={}: {}".format(i, str(e)))
            continue

    logs.append("参与墙体生成的类别统计: {}".format(str(class_counter)))
    return wall_mask, class_counter

def clean_wall_mask(binary_mask, logs):
    mask = binary_mask.copy()

    kernel_bridge = cv2.getStructuringElement(cv2.MORPH_RECT, (3, 3))
    kernel_close_big = cv2.getStructuringElement(cv2.MORPH_RECT, (7, 7))
    kernel_close_small = cv2.getStructuringElement(cv2.MORPH_RECT, (5, 5))

    mask = cv2.dilate(mask, kernel_bridge, iterations=1)
    mask = cv2.morphologyEx(mask, cv2.MORPH_CLOSE, kernel_close_big)
    mask = cv2.morphologyEx(mask, cv2.MORPH_CLOSE, kernel_close_small)
    mask = cv2.erode(mask, kernel_bridge, iterations=1)

    num_labels, labels, stats, _ = cv2.connectedComponentsWithStats(mask, connectivity=8)
    cleaned = np.zeros_like(mask)

    for i in range(1, num_labels):
        area = stats[i, cv2.CC_STAT_AREA]
        if area >= 30:
            cleaned[labels == i] = 255

    logs.append("结构mask清理完成(补缝增强版)")
    return cleaned

def estimate_wall_width_pixels(binary_mask, logs):
    if binary_mask is None or binary_mask.max() == 0:
        logs.append("墙宽估计失败：mask为空")
        return 6.0

    dist = cv2.distanceTransform(binary_mask, cv2.DIST_L2, 5)
    vals = dist[dist > 0]
    if len(vals) == 0:
        logs.append("墙宽估计失败：distanceTransform为空")
        return 6.0

    wall_width_px = max(2.0, 2.0 * np.median(vals))
    logs.append("估计墙宽像素值: {:.2f}".format(wall_width_px))
    return wall_width_px

def skeletonize_wall_mask(binary_mask, logs):
    try:
        from skimage.morphology import skeletonize
        skel = skeletonize(binary_mask > 0)
        logs.append("使用 skimage.skeletonize 成功")
        return skel.astype(np.uint8)
    except Exception as e:
        logs.append("skimage骨架失败，改用fallback: {}".format(str(e)))
        return skeletonize_fallback(binary_mask, logs)

def skeletonize_fallback(binary_mask, logs):
    img = (binary_mask > 0).astype(np.uint8) * 255
    size = np.size(img)
    skel = np.zeros(img.shape, np.uint8)

    element = cv2.getStructuringElement(cv2.MORPH_CROSS, (3, 3))
    done = False

    while not done:
        eroded = cv2.erode(img, element)
        temp = cv2.dilate(eroded, element)
        temp = cv2.subtract(img, temp)
        skel = cv2.bitwise_or(skel, temp)
        img = eroded.copy()

        zeros = size - cv2.countNonZero(img)
        if zeros == size:
            done = True

    logs.append("fallback skeletonize 成功")
    return (skel > 0).astype(np.uint8)

def get_neighbors_8(x, y, w, h):
    nbs = []
    for dy in [-1, 0, 1]:
        for dx in [-1, 0, 1]:
            if dx == 0 and dy == 0:
                continue
            nx = x + dx
            ny = y + dy
            if 0 <= nx < w and 0 <= ny < h:
                nbs.append((nx, ny))
    return nbs

def extract_skeleton_graph(skel, logs):
    h, w = skel.shape
    skel_pts = set()
    for y in range(h):
        xs = np.where(skel[y] > 0)[0]
        for x in xs:
            skel_pts.add((x, y))

    if not skel_pts:
        logs.append("骨架为空")
        return [], []

    degree = {}
    for (x, y) in skel_pts:
        cnt = 0
        for nx, ny in get_neighbors_8(x, y, w, h):
            if (nx, ny) in skel_pts:
                cnt += 1
        degree[(x, y)] = cnt

    nodes = [p for p, d in degree.items() if d != 2]

    if not nodes:
        nodes = list(skel_pts)

    node_set = set(nodes)
    visited_edges = set()
    edges = []

    for node in nodes:
        x0, y0 = node
        for nx, ny in get_neighbors_8(x0, y0, w, h):
            if (nx, ny) not in skel_pts:
                continue

            edge_key = tuple(sorted([node, (nx, ny)]))
            if edge_key in visited_edges:
                continue

            path = [node, (nx, ny)]
            prev = node
            curr = (nx, ny)

            while True:
                visited_edges.add(tuple(sorted([prev, curr])))

                if curr in node_set and curr != node:
                    break

                nbrs = []
                for tx, ty in get_neighbors_8(curr[0], curr[1], w, h):
                    if (tx, ty) in skel_pts and (tx, ty) != prev:
                        nbrs.append((tx, ty))

                if len(nbrs) == 0:
                    break
                if len(nbrs) > 1:
                    break

                nxt = nbrs[0]
                path.append(nxt)
                prev = curr
                curr = nxt

            if len(path) >= 2:
                edges.append(path)

    logs.append("骨架图提取完成: nodes={}, edges={}".format(len(nodes), len(edges)))
    return nodes, edges

def split_path_by_direction(path, turn_threshold=2):
    if not path or len(path) < 3:
        return [path] if path else []

    segments = []
    current = [path[0], path[1]]

    def major_dir(p1, p2):
        dx = p2[0] - p1[0]
        dy = p2[1] - p1[1]
        if abs(dx) >= abs(dy):
            return "h"
        else:
            return "v"

    prev_dir = major_dir(path[0], path[1])

    for i in range(2, len(path)):
        d = major_dir(path[i-1], path[i])

        if d == prev_dir:
            current.append(path[i])
        else:
            if len(current) <= turn_threshold and segments:
                segments[-1].extend(current[1:])
                current = [segments[-1][-1], path[i]]
            else:
                segments.append(current)
                current = [path[i-1], path[i]]
            prev_dir = d

    if current:
        if len(current) <= turn_threshold and segments:
            segments[-1].extend(current[1:])
        else:
            segments.append(current)

    cleaned = []
    for seg in segments:
        if seg and len(seg) >= 2:
            cleaned.append(seg)

    return cleaned

def fit_axis_line_from_mask(sub_path, wall_mask, pixelWidth, pixelHeight, min_len_px=8):
    if not sub_path or len(sub_path) < 2:
        return None

    xs = [p[0] for p in sub_path]
    ys = [p[1] for p in sub_path]

    x_min = max(0, int(min(xs)))
    x_max = min(pixelWidth - 1, int(max(xs)))
    y_min = max(0, int(min(ys)))
    y_max = min(pixelHeight - 1, int(max(ys)))

    dx = x_max - x_min
    dy = y_max - y_min

    if dx >= dy:
        mids = []
        for x in range(x_min, x_max + 1):
            ys_in = np.where(wall_mask[:, x] > 0)[0]
            ys_local = ys_in[(ys_in >= y_min - 8) & (ys_in <= y_max + 8)]
            if len(ys_local) >= 2:
                y_top = np.min(ys_local)
                y_bot = np.max(ys_local)
                y_mid = 0.5 * (y_top + y_bot)
                mids.append((x, y_mid))

        if len(mids) < 2:
            return None

        xs2 = [p[0] for p in mids]
        ys2 = [p[1] for p in mids]

        x1 = min(xs2)
        x2 = max(xs2)
        y = float(np.median(ys2))

        if (x2 - x1) < min_len_px:
            return None

        return ((x1, y), (x2, y), "h")

    else:
        mids = []
        for y in range(y_min, y_max + 1):
            xs_in = np.where(wall_mask[y, :] > 0)[0]
            xs_local = xs_in[(xs_in >= x_min - 8) & (xs_in <= x_max + 8)]
            if len(xs_local) >= 2:
                x_left = np.min(xs_local)
                x_right = np.max(xs_local)
                x_mid = 0.5 * (x_left + x_right)
                mids.append((x_mid, y))

        if len(mids) < 2:
            return None

        xs2 = [p[0] for p in mids]
        ys2 = [p[1] for p in mids]

        y1 = min(ys2)
        y2 = max(ys2)
        x = float(np.median(xs2))

        if (y2 - y1) < min_len_px:
            return None

        return ((x, y1), (x, y2), "v")

def pixel_line_to_revit_linestring(p1, p2):
    rp1 = pix_to_revit(p1[0], p1[1])
    rp2 = pix_to_revit(p2[0], p2[1])
    if rp1.DistanceTo(rp2) < 0.1:
        return None
    return LineString([(rp1.X, rp1.Y), (rp2.X, rp2.Y)])

def simplify_path_to_axis_lines(path, wall_mask, pixelWidth, pixelHeight, logs, min_len_px=8):
    result_lines = []

    sub_paths = split_path_by_direction(path, turn_threshold=2)
    for sub in sub_paths:
        try:
            fitted = fit_axis_line_from_mask(
                sub, wall_mask, pixelWidth, pixelHeight, min_len_px=min_len_px
            )
            if fitted is None:
                continue

            p1, p2, ori = fitted
            line_geom = pixel_line_to_revit_linestring(p1, p2)
            if line_geom is None:
                continue

            if line_geom.length < 0.08:
                continue

            result_lines.append(line_geom)

        except Exception as e:
            logs.append("子段拟合失败: {}".format(str(e)))
            continue

    return result_lines

def extract_wall_centerlines_from_global_mask(result, pixelWidth, pixelHeight, logs):
    wall_mask, class_counter = build_global_structure_mask(result, pixelWidth, pixelHeight, logs)
    if wall_mask.max() == 0:
        logs.append("没有结构类mask被写入全局墙图")
        return [], 0.3, class_counter, wall_mask

    cleaned_mask = clean_wall_mask(wall_mask, logs)
    wall_width_px = estimate_wall_width_pixels(cleaned_mask, logs)

    skel = skeletonize_wall_mask(cleaned_mask, logs)
    nodes, edges = extract_skeleton_graph(skel, logs)

    if not edges:
        logs.append("骨架没有边")
        wall_width_ft = wall_width_px * (scale_x_ft_per_px_global if scale_x_ft_per_px_global else scaleX)
        return [], wall_width_ft, class_counter, cleaned_mask

    wall_width_ft = wall_width_px * (scale_x_ft_per_px_global if scale_x_ft_per_px_global else scaleX)
    candidates = []

    for idx, path in enumerate(edges):
        try:
            line_list = simplify_path_to_axis_lines(
                path, cleaned_mask, pixelWidth, pixelHeight, logs,
                min_len_px=max(3, int(wall_width_px * 0.5))
            )

            for line_geom in line_list:
                candidates.append({
                    'line': line_geom,
                    'thickness': wall_width_ft,
                    'name': "Wall"
                })

        except Exception as e:
            logs.append("路径{}转中心线失败: {}".format(idx, str(e)))
            continue

    logs.append("全局提取中心线候选数量: {}".format(len(candidates)))
    return candidates, wall_width_ft, class_counter, cleaned_mask

# =========================
# 第二版增强：几何补缝与对齐
# =========================
def bridge_near_orthogonal_gaps(segments, gap_tol=0.6, axis_tol=0.25):
    if not segments:
        return segments

    segs = copy_segments(segments)

    for i in range(len(segs)):
        for j in range(i + 1, len(segs)):
            si = segs[i]
            sj = segs[j]
            if si is None or sj is None:
                continue

            oi = get_line_orientation(si)
            oj = get_line_orientation(sj)

            if oi == oj:
                continue

            if oi == "v" and oj == "h":
                tmp = si
                si = sj
                sj = tmp
                idx_h = j
                idx_v = i
            else:
                idx_h = i
                idx_v = j

            coords_h = list(si['line'].coords)
            coords_v = list(sj['line'].coords)

            hx1, hy1 = coords_h[0]
            hx2, hy2 = coords_h[-1]
            vx1, vy1 = coords_v[0]
            vx2, vy2 = coords_v[-1]

            y_h = 0.5 * (hy1 + hy2)
            x_v = 0.5 * (vx1 + vx2)

            hminx, hmaxx = min(hx1, hx2), max(hx1, hx2)
            vminy, vmaxy = min(vy1, vy2), max(vy1, vy2)

            inter_pt = (x_v, y_h)

            h_endpts = [(hx1, hy1), (hx2, hy2)]
            v_endpts = [(vx1, vy1), (vx2, vy2)]

            h_dists = [((p[0]-inter_pt[0])**2 + (p[1]-inter_pt[1])**2)**0.5 for p in h_endpts]
            v_dists = [((p[0]-inter_pt[0])**2 + (p[1]-inter_pt[1])**2)**0.5 for p in v_endpts]

            h_min_idx = int(np.argmin(h_dists))
            v_min_idx = int(np.argmin(v_dists))

            h_min_dist = h_dists[h_min_idx]
            v_min_dist = v_dists[v_min_idx]

            cond_h = (x_v >= hminx - axis_tol and x_v <= hmaxx + gap_tol)
            cond_v = (y_h >= vminy - axis_tol and y_h <= vmaxy + gap_tol)

            if h_min_dist <= gap_tol and v_min_dist <= gap_tol and cond_h and cond_v:
                other_h = h_endpts[1 - h_min_idx]
                other_v = v_endpts[1 - v_min_idx]

                new_h = snap_line_to_axis(LineString([other_h, inter_pt]))
                new_v = snap_line_to_axis(LineString([other_v, inter_pt]))

                if new_h is not None and new_h.length >= 0.08:
                    segs[idx_h]['line'] = new_h
                if new_v is not None and new_v.length >= 0.08:
                    segs[idx_v]['line'] = new_v

    cleaned = []
    for s in segs:
        try:
            if s['line'] is None or s['line'].is_empty:
                continue
            if s['line'].length < 0.08:
                continue
            cleaned.append(s)
        except:
            continue
    return cleaned

def align_parallel_segments(segments, coord_tol=0.35):
    """
    将接近共线的水平段/竖直段拉齐到同一坐标轴
    水平：对齐 y
    竖直：对齐 x
    """
    if not segments:
        return segments

    segs = copy_segments(segments)

    horizontal_groups = []
    vertical_groups = []

    for idx, s in enumerate(segs):
        coords = list(s['line'].coords)
        x1, y1 = coords[0]
        x2, y2 = coords[-1]
        ori = get_line_orientation(s)

        if ori == "h":
            y = 0.5 * (y1 + y2)
            added = False
            for g in horizontal_groups:
                if abs(g['coord'] - y) <= coord_tol:
                    g['indices'].append(idx)
                    g['values'].append(y)
                    g['coord'] = float(np.median(g['values']))
                    added = True
                    break
            if not added:
                horizontal_groups.append({
                    'coord': y,
                    'indices': [idx],
                    'values': [y]
                })
        else:
            x = 0.5 * (x1 + x2)
            added = False
            for g in vertical_groups:
                if abs(g['coord'] - x) <= coord_tol:
                    g['indices'].append(idx)
                    g['values'].append(x)
                    g['coord'] = float(np.median(g['values']))
                    added = True
                    break
            if not added:
                vertical_groups.append({
                    'coord': x,
                    'indices': [idx],
                    'values': [x]
                })

    for g in horizontal_groups:
        target_y = g['coord']
        for idx in g['indices']:
            coords = list(segs[idx]['line'].coords)
            x1, y1 = coords[0]
            x2, y2 = coords[-1]
            segs[idx]['line'] = LineString([(x1, target_y), (x2, target_y)])

    for g in vertical_groups:
        target_x = g['coord']
        for idx in g['indices']:
            coords = list(segs[idx]['line'].coords)
            x1, y1 = coords[0]
            x2, y2 = coords[-1]
            segs[idx]['line'] = LineString([(target_x, y1), (target_x, y2)])

    return segs

def bridge_parallel_gaps(segments, coord_tol=0.25, gap_tol=0.8):
    """
    平行且接近共线的短缝桥接
    - 水平对水平：y接近，x方向中间差一小截 -> 合并成一条
    - 竖直对竖直：x接近，y方向中间差一小截 -> 合并成一条
    """
    if not segments:
        return segments

    segs = copy_segments(segments)
    used = [False] * len(segs)
    result = []

    # 先水平
    horiz = []
    vert = []
    other = []

    for idx, s in enumerate(segs):
        ori = get_line_orientation(s)
        coords = list(s['line'].coords)
        x1, y1 = coords[0]
        x2, y2 = coords[-1]

        if ori == "h":
            y = 0.5 * (y1 + y2)
            xmin = min(x1, x2)
            xmax = max(x1, x2)
            horiz.append((idx, y, xmin, xmax, s))
        else:
            x = 0.5 * (x1 + x2)
            ymin = min(y1, y2)
            ymax = max(y1, y2)
            vert.append((idx, x, ymin, ymax, s))

    horiz.sort(key=lambda t: (round(t[1], 3), t[2]))
    consumed = set()
    for i in range(len(horiz)):
        if i in consumed:
            continue
        idx_i, y_i, x1_i, x2_i, seg_i = horiz[i]
        cur_y = y_i
        cur_x1 = x1_i
        cur_x2 = x2_i
        cur_thick = seg_i['thickness']
        cur_name = seg_i['name']

        for j in range(i + 1, len(horiz)):
            if j in consumed:
                continue
            idx_j, y_j, x1_j, x2_j, seg_j = horiz[j]

            if abs(y_j - cur_y) <= coord_tol:
                gap = x1_j - cur_x2
                overlap = min(cur_x2, x2_j) - max(cur_x1, x1_j)
                if gap <= gap_tol or overlap >= -coord_tol:
                    cur_x1 = min(cur_x1, x1_j)
                    cur_x2 = max(cur_x2, x2_j)
                    cur_y = float(np.median([cur_y, y_j]))
                    cur_thick = 0.5 * (cur_thick + seg_j['thickness'])
                    consumed.add(j)

        result.append({
            'line': LineString([(cur_x1, cur_y), (cur_x2, cur_y)]),
            'thickness': cur_thick,
            'name': cur_name
        })

    vert.sort(key=lambda t: (round(t[1], 3), t[2]))
    consumed = set()
    for i in range(len(vert)):
        if i in consumed:
            continue
        idx_i, x_i, y1_i, y2_i, seg_i = vert[i]
        cur_x = x_i
        cur_y1 = y1_i
        cur_y2 = y2_i
        cur_thick = seg_i['thickness']
        cur_name = seg_i['name']

        for j in range(i + 1, len(vert)):
            if j in consumed:
                continue
            idx_j, x_j, y1_j, y2_j, seg_j = vert[j]

            if abs(x_j - cur_x) <= coord_tol:
                gap = y1_j - cur_y2
                overlap = min(cur_y2, y2_j) - max(cur_y1, y1_j)
                if gap <= gap_tol or overlap >= -coord_tol:
                    cur_y1 = min(cur_y1, y1_j)
                    cur_y2 = max(cur_y2, y2_j)
                    cur_x = float(np.median([cur_x, x_j]))
                    cur_thick = 0.5 * (cur_thick + seg_j['thickness'])
                    consumed.add(j)

        result.append({
            'line': LineString([(cur_x, cur_y1), (cur_x, cur_y2)]),
            'thickness': cur_thick,
            'name': cur_name
        })

    return result

def snap_near_endpoints(segments, snap_tol=0.25):
    """
    对近距离端点做统一吸附
    """
    if not segments:
        return segments

    pts = []
    for idx, seg in enumerate(segments):
        coords = list(seg['line'].coords)
        pts.append((idx, 0, coords[0]))
        pts.append((idx, 1, coords[-1]))

    clusters = []
    for item in pts:
        idx, end_flag, p = item
        assigned = False
        for c in clusters:
            cx, cy = c['center']
            if ((p[0]-cx)**2 + (p[1]-cy)**2)**0.5 <= snap_tol:
                c['items'].append(item)
                xs = [it[2][0] for it in c['items']]
                ys = [it[2][1] for it in c['items']]
                c['center'] = (float(np.mean(xs)), float(np.mean(ys)))
                assigned = True
                break
        if not assigned:
            clusters.append({
                'center': (p[0], p[1]),
                'items': [item]
            })

    segs = copy_segments(segments)

    for c in clusters:
        center = c['center']
        for idx, end_flag, p in c['items']:
            coords = list(segs[idx]['line'].coords)
            if end_flag == 0:
                new_line = LineString([center, coords[-1]])
            else:
                new_line = LineString([coords[0], center])

            new_line = snap_line_to_axis(new_line)
            if new_line is not None and new_line.length >= 0.08:
                segs[idx]['line'] = new_line

    return segs

def clean_duplicate_segments(segments, coord_tol=0.05):
    if not segments:
        return segments

    uniq = []
    keys = set()

    for s in segments:
        try:
            coords = list(s['line'].coords)
            x1, y1 = coords[0]
            x2, y2 = coords[-1]

            p1 = (round(x1 / coord_tol), round(y1 / coord_tol))
            p2 = (round(x2 / coord_tol), round(y2 / coord_tol))
            key = tuple(sorted([p1, p2]))

            if key in keys:
                continue
            keys.add(key)
            uniq.append(s)
        except:
            continue

    return uniq

def run_geometry_enhancement_v2(segments, logs):
    if not segments:
        return segments

    segs = copy_segments(segments)
    logs.append("V2增强-输入墙段数: {}".format(len(segs)))

    segs = align_parallel_segments(segs, coord_tol=0.35)
    logs.append("V2增强-平行对齐后: {}".format(len(segs)))

    segs = bridge_parallel_gaps(segs, coord_tol=0.25, gap_tol=0.8)
    logs.append("V2增强-平行短缝桥接后: {}".format(len(segs)))

    segs = bridge_near_orthogonal_gaps(segs, gap_tol=0.6, axis_tol=0.25)
    logs.append("V2增强-正交补缝后: {}".format(len(segs)))

    segs = snap_near_endpoints(segs, snap_tol=0.25)
    logs.append("V2增强-端点吸附后: {}".format(len(segs)))

    segs = merge_collinear_segments_strict(segs, coord_tol=0.08, gap_tol=0.35)
    logs.append("V2增强-严格共线合并后: {}".format(len(segs)))

    segs = clean_duplicate_segments(segs, coord_tol=0.05)
    logs.append("V2增强-去重后: {}".format(len(segs)))

    cleaned = []
    for s in segs:
        try:
            if s['line'] is None or s['line'].is_empty:
                continue
            if s['line'].length < 0.08:
                continue
            cleaned.append(s)
        except:
            continue

    logs.append("V2增强-最终墙段数: {}".format(len(cleaned)))
    return cleaned

# =========================
# 运行YOLO分割
# =========================
yolo_seg = YOLO(dect_Model, task="seg")
seg_result = yolo_seg(source=pixpath, save=False, conf=0.3, iou=0.45, imgsz=640)
cv2.imwrite(newpath, seg_result[0].plot())

result = seg_result[0]
boxes = result.boxes
xyxy = boxes.xyxy.cpu().numpy() if boxes is not None else np.empty((0,4))
cls_ids = boxes.cls.cpu().numpy().astype(int) if boxes is not None else np.array([], dtype=int)
names = result.names

# =========================
# 读取OCR尺寸JSON
# =========================
dims_data = None
horizontal_length_mm = None
vertical_length_mm = None

try:
    with open(dims_json_path, "r", encoding="utf-8") as f:
        dims_data = json.load(f)

    if dims_data.get("ok", False):
        if "result" in dims_data:
            horizontal_length_mm = dims_data["result"].get("horizontal_length", None)
            vertical_length_mm = dims_data["result"].get("vertical_length", None)
        else:
            horizontal_length_mm = dims_data.get("horizontal_length", None)
            vertical_length_mm = dims_data.get("vertical_length", None)

    logs.append("读取dims_json成功: horizontal={} mm, vertical={} mm".format(
        str(horizontal_length_mm), str(vertical_length_mm)
    ))
except Exception as e:
    logs.append("读取dims_json失败: {}".format(str(e)))

# =========================
# 先做结构mask -> bbox -> scale
# =========================
global_structure_mask, structure_class_counter = build_global_structure_mask(result, pixelWidth, pixelHeight, logs)
cleaned_global_structure_mask = clean_wall_mask(global_structure_mask, logs)
bbox_info = get_mask_bbox(cleaned_global_structure_mask, logs)

scale_x_mm_per_px = None
scale_y_mm_per_px = None
scale_avg_mm_per_px = None
scale_x_ft_per_px = None
scale_y_ft_per_px = None
scale_avg_ft_per_px = None

if bbox_info is not None and horizontal_length_mm is not None and vertical_length_mm is not None:
    try:
        bbox_w = bbox_info["width"]
        bbox_h = bbox_info["height"]

        if bbox_w > 0 and bbox_h > 0:
            scale_x_mm_per_px = float(horizontal_length_mm) / float(bbox_w)
            scale_y_mm_per_px = float(vertical_length_mm) / float(bbox_h)
            scale_avg_mm_per_px = (scale_x_mm_per_px + scale_y_mm_per_px) / 2.0

            mm_to_ft = 1.0 / 304.8
            scale_x_ft_per_px = scale_x_mm_per_px * mm_to_ft
            scale_y_ft_per_px = scale_y_mm_per_px * mm_to_ft
            scale_avg_ft_per_px = scale_avg_mm_per_px * mm_to_ft

            bbox_info_global = bbox_info
            scale_x_ft_per_px_global = scale_x_ft_per_px
            scale_y_ft_per_px_global = scale_y_ft_per_px

            logs.append("scale_x_mm_per_px={:.6f}".format(scale_x_mm_per_px))
            logs.append("scale_y_mm_per_px={:.6f}".format(scale_y_mm_per_px))
            logs.append("scale_avg_mm_per_px={:.6f}".format(scale_avg_mm_per_px))
            logs.append("scale_x_ft_per_px={:.6f}".format(scale_x_ft_per_px))
            logs.append("scale_y_ft_per_px={:.6f}".format(scale_y_ft_per_px))
        else:
            logs.append("bbox宽高无效，无法计算scale")
    except Exception as e:
        logs.append("scale计算失败: {}".format(str(e)))
else:
    logs.append("bbox或真实尺寸缺失，使用fallback整图scale")

# =========================
# Revit文档对象
# =========================
doc = DocumentManager.Instance.CurrentDBDocument
app = doc.Application

wall_type = None
wall_type_collector = FilteredElementCollector(doc).OfClass(WallType)

for wt in wall_type_collector:
    if wt.Kind == WallKind.Basic:
        name_param = wt.get_Parameter(BuiltInParameter.SYMBOL_NAME_PARAM)
        if name_param and name_param.AsString() == TARGET_WALL_TYPE_NAME:
            wall_type = wt
            break

if wall_type is None:
    for wt in wall_type_collector:
        if wt.Kind == WallKind.Basic:
            wall_type = wt
            break

if wall_type is None:
    raise Exception("项目中找不到任何基本墙类型！")

level = None
level_collector = FilteredElementCollector(doc).OfClass(Level)
for lvl in level_collector:
    name_param = lvl.get_Parameter(BuiltInParameter.LEVEL_NAME)
    if name_param and name_param.AsString() == TARGET_LEVEL_NAME:
        level = lvl
        break

if level is None:
    level = level_collector.FirstElement()
    if level is None:
        raise Exception("项目中找不到任何标高！")

TransactionManager.Instance.EnsureInTransaction(doc)

created_walls = []
wall_candidates = []

wallHeight = height

plane = Plane.CreateByNormalAndOrigin(XYZ.BasisZ, origin)
sketch_plane = SketchPlane.Create(doc, plane)

# =========================
# 提取中心线并创建墙
# =========================
if result.masks is not None:
    logs.append("YOLO类别映射: {}".format(str(result.names)))

    wall_candidates, default_wall_thickness, used_class_counter, final_mask_used = extract_wall_centerlines_from_global_mask(
        result, pixelWidth, pixelHeight, logs
    )

    logs.append("初始墙候选数量: {}".format(len(wall_candidates)))

    optimized_walls = optimize_wall_centerlines(
        wall_candidates,
        iter_count=1,
        enable_merge_collinear=False
    )

    logs.append("初步优化后墙数量: {}".format(len(optimized_walls)))

    # 第二版增强
    optimized_walls = run_geometry_enhancement_v2(optimized_walls, logs)

    for idx, w in enumerate(optimized_walls):
        try:
            line_geom = w['line']
            thickness_val = w['thickness']
            name = "Wall"

            coords = list(line_geom.coords)
            if len(coords) < 2:
                logs.append("墙{}失败：coords不足".format(idx))
                continue

            start_pt = XYZ(coords[0][0], coords[0][1], 0)
            end_pt = XYZ(coords[-1][0], coords[-1][1], 0)

            if start_pt.DistanceTo(end_pt) < 0.1:
                logs.append("墙{}失败：线太短".format(idx))
                continue

            revit_line = Line.CreateBound(start_pt, end_pt)

            logs.append("准备创建墙{}: len={:.3f}, thickness={:.3f}".format(
                idx, revit_line.Length, thickness_val
            ))

            wall = Wall.Create(doc, revit_line, wall_type.Id, level.Id, wallHeight, 0, False, False)

            try:
                param = wall.get_Parameter(BuiltInParameter.WALL_ATTR_WIDTH_PARAM)
                if param and not param.IsReadOnly:
                    param.Set(thickness_val)
            except Exception as e2:
                logs.append("墙{}宽度设置失败(可忽略): {}".format(idx, str(e2)))

            try:
                wall.Name = sanitize_name(name)
            except:
                pass

            created_walls.append(wall.ToDSType(True))
            logs.append("墙{}创建成功".format(idx))

        except Exception as e:
            logs.append("墙{}创建失败: {}".format(idx, str(e)))
            logs.append(traceback.format_exc())
            continue
else:
    logs.append("result.masks is None，没有分割mask")

# =========================
# 提交事务
# =========================
TransactionManager.Instance.TransactionTaskDone()
doc.Regenerate()

# =========================
# 写 seg_meta_json
# =========================
seg_meta = {
    "ok": True,
    "image_path": pixpath,
    "seg_vis_path": newpath,
    "dims_json_path": dims_json_path,
    "wall_bbox_px": bbox_info,
    "real_size_mm": {
        "horizontal_length": horizontal_length_mm,
        "vertical_length": vertical_length_mm
    },
    "scale": {
        "scale_x_mm_per_px": scale_x_mm_per_px,
        "scale_y_mm_per_px": scale_y_mm_per_px,
        "scale_avg_mm_per_px": scale_avg_mm_per_px,
        "scale_x_ft_per_px": scale_x_ft_per_px,
        "scale_y_ft_per_px": scale_y_ft_per_px,
        "scale_avg_ft_per_px": scale_avg_ft_per_px
    },
    "structure_mask_classes_used": structure_class_counter,
    "debug": {
        "pixelWidth": pixelWidth,
        "pixelHeight": pixelHeight,
        "wall_count": len(created_walls),
        "mask_count": len(result.masks.xy) if result.masks is not None else 0,
        "class_names": result.names,
        "log_count": len(logs)
    }
}

try:
    ensure_dir_of_file(seg_meta_json_path)
    with open(seg_meta_json_path, "w", encoding="utf-8") as f:
        json.dump(seg_meta, f, ensure_ascii=False, indent=2)
    logs.append("seg_meta_json已写出: {}".format(seg_meta_json_path))
except Exception as e:
    logs.append("seg_meta_json写出失败: {}".format(str(e)))

OUT = newpath, created_walls, seg_meta_json_path, logs
# ----------------------------------------
python_version_23 = Watch(python_script_23)  # graph output
python_paths_5 = Watch(python_script_6)  # graph output
imagepath_5 = Filename("..\tests\a2室1厅1厨1卫-67.01㎡-南-103108006504.jpg")
imagepath_6 = Filename("..\tests\a3室2厅1厨1卫-87.3㎡-南-103104280748.jpg")
