# Dynamo graph Almost_Modelings.dyn (Dynamo 3.0.3.7597)

imagepath = Filename("..\tests\a3室2厅1厨1卫-107.04㎡-南 北-103101807914.jpg")
file_from_path = FileObject(path=imagepath)
readFromFile = Image.ReadFromFile(file=file_from_path)
watch_image = WatchImageCore(image=readFromFile)
modelpath = Filename("E:\yanjiu\hou_pracs_on\Testings\Saves\best_detect1.pt")
scale = DoubleInput(57)
seg_WWTD_Modelpath = Filename("..\..\hou_pracs_on\Testings\Saves\best_WWTD2_seg.pt")
number = DoubleInput(9.94)
exe_path = Filename("C:\Users\Lenovo\anaconda3\envs\revitenv\python.exe")
script_path = Filename("..\..\hou_pracs_on\revit_paddleocr_tests\jsons\ocr_runner.py")
string = StringInput("E:\yanjiu\hou_pracs_on\revit_paddleocr_tests\jsons")
json_path = Filename("..\..\hou_pracs_on\revit_paddleocr_tests\jsons\Test1.json")
read_length_export2Json = Python(IN[0]=imagepath, IN[1]=exe_path, IN[2]=script_path, IN[3]=string, IN[4]=json_path)  # CPython3
# ---------- read_length_export2Json.python (217 lines) ----------
# 加载 Python Standard 和 DesignScript 库
import sys
import clr
clr.AddReference('ProtoGeometry')
from Autodesk.DesignScript.Geometry import *

import os
import json
import subprocess
import shutil
import re

# IN[0] = 原始图片长路径（不能动）
# IN[1] = revitenv python.exe 路径
# IN[2] = ocr_runner.py 路径
# IN[3] = 临时工作目录，例如 E:\temp_ocr
# IN[4] = json 输出路径，例如 E:\temp_ocr\ocr_result.json

src_image_path = IN[0]
python_exe = IN[1]
script_path = IN[2]
work_dir = IN[3]
output_json = IN[4]

def ensure_dir(path):
    if not os.path.exists(path):
        os.makedirs(path)

def classify_text(text):
    t = (text or "").strip()

    room_keywords = ["客厅", "卧室", "厨房", "卫生间", "阳台", "餐厅", "书房", "主卧", "次卧"]
    if any(k in t for k in room_keywords):
        return "room_name"

    if re.match(r'^\d+(\.\d+)?\s*(m²|m2|㎡)$', t, re.I):
        return "area"

    if re.match(r'^\d+(\.\d+)?$', t):
        return "number"

    # 含尺寸链常见符号/字母/数字
    if re.search(r'[\dKk→—\-米]+', t):
        nums = extract_dimension_numbers(t)
        if len(nums) >= 2:
            return "dimension_chain"
        elif len(nums) == 1:
            return "dimension_like"

    return "other"

def normalize_area_text(text):
    t = (text or "").strip()
    t = t.replace("㎡", "m²")
    t = re.sub(r'(?i)m2', 'm²', t)
    return t

def extract_dimension_numbers(text):
    """
    从类似 'K1280→1325→1905—→K3390—715' 中提取数字序列
    返回 [1280,1325,1905,3390,715]
    """
    if not text:
        return []
    nums = re.findall(r'\d+(?:\.\d+)?', text)
    result = []
    for n in nums:
        try:
            if "." in n:
                result.append(float(n))
            else:
                result.append(int(n))
        except:
            pass
    return result

def is_valid_item(item):
    text = (item.get("text") or "").strip()
    score = float(item.get("score", 0))
    kind = item.get("kind", "other")

    if not text:
        return False

    # 不同类型不同阈值
    if kind == "room_name":
        return score >= 0.75
    elif kind == "area":
        return score >= 0.75
    elif kind == "number":
        return score >= 0.85
    elif kind == "dimension_chain":
        # 尺寸链可以稍微放宽，因为经常混入符号
        return score >= 0.70 or len(item.get("dimension_numbers", [])) >= 2
    elif kind == "dimension_like":
        return score >= 0.75
    else:
        return score >= 0.75

def poly_center(poly):
    try:
        xs = [p[0] for p in poly]
        ys = [p[1] for p in poly]
        return [sum(xs) / float(len(xs)), sum(ys) / float(len(ys))]
    except:
        return None

try:
    ensure_dir(work_dir)

    # 固定复制输出图像
    test_image_path = os.path.join(work_dir, "Test1.jpg")

    # 直接复制文件，最稳
    shutil.copyfile(src_image_path, test_image_path)

    # 调外部 python
    cmd = [python_exe, script_path, test_image_path, output_json]

    p = subprocess.Popen(
        cmd,
        stdout=subprocess.PIPE,
        stderr=subprocess.PIPE,
        shell=False
    )
    stdout, stderr = p.communicate()

    stdout_text = stdout.decode("utf-8", errors="ignore")
    stderr_text = stderr.decode("utf-8", errors="ignore")

    if not os.path.exists(output_json):
        OUT = {
            "ok": False,
            "error": "output_json not found",
            "src_image_path": src_image_path,
            "test_image_path": test_image_path,
            "cmd": cmd,
            "stdout": stdout_text,
            "stderr": stderr_text
        }
    else:
        with open(output_json, "r", encoding="utf-8") as f:
            data = json.load(f)

        if not data.get("ok", False):
            OUT = {
                "ok": False,
                "src_image_path": src_image_path,
                "test_image_path": test_image_path,
                "cmd": cmd,
                "stdout": stdout_text,
                "stderr": stderr_text,
                "json": data
            }
        else:
            items = data.get("items", [])
            processed_items = []

            for item in items:
                text = (item.get("text") or "").strip()
                score = float(item.get("score", 0))
                poly = item.get("poly", None)

                clean_text = normalize_area_text(text)
                kind = classify_text(clean_text)
                dim_nums = extract_dimension_numbers(clean_text)
                center = poly_center(poly) if isinstance(poly, list) else None

                item2 = {
                    "text": text,
                    "clean_text": clean_text,
                    "score": score,
                    "poly": poly,
                    "center": center,
                    "kind": kind,
                    "dimension_numbers": dim_nums
                }

                item2["valid"] = is_valid_item(item2)
                processed_items.append(item2)

            valid_items = [x for x in processed_items if x["valid"]]
            invalid_items = [x for x in processed_items if not x["valid"]]

            room_items = [x for x in valid_items if x["kind"] == "room_name"]
            area_items = [x for x in valid_items if x["kind"] == "area"]
            number_items = [x for x in valid_items if x["kind"] == "number"]
            dimension_chain_items = [x for x in valid_items if x["kind"] == "dimension_chain"]
            dimension_like_items = [x for x in valid_items if x["kind"] == "dimension_like"]
            other_items = [x for x in valid_items if x["kind"] == "other"]

            OUT = {
                "ok": True,
                "src_image_path": src_image_path,
                "test_image_path": test_image_path,
                "output_json": output_json,
                "cmd": cmd,
                "stdout": stdout_text,
                "stderr": stderr_text,
                "all_items": processed_items,
                "valid_items": valid_items,
                "invalid_items": invalid_items,
                "room_items": room_items,
                "area_items": area_items,
                "number_items": number_items,
                "dimension_chain_items": dimension_chain_items,
                "dimension_like_items": dimension_like_items,
                "other_items": other_items
            }
            OUT = output_json

except Exception as e:
    OUT = {
        "ok": False,
        "error": str(e),
        "src_image_path": src_image_path
    }
# ----------------------------------------
layout_Process_data_JsonPath = Filename("..\..\hou_pracs_on\revit_paddleocr_tests\jsons\Test1_dims.json")
wash_json_2_Length = Python(IN[0]=read_length_export2Json, IN[1]=layout_Process_data_JsonPath)  # CPython3
# ---------- wash_json_2_Length.python (265 lines) ----------
# 加载 Python Standard 和 DesignScript 库
import sys
import clr
clr.AddReference('ProtoGeometry')
from Autodesk.DesignScript.Geometry import *
#-----------------------
import json
import re
import os

ocr_json_path = IN[0]
result_json_path = IN[1]

def ensure_dir_of_file(file_path):
    folder = os.path.dirname(file_path)
    if folder and not os.path.exists(folder):
        os.makedirs(folder)

def get_poly(item):
    return item.get("poly", None)

def get_center(item):
    poly = get_poly(item)
    if poly:
        xs = [p[0] for p in poly]
        ys = [p[1] for p in poly]
        return sum(xs) / float(len(xs)), sum(ys) / float(len(ys))
    return None, None

def get_width_height(item):
    poly = get_poly(item)
    if not poly:
        return None, None
    xs = [p[0] for p in poly]
    ys = [p[1] for p in poly]
    return max(xs) - min(xs), max(ys) - min(ys)

def infer_axis(item):
    w, h = get_width_height(item)
    if w is None or h is None:
        return "unknown"
    if w >= h * 1.5:
        return "horizontal"
    elif h >= w * 1.5:
        return "vertical"
    else:
        return "unknown"

def extract_numbers_from_text(text):
    nums = re.findall(r'\d+(?:\.\d+)?', text or "")
    result = []
    for n in nums:
        try:
            v = float(n)
            if 100 <= v <= 50000:
                # 尽量转 int，便于后续使用
                if abs(v - int(v)) < 1e-6:
                    result.append(int(v))
                else:
                    result.append(v)
        except:
            pass
    return result

def classify_text(text):
    nums = extract_numbers_from_text(text)
    if len(nums) >= 2:
        return "dimension_chain"
    elif len(nums) == 1:
        return "number"
    return "other"

def is_valid_dimension_item(item):
    text = str(item.get("text", "")).strip()
    score = float(item.get("score", 0))
    kind = classify_text(text)
    nums = extract_numbers_from_text(text)

    if len(nums) == 0:
        return False

    if kind in ["number", "dimension_chain"] and score >= 0.75:
        return True

    return False

def build_processed_items(items):
    result = []
    for item in items:
        text = str(item.get("text", "")).strip()
        nums = extract_numbers_from_text(text)
        kind = classify_text(text)
        center = get_center(item)

        result.append({
            "text": text,
            "score": float(item.get("score", 0)),
            "poly": item.get("poly", None),
            "center": center,
            "kind": kind,
            "dimension_numbers": nums,
            "valid": is_valid_dimension_item(item)
        })
    return result

def group_items(items, axis, tol=60):
    groups = []

    for item in items:
        x, y = item.get("center", (None, None))
        if x is None:
            continue

        coord = y if axis == "horizontal" else x

        found = None
        for g in groups:
            if abs(g["coord"] - coord) <= tol:
                found = g
                break

        if found is None:
            found = {"axis": axis, "coord": coord, "items": []}
            groups.append(found)

        found["items"].append(item)

    # 更新组坐标
    for g in groups:
        vals = []
        for it in g["items"]:
            x, y = it.get("center", (None, None))
            vals.append(y if axis == "horizontal" else x)
        if vals:
            g["coord"] = sum(vals) / float(len(vals))

    return groups

def dedup_group_numbers(group, axis):
    entries = []

    for item in group["items"]:
        nums = item.get("dimension_numbers", [])
        x, y = item.get("center", (None, None))
        pos = x if axis == "horizontal" else y

        for n in nums:
            entries.append({
                "value": n,
                "pos": pos,
                "text": item.get("text", "")
            })

    entries = sorted(entries, key=lambda e: e["pos"] if e["pos"] is not None else 0)

    deduped = []
    for e in entries:
        duplicated = False
        for d in deduped:
            same_value = (d["value"] == e["value"])
            close_pos = False
            if d["pos"] is not None and e["pos"] is not None:
                close_pos = abs(d["pos"] - e["pos"]) <= 20
            if same_value and close_pos:
                duplicated = True
                break
        if not duplicated:
            deduped.append(e)

    return deduped

def summarize_group(group, axis):
    deduped = dedup_group_numbers(group, axis)
    values = [e["value"] for e in deduped]

    texts = []
    seen = set()
    for item in group["items"]:
        t = item.get("text", "")
        if t not in seen:
            texts.append(t)
            seen.add(t)

    return {
        "axis": axis,
        "coord": group["coord"],
        "count": len(group["items"]),
        "values": values,
        "sum": sum(values) if values else None,
        "texts": texts
    }

try:
    with open(ocr_json_path, "r", encoding="utf-8") as f:
        data = json.load(f)

    if not data.get("ok", False):
        result_data = {
            "ok": False,
            "error": "ocr json not ok",
            "source_json": ocr_json_path
        }
    else:
        raw_items = data.get("items", [])
        items = build_processed_items(raw_items)

        dim_items = [it for it in items if it["valid"]]

        horizontal_items = [it for it in dim_items if infer_axis(it) == "horizontal"]
        vertical_items = [it for it in dim_items if infer_axis(it) == "vertical"]

        horizontal_groups = [summarize_group(g, "horizontal") for g in group_items(horizontal_items, "horizontal", 60)]
        vertical_groups = [summarize_group(g, "vertical") for g in group_items(vertical_items, "vertical", 60)]

        horizontal_groups = [g for g in horizontal_groups if g["sum"] is not None]
        vertical_groups = [g for g in vertical_groups if g["sum"] is not None]

        horizontal_groups = sorted(horizontal_groups, key=lambda g: g["sum"], reverse=True)
        vertical_groups = sorted(vertical_groups, key=lambda g: g["sum"], reverse=True)

        horizontal_main = horizontal_groups[0] if horizontal_groups else None
        vertical_main = vertical_groups[0] if vertical_groups else None

        result_data = {
            "ok": True,
            "source_json": ocr_json_path,
            "result": {
                "horizontal_length": horizontal_main["sum"] if horizontal_main else None,
                "vertical_length": vertical_main["sum"] if vertical_main else None,
                "horizontal_candidates": [g["sum"] for g in horizontal_groups],
                "vertical_candidates": [g["sum"] for g in vertical_groups],
                "horizontal_segments": horizontal_main["values"] if horizontal_main else [],
                "vertical_segments": vertical_main["values"] if vertical_main else [],
                "horizontal_coord": horizontal_main["coord"] if horizontal_main else None,
                "vertical_coord": vertical_main["coord"] if vertical_main else None
            },
            "debug": {
                "horizontal_groups": horizontal_groups,
                "vertical_groups": vertical_groups
            }
        }

    ensure_dir_of_file(result_json_path)
    with open(result_json_path, "w", encoding="utf-8") as f:
        json.dump(result_data, f, ensure_ascii=False, indent=2)

    #----------------
    OUT = result_json_path

except Exception as e:
    err = {
        "ok": False,
        "error": str(e),
        "source_json": ocr_json_path,
        "result_json_path": result_json_path
    }

    try:
        ensure_dir_of_file(result_json_path)
        with open(result_json_path, "w", encoding="utf-8") as f:
            json.dump(err, f, ensure_ascii=False, indent=2)
    except:
        pass

    OUT = result_json_path
# ----------------------------------------
python_version = Watch(wash_json_2_Length)  # graph output
seg_meta_Json_Path = Filename("..\..\hou_pracs_on\revit_paddleocr_tests\jsons\seg_meta.json")
python_script = Python(IN[0]=seg_WWTD_Modelpath, IN[1]=imagepath, IN[2]=number, IN[3]=scale, IN[4]=python_version, IN[5]=seg_meta_Json_Path)  # CPython3
# ---------- python_script.python (2081 lines) ----------
# 加载 Python Standard 和 DesignScript 库
# --------------------------------
import sys
import clr

clr.AddReference('ProtoGeometry')
from Autodesk.DesignScript.Geometry import *
import Autodesk.DesignScript.Geometry as DS

import System

sys.path.append("C:/Users/Lenovo/anaconda3/envs/revitenv/Lib/site-packages")

clr.AddReference('RevitAPI')
clr.AddReference('RevitAPIUI')
from Autodesk.Revit.DB import *
from Autodesk.Revit.UI import *

clr.AddReference('RevitServices')
from RevitServices.Persistence import DocumentManager
from RevitServices.Transactions import TransactionManager

clr.AddReference('RevitNodes')
import Revit
clr.ImportExtensions(Revit.Elements)
clr.ImportExtensions(Revit.GeometryConversion)

import re
import math
import json
import os
import traceback
import numpy as np
import cv2

from shapely.geometry import LineString
from shapely.geometry import Polygon as ShpPolygon
from shapely.geometry import MultiPolygon as ShpMultiPolygon

from skimage.morphology import skeletonize
from ultralytics import YOLO

dataEnteringNode = IN

# =========================
# 输入
# =========================
dect_Model = IN[0]
pixpath = IN[1]
height = IN[2]
scale = IN[3]
dims_json_path = IN[4]
seg_meta_json_path = IN[5]

# =========================
# 基础参数
# =========================
origin = XYZ(0, 0, 0)
widthFt = scale
pixelWidth = 1600
pixelHeight = 1200

EPS = 1e-6

# 当前 OCR JSON 中的 horizontal_length / vertical_length 按墙体轴线尺寸理解。
# 但结构 mask / bbox 更接近墙体外轮廓。
# 基本墙厚 200mm，两端各半墙厚，总补偿 200mm。
AXIS_DIM_CORRECTION_MM = 200.0

# =========================
# BIM 墙类型配置
# =========================
# 外墙类型：Revit下拉列表中显示的 200mm 墙
EXTERIOR_WALL_TYPE_KEYWORD = "基本墙 常规 - 200mm"

# 内墙类型：Revit下拉列表中显示的 138mm 隔断
INTERIOR_WALL_TYPE_KEYWORD = "内部-138mm隔断"

# 默认兜底墙类型
TARGET_WALL_TYPE_NAME = "基本墙 200mm"

TARGET_LEVEL_NAME = "标高 2"

# 内外墙判定参数
EXTERIOR_WALL_MM = 200.0
INTERIOR_WALL_MM = 138.0

# 以 200 和 138 的中间值作为厚度阈值
WALL_THICKNESS_THRESHOLD_MM = (EXTERIOR_WALL_MM + INTERIOR_WALL_MM) / 2.0

#判断是否靠近外边界的距离阈值--------
OUTER_BOUNDARY_NEAR_MM = 260.0

#分割可视化输出----------
newpath = "E:/yanjiu/revitss/tests/jjianzhu_seg.jpg"

#fallback整图比例---------------
scaleX = widthFt / pixelWidth if pixelWidth > 0 else 0.0
scaleY = widthFt * (pixelHeight / pixelWidth) / pixelHeight if pixelWidth > 0 and pixelHeight > 0 else 0.0

bbox_info_global = None
scale_x_ft_per_px_global = None
scale_y_ft_per_px_global = None

scale_x_mm_per_px = None
scale_y_mm_per_px = None
scale_avg_mm_per_px = None
scale_x_ft_per_px = None
scale_y_ft_per_px = None
scale_avg_ft_per_px = None

logs = []

# =========================
# utils funcs
# =========================
def ensure_dir_of_file(file_path):
    folder = os.path.dirname(file_path)
    if folder and not os.path.exists(folder):
        os.makedirs(folder)


def sanitize_name(name):
    if not name:
        return "Unknown"
    cleaned = re.sub(r'[\x00-\x1f\x7f]', '', name)
    if not cleaned.strip():
        return "Unnamed"
    return cleaned


def pix_to_revit(x, y):
    global bbox_info_global, scale_x_ft_per_px_global, scale_y_ft_per_px_global

    try:
        if bbox_info_global is not None and scale_x_ft_per_px_global is not None and scale_y_ft_per_px_global is not None:
            min_x = bbox_info_global["min_x"]
            min_y = bbox_info_global["min_y"]
            bbox_h = bbox_info_global["height"]

            local_x = x - min_x
            local_y = y - min_y

            revit_x = origin.X + local_x * scale_x_ft_per_px_global
            revit_y = origin.Y + (bbox_h - local_y) * scale_y_ft_per_px_global
            return XYZ(revit_x, revit_y, origin.Z)
    except:
        pass

    revit_x = origin.X + x * scaleX
    revit_y = origin.Y + (pixelHeight - y) * scaleY
    return XYZ(revit_x, revit_y, origin.Z)


def revit_to_pix_xy(rx, ry):
    global bbox_info_global, scale_x_ft_per_px_global, scale_y_ft_per_px_global

    try:
        if bbox_info_global is not None and scale_x_ft_per_px_global is not None and scale_y_ft_per_px_global is not None:
            min_x = bbox_info_global["min_x"]
            min_y = bbox_info_global["min_y"]
            bbox_h = bbox_info_global["height"]

            local_x = (rx - origin.X) / scale_x_ft_per_px_global
            local_y = bbox_h - ((ry - origin.Y) / scale_y_ft_per_px_global)

            px = local_x + min_x
            py = local_y + min_y

            return float(px), float(py)
    except:
        pass

    px = (rx - origin.X) / scaleX if scaleX != 0 else 0
    py = pixelHeight - ((ry - origin.Y) / scaleY) if scaleY != 0 else 0
    return float(px), float(py)


def get_mask_bbox(binary_mask, logs):
    if binary_mask is None:
        logs.append("get_mask_bbox失败: binary_mask is None")
        return None

    ys, xs = np.where(binary_mask > 0)
    if len(xs) == 0 or len(ys) == 0:
        logs.append("get_mask_bbox失败: 墙体mask为空")
        return None

    min_x = int(np.min(xs))
    max_x = int(np.max(xs))
    min_y = int(np.min(ys))
    max_y = int(np.max(ys))

    bbox = {
        "min_x": min_x,
        "min_y": min_y,
        "max_x": max_x,
        "max_y": max_y,
        "width": int(max_x - min_x + 1),
        "height": int(max_y - min_y + 1)
    }

    logs.append("结构mask bbox: {}".format(str(bbox)))
    return bbox


def get_wall_type_name(wt):
    try:
        p = wt.get_Parameter(BuiltInParameter.SYMBOL_NAME_PARAM)
        if p:
            return p.AsString()
    except:
        pass

    try:
        return wt.Name
    except:
        return "Unknown"


def get_wall_type_by_keyword(doc, keyword, logs):
    """
    根据墙类型名称关键字查找 Basic WallType。
    keyword 可以是完整类型名，也可以是部分名称。
    """
    if keyword is None:
        return None

    keyword = str(keyword).strip()
    if not keyword:
        return None

    wall_type_collector = FilteredElementCollector(doc).OfClass(WallType)

    exact_match = None
    fuzzy_match = None
    available_names = []

    for wt in wall_type_collector:
        try:
            if wt.Kind != WallKind.Basic:
                continue

            type_name = get_wall_type_name(wt)

            family_name = ""
            try:
                family_param = wt.get_Parameter(BuiltInParameter.SYMBOL_FAMILY_NAME_PARAM)
                if family_param:
                    family_name = family_param.AsString()
            except:
                family_name = ""

            full_name = "{} {}".format(family_name, type_name)
            available_names.append(full_name)

            if type_name == keyword or full_name == keyword:
                exact_match = wt
                break

            if keyword in type_name or keyword in full_name:
                fuzzy_match = wt

        except Exception as e:
            logs.append("读取墙类型失败: {}".format(str(e)))
            continue

    if exact_match is not None:
        logs.append("墙类型精确匹配成功: {}".format(keyword))
        return exact_match

    if fuzzy_match is not None:
        logs.append("墙类型模糊匹配成功: {}".format(keyword))
        return fuzzy_match

    logs.append("未找到墙类型关键字: {}".format(keyword))
    logs.append("当前项目可用墙类型: {}".format(str(available_names)))

    return None


# =========================
# 类别配置class type
# =========================
STRUCTURE_CLASS_KEYWORDS = [
    "wall",
    "墙",
    "墙体",
    "basic wall",
    "door",
    "门",
    "tdoor",
    "double door",
    "window",
    "窗",
    "窗户"
]

STRUCTURE_CLASS_EXACT = set([
    "wall",
    "door",
    "window",
    "tdoor"
])

EXPAND_CLASSES = set([
    "door",
    "window",
    "tdoor"
])


def normalize_class_name(name):
    if name is None:
        return ""
    return str(name).strip().lower()


def is_structure_wall_like_class(name):
    n = normalize_class_name(name)
    if not n:
        return False

    if n in STRUCTURE_CLASS_EXACT:
        return True

    for kw in STRUCTURE_CLASS_KEYWORDS:
        if kw.lower() in n:
            return True

    return False


# =========================
# 几何tools-----
# =========================
def snap_line_to_axis(line_geom):
    if line_geom is None or line_geom.is_empty:
        return None

    coords = list(line_geom.coords)
    if len(coords) < 2:
        return None

    x1, y1 = coords[0]
    x2, y2 = coords[-1]
    dx = x2 - x1
    dy = y2 - y1

    if abs(dx) >= abs(dy):
        ym = 0.5 * (y1 + y2)
        return LineString([(x1, ym), (x2, ym)])
    else:
        xm = 0.5 * (x1 + x2)
        return LineString([(xm, y1), (xm, y2)])


def get_line_orientation_from_geom(line_geom):
    coords = list(line_geom.coords)
    x1, y1 = coords[0]
    x2, y2 = coords[-1]

    if abs(y2 - y1) <= abs(x2 - x1):
        return "h"
    return "v"


def get_line_orientation(seg):
    return get_line_orientation_from_geom(seg['line'])


def copy_segments(segments):
    """
    保留所有字段，防止 wall_kind、width_mm 等扩展信息丢失。
    """
    out = []
    for s in segments:
        ns = {}
        for k, v in s.items():
            ns[k] = v
        out.append(ns)
    return out


def point_to_segment_distance(pt, a, b):
    px, py = pt
    ax, ay = a
    bx, by = b

    dx = bx - ax
    dy = by - ay

    if abs(dx) < EPS and abs(dy) < EPS:
        return ((px - ax) ** 2 + (py - ay) ** 2) ** 0.5, a, 0.0

    t = ((px - ax) * dx + (py - ay) * dy) / (dx * dx + dy * dy)
    t_clamped = max(0.0, min(1.0, t))

    qx = ax + t_clamped * dx
    qy = ay + t_clamped * dy

    dist = ((px - qx) ** 2 + (py - qy) ** 2) ** 0.5

    return dist, (qx, qy), t_clamped


def merge_close_vertices(segments, delta):
    pts = []

    for seg in segments:
        coords = list(seg['line'].coords)
        pts.append(coords[0])
        pts.append(coords[-1])

    if not pts:
        return segments

    clusters = []

    for p in pts:
        assigned = False

        for cluster in clusters:
            cx, cy, plist = cluster
            d2 = (p[0] - cx) ** 2 + (p[1] - cy) ** 2

            if d2 < delta * delta:
                plist.append(p)
                nx = sum(pp[0] for pp in plist) / len(plist)
                ny = sum(pp[1] for pp in plist) / len(plist)
                cluster[0] = nx
                cluster[1] = ny
                assigned = True
                break

        if not assigned:
            clusters.append([p[0], p[1], [p]])

    def snap_point(p):
        best = p
        best_d = 1e18

        for cx, cy, plist in clusters:
            d2 = (p[0] - cx) ** 2 + (p[1] - cy) ** 2
            if d2 < best_d:
                best_d = d2
                best = (cx, cy)

        return best

    new_segments = []

    for seg in segments:
        coords = list(seg['line'].coords)
        p1 = snap_point(coords[0])
        p2 = snap_point(coords[-1])

        if ((p1[0] - p2[0]) ** 2 + (p1[1] - p2[1]) ** 2) ** 0.5 < 0.1:
            continue

        new_line = snap_line_to_axis(LineString([p1, p2]))

        if new_line is None:
            continue

        ns = {}
        for k, v in seg.items():
            ns[k] = v
        ns['line'] = new_line

        new_segments.append(ns)

    return new_segments


def split_segments_by_near_vertices(segments, delta):
    if not segments:
        return segments

    vertices = []

    for seg in segments:
        coords = list(seg['line'].coords)
        vertices.append(coords[0])
        vertices.append(coords[-1])

    new_segments = []

    for idx, seg in enumerate(segments):
        coords = list(seg['line'].coords)
        a = coords[0]
        b = coords[-1]

        split_pts = []

        for v in vertices:
            if v == a or v == b:
                continue

            dist, proj, t = point_to_segment_distance(v, a, b)

            if dist < delta and t > 0.01 and t < 0.99:
                split_pts.append((t, v))

        if not split_pts:
            new_segments.append(seg)
        else:
            split_pts.sort(key=lambda x: x[0])
            chain = [a] + [v for _, v in split_pts] + [b]

            for p1, p2 in zip(chain[:-1], chain[1:]):
                if ((p1[0] - p2[0]) ** 2 + (p1[1] - p2[1]) ** 2) ** 0.5 < 0.1:
                    continue

                new_line = snap_line_to_axis(LineString([p1, p2]))

                if new_line is None:
                    continue

                ns = {}
                for k, v in seg.items():
                    ns[k] = v
                ns['line'] = new_line

                new_segments.append(ns)

    return new_segments


def merge_collinear_segments_strict(segments, coord_tol=0.08, gap_tol=0.25):
    if not segments:
        return segments

    horizontal = []
    vertical = []
    others = []

    for seg in segments:
        coords = list(seg['line'].coords)
        x1, y1 = coords[0]
        x2, y2 = coords[-1]

        if abs(y2 - y1) <= coord_tol:
            y = 0.5 * (y1 + y2)
            xmin, xmax = min(x1, x2), max(x1, x2)
            horizontal.append((y, xmin, xmax, seg))

        elif abs(x2 - x1) <= coord_tol:
            x = 0.5 * (x1 + x2)
            ymin, ymax = min(y1, y2), max(y1, y2)
            vertical.append((x, ymin, ymax, seg))

        else:
            others.append(seg)

    merged = []

    horizontal.sort(key=lambda t: (round(t[0], 2), t[1]))
    used = [False] * len(horizontal)

    for i in range(len(horizontal)):
        if used[i]:
            continue

        y, x1, x2, seg = horizontal[i]
        base_seg = seg

        for j in range(i + 1, len(horizontal)):
            if used[j]:
                continue

            y2, xx1, xx2, seg2 = horizontal[j]

            if abs(y2 - y) <= coord_tol and xx1 <= x2 + gap_tol:
                x2 = max(x2, xx2)
                used[j] = True

        ns = {}
        for k, v in base_seg.items():
            ns[k] = v
        ns['line'] = LineString([(x1, y), (x2, y)])

        merged.append(ns)

    vertical.sort(key=lambda t: (round(t[0], 2), t[1]))
    used = [False] * len(vertical)

    for i in range(len(vertical)):
        if used[i]:
            continue

        x, y1, y2, seg = vertical[i]
        base_seg = seg

        for j in range(i + 1, len(vertical)):
            if used[j]:
                continue

            x2, yy1, yy2, seg2 = vertical[j]

            if abs(x2 - x) <= coord_tol and yy1 <= y2 + gap_tol:
                y2 = max(y2, yy2)
                used[j] = True

        ns = {}
        for k, v in base_seg.items():
            ns[k] = v
        ns['line'] = LineString([(x, y1), (x, y2)])

        merged.append(ns)

    merged.extend(others)

    return merged


def optimize_wall_centerlines(candidates, iter_count=1, enable_merge_collinear=True):
    if not candidates:
        return []

    segs = candidates[:]

    if enable_merge_collinear:
        segs = merge_collinear_segments_strict(segs, coord_tol=0.08, gap_tol=0.35)

    for _ in range(iter_count):
        if not segs:
            break

        avg_t = sum(s['thickness'] for s in segs) / max(len(segs), 1)
        delta = 0.20 * avg_t

        if delta < 0.03:
            delta = 0.03
        if delta > 0.12:
            delta = 0.12

        segs = merge_close_vertices(segs, delta)
        segs = split_segments_by_near_vertices(segs, delta)

    cleaned = []

    for s in segs:
        try:
            if s['line'] is None or s['line'].is_empty:
                continue
            if s['line'].length < 0.08:
                continue
            cleaned.append(s)
        except:
            continue

    return cleaned


# =========================
# mask构建与清理
# =========================
def build_global_structure_mask(result, pixelWidth, pixelHeight, logs):
    wall_mask = np.zeros((pixelHeight, pixelWidth), dtype=np.uint8)
    class_counter = {}

    if result.masks is None:
        logs.append("result.masks is None")
        return wall_mask, class_counter

    masks_xy = result.masks.xy
    cls_ids = result.boxes.cls.cpu().numpy().astype(int)
    names = result.names

    logs.append("总mask数量: {}".format(len(masks_xy)))

    expand_kernel = cv2.getStructuringElement(cv2.MORPH_RECT, (5, 5))

    for i, contour_pts in enumerate(masks_xy):
        try:
            if i >= len(cls_ids):
                continue

            class_id = cls_ids[i]
            class_name = names[class_id]
            class_name_norm = normalize_class_name(class_name)

            if not is_structure_wall_like_class(class_name):
                continue

            pts = np.array(contour_pts, dtype=np.int32)

            if len(pts) < 3:
                continue

            pts[:, 0] = np.clip(pts[:, 0], 0, pixelWidth - 1)
            pts[:, 1] = np.clip(pts[:, 1], 0, pixelHeight - 1)

            if class_name_norm in EXPAND_CLASSES:
                temp = np.zeros((pixelHeight, pixelWidth), dtype=np.uint8)
                cv2.fillPoly(temp, [pts], 255)
                temp = cv2.dilate(temp, expand_kernel, iterations=1)
                wall_mask[temp > 0] = 255
            else:
                cv2.fillPoly(wall_mask, [pts], 255)

            class_counter[class_name_norm] = class_counter.get(class_name_norm, 0) + 1

        except Exception as e:
            logs.append("合成结构mask失败 idx={}: {}".format(i, str(e)))
            continue

    logs.append("参与墙体生成的类别统计: {}".format(str(class_counter)))

    return wall_mask, class_counter


def clean_wall_mask(binary_mask, logs):
    mask = binary_mask.copy()

    kernel_bridge = cv2.getStructuringElement(cv2.MORPH_RECT, (3, 3))
    kernel_close_big = cv2.getStructuringElement(cv2.MORPH_RECT, (7, 7))
    kernel_close_small = cv2.getStructuringElement(cv2.MORPH_RECT, (5, 5))

    mask = cv2.dilate(mask, kernel_bridge, iterations=1)
    mask = cv2.morphologyEx(mask, cv2.MORPH_CLOSE, kernel_close_big)
    mask = cv2.morphologyEx(mask, cv2.MORPH_CLOSE, kernel_close_small)
    mask = cv2.erode(mask, kernel_bridge, iterations=1)

    num_labels, labels, stats, _ = cv2.connectedComponentsWithStats(mask, connectivity=8)
    cleaned = np.zeros_like(mask)

    for i in range(1, num_labels):
        area = stats[i, cv2.CC_STAT_AREA]

        if area >= 30:
            cleaned[labels == i] = 255

    logs.append("结构mask清理完成")
    return cleaned


def estimate_wall_width_pixels(binary_mask, logs):
    if binary_mask is None or binary_mask.max() == 0:
        logs.append("墙宽估计失败：mask为空")
        return 6.0

    dist = cv2.distanceTransform(binary_mask, cv2.DIST_L2, 5)
    vals = dist[dist > 0]

    if len(vals) == 0:
        logs.append("墙宽估计失败：distanceTransform为空")
        return 6.0

    wall_width_px = max(2.0, 2.0 * np.median(vals))
    logs.append("估计全局墙宽像素值: {:.2f}".format(wall_width_px))

    return wall_width_px


def skeletonize_wall_mask(binary_mask, logs):
    try:
        skel = skeletonize(binary_mask > 0)
        logs.append("使用 skimage.skeletonize 成功")
        return skel.astype(np.uint8)
    except Exception as e:
        logs.append("skimage骨架失败: {}".format(str(e)))
        return skeletonize_fallback(binary_mask, logs)


def skeletonize_fallback(binary_mask, logs):
    img = (binary_mask > 0).astype(np.uint8) * 255
    size = np.size(img)
    skel = np.zeros(img.shape, np.uint8)

    element = cv2.getStructuringElement(cv2.MORPH_CROSS, (3, 3))
    done = False

    while not done:
        eroded = cv2.erode(img, element)
        temp = cv2.dilate(eroded, element)
        temp = cv2.subtract(img, temp)
        skel = cv2.bitwise_or(skel, temp)
        img = eroded.copy()

        zeros = size - cv2.countNonZero(img)

        if zeros == size:
            done = True

    logs.append("fallback skeletonize 成功")
    return (skel > 0).astype(np.uint8)


def get_neighbors_8(x, y, w, h):
    nbs = []

    for dy in [-1, 0, 1]:
        for dx in [-1, 0, 1]:
            if dx == 0 and dy == 0:
                continue

            nx = x + dx
            ny = y + dy

            if 0 <= nx < w and 0 <= ny < h:
                nbs.append((nx, ny))

    return nbs


def extract_skeleton_graph(skel, logs):
    h, w = skel.shape
    skel_pts = set()

    for y in range(h):
        xs = np.where(skel[y] > 0)[0]

        for x in xs:
            skel_pts.add((x, y))

    if not skel_pts:
        logs.append("骨架为空")
        return [], []

    degree = {}

    for (x, y) in skel_pts:
        cnt = 0

        for nx, ny in get_neighbors_8(x, y, w, h):
            if (nx, ny) in skel_pts:
                cnt += 1

        degree[(x, y)] = cnt

    nodes = [p for p, d in degree.items() if d != 2]

    if not nodes:
        nodes = list(skel_pts)

    node_set = set(nodes)
    visited_edges = set()
    edges = []

    for node in nodes:
        x0, y0 = node

        for nx, ny in get_neighbors_8(x0, y0, w, h):
            if (nx, ny) not in skel_pts:
                continue

            edge_key = tuple(sorted([node, (nx, ny)]))

            if edge_key in visited_edges:
                continue

            path = [node, (nx, ny)]
            prev = node
            curr = (nx, ny)

            while True:
                visited_edges.add(tuple(sorted([prev, curr])))

                if curr in node_set and curr != node:
                    break

                nbrs = []

                for tx, ty in get_neighbors_8(curr[0], curr[1], w, h):
                    if (tx, ty) in skel_pts and (tx, ty) != prev:
                        nbrs.append((tx, ty))

                if len(nbrs) == 0:
                    break

                if len(nbrs) > 1:
                    break

                nxt = nbrs[0]
                path.append(nxt)
                prev = curr
                curr = nxt

            if len(path) >= 2:
                edges.append(path)

    logs.append("骨架图提取完成: nodes={}, edges={}".format(len(nodes), len(edges)))

    return nodes, edges


def split_path_by_direction(path, turn_threshold=2):
    if not path or len(path) < 3:
        return [path] if path else []

    segments = []
    current = [path[0], path[1]]

    def major_dir(p1, p2):
        dx = p2[0] - p1[0]
        dy = p2[1] - p1[1]

        if abs(dx) >= abs(dy):
            return "h"
        else:
            return "v"

    prev_dir = major_dir(path[0], path[1])

    for i in range(2, len(path)):
        d = major_dir(path[i - 1], path[i])

        if d == prev_dir:
            current.append(path[i])
        else:
            if len(current) <= turn_threshold and segments:
                segments[-1].extend(current[1:])
                current = [segments[-1][-1], path[i]]
            else:
                segments.append(current)
                current = [path[i - 1], path[i]]

            prev_dir = d

    if current:
        if len(current) <= turn_threshold and segments:
            segments[-1].extend(current[1:])
        else:
            segments.append(current)

    cleaned = []

    for seg in segments:
        if seg and len(seg) >= 2:
            cleaned.append(seg)

    return cleaned


def fit_axis_line_from_mask(sub_path, wall_mask, pixelWidth, pixelHeight, min_len_px=8):
    if not sub_path or len(sub_path) < 2:
        return None

    xs = [p[0] for p in sub_path]
    ys = [p[1] for p in sub_path]

    x_min = max(0, int(min(xs)))
    x_max = min(pixelWidth - 1, int(max(xs)))
    y_min = max(0, int(min(ys)))
    y_max = min(pixelHeight - 1, int(max(ys)))

    dx = x_max - x_min
    dy = y_max - y_min

    if dx >= dy:
        mids = []

        for x in range(x_min, x_max + 1):
            ys_in = np.where(wall_mask[:, x] > 0)[0]
            ys_local = ys_in[(ys_in >= y_min - 8) & (ys_in <= y_max + 8)]

            if len(ys_local) >= 2:
                y_top = np.min(ys_local)
                y_bot = np.max(ys_local)
                y_mid = 0.5 * (y_top + y_bot)
                mids.append((x, y_mid))

        if len(mids) < 2:
            return None

        xs2 = [p[0] for p in mids]
        ys2 = [p[1] for p in mids]

        x1 = min(xs2)
        x2 = max(xs2)
        y = float(np.median(ys2))

        if (x2 - x1) < min_len_px:
            return None

        return ((x1, y), (x2, y), "h")

    else:
        mids = []

        for y in range(y_min, y_max + 1):
            xs_in = np.where(wall_mask[y, :] > 0)[0]
            xs_local = xs_in[(xs_in >= x_min - 8) & (xs_in <= x_max + 8)]

            if len(xs_local) >= 2:
                x_left = np.min(xs_local)
                x_right = np.max(xs_local)
                x_mid = 0.5 * (x_left + x_right)
                mids.append((x_mid, y))

        if len(mids) < 2:
            return None

        xs2 = [p[0] for p in mids]
        ys2 = [p[1] for p in mids]

        y1 = min(ys2)
        y2 = max(ys2)
        x = float(np.median(xs2))

        if (y2 - y1) < min_len_px:
            return None

        return ((x, y1), (x, y2), "v")


def pixel_line_to_revit_linestring(p1, p2):
    rp1 = pix_to_revit(p1[0], p1[1])
    rp2 = pix_to_revit(p2[0], p2[1])

    if rp1.DistanceTo(rp2) < 0.1:
        return None

    return LineString([(rp1.X, rp1.Y), (rp2.X, rp2.Y)])


def simplify_path_to_axis_lines(path, wall_mask, pixelWidth, pixelHeight, logs, min_len_px=8):
    result_lines = []
    sub_paths = split_path_by_direction(path, turn_threshold=2)

    for sub in sub_paths:
        try:
            fitted = fit_axis_line_from_mask(
                sub,
                wall_mask,
                pixelWidth,
                pixelHeight,
                min_len_px=min_len_px
            )

            if fitted is None:
                continue

            p1, p2, ori = fitted
            line_geom = pixel_line_to_revit_linestring(p1, p2)

            if line_geom is None:
                continue

            if line_geom.length < 0.08:
                continue

            result_lines.append(line_geom)

        except Exception as e:
            logs.append("子段拟合失败: {}".format(str(e)))
            continue

    return result_lines


def extract_wall_centerlines_from_global_mask(result, pixelWidth, pixelHeight, logs):
    wall_mask, class_counter = build_global_structure_mask(result, pixelWidth, pixelHeight, logs)

    if wall_mask.max() == 0:
        logs.append("没有结构类mask被写入全局墙图")
        return [], 0.3, class_counter, wall_mask

    cleaned_mask = clean_wall_mask(wall_mask, logs)
    wall_width_px = estimate_wall_width_pixels(cleaned_mask, logs)

    skel = skeletonize_wall_mask(cleaned_mask, logs)
    nodes, edges = extract_skeleton_graph(skel, logs)

    if not edges:
        logs.append("骨架没有边")
        wall_width_ft = wall_width_px * (scale_x_ft_per_px_global if scale_x_ft_per_px_global else scaleX)
        return [], wall_width_ft, class_counter, cleaned_mask

    wall_width_ft = wall_width_px * (scale_x_ft_per_px_global if scale_x_ft_per_px_global else scaleX)

    candidates = []

    for idx, path in enumerate(edges):
        try:
            line_list = simplify_path_to_axis_lines(
                path,
                cleaned_mask,
                pixelWidth,
                pixelHeight,
                logs,
                min_len_px=max(3, int(wall_width_px * 0.5))
            )

            for line_geom in line_list:
                candidates.append({
                    'line': line_geom,
                    'thickness': wall_width_ft,
                    'name': "Wall"
                })

        except Exception as e:
            logs.append("路径{}转中心线失败: {}".format(idx, str(e)))
            continue

    logs.append("全局提取中心线候选数量: {}".format(len(candidates)))

    return candidates, wall_width_ft, class_counter, cleaned_mask


# =========================
# 几何增强处理
# =========================
def align_parallel_segments(segments, coord_tol=0.35):
    if not segments:
        return segments

    segs = copy_segments(segments)

    horizontal_groups = []
    vertical_groups = []

    for idx, s in enumerate(segs):
        coords = list(s['line'].coords)
        x1, y1 = coords[0]
        x2, y2 = coords[-1]

        ori = get_line_orientation(s)

        if ori == "h":
            y = 0.5 * (y1 + y2)
            added = False

            for g in horizontal_groups:
                if abs(g['coord'] - y) <= coord_tol:
                    g['indices'].append(idx)
                    g['values'].append(y)
                    g['coord'] = float(np.median(g['values']))
                    added = True
                    break

            if not added:
                horizontal_groups.append({
                    'coord': y,
                    'indices': [idx],
                    'values': [y]
                })

        else:
            x = 0.5 * (x1 + x2)
            added = False

            for g in vertical_groups:
                if abs(g['coord'] - x) <= coord_tol:
                    g['indices'].append(idx)
                    g['values'].append(x)
                    g['coord'] = float(np.median(g['values']))
                    added = True
                    break

            if not added:
                vertical_groups.append({
                    'coord': x,
                    'indices': [idx],
                    'values': [x]
                })

    for g in horizontal_groups:
        target_y = g['coord']

        for idx in g['indices']:
            coords = list(segs[idx]['line'].coords)
            x1, y1 = coords[0]
            x2, y2 = coords[-1]
            segs[idx]['line'] = LineString([(x1, target_y), (x2, target_y)])

    for g in vertical_groups:
        target_x = g['coord']

        for idx in g['indices']:
            coords = list(segs[idx]['line'].coords)
            x1, y1 = coords[0]
            x2, y2 = coords[-1]
            segs[idx]['line'] = LineString([(target_x, y1), (target_x, y2)])

    return segs


def bridge_parallel_gaps(segments, coord_tol=0.25, gap_tol=0.8):
    if not segments:
        return segments

    segs = copy_segments(segments)

    horiz = []
    vert = []
    result = []

    for idx, s in enumerate(segs):
        ori = get_line_orientation(s)
        coords = list(s['line'].coords)
        x1, y1 = coords[0]
        x2, y2 = coords[-1]

        if ori == "h":
            y = 0.5 * (y1 + y2)
            xmin = min(x1, x2)
            xmax = max(x1, x2)
            horiz.append((idx, y, xmin, xmax, s))

        else:
            x = 0.5 * (x1 + x2)
            ymin = min(y1, y2)
            ymax = max(y1, y2)
            vert.append((idx, x, ymin, ymax, s))

    horiz.sort(key=lambda t: (round(t[1], 3), t[2]))
    consumed = set()

    for i in range(len(horiz)):
        if i in consumed:
            continue

        idx_i, y_i, x1_i, x2_i, seg_i = horiz[i]

        cur_y = y_i
        cur_x1 = x1_i
        cur_x2 = x2_i
        base_seg = seg_i

        for j in range(i + 1, len(horiz)):
            if j in consumed:
                continue

            idx_j, y_j, x1_j, x2_j, seg_j = horiz[j]

            if abs(y_j - cur_y) <= coord_tol:
                gap = x1_j - cur_x2
                overlap = min(cur_x2, x2_j) - max(cur_x1, x1_j)

                if gap <= gap_tol or overlap >= -coord_tol:
                    cur_x1 = min(cur_x1, x1_j)
                    cur_x2 = max(cur_x2, x2_j)
                    cur_y = float(np.median([cur_y, y_j]))
                    consumed.add(j)

        ns = {}
        for k, v in base_seg.items():
            ns[k] = v
        ns['line'] = LineString([(cur_x1, cur_y), (cur_x2, cur_y)])

        result.append(ns)

    vert.sort(key=lambda t: (round(t[1], 3), t[2]))
    consumed = set()

    for i in range(len(vert)):
        if i in consumed:
            continue

        idx_i, x_i, y1_i, y2_i, seg_i = vert[i]

        cur_x = x_i
        cur_y1 = y1_i
        cur_y2 = y2_i
        base_seg = seg_i

        for j in range(i + 1, len(vert)):
            if j in consumed:
                continue

            idx_j, x_j, y1_j, y2_j, seg_j = vert[j]

            if abs(x_j - cur_x) <= coord_tol:
                gap = y1_j - cur_y2
                overlap = min(cur_y2, y2_j) - max(cur_y1, y1_j)

                if gap <= gap_tol or overlap >= -coord_tol:
                    cur_y1 = min(cur_y1, y1_j)
                    cur_y2 = max(cur_y2, y2_j)
                    cur_x = float(np.median([cur_x, x_j]))
                    consumed.add(j)

        ns = {}
        for k, v in base_seg.items():
            ns[k] = v
        ns['line'] = LineString([(cur_x, cur_y1), (cur_x, cur_y2)])

        result.append(ns)

    return result


def bridge_near_orthogonal_gaps(segments, gap_tol=0.6, axis_tol=0.25):
    if not segments:
        return segments

    segs = copy_segments(segments)

    for i in range(len(segs)):
        for j in range(i + 1, len(segs)):
            si = segs[i]
            sj = segs[j]

            oi = get_line_orientation(si)
            oj = get_line_orientation(sj)

            if oi == oj:
                continue

            if oi == "v" and oj == "h":
                tmp = si
                si = sj
                sj = tmp
                idx_h = j
                idx_v = i
            else:
                idx_h = i
                idx_v = j

            coords_h = list(si['line'].coords)
            coords_v = list(sj['line'].coords)

            hx1, hy1 = coords_h[0]
            hx2, hy2 = coords_h[-1]
            vx1, vy1 = coords_v[0]
            vx2, vy2 = coords_v[-1]

            y_h = 0.5 * (hy1 + hy2)
            x_v = 0.5 * (vx1 + vx2)

            hminx, hmaxx = min(hx1, hx2), max(hx1, hx2)
            vminy, vmaxy = min(vy1, vy2), max(vy1, vy2)

            inter_pt = (x_v, y_h)

            h_endpts = [(hx1, hy1), (hx2, hy2)]
            v_endpts = [(vx1, vy1), (vx2, vy2)]

            h_dists = [((p[0] - inter_pt[0]) ** 2 + (p[1] - inter_pt[1]) ** 2) ** 0.5 for p in h_endpts]
            v_dists = [((p[0] - inter_pt[0]) ** 2 + (p[1] - inter_pt[1]) ** 2) ** 0.5 for p in v_endpts]

            h_min_idx = int(np.argmin(h_dists))
            v_min_idx = int(np.argmin(v_dists))

            h_min_dist = h_dists[h_min_idx]
            v_min_dist = v_dists[v_min_idx]

            cond_h = x_v >= hminx - axis_tol and x_v <= hmaxx + gap_tol
            cond_v = y_h >= vminy - axis_tol and y_h <= vmaxy + gap_tol

            if h_min_dist <= gap_tol and v_min_dist <= gap_tol and cond_h and cond_v:
                other_h = h_endpts[1 - h_min_idx]
                other_v = v_endpts[1 - v_min_idx]

                new_h = snap_line_to_axis(LineString([other_h, inter_pt]))
                new_v = snap_line_to_axis(LineString([other_v, inter_pt]))

                if new_h is not None and new_h.length >= 0.08:
                    segs[idx_h]['line'] = new_h

                if new_v is not None and new_v.length >= 0.08:
                    segs[idx_v]['line'] = new_v

    cleaned = []

    for s in segs:
        try:
            if s['line'] is None or s['line'].is_empty:
                continue

            if s['line'].length < 0.08:
                continue

            cleaned.append(s)
        except:
            continue

    return cleaned


def snap_near_endpoints(segments, snap_tol=0.25):
    if not segments:
        return segments

    pts = []

    for idx, seg in enumerate(segments):
        coords = list(seg['line'].coords)
        pts.append((idx, 0, coords[0]))
        pts.append((idx, 1, coords[-1]))

    clusters = []

    for item in pts:
        idx, end_flag, p = item
        assigned = False

        for c in clusters:
            cx, cy = c['center']

            if ((p[0] - cx) ** 2 + (p[1] - cy) ** 2) ** 0.5 <= snap_tol:
                c['items'].append(item)
                xs = [it[2][0] for it in c['items']]
                ys = [it[2][1] for it in c['items']]
                c['center'] = (float(np.mean(xs)), float(np.mean(ys)))
                assigned = True
                break

        if not assigned:
            clusters.append({
                'center': (p[0], p[1]),
                'items': [item]
            })

    segs = copy_segments(segments)

    for c in clusters:
        center = c['center']

        for idx, end_flag, p in c['items']:
            coords = list(segs[idx]['line'].coords)

            if end_flag == 0:
                new_line = LineString([center, coords[-1]])
            else:
                new_line = LineString([coords[0], center])

            new_line = snap_line_to_axis(new_line)

            if new_line is not None and new_line.length >= 0.08:
                segs[idx]['line'] = new_line

    return segs


def clean_duplicate_segments(segments, coord_tol=0.05):
    if not segments:
        return segments

    uniq = []
    keys = set()

    for s in segments:
        try:
            coords = list(s['line'].coords)
            x1, y1 = coords[0]
            x2, y2 = coords[-1]

            p1 = (round(x1 / coord_tol), round(y1 / coord_tol))
            p2 = (round(x2 / coord_tol), round(y2 / coord_tol))

            key = tuple(sorted([p1, p2]))

            if key in keys:
                continue

            keys.add(key)
            uniq.append(s)

        except:
            continue

    return uniq


def run_geometry_enhancement_v2(segments, logs):
    if not segments:
        return segments

    segs = copy_segments(segments)
    logs.append("V2增强-输入墙段数: {}".format(len(segs)))

    segs = align_parallel_segments(segs, coord_tol=0.35)
    logs.append("V2增强-平行对齐后: {}".format(len(segs)))

    segs = bridge_parallel_gaps(segs, coord_tol=0.25, gap_tol=0.8)
    logs.append("V2增强-平行短缝桥接后: {}".format(len(segs)))

    segs = bridge_near_orthogonal_gaps(segs, gap_tol=0.6, axis_tol=0.25)
    logs.append("V2增强-正交补缝后: {}".format(len(segs)))

    segs = snap_near_endpoints(segs, snap_tol=0.25)
    logs.append("V2增强-端点吸附后: {}".format(len(segs)))

    segs = merge_collinear_segments_strict(segs, coord_tol=0.08, gap_tol=0.35)
    logs.append("V2增强-严格共线合并后: {}".format(len(segs)))

    segs = clean_duplicate_segments(segs, coord_tol=0.05)
    logs.append("V2增强-去重后: {}".format(len(segs)))

    cleaned = []

    for s in segs:
        try:
            if s['line'] is None or s['line'].is_empty:
                continue

            if s['line'].length < 0.08:
                continue

            cleaned.append(s)

        except:
            continue

    logs.append("V2增强-最终墙段数: {}".format(len(cleaned)))

    return cleaned


# =========================
# 内外墙分类函数
# =========================
def find_continuous_width_1d(arr, center_idx, max_search=8):
    n = len(arr)

    if n <= 0:
        return None

    c = int(round(center_idx))

    if c < 0 or c >= n:
        return None

    # 若中心点不在mask内则向两侧寻找最近前景点#--------
    if arr[c] <= 0:
        found = None

        for d in range(1, max_search + 1):
            c1 = c - d
            c2 = c + d

            if c1 >= 0 and arr[c1] > 0:
                found = c1
                break

            if c2 < n and arr[c2] > 0:
                found = c2
                break

        if found is None:
            return None

        c = found

    left = c
    right = c

    while left - 1 >= 0 and arr[left - 1] > 0:
        left -= 1

    while right + 1 < n and arr[right + 1] > 0:
        right += 1

    return int(right - left + 1)


def sample_wall_width_px_from_mask(line_geom, wall_mask, logs, sample_count=15):
    """
    根据最终墙中心线，在 mask 中采样局部墙厚像素值。
    水平墙：沿图像 y 方向测厚。
    竖直墙：沿图像 x 方向测厚。
    """
    if line_geom is None or line_geom.is_empty:
        return None

    if wall_mask is None or wall_mask.max() == 0:
        return None

    try:
        coords = list(line_geom.coords)

        if len(coords) < 2:
            return None

        x1, y1 = coords[0]
        x2, y2 = coords[-1]

        p1x, p1y = revit_to_pix_xy(x1, y1)
        p2x, p2y = revit_to_pix_xy(x2, y2)

        dx = p2x - p1x
        dy = p2y - p1y

        ori = "h" if abs(dx) >= abs(dy) else "v"

        widths = []

        # 避开端点，减少节点连接区对厚度估计的影响
        for i in range(sample_count):
            t = float(i + 1) / float(sample_count + 1)

            px = p1x + t * dx
            py = p1y + t * dy

            ix = int(round(px))
            iy = int(round(py))

            if ix < 0 or ix >= pixelWidth or iy < 0 or iy >= pixelHeight:
                continue

            if ori == "h":
                col = wall_mask[:, ix]
                wpx = find_continuous_width_1d(col, iy, max_search=10)
            else:
                row = wall_mask[iy, :]
                wpx = find_continuous_width_1d(row, ix, max_search=10)

            if wpx is not None and wpx > 0:
                widths.append(wpx)

        if not widths:
            return None

        width_px = float(np.median(widths))

        return width_px

    except Exception as e:
        logs.append("局部墙厚采样失败: {}".format(str(e)))
        return None


def is_line_near_outer_bbox(line_geom, bbox_info, logs):
    """
    简化外墙判断：
    如果墙段中心点靠近整体结构 bbox 外边界，则更可能是外墙。
    """
    if line_geom is None or line_geom.is_empty:
        return False

    if bbox_info is None:
        return False

    try:
        coords = list(line_geom.coords)

        if len(coords) < 2:
            return False

        x1, y1 = coords[0]
        x2, y2 = coords[-1]

        p1x, p1y = revit_to_pix_xy(x1, y1)
        p2x, p2y = revit_to_pix_xy(x2, y2)

        cx = 0.5 * (p1x + p2x)
        cy = 0.5 * (p1y + p2y)

        min_x = bbox_info["min_x"]
        max_x = bbox_info["max_x"]
        min_y = bbox_info["min_y"]
        max_y = bbox_info["max_y"]

        if scale_avg_mm_per_px is not None and scale_avg_mm_per_px > 0:
            near_px = OUTER_BOUNDARY_NEAR_MM / scale_avg_mm_per_px
        else:
            near_px = 25.0

        dist_left = abs(cx - min_x)
        dist_right = abs(max_x - cx)
        dist_top = abs(cy - min_y)
        dist_bottom = abs(max_y - cy)

        min_dist = min(dist_left, dist_right, dist_top, dist_bottom)

        return min_dist <= near_px

    except Exception as e:
        logs.append("外边界邻近判断失败: {}".format(str(e)))
        return False


def classify_wall_segment(line_geom, wall_mask, bbox_info, logs):
    """
    根据局部墙厚和外轮廓位置，将墙段分为 exterior / interior。
    """
    width_px = sample_wall_width_px_from_mask(line_geom, wall_mask, logs, sample_count=15)

    width_mm = None

    try:
        if width_px is not None:
            ori = get_line_orientation_from_geom(line_geom)

            if ori == "h" and scale_y_mm_per_px is not None:
                width_mm = width_px * scale_y_mm_per_px

            elif ori == "v" and scale_x_mm_per_px is not None:
                width_mm = width_px * scale_x_mm_per_px

            elif scale_avg_mm_per_px is not None:
                width_mm = width_px * scale_avg_mm_per_px

    except Exception as e:
        logs.append("墙厚像素转毫米失败: {}".format(str(e)))

    near_outer = is_line_near_outer_bbox(line_geom, bbox_info, logs)

    wall_kind = "interior"

    # 规则1：局部厚度大于阈值，判为外墙
    if width_mm is not None and width_mm >= WALL_THICKNESS_THRESHOLD_MM:
        wall_kind = "exterior"

    # 规则2：靠近整体结构外边界，判为外墙
    if near_outer:
        wall_kind = "exterior"

    return {
        "wall_kind": wall_kind,
        "width_px": width_px,
        "width_mm": width_mm,
        "near_outer_bbox": near_outer
    }


# =========================
# 运行YOLO分割--------------
# =========================
try:
    yolo_seg = YOLO(dect_Model, task="seg")
    seg_result = yolo_seg(source=pixpath, save=False, conf=0.7, iou=0.45, imgsz=1280)

    result = seg_result[0]

    ensure_dir_of_file(newpath)
    cv2.imwrite(newpath, result.plot())

    boxes = result.boxes
    xyxy = boxes.xyxy.cpu().numpy() if boxes is not None else np.empty((0, 4))
    cls_ids = boxes.cls.cpu().numpy().astype(int) if boxes is not None else np.array([], dtype=int)
    names = result.names

    logs.append("YOLO分割完成")
    logs.append("YOLO类别映射: {}".format(str(result.names)))

except Exception as e:
    logs.append("YOLO分割失败: {}".format(str(e)))
    logs.append(traceback.format_exc())
    raise


# =========================
# 读取OCR尺寸JSON
# =========================
dims_data = None

horizontal_length_mm_raw = None
vertical_length_mm_raw = None

horizontal_length_mm = None
vertical_length_mm = None

try:
    with open(dims_json_path, "r", encoding="utf-8") as f:
        dims_data = json.load(f)

    if dims_data.get("ok", False):
        if "result" in dims_data:
            horizontal_length_mm_raw = dims_data["result"].get("horizontal_length", None)
            vertical_length_mm_raw = dims_data["result"].get("vertical_length", None)
        else:
            horizontal_length_mm_raw = dims_data.get("horizontal_length", None)
            vertical_length_mm_raw = dims_data.get("vertical_length", None)

    logs.append("读取dims_json成功，原始轴线尺寸: horizontal={} mm, vertical={} mm".format(
        str(horizontal_length_mm_raw),
        str(vertical_length_mm_raw)
    ))

    if horizontal_length_mm_raw is not None:
        horizontal_length_mm = float(horizontal_length_mm_raw) + AXIS_DIM_CORRECTION_MM
        logs.append("horizontal_length_mm轴线修正: {} + {} = {} mm".format(
            str(horizontal_length_mm_raw),
            str(AXIS_DIM_CORRECTION_MM),
            str(horizontal_length_mm)
        ))

    if vertical_length_mm_raw is not None:
        vertical_length_mm = float(vertical_length_mm_raw) + AXIS_DIM_CORRECTION_MM
        logs.append("vertical_length_mm轴线修正: {} + {} = {} mm".format(
            str(vertical_length_mm_raw),
            str(AXIS_DIM_CORRECTION_MM),
            str(vertical_length_mm)
        ))

except Exception as e:
    logs.append("读取dims_json失败: {}".format(str(e)))
    logs.append(traceback.format_exc())


# =========================
# mask -> bbox -> scale
# =========================
global_structure_mask, structure_class_counter = build_global_structure_mask(result, pixelWidth, pixelHeight, logs)
cleaned_global_structure_mask = clean_wall_mask(global_structure_mask, logs)
bbox_info = get_mask_bbox(cleaned_global_structure_mask, logs)

if bbox_info is not None and horizontal_length_mm is not None and vertical_length_mm is not None:
    try:
        bbox_w = bbox_info["width"]
        bbox_h = bbox_info["height"]

        if bbox_w > 0 and bbox_h > 0:
            scale_x_mm_per_px = float(horizontal_length_mm) / float(bbox_w)
            scale_y_mm_per_px = float(vertical_length_mm) / float(bbox_h)
            scale_avg_mm_per_px = (scale_x_mm_per_px + scale_y_mm_per_px) / 2.0

            mm_to_ft = 1.0 / 304.8

            scale_x_ft_per_px = scale_x_mm_per_px * mm_to_ft
            scale_y_ft_per_px = scale_y_mm_per_px * mm_to_ft
            scale_avg_ft_per_px = scale_avg_mm_per_px * mm_to_ft

            bbox_info_global = bbox_info
            scale_x_ft_per_px_global = scale_x_ft_per_px
            scale_y_ft_per_px_global = scale_y_ft_per_px

            logs.append("scale_x_mm_per_px={:.6f}".format(scale_x_mm_per_px))
            logs.append("scale_y_mm_per_px={:.6f}".format(scale_y_mm_per_px))
            logs.append("scale_avg_mm_per_px={:.6f}".format(scale_avg_mm_per_px))
            logs.append("scale_x_ft_per_px={:.6f}".format(scale_x_ft_per_px))
            logs.append("scale_y_ft_per_px={:.6f}".format(scale_y_ft_per_px))

        else:
            logs.append("bbox宽高无效，无法计算scale")

    except Exception as e:
        logs.append("scale计算失败: {}".format(str(e)))
        logs.append(traceback.format_exc())

else:
    logs.append("bbox或真实尺寸缺失，使用fallback整图scale")


# =========================
# Revit 文档对象
# =========================
doc = DocumentManager.Instance.CurrentDBDocument
app = doc.Application

# =========================
# 获取内外墙类型
# =========================
exterior_wall_type = get_wall_type_by_keyword(doc, EXTERIOR_WALL_TYPE_KEYWORD, logs)
interior_wall_type = get_wall_type_by_keyword(doc, INTERIOR_WALL_TYPE_KEYWORD, logs)

default_wall_type = get_wall_type_by_keyword(doc, TARGET_WALL_TYPE_NAME, logs)

if default_wall_type is None:
    wall_type_collector = FilteredElementCollector(doc).OfClass(WallType)

    for wt in wall_type_collector:
        if wt.Kind == WallKind.Basic:
            default_wall_type = wt
            logs.append("默认墙类型兜底为: {}".format(get_wall_type_name(wt)))
            break

if exterior_wall_type is None:
    logs.append("外墙类型未找到，使用默认墙类型兜底")
    exterior_wall_type = default_wall_type

if interior_wall_type is None:
    logs.append("内墙类型未找到，使用默认墙类型兜底")
    interior_wall_type = default_wall_type

if default_wall_type is None:
    raise Exception("项目中找不到任何基本墙类型！")


# =========================
# get 标高
# =========================
level = None
level_collector = FilteredElementCollector(doc).OfClass(Level)

for lvl in level_collector:
    name_param = lvl.get_Parameter(BuiltInParameter.LEVEL_NAME)

    if name_param and name_param.AsString() == TARGET_LEVEL_NAME:
        level = lvl
        break

if level is None:
    level_collector = FilteredElementCollector(doc).OfClass(Level)
    level = level_collector.FirstElement()

    if level is None:
        raise Exception("项目中找不到任何标高！")

logs.append("使用标高: {}".format(level.Name if hasattr(level, "Name") else TARGET_LEVEL_NAME))


# =========================
# 创建墙体
# =========================
TransactionManager.Instance.EnsureInTransaction(doc)

created_walls = []
wall_candidates = []

exterior_wall_count = 0
interior_wall_count = 0

wallHeight = height

plane = Plane.CreateByNormalAndOrigin(XYZ.BasisZ, origin)
sketch_plane = SketchPlane.Create(doc, plane)

final_mask_used = None
optimized_walls = []

if result.masks is not None:
    wall_candidates, default_wall_thickness, used_class_counter, final_mask_used = extract_wall_centerlines_from_global_mask(
        result,
        pixelWidth,
        pixelHeight,
        logs
    )

    logs.append("初始墙候选数量: {}".format(len(wall_candidates)))

    optimized_walls = optimize_wall_centerlines(
        wall_candidates,
        iter_count=1,
        enable_merge_collinear=False
    )

    logs.append("初步优化后墙数量: {}".format(len(optimized_walls)))

    optimized_walls = run_geometry_enhancement_v2(optimized_walls, logs)

    for idx, w in enumerate(optimized_walls):
        try:
            line_geom = w['line']

            coords = list(line_geom.coords)

            if len(coords) < 2:
                logs.append("墙{}失败：coords不足".format(idx))
                continue

            start_pt = XYZ(coords[0][0], coords[0][1], 0)
            end_pt = XYZ(coords[-1][0], coords[-1][1], 0)

            if start_pt.DistanceTo(end_pt) < 0.1:
                logs.append("墙{}失败：线太短".format(idx))
                continue

            revit_line = Line.CreateBound(start_pt, end_pt)

            # =========================
            # 内外墙分类
            # =========================
            class_info = classify_wall_segment(line_geom, final_mask_used, bbox_info, logs)

            wall_kind = class_info["wall_kind"]
            local_width_px = class_info["width_px"]
            local_width_mm = class_info["width_mm"]
            near_outer_bbox = class_info["near_outer_bbox"]

            if wall_kind == "exterior":
                selected_wall_type = exterior_wall_type
                wall_name = "ExteriorWall"
                selected_wall_kind_cn = "外墙"
            else:
                selected_wall_type = interior_wall_type
                wall_name = "InteriorWall"
                selected_wall_kind_cn = "内墙"

            selected_type_name = get_wall_type_name(selected_wall_type)

            logs.append(
                "准备创建墙{}: len={:.3f}, 判定={}, local_width_px={}, local_width_mm={}, near_outer={}, type={}".format(
                    idx,
                    revit_line.Length,
                    selected_wall_kind_cn,
                    str(local_width_px),
                    str(local_width_mm),
                    str(near_outer_bbox),
                    selected_type_name
                )
            )

            # 核心：根据内外墙选择不同 WallType
            wall = Wall.Create(
                doc,
                revit_line,
                selected_wall_type.Id,
                level.Id,
                wallHeight,
                0,
                False,
                False
            )

            # 不再设置 WALL_ATTR_WIDTH_PARAM
            # 墙厚由 WallType 的复合结构决定。
            try:
                wall.Name = sanitize_name(wall_name)
            except:
                pass

            created_walls.append(wall.ToDSType(True))

            if wall_kind == "exterior":
                exterior_wall_count += 1
            else:
                interior_wall_count += 1

            logs.append("墙{}创建成功，类型={}".format(idx, selected_type_name))

        except Exception as e:
            logs.append("墙{}创建失败: {}".format(idx, str(e)))
            logs.append(traceback.format_exc())
            continue

else:
    logs.append("result.masks is None，没有分割mask")


# =========================
# 提交事务
# =========================
TransactionManager.Instance.TransactionTaskDone()
doc.Regenerate()


# =========================
# 写入seg_meta_json
# =========================
seg_meta = {
    "ok": True,
    "image_path": pixpath,
    "seg_vis_path": newpath,
    "dims_json_path": dims_json_path,
    "wall_bbox_px": bbox_info,
    "real_size_mm": {
        "horizontal_length_raw": horizontal_length_mm_raw,
        "vertical_length_raw": vertical_length_mm_raw,
        "axis_dim_correction_mm": AXIS_DIM_CORRECTION_MM,
        "horizontal_length": horizontal_length_mm,
        "vertical_length": vertical_length_mm
    },
    "scale": {
        "scale_x_mm_per_px": scale_x_mm_per_px,
        "scale_y_mm_per_px": scale_y_mm_per_px,
        "scale_avg_mm_per_px": scale_avg_mm_per_px,
        "scale_x_ft_per_px": scale_x_ft_per_px,
        "scale_y_ft_per_px": scale_y_ft_per_px,
        "scale_avg_ft_per_px": scale_avg_ft_per_px
    },
    "wall_type_config": {
        "exterior_wall_type_keyword": EXTERIOR_WALL_TYPE_KEYWORD,
        "interior_wall_type_keyword": INTERIOR_WALL_TYPE_KEYWORD,
        "default_wall_type_name": TARGET_WALL_TYPE_NAME,
        "thickness_threshold_mm": WALL_THICKNESS_THRESHOLD_MM,
        "outer_boundary_near_mm": OUTER_BOUNDARY_NEAR_MM
    },
    "structure_mask_classes_used": structure_class_counter,
    "debug": {
        "pixelWidth": pixelWidth,
        "pixelHeight": pixelHeight,
        "wall_count": len(created_walls),
        "candidate_wall_count": len(wall_candidates),
        "optimized_wall_count": len(optimized_walls),
        "exterior_wall_count": exterior_wall_count,
        "interior_wall_count": interior_wall_count,
        "mask_count": len(result.masks.xy) if result.masks is not None else 0,
        "class_names": result.names,
        "log_count": len(logs)
    }
}

try:
    ensure_dir_of_file(seg_meta_json_path)

    with open(seg_meta_json_path, "w", encoding="utf-8") as f:
        json.dump(seg_meta, f, ensure_ascii=False, indent=2)

    logs.append("seg_meta_json已写出: {}".format(seg_meta_json_path))

except Exception as e:
    logs.append("seg_meta_json写出失败: {}".format(str(e)))


OUT = newpath, created_walls, seg_meta_json_path, logs
# ----------------------------------------
python_version_2 = Watch(python_script)  # graph output
python_version_3 = CodeBlock(i=python_version_2) { i[2]; }
python_version_4 = Watch(python_version_3)  # graph output
python_script_2 = Python(IN[0]=modelpath, IN[1]=imagepath, IN[2]=scale, IN[3]=python_version_4)  # CPython3
# ---------- python_script_2.python (539 lines) ----------
# 加载 PythonStandard 和 DesignScript 库
#-----------------------------
import sys
import clr
clr.AddReference('ProtoGeometry')
from Autodesk.DesignScript.Geometry import *
import Autodesk.DesignScript.Geometry as DS
import Revit
from Revit.Elements import *
import System
sys.path.append("C:/Users/Lenovo/anaconda3/envs/revitenv/Lib/site-packages")
clr.AddReference('RevitAPI')
clr.AddReference('RevitAPIUI')
from Autodesk.Revit.DB import *
from Autodesk.Revit.UI import *

clr.AddReference('RevitServices')
from RevitServices.Persistence import DocumentManager
from RevitServices.Transactions import TransactionManager

clr.AddReference('RevitNodes')
import Revit
clr.ImportExtensions(Revit.Elements)
clr.ImportExtensions(Revit.GeometryConversion)

import re
import json
import os
import numpy as np
import torch
import cv2
from ultralytics import YOLO

dataEnteringNode = IN 

# =========================
# 输入
# =========================
dect_Model = IN[0]
pixpath = IN[1]
scale = IN[2]              # fallback
seg_meta_json_path = IN[3] # 读取分割得到的缩放与bbox信息

# =========================
# 参数
# =========================
origin = XYZ(0, 0, 0)   
widthFt = scale
pixelWidth = 1600   
pixelHeight = 1200

newpath = "E:/yanjiu/revitss/tests/jjianzhu_dect.jpg"

# fallback比例
scaleX = widthFt / pixelWidth if pixelWidth > 0 else 0.0
scaleY = widthFt * (pixelHeight / pixelWidth) / pixelHeight if pixelWidth > 0 and pixelHeight > 0 else 0.0

# seg_meta读取到的参数
bbox_info = None
bbox_min_x = None
bbox_min_y = None
bbox_width = None
bbox_height = None
scale_x_ft_per_px = None
scale_y_ft_per_px = None

logs = []

# =========================
# 窗参数
# =========================
TARGET_WINDOW_FAMILY_NAME = "Window_test"   # 窗族名
TARGET_WINDOW_CLASS_NAME = "window"         # 检测类别名，统一转小写判断

DEFAULT_WINDOW_HEIGHT_MM = 1500.0           # 固定窗高
DEFAULT_SILL_HEIGHT_MM = 900.0              # 底高度
WINDOW_SHRINK_EACH_SIDE_MM = 120.0          # 每端向内收120mm
MIN_WINDOW_WIDTH_MM = 300.0                 # 最小窗宽，避免过小

# =========================
# 双开门参数
# =========================
TARGET_DOOR_FAMILY_NAME = "TwoSideDoor"     # 双开门族名
TARGET_DOOR_CLASS_NAME = "twosidedoor"      # 检测bbox类别名，代码里统一lower，所以这里写小写

DOOR_SHRINK_EACH_SIDE_MM = 100.0            # 双开门两边各向内收100mm左右
MIN_DOOR_WIDTH_MM = 500.0                   # 最小门宽，避免过小

MM_TO_FT = 1.0 / 304.8

# =========================
# 工具函数
# =========================
def sanitize_name(name):
    if not name:
        return "Unknown"
    cleaned = re.sub(r'[\x00-\x1f\x7f]', '', str(name))
    if not cleaned.strip():
        return "Unnamed"
    return cleaned

def mm_to_ft(mm):
    return float(mm) * MM_TO_FT

def load_seg_meta(seg_meta_json_path, logs):
    if seg_meta_json_path is None:
        logs.append("seg_meta_json_path为空")
        return None

    try:
        with open(seg_meta_json_path, "r", encoding="utf-8") as f:
            data = json.load(f)
        logs.append("读取seg_meta_json成功: {}".format(seg_meta_json_path))
        return data
    except Exception as e:
        logs.append("读取seg_meta_json失败: {}".format(str(e)))
        return None

def pix_to_revit(x, y):
    global bbox_min_x, bbox_min_y, bbox_width, bbox_height
    global scale_x_ft_per_px, scale_y_ft_per_px
    global origin, scaleX, scaleY, pixelHeight

    try:
        if bbox_min_x is not None and bbox_min_y is not None and bbox_height is not None \
           and scale_x_ft_per_px is not None and scale_y_ft_per_px is not None:

            local_x = x - bbox_min_x
            local_y = y - bbox_min_y

            revit_x = origin.X + local_x * scale_x_ft_per_px
            revit_y = origin.Y + (bbox_height - local_y) * scale_y_ft_per_px
            return XYZ(revit_x, revit_y, origin.Z)
    except:
        pass

    revit_x = origin.X + x * scaleX
    revit_y = origin.Y + (pixelHeight - y) * scaleY
    return XYZ(revit_x, revit_y, origin.Z)

def get_px_to_ft_x():
    global scale_x_ft_per_px, scaleX
    return scale_x_ft_per_px if scale_x_ft_per_px is not None else scaleX

def get_px_to_ft_y():
    global scale_y_ft_per_px, scaleY
    return scale_y_ft_per_px if scale_y_ft_per_px is not None else scaleY

def get_wall_curve(wall):
    try:
        loc = wall.Location
        if loc and hasattr(loc, "Curve"):
            return loc.Curve
    except:
        pass
    return None

def point_to_curve_distance_2d(pt, curve):
    try:
        proj = curve.Project(pt)
        if proj:
            q = proj.XYZPoint
            dx = pt.X - q.X
            dy = pt.Y - q.Y
            return (dx * dx + dy * dy) ** 0.5, q
    except:
        pass
    return None, None

def get_wall_orientation(curve):
    p0 = curve.GetEndPoint(0)
    p1 = curve.GetEndPoint(1)
    dx = abs(p1.X - p0.X)
    dy = abs(p1.Y - p0.Y)
    if dx >= dy:
        return "h"
    else:
        return "v"

def get_nearest_wall(doc, pt, max_dist_ft=3.0):
    nearest_wall = None
    nearest_curve = None
    nearest_proj_pt = None
    best_dist = 1e18

    walls = FilteredElementCollector(doc).OfClass(Wall).ToElements()
    for wall in walls:
        try:
            curve = get_wall_curve(wall)
            if curve is None:
                continue

            dist, proj_pt = point_to_curve_distance_2d(pt, curve)
            if dist is None:
                continue

            if dist < best_dist and dist <= max_dist_ft:
                best_dist = dist
                nearest_wall = wall
                nearest_curve = curve
                nearest_proj_pt = proj_pt

        except:
            continue

    return nearest_wall, nearest_curve, nearest_proj_pt, best_dist

def get_window_symbol(doc, family_name):
    collector = FilteredElementCollector(doc).OfClass(FamilySymbol).OfCategory(BuiltInCategory.OST_Windows)
    for sym in collector:
        try:
            fam = sym.Family
            if fam and fam.Name == family_name:
                return sym
        except:
            continue
    return None

def get_door_symbol(doc, family_name):
    collector = FilteredElementCollector(doc).OfClass(FamilySymbol).OfCategory(BuiltInCategory.OST_Doors)
    for sym in collector:
        try:
            fam = sym.Family
            if fam and fam.Name == family_name:
                return sym
        except:
            continue
    return None

def set_param_if_exists(elem, param_name, value, logs, label):
    try:
        p = elem.LookupParameter(param_name)
        if p and (not p.IsReadOnly):
            p.Set(value)
            logs.append("{} 参数设置成功: {}={:.4f}".format(label, param_name, value))
            return True
        else:
            logs.append("{} 参数不存在或只读: {}".format(label, param_name))
    except Exception as e:
        logs.append("{} 参数设置失败: {} -> {}".format(label, param_name, str(e)))
    return False

def create_debug_bbox(doc, sketch_plane, pt1, pt2, pt3, pt4):
    lines = [
        Line.CreateBound(pt1, pt2),
        Line.CreateBound(pt2, pt3),
        Line.CreateBound(pt3, pt4),
        Line.CreateBound(pt4, pt1)
    ]
    created = []
    for line in lines:
        try:
            mc = doc.Create.NewModelCurve(line, sketch_plane)
            created.append(mc)
        except:
            pass
    return created

def calc_bbox_length_along_wall_mm(x1, y1, x2, y2, wall_ori):
    """
    根据墙方向计算检测框沿墙方向的真实长度，单位mm。
    h墙：取bbox水平像素宽度
    v墙：取bbox竖向像素高度
    """
    bbox_w_px = abs(x2 - x1)
    bbox_h_px = abs(y2 - y1)

    if wall_ori == "h":
        raw_width_ft = bbox_w_px * get_px_to_ft_x()
    else:
        raw_width_ft = bbox_h_px * get_px_to_ft_y()

    return raw_width_ft * 304.8

# =========================
# 读取seg_meta
# =========================
seg_meta = load_seg_meta(seg_meta_json_path, logs)

if seg_meta and seg_meta.get("ok", False):
    try:
        bbox_info = seg_meta.get("wall_bbox_px", None)
        scale_info = seg_meta.get("scale", {})

        if bbox_info:
            bbox_min_x = bbox_info.get("min_x", None)
            bbox_min_y = bbox_info.get("min_y", None)
            bbox_width = bbox_info.get("width", None)
            bbox_height = bbox_info.get("height", None)

        scale_x_ft_per_px = scale_info.get("scale_x_ft_per_px", None)
        scale_y_ft_per_px = scale_info.get("scale_y_ft_per_px", None)

        dbg = seg_meta.get("debug", {})
        if "pixelWidth" in dbg and "pixelHeight" in dbg:
            pixelWidth = dbg.get("pixelWidth", pixelWidth)
            pixelHeight = dbg.get("pixelHeight", pixelHeight)

        logs.append("bbox_info={}".format(str(bbox_info)))
        logs.append("scale_x_ft_per_px={}".format(str(scale_x_ft_per_px)))
        logs.append("scale_y_ft_per_px={}".format(str(scale_y_ft_per_px)))
        logs.append("pixelWidth={}, pixelHeight={}".format(pixelWidth, pixelHeight))
    except Exception as e:
        logs.append("解析seg_meta失败: {}".format(str(e)))
else:
    logs.append("seg_meta无效，使用fallback整图scale")

# =========================
# 运行YOLO检测
# =========================
yolo_dect = YOLO(dect_Model, task="detect")
dect_result = yolo_dect(source=pixpath, save=False, conf=0.3, iou=0.45, imgsz=640)
cv2.imwrite(newpath, dect_result[0].plot())

result = dect_result[0]
boxes = result.boxes
xyxy = boxes.xyxy.cpu().numpy() if boxes is not None else np.empty((0, 4))
cls_ids = boxes.cls.cpu().numpy().astype(int) if boxes is not None else np.array([], dtype=int)
names = result.names

logs.append("检测框数量: {}".format(len(xyxy)))
logs.append("类别映射: {}".format(str(names)))

# =========================
# Revit文档对象
# =========================
doc = DocumentManager.Instance.CurrentDBDocument
app = doc.Application
TransactionManager.Instance.EnsureInTransaction(doc)

created_lines = []
created_windows = []
created_doors = []

plane = Plane.CreateByNormalAndOrigin(XYZ.BasisZ, origin)
sketch_plane = SketchPlane.Create(doc, plane)

# =========================
# 查找窗族类型
# =========================
window_symbol = get_window_symbol(doc, TARGET_WINDOW_FAMILY_NAME)
if window_symbol is None:
    logs.append("未找到窗族类型: {}".format(TARGET_WINDOW_FAMILY_NAME))
else:
    logs.append("找到窗族类型: {}".format(TARGET_WINDOW_FAMILY_NAME))
    try:
        if not window_symbol.IsActive:
            window_symbol.Activate()
            doc.Regenerate()
            logs.append("窗族类型已激活")
    except Exception as e:
        logs.append("窗族类型激活失败: {}".format(str(e)))

# =========================
# 查找双开门族类型
# =========================
door_symbol = get_door_symbol(doc, TARGET_DOOR_FAMILY_NAME)
if door_symbol is None:
    logs.append("未找到双开门族类型: {}".format(TARGET_DOOR_FAMILY_NAME))
else:
    logs.append("找到双开门族类型: {}".format(TARGET_DOOR_FAMILY_NAME))
    try:
        if not door_symbol.IsActive:
            door_symbol.Activate()
            doc.Regenerate()
            logs.append("双开门族类型已激活")
    except Exception as e:
        logs.append("双开门族类型激活失败: {}".format(str(e)))

# 取一个Level，供创建窗/门实例使用
level = FilteredElementCollector(doc).OfClass(Level).FirstElement()
if level is None:
    logs.append("未找到Level，无法创建窗或门实例")

# =========================
# 遍历检测结果
# =========================
for i, bbox in enumerate(xyxy):
    try:
        x1, y1, x2, y2 = bbox
        class_id = cls_ids[i]
        class_name = sanitize_name(names[class_id]).lower()

        # 可选：先画debug框
        pt1 = pix_to_revit(x1, y1)
        pt2 = pix_to_revit(x2, y1)
        pt3 = pix_to_revit(x2, y2)
        pt4 = pix_to_revit(x1, y2)
        dbg_lines = create_debug_bbox(doc, sketch_plane, pt1, pt2, pt3, pt4)
        created_lines.extend(dbg_lines)

        # 只处理 window 和 TwoSideDoor
        if class_name != TARGET_WINDOW_CLASS_NAME and class_name != TARGET_DOOR_CLASS_NAME:
            logs.append("检测项{}跳过: class={}".format(i, class_name))
            continue

        if level is None:
            logs.append("检测项{}跳过: 缺少Level".format(i))
            continue

        # 中心点
        cx = 0.5 * (x1 + x2)
        cy = 0.5 * (y1 + y2)
        center_pt = pix_to_revit(cx, cy)

        # 找最近墙
        host_wall, wall_curve, proj_pt, wall_dist = get_nearest_wall(doc, center_pt, max_dist_ft=3.0)
        if host_wall is None or wall_curve is None or proj_pt is None:
            logs.append("检测项{}失败: 未找到合适宿主墙".format(i))
            continue

        wall_ori = get_wall_orientation(wall_curve)

        # 插入点优先用投影点
        insert_pt = XYZ(proj_pt.X, proj_pt.Y, proj_pt.Z)

        # =========================
        # 处理窗
        # =========================
        if class_name == TARGET_WINDOW_CLASS_NAME:

            if window_symbol is None:
                logs.append("检测项{}跳过: 缺少窗族类型".format(i))
                continue

            raw_width_mm = calc_bbox_length_along_wall_mm(x1, y1, x2, y2, wall_ori)

            # 两端向内收
            final_width_mm = raw_width_mm - 2.0 * WINDOW_SHRINK_EACH_SIDE_MM
            final_width_mm = max(final_width_mm, MIN_WINDOW_WIDTH_MM)

            final_width_ft = mm_to_ft(final_width_mm)
            final_height_ft = mm_to_ft(DEFAULT_WINDOW_HEIGHT_MM)
            sill_height_ft = mm_to_ft(DEFAULT_SILL_HEIGHT_MM)

            # 创建窗实例
            try:
                win = doc.Create.NewFamilyInstance(
                    insert_pt,
                    window_symbol,
                    host_wall,
                    level,
                    StructuralType.NonStructural
                )
            except:
                # 有些版本/族可能只接受不带level的重载
                win = doc.Create.NewFamilyInstance(
                    insert_pt,
                    window_symbol,
                    host_wall,
                    StructuralType.NonStructural
                )

            doc.Regenerate()

            # 设置窗参数
            set_param_if_exists(win, "AI_Width", final_width_ft, logs, "窗{}".format(i))
            set_param_if_exists(win, "AI_Height", final_height_ft, logs, "窗{}".format(i))
            set_param_if_exists(win, "底高度", sill_height_ft, logs, "窗{}".format(i))

            created_windows.append(win.ToDSType(True))

            logs.append(
                "窗{}创建成功: class={}, wall_ori={}, raw_width_mm={:.1f}, final_width_mm={:.1f}, height_mm={:.1f}, sill_mm={:.1f}".format(
                    i,
                    class_name,
                    wall_ori,
                    raw_width_mm,
                    final_width_mm,
                    DEFAULT_WINDOW_HEIGHT_MM,
                    DEFAULT_SILL_HEIGHT_MM
                )
            )

        # =========================
        # 处理双开门 TwoSideDoor
        # =========================
        elif class_name == TARGET_DOOR_CLASS_NAME:

            if door_symbol is None:
                logs.append("检测项{}跳过: 缺少双开门族类型".format(i))
                continue

            raw_width_mm = calc_bbox_length_along_wall_mm(x1, y1, x2, y2, wall_ori)

            # 双开门宽度：bbox沿墙方向长度，两边各内收100mm左右
            final_door_width_mm = raw_width_mm - 2.0 * DOOR_SHRINK_EACH_SIDE_MM
            final_door_width_mm = max(final_door_width_mm, MIN_DOOR_WIDTH_MM)

            final_door_width_ft = mm_to_ft(final_door_width_mm)

            # 创建双开门实例
            try:
                door = doc.Create.NewFamilyInstance(
                    insert_pt,
                    door_symbol,
                    host_wall,
                    level,
                    StructuralType.NonStructural
                )
            except:
                door = doc.Create.NewFamilyInstance(
                    insert_pt,
                    door_symbol,
                    host_wall,
                    StructuralType.NonStructural
                )

            doc.Regenerate()

            # 只设置AI_Width，AI_Height保持族默认值
            set_param_if_exists(door, "AI_Width", final_door_width_ft, logs, "双开门{}".format(i))

            created_doors.append(door.ToDSType(True))

            logs.append(
                "双开门{}创建成功: class={}, wall_ori={}, raw_width_mm={:.1f}, final_width_mm={:.1f}, AI_Height保持默认".format(
                    i,
                    class_name,
                    wall_ori,
                    raw_width_mm,
                    final_door_width_mm
                )
            )

    except Exception as e:
        logs.append("检测项{}处理失败: {}".format(i, str(e)))
        continue

# =========================
# 提交事务
# =========================
TransactionManager.Instance.TransactionTaskDone()
doc.Regenerate()

# =========================
# 输出
# =========================
OUT = newpath, created_windows, created_doors, created_lines, logs
# ----------------------------------------
python_version_5 = CodeBlock(i=python_script_2) { i[0]; }
file_from_path_2 = FileObject(path=python_version_5)
readFromFile_2 = Image.ReadFromFile(file=file_from_path_2)
watch_image_2 = WatchImageCore(image=readFromFile_2)
file_from_path_3 = FileObject(path=imagepath)
readFromFile_3 = Image.ReadFromFile(file=file_from_path_3)
watch_image_3 = WatchImageCore(image=readFromFile_3)
imagepath_bug_on = Filename("..\tests\2室2厅1厨1卫-93.64㎡-南 北-103100368214.jpg")
modelpath_2 = Filename("..\..\hou_pracs_on\Testings\Saves\best_seg2.pt")
file_from_path_4 = FileObject(path=imagepath)
readFromFile_4 = Image.ReadFromFile(file=file_from_path_4)
watch_image_4 = WatchImageCore(image=readFromFile_4)
modelpath_3 = Filename("..\..\hou_pracs_on\Testings\Saves\best_dir2.pt")
furnture_Info_Json_Path = Filename("..\..\hou_pracs_on\revit_paddleocr_tests\jsons\pose_class_config.json")
python_script_3 = Python(IN[0]=modelpath_3, IN[1]=imagepath, IN[2]=scale, IN[5]=python_version_4, IN[6]=furnture_Info_Json_Path)  # CPython3; unwired: IN[3], IN[4]
# ---------- python_script_3.python (1672 lines) ----------
# -*- coding: utf-8 -*-
#-----------------------------
import sys
import clr
import math
import json
import numpy as np
import cv2

clr.AddReference('ProtoGeometry')
from Autodesk.DesignScript.Geometry import *

clr.AddReference('RevitAPI')
clr.AddReference('RevitAPIUI')
from Autodesk.Revit.DB import *
from Autodesk.Revit.DB.Structure import StructuralType

clr.AddReference('RevitServices')
from RevitServices.Persistence import DocumentManager
from RevitServices.Transactions import TransactionManager

clr.AddReference('RevitNodes')
import Revit
clr.ImportExtensions(Revit.Elements)
clr.ImportExtensions(Revit.GeometryConversion)

sys.path.append("C:/Users/Lenovo/anaconda3/envs/revitenv/Lib/site-packages")
from ultralytics import YOLO


# ============================================================
# 输入
# ============================================================
pose_Model = IN[0]
pixpath = IN[1]
scale = IN[2]
target_family_name = IN[3] if len(IN) > 3 else "Bed"
target_type_name = IN[4] if len(IN) > 4 else "Only_Bed"
seg_meta_json_path = IN[5] if len(IN) > 5 else None
class_config_json_path = IN[6] if len(IN) > 6 else None


# ============================================================
# 全局参数
# ============================================================
origin = XYZ(0, 0, 0)
widthFt = scale
pixelWidth = 1600
pixelHeight = 1200

bbox_min_x = None
bbox_min_y = None
bbox_width = None
bbox_height = None
scale_x_ft_per_px = None
scale_y_ft_per_px = None

logs = []


# ============================================================
# 默认配置
# ============================================================
DEFAULT_CLASS_CONFIG = {
    "Bed": {
        "family_name": "Bed",
        "type_name": "Bed",
        "rotate": True,
        "kp_start_idx": 0,
        "kp_end_idx": 1,
        "area_filter": True,
        "family_default_axis": "Y",
        "placement_mode": "free"
    },
    "BedSingle": {
        "family_name": "BedSingle",
        "type_name": "BedSingle",
        "rotate": True,
        "kp_start_idx": 0,
        "kp_end_idx": 1,
        "area_filter": False,
        "family_default_axis": "Y",
        "placement_mode": "free"
    },
    "CookingCounter": {
        "family_name": "CookingCounter",
        "type_name": "CookingCounter",
        "rotate": True,
        "kp_start_idx": 0,
        "kp_end_idx": 1,
        "area_filter": False,
        "family_default_axis": "Y",
        "placement_mode": "free"
    },
    "Cabinet": {
        "family_name": "Cabinet",
        "type_name": "Cabinet",
        "rotate": True,
        "kp_start_idx": 0,
        "kp_end_idx": 1,
        "area_filter": False,
        "family_default_axis": "Y",
        "placement_mode": "free"
    },
    "DiningTable": {
        "family_name": "DiningTable",
        "type_name": "DiningTable",
        "rotate": True,
        "kp_start_idx": 0,
        "kp_end_idx": 1,
        "area_filter": False,
        "family_default_axis": "Y",
        "placement_mode": "free"
    },
    "DiningTables": {
        "family_name": "DiningTables",
        "type_name": "DiningTables",
        "rotate": False,
        "area_filter": False,
        "placement_mode": "free"
    },
    "Sofa": {
        "family_name": "Sofa",
        "type_name": "Sofa",
        "rotate": True,
        "kp_start_idx": 0,
        "kp_end_idx": 1,
        "area_filter": False,
        "family_default_axis": "Y",
        "placement_mode": "free"
    },
    "TVStand": {
        "family_name": "TVStand",
        "type_name": "TVStand",
        "rotate": True,
        "kp_start_idx": 0,
        "kp_end_idx": 1,
        "area_filter": False,
        "family_default_axis": "Y",
        "placement_mode": "free"
    },
    "Toilet": {
        "family_name": "Toilet",
        "type_name": "Toilet",
        "rotate": True,
        "kp_start_idx": 0,
        "kp_end_idx": 1,
        "area_filter": False,
        "family_default_axis": "Y",
        "placement_mode": "free"
    },
    "LeftDoor": {
        "family_name": "LeftDoor",
        "type_name": "LeftDoor",
        "rotate": False,
        "kp_start_idx": 0,
        "kp_end_idx": 1,
        "area_filter": False,
        "placement_mode": "door_hosted",

        "door_max_host_wall_dist_ft": 4.0,
        "door_min_perp_score": 0.35,
        "door_min_end_clearance_ft": 0.45,
        "door_end_clearance_ratio": 0.25,

        "door_insert_reference": "bbox_center",
        "door_insert_offset_along_ft": 0.0,
        "door_insert_offset_normal_ft": 0.0,

        "door_try_candidate_count": 8,
        "door_geometry_match": True
    },
    "RightDoor": {
        "family_name": "RightDoor",
        "type_name": "RightDoor",
        "rotate": False,
        "kp_start_idx": 0,
        "kp_end_idx": 1,
        "area_filter": False,
        "placement_mode": "door_hosted",

        "door_max_host_wall_dist_ft": 4.0,
        "door_min_perp_score": 0.35,
        "door_min_end_clearance_ft": 0.45,
        "door_end_clearance_ratio": 0.25,

        "door_insert_reference": "bbox_center",
        "door_insert_offset_along_ft": 0.0,
        "door_insert_offset_normal_ft": 0.0,

        "door_try_candidate_count": 8,
        "door_geometry_match": True
    }
}


# ============================================================
# 基础工具
# ============================================================
def norm_str(s):
    if s is None:
        return ""
    return str(s).strip().lower()


def load_json_file(json_path, logs, label):
    if not json_path:
        logs.append("{}为空".format(label))
        return None
    try:
        with open(json_path, "r", encoding="utf-8") as f:
            data = json.load(f)
        logs.append("读取{}成功: {}".format(label, json_path))
        return data
    except Exception as e:
        logs.append("读取{}失败: {}".format(label, str(e)))
        return None


def load_class_config(class_config_json_path, logs):
    data = load_json_file(class_config_json_path, logs, "class_config_json_path")
    if isinstance(data, dict) and len(data) > 0:
        logs.append("使用外部CLASS_CONFIG，共{}类".format(len(data)))
        return data
    logs.append("使用内置DEFAULT_CLASS_CONFIG，共{}类".format(len(DEFAULT_CLASS_CONFIG)))
    return DEFAULT_CLASS_CONFIG


def load_seg_meta(seg_meta_json_path, logs):
    return load_json_file(seg_meta_json_path, logs, "seg_meta_json_path")


def pix_to_revit(x, y):
    global bbox_min_x, bbox_min_y, bbox_height
    global scale_x_ft_per_px, scale_y_ft_per_px
    global origin, widthFt, pixelWidth, pixelHeight

    try:
        if bbox_min_x is not None and bbox_min_y is not None and bbox_height is not None and \
           scale_x_ft_per_px is not None and scale_y_ft_per_px is not None:
            local_x = x - bbox_min_x
            local_y = y - bbox_min_y
            revit_x = origin.X + local_x * scale_x_ft_per_px
            revit_y = origin.Y + (bbox_height - local_y) * scale_y_ft_per_px
            return XYZ(revit_x, revit_y, origin.Z)
    except:
        pass

    scaleX = widthFt / pixelWidth if pixelWidth > 0 else 0.0
    scaleY = widthFt * (float(pixelHeight) / float(pixelWidth)) / pixelHeight if pixelWidth > 0 and pixelHeight > 0 else 0.0
    revit_x = origin.X + x * scaleX
    revit_y = origin.Y + (pixelHeight - y) * scaleY
    return XYZ(revit_x, revit_y, origin.Z)


def get_level(doc):
    av = doc.ActiveView
    try:
        if hasattr(av, "GenLevel") and av.GenLevel:
            return av.GenLevel
    except:
        pass

    levels = FilteredElementCollector(doc).OfClass(Level).ToElements()
    if levels and len(levels) > 0:
        return levels[0]
    return None


def build_symbol_lookup(doc):
    lookup = {}
    collector = FilteredElementCollector(doc).OfClass(FamilySymbol)

    for fs in collector:
        try:
            fam_name = fs.Family.Name if fs.Family else ""
            p = fs.get_Parameter(BuiltInParameter.SYMBOL_NAME_PARAM)
            typ_name = p.AsString() if p else fs.Name
            lookup[(norm_str(fam_name), norm_str(typ_name))] = fs
        except:
            pass

    return lookup


def get_symbol_from_lookup(symbol_lookup, family_name, type_name):
    return symbol_lookup.get((norm_str(family_name), norm_str(type_name)), None)


def ensure_symbol_active(doc, symbol):
    if symbol and not symbol.IsActive:
        symbol.Activate()
        doc.Regenerate()


def xyz_sub(a, b):
    return XYZ(a.X - b.X, a.Y - b.Y, a.Z - b.Z)


def xyz_add(a, b):
    return XYZ(a.X + b.X, a.Y + b.Y, a.Z + b.Z)


def xyz_mul(v, s):
    return XYZ(v.X * s, v.Y * s, v.Z * s)


def xyz_len2d(v):
    return math.sqrt(v.X * v.X + v.Y * v.Y)


def xyz_norm2d(v):
    l = xyz_len2d(v)
    if l < 1e-9:
        return None
    return XYZ(v.X / l, v.Y / l, 0)


def dot2d(a, b):
    return a.X * b.X + a.Y * b.Y


def dist2d(a, b):
    dx = a.X - b.X
    dy = a.Y - b.Y
    return math.sqrt(dx * dx + dy * dy)


def clamp(v, a, b):
    return max(a, min(b, v))


def rotate_instance(doc, instance, center_pt, angle):
    axis_end = XYZ(center_pt.X, center_pt.Y, center_pt.Z + 1.0)
    axis = Line.CreateBound(center_pt, axis_end)
    ElementTransformUtils.RotateElement(doc, instance.Id, axis, angle)


def create_family_instance(doc, center_pt, symbol, level):
    try:
        return doc.Create.NewFamilyInstance(
            center_pt,
            symbol,
            level,
            StructuralType.NonStructural
        )
    except:
        return doc.Create.NewFamilyInstance(
            center_pt,
            symbol,
            doc.ActiveView
        )


def get_angle_from_keypoints(start_pt, end_pt, family_default_axis="Y"):
    vec = XYZ(start_pt.X - end_pt.X, start_pt.Y - end_pt.Y, 0)
    if vec.GetLength() < 1e-6:
        return None

    angle = math.atan2(vec.Y, vec.X)

    if family_default_axis == "Y":
        angle -= math.pi / 2.0

    return angle


def compute_class_area_threshold(boxes, cls_ids, names, class_name, scale_ratio=0.33):
    areas = []

    for i, bbox in enumerate(boxes):
        cls_name = names[int(cls_ids[i])] if len(cls_ids) > i else ""
        if cls_name != class_name:
            continue
        x1, y1, x2, y2 = bbox
        areas.append(max(0, x2 - x1) * max(0, y2 - y1))

    if len(areas) == 0:
        return 0.0, 0.0

    median_area = float(np.median(areas))
    return median_area, median_area * scale_ratio


# ============================================================
# 墙工具
# ============================================================
def get_wall_curve(wall):
    try:
        loc = wall.Location
        if loc and hasattr(loc, "Curve"):
            return loc.Curve
    except:
        pass
    return None


def get_wall_direction_unit(curve):
    try:
        p0 = curve.GetEndPoint(0)
        p1 = curve.GetEndPoint(1)
        return xyz_norm2d(xyz_sub(p1, p0))
    except:
        return None


def get_wall_normal_unit_2d(wall_dir):
    if wall_dir is None:
        return None
    return XYZ(-wall_dir.Y, wall_dir.X, 0)


def get_curve_length_2d(curve):
    try:
        p0 = curve.GetEndPoint(0)
        p1 = curve.GetEndPoint(1)
        return dist2d(p0, p1)
    except:
        try:
            return curve.Length
        except:
            return 0.0


def point_to_line_segment_projection_2d(pt, p0, p1):
    vx = p1.X - p0.X
    vy = p1.Y - p0.Y
    wx = pt.X - p0.X
    wy = pt.Y - p0.Y

    vv = vx * vx + vy * vy
    if vv < 1e-9:
        return {
            "proj": XYZ(p0.X, p0.Y, 0),
            "dist": dist2d(pt, p0),
            "t_raw": 0.0,
            "t": 0.0,
            "inside": False,
            "length": 0.0,
            "end_clearance": 0.0
        }

    t_raw = (wx * vx + wy * vy) / vv
    t = clamp(t_raw, 0.0, 1.0)

    proj = XYZ(p0.X + t * vx, p0.Y + t * vy, 0)
    length = math.sqrt(vv)
    inside = t_raw >= -0.02 and t_raw <= 1.02

    if inside:
        end_clearance = min(t * length, (1.0 - t) * length)
    else:
        end_clearance = -min(abs(t_raw), abs(t_raw - 1.0)) * length

    return {
        "proj": proj,
        "dist": dist2d(pt, proj),
        "t_raw": t_raw,
        "t": t,
        "inside": inside,
        "length": length,
        "end_clearance": end_clearance
    }


def get_wall_projection_info_2d(curve, pt):
    try:
        p0 = curve.GetEndPoint(0)
        p1 = curve.GetEndPoint(1)
        return point_to_line_segment_projection_2d(pt, p0, p1)
    except:
        try:
            proj_result = curve.Project(pt)
            if proj_result:
                q = proj_result.XYZPoint
                return {
                    "proj": XYZ(q.X, q.Y, 0),
                    "dist": dist2d(pt, q),
                    "t_raw": None,
                    "t": None,
                    "inside": True,
                    "length": curve.Length,
                    "end_clearance": 999.0
                }
        except:
            pass

    return None


# ============================================================
# 门宽
# ============================================================
def get_symbol_width_ft(symbol):
    cand_names = ["AI_Width", "Width", "宽度"]

    for n in cand_names:
        try:
            p = symbol.LookupParameter(n)
            if p and p.StorageType == StorageType.Double:
                val = p.AsDouble()
                if val and val > 1e-6:
                    return val
        except:
            pass

    builtin_candidates = [
        BuiltInParameter.DOOR_WIDTH,
        BuiltInParameter.FAMILY_WIDTH_PARAM
    ]

    for bip in builtin_candidates:
        try:
            p = symbol.get_Parameter(bip)
            if p:
                val = p.AsDouble()
                if val and val > 1e-6:
                    return val
        except:
            pass

    return None


def place_hosted_door_instance(doc, level, symbol, wall, insert_pt):
    try:
        return doc.Create.NewFamilyInstance(
            insert_pt,
            symbol,
            wall,
            level,
            StructuralType.NonStructural
        )
    except:
        return doc.Create.NewFamilyInstance(
            insert_pt,
            symbol,
            wall,
            StructuralType.NonStructural
        )


# ============================================================
# flip 工具
# ============================================================
def can_flip_hand(inst):
    try:
        return inst.CanFlipHand
    except:
        return False


def can_flip_facing(inst):
    try:
        return inst.CanFlipFacing
    except:
        return False


def get_flip_state(inst):
    hand = False
    facing = False

    try:
        hand = inst.HandFlipped
    except:
        pass

    try:
        facing = inst.FacingFlipped
    except:
        pass

    return hand, facing


def set_flip_state(inst, target_hand, target_facing):
    changed = []

    try:
        cur_hand = inst.HandFlipped
    except:
        cur_hand = False

    if cur_hand != target_hand:
        if can_flip_hand(inst):
            inst.flipHand()
            changed.append("flipHand")
        else:
            return False, changed

    try:
        cur_facing = inst.FacingFlipped
    except:
        cur_facing = False

    if cur_facing != target_facing:
        if can_flip_facing(inst):
            inst.flipFacing()
            changed.append("flipFacing")
        else:
            return False, changed

    return True, changed


def get_candidate_flip_states(inst):
    cur_hand, cur_facing = get_flip_state(inst)

    raw = [
        (cur_hand, cur_facing),
        (not cur_hand, cur_facing),
        (cur_hand, not cur_facing),
        (not cur_hand, not cur_facing)
    ]

    states = []
    seen = set()

    for h, f in raw:
        if (h, f) in seen:
            continue

        if h != cur_hand and not can_flip_hand(inst):
            continue

        if f != cur_facing and not can_flip_facing(inst):
            continue

        states.append((h, f))
        seen.add((h, f))

    return states


# ============================================================
# 实例真实平面几何读取
# ============================================================
def segment_midpoint_2d(p0, p1):
    return XYZ((p0.X + p1.X) * 0.5, (p0.Y + p1.Y) * 0.5, 0)


def segment_dir_2d(p0, p1):
    return xyz_norm2d(XYZ(p1.X - p0.X, p1.Y - p0.Y, 0))


def safe_transform_point(trf, p):
    try:
        return trf.OfPoint(p)
    except:
        return p


def extract_instance_plan_segments_recursive(geom_elem, trf, out_segments):
    if geom_elem is None:
        return

    for g in geom_elem:
        try:
            if isinstance(g, GeometryInstance):
                try:
                    sym_trf = trf.Multiply(g.Transform)
                    sym_geom = g.GetSymbolGeometry()
                    extract_instance_plan_segments_recursive(sym_geom, sym_trf, out_segments)
                except:
                    pass

                try:
                    inst_geom = g.GetInstanceGeometry()
                    extract_instance_plan_segments_recursive(inst_geom, trf, out_segments)
                except:
                    pass

            elif isinstance(g, Line):
                p0 = safe_transform_point(trf, g.GetEndPoint(0))
                p1 = safe_transform_point(trf, g.GetEndPoint(1))
                out_segments.append((XYZ(p0.X, p0.Y, 0), XYZ(p1.X, p1.Y, 0), "Line"))

            elif isinstance(g, Arc):
                p0 = safe_transform_point(trf, g.GetEndPoint(0))
                p1 = safe_transform_point(trf, g.GetEndPoint(1))
                out_segments.append((XYZ(p0.X, p0.Y, 0), XYZ(p1.X, p1.Y, 0), "ArcChord"))

            elif isinstance(g, Curve):
                try:
                    p0 = safe_transform_point(trf, g.GetEndPoint(0))
                    p1 = safe_transform_point(trf, g.GetEndPoint(1))
                    out_segments.append((XYZ(p0.X, p0.Y, 0), XYZ(p1.X, p1.Y, 0), "CurveChord"))
                except:
                    pass

            elif isinstance(g, Solid):
                try:
                    for edge in g.Edges:
                        c = edge.AsCurve()
                        p0 = safe_transform_point(trf, c.GetEndPoint(0))
                        p1 = safe_transform_point(trf, c.GetEndPoint(1))
                        out_segments.append((XYZ(p0.X, p0.Y, 0), XYZ(p1.X, p1.Y, 0), "SolidEdge"))
                except:
                    pass

        except:
            continue


def get_instance_plan_segments(doc, inst):
    opts = Options()
    opts.ComputeReferences = False
    opts.IncludeNonVisibleObjects = True

    try:
        opts.DetailLevel = ViewDetailLevel.Fine
    except:
        pass

    try:
        opts.View = doc.ActiveView
    except:
        pass

    segments = []

    try:
        geom = inst.get_Geometry(opts)
        extract_instance_plan_segments_recursive(geom, Transform.Identity, segments)
    except:
        pass

    return segments


def filter_door_leaf_candidate_segments(segments, insert_pt, wall_dir, leaf_dir, door_width_ft):
    candidates = []

    min_len = max(0.4, door_width_ft * 0.20)
    max_len = max(door_width_ft * 1.80, 6.0)
    max_mid_dist = max(door_width_ft * 2.00, 6.0)

    for p0, p1, typ in segments:
        length = dist2d(p0, p1)

        if length < min_len or length > max_len:
            continue

        d = segment_dir_2d(p0, p1)
        if d is None:
            continue

        mid = segment_midpoint_2d(p0, p1)
        mid_dist = dist2d(mid, insert_pt)

        if mid_dist > max_mid_dist:
            continue

        parallel_to_wall = abs(dot2d(d, wall_dir))
        parallel_to_leaf = abs(dot2d(d, leaf_dir))

        if parallel_to_leaf + 0.15 < parallel_to_wall:
            continue

        candidates.append({
            "p0": p0,
            "p1": p1,
            "type": typ,
            "length": length,
            "mid_dist": mid_dist,
            "parallel_to_wall": parallel_to_wall,
            "parallel_to_leaf": parallel_to_leaf
        })

    return candidates


def score_leaf_segment_against_keypoints(seg_info, hinge_pt, leaf_end_pt, leaf_dir, door_width_ft):
    p0 = seg_info["p0"]
    p1 = seg_info["p1"]

    d0 = dist2d(p0, hinge_pt)
    d1 = dist2d(p1, hinge_pt)

    if d0 <= d1:
        hinge_candidate = p0
        end_candidate = p1
        dir_vec = segment_dir_2d(p0, p1)
        hinge_dist = d0
    else:
        hinge_candidate = p1
        end_candidate = p0
        dir_vec = segment_dir_2d(p1, p0)
        hinge_dist = d1

    if dir_vec is None:
        return -1e9, None

    dir_score = dot2d(dir_vec, leaf_dir)
    end_dist = dist2d(end_candidate, leaf_end_pt)

    norm = max(door_width_ft, 1.0)
    hinge_score = 1.0 - clamp(hinge_dist / norm, 0.0, 2.0)
    end_score = 1.0 - clamp(end_dist / norm, 0.0, 2.0)

    total = dir_score * 10.0 + hinge_score * 3.0 + end_score * 1.5 + seg_info["parallel_to_leaf"] * 1.0

    dbg = {
        "segment_type": seg_info["type"],
        "segment_p0_xyz": [p0.X, p0.Y, p0.Z],
        "segment_p1_xyz": [p1.X, p1.Y, p1.Z],
        "segment_length": seg_info["length"],
        "segment_mid_dist": seg_info["mid_dist"],
        "parallel_to_wall": seg_info["parallel_to_wall"],
        "parallel_to_leaf": seg_info["parallel_to_leaf"],
        "hinge_candidate_xyz": [hinge_candidate.X, hinge_candidate.Y, hinge_candidate.Z],
        "end_candidate_xyz": [end_candidate.X, end_candidate.Y, end_candidate.Z],
        "hinge_dist": hinge_dist,
        "end_dist": end_dist,
        "dir_vec_xyz": [dir_vec.X, dir_vec.Y, dir_vec.Z],
        "target_leaf_dir_xyz": [leaf_dir.X, leaf_dir.Y, leaf_dir.Z],
        "dir_score_dot": dir_score,
        "hinge_score": hinge_score,
        "end_score": end_score,
        "total_score": total
    }

    return total, dbg


def evaluate_door_actual_geometry_state(doc, inst, insert_pt, wall_dir, hinge_pt, leaf_end_pt, leaf_dir, door_width_ft):
    segments = get_instance_plan_segments(doc, inst)

    candidates = filter_door_leaf_candidate_segments(
        segments,
        insert_pt,
        wall_dir,
        leaf_dir,
        door_width_ft
    )

    best_score = -1e9
    best_dbg = None

    for c in candidates:
        score, dbg = score_leaf_segment_against_keypoints(
            c,
            hinge_pt,
            leaf_end_pt,
            leaf_dir,
            door_width_ft
        )

        if score > best_score:
            best_score = score
            best_dbg = dbg

    if best_dbg is None:
        best_dbg = {
            "reason": "no_leaf_segment_candidate",
            "raw_segment_count": len(segments),
            "candidate_count": len(candidates),
            "total_score": -1e9
        }
    else:
        best_dbg["raw_segment_count"] = len(segments)
        best_dbg["candidate_count"] = len(candidates)

    return best_score, best_dbg


# ============================================================
# 门宿主墙候选评分
# ============================================================
def get_best_door_host_wall_candidates(
    doc,
    bbox_center_pt,
    hinge_pt,
    leaf_end_pt,
    leaf_dir,
    door_width_ft,
    cfg
):
    max_dist_ft = float(cfg.get("door_max_host_wall_dist_ft", 4.0))
    min_perp_score = float(cfg.get("door_min_perp_score", 0.35))
    min_end_clearance_ft = float(cfg.get("door_min_end_clearance_ft", 0.45))
    end_clearance_ratio = float(cfg.get("door_end_clearance_ratio", 0.25))

    min_clearance = max(min_end_clearance_ft, door_width_ft * end_clearance_ratio)

    candidates = []

    walls = FilteredElementCollector(doc).OfClass(Wall).ToElements()

    for wall in walls:
        try:
            curve = get_wall_curve(wall)
            if curve is None:
                continue

            wall_dir = get_wall_direction_unit(curve)
            if wall_dir is None:
                continue

            wall_nrm = get_wall_normal_unit_2d(wall_dir)
            if wall_nrm is None:
                continue

            wall_len = get_curve_length_2d(curve)
            if wall_len < max(door_width_ft * 0.75, 1.0):
                continue

            hinge_info = get_wall_projection_info_2d(curve, hinge_pt)
            bbox_info = get_wall_projection_info_2d(curve, bbox_center_pt)
            end_info = get_wall_projection_info_2d(curve, leaf_end_pt)

            if hinge_info is None or bbox_info is None:
                continue

            hinge_dist = hinge_info["dist"]
            bbox_dist = bbox_info["dist"]
            end_dist = end_info["dist"] if end_info else 999.0

            if hinge_dist > max_dist_ft and bbox_dist > max_dist_ft:
                continue

            perp_score = 1.0 - abs(dot2d(wall_dir, leaf_dir))

            if perp_score < min_perp_score:
                continue

            # 默认插入点参考 bbox 中心投影；如果 bbox 因走廊偏差太大，也允许配置用 hinge。
            insert_ref = cfg.get("door_insert_reference", "bbox_center")
            if insert_ref == "hinge":
                insert_info = hinge_info
            elif insert_ref == "mid_kp":
                mid_kp = XYZ((hinge_pt.X + leaf_end_pt.X) * 0.5, (hinge_pt.Y + leaf_end_pt.Y) * 0.5, 0)
                tmp = get_wall_projection_info_2d(curve, mid_kp)
                insert_info = tmp if tmp else bbox_info
            else:
                insert_info = bbox_info

            if insert_info is None:
                continue

            insert_proj = insert_info["proj"]
            insert_inside = insert_info["inside"]
            insert_end_clearance = insert_info["end_clearance"]

            inside_score = 1.0 if insert_inside else -4.0

            # 靠近墙端会导致 cut wall 失败，但不直接全部剔除，先降权。
            clearance_score = clamp(insert_end_clearance / max(min_clearance, 1e-6), 0.0, 1.0)

            if insert_inside and insert_end_clearance < min_clearance:
                end_penalty = -4.0
            elif not insert_inside:
                end_penalty = -8.0
            else:
                end_penalty = 0.0

            # hinge 点比 bbox 中心更可靠，尤其是走廊门。
            score = (
                perp_score * 10.0
                - hinge_dist * 3.5
                - bbox_dist * 1.0
                - min(end_dist, max_dist_ft) * 0.25
                + inside_score * 3.0
                + clearance_score * 2.5
                + end_penalty
            )

            candidates.append({
                "wall": wall,
                "curve": curve,
                "wall_dir": wall_dir,
                "wall_nrm": wall_nrm,
                "wall_len": wall_len,
                "hinge_dist": hinge_dist,
                "bbox_dist": bbox_dist,
                "end_dist": end_dist,
                "hinge_proj": hinge_info["proj"],
                "bbox_proj": bbox_info["proj"],
                "insert_proj": insert_proj,
                "insert_inside": insert_inside,
                "insert_end_clearance": insert_end_clearance,
                "perp_score": perp_score,
                "clearance_score": clearance_score,
                "score": score,
                "wall_id": wall.Id.IntegerValue
            })

        except:
            continue

    candidates.sort(key=lambda x: x["score"], reverse=True)
    return candidates


def serialize_wall_candidate(c):
    return {
        "wall_id": c["wall_id"],
        "score": c["score"],
        "perp_score": c["perp_score"],
        "hinge_dist": c["hinge_dist"],
        "bbox_dist": c["bbox_dist"],
        "end_dist": c["end_dist"],
        "wall_len": c["wall_len"],
        "insert_inside": c["insert_inside"],
        "insert_end_clearance": c["insert_end_clearance"],
        "clearance_score": c["clearance_score"],
        "hinge_proj_xyz": [c["hinge_proj"].X, c["hinge_proj"].Y, c["hinge_proj"].Z],
        "bbox_proj_xyz": [c["bbox_proj"].X, c["bbox_proj"].Y, c["bbox_proj"].Z],
        "insert_proj_xyz": [c["insert_proj"].X, c["insert_proj"].Y, c["insert_proj"].Z],
        "wall_dir_xyz": [c["wall_dir"].X, c["wall_dir"].Y, c["wall_dir"].Z],
        "wall_normal_xyz": [c["wall_nrm"].X, c["wall_nrm"].Y, c["wall_nrm"].Z]
    }


def build_insert_point_from_candidate(c, cfg):
    offset_along_ft = float(cfg.get("door_insert_offset_along_ft", 0.0))
    offset_normal_ft = float(cfg.get("door_insert_offset_normal_ft", 0.0))

    insert_pt = xyz_add(
        xyz_add(c["insert_proj"], xyz_mul(c["wall_dir"], offset_along_ft)),
        xyz_mul(c["wall_nrm"], offset_normal_ft)
    )

    return insert_pt


# ============================================================
# 临时试放：候选墙 + flip + 真实几何评分
# ============================================================
def test_place_door_on_candidate(
    doc,
    level,
    symbol,
    candidate,
    insert_pt,
    hinge_pt,
    leaf_end_pt,
    leaf_dir,
    door_width_ft
):
    sub = SubTransaction(doc)
    inst = None

    result = {
        "candidate": serialize_wall_candidate(candidate),
        "insert_xyz": [insert_pt.X, insert_pt.Y, insert_pt.Z],
        "ok": False,
        "error": None,
        "best_score": -1e9,
        "best_state": None,
        "best_eval_debug": None,
        "state_evals": []
    }

    try:
        sub.Start()

        inst = place_hosted_door_instance(
            doc,
            level,
            symbol,
            candidate["wall"],
            insert_pt
        )

        doc.Regenerate()

        flip_states = get_candidate_flip_states(inst)
        if len(flip_states) == 0:
            flip_states = [get_flip_state(inst)]

        best_score = -1e9
        best_state = get_flip_state(inst)
        best_eval_dbg = None
        state_evals = []

        for target_hand, target_facing in flip_states:
            ok, changed = set_flip_state(inst, target_hand, target_facing)
            doc.Regenerate()

            if not ok:
                state_evals.append({
                    "tested_state": {
                        "target_hand_flipped": target_hand,
                        "target_facing_flipped": target_facing,
                        "changed_ops": changed
                    },
                    "reason": "set_flip_state_failed"
                })
                continue

            score, eval_dbg = evaluate_door_actual_geometry_state(
                doc,
                inst,
                insert_pt,
                candidate["wall_dir"],
                hinge_pt,
                leaf_end_pt,
                leaf_dir,
                door_width_ft
            )

            eval_dbg["tested_state"] = {
                "target_hand_flipped": target_hand,
                "target_facing_flipped": target_facing,
                "changed_ops": changed
            }

            try:
                eval_dbg["hand_orientation_xyz"] = [
                    inst.HandOrientation.X,
                    inst.HandOrientation.Y,
                    inst.HandOrientation.Z
                ]
            except:
                eval_dbg["hand_orientation_xyz"] = None

            try:
                eval_dbg["facing_orientation_xyz"] = [
                    inst.FacingOrientation.X,
                    inst.FacingOrientation.Y,
                    inst.FacingOrientation.Z
                ]
            except:
                eval_dbg["facing_orientation_xyz"] = None

            try:
                eval_dbg["hand_flipped"] = inst.HandFlipped
            except:
                eval_dbg["hand_flipped"] = None

            try:
                eval_dbg["facing_flipped"] = inst.FacingFlipped
            except:
                eval_dbg["facing_flipped"] = None

            state_evals.append(eval_dbg)

            if score > best_score:
                best_score = score
                best_state = (target_hand, target_facing)
                best_eval_dbg = eval_dbg

        result["ok"] = True
        result["best_score"] = best_score
        result["best_state"] = best_state
        result["best_eval_debug"] = best_eval_dbg
        result["state_evals"] = state_evals

        sub.RollBack()

    except Exception as e:
        result["ok"] = False
        result["error"] = str(e)

        try:
            if sub.HasStarted():
                sub.RollBack()
        except:
            pass

    return result


def create_final_door_on_candidate(
    doc,
    level,
    symbol,
    candidate,
    insert_pt,
    best_state
):
    inst = place_hosted_door_instance(
        doc,
        level,
        symbol,
        candidate["wall"],
        insert_pt
    )
    doc.Regenerate()

    if best_state is not None:
        set_flip_state(inst, best_state[0], best_state[1])
        doc.Regenerate()

    return inst


# ============================================================
# 门处理：宿主墙候选评分 + 真实几何匹配 + 失败回退
# ============================================================
def process_door_instance(
    doc,
    level,
    symbol,
    cls_name,
    bbox,
    kp_start_pt,
    kp_end_pt,
    cfg,
    logs,
    debug_tag="door"
):
    x1, y1, x2, y2 = bbox
    cx = (x1 + x2) * 0.5
    cy = (y1 + y2) * 0.5

    bbox_center_pt = pix_to_revit(cx, cy)

    if kp_start_pt is None or kp_end_pt is None:
        raise Exception("门缺少关键点，无法放置")

    # 默认 kp_start = DoorS / hinge，kp_end = DoorE / leaf end
    hinge_pt = kp_start_pt
    leaf_end_pt = kp_end_pt

    leaf_dir = xyz_norm2d(xyz_sub(leaf_end_pt, hinge_pt))
    if leaf_dir is None:
        raise Exception("门关键点方向无效")

    door_width_ft = get_symbol_width_ft(symbol)

    if door_width_ft is None or door_width_ft < 1e-6:
        pt_x1 = pix_to_revit(x1, y1)
        pt_x2 = pix_to_revit(x2, y1)
        pt_y2 = pix_to_revit(x1, y2)

        bbox_w_ft = abs(pt_x2.X - pt_x1.X)
        bbox_h_ft = abs(pt_y2.Y - pt_x1.Y)

        door_width_ft = min(max(min(bbox_w_ft, bbox_h_ft), 2.0), 4.0)
        logs.append("{} 使用bbox估计门宽: {:.3f} ft".format(debug_tag, door_width_ft))
    else:
        logs.append("{} 读取门族默认宽度: {:.3f} ft".format(debug_tag, door_width_ft))

    candidates = get_best_door_host_wall_candidates(
        doc,
        bbox_center_pt,
        hinge_pt,
        leaf_end_pt,
        leaf_dir,
        door_width_ft,
        cfg
    )

    try_count = int(cfg.get("door_try_candidate_count", 8))
    candidates_to_try = candidates[:max(1, try_count)]

    if len(candidates_to_try) == 0:
        raise Exception("未找到合格门宿主墙候选")

    test_results = []
    best_test = None
    best_candidate = None
    best_insert_pt = None

    for c in candidates_to_try:
        insert_pt = build_insert_point_from_candidate(c, cfg)

        test_result = test_place_door_on_candidate(
            doc,
            level,
            symbol,
            c,
            insert_pt,
            hinge_pt,
            leaf_end_pt,
            leaf_dir,
            door_width_ft
        )

        test_results.append(test_result)

        if not test_result["ok"]:
            continue

        # 组合评分：
        # 墙候选本身分 + 实际门板几何分。
        # 如果实际几何读不到，best_score 会很低，不会被选中。
        combined_score = c["score"] + test_result["best_score"] * 1.5
        test_result["combined_score"] = combined_score

        if best_test is None or combined_score > best_test.get("combined_score", -1e9):
            best_test = test_result
            best_candidate = c
            best_insert_pt = insert_pt

    if best_test is None or best_candidate is None or best_insert_pt is None:
        raise Exception("所有候选墙试放失败: {}".format(str(test_results)))

    # 正式创建最终门
    final_inst = None
    final_error = None

    # 先试最佳；若正式创建仍失败，继续按综合分排序的其他候选回退
    ok_tests = []
    for idx, tr in enumerate(test_results):
        if tr.get("ok", False):
            ok_tests.append((idx, tr.get("combined_score", -1e9), tr))

    ok_tests.sort(key=lambda x: x[1], reverse=True)

    final_candidate = None
    final_insert_pt = None
    final_test = None

    for idx, score, tr in ok_tests:
        c = candidates_to_try[idx]
        insert_pt = build_insert_point_from_candidate(c, cfg)
        best_state = tr.get("best_state", None)

        try:
            final_inst = create_final_door_on_candidate(
                doc,
                level,
                symbol,
                c,
                insert_pt,
                best_state
            )

            final_candidate = c
            final_insert_pt = insert_pt
            final_test = tr
            final_error = None
            break

        except Exception as e:
            final_error = str(e)
            try:
                if final_inst is not None:
                    doc.Delete(final_inst.Id)
                    doc.Regenerate()
            except:
                pass
            final_inst = None
            continue

    if final_inst is None:
        raise Exception("正式创建门失败: {}".format(final_error))

    return final_inst, {
        "match_method": "host_wall_candidates_plus_actual_instance_plan_geometry",
        "door_width_ft": door_width_ft,
        "bbox_px": [float(x1), float(y1), float(x2), float(y2)],
        "bbox_center_xyz": [bbox_center_pt.X, bbox_center_pt.Y, bbox_center_pt.Z],
        "kp_start_xyz": [kp_start_pt.X, kp_start_pt.Y, kp_start_pt.Z],
        "kp_end_xyz": [kp_end_pt.X, kp_end_pt.Y, kp_end_pt.Z],
        "hinge_pt_xyz": [hinge_pt.X, hinge_pt.Y, hinge_pt.Z],
        "leaf_end_pt_xyz": [leaf_end_pt.X, leaf_end_pt.Y, leaf_end_pt.Z],
        "leaf_dir_xyz": [leaf_dir.X, leaf_dir.Y, leaf_dir.Z],
        "candidate_count": len(candidates),
        "tried_candidate_count": len(candidates_to_try),
        "top_candidates": [serialize_wall_candidate(c) for c in candidates_to_try],
        "test_results": test_results,
        "selected_candidate": serialize_wall_candidate(final_candidate),
        "selected_insert_xyz": [final_insert_pt.X, final_insert_pt.Y, final_insert_pt.Z],
        "selected_best_state": final_test.get("best_state", None),
        "selected_best_score": final_test.get("best_score", None),
        "selected_combined_score": final_test.get("combined_score", None),
        "selected_best_eval_debug": final_test.get("best_eval_debug", None),
        "selected_state_evals": final_test.get("state_evals", None),
        "final_instance_id": final_inst.Id.IntegerValue
    }


# ============================================================
# 读取配置
# ============================================================
CLASS_CONFIG = load_class_config(class_config_json_path, logs)


# ============================================================
# 读取 seg_meta
# ============================================================
seg_meta = load_seg_meta(seg_meta_json_path, logs)

if seg_meta and seg_meta.get("ok", False):
    try:
        bbox_info = seg_meta.get("wall_bbox_px", None)
        scale_info = seg_meta.get("scale", {})
        dbg = seg_meta.get("debug", {})

        if bbox_info:
            bbox_min_x = bbox_info.get("min_x", None)
            bbox_min_y = bbox_info.get("min_y", None)
            bbox_width = bbox_info.get("width", None)
            bbox_height = bbox_info.get("height", None)

        scale_x_ft_per_px = scale_info.get("scale_x_ft_per_px", None)
        scale_y_ft_per_px = scale_info.get("scale_y_ft_per_px", None)

        if "pixelWidth" in dbg and "pixelHeight" in dbg:
            pixelWidth = dbg.get("pixelWidth", pixelWidth)
            pixelHeight = dbg.get("pixelHeight", pixelHeight)

        logs.append("bbox_info={}".format(str(bbox_info)))
        logs.append("scale_x_ft_per_px={}".format(str(scale_x_ft_per_px)))
        logs.append("scale_y_ft_per_px={}".format(str(scale_y_ft_per_px)))
        logs.append("pixelWidth={}, pixelHeight={}".format(pixelWidth, pixelHeight))

    except Exception as e:
        logs.append("解析seg_meta失败: {}".format(str(e)))
else:
    logs.append("seg_meta无效，使用fallback整图scale")


# ============================================================
# YOLO Pose
# ============================================================
yolo_pose = YOLO(pose_Model, task="pose")
newpath = "E:/yanjiu/revitss/tests/jjianzhu_pose.jpg"

pose_results = yolo_pose(
    source=pixpath,
    save=False,
    conf=0.3,
    iou=0.45,
    imgsz=640
)

cv2.imwrite(newpath, pose_results[0].plot())

result = pose_results[0]
boxes = result.boxes.xyxy.cpu().numpy() if result.boxes is not None else []
cls_ids = result.boxes.cls.cpu().numpy().astype(int) if result.boxes is not None else []
confs = result.boxes.conf.cpu().numpy() if result.boxes is not None else []
names = result.names

kps_xy = None
if result.keypoints is not None and result.keypoints.xy is not None:
    kps_xy = result.keypoints.xy.cpu().numpy()


# ============================================================
# Revit 文档
# ============================================================
doc = DocumentManager.Instance.CurrentDBDocument

TransactionManager.Instance.EnsureInTransaction(doc)

level = get_level(doc)
symbol_lookup = build_symbol_lookup(doc)

bed_median_area, bed_min_area = compute_class_area_threshold(
    boxes,
    cls_ids,
    names,
    "Bed",
    0.33
)

created_instances = []
debug_info = []
missing_family_types = []
skipped_unconfigured_classes = []


# 预激活符号
for cls_name, cfg in CLASS_CONFIG.items():
    symbol = get_symbol_from_lookup(
        symbol_lookup,
        cfg.get("family_name"),
        cfg.get("type_name")
    )
    if symbol:
        ensure_symbol_active(doc, symbol)


# ============================================================
# 主循环
# ============================================================
for i, bbox in enumerate(boxes):
    cls_name = names[int(cls_ids[i])] if len(cls_ids) > i else ""
    conf = confs[i] if len(confs) > i else 0.0

    if cls_name not in CLASS_CONFIG:
        skipped_unconfigured_classes.append({
            "index": i,
            "class": cls_name,
            "reason": "class_not_configured"
        })
        continue

    cfg = CLASS_CONFIG[cls_name]

    family_name = cfg.get("family_name")
    type_name = cfg.get("type_name")
    need_rotate = cfg.get("rotate", False)
    family_default_axis = cfg.get("family_default_axis", "Y")
    placement_mode = cfg.get("placement_mode", "free")

    symbol = get_symbol_from_lookup(symbol_lookup, family_name, type_name)

    if symbol is None:
        missing_family_types.append({
            "index": i,
            "class": cls_name,
            "family_name": family_name,
            "type_name": type_name,
            "reason": "family_symbol_not_found"
        })
        continue

    x1, y1, x2, y2 = bbox
    cx = (x1 + x2) * 0.5
    cy = (y1 + y2) * 0.5
    center_pt = pix_to_revit(cx, cy)

    area = max(0, x2 - x1) * max(0, y2 - y1)

    if cfg.get("area_filter", False):
        if cls_name == "Bed" and bed_min_area > 0 and area < bed_min_area:
            debug_info.append({
                "index": i,
                "class": cls_name,
                "reason": "filtered_small_area",
                "area": float(area),
                "threshold": float(bed_min_area)
            })
            continue

    start_pt = None
    end_pt = None

    if kps_xy is not None and i < len(kps_xy):
        kp_start_idx = cfg.get("kp_start_idx", None)
        kp_end_idx = cfg.get("kp_end_idx", None)

        kp = kps_xy[i]

        if kp_start_idx is not None and kp_end_idx is not None and len(kp) > max(kp_start_idx, kp_end_idx):
            sx, sy = kp[kp_start_idx]
            ex, ey = kp[kp_end_idx]
            start_pt = pix_to_revit(sx, sy)
            end_pt = pix_to_revit(ex, ey)

    # ------------------------------
    # 门：宿主墙候选评分 + 试放回退 + 实际几何匹配
    # ------------------------------
    if placement_mode == "door_hosted":
        try:
            inst, door_dbg = process_door_instance(
                doc,
                level,
                symbol,
                cls_name,
                bbox,
                start_pt,
                end_pt,
                cfg,
                logs,
                debug_tag="door_{}_{}".format(i, cls_name)
            )

            created_instances.append(inst.ToDSType(False))

            debug_info.append({
                "index": i,
                "class": cls_name,
                "family_name": family_name,
                "type_name": type_name,
                "placement_mode": "door_hosted",
                "bbox_px": [float(x1), float(y1), float(x2), float(y2)],
                "area": float(area),
                "conf": float(conf),
                "door_debug": door_dbg
            })

        except Exception as e:
            debug_info.append({
                "index": i,
                "class": cls_name,
                "family_name": family_name,
                "type_name": type_name,
                "placement_mode": "door_hosted",
                "reason": "door_place_failed",
                "error": str(e),
                "bbox_px": [float(x1), float(y1), float(x2), float(y2)],
                "kp_start_xyz": [start_pt.X, start_pt.Y, start_pt.Z] if start_pt else None,
                "kp_end_xyz": [end_pt.X, end_pt.Y, end_pt.Z] if end_pt else None
            })

        continue

    # ------------------------------
    # 普通自由族
    # ------------------------------
    try:
        instance = create_family_instance(doc, center_pt, symbol, level)
    except Exception as e:
        debug_info.append({
            "index": i,
            "class": cls_name,
            "reason": "create_instance_failed",
            "error": str(e)
        })
        continue

    rotated = False
    angle = None

    if need_rotate:
        if start_pt is not None and end_pt is not None:
            angle = get_angle_from_keypoints(start_pt, end_pt, family_default_axis)

            if angle is not None:
                try:
                    rotate_instance(doc, instance, center_pt, angle)
                    rotated = True
                except Exception as e:
                    debug_info.append({
                        "index": i,
                        "class": cls_name,
                        "reason": "rotate_failed",
                        "error": str(e)
                    })
            else:
                debug_info.append({
                    "index": i,
                    "class": cls_name,
                    "reason": "zero_direction_vector"
                })
        else:
            debug_info.append({
                "index": i,
                "class": cls_name,
                "reason": "no_keypoints_for_rotation"
            })

    created_instances.append(instance.ToDSType(False))

    debug_info.append({
        "index": i,
        "class": cls_name,
        "family_name": family_name,
        "type_name": type_name,
        "placement_mode": "free",
        "center_xyz": [center_pt.X, center_pt.Y, center_pt.Z],
        "bbox_px": [float(x1), float(y1), float(x2), float(y2)],
        "area": float(area),
        "rotated": rotated,
        "angle_rad": angle,
        "angle_deg": angle * 180.0 / math.pi if angle is not None else None,
        "conf": float(conf),
        "kp_start_xyz": [start_pt.X, start_pt.Y, start_pt.Z] if start_pt else None,
        "kp_end_xyz": [end_pt.X, end_pt.Y, end_pt.Z] if end_pt else None
    })


# ============================================================
# 提交
# ============================================================
TransactionManager.Instance.TransactionTaskDone()
doc.Regenerate()


OUT = {
    "preview_image": newpath,
    "created_instances": created_instances,
    "debug_info": debug_info,
    "missing_family_types": missing_family_types,
    "skipped_unconfigured_classes": skipped_unconfigured_classes,
    "bed_area_threshold": {
        "median_area": bed_median_area,
        "min_area": bed_min_area
    },
    "seg_meta_json_path": seg_meta_json_path,
    "class_config_json_path": class_config_json_path,
    "logs": logs
}
# ----------------------------------------
python_version_6 = Watch(python_script_3)  # graph output
python_version_7 = CodeBlock(i=python_version_6) { i["preview_image"]; }
file_from_path_5 = FileObject(path=python_version_7)
readFromFile_5 = Image.ReadFromFile(file=file_from_path_5)
watch_image_5 = WatchImageCore(image=readFromFile_5)
imagepath_2 = Filename("..\tests\a3室2厅1厨2卫-113.69㎡-南 北-103114745417.jpg")
python_version_8 = CodeBlock(i=python_version_2) { i[0]; }
file_from_path_6 = FileObject(path=python_version_8)
readFromFile_6 = Image.ReadFromFile(file=file_from_path_6)
watch_image_6 = WatchImageCore(image=readFromFile_6)
python_version_9 = Watch(python_version_8)  # graph output
readFromFile_7 = Image.ReadFromFile(file=file_from_path_6)
python_paths = Watch()  # graph output; unwired: arg0
seg_WWTD_Modelpath_2 = Filename("..\..\hou_pracs_on\Testings\Saves\best_WWTD_seg.pt")
python_script_4 = Python(IN[0]=seg_WWTD_Modelpath_2, IN[1]=imagepath, IN[2]=number, IN[3]=scale, IN[4]=python_version, IN[5]=seg_meta_Json_Path)  # CPython3; frozen
# ---------- python_script_4.python (1528 lines) ----------
# 加载 Python Standard 和 DesignScript 库
#---------------------------
import sys
import clr
clr.AddReference('ProtoGeometry')
from Autodesk.DesignScript.Geometry import *
import Autodesk.DesignScript.Geometry as DS
import Revit
from Revit.Elements import *
import System
sys.path.append("C:/Users/Lenovo/anaconda3/envs/revitenv/Lib/site-packages")
clr.AddReference('RevitAPI')
clr.AddReference('RevitAPIUI')
from Autodesk.Revit.DB import *
from Autodesk.Revit.UI import *

clr.AddReference('RevitServices')
from RevitServices.Persistence import DocumentManager
from RevitServices.Transactions import TransactionManager

clr.AddReference('RevitNodes')
import Revit
clr.ImportExtensions(Revit.Elements)
clr.ImportExtensions(Revit.GeometryConversion)

import re
import math
import json
import os
import traceback
import numpy as np
import torch
import cv2

from scipy.spatial import Voronoi
from scipy import ndimage
from shapely.geometry import Polygon, LineString, MultiLineString
from shapely.ops import linemerge
from shapely.ops import unary_union, split
from shapely.geometry import Point as ShpPoint
from shapely.geometry import Polygon as ShpPolygon
from shapely.geometry import MultiPolygon as ShpMultiPolygon
from shapely.geometry import Point as ShpPoint
from shapely.geometry import MultiLineString
from shapely.ops import linemerge
from skimage.morphology import skeletonize
from ultralytics import YOLO

dataEnteringNode = IN 

# =========================
# 输入
# =========================
dect_Model = IN[0]
pixpath = IN[1]
height = IN[2]
scale = IN[3]
dims_json_path = IN[4]
seg_meta_json_path = IN[5]

# =========================
# 参数
# =========================
origin = XYZ(0, 0, 0)   
widthFt = scale
pixelWidth = 1600   
pixelHeight = 1200 
DENSIFY_DIST = 0.5  
EPS = 1e-6

TARGET_WALL_TYPE_NAME = "基本墙 200mm"
TARGET_LEVEL_NAME = "标高 2"

newpath = "E:/yanjiu/revitss/tests/jjianzhu_seg.jpg"

scaleX = widthFt / pixelWidth if pixelWidth > 0 else 0.0
scaleY = widthFt * (pixelHeight / pixelWidth) / pixelHeight if pixelWidth > 0 and pixelHeight > 0 else 0.0

bbox_info_global = None
scale_x_ft_per_px_global = None
scale_y_ft_per_px_global = None

logs = []

# =========================
# 工具函数
# =========================
def ensure_dir_of_file(file_path):
    folder = os.path.dirname(file_path)
    if folder and not os.path.exists(folder):
        os.makedirs(folder)

def pix_to_revit(x, y):
    global bbox_info_global, scale_x_ft_per_px_global, scale_y_ft_per_px_global

    try:
        if bbox_info_global is not None and scale_x_ft_per_px_global is not None and scale_y_ft_per_px_global is not None:
            min_x = bbox_info_global["min_x"]
            min_y = bbox_info_global["min_y"]
            bbox_h = bbox_info_global["height"]

            local_x = x - min_x
            local_y = y - min_y

            revit_x = origin.X + local_x * scale_x_ft_per_px_global
            revit_y = origin.Y + (bbox_h - local_y) * scale_y_ft_per_px_global
            return XYZ(revit_x, revit_y, origin.Z)
    except:
        pass

    revit_x = origin.X + x * scaleX
    revit_y = origin.Y + (pixelHeight - y) * scaleY
    return XYZ(revit_x, revit_y, origin.Z)

def sanitize_name(name):
    if not name:
        return "Unknown"
    cleaned = re.sub(r'[\x00-\x1f\x7f]', '', name)
    if not cleaned.strip():
        return "Unnamed"
    return cleaned

def get_mask_bbox(binary_mask, logs):
    if binary_mask is None:
        logs.append("get_mask_bbox失败: binary_mask is None")
        return None

    ys, xs = np.where(binary_mask > 0)
    if len(xs) == 0 or len(ys) == 0:
        logs.append("get_mask_bbox失败: 墙体mask为空")
        return None

    min_x = int(np.min(xs))
    max_x = int(np.max(xs))
    min_y = int(np.min(ys))
    max_y = int(np.max(ys))

    bbox = {
        "min_x": min_x,
        "min_y": min_y,
        "max_x": max_x,
        "max_y": max_y,
        "width": int(max_x - min_x + 1),
        "height": int(max_y - min_y + 1)
    }
    logs.append("结构mask bbox: {}".format(str(bbox)))
    return bbox

# =========================
# 结构类配置
# =========================
STRUCTURE_CLASS_KEYWORDS = [
    "wall",
    "墙",
    "墙体",
    "basic wall",
    "door",
    "门",
    "tdoor",
    "double door",
    "window",
    "窗",
    "窗户"
]

STRUCTURE_CLASS_EXACT = set([
    "wall",
    "door",
    "window",
    "tdoor"
])

EXPAND_CLASSES = set([
    "door",
    "window",
    "tdoor"
])

def normalize_class_name(name):
    if name is None:
        return ""
    return str(name).strip().lower()

def is_structure_wall_like_class(name):
    n = normalize_class_name(name)
    if not n:
        return False

    if n in STRUCTURE_CLASS_EXACT:
        return True

    for kw in STRUCTURE_CLASS_KEYWORDS:
        if kw.lower() in n:
            return True
    return False

def ensure_polygon(geom):
    if geom is None or geom.is_empty:
        return None
    try:
        if not geom.is_valid:
            geom = geom.buffer(0)
    except:
        pass
    if geom is None or geom.is_empty:
        return None

    if isinstance(geom, ShpPolygon):
        return geom

    if isinstance(geom, ShpMultiPolygon):
        polys = [g for g in geom.geoms if g is not None and not g.is_empty]
        if not polys:
            return None
        polys.sort(key=lambda p: p.area, reverse=True)
        return polys[0]

    return None

def line_long_enough(line_geom, min_len=0.1):
    if line_geom is None or line_geom.is_empty:
        return False
    try:
        return line_geom.length >= min_len
    except:
        return False

def snap_line_to_axis(line_geom):
    if line_geom is None or line_geom.is_empty:
        return None
    coords = list(line_geom.coords)
    if len(coords) < 2:
        return None
    x1, y1 = coords[0]
    x2, y2 = coords[-1]
    dx = x2 - x1
    dy = y2 - y1
    if abs(dx) >= abs(dy):
        ym = 0.5 * (y1 + y2)
        return LineString([(x1, ym), (x2, ym)])
    else:
        xm = 0.5 * (x1 + x2)
        return LineString([(xm, y1), (xm, y2)])

def get_line_orientation_from_geom(line_geom):
    coords = list(line_geom.coords)
    x1, y1 = coords[0]
    x2, y2 = coords[-1]
    if abs(y2 - y1) <= abs(x2 - x1):
        return "h"
    return "v"

def get_line_orientation(seg):
    return get_line_orientation_from_geom(seg['line'])

def line_length(line_geom):
    try:
        return line_geom.length
    except:
        return 0.0

def copy_segments(segments):
    out = []
    for s in segments:
        out.append({
            'line': s['line'],
            'thickness': s['thickness'],
            'name': s['name']
        })
    return out

def longest_linestring_from_intersection(inter):
    if inter is None or inter.is_empty:
        return None
    if inter.geom_type == "LineString":
        return inter
    if inter.geom_type == "MultiLineString":
        lines = [g for g in inter.geoms if g.length > 1e-4]
        if not lines:
            return None
        lines.sort(key=lambda g: g.length, reverse=True)
        return lines[0]
    return None

def merge_close_vertices(segments, delta):
    pts = []
    for seg in segments:
        coords = list(seg['line'].coords)
        pts.append(coords[0])
        pts.append(coords[-1])

    if not pts:
        return segments

    clusters = []
    for p in pts:
        assigned = False
        for cluster in clusters:
            cx, cy, plist = cluster
            d2 = (p[0]-cx)**2 + (p[1]-cy)**2
            if d2 < delta * delta:
                plist.append(p)
                nx = sum(pp[0] for pp in plist) / len(plist)
                ny = sum(pp[1] for pp in plist) / len(plist)
                cluster[0] = nx
                cluster[1] = ny
                assigned = True
                break
        if not assigned:
            clusters.append([p[0], p[1], [p]])

    def snap_point(p):
        best = p
        best_d = 1e18
        for cx, cy, plist in clusters:
            d2 = (p[0]-cx)**2 + (p[1]-cy)**2
            if d2 < best_d:
                best_d = d2
                best = (cx, cy)
        return best

    new_segments = []
    for seg in segments:
        coords = list(seg['line'].coords)
        p1 = snap_point(coords[0])
        p2 = snap_point(coords[-1])
        if ((p1[0]-p2[0])**2 + (p1[1]-p2[1])**2) ** 0.5 < 0.1:
            continue
        new_line = LineString([p1, p2])
        new_line = snap_line_to_axis(new_line)
        if new_line is None:
            continue
        new_segments.append({
            'line': new_line,
            'thickness': seg['thickness'],
            'name': seg['name']
        })
    return new_segments

def point_to_segment_distance(pt, a, b):
    px, py = pt
    ax, ay = a
    bx, by = b
    dx = bx - ax
    dy = by - ay
    if abs(dx) < EPS and abs(dy) < EPS:
        return ((px-ax)**2 + (py-ay)**2)**0.5, a, 0.0

    t = ((px-ax)*dx + (py-ay)*dy) / (dx*dx + dy*dy)
    t_clamped = max(0.0, min(1.0, t))
    qx = ax + t_clamped * dx
    qy = ay + t_clamped * dy
    dist = ((px-qx)**2 + (py-qy)**2)**0.5
    return dist, (qx, qy), t_clamped

def split_segments_by_near_vertices(segments, delta):
    if not segments:
        return segments

    vertices = []
    for seg in segments:
        coords = list(seg['line'].coords)
        vertices.append(coords[0])
        vertices.append(coords[-1])

    new_segments = []
    for idx, seg in enumerate(segments):
        coords = list(seg['line'].coords)
        a = coords[0]
        b = coords[-1]
        split_pts = []

        for v in vertices:
            if v == a or v == b:
                continue
            dist, proj, t = point_to_segment_distance(v, a, b)
            if dist < delta and t > 0.01 and t < 0.99:
                split_pts.append((t, v))

        if not split_pts:
            new_segments.append(seg)
        else:
            split_pts.sort(key=lambda x: x[0])
            chain = [a] + [v for _, v in split_pts] + [b]
            for p1, p2 in zip(chain[:-1], chain[1:]):
                if ((p1[0]-p2[0])**2 + (p1[1]-p2[1])**2) ** 0.5 < 0.1:
                    continue
                new_line = snap_line_to_axis(LineString([p1, p2]))
                if new_line is None:
                    continue
                new_segments.append({
                    'line': new_line,
                    'thickness': seg['thickness'],
                    'name': seg['name']
                })
    return new_segments

def merge_collinear_segments_strict(segments, coord_tol=0.08, gap_tol=0.25):
    if not segments:
        return segments

    horizontal = []
    vertical = []
    others = []

    for seg in segments:
        coords = list(seg['line'].coords)
        x1, y1 = coords[0]
        x2, y2 = coords[-1]

        if abs(y2 - y1) <= coord_tol:
            y = 0.5 * (y1 + y2)
            xmin, xmax = min(x1, x2), max(x1, x2)
            horizontal.append((y, xmin, xmax, seg))
        elif abs(x2 - x1) <= coord_tol:
            x = 0.5 * (x1 + x2)
            ymin, ymax = min(y1, y2), max(y1, y2)
            vertical.append((x, ymin, ymax, seg))
        else:
            others.append(seg)

    merged = []

    horizontal.sort(key=lambda t: (round(t[0], 2), t[1]))
    used = [False] * len(horizontal)
    for i in range(len(horizontal)):
        if used[i]:
            continue
        y, x1, x2, seg = horizontal[i]
        thick = seg['thickness']
        name = seg['name']

        for j in range(i + 1, len(horizontal)):
            if used[j]:
                continue
            y2, xx1, xx2, seg2 = horizontal[j]
            if abs(y2 - y) <= coord_tol and xx1 <= x2 + gap_tol:
                x2 = max(x2, xx2)
                thick = 0.5 * (thick + seg2['thickness'])
                used[j] = True

        merged.append({
            'line': LineString([(x1, y), (x2, y)]),
            'thickness': thick,
            'name': name
        })

    vertical.sort(key=lambda t: (round(t[0], 2), t[1]))
    used = [False] * len(vertical)
    for i in range(len(vertical)):
        if used[i]:
            continue
        x, y1, y2, seg = vertical[i]
        thick = seg['thickness']
        name = seg['name']

        for j in range(i + 1, len(vertical)):
            if used[j]:
                continue
            x2, yy1, yy2, seg2 = vertical[j]
            if abs(x2 - x) <= coord_tol and yy1 <= y2 + gap_tol:
                y2 = max(y2, yy2)
                thick = 0.5 * (thick + seg2['thickness'])
                used[j] = True

        merged.append({
            'line': LineString([(x, y1), (x, y2)]),
            'thickness': thick,
            'name': name
        })

    merged.extend(others)
    return merged

def optimize_wall_centerlines(candidates, iter_count=1, enable_merge_collinear=True):
    if not candidates:
        return []

    segs = candidates[:]

    if enable_merge_collinear:
        segs = merge_collinear_segments_strict(segs, coord_tol=0.08, gap_tol=0.35)

    for _ in range(iter_count):
        if not segs:
            break

        avg_t = sum(s['thickness'] for s in segs) / max(len(segs), 1)
        delta = 0.20 * avg_t
        if delta < 0.03:
            delta = 0.03
        if delta > 0.12:
            delta = 0.12

        segs = merge_close_vertices(segs, delta)
        segs = split_segments_by_near_vertices(segs, delta)

    cleaned = []
    for s in segs:
        try:
            if s['line'] is None or s['line'].is_empty:
                continue
            if s['line'].length < 0.08:
                continue
            cleaned.append(s)
        except:
            continue

    return cleaned

# =========================
# mask 构建与清理
# =========================
def build_global_structure_mask(result, pixelWidth, pixelHeight, logs):
    wall_mask = np.zeros((pixelHeight, pixelWidth), dtype=np.uint8)
    class_counter = {}

    if result.masks is None:
        logs.append("result.masks is None")
        return wall_mask, class_counter

    masks_xy = result.masks.xy
    cls_ids = result.boxes.cls.cpu().numpy().astype(int)
    names = result.names

    logs.append("总mask数量: {}".format(len(masks_xy)))

    expand_kernel = cv2.getStructuringElement(cv2.MORPH_RECT, (5, 5))

    for i, contour_pts in enumerate(masks_xy):
        try:
            if i >= len(cls_ids):
                continue

            class_id = cls_ids[i]
            class_name = names[class_id]
            class_name_norm = normalize_class_name(class_name)

            if not is_structure_wall_like_class(class_name):
                continue

            pts = np.array(contour_pts, dtype=np.int32)
            if len(pts) < 3:
                continue

            pts[:, 0] = np.clip(pts[:, 0], 0, pixelWidth - 1)
            pts[:, 1] = np.clip(pts[:, 1], 0, pixelHeight - 1)

            if class_name_norm in EXPAND_CLASSES:
                temp = np.zeros((pixelHeight, pixelWidth), dtype=np.uint8)
                cv2.fillPoly(temp, [pts], 255)
                temp = cv2.dilate(temp, expand_kernel, iterations=1)
                wall_mask[temp > 0] = 255
            else:
                cv2.fillPoly(wall_mask, [pts], 255)

            class_counter[class_name_norm] = class_counter.get(class_name_norm, 0) + 1

        except Exception as e:
            logs.append("合成结构mask失败 idx={}: {}".format(i, str(e)))
            continue

    logs.append("参与墙体生成的类别统计: {}".format(str(class_counter)))
    return wall_mask, class_counter

def clean_wall_mask(binary_mask, logs):
    mask = binary_mask.copy()

    kernel_bridge = cv2.getStructuringElement(cv2.MORPH_RECT, (3, 3))
    kernel_close_big = cv2.getStructuringElement(cv2.MORPH_RECT, (7, 7))
    kernel_close_small = cv2.getStructuringElement(cv2.MORPH_RECT, (5, 5))

    mask = cv2.dilate(mask, kernel_bridge, iterations=1)
    mask = cv2.morphologyEx(mask, cv2.MORPH_CLOSE, kernel_close_big)
    mask = cv2.morphologyEx(mask, cv2.MORPH_CLOSE, kernel_close_small)
    mask = cv2.erode(mask, kernel_bridge, iterations=1)

    num_labels, labels, stats, _ = cv2.connectedComponentsWithStats(mask, connectivity=8)
    cleaned = np.zeros_like(mask)

    for i in range(1, num_labels):
        area = stats[i, cv2.CC_STAT_AREA]
        if area >= 30:
            cleaned[labels == i] = 255

    logs.append("结构mask清理完成(补缝增强版)")
    return cleaned

def estimate_wall_width_pixels(binary_mask, logs):
    if binary_mask is None or binary_mask.max() == 0:
        logs.append("墙宽估计失败：mask为空")
        return 6.0

    dist = cv2.distanceTransform(binary_mask, cv2.DIST_L2, 5)
    vals = dist[dist > 0]
    if len(vals) == 0:
        logs.append("墙宽估计失败：distanceTransform为空")
        return 6.0

    wall_width_px = max(2.0, 2.0 * np.median(vals))
    logs.append("估计墙宽像素值: {:.2f}".format(wall_width_px))
    return wall_width_px

def skeletonize_wall_mask(binary_mask, logs):
    try:
        from skimage.morphology import skeletonize
        skel = skeletonize(binary_mask > 0)
        logs.append("使用 skimage.skeletonize 成功")
        return skel.astype(np.uint8)
    except Exception as e:
        logs.append("skimage骨架失败，改用fallback: {}".format(str(e)))
        return skeletonize_fallback(binary_mask, logs)

def skeletonize_fallback(binary_mask, logs):
    img = (binary_mask > 0).astype(np.uint8) * 255
    size = np.size(img)
    skel = np.zeros(img.shape, np.uint8)

    element = cv2.getStructuringElement(cv2.MORPH_CROSS, (3, 3))
    done = False

    while not done:
        eroded = cv2.erode(img, element)
        temp = cv2.dilate(eroded, element)
        temp = cv2.subtract(img, temp)
        skel = cv2.bitwise_or(skel, temp)
        img = eroded.copy()

        zeros = size - cv2.countNonZero(img)
        if zeros == size:
            done = True

    logs.append("fallback skeletonize 成功")
    return (skel > 0).astype(np.uint8)

def get_neighbors_8(x, y, w, h):
    nbs = []
    for dy in [-1, 0, 1]:
        for dx in [-1, 0, 1]:
            if dx == 0 and dy == 0:
                continue
            nx = x + dx
            ny = y + dy
            if 0 <= nx < w and 0 <= ny < h:
                nbs.append((nx, ny))
    return nbs

def extract_skeleton_graph(skel, logs):
    h, w = skel.shape
    skel_pts = set()
    for y in range(h):
        xs = np.where(skel[y] > 0)[0]
        for x in xs:
            skel_pts.add((x, y))

    if not skel_pts:
        logs.append("骨架为空")
        return [], []

    degree = {}
    for (x, y) in skel_pts:
        cnt = 0
        for nx, ny in get_neighbors_8(x, y, w, h):
            if (nx, ny) in skel_pts:
                cnt += 1
        degree[(x, y)] = cnt

    nodes = [p for p, d in degree.items() if d != 2]

    if not nodes:
        nodes = list(skel_pts)

    node_set = set(nodes)
    visited_edges = set()
    edges = []

    for node in nodes:
        x0, y0 = node
        for nx, ny in get_neighbors_8(x0, y0, w, h):
            if (nx, ny) not in skel_pts:
                continue

            edge_key = tuple(sorted([node, (nx, ny)]))
            if edge_key in visited_edges:
                continue

            path = [node, (nx, ny)]
            prev = node
            curr = (nx, ny)

            while True:
                visited_edges.add(tuple(sorted([prev, curr])))

                if curr in node_set and curr != node:
                    break

                nbrs = []
                for tx, ty in get_neighbors_8(curr[0], curr[1], w, h):
                    if (tx, ty) in skel_pts and (tx, ty) != prev:
                        nbrs.append((tx, ty))

                if len(nbrs) == 0:
                    break
                if len(nbrs) > 1:
                    break

                nxt = nbrs[0]
                path.append(nxt)
                prev = curr
                curr = nxt

            if len(path) >= 2:
                edges.append(path)

    logs.append("骨架图提取完成: nodes={}, edges={}".format(len(nodes), len(edges)))
    return nodes, edges

def split_path_by_direction(path, turn_threshold=2):
    if not path or len(path) < 3:
        return [path] if path else []

    segments = []
    current = [path[0], path[1]]

    def major_dir(p1, p2):
        dx = p2[0] - p1[0]
        dy = p2[1] - p1[1]
        if abs(dx) >= abs(dy):
            return "h"
        else:
            return "v"

    prev_dir = major_dir(path[0], path[1])

    for i in range(2, len(path)):
        d = major_dir(path[i-1], path[i])

        if d == prev_dir:
            current.append(path[i])
        else:
            if len(current) <= turn_threshold and segments:
                segments[-1].extend(current[1:])
                current = [segments[-1][-1], path[i]]
            else:
                segments.append(current)
                current = [path[i-1], path[i]]
            prev_dir = d

    if current:
        if len(current) <= turn_threshold and segments:
            segments[-1].extend(current[1:])
        else:
            segments.append(current)

    cleaned = []
    for seg in segments:
        if seg and len(seg) >= 2:
            cleaned.append(seg)

    return cleaned

def fit_axis_line_from_mask(sub_path, wall_mask, pixelWidth, pixelHeight, min_len_px=8):
    if not sub_path or len(sub_path) < 2:
        return None

    xs = [p[0] for p in sub_path]
    ys = [p[1] for p in sub_path]

    x_min = max(0, int(min(xs)))
    x_max = min(pixelWidth - 1, int(max(xs)))
    y_min = max(0, int(min(ys)))
    y_max = min(pixelHeight - 1, int(max(ys)))

    dx = x_max - x_min
    dy = y_max - y_min

    if dx >= dy:
        mids = []
        for x in range(x_min, x_max + 1):
            ys_in = np.where(wall_mask[:, x] > 0)[0]
            ys_local = ys_in[(ys_in >= y_min - 8) & (ys_in <= y_max + 8)]
            if len(ys_local) >= 2:
                y_top = np.min(ys_local)
                y_bot = np.max(ys_local)
                y_mid = 0.5 * (y_top + y_bot)
                mids.append((x, y_mid))

        if len(mids) < 2:
            return None

        xs2 = [p[0] for p in mids]
        ys2 = [p[1] for p in mids]

        x1 = min(xs2)
        x2 = max(xs2)
        y = float(np.median(ys2))

        if (x2 - x1) < min_len_px:
            return None

        return ((x1, y), (x2, y), "h")

    else:
        mids = []
        for y in range(y_min, y_max + 1):
            xs_in = np.where(wall_mask[y, :] > 0)[0]
            xs_local = xs_in[(xs_in >= x_min - 8) & (xs_in <= x_max + 8)]
            if len(xs_local) >= 2:
                x_left = np.min(xs_local)
                x_right = np.max(xs_local)
                x_mid = 0.5 * (x_left + x_right)
                mids.append((x_mid, y))

        if len(mids) < 2:
            return None

        xs2 = [p[0] for p in mids]
        ys2 = [p[1] for p in mids]

        y1 = min(ys2)
        y2 = max(ys2)
        x = float(np.median(xs2))

        if (y2 - y1) < min_len_px:
            return None

        return ((x, y1), (x, y2), "v")

def pixel_line_to_revit_linestring(p1, p2):
    rp1 = pix_to_revit(p1[0], p1[1])
    rp2 = pix_to_revit(p2[0], p2[1])
    if rp1.DistanceTo(rp2) < 0.1:
        return None
    return LineString([(rp1.X, rp1.Y), (rp2.X, rp2.Y)])

def simplify_path_to_axis_lines(path, wall_mask, pixelWidth, pixelHeight, logs, min_len_px=8):
    result_lines = []

    sub_paths = split_path_by_direction(path, turn_threshold=2)
    for sub in sub_paths:
        try:
            fitted = fit_axis_line_from_mask(
                sub, wall_mask, pixelWidth, pixelHeight, min_len_px=min_len_px
            )
            if fitted is None:
                continue

            p1, p2, ori = fitted
            line_geom = pixel_line_to_revit_linestring(p1, p2)
            if line_geom is None:
                continue

            if line_geom.length < 0.08:
                continue

            result_lines.append(line_geom)

        except Exception as e:
            logs.append("子段拟合失败: {}".format(str(e)))
            continue

    return result_lines

def extract_wall_centerlines_from_global_mask(result, pixelWidth, pixelHeight, logs):
    wall_mask, class_counter = build_global_structure_mask(result, pixelWidth, pixelHeight, logs)
    if wall_mask.max() == 0:
        logs.append("没有结构类mask被写入全局墙图")
        return [], 0.3, class_counter, wall_mask

    cleaned_mask = clean_wall_mask(wall_mask, logs)
    wall_width_px = estimate_wall_width_pixels(cleaned_mask, logs)

    skel = skeletonize_wall_mask(cleaned_mask, logs)
    nodes, edges = extract_skeleton_graph(skel, logs)

    if not edges:
        logs.append("骨架没有边")
        wall_width_ft = wall_width_px * (scale_x_ft_per_px_global if scale_x_ft_per_px_global else scaleX)
        return [], wall_width_ft, class_counter, cleaned_mask

    wall_width_ft = wall_width_px * (scale_x_ft_per_px_global if scale_x_ft_per_px_global else scaleX)
    candidates = []

    for idx, path in enumerate(edges):
        try:
            line_list = simplify_path_to_axis_lines(
                path, cleaned_mask, pixelWidth, pixelHeight, logs,
                min_len_px=max(3, int(wall_width_px * 0.5))
            )

            for line_geom in line_list:
                candidates.append({
                    'line': line_geom,
                    'thickness': wall_width_ft,
                    'name': "Wall"
                })

        except Exception as e:
            logs.append("路径{}转中心线失败: {}".format(idx, str(e)))
            continue

    logs.append("全局提取中心线候选数量: {}".format(len(candidates)))
    return candidates, wall_width_ft, class_counter, cleaned_mask

# =========================
# 第二版增强：几何补缝与对齐
# =========================
def bridge_near_orthogonal_gaps(segments, gap_tol=0.6, axis_tol=0.25):
    if not segments:
        return segments

    segs = copy_segments(segments)

    for i in range(len(segs)):
        for j in range(i + 1, len(segs)):
            si = segs[i]
            sj = segs[j]
            if si is None or sj is None:
                continue

            oi = get_line_orientation(si)
            oj = get_line_orientation(sj)

            if oi == oj:
                continue

            if oi == "v" and oj == "h":
                tmp = si
                si = sj
                sj = tmp
                idx_h = j
                idx_v = i
            else:
                idx_h = i
                idx_v = j

            coords_h = list(si['line'].coords)
            coords_v = list(sj['line'].coords)

            hx1, hy1 = coords_h[0]
            hx2, hy2 = coords_h[-1]
            vx1, vy1 = coords_v[0]
            vx2, vy2 = coords_v[-1]

            y_h = 0.5 * (hy1 + hy2)
            x_v = 0.5 * (vx1 + vx2)

            hminx, hmaxx = min(hx1, hx2), max(hx1, hx2)
            vminy, vmaxy = min(vy1, vy2), max(vy1, vy2)

            inter_pt = (x_v, y_h)

            h_endpts = [(hx1, hy1), (hx2, hy2)]
            v_endpts = [(vx1, vy1), (vx2, vy2)]

            h_dists = [((p[0]-inter_pt[0])**2 + (p[1]-inter_pt[1])**2)**0.5 for p in h_endpts]
            v_dists = [((p[0]-inter_pt[0])**2 + (p[1]-inter_pt[1])**2)**0.5 for p in v_endpts]

            h_min_idx = int(np.argmin(h_dists))
            v_min_idx = int(np.argmin(v_dists))

            h_min_dist = h_dists[h_min_idx]
            v_min_dist = v_dists[v_min_idx]

            cond_h = (x_v >= hminx - axis_tol and x_v <= hmaxx + gap_tol)
            cond_v = (y_h >= vminy - axis_tol and y_h <= vmaxy + gap_tol)

            if h_min_dist <= gap_tol and v_min_dist <= gap_tol and cond_h and cond_v:
                other_h = h_endpts[1 - h_min_idx]
                other_v = v_endpts[1 - v_min_idx]

                new_h = snap_line_to_axis(LineString([other_h, inter_pt]))
                new_v = snap_line_to_axis(LineString([other_v, inter_pt]))

                if new_h is not None and new_h.length >= 0.08:
                    segs[idx_h]['line'] = new_h
                if new_v is not None and new_v.length >= 0.08:
                    segs[idx_v]['line'] = new_v

    cleaned = []
    for s in segs:
        try:
            if s['line'] is None or s['line'].is_empty:
                continue
            if s['line'].length < 0.08:
                continue
            cleaned.append(s)
        except:
            continue
    return cleaned

def align_parallel_segments(segments, coord_tol=0.35):
    """
    将接近共线的水平段/竖直段拉齐到同一坐标轴
    水平：对齐 y
    竖直：对齐 x
    """
    if not segments:
        return segments

    segs = copy_segments(segments)

    horizontal_groups = []
    vertical_groups = []

    for idx, s in enumerate(segs):
        coords = list(s['line'].coords)
        x1, y1 = coords[0]
        x2, y2 = coords[-1]
        ori = get_line_orientation(s)

        if ori == "h":
            y = 0.5 * (y1 + y2)
            added = False
            for g in horizontal_groups:
                if abs(g['coord'] - y) <= coord_tol:
                    g['indices'].append(idx)
                    g['values'].append(y)
                    g['coord'] = float(np.median(g['values']))
                    added = True
                    break
            if not added:
                horizontal_groups.append({
                    'coord': y,
                    'indices': [idx],
                    'values': [y]
                })
        else:
            x = 0.5 * (x1 + x2)
            added = False
            for g in vertical_groups:
                if abs(g['coord'] - x) <= coord_tol:
                    g['indices'].append(idx)
                    g['values'].append(x)
                    g['coord'] = float(np.median(g['values']))
                    added = True
                    break
            if not added:
                vertical_groups.append({
                    'coord': x,
                    'indices': [idx],
                    'values': [x]
                })

    for g in horizontal_groups:
        target_y = g['coord']
        for idx in g['indices']:
            coords = list(segs[idx]['line'].coords)
            x1, y1 = coords[0]
            x2, y2 = coords[-1]
            segs[idx]['line'] = LineString([(x1, target_y), (x2, target_y)])

    for g in vertical_groups:
        target_x = g['coord']
        for idx in g['indices']:
            coords = list(segs[idx]['line'].coords)
            x1, y1 = coords[0]
            x2, y2 = coords[-1]
            segs[idx]['line'] = LineString([(target_x, y1), (target_x, y2)])

    return segs

def bridge_parallel_gaps(segments, coord_tol=0.25, gap_tol=0.8):
    """
    平行且接近共线的短缝桥接
    - 水平对水平：y接近，x方向中间差一小截 -> 合并成一条
    - 竖直对竖直：x接近，y方向中间差一小截 -> 合并成一条
    """
    if not segments:
        return segments

    segs = copy_segments(segments)
    used = [False] * len(segs)
    result = []

    # 先水平
    horiz = []
    vert = []
    other = []

    for idx, s in enumerate(segs):
        ori = get_line_orientation(s)
        coords = list(s['line'].coords)
        x1, y1 = coords[0]
        x2, y2 = coords[-1]

        if ori == "h":
            y = 0.5 * (y1 + y2)
            xmin = min(x1, x2)
            xmax = max(x1, x2)
            horiz.append((idx, y, xmin, xmax, s))
        else:
            x = 0.5 * (x1 + x2)
            ymin = min(y1, y2)
            ymax = max(y1, y2)
            vert.append((idx, x, ymin, ymax, s))

    horiz.sort(key=lambda t: (round(t[1], 3), t[2]))
    consumed = set()
    for i in range(len(horiz)):
        if i in consumed:
            continue
        idx_i, y_i, x1_i, x2_i, seg_i = horiz[i]
        cur_y = y_i
        cur_x1 = x1_i
        cur_x2 = x2_i
        cur_thick = seg_i['thickness']
        cur_name = seg_i['name']

        for j in range(i + 1, len(horiz)):
            if j in consumed:
                continue
            idx_j, y_j, x1_j, x2_j, seg_j = horiz[j]

            if abs(y_j - cur_y) <= coord_tol:
                gap = x1_j - cur_x2
                overlap = min(cur_x2, x2_j) - max(cur_x1, x1_j)
                if gap <= gap_tol or overlap >= -coord_tol:
                    cur_x1 = min(cur_x1, x1_j)
                    cur_x2 = max(cur_x2, x2_j)
                    cur_y = float(np.median([cur_y, y_j]))
                    cur_thick = 0.5 * (cur_thick + seg_j['thickness'])
                    consumed.add(j)

        result.append({
            'line': LineString([(cur_x1, cur_y), (cur_x2, cur_y)]),
            'thickness': cur_thick,
            'name': cur_name
        })

    vert.sort(key=lambda t: (round(t[1], 3), t[2]))
    consumed = set()
    for i in range(len(vert)):
        if i in consumed:
            continue
        idx_i, x_i, y1_i, y2_i, seg_i = vert[i]
        cur_x = x_i
        cur_y1 = y1_i
        cur_y2 = y2_i
        cur_thick = seg_i['thickness']
        cur_name = seg_i['name']

        for j in range(i + 1, len(vert)):
            if j in consumed:
                continue
            idx_j, x_j, y1_j, y2_j, seg_j = vert[j]

            if abs(x_j - cur_x) <= coord_tol:
                gap = y1_j - cur_y2
                overlap = min(cur_y2, y2_j) - max(cur_y1, y1_j)
                if gap <= gap_tol or overlap >= -coord_tol:
                    cur_y1 = min(cur_y1, y1_j)
                    cur_y2 = max(cur_y2, y2_j)
                    cur_x = float(np.median([cur_x, x_j]))
                    cur_thick = 0.5 * (cur_thick + seg_j['thickness'])
                    consumed.add(j)

        result.append({
            'line': LineString([(cur_x, cur_y1), (cur_x, cur_y2)]),
            'thickness': cur_thick,
            'name': cur_name
        })

    return result

def snap_near_endpoints(segments, snap_tol=0.25):
    """
    对近距离端点做统一吸附
    """
    if not segments:
        return segments

    pts = []
    for idx, seg in enumerate(segments):
        coords = list(seg['line'].coords)
        pts.append((idx, 0, coords[0]))
        pts.append((idx, 1, coords[-1]))

    clusters = []
    for item in pts:
        idx, end_flag, p = item
        assigned = False
        for c in clusters:
            cx, cy = c['center']
            if ((p[0]-cx)**2 + (p[1]-cy)**2)**0.5 <= snap_tol:
                c['items'].append(item)
                xs = [it[2][0] for it in c['items']]
                ys = [it[2][1] for it in c['items']]
                c['center'] = (float(np.mean(xs)), float(np.mean(ys)))
                assigned = True
                break
        if not assigned:
            clusters.append({
                'center': (p[0], p[1]),
                'items': [item]
            })

    segs = copy_segments(segments)

    for c in clusters:
        center = c['center']
        for idx, end_flag, p in c['items']:
            coords = list(segs[idx]['line'].coords)
            if end_flag == 0:
                new_line = LineString([center, coords[-1]])
            else:
                new_line = LineString([coords[0], center])

            new_line = snap_line_to_axis(new_line)
            if new_line is not None and new_line.length >= 0.08:
                segs[idx]['line'] = new_line

    return segs

def clean_duplicate_segments(segments, coord_tol=0.05):
    if not segments:
        return segments

    uniq = []
    keys = set()

    for s in segments:
        try:
            coords = list(s['line'].coords)
            x1, y1 = coords[0]
            x2, y2 = coords[-1]

            p1 = (round(x1 / coord_tol), round(y1 / coord_tol))
            p2 = (round(x2 / coord_tol), round(y2 / coord_tol))
            key = tuple(sorted([p1, p2]))

            if key in keys:
                continue
            keys.add(key)
            uniq.append(s)
        except:
            continue

    return uniq

def run_geometry_enhancement_v2(segments, logs):
    if not segments:
        return segments

    segs = copy_segments(segments)
    logs.append("V2增强-输入墙段数: {}".format(len(segs)))

    segs = align_parallel_segments(segs, coord_tol=0.35)
    logs.append("V2增强-平行对齐后: {}".format(len(segs)))

    segs = bridge_parallel_gaps(segs, coord_tol=0.25, gap_tol=0.8)
    logs.append("V2增强-平行短缝桥接后: {}".format(len(segs)))

    segs = bridge_near_orthogonal_gaps(segs, gap_tol=0.6, axis_tol=0.25)
    logs.append("V2增强-正交补缝后: {}".format(len(segs)))

    segs = snap_near_endpoints(segs, snap_tol=0.25)
    logs.append("V2增强-端点吸附后: {}".format(len(segs)))

    segs = merge_collinear_segments_strict(segs, coord_tol=0.08, gap_tol=0.35)
    logs.append("V2增强-严格共线合并后: {}".format(len(segs)))

    segs = clean_duplicate_segments(segs, coord_tol=0.05)
    logs.append("V2增强-去重后: {}".format(len(segs)))

    cleaned = []
    for s in segs:
        try:
            if s['line'] is None or s['line'].is_empty:
                continue
            if s['line'].length < 0.08:
                continue
            cleaned.append(s)
        except:
            continue

    logs.append("V2增强-最终墙段数: {}".format(len(cleaned)))
    return cleaned

# =========================
# 运行YOLO分割
# =========================
yolo_seg = YOLO(dect_Model, task="seg")
seg_result = yolo_seg(source=pixpath, save=False, conf=0.3, iou=0.45, imgsz=640)
cv2.imwrite(newpath, seg_result[0].plot())

result = seg_result[0]
boxes = result.boxes
xyxy = boxes.xyxy.cpu().numpy() if boxes is not None else np.empty((0,4))
cls_ids = boxes.cls.cpu().numpy().astype(int) if boxes is not None else np.array([], dtype=int)
names = result.names

# =========================
# 读取OCR尺寸JSON
# =========================
dims_data = None
horizontal_length_mm = None
vertical_length_mm = None

try:
    with open(dims_json_path, "r", encoding="utf-8") as f:
        dims_data = json.load(f)

    if dims_data.get("ok", False):
        if "result" in dims_data:
            horizontal_length_mm = dims_data["result"].get("horizontal_length", None)
            vertical_length_mm = dims_data["result"].get("vertical_length", None)
        else:
            horizontal_length_mm = dims_data.get("horizontal_length", None)
            vertical_length_mm = dims_data.get("vertical_length", None)

    logs.append("读取dims_json成功: horizontal={} mm, vertical={} mm".format(
        str(horizontal_length_mm), str(vertical_length_mm)
    ))
except Exception as e:
    logs.append("读取dims_json失败: {}".format(str(e)))

# =========================
# 先做结构mask -> bbox -> scale
# =========================
global_structure_mask, structure_class_counter = build_global_structure_mask(result, pixelWidth, pixelHeight, logs)
cleaned_global_structure_mask = clean_wall_mask(global_structure_mask, logs)
bbox_info = get_mask_bbox(cleaned_global_structure_mask, logs)

scale_x_mm_per_px = None
scale_y_mm_per_px = None
scale_avg_mm_per_px = None
scale_x_ft_per_px = None
scale_y_ft_per_px = None
scale_avg_ft_per_px = None

if bbox_info is not None and horizontal_length_mm is not None and vertical_length_mm is not None:
    try:
        bbox_w = bbox_info["width"]
        bbox_h = bbox_info["height"]

        if bbox_w > 0 and bbox_h > 0:
            scale_x_mm_per_px = float(horizontal_length_mm) / float(bbox_w)
            scale_y_mm_per_px = float(vertical_length_mm) / float(bbox_h)
            scale_avg_mm_per_px = (scale_x_mm_per_px + scale_y_mm_per_px) / 2.0

            mm_to_ft = 1.0 / 304.8
            scale_x_ft_per_px = scale_x_mm_per_px * mm_to_ft
            scale_y_ft_per_px = scale_y_mm_per_px * mm_to_ft
            scale_avg_ft_per_px = scale_avg_mm_per_px * mm_to_ft

            bbox_info_global = bbox_info
            scale_x_ft_per_px_global = scale_x_ft_per_px
            scale_y_ft_per_px_global = scale_y_ft_per_px

            logs.append("scale_x_mm_per_px={:.6f}".format(scale_x_mm_per_px))
            logs.append("scale_y_mm_per_px={:.6f}".format(scale_y_mm_per_px))
            logs.append("scale_avg_mm_per_px={:.6f}".format(scale_avg_mm_per_px))
            logs.append("scale_x_ft_per_px={:.6f}".format(scale_x_ft_per_px))
            logs.append("scale_y_ft_per_px={:.6f}".format(scale_y_ft_per_px))
        else:
            logs.append("bbox宽高无效，无法计算scale")
    except Exception as e:
        logs.append("scale计算失败: {}".format(str(e)))
else:
    logs.append("bbox或真实尺寸缺失，使用fallback整图scale")

# =========================
# Revit文档对象
# =========================
doc = DocumentManager.Instance.CurrentDBDocument
app = doc.Application

wall_type = None
wall_type_collector = FilteredElementCollector(doc).OfClass(WallType)

for wt in wall_type_collector:
    if wt.Kind == WallKind.Basic:
        name_param = wt.get_Parameter(BuiltInParameter.SYMBOL_NAME_PARAM)
        if name_param and name_param.AsString() == TARGET_WALL_TYPE_NAME:
            wall_type = wt
            break

if wall_type is None:
    for wt in wall_type_collector:
        if wt.Kind == WallKind.Basic:
            wall_type = wt
            break

if wall_type is None:
    raise Exception("项目中找不到任何基本墙类型！")

level = None
level_collector = FilteredElementCollector(doc).OfClass(Level)
for lvl in level_collector:
    name_param = lvl.get_Parameter(BuiltInParameter.LEVEL_NAME)
    if name_param and name_param.AsString() == TARGET_LEVEL_NAME:
        level = lvl
        break

if level is None:
    level = level_collector.FirstElement()
    if level is None:
        raise Exception("项目中找不到任何标高！")

TransactionManager.Instance.EnsureInTransaction(doc)

created_walls = []
wall_candidates = []

wallHeight = height

plane = Plane.CreateByNormalAndOrigin(XYZ.BasisZ, origin)
sketch_plane = SketchPlane.Create(doc, plane)

# =========================
# 提取中心线并创建墙
# =========================
if result.masks is not None:
    logs.append("YOLO类别映射: {}".format(str(result.names)))

    wall_candidates, default_wall_thickness, used_class_counter, final_mask_used = extract_wall_centerlines_from_global_mask(
        result, pixelWidth, pixelHeight, logs
    )

    logs.append("初始墙候选数量: {}".format(len(wall_candidates)))

    optimized_walls = optimize_wall_centerlines(
        wall_candidates,
        iter_count=1,
        enable_merge_collinear=False
    )

    logs.append("初步优化后墙数量: {}".format(len(optimized_walls)))

    # 第二版增强
    optimized_walls = run_geometry_enhancement_v2(optimized_walls, logs)

    for idx, w in enumerate(optimized_walls):
        try:
            line_geom = w['line']
            thickness_val = w['thickness']
            name = "Wall"

            coords = list(line_geom.coords)
            if len(coords) < 2:
                logs.append("墙{}失败：coords不足".format(idx))
                continue

            start_pt = XYZ(coords[0][0], coords[0][1], 0)
            end_pt = XYZ(coords[-1][0], coords[-1][1], 0)

            if start_pt.DistanceTo(end_pt) < 0.1:
                logs.append("墙{}失败：线太短".format(idx))
                continue

            revit_line = Line.CreateBound(start_pt, end_pt)

            logs.append("准备创建墙{}: len={:.3f}, thickness={:.3f}".format(
                idx, revit_line.Length, thickness_val
            ))

            wall = Wall.Create(doc, revit_line, wall_type.Id, level.Id, wallHeight, 0, False, False)

            try:
                param = wall.get_Parameter(BuiltInParameter.WALL_ATTR_WIDTH_PARAM)
                if param and not param.IsReadOnly:
                    param.Set(thickness_val)
            except Exception as e2:
                logs.append("墙{}宽度设置失败(可忽略): {}".format(idx, str(e2)))

            try:
                wall.Name = sanitize_name(name)
            except:
                pass

            created_walls.append(wall.ToDSType(True))
            logs.append("墙{}创建成功".format(idx))

        except Exception as e:
            logs.append("墙{}创建失败: {}".format(idx, str(e)))
            logs.append(traceback.format_exc())
            continue
else:
    logs.append("result.masks is None，没有分割mask")

# =========================
# 提交事务
# =========================
TransactionManager.Instance.TransactionTaskDone()
doc.Regenerate()

# =========================
# 写 seg_meta_json
# =========================
seg_meta = {
    "ok": True,
    "image_path": pixpath,
    "seg_vis_path": newpath,
    "dims_json_path": dims_json_path,
    "wall_bbox_px": bbox_info,
    "real_size_mm": {
        "horizontal_length": horizontal_length_mm,
        "vertical_length": vertical_length_mm
    },
    "scale": {
        "scale_x_mm_per_px": scale_x_mm_per_px,
        "scale_y_mm_per_px": scale_y_mm_per_px,
        "scale_avg_mm_per_px": scale_avg_mm_per_px,
        "scale_x_ft_per_px": scale_x_ft_per_px,
        "scale_y_ft_per_px": scale_y_ft_per_px,
        "scale_avg_ft_per_px": scale_avg_ft_per_px
    },
    "structure_mask_classes_used": structure_class_counter,
    "debug": {
        "pixelWidth": pixelWidth,
        "pixelHeight": pixelHeight,
        "wall_count": len(created_walls),
        "mask_count": len(result.masks.xy) if result.masks is not None else 0,
        "class_names": result.names,
        "log_count": len(logs)
    }
}

try:
    ensure_dir_of_file(seg_meta_json_path)
    with open(seg_meta_json_path, "w", encoding="utf-8") as f:
        json.dump(seg_meta, f, ensure_ascii=False, indent=2)
    logs.append("seg_meta_json已写出: {}".format(seg_meta_json_path))
except Exception as e:
    logs.append("seg_meta_json写出失败: {}".format(str(e)))

OUT = newpath, created_walls, seg_meta_json_path, logs
# ----------------------------------------
python_version_10 = Watch(python_script_3)  # graph output
imagepath_3 = Filename("..\tests\a3室2厅1厨2卫-120.49㎡-南 北-103104688478.jpg")
python_paths_2 = Watch(python_script_2)  # graph output
imagepath_4 = Filename("..\tests\a3室2厅1厨1卫-83.73㎡-东 南-103104489220.jpg")
imagepath_5 = Filename("..\tests\a3室2厅1厨1卫-87.3㎡-南-103104280748.jpg")
python_script_5 = Python(IN[0]=seg_WWTD_Modelpath, IN[1]=imagepath, IN[2]=number, IN[3]=scale, IN[4]=python_version, IN[5]=seg_meta_Json_Path)  # CPython3; frozen
# ---------- python_script_5.python (1528 lines) ----------
# 加载 Python Standard 和 DesignScript 库
#---------------------------
import sys
import clr
clr.AddReference('ProtoGeometry')
from Autodesk.DesignScript.Geometry import *
import Autodesk.DesignScript.Geometry as DS
import Revit
from Revit.Elements import *
import System
sys.path.append("C:/Users/Lenovo/anaconda3/envs/revitenv/Lib/site-packages")
clr.AddReference('RevitAPI')
clr.AddReference('RevitAPIUI')
from Autodesk.Revit.DB import *
from Autodesk.Revit.UI import *

clr.AddReference('RevitServices')
from RevitServices.Persistence import DocumentManager
from RevitServices.Transactions import TransactionManager

clr.AddReference('RevitNodes')
import Revit
clr.ImportExtensions(Revit.Elements)
clr.ImportExtensions(Revit.GeometryConversion)

import re
import math
import json
import os
import traceback
import numpy as np
import torch
import cv2

from scipy.spatial import Voronoi
from scipy import ndimage
from shapely.geometry import Polygon, LineString, MultiLineString
from shapely.ops import linemerge
from shapely.ops import unary_union, split
from shapely.geometry import Point as ShpPoint
from shapely.geometry import Polygon as ShpPolygon
from shapely.geometry import MultiPolygon as ShpMultiPolygon
from shapely.geometry import Point as ShpPoint
from shapely.geometry import MultiLineString
from shapely.ops import linemerge
from skimage.morphology import skeletonize
from ultralytics import YOLO

dataEnteringNode = IN 

# =========================
# 输入
# =========================
dect_Model = IN[0]
pixpath = IN[1]
height = IN[2]
scale = IN[3]
dims_json_path = IN[4]
seg_meta_json_path = IN[5]

# =========================
# 参数
# =========================
origin = XYZ(0, 0, 0)   
widthFt = scale
pixelWidth = 1600   
pixelHeight = 1200 
DENSIFY_DIST = 0.5  
EPS = 1e-6

TARGET_WALL_TYPE_NAME = "基本墙 200mm"
TARGET_LEVEL_NAME = "标高 2"

newpath = "E:/yanjiu/revitss/tests/jjianzhu_seg.jpg"

scaleX = widthFt / pixelWidth if pixelWidth > 0 else 0.0
scaleY = widthFt * (pixelHeight / pixelWidth) / pixelHeight if pixelWidth > 0 and pixelHeight > 0 else 0.0

bbox_info_global = None
scale_x_ft_per_px_global = None
scale_y_ft_per_px_global = None

logs = []

# =========================
# 工具函数
# =========================
def ensure_dir_of_file(file_path):
    folder = os.path.dirname(file_path)
    if folder and not os.path.exists(folder):
        os.makedirs(folder)

def pix_to_revit(x, y):
    global bbox_info_global, scale_x_ft_per_px_global, scale_y_ft_per_px_global

    try:
        if bbox_info_global is not None and scale_x_ft_per_px_global is not None and scale_y_ft_per_px_global is not None:
            min_x = bbox_info_global["min_x"]
            min_y = bbox_info_global["min_y"]
            bbox_h = bbox_info_global["height"]

            local_x = x - min_x
            local_y = y - min_y

            revit_x = origin.X + local_x * scale_x_ft_per_px_global
            revit_y = origin.Y + (bbox_h - local_y) * scale_y_ft_per_px_global
            return XYZ(revit_x, revit_y, origin.Z)
    except:
        pass

    revit_x = origin.X + x * scaleX
    revit_y = origin.Y + (pixelHeight - y) * scaleY
    return XYZ(revit_x, revit_y, origin.Z)

def sanitize_name(name):
    if not name:
        return "Unknown"
    cleaned = re.sub(r'[\x00-\x1f\x7f]', '', name)
    if not cleaned.strip():
        return "Unnamed"
    return cleaned

def get_mask_bbox(binary_mask, logs):
    if binary_mask is None:
        logs.append("get_mask_bbox失败: binary_mask is None")
        return None

    ys, xs = np.where(binary_mask > 0)
    if len(xs) == 0 or len(ys) == 0:
        logs.append("get_mask_bbox失败: 墙体mask为空")
        return None

    min_x = int(np.min(xs))
    max_x = int(np.max(xs))
    min_y = int(np.min(ys))
    max_y = int(np.max(ys))

    bbox = {
        "min_x": min_x,
        "min_y": min_y,
        "max_x": max_x,
        "max_y": max_y,
        "width": int(max_x - min_x + 1),
        "height": int(max_y - min_y + 1)
    }
    logs.append("结构mask bbox: {}".format(str(bbox)))
    return bbox

# =========================
# 结构类配置
# =========================
STRUCTURE_CLASS_KEYWORDS = [
    "wall",
    "墙",
    "墙体",
    "basic wall",
    "door",
    "门",
    "tdoor",
    "double door",
    "window",
    "窗",
    "窗户"
]

STRUCTURE_CLASS_EXACT = set([
    "wall",
    "door",
    "window",
    "tdoor"
])

EXPAND_CLASSES = set([
    "door",
    "window",
    "tdoor"
])

def normalize_class_name(name):
    if name is None:
        return ""
    return str(name).strip().lower()

def is_structure_wall_like_class(name):
    n = normalize_class_name(name)
    if not n:
        return False

    if n in STRUCTURE_CLASS_EXACT:
        return True

    for kw in STRUCTURE_CLASS_KEYWORDS:
        if kw.lower() in n:
            return True
    return False

def ensure_polygon(geom):
    if geom is None or geom.is_empty:
        return None
    try:
        if not geom.is_valid:
            geom = geom.buffer(0)
    except:
        pass
    if geom is None or geom.is_empty:
        return None

    if isinstance(geom, ShpPolygon):
        return geom

    if isinstance(geom, ShpMultiPolygon):
        polys = [g for g in geom.geoms if g is not None and not g.is_empty]
        if not polys:
            return None
        polys.sort(key=lambda p: p.area, reverse=True)
        return polys[0]

    return None

def line_long_enough(line_geom, min_len=0.1):
    if line_geom is None or line_geom.is_empty:
        return False
    try:
        return line_geom.length >= min_len
    except:
        return False

def snap_line_to_axis(line_geom):
    if line_geom is None or line_geom.is_empty:
        return None
    coords = list(line_geom.coords)
    if len(coords) < 2:
        return None
    x1, y1 = coords[0]
    x2, y2 = coords[-1]
    dx = x2 - x1
    dy = y2 - y1
    if abs(dx) >= abs(dy):
        ym = 0.5 * (y1 + y2)
        return LineString([(x1, ym), (x2, ym)])
    else:
        xm = 0.5 * (x1 + x2)
        return LineString([(xm, y1), (xm, y2)])

def get_line_orientation_from_geom(line_geom):
    coords = list(line_geom.coords)
    x1, y1 = coords[0]
    x2, y2 = coords[-1]
    if abs(y2 - y1) <= abs(x2 - x1):
        return "h"
    return "v"

def get_line_orientation(seg):
    return get_line_orientation_from_geom(seg['line'])

def line_length(line_geom):
    try:
        return line_geom.length
    except:
        return 0.0

def copy_segments(segments):
    out = []
    for s in segments:
        out.append({
            'line': s['line'],
            'thickness': s['thickness'],
            'name': s['name']
        })
    return out

def longest_linestring_from_intersection(inter):
    if inter is None or inter.is_empty:
        return None
    if inter.geom_type == "LineString":
        return inter
    if inter.geom_type == "MultiLineString":
        lines = [g for g in inter.geoms if g.length > 1e-4]
        if not lines:
            return None
        lines.sort(key=lambda g: g.length, reverse=True)
        return lines[0]
    return None

def merge_close_vertices(segments, delta):
    pts = []
    for seg in segments:
        coords = list(seg['line'].coords)
        pts.append(coords[0])
        pts.append(coords[-1])

    if not pts:
        return segments

    clusters = []
    for p in pts:
        assigned = False
        for cluster in clusters:
            cx, cy, plist = cluster
            d2 = (p[0]-cx)**2 + (p[1]-cy)**2
            if d2 < delta * delta:
                plist.append(p)
                nx = sum(pp[0] for pp in plist) / len(plist)
                ny = sum(pp[1] for pp in plist) / len(plist)
                cluster[0] = nx
                cluster[1] = ny
                assigned = True
                break
        if not assigned:
            clusters.append([p[0], p[1], [p]])

    def snap_point(p):
        best = p
        best_d = 1e18
        for cx, cy, plist in clusters:
            d2 = (p[0]-cx)**2 + (p[1]-cy)**2
            if d2 < best_d:
                best_d = d2
                best = (cx, cy)
        return best

    new_segments = []
    for seg in segments:
        coords = list(seg['line'].coords)
        p1 = snap_point(coords[0])
        p2 = snap_point(coords[-1])
        if ((p1[0]-p2[0])**2 + (p1[1]-p2[1])**2) ** 0.5 < 0.1:
            continue
        new_line = LineString([p1, p2])
        new_line = snap_line_to_axis(new_line)
        if new_line is None:
            continue
        new_segments.append({
            'line': new_line,
            'thickness': seg['thickness'],
            'name': seg['name']
        })
    return new_segments

def point_to_segment_distance(pt, a, b):
    px, py = pt
    ax, ay = a
    bx, by = b
    dx = bx - ax
    dy = by - ay
    if abs(dx) < EPS and abs(dy) < EPS:
        return ((px-ax)**2 + (py-ay)**2)**0.5, a, 0.0

    t = ((px-ax)*dx + (py-ay)*dy) / (dx*dx + dy*dy)
    t_clamped = max(0.0, min(1.0, t))
    qx = ax + t_clamped * dx
    qy = ay + t_clamped * dy
    dist = ((px-qx)**2 + (py-qy)**2)**0.5
    return dist, (qx, qy), t_clamped

def split_segments_by_near_vertices(segments, delta):
    if not segments:
        return segments

    vertices = []
    for seg in segments:
        coords = list(seg['line'].coords)
        vertices.append(coords[0])
        vertices.append(coords[-1])

    new_segments = []
    for idx, seg in enumerate(segments):
        coords = list(seg['line'].coords)
        a = coords[0]
        b = coords[-1]
        split_pts = []

        for v in vertices:
            if v == a or v == b:
                continue
            dist, proj, t = point_to_segment_distance(v, a, b)
            if dist < delta and t > 0.01 and t < 0.99:
                split_pts.append((t, v))

        if not split_pts:
            new_segments.append(seg)
        else:
            split_pts.sort(key=lambda x: x[0])
            chain = [a] + [v for _, v in split_pts] + [b]
            for p1, p2 in zip(chain[:-1], chain[1:]):
                if ((p1[0]-p2[0])**2 + (p1[1]-p2[1])**2) ** 0.5 < 0.1:
                    continue
                new_line = snap_line_to_axis(LineString([p1, p2]))
                if new_line is None:
                    continue
                new_segments.append({
                    'line': new_line,
                    'thickness': seg['thickness'],
                    'name': seg['name']
                })
    return new_segments

def merge_collinear_segments_strict(segments, coord_tol=0.08, gap_tol=0.25):
    if not segments:
        return segments

    horizontal = []
    vertical = []
    others = []

    for seg in segments:
        coords = list(seg['line'].coords)
        x1, y1 = coords[0]
        x2, y2 = coords[-1]

        if abs(y2 - y1) <= coord_tol:
            y = 0.5 * (y1 + y2)
            xmin, xmax = min(x1, x2), max(x1, x2)
            horizontal.append((y, xmin, xmax, seg))
        elif abs(x2 - x1) <= coord_tol:
            x = 0.5 * (x1 + x2)
            ymin, ymax = min(y1, y2), max(y1, y2)
            vertical.append((x, ymin, ymax, seg))
        else:
            others.append(seg)

    merged = []

    horizontal.sort(key=lambda t: (round(t[0], 2), t[1]))
    used = [False] * len(horizontal)
    for i in range(len(horizontal)):
        if used[i]:
            continue
        y, x1, x2, seg = horizontal[i]
        thick = seg['thickness']
        name = seg['name']

        for j in range(i + 1, len(horizontal)):
            if used[j]:
                continue
            y2, xx1, xx2, seg2 = horizontal[j]
            if abs(y2 - y) <= coord_tol and xx1 <= x2 + gap_tol:
                x2 = max(x2, xx2)
                thick = 0.5 * (thick + seg2['thickness'])
                used[j] = True

        merged.append({
            'line': LineString([(x1, y), (x2, y)]),
            'thickness': thick,
            'name': name
        })

    vertical.sort(key=lambda t: (round(t[0], 2), t[1]))
    used = [False] * len(vertical)
    for i in range(len(vertical)):
        if used[i]:
            continue
        x, y1, y2, seg = vertical[i]
        thick = seg['thickness']
        name = seg['name']

        for j in range(i + 1, len(vertical)):
            if used[j]:
                continue
            x2, yy1, yy2, seg2 = vertical[j]
            if abs(x2 - x) <= coord_tol and yy1 <= y2 + gap_tol:
                y2 = max(y2, yy2)
                thick = 0.5 * (thick + seg2['thickness'])
                used[j] = True

        merged.append({
            'line': LineString([(x, y1), (x, y2)]),
            'thickness': thick,
            'name': name
        })

    merged.extend(others)
    return merged

def optimize_wall_centerlines(candidates, iter_count=1, enable_merge_collinear=True):
    if not candidates:
        return []

    segs = candidates[:]

    if enable_merge_collinear:
        segs = merge_collinear_segments_strict(segs, coord_tol=0.08, gap_tol=0.35)

    for _ in range(iter_count):
        if not segs:
            break

        avg_t = sum(s['thickness'] for s in segs) / max(len(segs), 1)
        delta = 0.20 * avg_t
        if delta < 0.03:
            delta = 0.03
        if delta > 0.12:
            delta = 0.12

        segs = merge_close_vertices(segs, delta)
        segs = split_segments_by_near_vertices(segs, delta)

    cleaned = []
    for s in segs:
        try:
            if s['line'] is None or s['line'].is_empty:
                continue
            if s['line'].length < 0.08:
                continue
            cleaned.append(s)
        except:
            continue

    return cleaned

# =========================
# mask 构建与清理
# =========================
def build_global_structure_mask(result, pixelWidth, pixelHeight, logs):
    wall_mask = np.zeros((pixelHeight, pixelWidth), dtype=np.uint8)
    class_counter = {}

    if result.masks is None:
        logs.append("result.masks is None")
        return wall_mask, class_counter

    masks_xy = result.masks.xy
    cls_ids = result.boxes.cls.cpu().numpy().astype(int)
    names = result.names

    logs.append("总mask数量: {}".format(len(masks_xy)))

    expand_kernel = cv2.getStructuringElement(cv2.MORPH_RECT, (5, 5))

    for i, contour_pts in enumerate(masks_xy):
        try:
            if i >= len(cls_ids):
                continue

            class_id = cls_ids[i]
            class_name = names[class_id]
            class_name_norm = normalize_class_name(class_name)

            if not is_structure_wall_like_class(class_name):
                continue

            pts = np.array(contour_pts, dtype=np.int32)
            if len(pts) < 3:
                continue

            pts[:, 0] = np.clip(pts[:, 0], 0, pixelWidth - 1)
            pts[:, 1] = np.clip(pts[:, 1], 0, pixelHeight - 1)

            if class_name_norm in EXPAND_CLASSES:
                temp = np.zeros((pixelHeight, pixelWidth), dtype=np.uint8)
                cv2.fillPoly(temp, [pts], 255)
                temp = cv2.dilate(temp, expand_kernel, iterations=1)
                wall_mask[temp > 0] = 255
            else:
                cv2.fillPoly(wall_mask, [pts], 255)

            class_counter[class_name_norm] = class_counter.get(class_name_norm, 0) + 1

        except Exception as e:
            logs.append("合成结构mask失败 idx={}: {}".format(i, str(e)))
            continue

    logs.append("参与墙体生成的类别统计: {}".format(str(class_counter)))
    return wall_mask, class_counter

def clean_wall_mask(binary_mask, logs):
    mask = binary_mask.copy()

    kernel_bridge = cv2.getStructuringElement(cv2.MORPH_RECT, (3, 3))
    kernel_close_big = cv2.getStructuringElement(cv2.MORPH_RECT, (7, 7))
    kernel_close_small = cv2.getStructuringElement(cv2.MORPH_RECT, (5, 5))

    mask = cv2.dilate(mask, kernel_bridge, iterations=1)
    mask = cv2.morphologyEx(mask, cv2.MORPH_CLOSE, kernel_close_big)
    mask = cv2.morphologyEx(mask, cv2.MORPH_CLOSE, kernel_close_small)
    mask = cv2.erode(mask, kernel_bridge, iterations=1)

    num_labels, labels, stats, _ = cv2.connectedComponentsWithStats(mask, connectivity=8)
    cleaned = np.zeros_like(mask)

    for i in range(1, num_labels):
        area = stats[i, cv2.CC_STAT_AREA]
        if area >= 30:
            cleaned[labels == i] = 255

    logs.append("结构mask清理完成(补缝增强版)")
    return cleaned

def estimate_wall_width_pixels(binary_mask, logs):
    if binary_mask is None or binary_mask.max() == 0:
        logs.append("墙宽估计失败：mask为空")
        return 6.0

    dist = cv2.distanceTransform(binary_mask, cv2.DIST_L2, 5)
    vals = dist[dist > 0]
    if len(vals) == 0:
        logs.append("墙宽估计失败：distanceTransform为空")
        return 6.0

    wall_width_px = max(2.0, 2.0 * np.median(vals))
    logs.append("估计墙宽像素值: {:.2f}".format(wall_width_px))
    return wall_width_px

def skeletonize_wall_mask(binary_mask, logs):
    try:
        from skimage.morphology import skeletonize
        skel = skeletonize(binary_mask > 0)
        logs.append("使用 skimage.skeletonize 成功")
        return skel.astype(np.uint8)
    except Exception as e:
        logs.append("skimage骨架失败，改用fallback: {}".format(str(e)))
        return skeletonize_fallback(binary_mask, logs)

def skeletonize_fallback(binary_mask, logs):
    img = (binary_mask > 0).astype(np.uint8) * 255
    size = np.size(img)
    skel = np.zeros(img.shape, np.uint8)

    element = cv2.getStructuringElement(cv2.MORPH_CROSS, (3, 3))
    done = False

    while not done:
        eroded = cv2.erode(img, element)
        temp = cv2.dilate(eroded, element)
        temp = cv2.subtract(img, temp)
        skel = cv2.bitwise_or(skel, temp)
        img = eroded.copy()

        zeros = size - cv2.countNonZero(img)
        if zeros == size:
            done = True

    logs.append("fallback skeletonize 成功")
    return (skel > 0).astype(np.uint8)

def get_neighbors_8(x, y, w, h):
    nbs = []
    for dy in [-1, 0, 1]:
        for dx in [-1, 0, 1]:
            if dx == 0 and dy == 0:
                continue
            nx = x + dx
            ny = y + dy
            if 0 <= nx < w and 0 <= ny < h:
                nbs.append((nx, ny))
    return nbs

def extract_skeleton_graph(skel, logs):
    h, w = skel.shape
    skel_pts = set()
    for y in range(h):
        xs = np.where(skel[y] > 0)[0]
        for x in xs:
            skel_pts.add((x, y))

    if not skel_pts:
        logs.append("骨架为空")
        return [], []

    degree = {}
    for (x, y) in skel_pts:
        cnt = 0
        for nx, ny in get_neighbors_8(x, y, w, h):
            if (nx, ny) in skel_pts:
                cnt += 1
        degree[(x, y)] = cnt

    nodes = [p for p, d in degree.items() if d != 2]

    if not nodes:
        nodes = list(skel_pts)

    node_set = set(nodes)
    visited_edges = set()
    edges = []

    for node in nodes:
        x0, y0 = node
        for nx, ny in get_neighbors_8(x0, y0, w, h):
            if (nx, ny) not in skel_pts:
                continue

            edge_key = tuple(sorted([node, (nx, ny)]))
            if edge_key in visited_edges:
                continue

            path = [node, (nx, ny)]
            prev = node
            curr = (nx, ny)

            while True:
                visited_edges.add(tuple(sorted([prev, curr])))

                if curr in node_set and curr != node:
                    break

                nbrs = []
                for tx, ty in get_neighbors_8(curr[0], curr[1], w, h):
                    if (tx, ty) in skel_pts and (tx, ty) != prev:
                        nbrs.append((tx, ty))

                if len(nbrs) == 0:
                    break
                if len(nbrs) > 1:
                    break

                nxt = nbrs[0]
                path.append(nxt)
                prev = curr
                curr = nxt

            if len(path) >= 2:
                edges.append(path)

    logs.append("骨架图提取完成: nodes={}, edges={}".format(len(nodes), len(edges)))
    return nodes, edges

def split_path_by_direction(path, turn_threshold=2):
    if not path or len(path) < 3:
        return [path] if path else []

    segments = []
    current = [path[0], path[1]]

    def major_dir(p1, p2):
        dx = p2[0] - p1[0]
        dy = p2[1] - p1[1]
        if abs(dx) >= abs(dy):
            return "h"
        else:
            return "v"

    prev_dir = major_dir(path[0], path[1])

    for i in range(2, len(path)):
        d = major_dir(path[i-1], path[i])

        if d == prev_dir:
            current.append(path[i])
        else:
            if len(current) <= turn_threshold and segments:
                segments[-1].extend(current[1:])
                current = [segments[-1][-1], path[i]]
            else:
                segments.append(current)
                current = [path[i-1], path[i]]
            prev_dir = d

    if current:
        if len(current) <= turn_threshold and segments:
            segments[-1].extend(current[1:])
        else:
            segments.append(current)

    cleaned = []
    for seg in segments:
        if seg and len(seg) >= 2:
            cleaned.append(seg)

    return cleaned

def fit_axis_line_from_mask(sub_path, wall_mask, pixelWidth, pixelHeight, min_len_px=8):
    if not sub_path or len(sub_path) < 2:
        return None

    xs = [p[0] for p in sub_path]
    ys = [p[1] for p in sub_path]

    x_min = max(0, int(min(xs)))
    x_max = min(pixelWidth - 1, int(max(xs)))
    y_min = max(0, int(min(ys)))
    y_max = min(pixelHeight - 1, int(max(ys)))

    dx = x_max - x_min
    dy = y_max - y_min

    if dx >= dy:
        mids = []
        for x in range(x_min, x_max + 1):
            ys_in = np.where(wall_mask[:, x] > 0)[0]
            ys_local = ys_in[(ys_in >= y_min - 8) & (ys_in <= y_max + 8)]
            if len(ys_local) >= 2:
                y_top = np.min(ys_local)
                y_bot = np.max(ys_local)
                y_mid = 0.5 * (y_top + y_bot)
                mids.append((x, y_mid))

        if len(mids) < 2:
            return None

        xs2 = [p[0] for p in mids]
        ys2 = [p[1] for p in mids]

        x1 = min(xs2)
        x2 = max(xs2)
        y = float(np.median(ys2))

        if (x2 - x1) < min_len_px:
            return None

        return ((x1, y), (x2, y), "h")

    else:
        mids = []
        for y in range(y_min, y_max + 1):
            xs_in = np.where(wall_mask[y, :] > 0)[0]
            xs_local = xs_in[(xs_in >= x_min - 8) & (xs_in <= x_max + 8)]
            if len(xs_local) >= 2:
                x_left = np.min(xs_local)
                x_right = np.max(xs_local)
                x_mid = 0.5 * (x_left + x_right)
                mids.append((x_mid, y))

        if len(mids) < 2:
            return None

        xs2 = [p[0] for p in mids]
        ys2 = [p[1] for p in mids]

        y1 = min(ys2)
        y2 = max(ys2)
        x = float(np.median(xs2))

        if (y2 - y1) < min_len_px:
            return None

        return ((x, y1), (x, y2), "v")

def pixel_line_to_revit_linestring(p1, p2):
    rp1 = pix_to_revit(p1[0], p1[1])
    rp2 = pix_to_revit(p2[0], p2[1])
    if rp1.DistanceTo(rp2) < 0.1:
        return None
    return LineString([(rp1.X, rp1.Y), (rp2.X, rp2.Y)])

def simplify_path_to_axis_lines(path, wall_mask, pixelWidth, pixelHeight, logs, min_len_px=8):
    result_lines = []

    sub_paths = split_path_by_direction(path, turn_threshold=2)
    for sub in sub_paths:
        try:
            fitted = fit_axis_line_from_mask(
                sub, wall_mask, pixelWidth, pixelHeight, min_len_px=min_len_px
            )
            if fitted is None:
                continue

            p1, p2, ori = fitted
            line_geom = pixel_line_to_revit_linestring(p1, p2)
            if line_geom is None:
                continue

            if line_geom.length < 0.08:
                continue

            result_lines.append(line_geom)

        except Exception as e:
            logs.append("子段拟合失败: {}".format(str(e)))
            continue

    return result_lines

def extract_wall_centerlines_from_global_mask(result, pixelWidth, pixelHeight, logs):
    wall_mask, class_counter = build_global_structure_mask(result, pixelWidth, pixelHeight, logs)
    if wall_mask.max() == 0:
        logs.append("没有结构类mask被写入全局墙图")
        return [], 0.3, class_counter, wall_mask

    cleaned_mask = clean_wall_mask(wall_mask, logs)
    wall_width_px = estimate_wall_width_pixels(cleaned_mask, logs)

    skel = skeletonize_wall_mask(cleaned_mask, logs)
    nodes, edges = extract_skeleton_graph(skel, logs)

    if not edges:
        logs.append("骨架没有边")
        wall_width_ft = wall_width_px * (scale_x_ft_per_px_global if scale_x_ft_per_px_global else scaleX)
        return [], wall_width_ft, class_counter, cleaned_mask

    wall_width_ft = wall_width_px * (scale_x_ft_per_px_global if scale_x_ft_per_px_global else scaleX)
    candidates = []

    for idx, path in enumerate(edges):
        try:
            line_list = simplify_path_to_axis_lines(
                path, cleaned_mask, pixelWidth, pixelHeight, logs,
                min_len_px=max(3, int(wall_width_px * 0.5))
            )

            for line_geom in line_list:
                candidates.append({
                    'line': line_geom,
                    'thickness': wall_width_ft,
                    'name': "Wall"
                })

        except Exception as e:
            logs.append("路径{}转中心线失败: {}".format(idx, str(e)))
            continue

    logs.append("全局提取中心线候选数量: {}".format(len(candidates)))
    return candidates, wall_width_ft, class_counter, cleaned_mask

# =========================
# 第二版增强：几何补缝与对齐
# =========================
def bridge_near_orthogonal_gaps(segments, gap_tol=0.6, axis_tol=0.25):
    if not segments:
        return segments

    segs = copy_segments(segments)

    for i in range(len(segs)):
        for j in range(i + 1, len(segs)):
            si = segs[i]
            sj = segs[j]
            if si is None or sj is None:
                continue

            oi = get_line_orientation(si)
            oj = get_line_orientation(sj)

            if oi == oj:
                continue

            if oi == "v" and oj == "h":
                tmp = si
                si = sj
                sj = tmp
                idx_h = j
                idx_v = i
            else:
                idx_h = i
                idx_v = j

            coords_h = list(si['line'].coords)
            coords_v = list(sj['line'].coords)

            hx1, hy1 = coords_h[0]
            hx2, hy2 = coords_h[-1]
            vx1, vy1 = coords_v[0]
            vx2, vy2 = coords_v[-1]

            y_h = 0.5 * (hy1 + hy2)
            x_v = 0.5 * (vx1 + vx2)

            hminx, hmaxx = min(hx1, hx2), max(hx1, hx2)
            vminy, vmaxy = min(vy1, vy2), max(vy1, vy2)

            inter_pt = (x_v, y_h)

            h_endpts = [(hx1, hy1), (hx2, hy2)]
            v_endpts = [(vx1, vy1), (vx2, vy2)]

            h_dists = [((p[0]-inter_pt[0])**2 + (p[1]-inter_pt[1])**2)**0.5 for p in h_endpts]
            v_dists = [((p[0]-inter_pt[0])**2 + (p[1]-inter_pt[1])**2)**0.5 for p in v_endpts]

            h_min_idx = int(np.argmin(h_dists))
            v_min_idx = int(np.argmin(v_dists))

            h_min_dist = h_dists[h_min_idx]
            v_min_dist = v_dists[v_min_idx]

            cond_h = (x_v >= hminx - axis_tol and x_v <= hmaxx + gap_tol)
            cond_v = (y_h >= vminy - axis_tol and y_h <= vmaxy + gap_tol)

            if h_min_dist <= gap_tol and v_min_dist <= gap_tol and cond_h and cond_v:
                other_h = h_endpts[1 - h_min_idx]
                other_v = v_endpts[1 - v_min_idx]

                new_h = snap_line_to_axis(LineString([other_h, inter_pt]))
                new_v = snap_line_to_axis(LineString([other_v, inter_pt]))

                if new_h is not None and new_h.length >= 0.08:
                    segs[idx_h]['line'] = new_h
                if new_v is not None and new_v.length >= 0.08:
                    segs[idx_v]['line'] = new_v

    cleaned = []
    for s in segs:
        try:
            if s['line'] is None or s['line'].is_empty:
                continue
            if s['line'].length < 0.08:
                continue
            cleaned.append(s)
        except:
            continue
    return cleaned

def align_parallel_segments(segments, coord_tol=0.35):
    """
    将接近共线的水平段/竖直段拉齐到同一坐标轴
    水平：对齐 y
    竖直：对齐 x
    """
    if not segments:
        return segments

    segs = copy_segments(segments)

    horizontal_groups = []
    vertical_groups = []

    for idx, s in enumerate(segs):
        coords = list(s['line'].coords)
        x1, y1 = coords[0]
        x2, y2 = coords[-1]
        ori = get_line_orientation(s)

        if ori == "h":
            y = 0.5 * (y1 + y2)
            added = False
            for g in horizontal_groups:
                if abs(g['coord'] - y) <= coord_tol:
                    g['indices'].append(idx)
                    g['values'].append(y)
                    g['coord'] = float(np.median(g['values']))
                    added = True
                    break
            if not added:
                horizontal_groups.append({
                    'coord': y,
                    'indices': [idx],
                    'values': [y]
                })
        else:
            x = 0.5 * (x1 + x2)
            added = False
            for g in vertical_groups:
                if abs(g['coord'] - x) <= coord_tol:
                    g['indices'].append(idx)
                    g['values'].append(x)
                    g['coord'] = float(np.median(g['values']))
                    added = True
                    break
            if not added:
                vertical_groups.append({
                    'coord': x,
                    'indices': [idx],
                    'values': [x]
                })

    for g in horizontal_groups:
        target_y = g['coord']
        for idx in g['indices']:
            coords = list(segs[idx]['line'].coords)
            x1, y1 = coords[0]
            x2, y2 = coords[-1]
            segs[idx]['line'] = LineString([(x1, target_y), (x2, target_y)])

    for g in vertical_groups:
        target_x = g['coord']
        for idx in g['indices']:
            coords = list(segs[idx]['line'].coords)
            x1, y1 = coords[0]
            x2, y2 = coords[-1]
            segs[idx]['line'] = LineString([(target_x, y1), (target_x, y2)])

    return segs

def bridge_parallel_gaps(segments, coord_tol=0.25, gap_tol=0.8):
    """
    平行且接近共线的短缝桥接
    - 水平对水平：y接近，x方向中间差一小截 -> 合并成一条
    - 竖直对竖直：x接近，y方向中间差一小截 -> 合并成一条
    """
    if not segments:
        return segments

    segs = copy_segments(segments)
    used = [False] * len(segs)
    result = []

    # 先水平
    horiz = []
    vert = []
    other = []

    for idx, s in enumerate(segs):
        ori = get_line_orientation(s)
        coords = list(s['line'].coords)
        x1, y1 = coords[0]
        x2, y2 = coords[-1]

        if ori == "h":
            y = 0.5 * (y1 + y2)
            xmin = min(x1, x2)
            xmax = max(x1, x2)
            horiz.append((idx, y, xmin, xmax, s))
        else:
            x = 0.5 * (x1 + x2)
            ymin = min(y1, y2)
            ymax = max(y1, y2)
            vert.append((idx, x, ymin, ymax, s))

    horiz.sort(key=lambda t: (round(t[1], 3), t[2]))
    consumed = set()
    for i in range(len(horiz)):
        if i in consumed:
            continue
        idx_i, y_i, x1_i, x2_i, seg_i = horiz[i]
        cur_y = y_i
        cur_x1 = x1_i
        cur_x2 = x2_i
        cur_thick = seg_i['thickness']
        cur_name = seg_i['name']

        for j in range(i + 1, len(horiz)):
            if j in consumed:
                continue
            idx_j, y_j, x1_j, x2_j, seg_j = horiz[j]

            if abs(y_j - cur_y) <= coord_tol:
                gap = x1_j - cur_x2
                overlap = min(cur_x2, x2_j) - max(cur_x1, x1_j)
                if gap <= gap_tol or overlap >= -coord_tol:
                    cur_x1 = min(cur_x1, x1_j)
                    cur_x2 = max(cur_x2, x2_j)
                    cur_y = float(np.median([cur_y, y_j]))
                    cur_thick = 0.5 * (cur_thick + seg_j['thickness'])
                    consumed.add(j)

        result.append({
            'line': LineString([(cur_x1, cur_y), (cur_x2, cur_y)]),
            'thickness': cur_thick,
            'name': cur_name
        })

    vert.sort(key=lambda t: (round(t[1], 3), t[2]))
    consumed = set()
    for i in range(len(vert)):
        if i in consumed:
            continue
        idx_i, x_i, y1_i, y2_i, seg_i = vert[i]
        cur_x = x_i
        cur_y1 = y1_i
        cur_y2 = y2_i
        cur_thick = seg_i['thickness']
        cur_name = seg_i['name']

        for j in range(i + 1, len(vert)):
            if j in consumed:
                continue
            idx_j, x_j, y1_j, y2_j, seg_j = vert[j]

            if abs(x_j - cur_x) <= coord_tol:
                gap = y1_j - cur_y2
                overlap = min(cur_y2, y2_j) - max(cur_y1, y1_j)
                if gap <= gap_tol or overlap >= -coord_tol:
                    cur_y1 = min(cur_y1, y1_j)
                    cur_y2 = max(cur_y2, y2_j)
                    cur_x = float(np.median([cur_x, x_j]))
                    cur_thick = 0.5 * (cur_thick + seg_j['thickness'])
                    consumed.add(j)

        result.append({
            'line': LineString([(cur_x, cur_y1), (cur_x, cur_y2)]),
            'thickness': cur_thick,
            'name': cur_name
        })

    return result

def snap_near_endpoints(segments, snap_tol=0.25):
    """
    对近距离端点做统一吸附
    """
    if not segments:
        return segments

    pts = []
    for idx, seg in enumerate(segments):
        coords = list(seg['line'].coords)
        pts.append((idx, 0, coords[0]))
        pts.append((idx, 1, coords[-1]))

    clusters = []
    for item in pts:
        idx, end_flag, p = item
        assigned = False
        for c in clusters:
            cx, cy = c['center']
            if ((p[0]-cx)**2 + (p[1]-cy)**2)**0.5 <= snap_tol:
                c['items'].append(item)
                xs = [it[2][0] for it in c['items']]
                ys = [it[2][1] for it in c['items']]
                c['center'] = (float(np.mean(xs)), float(np.mean(ys)))
                assigned = True
                break
        if not assigned:
            clusters.append({
                'center': (p[0], p[1]),
                'items': [item]
            })

    segs = copy_segments(segments)

    for c in clusters:
        center = c['center']
        for idx, end_flag, p in c['items']:
            coords = list(segs[idx]['line'].coords)
            if end_flag == 0:
                new_line = LineString([center, coords[-1]])
            else:
                new_line = LineString([coords[0], center])

            new_line = snap_line_to_axis(new_line)
            if new_line is not None and new_line.length >= 0.08:
                segs[idx]['line'] = new_line

    return segs

def clean_duplicate_segments(segments, coord_tol=0.05):
    if not segments:
        return segments

    uniq = []
    keys = set()

    for s in segments:
        try:
            coords = list(s['line'].coords)
            x1, y1 = coords[0]
            x2, y2 = coords[-1]

            p1 = (round(x1 / coord_tol), round(y1 / coord_tol))
            p2 = (round(x2 / coord_tol), round(y2 / coord_tol))
            key = tuple(sorted([p1, p2]))

            if key in keys:
                continue
            keys.add(key)
            uniq.append(s)
        except:
            continue

    return uniq

def run_geometry_enhancement_v2(segments, logs):
    if not segments:
        return segments

    segs = copy_segments(segments)
    logs.append("V2增强-输入墙段数: {}".format(len(segs)))

    segs = align_parallel_segments(segs, coord_tol=0.35)
    logs.append("V2增强-平行对齐后: {}".format(len(segs)))

    segs = bridge_parallel_gaps(segs, coord_tol=0.25, gap_tol=0.8)
    logs.append("V2增强-平行短缝桥接后: {}".format(len(segs)))

    segs = bridge_near_orthogonal_gaps(segs, gap_tol=0.6, axis_tol=0.25)
    logs.append("V2增强-正交补缝后: {}".format(len(segs)))

    segs = snap_near_endpoints(segs, snap_tol=0.25)
    logs.append("V2增强-端点吸附后: {}".format(len(segs)))

    segs = merge_collinear_segments_strict(segs, coord_tol=0.08, gap_tol=0.35)
    logs.append("V2增强-严格共线合并后: {}".format(len(segs)))

    segs = clean_duplicate_segments(segs, coord_tol=0.05)
    logs.append("V2增强-去重后: {}".format(len(segs)))

    cleaned = []
    for s in segs:
        try:
            if s['line'] is None or s['line'].is_empty:
                continue
            if s['line'].length < 0.08:
                continue
            cleaned.append(s)
        except:
            continue

    logs.append("V2增强-最终墙段数: {}".format(len(cleaned)))
    return cleaned

# =========================
# 运行YOLO分割
# =========================
yolo_seg = YOLO(dect_Model, task="seg")
seg_result = yolo_seg(source=pixpath, save=False, conf=0.7, iou=0.45, imgsz=1280)
cv2.imwrite(newpath, seg_result[0].plot())

result = seg_result[0]
boxes = result.boxes
xyxy = boxes.xyxy.cpu().numpy() if boxes is not None else np.empty((0,4))
cls_ids = boxes.cls.cpu().numpy().astype(int) if boxes is not None else np.array([], dtype=int)
names = result.names

# =========================
# 读取OCR尺寸JSON
# =========================
dims_data = None
horizontal_length_mm = None
vertical_length_mm = None

try:
    with open(dims_json_path, "r", encoding="utf-8") as f:
        dims_data = json.load(f)

    if dims_data.get("ok", False):
        if "result" in dims_data:
            horizontal_length_mm = dims_data["result"].get("horizontal_length", None)
            vertical_length_mm = dims_data["result"].get("vertical_length", None)
        else:
            horizontal_length_mm = dims_data.get("horizontal_length", None)
            vertical_length_mm = dims_data.get("vertical_length", None)

    logs.append("读取dims_json成功: horizontal={} mm, vertical={} mm".format(
        str(horizontal_length_mm), str(vertical_length_mm)
    ))
except Exception as e:
    logs.append("读取dims_json失败: {}".format(str(e)))

# =========================
# 先做结构mask -> bbox -> scale
# =========================
global_structure_mask, structure_class_counter = build_global_structure_mask(result, pixelWidth, pixelHeight, logs)
cleaned_global_structure_mask = clean_wall_mask(global_structure_mask, logs)
bbox_info = get_mask_bbox(cleaned_global_structure_mask, logs)

scale_x_mm_per_px = None
scale_y_mm_per_px = None
scale_avg_mm_per_px = None
scale_x_ft_per_px = None
scale_y_ft_per_px = None
scale_avg_ft_per_px = None

if bbox_info is not None and horizontal_length_mm is not None and vertical_length_mm is not None:
    try:
        bbox_w = bbox_info["width"]
        bbox_h = bbox_info["height"]

        if bbox_w > 0 and bbox_h > 0:
            scale_x_mm_per_px = float(horizontal_length_mm) / float(bbox_w)
            scale_y_mm_per_px = float(vertical_length_mm) / float(bbox_h)
            scale_avg_mm_per_px = (scale_x_mm_per_px + scale_y_mm_per_px) / 2.0

            mm_to_ft = 1.0 / 304.8
            scale_x_ft_per_px = scale_x_mm_per_px * mm_to_ft
            scale_y_ft_per_px = scale_y_mm_per_px * mm_to_ft
            scale_avg_ft_per_px = scale_avg_mm_per_px * mm_to_ft

            bbox_info_global = bbox_info
            scale_x_ft_per_px_global = scale_x_ft_per_px
            scale_y_ft_per_px_global = scale_y_ft_per_px

            logs.append("scale_x_mm_per_px={:.6f}".format(scale_x_mm_per_px))
            logs.append("scale_y_mm_per_px={:.6f}".format(scale_y_mm_per_px))
            logs.append("scale_avg_mm_per_px={:.6f}".format(scale_avg_mm_per_px))
            logs.append("scale_x_ft_per_px={:.6f}".format(scale_x_ft_per_px))
            logs.append("scale_y_ft_per_px={:.6f}".format(scale_y_ft_per_px))
        else:
            logs.append("bbox宽高无效，无法计算scale")
    except Exception as e:
        logs.append("scale计算失败: {}".format(str(e)))
else:
    logs.append("bbox或真实尺寸缺失，使用fallback整图scale")

# =========================
# Revit文档对象
# =========================
doc = DocumentManager.Instance.CurrentDBDocument
app = doc.Application

wall_type = None
wall_type_collector = FilteredElementCollector(doc).OfClass(WallType)

for wt in wall_type_collector:
    if wt.Kind == WallKind.Basic:
        name_param = wt.get_Parameter(BuiltInParameter.SYMBOL_NAME_PARAM)
        if name_param and name_param.AsString() == TARGET_WALL_TYPE_NAME:
            wall_type = wt
            break

if wall_type is None:
    for wt in wall_type_collector:
        if wt.Kind == WallKind.Basic:
            wall_type = wt
            break

if wall_type is None:
    raise Exception("项目中找不到任何基本墙类型！")

level = None
level_collector = FilteredElementCollector(doc).OfClass(Level)
for lvl in level_collector:
    name_param = lvl.get_Parameter(BuiltInParameter.LEVEL_NAME)
    if name_param and name_param.AsString() == TARGET_LEVEL_NAME:
        level = lvl
        break

if level is None:
    level = level_collector.FirstElement()
    if level is None:
        raise Exception("项目中找不到任何标高！")

TransactionManager.Instance.EnsureInTransaction(doc)

created_walls = []
wall_candidates = []

wallHeight = height

plane = Plane.CreateByNormalAndOrigin(XYZ.BasisZ, origin)
sketch_plane = SketchPlane.Create(doc, plane)

# =========================
# 提取中心线并创建墙
# =========================
if result.masks is not None:
    logs.append("YOLO类别映射: {}".format(str(result.names)))

    wall_candidates, default_wall_thickness, used_class_counter, final_mask_used = extract_wall_centerlines_from_global_mask(
        result, pixelWidth, pixelHeight, logs
    )

    logs.append("初始墙候选数量: {}".format(len(wall_candidates)))

    optimized_walls = optimize_wall_centerlines(
        wall_candidates,
        iter_count=1,
        enable_merge_collinear=False
    )

    logs.append("初步优化后墙数量: {}".format(len(optimized_walls)))

    # 第二版增强
    optimized_walls = run_geometry_enhancement_v2(optimized_walls, logs)

    for idx, w in enumerate(optimized_walls):
        try:
            line_geom = w['line']
            thickness_val = w['thickness']
            name = "Wall"

            coords = list(line_geom.coords)
            if len(coords) < 2:
                logs.append("墙{}失败：coords不足".format(idx))
                continue

            start_pt = XYZ(coords[0][0], coords[0][1], 0)
            end_pt = XYZ(coords[-1][0], coords[-1][1], 0)

            if start_pt.DistanceTo(end_pt) < 0.1:
                logs.append("墙{}失败：线太短".format(idx))
                continue

            revit_line = Line.CreateBound(start_pt, end_pt)

            logs.append("准备创建墙{}: len={:.3f}, thickness={:.3f}".format(
                idx, revit_line.Length, thickness_val
            ))

            wall = Wall.Create(doc, revit_line, wall_type.Id, level.Id, wallHeight, 0, False, False)

            try:
                param = wall.get_Parameter(BuiltInParameter.WALL_ATTR_WIDTH_PARAM)
                if param and not param.IsReadOnly:
                    param.Set(thickness_val)
            except Exception as e2:
                logs.append("墙{}宽度设置失败(可忽略): {}".format(idx, str(e2)))

            try:
                wall.Name = sanitize_name(name)
            except:
                pass

            created_walls.append(wall.ToDSType(True))
            logs.append("墙{}创建成功".format(idx))

        except Exception as e:
            logs.append("墙{}创建失败: {}".format(idx, str(e)))
            logs.append(traceback.format_exc())
            continue
else:
    logs.append("result.masks is None，没有分割mask")

# =========================
# 提交事务
# =========================
TransactionManager.Instance.TransactionTaskDone()
doc.Regenerate()

# =========================
# 写 seg_meta_json
# =========================
seg_meta = {
    "ok": True,
    "image_path": pixpath,
    "seg_vis_path": newpath,
    "dims_json_path": dims_json_path,
    "wall_bbox_px": bbox_info,
    "real_size_mm": {
        "horizontal_length": horizontal_length_mm,
        "vertical_length": vertical_length_mm
    },
    "scale": {
        "scale_x_mm_per_px": scale_x_mm_per_px,
        "scale_y_mm_per_px": scale_y_mm_per_px,
        "scale_avg_mm_per_px": scale_avg_mm_per_px,
        "scale_x_ft_per_px": scale_x_ft_per_px,
        "scale_y_ft_per_px": scale_y_ft_per_px,
        "scale_avg_ft_per_px": scale_avg_ft_per_px
    },
    "structure_mask_classes_used": structure_class_counter,
    "debug": {
        "pixelWidth": pixelWidth,
        "pixelHeight": pixelHeight,
        "wall_count": len(created_walls),
        "mask_count": len(result.masks.xy) if result.masks is not None else 0,
        "class_names": result.names,
        "log_count": len(logs)
    }
}

try:
    ensure_dir_of_file(seg_meta_json_path)
    with open(seg_meta_json_path, "w", encoding="utf-8") as f:
        json.dump(seg_meta, f, ensure_ascii=False, indent=2)
    logs.append("seg_meta_json已写出: {}".format(seg_meta_json_path))
except Exception as e:
    logs.append("seg_meta_json写出失败: {}".format(str(e)))

OUT = newpath, created_walls, seg_meta_json_path, logs
# ----------------------------------------
imagepath_6 = Filename("..\tests\2室1厅1厨1卫-74.16㎡-南-103122859832.jpg")
imagepath_7 = Filename("..\tests\3室2厅1厨1卫-89.01㎡-南-103125392103.jpg")
modelpath_4 = Filename("..\..\hou_pracs_on\Testings\Saves\best_dirs3.pt")
python_script_6 = Python(IN[0]=seg_WWTD_Modelpath, IN[1]=imagepath, IN[2]=number, IN[3]=scale, IN[4]=python_version, IN[5]=seg_meta_Json_Path)  # CPython3; frozen
# ---------- python_script_6.python (1528 lines) ----------
# 加载 Python Standard 和 DesignScript 库
#-----------------------
import sys
import clr
clr.AddReference('ProtoGeometry')
from Autodesk.DesignScript.Geometry import *
import Autodesk.DesignScript.Geometry as DS
import Revit
from Revit.Elements import *
import System
sys.path.append("C:/Users/Lenovo/anaconda3/envs/revitenv/Lib/site-packages")
clr.AddReference('RevitAPI')
clr.AddReference('RevitAPIUI')
from Autodesk.Revit.DB import *
from Autodesk.Revit.UI import *

clr.AddReference('RevitServices')
from RevitServices.Persistence import DocumentManager
from RevitServices.Transactions import TransactionManager

clr.AddReference('RevitNodes')
import Revit
clr.ImportExtensions(Revit.Elements)
clr.ImportExtensions(Revit.GeometryConversion)

import re
import math
import json
import os
import traceback
import numpy as np
import torch
import cv2

from scipy.spatial import Voronoi
from scipy import ndimage
from shapely.geometry import Polygon, LineString, MultiLineString
from shapely.ops import linemerge
from shapely.ops import unary_union, split
from shapely.geometry import Point as ShpPoint
from shapely.geometry import Polygon as ShpPolygon
from shapely.geometry import MultiPolygon as ShpMultiPolygon
from shapely.geometry import Point as ShpPoint
from shapely.geometry import MultiLineString
from shapely.ops import linemerge
from skimage.morphology import skeletonize
from ultralytics import YOLO

dataEnteringNode = IN 

# =========================
# 输入
# =========================
dect_Model = IN[0]
pixpath = IN[1]
height = IN[2]
scale = IN[3]
dims_json_path = IN[4]
seg_meta_json_path = IN[5]

# =========================
# 参数
# =========================
origin = XYZ(0, 0, 0)   
widthFt = scale
pixelWidth = 1600   
pixelHeight = 1200 
DENSIFY_DIST = 0.5  
EPS = 1e-6

TARGET_WALL_TYPE_NAME = "基本墙 200mm"
TARGET_LEVEL_NAME = "标高 2"

newpath = "E:/yanjiu/revitss/tests/jjianzhu_seg.jpg"

scaleX = widthFt / pixelWidth if pixelWidth > 0 else 0.0
scaleY = widthFt * (pixelHeight / pixelWidth) / pixelHeight if pixelWidth > 0 and pixelHeight > 0 else 0.0

bbox_info_global = None
scale_x_ft_per_px_global = None
scale_y_ft_per_px_global = None

logs = []

# =========================
# 工具函数
# =========================
def ensure_dir_of_file(file_path):
    folder = os.path.dirname(file_path)
    if folder and not os.path.exists(folder):
        os.makedirs(folder)

def pix_to_revit(x, y):
    global bbox_info_global, scale_x_ft_per_px_global, scale_y_ft_per_px_global

    try:
        if bbox_info_global is not None and scale_x_ft_per_px_global is not None and scale_y_ft_per_px_global is not None:
            min_x = bbox_info_global["min_x"]
            min_y = bbox_info_global["min_y"]
            bbox_h = bbox_info_global["height"]

            local_x = x - min_x
            local_y = y - min_y

            revit_x = origin.X + local_x * scale_x_ft_per_px_global
            revit_y = origin.Y + (bbox_h - local_y) * scale_y_ft_per_px_global
            return XYZ(revit_x, revit_y, origin.Z)
    except:
        pass

    revit_x = origin.X + x * scaleX
    revit_y = origin.Y + (pixelHeight - y) * scaleY
    return XYZ(revit_x, revit_y, origin.Z)

def sanitize_name(name):
    if not name:
        return "Unknown"
    cleaned = re.sub(r'[\x00-\x1f\x7f]', '', name)
    if not cleaned.strip():
        return "Unnamed"
    return cleaned

def get_mask_bbox(binary_mask, logs):
    if binary_mask is None:
        logs.append("get_mask_bbox失败: binary_mask is None")
        return None

    ys, xs = np.where(binary_mask > 0)
    if len(xs) == 0 or len(ys) == 0:
        logs.append("get_mask_bbox失败: 墙体mask为空")
        return None

    min_x = int(np.min(xs))
    max_x = int(np.max(xs))
    min_y = int(np.min(ys))
    max_y = int(np.max(ys))

    bbox = {
        "min_x": min_x,
        "min_y": min_y,
        "max_x": max_x,
        "max_y": max_y,
        "width": int(max_x - min_x + 1),
        "height": int(max_y - min_y + 1)
    }
    logs.append("结构mask bbox: {}".format(str(bbox)))
    return bbox

# =========================
# 结构类配置
# =========================
STRUCTURE_CLASS_KEYWORDS = [
    "wall",
    "墙",
    "墙体",
    "basic wall",
    "door",
    "门",
    "tdoor",
    "double door",
    "window",
    "窗",
    "窗户"
]

STRUCTURE_CLASS_EXACT = set([
    "wall",
    "door",
    "window",
    "tdoor"
])

EXPAND_CLASSES = set([
    "door",
    "window",
    "tdoor"
])

def normalize_class_name(name):
    if name is None:
        return ""
    return str(name).strip().lower()

def is_structure_wall_like_class(name):
    n = normalize_class_name(name)
    if not n:
        return False

    if n in STRUCTURE_CLASS_EXACT:
        return True

    for kw in STRUCTURE_CLASS_KEYWORDS:
        if kw.lower() in n:
            return True
    return False

def ensure_polygon(geom):
    if geom is None or geom.is_empty:
        return None
    try:
        if not geom.is_valid:
            geom = geom.buffer(0)
    except:
        pass
    if geom is None or geom.is_empty:
        return None

    if isinstance(geom, ShpPolygon):
        return geom

    if isinstance(geom, ShpMultiPolygon):
        polys = [g for g in geom.geoms if g is not None and not g.is_empty]
        if not polys:
            return None
        polys.sort(key=lambda p: p.area, reverse=True)
        return polys[0]

    return None

def line_long_enough(line_geom, min_len=0.1):
    if line_geom is None or line_geom.is_empty:
        return False
    try:
        return line_geom.length >= min_len
    except:
        return False

def snap_line_to_axis(line_geom):
    if line_geom is None or line_geom.is_empty:
        return None
    coords = list(line_geom.coords)
    if len(coords) < 2:
        return None
    x1, y1 = coords[0]
    x2, y2 = coords[-1]
    dx = x2 - x1
    dy = y2 - y1
    if abs(dx) >= abs(dy):
        ym = 0.5 * (y1 + y2)
        return LineString([(x1, ym), (x2, ym)])
    else:
        xm = 0.5 * (x1 + x2)
        return LineString([(xm, y1), (xm, y2)])

def get_line_orientation_from_geom(line_geom):
    coords = list(line_geom.coords)
    x1, y1 = coords[0]
    x2, y2 = coords[-1]
    if abs(y2 - y1) <= abs(x2 - x1):
        return "h"
    return "v"

def get_line_orientation(seg):
    return get_line_orientation_from_geom(seg['line'])

def line_length(line_geom):
    try:
        return line_geom.length
    except:
        return 0.0

def copy_segments(segments):
    out = []
    for s in segments:
        out.append({
            'line': s['line'],
            'thickness': s['thickness'],
            'name': s['name']
        })
    return out

def longest_linestring_from_intersection(inter):
    if inter is None or inter.is_empty:
        return None
    if inter.geom_type == "LineString":
        return inter
    if inter.geom_type == "MultiLineString":
        lines = [g for g in inter.geoms if g.length > 1e-4]
        if not lines:
            return None
        lines.sort(key=lambda g: g.length, reverse=True)
        return lines[0]
    return None

def merge_close_vertices(segments, delta):
    pts = []
    for seg in segments:
        coords = list(seg['line'].coords)
        pts.append(coords[0])
        pts.append(coords[-1])

    if not pts:
        return segments

    clusters = []
    for p in pts:
        assigned = False
        for cluster in clusters:
            cx, cy, plist = cluster
            d2 = (p[0]-cx)**2 + (p[1]-cy)**2
            if d2 < delta * delta:
                plist.append(p)
                nx = sum(pp[0] for pp in plist) / len(plist)
                ny = sum(pp[1] for pp in plist) / len(plist)
                cluster[0] = nx
                cluster[1] = ny
                assigned = True
                break
        if not assigned:
            clusters.append([p[0], p[1], [p]])

    def snap_point(p):
        best = p
        best_d = 1e18
        for cx, cy, plist in clusters:
            d2 = (p[0]-cx)**2 + (p[1]-cy)**2
            if d2 < best_d:
                best_d = d2
                best = (cx, cy)
        return best

    new_segments = []
    for seg in segments:
        coords = list(seg['line'].coords)
        p1 = snap_point(coords[0])
        p2 = snap_point(coords[-1])
        if ((p1[0]-p2[0])**2 + (p1[1]-p2[1])**2) ** 0.5 < 0.1:
            continue
        new_line = LineString([p1, p2])
        new_line = snap_line_to_axis(new_line)
        if new_line is None:
            continue
        new_segments.append({
            'line': new_line,
            'thickness': seg['thickness'],
            'name': seg['name']
        })
    return new_segments

def point_to_segment_distance(pt, a, b):
    px, py = pt
    ax, ay = a
    bx, by = b
    dx = bx - ax
    dy = by - ay
    if abs(dx) < EPS and abs(dy) < EPS:
        return ((px-ax)**2 + (py-ay)**2)**0.5, a, 0.0

    t = ((px-ax)*dx + (py-ay)*dy) / (dx*dx + dy*dy)
    t_clamped = max(0.0, min(1.0, t))
    qx = ax + t_clamped * dx
    qy = ay + t_clamped * dy
    dist = ((px-qx)**2 + (py-qy)**2)**0.5
    return dist, (qx, qy), t_clamped

def split_segments_by_near_vertices(segments, delta):
    if not segments:
        return segments

    vertices = []
    for seg in segments:
        coords = list(seg['line'].coords)
        vertices.append(coords[0])
        vertices.append(coords[-1])

    new_segments = []
    for idx, seg in enumerate(segments):
        coords = list(seg['line'].coords)
        a = coords[0]
        b = coords[-1]
        split_pts = []

        for v in vertices:
            if v == a or v == b:
                continue
            dist, proj, t = point_to_segment_distance(v, a, b)
            if dist < delta and t > 0.01 and t < 0.99:
                split_pts.append((t, v))

        if not split_pts:
            new_segments.append(seg)
        else:
            split_pts.sort(key=lambda x: x[0])
            chain = [a] + [v for _, v in split_pts] + [b]
            for p1, p2 in zip(chain[:-1], chain[1:]):
                if ((p1[0]-p2[0])**2 + (p1[1]-p2[1])**2) ** 0.5 < 0.1:
                    continue
                new_line = snap_line_to_axis(LineString([p1, p2]))
                if new_line is None:
                    continue
                new_segments.append({
                    'line': new_line,
                    'thickness': seg['thickness'],
                    'name': seg['name']
                })
    return new_segments

def merge_collinear_segments_strict(segments, coord_tol=0.08, gap_tol=0.25):
    if not segments:
        return segments

    horizontal = []
    vertical = []
    others = []

    for seg in segments:
        coords = list(seg['line'].coords)
        x1, y1 = coords[0]
        x2, y2 = coords[-1]

        if abs(y2 - y1) <= coord_tol:
            y = 0.5 * (y1 + y2)
            xmin, xmax = min(x1, x2), max(x1, x2)
            horizontal.append((y, xmin, xmax, seg))
        elif abs(x2 - x1) <= coord_tol:
            x = 0.5 * (x1 + x2)
            ymin, ymax = min(y1, y2), max(y1, y2)
            vertical.append((x, ymin, ymax, seg))
        else:
            others.append(seg)

    merged = []

    horizontal.sort(key=lambda t: (round(t[0], 2), t[1]))
    used = [False] * len(horizontal)
    for i in range(len(horizontal)):
        if used[i]:
            continue
        y, x1, x2, seg = horizontal[i]
        thick = seg['thickness']
        name = seg['name']

        for j in range(i + 1, len(horizontal)):
            if used[j]:
                continue
            y2, xx1, xx2, seg2 = horizontal[j]
            if abs(y2 - y) <= coord_tol and xx1 <= x2 + gap_tol:
                x2 = max(x2, xx2)
                thick = 0.5 * (thick + seg2['thickness'])
                used[j] = True

        merged.append({
            'line': LineString([(x1, y), (x2, y)]),
            'thickness': thick,
            'name': name
        })

    vertical.sort(key=lambda t: (round(t[0], 2), t[1]))
    used = [False] * len(vertical)
    for i in range(len(vertical)):
        if used[i]:
            continue
        x, y1, y2, seg = vertical[i]
        thick = seg['thickness']
        name = seg['name']

        for j in range(i + 1, len(vertical)):
            if used[j]:
                continue
            x2, yy1, yy2, seg2 = vertical[j]
            if abs(x2 - x) <= coord_tol and yy1 <= y2 + gap_tol:
                y2 = max(y2, yy2)
                thick = 0.5 * (thick + seg2['thickness'])
                used[j] = True

        merged.append({
            'line': LineString([(x, y1), (x, y2)]),
            'thickness': thick,
            'name': name
        })

    merged.extend(others)
    return merged

def optimize_wall_centerlines(candidates, iter_count=1, enable_merge_collinear=True):
    if not candidates:
        return []

    segs = candidates[:]

    if enable_merge_collinear:
        segs = merge_collinear_segments_strict(segs, coord_tol=0.08, gap_tol=0.35)

    for _ in range(iter_count):
        if not segs:
            break

        avg_t = sum(s['thickness'] for s in segs) / max(len(segs), 1)
        delta = 0.20 * avg_t
        if delta < 0.03:
            delta = 0.03
        if delta > 0.12:
            delta = 0.12

        segs = merge_close_vertices(segs, delta)
        segs = split_segments_by_near_vertices(segs, delta)

    cleaned = []
    for s in segs:
        try:
            if s['line'] is None or s['line'].is_empty:
                continue
            if s['line'].length < 0.08:
                continue
            cleaned.append(s)
        except:
            continue

    return cleaned

# =========================
# mask 构建与清理
# =========================
def build_global_structure_mask(result, pixelWidth, pixelHeight, logs):
    wall_mask = np.zeros((pixelHeight, pixelWidth), dtype=np.uint8)
    class_counter = {}

    if result.masks is None:
        logs.append("result.masks is None")
        return wall_mask, class_counter

    masks_xy = result.masks.xy
    cls_ids = result.boxes.cls.cpu().numpy().astype(int)
    names = result.names

    logs.append("总mask数量: {}".format(len(masks_xy)))

    expand_kernel = cv2.getStructuringElement(cv2.MORPH_RECT, (5, 5))

    for i, contour_pts in enumerate(masks_xy):
        try:
            if i >= len(cls_ids):
                continue

            class_id = cls_ids[i]
            class_name = names[class_id]
            class_name_norm = normalize_class_name(class_name)

            if not is_structure_wall_like_class(class_name):
                continue

            pts = np.array(contour_pts, dtype=np.int32)
            if len(pts) < 3:
                continue

            pts[:, 0] = np.clip(pts[:, 0], 0, pixelWidth - 1)
            pts[:, 1] = np.clip(pts[:, 1], 0, pixelHeight - 1)

            if class_name_norm in EXPAND_CLASSES:
                temp = np.zeros((pixelHeight, pixelWidth), dtype=np.uint8)
                cv2.fillPoly(temp, [pts], 255)
                temp = cv2.dilate(temp, expand_kernel, iterations=1)
                wall_mask[temp > 0] = 255
            else:
                cv2.fillPoly(wall_mask, [pts], 255)

            class_counter[class_name_norm] = class_counter.get(class_name_norm, 0) + 1

        except Exception as e:
            logs.append("合成结构mask失败 idx={}: {}".format(i, str(e)))
            continue

    logs.append("参与墙体生成的类别统计: {}".format(str(class_counter)))
    return wall_mask, class_counter

def clean_wall_mask(binary_mask, logs):
    mask = binary_mask.copy()

    kernel_bridge = cv2.getStructuringElement(cv2.MORPH_RECT, (3, 3))
    kernel_close_big = cv2.getStructuringElement(cv2.MORPH_RECT, (7, 7))
    kernel_close_small = cv2.getStructuringElement(cv2.MORPH_RECT, (5, 5))

    mask = cv2.dilate(mask, kernel_bridge, iterations=1)
    mask = cv2.morphologyEx(mask, cv2.MORPH_CLOSE, kernel_close_big)
    mask = cv2.morphologyEx(mask, cv2.MORPH_CLOSE, kernel_close_small)
    mask = cv2.erode(mask, kernel_bridge, iterations=1)

    num_labels, labels, stats, _ = cv2.connectedComponentsWithStats(mask, connectivity=8)
    cleaned = np.zeros_like(mask)

    for i in range(1, num_labels):
        area = stats[i, cv2.CC_STAT_AREA]
        if area >= 30:
            cleaned[labels == i] = 255

    logs.append("结构mask清理完成(补缝增强版)")
    return cleaned

def estimate_wall_width_pixels(binary_mask, logs):
    if binary_mask is None or binary_mask.max() == 0:
        logs.append("墙宽估计失败：mask为空")
        return 6.0

    dist = cv2.distanceTransform(binary_mask, cv2.DIST_L2, 5)
    vals = dist[dist > 0]
    if len(vals) == 0:
        logs.append("墙宽估计失败：distanceTransform为空")
        return 6.0

    wall_width_px = max(2.0, 2.0 * np.median(vals))
    logs.append("估计墙宽像素值: {:.2f}".format(wall_width_px))
    return wall_width_px

def skeletonize_wall_mask(binary_mask, logs):
    try:
        from skimage.morphology import skeletonize
        skel = skeletonize(binary_mask > 0)
        logs.append("使用 skimage.skeletonize 成功")
        return skel.astype(np.uint8)
    except Exception as e:
        logs.append("skimage骨架失败，改用fallback: {}".format(str(e)))
        return skeletonize_fallback(binary_mask, logs)

def skeletonize_fallback(binary_mask, logs):
    img = (binary_mask > 0).astype(np.uint8) * 255
    size = np.size(img)
    skel = np.zeros(img.shape, np.uint8)

    element = cv2.getStructuringElement(cv2.MORPH_CROSS, (3, 3))
    done = False

    while not done:
        eroded = cv2.erode(img, element)
        temp = cv2.dilate(eroded, element)
        temp = cv2.subtract(img, temp)
        skel = cv2.bitwise_or(skel, temp)
        img = eroded.copy()

        zeros = size - cv2.countNonZero(img)
        if zeros == size:
            done = True

    logs.append("fallback skeletonize 成功")
    return (skel > 0).astype(np.uint8)

def get_neighbors_8(x, y, w, h):
    nbs = []
    for dy in [-1, 0, 1]:
        for dx in [-1, 0, 1]:
            if dx == 0 and dy == 0:
                continue
            nx = x + dx
            ny = y + dy
            if 0 <= nx < w and 0 <= ny < h:
                nbs.append((nx, ny))
    return nbs

def extract_skeleton_graph(skel, logs):
    h, w = skel.shape
    skel_pts = set()
    for y in range(h):
        xs = np.where(skel[y] > 0)[0]
        for x in xs:
            skel_pts.add((x, y))

    if not skel_pts:
        logs.append("骨架为空")
        return [], []

    degree = {}
    for (x, y) in skel_pts:
        cnt = 0
        for nx, ny in get_neighbors_8(x, y, w, h):
            if (nx, ny) in skel_pts:
                cnt += 1
        degree[(x, y)] = cnt

    nodes = [p for p, d in degree.items() if d != 2]

    if not nodes:
        nodes = list(skel_pts)

    node_set = set(nodes)
    visited_edges = set()
    edges = []

    for node in nodes:
        x0, y0 = node
        for nx, ny in get_neighbors_8(x0, y0, w, h):
            if (nx, ny) not in skel_pts:
                continue

            edge_key = tuple(sorted([node, (nx, ny)]))
            if edge_key in visited_edges:
                continue

            path = [node, (nx, ny)]
            prev = node
            curr = (nx, ny)

            while True:
                visited_edges.add(tuple(sorted([prev, curr])))

                if curr in node_set and curr != node:
                    break

                nbrs = []
                for tx, ty in get_neighbors_8(curr[0], curr[1], w, h):
                    if (tx, ty) in skel_pts and (tx, ty) != prev:
                        nbrs.append((tx, ty))

                if len(nbrs) == 0:
                    break
                if len(nbrs) > 1:
                    break

                nxt = nbrs[0]
                path.append(nxt)
                prev = curr
                curr = nxt

            if len(path) >= 2:
                edges.append(path)

    logs.append("骨架图提取完成: nodes={}, edges={}".format(len(nodes), len(edges)))
    return nodes, edges

def split_path_by_direction(path, turn_threshold=2):
    if not path or len(path) < 3:
        return [path] if path else []

    segments = []
    current = [path[0], path[1]]

    def major_dir(p1, p2):
        dx = p2[0] - p1[0]
        dy = p2[1] - p1[1]
        if abs(dx) >= abs(dy):
            return "h"
        else:
            return "v"

    prev_dir = major_dir(path[0], path[1])

    for i in range(2, len(path)):
        d = major_dir(path[i-1], path[i])

        if d == prev_dir:
            current.append(path[i])
        else:
            if len(current) <= turn_threshold and segments:
                segments[-1].extend(current[1:])
                current = [segments[-1][-1], path[i]]
            else:
                segments.append(current)
                current = [path[i-1], path[i]]
            prev_dir = d

    if current:
        if len(current) <= turn_threshold and segments:
            segments[-1].extend(current[1:])
        else:
            segments.append(current)

    cleaned = []
    for seg in segments:
        if seg and len(seg) >= 2:
            cleaned.append(seg)

    return cleaned

def fit_axis_line_from_mask(sub_path, wall_mask, pixelWidth, pixelHeight, min_len_px=8):
    if not sub_path or len(sub_path) < 2:
        return None

    xs = [p[0] for p in sub_path]
    ys = [p[1] for p in sub_path]

    x_min = max(0, int(min(xs)))
    x_max = min(pixelWidth - 1, int(max(xs)))
    y_min = max(0, int(min(ys)))
    y_max = min(pixelHeight - 1, int(max(ys)))

    dx = x_max - x_min
    dy = y_max - y_min

    if dx >= dy:
        mids = []
        for x in range(x_min, x_max + 1):
            ys_in = np.where(wall_mask[:, x] > 0)[0]
            ys_local = ys_in[(ys_in >= y_min - 8) & (ys_in <= y_max + 8)]
            if len(ys_local) >= 2:
                y_top = np.min(ys_local)
                y_bot = np.max(ys_local)
                y_mid = 0.5 * (y_top + y_bot)
                mids.append((x, y_mid))

        if len(mids) < 2:
            return None

        xs2 = [p[0] for p in mids]
        ys2 = [p[1] for p in mids]

        x1 = min(xs2)
        x2 = max(xs2)
        y = float(np.median(ys2))

        if (x2 - x1) < min_len_px:
            return None

        return ((x1, y), (x2, y), "h")

    else:
        mids = []
        for y in range(y_min, y_max + 1):
            xs_in = np.where(wall_mask[y, :] > 0)[0]
            xs_local = xs_in[(xs_in >= x_min - 8) & (xs_in <= x_max + 8)]
            if len(xs_local) >= 2:
                x_left = np.min(xs_local)
                x_right = np.max(xs_local)
                x_mid = 0.5 * (x_left + x_right)
                mids.append((x_mid, y))

        if len(mids) < 2:
            return None

        xs2 = [p[0] for p in mids]
        ys2 = [p[1] for p in mids]

        y1 = min(ys2)
        y2 = max(ys2)
        x = float(np.median(xs2))

        if (y2 - y1) < min_len_px:
            return None

        return ((x, y1), (x, y2), "v")

def pixel_line_to_revit_linestring(p1, p2):
    rp1 = pix_to_revit(p1[0], p1[1])
    rp2 = pix_to_revit(p2[0], p2[1])
    if rp1.DistanceTo(rp2) < 0.1:
        return None
    return LineString([(rp1.X, rp1.Y), (rp2.X, rp2.Y)])

def simplify_path_to_axis_lines(path, wall_mask, pixelWidth, pixelHeight, logs, min_len_px=8):
    result_lines = []

    sub_paths = split_path_by_direction(path, turn_threshold=2)
    for sub in sub_paths:
        try:
            fitted = fit_axis_line_from_mask(
                sub, wall_mask, pixelWidth, pixelHeight, min_len_px=min_len_px
            )
            if fitted is None:
                continue

            p1, p2, ori = fitted
            line_geom = pixel_line_to_revit_linestring(p1, p2)
            if line_geom is None:
                continue

            if line_geom.length < 0.08:
                continue

            result_lines.append(line_geom)

        except Exception as e:
            logs.append("子段拟合失败: {}".format(str(e)))
            continue

    return result_lines

def extract_wall_centerlines_from_global_mask(result, pixelWidth, pixelHeight, logs):
    wall_mask, class_counter = build_global_structure_mask(result, pixelWidth, pixelHeight, logs)
    if wall_mask.max() == 0:
        logs.append("没有结构类mask被写入全局墙图")
        return [], 0.3, class_counter, wall_mask

    cleaned_mask = clean_wall_mask(wall_mask, logs)
    wall_width_px = estimate_wall_width_pixels(cleaned_mask, logs)

    skel = skeletonize_wall_mask(cleaned_mask, logs)
    nodes, edges = extract_skeleton_graph(skel, logs)

    if not edges:
        logs.append("骨架没有边")
        wall_width_ft = wall_width_px * (scale_x_ft_per_px_global if scale_x_ft_per_px_global else scaleX)
        return [], wall_width_ft, class_counter, cleaned_mask

    wall_width_ft = wall_width_px * (scale_x_ft_per_px_global if scale_x_ft_per_px_global else scaleX)
    candidates = []

    for idx, path in enumerate(edges):
        try:
            line_list = simplify_path_to_axis_lines(
                path, cleaned_mask, pixelWidth, pixelHeight, logs,
                min_len_px=max(3, int(wall_width_px * 0.5))
            )

            for line_geom in line_list:
                candidates.append({
                    'line': line_geom,
                    'thickness': wall_width_ft,
                    'name': "Wall"
                })

        except Exception as e:
            logs.append("路径{}转中心线失败: {}".format(idx, str(e)))
            continue

    logs.append("全局提取中心线候选数量: {}".format(len(candidates)))
    return candidates, wall_width_ft, class_counter, cleaned_mask

# =========================
# 第二版增强：几何补缝与对齐
# =========================
def bridge_near_orthogonal_gaps(segments, gap_tol=0.6, axis_tol=0.25):
    if not segments:
        return segments

    segs = copy_segments(segments)

    for i in range(len(segs)):
        for j in range(i + 1, len(segs)):
            si = segs[i]
            sj = segs[j]
            if si is None or sj is None:
                continue

            oi = get_line_orientation(si)
            oj = get_line_orientation(sj)

            if oi == oj:
                continue

            if oi == "v" and oj == "h":
                tmp = si
                si = sj
                sj = tmp
                idx_h = j
                idx_v = i
            else:
                idx_h = i
                idx_v = j

            coords_h = list(si['line'].coords)
            coords_v = list(sj['line'].coords)

            hx1, hy1 = coords_h[0]
            hx2, hy2 = coords_h[-1]
            vx1, vy1 = coords_v[0]
            vx2, vy2 = coords_v[-1]

            y_h = 0.5 * (hy1 + hy2)
            x_v = 0.5 * (vx1 + vx2)

            hminx, hmaxx = min(hx1, hx2), max(hx1, hx2)
            vminy, vmaxy = min(vy1, vy2), max(vy1, vy2)

            inter_pt = (x_v, y_h)

            h_endpts = [(hx1, hy1), (hx2, hy2)]
            v_endpts = [(vx1, vy1), (vx2, vy2)]

            h_dists = [((p[0]-inter_pt[0])**2 + (p[1]-inter_pt[1])**2)**0.5 for p in h_endpts]
            v_dists = [((p[0]-inter_pt[0])**2 + (p[1]-inter_pt[1])**2)**0.5 for p in v_endpts]

            h_min_idx = int(np.argmin(h_dists))
            v_min_idx = int(np.argmin(v_dists))

            h_min_dist = h_dists[h_min_idx]
            v_min_dist = v_dists[v_min_idx]

            cond_h = (x_v >= hminx - axis_tol and x_v <= hmaxx + gap_tol)
            cond_v = (y_h >= vminy - axis_tol and y_h <= vmaxy + gap_tol)

            if h_min_dist <= gap_tol and v_min_dist <= gap_tol and cond_h and cond_v:
                other_h = h_endpts[1 - h_min_idx]
                other_v = v_endpts[1 - v_min_idx]

                new_h = snap_line_to_axis(LineString([other_h, inter_pt]))
                new_v = snap_line_to_axis(LineString([other_v, inter_pt]))

                if new_h is not None and new_h.length >= 0.08:
                    segs[idx_h]['line'] = new_h
                if new_v is not None and new_v.length >= 0.08:
                    segs[idx_v]['line'] = new_v

    cleaned = []
    for s in segs:
        try:
            if s['line'] is None or s['line'].is_empty:
                continue
            if s['line'].length < 0.08:
                continue
            cleaned.append(s)
        except:
            continue
    return cleaned

def align_parallel_segments(segments, coord_tol=0.35):
    """
    将接近共线的水平段/竖直段拉齐到同一坐标轴
    水平：对齐 y
    竖直：对齐 x
    """
    if not segments:
        return segments

    segs = copy_segments(segments)

    horizontal_groups = []
    vertical_groups = []

    for idx, s in enumerate(segs):
        coords = list(s['line'].coords)
        x1, y1 = coords[0]
        x2, y2 = coords[-1]
        ori = get_line_orientation(s)

        if ori == "h":
            y = 0.5 * (y1 + y2)
            added = False
            for g in horizontal_groups:
                if abs(g['coord'] - y) <= coord_tol:
                    g['indices'].append(idx)
                    g['values'].append(y)
                    g['coord'] = float(np.median(g['values']))
                    added = True
                    break
            if not added:
                horizontal_groups.append({
                    'coord': y,
                    'indices': [idx],
                    'values': [y]
                })
        else:
            x = 0.5 * (x1 + x2)
            added = False
            for g in vertical_groups:
                if abs(g['coord'] - x) <= coord_tol:
                    g['indices'].append(idx)
                    g['values'].append(x)
                    g['coord'] = float(np.median(g['values']))
                    added = True
                    break
            if not added:
                vertical_groups.append({
                    'coord': x,
                    'indices': [idx],
                    'values': [x]
                })

    for g in horizontal_groups:
        target_y = g['coord']
        for idx in g['indices']:
            coords = list(segs[idx]['line'].coords)
            x1, y1 = coords[0]
            x2, y2 = coords[-1]
            segs[idx]['line'] = LineString([(x1, target_y), (x2, target_y)])

    for g in vertical_groups:
        target_x = g['coord']
        for idx in g['indices']:
            coords = list(segs[idx]['line'].coords)
            x1, y1 = coords[0]
            x2, y2 = coords[-1]
            segs[idx]['line'] = LineString([(target_x, y1), (target_x, y2)])

    return segs

def bridge_parallel_gaps(segments, coord_tol=0.25, gap_tol=0.8):
    """
    平行且接近共线的短缝桥接
    - 水平对水平：y接近，x方向中间差一小截 -> 合并成一条
    - 竖直对竖直：x接近，y方向中间差一小截 -> 合并成一条
    """
    if not segments:
        return segments

    segs = copy_segments(segments)
    used = [False] * len(segs)
    result = []

    # 先水平
    horiz = []
    vert = []
    other = []

    for idx, s in enumerate(segs):
        ori = get_line_orientation(s)
        coords = list(s['line'].coords)
        x1, y1 = coords[0]
        x2, y2 = coords[-1]

        if ori == "h":
            y = 0.5 * (y1 + y2)
            xmin = min(x1, x2)
            xmax = max(x1, x2)
            horiz.append((idx, y, xmin, xmax, s))
        else:
            x = 0.5 * (x1 + x2)
            ymin = min(y1, y2)
            ymax = max(y1, y2)
            vert.append((idx, x, ymin, ymax, s))

    horiz.sort(key=lambda t: (round(t[1], 3), t[2]))
    consumed = set()
    for i in range(len(horiz)):
        if i in consumed:
            continue
        idx_i, y_i, x1_i, x2_i, seg_i = horiz[i]
        cur_y = y_i
        cur_x1 = x1_i
        cur_x2 = x2_i
        cur_thick = seg_i['thickness']
        cur_name = seg_i['name']

        for j in range(i + 1, len(horiz)):
            if j in consumed:
                continue
            idx_j, y_j, x1_j, x2_j, seg_j = horiz[j]

            if abs(y_j - cur_y) <= coord_tol:
                gap = x1_j - cur_x2
                overlap = min(cur_x2, x2_j) - max(cur_x1, x1_j)
                if gap <= gap_tol or overlap >= -coord_tol:
                    cur_x1 = min(cur_x1, x1_j)
                    cur_x2 = max(cur_x2, x2_j)
                    cur_y = float(np.median([cur_y, y_j]))
                    cur_thick = 0.5 * (cur_thick + seg_j['thickness'])
                    consumed.add(j)

        result.append({
            'line': LineString([(cur_x1, cur_y), (cur_x2, cur_y)]),
            'thickness': cur_thick,
            'name': cur_name
        })

    vert.sort(key=lambda t: (round(t[1], 3), t[2]))
    consumed = set()
    for i in range(len(vert)):
        if i in consumed:
            continue
        idx_i, x_i, y1_i, y2_i, seg_i = vert[i]
        cur_x = x_i
        cur_y1 = y1_i
        cur_y2 = y2_i
        cur_thick = seg_i['thickness']
        cur_name = seg_i['name']

        for j in range(i + 1, len(vert)):
            if j in consumed:
                continue
            idx_j, x_j, y1_j, y2_j, seg_j = vert[j]

            if abs(x_j - cur_x) <= coord_tol:
                gap = y1_j - cur_y2
                overlap = min(cur_y2, y2_j) - max(cur_y1, y1_j)
                if gap <= gap_tol or overlap >= -coord_tol:
                    cur_y1 = min(cur_y1, y1_j)
                    cur_y2 = max(cur_y2, y2_j)
                    cur_x = float(np.median([cur_x, x_j]))
                    cur_thick = 0.5 * (cur_thick + seg_j['thickness'])
                    consumed.add(j)

        result.append({
            'line': LineString([(cur_x, cur_y1), (cur_x, cur_y2)]),
            'thickness': cur_thick,
            'name': cur_name
        })

    return result

def snap_near_endpoints(segments, snap_tol=0.25):
    """
    对近距离端点做统一吸附
    """
    if not segments:
        return segments

    pts = []
    for idx, seg in enumerate(segments):
        coords = list(seg['line'].coords)
        pts.append((idx, 0, coords[0]))
        pts.append((idx, 1, coords[-1]))

    clusters = []
    for item in pts:
        idx, end_flag, p = item
        assigned = False
        for c in clusters:
            cx, cy = c['center']
            if ((p[0]-cx)**2 + (p[1]-cy)**2)**0.5 <= snap_tol:
                c['items'].append(item)
                xs = [it[2][0] for it in c['items']]
                ys = [it[2][1] for it in c['items']]
                c['center'] = (float(np.mean(xs)), float(np.mean(ys)))
                assigned = True
                break
        if not assigned:
            clusters.append({
                'center': (p[0], p[1]),
                'items': [item]
            })

    segs = copy_segments(segments)

    for c in clusters:
        center = c['center']
        for idx, end_flag, p in c['items']:
            coords = list(segs[idx]['line'].coords)
            if end_flag == 0:
                new_line = LineString([center, coords[-1]])
            else:
                new_line = LineString([coords[0], center])

            new_line = snap_line_to_axis(new_line)
            if new_line is not None and new_line.length >= 0.08:
                segs[idx]['line'] = new_line

    return segs

def clean_duplicate_segments(segments, coord_tol=0.05):
    if not segments:
        return segments

    uniq = []
    keys = set()

    for s in segments:
        try:
            coords = list(s['line'].coords)
            x1, y1 = coords[0]
            x2, y2 = coords[-1]

            p1 = (round(x1 / coord_tol), round(y1 / coord_tol))
            p2 = (round(x2 / coord_tol), round(y2 / coord_tol))
            key = tuple(sorted([p1, p2]))

            if key in keys:
                continue
            keys.add(key)
            uniq.append(s)
        except:
            continue

    return uniq

def run_geometry_enhancement_v2(segments, logs):
    if not segments:
        return segments

    segs = copy_segments(segments)
    logs.append("V2增强-输入墙段数: {}".format(len(segs)))

    segs = align_parallel_segments(segs, coord_tol=0.35)
    logs.append("V2增强-平行对齐后: {}".format(len(segs)))

    segs = bridge_parallel_gaps(segs, coord_tol=0.25, gap_tol=0.8)
    logs.append("V2增强-平行短缝桥接后: {}".format(len(segs)))

    segs = bridge_near_orthogonal_gaps(segs, gap_tol=0.6, axis_tol=0.25)
    logs.append("V2增强-正交补缝后: {}".format(len(segs)))

    segs = snap_near_endpoints(segs, snap_tol=0.25)
    logs.append("V2增强-端点吸附后: {}".format(len(segs)))

    segs = merge_collinear_segments_strict(segs, coord_tol=0.08, gap_tol=0.35)
    logs.append("V2增强-严格共线合并后: {}".format(len(segs)))

    segs = clean_duplicate_segments(segs, coord_tol=0.05)
    logs.append("V2增强-去重后: {}".format(len(segs)))

    cleaned = []
    for s in segs:
        try:
            if s['line'] is None or s['line'].is_empty:
                continue
            if s['line'].length < 0.08:
                continue
            cleaned.append(s)
        except:
            continue

    logs.append("V2增强-最终墙段数: {}".format(len(cleaned)))
    return cleaned

# =========================
# 运行YOLO分割
# =========================
yolo_seg = YOLO(dect_Model, task="seg")
seg_result = yolo_seg(source=pixpath, save=False, conf=0.7, iou=0.45, imgsz=1280)
cv2.imwrite(newpath, seg_result[0].plot())

result = seg_result[0]
boxes = result.boxes
xyxy = boxes.xyxy.cpu().numpy() if boxes is not None else np.empty((0,4))
cls_ids = boxes.cls.cpu().numpy().astype(int) if boxes is not None else np.array([], dtype=int)
names = result.names

# =========================
# 读取OCR尺寸JSON
# =========================
dims_data = None
horizontal_length_mm = None
vertical_length_mm = None

try:
    with open(dims_json_path, "r", encoding="utf-8") as f:
        dims_data = json.load(f)

    if dims_data.get("ok", False):
        if "result" in dims_data:
            horizontal_length_mm = dims_data["result"].get("horizontal_length", None)
            vertical_length_mm = dims_data["result"].get("vertical_length", None)
        else:
            horizontal_length_mm = dims_data.get("horizontal_length", None)
            vertical_length_mm = dims_data.get("vertical_length", None)

    logs.append("读取dims_json成功: horizontal={} mm, vertical={} mm".format(
        str(horizontal_length_mm), str(vertical_length_mm)
    ))
except Exception as e:
    logs.append("读取dims_json失败: {}".format(str(e)))

# =========================
# 先做结构mask -> bbox -> scale
# =========================
global_structure_mask, structure_class_counter = build_global_structure_mask(result, pixelWidth, pixelHeight, logs)
cleaned_global_structure_mask = clean_wall_mask(global_structure_mask, logs)
bbox_info = get_mask_bbox(cleaned_global_structure_mask, logs)

scale_x_mm_per_px = None
scale_y_mm_per_px = None
scale_avg_mm_per_px = None
scale_x_ft_per_px = None
scale_y_ft_per_px = None
scale_avg_ft_per_px = None

if bbox_info is not None and horizontal_length_mm is not None and vertical_length_mm is not None:
    try:
        bbox_w = bbox_info["width"]
        bbox_h = bbox_info["height"]

        if bbox_w > 0 and bbox_h > 0:
            scale_x_mm_per_px = float(horizontal_length_mm+200) / float(bbox_w)
            scale_y_mm_per_px = float(vertical_length_mm+200) / float(bbox_h)
            scale_avg_mm_per_px = (scale_x_mm_per_px + scale_y_mm_per_px) / 2.0

            mm_to_ft = 1.0 / 304.8
            scale_x_ft_per_px = scale_x_mm_per_px * mm_to_ft
            scale_y_ft_per_px = scale_y_mm_per_px * mm_to_ft
            scale_avg_ft_per_px = scale_avg_mm_per_px * mm_to_ft

            bbox_info_global = bbox_info
            scale_x_ft_per_px_global = scale_x_ft_per_px
            scale_y_ft_per_px_global = scale_y_ft_per_px

            logs.append("scale_x_mm_per_px={:.6f}".format(scale_x_mm_per_px))
            logs.append("scale_y_mm_per_px={:.6f}".format(scale_y_mm_per_px))
            logs.append("scale_avg_mm_per_px={:.6f}".format(scale_avg_mm_per_px))
            logs.append("scale_x_ft_per_px={:.6f}".format(scale_x_ft_per_px))
            logs.append("scale_y_ft_per_px={:.6f}".format(scale_y_ft_per_px))
        else:
            logs.append("bbox宽高无效，无法计算scale")
    except Exception as e:
        logs.append("scale计算失败: {}".format(str(e)))
else:
    logs.append("bbox或真实尺寸缺失，使用fallback整图scale")

# =========================
# Revit文档对象
# =========================
doc = DocumentManager.Instance.CurrentDBDocument
app = doc.Application

wall_type = None
wall_type_collector = FilteredElementCollector(doc).OfClass(WallType)

for wt in wall_type_collector:
    if wt.Kind == WallKind.Basic:
        name_param = wt.get_Parameter(BuiltInParameter.SYMBOL_NAME_PARAM)
        if name_param and name_param.AsString() == TARGET_WALL_TYPE_NAME:
            wall_type = wt
            break

if wall_type is None:
    for wt in wall_type_collector:
        if wt.Kind == WallKind.Basic:
            wall_type = wt
            break

if wall_type is None:
    raise Exception("项目中找不到任何基本墙类型！")

level = None
level_collector = FilteredElementCollector(doc).OfClass(Level)
for lvl in level_collector:
    name_param = lvl.get_Parameter(BuiltInParameter.LEVEL_NAME)
    if name_param and name_param.AsString() == TARGET_LEVEL_NAME:
        level = lvl
        break

if level is None:
    level = level_collector.FirstElement()
    if level is None:
        raise Exception("项目中找不到任何标高！")

TransactionManager.Instance.EnsureInTransaction(doc)

created_walls = []
wall_candidates = []

wallHeight = height

plane = Plane.CreateByNormalAndOrigin(XYZ.BasisZ, origin)
sketch_plane = SketchPlane.Create(doc, plane)

# =========================
# 提取中心线并创建墙
# =========================
if result.masks is not None:
    logs.append("YOLO类别映射: {}".format(str(result.names)))

    wall_candidates, default_wall_thickness, used_class_counter, final_mask_used = extract_wall_centerlines_from_global_mask(
        result, pixelWidth, pixelHeight, logs
    )

    logs.append("初始墙候选数量: {}".format(len(wall_candidates)))

    optimized_walls = optimize_wall_centerlines(
        wall_candidates,
        iter_count=1,
        enable_merge_collinear=False
    )

    logs.append("初步优化后墙数量: {}".format(len(optimized_walls)))

    # 第二版增强
    optimized_walls = run_geometry_enhancement_v2(optimized_walls, logs)

    for idx, w in enumerate(optimized_walls):
        try:
            line_geom = w['line']
            thickness_val = w['thickness']
            name = "Wall"

            coords = list(line_geom.coords)
            if len(coords) < 2:
                logs.append("墙{}失败：coords不足".format(idx))
                continue

            start_pt = XYZ(coords[0][0], coords[0][1], 0)
            end_pt = XYZ(coords[-1][0], coords[-1][1], 0)

            if start_pt.DistanceTo(end_pt) < 0.1:
                logs.append("墙{}失败：线太短".format(idx))
                continue

            revit_line = Line.CreateBound(start_pt, end_pt)

            logs.append("准备创建墙{}: len={:.3f}, thickness={:.3f}".format(
                idx, revit_line.Length, thickness_val
            ))

            wall = Wall.Create(doc, revit_line, wall_type.Id, level.Id, wallHeight, 0, False, False)

            try:
                param = wall.get_Parameter(BuiltInParameter.WALL_ATTR_WIDTH_PARAM)
                if param and not param.IsReadOnly:
                    param.Set(thickness_val)
            except Exception as e2:
                logs.append("墙{}宽度设置失败(可忽略): {}".format(idx, str(e2)))

            try:
                wall.Name = sanitize_name(name)
            except:
                pass

            created_walls.append(wall.ToDSType(True))
            logs.append("墙{}创建成功".format(idx))

        except Exception as e:
            logs.append("墙{}创建失败: {}".format(idx, str(e)))
            logs.append(traceback.format_exc())
            continue
else:
    logs.append("result.masks is None，没有分割mask")

# =========================
# 提交事务
# =========================
TransactionManager.Instance.TransactionTaskDone()
doc.Regenerate()

# =========================
# 写 seg_meta_json
# =========================
seg_meta = {
    "ok": True,
    "image_path": pixpath,
    "seg_vis_path": newpath,
    "dims_json_path": dims_json_path,
    "wall_bbox_px": bbox_info,
    "real_size_mm": {
        "horizontal_length": horizontal_length_mm,
        "vertical_length": vertical_length_mm
    },
    "scale": {
        "scale_x_mm_per_px": scale_x_mm_per_px,
        "scale_y_mm_per_px": scale_y_mm_per_px,
        "scale_avg_mm_per_px": scale_avg_mm_per_px,
        "scale_x_ft_per_px": scale_x_ft_per_px,
        "scale_y_ft_per_px": scale_y_ft_per_px,
        "scale_avg_ft_per_px": scale_avg_ft_per_px
    },
    "structure_mask_classes_used": structure_class_counter,
    "debug": {
        "pixelWidth": pixelWidth,
        "pixelHeight": pixelHeight,
        "wall_count": len(created_walls),
        "mask_count": len(result.masks.xy) if result.masks is not None else 0,
        "class_names": result.names,
        "log_count": len(logs)
    }
}

try:
    ensure_dir_of_file(seg_meta_json_path)
    with open(seg_meta_json_path, "w", encoding="utf-8") as f:
        json.dump(seg_meta, f, ensure_ascii=False, indent=2)
    logs.append("seg_meta_json已写出: {}".format(seg_meta_json_path))
except Exception as e:
    logs.append("seg_meta_json写出失败: {}".format(str(e)))

OUT = newpath, created_walls, seg_meta_json_path, logs
# ----------------------------------------
python_script_7 = Python(IN[0]=seg_WWTD_Modelpath, IN[1]=imagepath, IN[2]=number, IN[3]=scale, IN[4]=python_version, IN[5]=seg_meta_Json_Path)  # CPython3; frozen
# ---------- python_script_7.python (1571 lines) ----------
# 加载 Python Standard 和 DesignScript 库
#-------------------------------
import sys
import clr
clr.AddReference('ProtoGeometry')
from Autodesk.DesignScript.Geometry import *
import Autodesk.DesignScript.Geometry as DS
import Revit
from Revit.Elements import *
import System
sys.path.append("C:/Users/Lenovo/anaconda3/envs/revitenv/Lib/site-packages")
clr.AddReference('RevitAPI')
clr.AddReference('RevitAPIUI')
from Autodesk.Revit.DB import *
from Autodesk.Revit.UI import *

clr.AddReference('RevitServices')
from RevitServices.Persistence import DocumentManager
from RevitServices.Transactions import TransactionManager

clr.AddReference('RevitNodes')
import Revit
clr.ImportExtensions(Revit.Elements)
clr.ImportExtensions(Revit.GeometryConversion)

import re
import math
import json
import os
import traceback
import numpy as np
import torch
import cv2

from scipy.spatial import Voronoi
from scipy import ndimage
from shapely.geometry import Polygon, LineString, MultiLineString
from shapely.ops import linemerge
from shapely.ops import unary_union, split
from shapely.geometry import Point as ShpPoint
from shapely.geometry import Polygon as ShpPolygon
from shapely.geometry import MultiPolygon as ShpMultiPolygon
from shapely.geometry import Point as ShpPoint
from shapely.geometry import MultiLineString
from shapely.ops import linemerge
from skimage.morphology import skeletonize
from ultralytics import YOLO

dataEnteringNode = IN 

# =========================
# 输入
# =========================
dect_Model = IN[0]
pixpath = IN[1]
height = IN[2]
scale = IN[3]
dims_json_path = IN[4]
seg_meta_json_path = IN[5]

# =========================
# 参数
# =========================
origin = XYZ(0, 0, 0)   
widthFt = scale
pixelWidth = 1600   
pixelHeight = 1200 
DENSIFY_DIST = 0.5  
EPS = 1e-6

# =========================
# 尺寸链轴线修正
# =========================
# 当前 OCR JSON 中的 horizontal_length / vertical_length 按墙体轴线尺寸理解。
# 但结构 mask / bbox 更接近墙体外轮廓。
# 基本墙厚 200mm，两端各半墙厚，总补偿 200mm。
AXIS_DIM_CORRECTION_MM = 200.0

TARGET_WALL_TYPE_NAME = "基本墙 200mm"
TARGET_LEVEL_NAME = "标高 2"

newpath = "E:/yanjiu/revitss/tests/jjianzhu_seg.jpg"

scaleX = widthFt / pixelWidth if pixelWidth > 0 else 0.0
scaleY = widthFt * (pixelHeight / pixelWidth) / pixelHeight if pixelWidth > 0 and pixelHeight > 0 else 0.0

bbox_info_global = None
scale_x_ft_per_px_global = None
scale_y_ft_per_px_global = None

logs = []

# =========================
# 工具函数
# =========================
def ensure_dir_of_file(file_path):
    folder = os.path.dirname(file_path)
    if folder and not os.path.exists(folder):
        os.makedirs(folder)

def pix_to_revit(x, y):
    global bbox_info_global, scale_x_ft_per_px_global, scale_y_ft_per_px_global

    try:
        if bbox_info_global is not None and scale_x_ft_per_px_global is not None and scale_y_ft_per_px_global is not None:
            min_x = bbox_info_global["min_x"]
            min_y = bbox_info_global["min_y"]
            bbox_h = bbox_info_global["height"]

            local_x = x - min_x
            local_y = y - min_y

            revit_x = origin.X + local_x * scale_x_ft_per_px_global
            revit_y = origin.Y + (bbox_h - local_y) * scale_y_ft_per_px_global
            return XYZ(revit_x, revit_y, origin.Z)
    except:
        pass

    revit_x = origin.X + x * scaleX
    revit_y = origin.Y + (pixelHeight - y) * scaleY
    return XYZ(revit_x, revit_y, origin.Z)

def sanitize_name(name):
    if not name:
        return "Unknown"
    cleaned = re.sub(r'[\x00-\x1f\x7f]', '', name)
    if not cleaned.strip():
        return "Unnamed"
    return cleaned

def get_mask_bbox(binary_mask, logs):
    if binary_mask is None:
        logs.append("get_mask_bbox失败: binary_mask is None")
        return None

    ys, xs = np.where(binary_mask > 0)
    if len(xs) == 0 or len(ys) == 0:
        logs.append("get_mask_bbox失败: 墙体mask为空")
        return None

    min_x = int(np.min(xs))
    max_x = int(np.max(xs))
    min_y = int(np.min(ys))
    max_y = int(np.max(ys))

    bbox = {
        "min_x": min_x,
        "min_y": min_y,
        "max_x": max_x,
        "max_y": max_y,
        "width": int(max_x - min_x + 1),
        "height": int(max_y - min_y + 1)
    }
    logs.append("结构mask bbox: {}".format(str(bbox)))
    return bbox

# =========================
# 结构类配置
# =========================
STRUCTURE_CLASS_KEYWORDS = [
    "wall",
    "墙",
    "墙体",
    "basic wall",
    "door",
    "门",
    "tdoor",
    "double door",
    "window",
    "窗",
    "窗户"
]

STRUCTURE_CLASS_EXACT = set([
    "wall",
    "door",
    "window",
    "tdoor"
])

EXPAND_CLASSES = set([
    "door",
    "window",
    "tdoor"
])

def normalize_class_name(name):
    if name is None:
        return ""
    return str(name).strip().lower()

def is_structure_wall_like_class(name):
    n = normalize_class_name(name)
    if not n:
        return False

    if n in STRUCTURE_CLASS_EXACT:
        return True

    for kw in STRUCTURE_CLASS_KEYWORDS:
        if kw.lower() in n:
            return True
    return False

def ensure_polygon(geom):
    if geom is None or geom.is_empty:
        return None
    try:
        if not geom.is_valid:
            geom = geom.buffer(0)
    except:
        pass
    if geom is None or geom.is_empty:
        return None

    if isinstance(geom, ShpPolygon):
        return geom

    if isinstance(geom, ShpMultiPolygon):
        polys = [g for g in geom.geoms if g is not None and not g.is_empty]
        if not polys:
            return None
        polys.sort(key=lambda p: p.area, reverse=True)
        return polys[0]

    return None

def line_long_enough(line_geom, min_len=0.1):
    if line_geom is None or line_geom.is_empty:
        return False
    try:
        return line_geom.length >= min_len
    except:
        return False

def snap_line_to_axis(line_geom):
    if line_geom is None or line_geom.is_empty:
        return None
    coords = list(line_geom.coords)
    if len(coords) < 2:
        return None
    x1, y1 = coords[0]
    x2, y2 = coords[-1]
    dx = x2 - x1
    dy = y2 - y1
    if abs(dx) >= abs(dy):
        ym = 0.5 * (y1 + y2)
        return LineString([(x1, ym), (x2, ym)])
    else:
        xm = 0.5 * (x1 + x2)
        return LineString([(xm, y1), (xm, y2)])

def get_line_orientation_from_geom(line_geom):
    coords = list(line_geom.coords)
    x1, y1 = coords[0]
    x2, y2 = coords[-1]
    if abs(y2 - y1) <= abs(x2 - x1):
        return "h"
    return "v"

def get_line_orientation(seg):
    return get_line_orientation_from_geom(seg['line'])

def line_length(line_geom):
    try:
        return line_geom.length
    except:
        return 0.0

def copy_segments(segments):
    out = []
    for s in segments:
        out.append({
            'line': s['line'],
            'thickness': s['thickness'],
            'name': s['name']
        })
    return out

def longest_linestring_from_intersection(inter):
    if inter is None or inter.is_empty:
        return None
    if inter.geom_type == "LineString":
        return inter
    if inter.geom_type == "MultiLineString":
        lines = [g for g in inter.geoms if g.length > 1e-4]
        if not lines:
            return None
        lines.sort(key=lambda g: g.length, reverse=True)
        return lines[0]
    return None

def merge_close_vertices(segments, delta):
    pts = []
    for seg in segments:
        coords = list(seg['line'].coords)
        pts.append(coords[0])
        pts.append(coords[-1])

    if not pts:
        return segments

    clusters = []
    for p in pts:
        assigned = False
        for cluster in clusters:
            cx, cy, plist = cluster
            d2 = (p[0]-cx)**2 + (p[1]-cy)**2
            if d2 < delta * delta:
                plist.append(p)
                nx = sum(pp[0] for pp in plist) / len(plist)
                ny = sum(pp[1] for pp in plist) / len(plist)
                cluster[0] = nx
                cluster[1] = ny
                assigned = True
                break
        if not assigned:
            clusters.append([p[0], p[1], [p]])

    def snap_point(p):
        best = p
        best_d = 1e18
        for cx, cy, plist in clusters:
            d2 = (p[0]-cx)**2 + (p[1]-cy)**2
            if d2 < best_d:
                best_d = d2
                best = (cx, cy)
        return best

    new_segments = []
    for seg in segments:
        coords = list(seg['line'].coords)
        p1 = snap_point(coords[0])
        p2 = snap_point(coords[-1])
        if ((p1[0]-p2[0])**2 + (p1[1]-p2[1])**2) ** 0.5 < 0.1:
            continue
        new_line = LineString([p1, p2])
        new_line = snap_line_to_axis(new_line)
        if new_line is None:
            continue
        new_segments.append({
            'line': new_line,
            'thickness': seg['thickness'],
            'name': seg['name']
        })
    return new_segments

def point_to_segment_distance(pt, a, b):
    px, py = pt
    ax, ay = a
    bx, by = b
    dx = bx - ax
    dy = by - ay
    if abs(dx) < EPS and abs(dy) < EPS:
        return ((px-ax)**2 + (py-ay)**2)**0.5, a, 0.0

    t = ((px-ax)*dx + (py-ay)*dy) / (dx*dx + dy*dy)
    t_clamped = max(0.0, min(1.0, t))
    qx = ax + t_clamped * dx
    qy = ay + t_clamped * dy
    dist = ((px-qx)**2 + (py-qy)**2)**0.5
    return dist, (qx, qy), t_clamped

def split_segments_by_near_vertices(segments, delta):
    if not segments:
        return segments

    vertices = []
    for seg in segments:
        coords = list(seg['line'].coords)
        vertices.append(coords[0])
        vertices.append(coords[-1])

    new_segments = []
    for idx, seg in enumerate(segments):
        coords = list(seg['line'].coords)
        a = coords[0]
        b = coords[-1]
        split_pts = []

        for v in vertices:
            if v == a or v == b:
                continue
            dist, proj, t = point_to_segment_distance(v, a, b)
            if dist < delta and t > 0.01 and t < 0.99:
                split_pts.append((t, v))

        if not split_pts:
            new_segments.append(seg)
        else:
            split_pts.sort(key=lambda x: x[0])
            chain = [a] + [v for _, v in split_pts] + [b]
            for p1, p2 in zip(chain[:-1], chain[1:]):
                if ((p1[0]-p2[0])**2 + (p1[1]-p2[1])**2) ** 0.5 < 0.1:
                    continue
                new_line = snap_line_to_axis(LineString([p1, p2]))
                if new_line is None:
                    continue
                new_segments.append({
                    'line': new_line,
                    'thickness': seg['thickness'],
                    'name': seg['name']
                })
    return new_segments

def merge_collinear_segments_strict(segments, coord_tol=0.08, gap_tol=0.25):
    if not segments:
        return segments

    horizontal = []
    vertical = []
    others = []

    for seg in segments:
        coords = list(seg['line'].coords)
        x1, y1 = coords[0]
        x2, y2 = coords[-1]

        if abs(y2 - y1) <= coord_tol:
            y = 0.5 * (y1 + y2)
            xmin, xmax = min(x1, x2), max(x1, x2)
            horizontal.append((y, xmin, xmax, seg))
        elif abs(x2 - x1) <= coord_tol:
            x = 0.5 * (x1 + x2)
            ymin, ymax = min(y1, y2), max(y1, y2)
            vertical.append((x, ymin, ymax, seg))
        else:
            others.append(seg)

    merged = []

    horizontal.sort(key=lambda t: (round(t[0], 2), t[1]))
    used = [False] * len(horizontal)
    for i in range(len(horizontal)):
        if used[i]:
            continue
        y, x1, x2, seg = horizontal[i]
        thick = seg['thickness']
        name = seg['name']

        for j in range(i + 1, len(horizontal)):
            if used[j]:
                continue
            y2, xx1, xx2, seg2 = horizontal[j]
            if abs(y2 - y) <= coord_tol and xx1 <= x2 + gap_tol:
                x2 = max(x2, xx2)
                thick = 0.5 * (thick + seg2['thickness'])
                used[j] = True

        merged.append({
            'line': LineString([(x1, y), (x2, y)]),
            'thickness': thick,
            'name': name
        })

    vertical.sort(key=lambda t: (round(t[0], 2), t[1]))
    used = [False] * len(vertical)
    for i in range(len(vertical)):
        if used[i]:
            continue
        x, y1, y2, seg = vertical[i]
        thick = seg['thickness']
        name = seg['name']

        for j in range(i + 1, len(vertical)):
            if used[j]:
                continue
            x2, yy1, yy2, seg2 = vertical[j]
            if abs(x2 - x) <= coord_tol and yy1 <= y2 + gap_tol:
                y2 = max(y2, yy2)
                thick = 0.5 * (thick + seg2['thickness'])
                used[j] = True

        merged.append({
            'line': LineString([(x, y1), (x, y2)]),
            'thickness': thick,
            'name': name
        })

    merged.extend(others)
    return merged

def optimize_wall_centerlines(candidates, iter_count=1, enable_merge_collinear=True):
    if not candidates:
        return []

    segs = candidates[:]

    if enable_merge_collinear:
        segs = merge_collinear_segments_strict(segs, coord_tol=0.08, gap_tol=0.35)

    for _ in range(iter_count):
        if not segs:
            break

        avg_t = sum(s['thickness'] for s in segs) / max(len(segs), 1)
        delta = 0.20 * avg_t
        if delta < 0.03:
            delta = 0.03
        if delta > 0.12:
            delta = 0.12

        segs = merge_close_vertices(segs, delta)
        segs = split_segments_by_near_vertices(segs, delta)

    cleaned = []
    for s in segs:
        try:
            if s['line'] is None or s['line'].is_empty:
                continue
            if s['line'].length < 0.08:
                continue
            cleaned.append(s)
        except:
            continue

    return cleaned

# =========================
# mask 构建与清理
# =========================
def build_global_structure_mask(result, pixelWidth, pixelHeight, logs):
    wall_mask = np.zeros((pixelHeight, pixelWidth), dtype=np.uint8)
    class_counter = {}

    if result.masks is None:
        logs.append("result.masks is None")
        return wall_mask, class_counter

    masks_xy = result.masks.xy
    cls_ids = result.boxes.cls.cpu().numpy().astype(int)
    names = result.names

    logs.append("总mask数量: {}".format(len(masks_xy)))

    expand_kernel = cv2.getStructuringElement(cv2.MORPH_RECT, (5, 5))

    for i, contour_pts in enumerate(masks_xy):
        try:
            if i >= len(cls_ids):
                continue

            class_id = cls_ids[i]
            class_name = names[class_id]
            class_name_norm = normalize_class_name(class_name)

            if not is_structure_wall_like_class(class_name):
                continue

            pts = np.array(contour_pts, dtype=np.int32)
            if len(pts) < 3:
                continue

            pts[:, 0] = np.clip(pts[:, 0], 0, pixelWidth - 1)
            pts[:, 1] = np.clip(pts[:, 1], 0, pixelHeight - 1)

            if class_name_norm in EXPAND_CLASSES:
                temp = np.zeros((pixelHeight, pixelWidth), dtype=np.uint8)
                cv2.fillPoly(temp, [pts], 255)
                temp = cv2.dilate(temp, expand_kernel, iterations=1)
                wall_mask[temp > 0] = 255
            else:
                cv2.fillPoly(wall_mask, [pts], 255)

            class_counter[class_name_norm] = class_counter.get(class_name_norm, 0) + 1

        except Exception as e:
            logs.append("合成结构mask失败 idx={}: {}".format(i, str(e)))
            continue

    logs.append("参与墙体生成的类别统计: {}".format(str(class_counter)))
    return wall_mask, class_counter

def clean_wall_mask(binary_mask, logs):
    mask = binary_mask.copy()

    kernel_bridge = cv2.getStructuringElement(cv2.MORPH_RECT, (3, 3))
    kernel_close_big = cv2.getStructuringElement(cv2.MORPH_RECT, (7, 7))
    kernel_close_small = cv2.getStructuringElement(cv2.MORPH_RECT, (5, 5))

    mask = cv2.dilate(mask, kernel_bridge, iterations=1)
    mask = cv2.morphologyEx(mask, cv2.MORPH_CLOSE, kernel_close_big)
    mask = cv2.morphologyEx(mask, cv2.MORPH_CLOSE, kernel_close_small)
    mask = cv2.erode(mask, kernel_bridge, iterations=1)

    num_labels, labels, stats, _ = cv2.connectedComponentsWithStats(mask, connectivity=8)
    cleaned = np.zeros_like(mask)

    for i in range(1, num_labels):
        area = stats[i, cv2.CC_STAT_AREA]
        if area >= 30:
            cleaned[labels == i] = 255

    logs.append("结构mask清理完成(补缝增强版)")
    return cleaned

def estimate_wall_width_pixels(binary_mask, logs):
    if binary_mask is None or binary_mask.max() == 0:
        logs.append("墙宽估计失败：mask为空")
        return 6.0

    dist = cv2.distanceTransform(binary_mask, cv2.DIST_L2, 5)
    vals = dist[dist > 0]
    if len(vals) == 0:
        logs.append("墙宽估计失败：distanceTransform为空")
        return 6.0

    wall_width_px = max(2.0, 2.0 * np.median(vals))
    logs.append("估计墙宽像素值: {:.2f}".format(wall_width_px))
    return wall_width_px

def skeletonize_wall_mask(binary_mask, logs):
    try:
        from skimage.morphology import skeletonize
        skel = skeletonize(binary_mask > 0)
        logs.append("使用 skimage.skeletonize 成功")
        return skel.astype(np.uint8)
    except Exception as e:
        logs.append("skimage骨架失败，改用fallback: {}".format(str(e)))
        return skeletonize_fallback(binary_mask, logs)

def skeletonize_fallback(binary_mask, logs):
    img = (binary_mask > 0).astype(np.uint8) * 255
    size = np.size(img)
    skel = np.zeros(img.shape, np.uint8)

    element = cv2.getStructuringElement(cv2.MORPH_CROSS, (3, 3))
    done = False

    while not done:
        eroded = cv2.erode(img, element)
        temp = cv2.dilate(eroded, element)
        temp = cv2.subtract(img, temp)
        skel = cv2.bitwise_or(skel, temp)
        img = eroded.copy()

        zeros = size - cv2.countNonZero(img)
        if zeros == size:
            done = True

    logs.append("fallback skeletonize 成功")
    return (skel > 0).astype(np.uint8)

def get_neighbors_8(x, y, w, h):
    nbs = []
    for dy in [-1, 0, 1]:
        for dx in [-1, 0, 1]:
            if dx == 0 and dy == 0:
                continue
            nx = x + dx
            ny = y + dy
            if 0 <= nx < w and 0 <= ny < h:
                nbs.append((nx, ny))
    return nbs

def extract_skeleton_graph(skel, logs):
    h, w = skel.shape
    skel_pts = set()
    for y in range(h):
        xs = np.where(skel[y] > 0)[0]
        for x in xs:
            skel_pts.add((x, y))

    if not skel_pts:
        logs.append("骨架为空")
        return [], []

    degree = {}
    for (x, y) in skel_pts:
        cnt = 0
        for nx, ny in get_neighbors_8(x, y, w, h):
            if (nx, ny) in skel_pts:
                cnt += 1
        degree[(x, y)] = cnt

    nodes = [p for p, d in degree.items() if d != 2]

    if not nodes:
        nodes = list(skel_pts)

    node_set = set(nodes)
    visited_edges = set()
    edges = []

    for node in nodes:
        x0, y0 = node
        for nx, ny in get_neighbors_8(x0, y0, w, h):
            if (nx, ny) not in skel_pts:
                continue

            edge_key = tuple(sorted([node, (nx, ny)]))
            if edge_key in visited_edges:
                continue

            path = [node, (nx, ny)]
            prev = node
            curr = (nx, ny)

            while True:
                visited_edges.add(tuple(sorted([prev, curr])))

                if curr in node_set and curr != node:
                    break

                nbrs = []
                for tx, ty in get_neighbors_8(curr[0], curr[1], w, h):
                    if (tx, ty) in skel_pts and (tx, ty) != prev:
                        nbrs.append((tx, ty))

                if len(nbrs) == 0:
                    break
                if len(nbrs) > 1:
                    break

                nxt = nbrs[0]
                path.append(nxt)
                prev = curr
                curr = nxt

            if len(path) >= 2:
                edges.append(path)

    logs.append("骨架图提取完成: nodes={}, edges={}".format(len(nodes), len(edges)))
    return nodes, edges

def split_path_by_direction(path, turn_threshold=2):
    if not path or len(path) < 3:
        return [path] if path else []

    segments = []
    current = [path[0], path[1]]

    def major_dir(p1, p2):
        dx = p2[0] - p1[0]
        dy = p2[1] - p1[1]
        if abs(dx) >= abs(dy):
            return "h"
        else:
            return "v"

    prev_dir = major_dir(path[0], path[1])

    for i in range(2, len(path)):
        d = major_dir(path[i-1], path[i])

        if d == prev_dir:
            current.append(path[i])
        else:
            if len(current) <= turn_threshold and segments:
                segments[-1].extend(current[1:])
                current = [segments[-1][-1], path[i]]
            else:
                segments.append(current)
                current = [path[i-1], path[i]]
            prev_dir = d

    if current:
        if len(current) <= turn_threshold and segments:
            segments[-1].extend(current[1:])
        else:
            segments.append(current)

    cleaned = []
    for seg in segments:
        if seg and len(seg) >= 2:
            cleaned.append(seg)

    return cleaned

def fit_axis_line_from_mask(sub_path, wall_mask, pixelWidth, pixelHeight, min_len_px=8):
    if not sub_path or len(sub_path) < 2:
        return None

    xs = [p[0] for p in sub_path]
    ys = [p[1] for p in sub_path]

    x_min = max(0, int(min(xs)))
    x_max = min(pixelWidth - 1, int(max(xs)))
    y_min = max(0, int(min(ys)))
    y_max = min(pixelHeight - 1, int(max(ys)))

    dx = x_max - x_min
    dy = y_max - y_min

    if dx >= dy:
        mids = []
        for x in range(x_min, x_max + 1):
            ys_in = np.where(wall_mask[:, x] > 0)[0]
            ys_local = ys_in[(ys_in >= y_min - 8) & (ys_in <= y_max + 8)]
            if len(ys_local) >= 2:
                y_top = np.min(ys_local)
                y_bot = np.max(ys_local)
                y_mid = 0.5 * (y_top + y_bot)
                mids.append((x, y_mid))

        if len(mids) < 2:
            return None

        xs2 = [p[0] for p in mids]
        ys2 = [p[1] for p in mids]

        x1 = min(xs2)
        x2 = max(xs2)
        y = float(np.median(ys2))

        if (x2 - x1) < min_len_px:
            return None

        return ((x1, y), (x2, y), "h")

    else:
        mids = []
        for y in range(y_min, y_max + 1):
            xs_in = np.where(wall_mask[y, :] > 0)[0]
            xs_local = xs_in[(xs_in >= x_min - 8) & (xs_in <= x_max + 8)]
            if len(xs_local) >= 2:
                x_left = np.min(xs_local)
                x_right = np.max(xs_local)
                x_mid = 0.5 * (x_left + x_right)
                mids.append((x_mid, y))

        if len(mids) < 2:
            return None

        xs2 = [p[0] for p in mids]
        ys2 = [p[1] for p in mids]

        y1 = min(ys2)
        y2 = max(ys2)
        x = float(np.median(xs2))

        if (y2 - y1) < min_len_px:
            return None

        return ((x, y1), (x, y2), "v")

def pixel_line_to_revit_linestring(p1, p2):
    rp1 = pix_to_revit(p1[0], p1[1])
    rp2 = pix_to_revit(p2[0], p2[1])
    if rp1.DistanceTo(rp2) < 0.1:
        return None
    return LineString([(rp1.X, rp1.Y), (rp2.X, rp2.Y)])

def simplify_path_to_axis_lines(path, wall_mask, pixelWidth, pixelHeight, logs, min_len_px=8):
    result_lines = []

    sub_paths = split_path_by_direction(path, turn_threshold=2)
    for sub in sub_paths:
        try:
            fitted = fit_axis_line_from_mask(
                sub, wall_mask, pixelWidth, pixelHeight, min_len_px=min_len_px
            )
            if fitted is None:
                continue

            p1, p2, ori = fitted
            line_geom = pixel_line_to_revit_linestring(p1, p2)
            if line_geom is None:
                continue

            if line_geom.length < 0.08:
                continue

            result_lines.append(line_geom)

        except Exception as e:
            logs.append("子段拟合失败: {}".format(str(e)))
            continue

    return result_lines

def extract_wall_centerlines_from_global_mask(result, pixelWidth, pixelHeight, logs):
    wall_mask, class_counter = build_global_structure_mask(result, pixelWidth, pixelHeight, logs)
    if wall_mask.max() == 0:
        logs.append("没有结构类mask被写入全局墙图")
        return [], 0.3, class_counter, wall_mask

    cleaned_mask = clean_wall_mask(wall_mask, logs)
    wall_width_px = estimate_wall_width_pixels(cleaned_mask, logs)

    skel = skeletonize_wall_mask(cleaned_mask, logs)
    nodes, edges = extract_skeleton_graph(skel, logs)

    if not edges:
        logs.append("骨架没有边")
        wall_width_ft = wall_width_px * (scale_x_ft_per_px_global if scale_x_ft_per_px_global else scaleX)
        return [], wall_width_ft, class_counter, cleaned_mask

    wall_width_ft = wall_width_px * (scale_x_ft_per_px_global if scale_x_ft_per_px_global else scaleX)
    candidates = []

    for idx, path in enumerate(edges):
        try:
            line_list = simplify_path_to_axis_lines(
                path, cleaned_mask, pixelWidth, pixelHeight, logs,
                min_len_px=max(3, int(wall_width_px * 0.5))
            )

            for line_geom in line_list:
                candidates.append({
                    'line': line_geom,
                    'thickness': wall_width_ft,
                    'name': "Wall"
                })

        except Exception as e:
            logs.append("路径{}转中心线失败: {}".format(idx, str(e)))
            continue

    logs.append("全局提取中心线候选数量: {}".format(len(candidates)))
    return candidates, wall_width_ft, class_counter, cleaned_mask

# =========================
# 第二版增强：几何补缝与对齐
# =========================
def bridge_near_orthogonal_gaps(segments, gap_tol=0.6, axis_tol=0.25):
    if not segments:
        return segments

    segs = copy_segments(segments)

    for i in range(len(segs)):
        for j in range(i + 1, len(segs)):
            si = segs[i]
            sj = segs[j]
            if si is None or sj is None:
                continue

            oi = get_line_orientation(si)
            oj = get_line_orientation(sj)

            if oi == oj:
                continue

            if oi == "v" and oj == "h":
                tmp = si
                si = sj
                sj = tmp
                idx_h = j
                idx_v = i
            else:
                idx_h = i
                idx_v = j

            coords_h = list(si['line'].coords)
            coords_v = list(sj['line'].coords)

            hx1, hy1 = coords_h[0]
            hx2, hy2 = coords_h[-1]
            vx1, vy1 = coords_v[0]
            vx2, vy2 = coords_v[-1]

            y_h = 0.5 * (hy1 + hy2)
            x_v = 0.5 * (vx1 + vx2)

            hminx, hmaxx = min(hx1, hx2), max(hx1, hx2)
            vminy, vmaxy = min(vy1, vy2), max(vy1, vy2)

            inter_pt = (x_v, y_h)

            h_endpts = [(hx1, hy1), (hx2, hy2)]
            v_endpts = [(vx1, vy1), (vx2, vy2)]

            h_dists = [((p[0]-inter_pt[0])**2 + (p[1]-inter_pt[1])**2)**0.5 for p in h_endpts]
            v_dists = [((p[0]-inter_pt[0])**2 + (p[1]-inter_pt[1])**2)**0.5 for p in v_endpts]

            h_min_idx = int(np.argmin(h_dists))
            v_min_idx = int(np.argmin(v_dists))

            h_min_dist = h_dists[h_min_idx]
            v_min_dist = v_dists[v_min_idx]

            cond_h = (x_v >= hminx - axis_tol and x_v <= hmaxx + gap_tol)
            cond_v = (y_h >= vminy - axis_tol and y_h <= vmaxy + gap_tol)

            if h_min_dist <= gap_tol and v_min_dist <= gap_tol and cond_h and cond_v:
                other_h = h_endpts[1 - h_min_idx]
                other_v = v_endpts[1 - v_min_idx]

                new_h = snap_line_to_axis(LineString([other_h, inter_pt]))
                new_v = snap_line_to_axis(LineString([other_v, inter_pt]))

                if new_h is not None and new_h.length >= 0.08:
                    segs[idx_h]['line'] = new_h
                if new_v is not None and new_v.length >= 0.08:
                    segs[idx_v]['line'] = new_v

    cleaned = []
    for s in segs:
        try:
            if s['line'] is None or s['line'].is_empty:
                continue
            if s['line'].length < 0.08:
                continue
            cleaned.append(s)
        except:
            continue
    return cleaned

def align_parallel_segments(segments, coord_tol=0.35):
    """
    将接近共线的水平段/竖直段拉齐到同一坐标轴
    水平：对齐 y
    竖直：对齐 x
    """
    if not segments:
        return segments

    segs = copy_segments(segments)

    horizontal_groups = []
    vertical_groups = []

    for idx, s in enumerate(segs):
        coords = list(s['line'].coords)
        x1, y1 = coords[0]
        x2, y2 = coords[-1]
        ori = get_line_orientation(s)

        if ori == "h":
            y = 0.5 * (y1 + y2)
            added = False
            for g in horizontal_groups:
                if abs(g['coord'] - y) <= coord_tol:
                    g['indices'].append(idx)
                    g['values'].append(y)
                    g['coord'] = float(np.median(g['values']))
                    added = True
                    break
            if not added:
                horizontal_groups.append({
                    'coord': y,
                    'indices': [idx],
                    'values': [y]
                })
        else:
            x = 0.5 * (x1 + x2)
            added = False
            for g in vertical_groups:
                if abs(g['coord'] - x) <= coord_tol:
                    g['indices'].append(idx)
                    g['values'].append(x)
                    g['coord'] = float(np.median(g['values']))
                    added = True
                    break
            if not added:
                vertical_groups.append({
                    'coord': x,
                    'indices': [idx],
                    'values': [x]
                })

    for g in horizontal_groups:
        target_y = g['coord']
        for idx in g['indices']:
            coords = list(segs[idx]['line'].coords)
            x1, y1 = coords[0]
            x2, y2 = coords[-1]
            segs[idx]['line'] = LineString([(x1, target_y), (x2, target_y)])

    for g in vertical_groups:
        target_x = g['coord']
        for idx in g['indices']:
            coords = list(segs[idx]['line'].coords)
            x1, y1 = coords[0]
            x2, y2 = coords[-1]
            segs[idx]['line'] = LineString([(target_x, y1), (target_x, y2)])

    return segs

def bridge_parallel_gaps(segments, coord_tol=0.25, gap_tol=0.8):
    """
    平行且接近共线的短缝桥接
    - 水平对水平：y接近，x方向中间差一小截 -> 合并成一条
    - 竖直对竖直：x接近，y方向中间差一小截 -> 合并成一条
    """
    if not segments:
        return segments

    segs = copy_segments(segments)
    used = [False] * len(segs)
    result = []

    horiz = []
    vert = []
    other = []

    for idx, s in enumerate(segs):
        ori = get_line_orientation(s)
        coords = list(s['line'].coords)
        x1, y1 = coords[0]
        x2, y2 = coords[-1]

        if ori == "h":
            y = 0.5 * (y1 + y2)
            xmin = min(x1, x2)
            xmax = max(x1, x2)
            horiz.append((idx, y, xmin, xmax, s))
        else:
            x = 0.5 * (x1 + x2)
            ymin = min(y1, y2)
            ymax = max(y1, y2)
            vert.append((idx, x, ymin, ymax, s))

    horiz.sort(key=lambda t: (round(t[1], 3), t[2]))
    consumed = set()
    for i in range(len(horiz)):
        if i in consumed:
            continue
        idx_i, y_i, x1_i, x2_i, seg_i = horiz[i]
        cur_y = y_i
        cur_x1 = x1_i
        cur_x2 = x2_i
        cur_thick = seg_i['thickness']
        cur_name = seg_i['name']

        for j in range(i + 1, len(horiz)):
            if j in consumed:
                continue
            idx_j, y_j, x1_j, x2_j, seg_j = horiz[j]

            if abs(y_j - cur_y) <= coord_tol:
                gap = x1_j - cur_x2
                overlap = min(cur_x2, x2_j) - max(cur_x1, x1_j)
                if gap <= gap_tol or overlap >= -coord_tol:
                    cur_x1 = min(cur_x1, x1_j)
                    cur_x2 = max(cur_x2, x2_j)
                    cur_y = float(np.median([cur_y, y_j]))
                    cur_thick = 0.5 * (cur_thick + seg_j['thickness'])
                    consumed.add(j)

        result.append({
            'line': LineString([(cur_x1, cur_y), (cur_x2, cur_y)]),
            'thickness': cur_thick,
            'name': cur_name
        })

    vert.sort(key=lambda t: (round(t[1], 3), t[2]))
    consumed = set()
    for i in range(len(vert)):
        if i in consumed:
            continue
        idx_i, x_i, y1_i, y2_i, seg_i = vert[i]
        cur_x = x_i
        cur_y1 = y1_i
        cur_y2 = y2_i
        cur_thick = seg_i['thickness']
        cur_name = seg_i['name']

        for j in range(i + 1, len(vert)):
            if j in consumed:
                continue
            idx_j, x_j, y1_j, y2_j, seg_j = vert[j]

            if abs(x_j - cur_x) <= coord_tol:
                gap = y1_j - cur_y2
                overlap = min(cur_y2, y2_j) - max(cur_y1, y1_j)
                if gap <= gap_tol or overlap >= -coord_tol:
                    cur_y1 = min(cur_y1, y1_j)
                    cur_y2 = max(cur_y2, y2_j)
                    cur_x = float(np.median([cur_x, x_j]))
                    cur_thick = 0.5 * (cur_thick + seg_j['thickness'])
                    consumed.add(j)

        result.append({
            'line': LineString([(cur_x, cur_y1), (cur_x, cur_y2)]),
            'thickness': cur_thick,
            'name': cur_name
        })

    return result

def snap_near_endpoints(segments, snap_tol=0.25):
    """
    对近距离端点做统一吸附
    """
    if not segments:
        return segments

    pts = []
    for idx, seg in enumerate(segments):
        coords = list(seg['line'].coords)
        pts.append((idx, 0, coords[0]))
        pts.append((idx, 1, coords[-1]))

    clusters = []
    for item in pts:
        idx, end_flag, p = item
        assigned = False
        for c in clusters:
            cx, cy = c['center']
            if ((p[0]-cx)**2 + (p[1]-cy)**2)**0.5 <= snap_tol:
                c['items'].append(item)
                xs = [it[2][0] for it in c['items']]
                ys = [it[2][1] for it in c['items']]
                c['center'] = (float(np.mean(xs)), float(np.mean(ys)))
                assigned = True
                break
        if not assigned:
            clusters.append({
                'center': (p[0], p[1]),
                'items': [item]
            })

    segs = copy_segments(segments)

    for c in clusters:
        center = c['center']
        for idx, end_flag, p in c['items']:
            coords = list(segs[idx]['line'].coords)
            if end_flag == 0:
                new_line = LineString([center, coords[-1]])
            else:
                new_line = LineString([coords[0], center])

            new_line = snap_line_to_axis(new_line)
            if new_line is not None and new_line.length >= 0.08:
                segs[idx]['line'] = new_line

    return segs

def clean_duplicate_segments(segments, coord_tol=0.05):
    if not segments:
        return segments

    uniq = []
    keys = set()

    for s in segments:
        try:
            coords = list(s['line'].coords)
            x1, y1 = coords[0]
            x2, y2 = coords[-1]

            p1 = (round(x1 / coord_tol), round(y1 / coord_tol))
            p2 = (round(x2 / coord_tol), round(y2 / coord_tol))
            key = tuple(sorted([p1, p2]))

            if key in keys:
                continue
            keys.add(key)
            uniq.append(s)
        except:
            continue

    return uniq

def run_geometry_enhancement_v2(segments, logs):
    if not segments:
        return segments

    segs = copy_segments(segments)
    logs.append("V2增强-输入墙段数: {}".format(len(segs)))

    segs = align_parallel_segments(segs, coord_tol=0.35)
    logs.append("V2增强-平行对齐后: {}".format(len(segs)))

    segs = bridge_parallel_gaps(segs, coord_tol=0.25, gap_tol=0.8)
    logs.append("V2增强-平行短缝桥接后: {}".format(len(segs)))

    segs = bridge_near_orthogonal_gaps(segs, gap_tol=0.6, axis_tol=0.25)
    logs.append("V2增强-正交补缝后: {}".format(len(segs)))

    segs = snap_near_endpoints(segs, snap_tol=0.25)
    logs.append("V2增强-端点吸附后: {}".format(len(segs)))

    segs = merge_collinear_segments_strict(segs, coord_tol=0.08, gap_tol=0.35)
    logs.append("V2增强-严格共线合并后: {}".format(len(segs)))

    segs = clean_duplicate_segments(segs, coord_tol=0.05)
    logs.append("V2增强-去重后: {}".format(len(segs)))

    cleaned = []
    for s in segs:
        try:
            if s['line'] is None or s['line'].is_empty:
                continue
            if s['line'].length < 0.08:
                continue
            cleaned.append(s)
        except:
            continue

    logs.append("V2增强-最终墙段数: {}".format(len(cleaned)))
    return cleaned

# =========================
# 运行YOLO分割
# =========================
yolo_seg = YOLO(dect_Model, task="seg")
seg_result = yolo_seg(source=pixpath, save=False, conf=0.7, iou=0.45, imgsz=1280)
cv2.imwrite(newpath, seg_result[0].plot())

result = seg_result[0]
boxes = result.boxes
xyxy = boxes.xyxy.cpu().numpy() if boxes is not None else np.empty((0,4))
cls_ids = boxes.cls.cpu().numpy().astype(int) if boxes is not None else np.array([], dtype=int)
names = result.names

# =========================
# 读取OCR尺寸JSON
# =========================
dims_data = None

# 原始OCR尺寸，单位mm
horizontal_length_mm_raw = None
vertical_length_mm_raw = None

# 修正后尺寸，单位mm
horizontal_length_mm = None
vertical_length_mm = None

try:
    with open(dims_json_path, "r", encoding="utf-8") as f:
        dims_data = json.load(f)

    if dims_data.get("ok", False):
        if "result" in dims_data:
            horizontal_length_mm_raw = dims_data["result"].get("horizontal_length", None)
            vertical_length_mm_raw = dims_data["result"].get("vertical_length", None)
        else:
            horizontal_length_mm_raw = dims_data.get("horizontal_length", None)
            vertical_length_mm_raw = dims_data.get("vertical_length", None)

    logs.append("读取dims_json成功，原始轴线尺寸: horizontal={} mm, vertical={} mm".format(
        str(horizontal_length_mm_raw), str(vertical_length_mm_raw)
    ))

    # =========================
    # 核心修改：
    # 读取 JSON 得到尺寸后，直接补偿 200mm
    # =========================
    if horizontal_length_mm_raw is not None:
        horizontal_length_mm = float(horizontal_length_mm_raw) + AXIS_DIM_CORRECTION_MM
        logs.append(
            "horizontal_length_mm轴线修正: {} + {} = {} mm".format(
                str(horizontal_length_mm_raw),
                str(AXIS_DIM_CORRECTION_MM),
                str(horizontal_length_mm)
            )
        )

    if vertical_length_mm_raw is not None:
        vertical_length_mm = float(vertical_length_mm_raw) + AXIS_DIM_CORRECTION_MM
        logs.append(
            "vertical_length_mm轴线修正: {} + {} = {} mm".format(
                str(vertical_length_mm_raw),
                str(AXIS_DIM_CORRECTION_MM),
                str(vertical_length_mm)
            )
        )

except Exception as e:
    logs.append("读取dims_json失败: {}".format(str(e)))
    logs.append(traceback.format_exc())

# =========================
# 先做结构mask -> bbox -> scale
# =========================
global_structure_mask, structure_class_counter = build_global_structure_mask(result, pixelWidth, pixelHeight, logs)
cleaned_global_structure_mask = clean_wall_mask(global_structure_mask, logs)
bbox_info = get_mask_bbox(cleaned_global_structure_mask, logs)

scale_x_mm_per_px = None
scale_y_mm_per_px = None
scale_avg_mm_per_px = None
scale_x_ft_per_px = None
scale_y_ft_per_px = None
scale_avg_ft_per_px = None

if bbox_info is not None and horizontal_length_mm is not None and vertical_length_mm is not None:
    try:
        bbox_w = bbox_info["width"]
        bbox_h = bbox_info["height"]

        if bbox_w > 0 and bbox_h > 0:
            scale_x_mm_per_px = float(horizontal_length_mm) / float(bbox_w)
            scale_y_mm_per_px = float(vertical_length_mm) / float(bbox_h)
            scale_avg_mm_per_px = (scale_x_mm_per_px + scale_y_mm_per_px) / 2.0

            mm_to_ft = 1.0 / 304.8
            scale_x_ft_per_px = scale_x_mm_per_px * mm_to_ft
            scale_y_ft_per_px = scale_y_mm_per_px * mm_to_ft
            scale_avg_ft_per_px = scale_avg_mm_per_px * mm_to_ft

            bbox_info_global = bbox_info
            scale_x_ft_per_px_global = scale_x_ft_per_px
            scale_y_ft_per_px_global = scale_y_ft_per_px

            logs.append("scale_x_mm_per_px={:.6f}".format(scale_x_mm_per_px))
            logs.append("scale_y_mm_per_px={:.6f}".format(scale_y_mm_per_px))
            logs.append("scale_avg_mm_per_px={:.6f}".format(scale_avg_mm_per_px))
            logs.append("scale_x_ft_per_px={:.6f}".format(scale_x_ft_per_px))
            logs.append("scale_y_ft_per_px={:.6f}".format(scale_y_ft_per_px))
        else:
            logs.append("bbox宽高无效，无法计算scale")
    except Exception as e:
        logs.append("scale计算失败: {}".format(str(e)))
        logs.append(traceback.format_exc())
else:
    logs.append("bbox或真实尺寸缺失，使用fallback整图scale")

# =========================
# Revit文档对象
# =========================
doc = DocumentManager.Instance.CurrentDBDocument
app = doc.Application

wall_type = None
wall_type_collector = FilteredElementCollector(doc).OfClass(WallType)

for wt in wall_type_collector:
    if wt.Kind == WallKind.Basic:
        name_param = wt.get_Parameter(BuiltInParameter.SYMBOL_NAME_PARAM)
        if name_param and name_param.AsString() == TARGET_WALL_TYPE_NAME:
            wall_type = wt
            break

if wall_type is None:
    for wt in wall_type_collector:
        if wt.Kind == WallKind.Basic:
            wall_type = wt
            break

if wall_type is None:
    raise Exception("项目中找不到任何基本墙类型！")

level = None
level_collector = FilteredElementCollector(doc).OfClass(Level)
for lvl in level_collector:
    name_param = lvl.get_Parameter(BuiltInParameter.LEVEL_NAME)
    if name_param and name_param.AsString() == TARGET_LEVEL_NAME:
        level = lvl
        break

if level is None:
    level = level_collector.FirstElement()
    if level is None:
        raise Exception("项目中找不到任何标高！")

TransactionManager.Instance.EnsureInTransaction(doc)

created_walls = []
wall_candidates = []

wallHeight = height

plane = Plane.CreateByNormalAndOrigin(XYZ.BasisZ, origin)
sketch_plane = SketchPlane.Create(doc, plane)

# =========================
# 提取中心线并创建墙
# =========================
if result.masks is not None:
    logs.append("YOLO类别映射: {}".format(str(result.names)))

    wall_candidates, default_wall_thickness, used_class_counter, final_mask_used = extract_wall_centerlines_from_global_mask(
        result, pixelWidth, pixelHeight, logs
    )

    logs.append("初始墙候选数量: {}".format(len(wall_candidates)))

    optimized_walls = optimize_wall_centerlines(
        wall_candidates,
        iter_count=1,
        enable_merge_collinear=False
    )

    logs.append("初步优化后墙数量: {}".format(len(optimized_walls)))

    # 第二版增强
    optimized_walls = run_geometry_enhancement_v2(optimized_walls, logs)

    for idx, w in enumerate(optimized_walls):
        try:
            line_geom = w['line']
            thickness_val = w['thickness']
            name = "Wall"

            coords = list(line_geom.coords)
            if len(coords) < 2:
                logs.append("墙{}失败：coords不足".format(idx))
                continue

            start_pt = XYZ(coords[0][0], coords[0][1], 0)
            end_pt = XYZ(coords[-1][0], coords[-1][1], 0)

            if start_pt.DistanceTo(end_pt) < 0.1:
                logs.append("墙{}失败：线太短".format(idx))
                continue

            revit_line = Line.CreateBound(start_pt, end_pt)

            logs.append("准备创建墙{}: len={:.3f}, thickness={:.3f}".format(
                idx, revit_line.Length, thickness_val
            ))

            wall = Wall.Create(doc, revit_line, wall_type.Id, level.Id, wallHeight, 0, False, False)

            try:
                param = wall.get_Parameter(BuiltInParameter.WALL_ATTR_WIDTH_PARAM)
                if param and not param.IsReadOnly:
                    param.Set(thickness_val)
            except Exception as e2:
                logs.append("墙{}宽度设置失败(可忽略): {}".format(idx, str(e2)))

            try:
                wall.Name = sanitize_name(name)
            except:
                pass

            created_walls.append(wall.ToDSType(True))
            logs.append("墙{}创建成功".format(idx))

        except Exception as e:
            logs.append("墙{}创建失败: {}".format(idx, str(e)))
            logs.append(traceback.format_exc())
            continue
else:
    logs.append("result.masks is None，没有分割mask")

# =========================
# 提交事务
# =========================
TransactionManager.Instance.TransactionTaskDone()
doc.Regenerate()

# =========================
# 写 seg_meta_json
# =========================
seg_meta = {
    "ok": True,
    "image_path": pixpath,
    "seg_vis_path": newpath,
    "dims_json_path": dims_json_path,
    "wall_bbox_px": bbox_info,
    "real_size_mm": {
        "horizontal_length_raw": horizontal_length_mm_raw,
        "vertical_length_raw": vertical_length_mm_raw,
        "axis_dim_correction_mm": AXIS_DIM_CORRECTION_MM,
        "horizontal_length": horizontal_length_mm,
        "vertical_length": vertical_length_mm
    },
    "scale": {
        "scale_x_mm_per_px": scale_x_mm_per_px,
        "scale_y_mm_per_px": scale_y_mm_per_px,
        "scale_avg_mm_per_px": scale_avg_mm_per_px,
        "scale_x_ft_per_px": scale_x_ft_per_px,
        "scale_y_ft_per_px": scale_y_ft_per_px,
        "scale_avg_ft_per_px": scale_avg_ft_per_px
    },
    "structure_mask_classes_used": structure_class_counter,
    "debug": {
        "pixelWidth": pixelWidth,
        "pixelHeight": pixelHeight,
        "wall_count": len(created_walls),
        "mask_count": len(result.masks.xy) if result.masks is not None else 0,
        "class_names": result.names,
        "log_count": len(logs)
    }
}

try:
    ensure_dir_of_file(seg_meta_json_path)
    with open(seg_meta_json_path, "w", encoding="utf-8") as f:
        json.dump(seg_meta, f, ensure_ascii=False, indent=2)
    logs.append("seg_meta_json已写出: {}".format(seg_meta_json_path))
except Exception as e:
    logs.append("seg_meta_json写出失败: {}".format(str(e)))

OUT = newpath, created_walls, seg_meta_json_path, logs
# ----------------------------------------
python_version_11 = Watch(python_script)  # graph output
get_masks_and_join = Python(IN[0]=seg_WWTD_Modelpath_2, IN[1]=imagepath)  # CPython3; frozen
# ---------- get_masks_and_join.python (431 lines) ----------
# -*- coding: utf-8 -*-

import os
import traceback
import random
import cv2
import numpy as np

try:
    from ultralytics import YOLO
except Exception:
    YOLO = None

logs = []

# ============================================================
# 输入
# ============================================================

try:
    dect_Model = IN[0]
except:
    dect_Model = None

try:
    pixpath = IN[1]
except:
    pixpath = ""

# 可选参数
try:
    YOLO_IMGSZ = int(IN[2])
except:
    YOLO_IMGSZ = 1280

try:
    YOLO_CONF = float(IN[3])
except:
    YOLO_CONF = 0.7

try:
    YOLO_IOU = float(IN[4])
except:
    YOLO_IOU = 0.45

# 这里即使给了 IN[5]，也只是子文件夹名字，不允许变成完整路径
try:
    output_folder_name = str(IN[5]).strip()
    if not output_folder_name:
        output_folder_name = "structure_mask_process"
except:
    output_folder_name = "structure_mask_process"

# 防止有人把 json 路径传进来
output_folder_name = os.path.basename(output_folder_name)
output_folder_name = output_folder_name.replace(".json", "")
output_folder_name = output_folder_name.replace(".txt", "")
output_folder_name = output_folder_name.replace(".png", "")
output_folder_name = output_folder_name.replace(".jpg", "")
if output_folder_name == "":
    output_folder_name = "structure_mask_process"


# ============================================================
# 参数
# ============================================================

CLASS_COLORS = {
    "wall":   (255, 255, 255),  # 白
    "door":   (0, 255, 255),    # 黄
    "window": (255, 0, 0),      # 蓝
    "tdoor":  (255, 0, 255)     # 紫
}

USE_RANDOM_COLORS = False

OPENING_DILATE_KERNEL = 9
OPENING_DILATE_ITER = 1

BRIDGE_KERNEL = 5
BRIDGE_ITER = 1

CLOSE_KERNEL = 7
CLOSE_ITER = 1

OPEN_KERNEL = 3
OPEN_ITER = 1

ERODE_BACK_KERNEL = 3
ERODE_BACK_ITER = 1

MIN_COMPONENT_AREA = 80


# ============================================================
# 工具函数
# ============================================================

def ensure_dir(folder):
    if not folder:
        raise Exception("输出文件夹为空，无法创建。")
    if not os.path.exists(folder):
        os.makedirs(folder)


def normalize_class_name(name):
    if name is None:
        return ""
    return str(name).strip().lower()


def classify_structural_class(class_name):
    n = normalize_class_name(class_name)

    if not n:
        return None

    # tdoor 优先
    for kw in ["tdoor", "double door", "double-door", "double_door", "双开门", "双扇门", "双门"]:
        if kw in n:
            return "tdoor"

    for kw in ["window", "windows", "窗", "窗户", "飘窗"]:
        if kw in n:
            return "window"

    for kw in ["door", "single door", "single-door", "single_door", "门", "单开门", "单扇门"]:
        if kw in n:
            return "door"

    for kw in ["wall", "basic wall", "bearing wall", "shear wall", "墙", "墙体", "基本墙", "承重墙", "剪力墙"]:
        if kw in n:
            return "wall"

    return None


def get_model(model_input):
    if model_input is None:
        raise Exception("IN[0] 为空，请传入 YOLO 模型对象或模型路径。")

    if not isinstance(model_input, str):
        if hasattr(model_input, "predict") or hasattr(model_input, "__call__"):
            logs.append("检测到 IN[0] 是已加载模型对象，直接使用。")
            return model_input

    model_path = str(model_input).strip()

    if not model_path:
        raise Exception("模型路径为空。")

    if not os.path.exists(model_path):
        raise Exception("YOLO 模型路径不存在: {}".format(model_path))

    if YOLO is None:
        raise Exception("无法导入 ultralytics.YOLO，请检查环境。")

    logs.append("开始加载 YOLO 模型: {}".format(model_path))
    model = YOLO(model_path)
    logs.append("YOLO 模型加载完成。")
    return model


def safe_get_class_name(names, cls_id):
    try:
        if isinstance(names, dict):
            return names.get(int(cls_id), str(cls_id))
        return names[int(cls_id)]
    except:
        return str(cls_id)


def empty_class_masks(h, w):
    return {
        "wall": np.zeros((h, w), dtype=np.uint8),
        "door": np.zeros((h, w), dtype=np.uint8),
        "window": np.zeros((h, w), dtype=np.uint8),
        "tdoor": np.zeros((h, w), dtype=np.uint8)
    }


def fill_polygon_to_mask(mask, contour_pts, width, height):
    pts = np.array(contour_pts, dtype=np.int32)

    if pts is None or len(pts) < 3:
        return False

    pts[:, 0] = np.clip(pts[:, 0], 0, width - 1)
    pts[:, 1] = np.clip(pts[:, 1], 0, height - 1)

    cv2.fillPoly(mask, [pts], 255)
    return True


def build_raw_structural_masks(result, width, height):
    class_masks = empty_class_masks(height, width)

    if result is None or result.masks is None:
        return class_masks

    masks_xy = result.masks.xy

    if result.boxes is not None and result.boxes.cls is not None:
        cls_ids = result.boxes.cls.cpu().numpy().astype(int)
    else:
        cls_ids = np.zeros(len(masks_xy), dtype=np.int32)

    names = result.names

    logs.append("YOLO 类别映射: {}".format(str(names)))
    logs.append("YOLO 实例 mask 数量: {}".format(len(masks_xy)))

    count_dict = {"wall": 0, "door": 0, "window": 0, "tdoor": 0, "ignored": 0}

    for i, contour_pts in enumerate(masks_xy):
        try:
            if i >= len(cls_ids):
                count_dict["ignored"] += 1
                continue

            cls_id = int(cls_ids[i])
            class_name = safe_get_class_name(names, cls_id)
            structural_key = classify_structural_class(class_name)

            if structural_key is None:
                count_dict["ignored"] += 1
                continue

            ok = fill_polygon_to_mask(class_masks[structural_key], contour_pts, width, height)

            if ok:
                count_dict[structural_key] += 1
                logs.append("结构性类别写入: idx={}, name={}, mapped={}".format(i, class_name, structural_key))
            else:
                count_dict["ignored"] += 1

        except Exception as e:
            count_dict["ignored"] += 1
            logs.append("处理实例失败 idx={}: {}".format(i, str(e)))

    logs.append("结构性类别统计: {}".format(str(count_dict)))
    return class_masks


def generate_random_colors():
    random.seed(1234)
    return {
        "wall":   (random.randint(40,255), random.randint(40,255), random.randint(40,255)),
        "door":   (random.randint(40,255), random.randint(40,255), random.randint(40,255)),
        "window": (random.randint(40,255), random.randint(40,255), random.randint(40,255)),
        "tdoor":  (random.randint(40,255), random.randint(40,255), random.randint(40,255))
    }


def colorize_class_masks(class_masks, colors):
    h, w = class_masks["wall"].shape[:2]
    color_img = np.zeros((h, w, 3), dtype=np.uint8)

    for key in ["wall", "door", "window", "tdoor"]:
        color_img[class_masks[key] > 0] = colors[key]

    return color_img


def dilate_opening_masks(raw_class_masks):
    out = {}
    for key in raw_class_masks:
        out[key] = raw_class_masks[key].copy()

    kernel = cv2.getStructuringElement(cv2.MORPH_RECT, (OPENING_DILATE_KERNEL, OPENING_DILATE_KERNEL))

    for key in ["door", "window", "tdoor"]:
        out[key] = cv2.dilate(out[key], kernel, iterations=OPENING_DILATE_ITER)

    logs.append("门窗局部膨胀 kernel: {} x {}, iterations={}".format(
        OPENING_DILATE_KERNEL, OPENING_DILATE_KERNEL, OPENING_DILATE_ITER
    ))
    return out


def union_masks(class_masks):
    h, w = class_masks["wall"].shape[:2]
    merged = np.zeros((h, w), dtype=np.uint8)

    for key in ["wall", "door", "window", "tdoor"]:
        merged[class_masks[key] > 0] = 255

    return merged


def filter_small_components(mask, min_area):
    num_labels, labels, stats, _ = cv2.connectedComponentsWithStats(mask, connectivity=8)
    cleaned = np.zeros_like(mask, dtype=np.uint8)

    kept = 0
    removed = 0

    for label_id in range(1, num_labels):
        area = stats[label_id, cv2.CC_STAT_AREA]
        if area >= min_area:
            cleaned[labels == label_id] = 255
            kept += 1
        else:
            removed += 1

    logs.append("连通域过滤: kept={}, removed={}, min_area={}".format(kept, removed, min_area))
    return cleaned


def clean_structure_mask_with_gap_suppression(structure_mask):
    mask = structure_mask.copy().astype(np.uint8)
    mask[mask > 0] = 255

    bridge_kernel = cv2.getStructuringElement(cv2.MORPH_RECT, (BRIDGE_KERNEL, BRIDGE_KERNEL))
    mask = cv2.dilate(mask, bridge_kernel, iterations=BRIDGE_ITER)
    logs.append("局部桥接 dilate kernel: {} x {}, iterations={}".format(BRIDGE_KERNEL, BRIDGE_KERNEL, BRIDGE_ITER))

    close_kernel = cv2.getStructuringElement(cv2.MORPH_RECT, (CLOSE_KERNEL, CLOSE_KERNEL))
    mask = cv2.morphologyEx(mask, cv2.MORPH_CLOSE, close_kernel, iterations=CLOSE_ITER)
    logs.append("闭运算 kernel: {} x {}, iterations={}".format(CLOSE_KERNEL, CLOSE_KERNEL, CLOSE_ITER))

    open_kernel = cv2.getStructuringElement(cv2.MORPH_RECT, (OPEN_KERNEL, OPEN_KERNEL))
    mask = cv2.morphologyEx(mask, cv2.MORPH_OPEN, open_kernel, iterations=OPEN_ITER)
    logs.append("弱开运算 kernel: {} x {}, iterations={}".format(OPEN_KERNEL, OPEN_KERNEL, OPEN_ITER))

    mask = filter_small_components(mask, MIN_COMPONENT_AREA)

    if ERODE_BACK_KERNEL > 1 and ERODE_BACK_ITER > 0:
        erode_kernel = cv2.getStructuringElement(cv2.MORPH_RECT, (ERODE_BACK_KERNEL, ERODE_BACK_KERNEL))
        mask = cv2.erode(mask, erode_kernel, iterations=ERODE_BACK_ITER)
        logs.append("轻微回缩 erode kernel: {} x {}, iterations={}".format(
            ERODE_BACK_KERNEL, ERODE_BACK_KERNEL, ERODE_BACK_ITER
        ))

    mask[mask > 0] = 255
    return mask


def save_image(path, img):
    folder = os.path.dirname(path)
    ensure_dir(folder)

    ok = cv2.imwrite(path, img)
    if not ok:
        raise Exception("cv2.imwrite 保存失败: {}".format(path))

    logs.append("已保存图像: {}".format(path))


# ============================================================
# 主流程
# ============================================================

try:
    if not pixpath or not os.path.exists(pixpath):
        raise Exception("输入图像路径无效或不存在: {}".format(pixpath))

    img = cv2.imread(pixpath, cv2.IMREAD_COLOR)
    if img is None:
        raise Exception("cv2.imread 读取图像失败: {}".format(pixpath))

    h, w = img.shape[:2]

    logs.append("输入图像: {}".format(pixpath))
    logs.append("图像尺寸: width={}, height={}".format(w, h))

    # ======== 强制只按输入图片路径创建输出目录 ========
    image_dir = os.path.dirname(os.path.abspath(pixpath))
    output_dir = os.path.join(image_dir, output_folder_name)

    logs.append("输入图片所在目录: {}".format(image_dir))
    logs.append("输出子文件夹名称: {}".format(output_folder_name))
    logs.append("最终输出文件夹: {}".format(output_dir))

    ensure_dir(output_dir)

    model = get_model(dect_Model)

    logs.append("开始 YOLO 实例分割推理...")
    logs.append("YOLO_IMGSZ={}, YOLO_CONF={}, YOLO_IOU={}".format(YOLO_IMGSZ, YOLO_CONF, YOLO_IOU))

    results = model(
        pixpath,
        imgsz=YOLO_IMGSZ,
        conf=YOLO_CONF,
        iou=YOLO_IOU,
        verbose=False
    )

    if results is None or len(results) == 0:
        raise Exception("YOLO 推理没有返回结果。")

    result = results[0]
    logs.append("YOLO 推理完成。")

    raw_class_masks = build_raw_structural_masks(result, w, h)

    colors = generate_random_colors() if USE_RANDOM_COLORS else CLASS_COLORS

    raw_color_mask = colorize_class_masks(raw_class_masks, colors)
    raw_path = os.path.join(output_dir, "01_raw_structural_semantic_masks.png")
    save_image(raw_path, raw_color_mask)

    dilated_class_masks = dilate_opening_masks(raw_class_masks)
    dilated_color_mask = colorize_class_masks(dilated_class_masks, colors)
    dilated_path = os.path.join(output_dir, "02_dilated_opening_structural_masks.png")
    save_image(dilated_path, dilated_color_mask)

    merged_mask = union_masks(dilated_class_masks)
    cleaned_mask = clean_structure_mask_with_gap_suppression(merged_mask)
    cleaned_path = os.path.join(output_dir, "03_cleaned_structure_mask.png")
    save_image(cleaned_path, cleaned_mask)

    OUT = {
        "success": True,
        "output_dir": output_dir,
        "raw_structural_semantic_mask": raw_path,
        "dilated_opening_structural_mask": dilated_path,
        "cleaned_structure_mask": cleaned_path,
        "logs": logs
    }

except Exception as e:
    logs.append("执行失败: {}".format(str(e)))
    logs.append(traceback.format_exc())

    OUT = {
        "success": False,
        "error": str(e),
        "logs": logs
    }
# ----------------------------------------
python_version_12 = Watch(get_masks_and_join)  # graph output
get_centerlines_and_process = Python(IN[0]=seg_WWTD_Modelpath_2, IN[1]=imagepath)  # CPython3; frozen
# ---------- get_centerlines_and_process.python (1440 lines) ----------
# -*- coding: utf-8 -*-

# ============================================================
# Revit / Dynamo Python Node
#
# 7) 骨架化与墙体中心线提取
# 8) 中心线后处理策略
#
# 输出两张图：
#
# 04_raw_skeleton_overlay.png
#   清理后的二值结构掩膜 + 原始骨架红线
#
# 05_optimized_centerline_overlay.png
#   清理后的二值结构掩膜 + 优化后的中心线红线
#
# 输入：
# IN[0] = YOLO 模型对象 或 YOLO 模型路径
# IN[1] = 输入图片路径
#
# 可选：
# IN[2] = YOLO imgsz，默认 1280
# IN[3] = YOLO conf，默认 0.7
# IN[4] = YOLO iou，默认 0.45
# IN[5] = 输出子文件夹名，默认 structure_mask_process
# ============================================================


import os
import math
import traceback
import cv2
import numpy as np

try:
    from ultralytics import YOLO
except Exception:
    YOLO = None


# ============================================================
# 输入
# ============================================================

logs = []
logs.append("=== 当前运行的是骨架化与中心线后处理节点 V1 ===")

try:
    dect_Model = IN[0]
except:
    dect_Model = None

try:
    pixpath = IN[1]
except:
    pixpath = ""

try:
    YOLO_IMGSZ = int(IN[2])
except:
    YOLO_IMGSZ = 1280

try:
    YOLO_CONF = float(IN[3])
except:
    YOLO_CONF = 0.7

try:
    YOLO_IOU = float(IN[4])
except:
    YOLO_IOU = 0.45

try:
    OUTPUT_FOLDER_NAME = str(IN[5]).strip()
    if not OUTPUT_FOLDER_NAME:
        OUTPUT_FOLDER_NAME = "structure_mask_process"
except:
    OUTPUT_FOLDER_NAME = "structure_mask_process"

# 防止误把 json 文件路径传进 IN[5]
OUTPUT_FOLDER_NAME = os.path.basename(OUTPUT_FOLDER_NAME)
OUTPUT_FOLDER_NAME = OUTPUT_FOLDER_NAME.replace(".json", "")
OUTPUT_FOLDER_NAME = OUTPUT_FOLDER_NAME.replace(".txt", "")
OUTPUT_FOLDER_NAME = OUTPUT_FOLDER_NAME.replace(".png", "")
OUTPUT_FOLDER_NAME = OUTPUT_FOLDER_NAME.replace(".jpg", "")
OUTPUT_FOLDER_NAME = OUTPUT_FOLDER_NAME.replace(".jpeg", "")

if not OUTPUT_FOLDER_NAME:
    OUTPUT_FOLDER_NAME = "structure_mask_process"


# ============================================================
# 参数配置
# ============================================================

STRUCTURAL_CLASS_KEYS = ["wall", "door", "window", "tdoor"]

# 门窗局部膨胀
OPENING_DILATE_KERNEL = 9
OPENING_DILATE_ITER = 1

# 形态学清理
BRIDGE_KERNEL = 5
BRIDGE_ITER = 1

CLOSE_KERNEL = 7
CLOSE_ITER = 1

OPEN_KERNEL = 3
OPEN_ITER = 1

ERODE_BACK_KERNEL = 3
ERODE_BACK_ITER = 1

MIN_COMPONENT_AREA = 80

# 骨架绘制参数，和前面 Houdini 红色骨架风格保持一致
RED_COLOR = (0, 0, 255)       # OpenCV BGR 红色
RAW_SKELETON_THICKNESS = 5
OPT_CENTERLINE_THICKNESS = 5

# 骨架矢量化参数
RDP_EPSILON_PX = 4.0
MIN_SEGMENT_LENGTH_PX = 8.0

# 中心线优化参数
SNAP_VERTEX_TOL = 8.0
MERGE_COORD_TOL = 8.0
MERGE_GAP_TOL = 22.0

# 端点延伸与桥接参数
ENABLE_ENDPOINT_BRIDGE = True
ENDPOINT_BRIDGE_TOL = 18.0

# 共线合并执行轮数
MERGE_ITERATIONS = 2


# ============================================================
# 基础工具函数
# ============================================================

def ensure_dir(folder):
    if not folder:
        raise Exception("输出文件夹为空。")
    if not os.path.exists(folder):
        os.makedirs(folder)


def save_image(path, img):
    ensure_dir(os.path.dirname(path))
    ok = cv2.imwrite(path, img)
    if not ok:
        raise Exception("cv2.imwrite 保存失败: {}".format(path))
    logs.append("已保存图像: {}".format(path))


def normalize_class_name(name):
    if name is None:
        return ""
    return str(name).strip().lower()


def classify_structural_class(class_name):
    """
    将模型类别映射到结构性类别集合：
    C_s = {Wall, Door, Window, TDoor}
    """
    n = normalize_class_name(class_name)

    if not n:
        return None

    # TDoor 优先判断，避免被 Door 捕获
    for kw in ["tdoor", "double door", "double-door", "double_door", "双开门", "双扇门", "双门"]:
        if kw in n:
            return "tdoor"

    for kw in ["window", "windows", "窗", "窗户", "飘窗"]:
        if kw in n:
            return "window"

    for kw in ["door", "single door", "single-door", "single_door", "门", "单开门", "单扇门"]:
        if kw in n:
            return "door"

    for kw in ["wall", "basic wall", "bearing wall", "shear wall", "墙", "墙体", "基本墙", "承重墙", "剪力墙"]:
        if kw in n:
            return "wall"

    return None


def get_model(model_input):
    if model_input is None:
        raise Exception("IN[0] 为空，请传入 YOLO 模型对象或模型路径。")

    if not isinstance(model_input, str):
        if hasattr(model_input, "predict") or hasattr(model_input, "__call__"):
            logs.append("检测到 IN[0] 是已加载模型对象，直接使用。")
            return model_input

    model_path = str(model_input).strip()

    if not os.path.exists(model_path):
        raise Exception("YOLO 模型路径不存在: {}".format(model_path))

    if YOLO is None:
        raise Exception("无法导入 ultralytics.YOLO，请检查 Python 环境。")

    logs.append("开始加载 YOLO 模型: {}".format(model_path))
    model = YOLO(model_path)
    logs.append("YOLO 模型加载完成。")
    return model


def safe_get_class_name(names, cls_id):
    try:
        if isinstance(names, dict):
            return names.get(int(cls_id), str(cls_id))
        return names[int(cls_id)]
    except:
        return str(cls_id)


def ensure_binary_mask(mask):
    arr = np.asarray(mask)

    if len(arr.shape) == 2:
        gray = arr
    elif len(arr.shape) == 3:
        c = arr.shape[2]
        if c == 1:
            gray = arr[:, :, 0]
        elif c == 3:
            gray = cv2.cvtColor(arr, cv2.COLOR_BGR2GRAY)
        elif c == 4:
            gray = cv2.cvtColor(arr, cv2.COLOR_BGRA2GRAY)
        else:
            raise Exception("不支持的图像通道数: {}".format(arr.shape))
    else:
        raise Exception("不支持的图像维度: {}".format(arr.shape))

    out = gray.astype(np.uint8)
    out[out > 0] = 255
    return out


def create_mask_base_bgr(mask):
    gray = ensure_binary_mask(mask)
    return cv2.cvtColor(gray, cv2.COLOR_GRAY2BGR)


# ============================================================
# 结构掩膜构建与清理
# ============================================================

def empty_class_masks(h, w):
    return {
        "wall": np.zeros((h, w), dtype=np.uint8),
        "door": np.zeros((h, w), dtype=np.uint8),
        "window": np.zeros((h, w), dtype=np.uint8),
        "tdoor": np.zeros((h, w), dtype=np.uint8)
    }


def fill_polygon_to_mask(mask, contour_pts, width, height):
    pts = np.array(contour_pts, dtype=np.int32)

    if pts is None or len(pts) < 3:
        return False

    pts[:, 0] = np.clip(pts[:, 0], 0, width - 1)
    pts[:, 1] = np.clip(pts[:, 1], 0, height - 1)

    cv2.fillPoly(mask, [pts], 255)
    return True


def build_raw_structural_masks(result, width, height):
    class_masks = empty_class_masks(height, width)

    if result is None:
        logs.append("YOLO result is None。")
        return class_masks

    if result.masks is None:
        logs.append("YOLO result.masks is None，没有实例分割 mask。")
        return class_masks

    masks_xy = result.masks.xy

    if result.boxes is not None and result.boxes.cls is not None:
        cls_ids = result.boxes.cls.cpu().numpy().astype(int)
    else:
        cls_ids = np.zeros(len(masks_xy), dtype=np.int32)

    names = result.names

    logs.append("YOLO 类别映射: {}".format(str(names)))
    logs.append("YOLO 实例 mask 数量: {}".format(len(masks_xy)))

    count_dict = {
        "wall": 0,
        "door": 0,
        "window": 0,
        "tdoor": 0,
        "ignored": 0
    }

    for i, contour_pts in enumerate(masks_xy):
        try:
            if i >= len(cls_ids):
                count_dict["ignored"] += 1
                continue

            cls_id = int(cls_ids[i])
            class_name = safe_get_class_name(names, cls_id)
            structural_key = classify_structural_class(class_name)

            if structural_key is None:
                count_dict["ignored"] += 1
                continue

            ok = fill_polygon_to_mask(
                class_masks[structural_key],
                contour_pts,
                width,
                height
            )

            if ok:
                count_dict[structural_key] += 1
            else:
                count_dict["ignored"] += 1

        except Exception as e:
            count_dict["ignored"] += 1
            logs.append("处理实例失败 idx={}: {}".format(i, str(e)))

    logs.append("结构性类别统计: {}".format(str(count_dict)))
    return class_masks


def dilate_opening_masks(raw_class_masks):
    out = {}

    for key in STRUCTURAL_CLASS_KEYS:
        out[key] = raw_class_masks[key].copy()

    kernel = cv2.getStructuringElement(
        cv2.MORPH_RECT,
        (OPENING_DILATE_KERNEL, OPENING_DILATE_KERNEL)
    )

    for key in ["door", "window", "tdoor"]:
        out[key] = cv2.dilate(
            raw_class_masks[key],
            kernel,
            iterations=OPENING_DILATE_ITER
        )

    logs.append("门窗局部膨胀 kernel={} iterations={}".format(
        OPENING_DILATE_KERNEL,
        OPENING_DILATE_ITER
    ))

    return out


def union_masks(class_masks):
    h, w = class_masks["wall"].shape[:2]
    merged = np.zeros((h, w), dtype=np.uint8)

    for key in STRUCTURAL_CLASS_KEYS:
        merged[class_masks[key] > 0] = 255

    return merged


def filter_small_components(mask, min_area):
    mask = ensure_binary_mask(mask)

    num_labels, labels, stats, _ = cv2.connectedComponentsWithStats(
        mask,
        connectivity=8
    )

    cleaned = np.zeros_like(mask, dtype=np.uint8)

    kept = 0
    removed = 0

    for label_id in range(1, num_labels):
        area = stats[label_id, cv2.CC_STAT_AREA]

        if area >= min_area:
            cleaned[labels == label_id] = 255
            kept += 1
        else:
            removed += 1

    logs.append("连通域过滤: kept={}, removed={}, min_area={}".format(
        kept,
        removed,
        min_area
    ))

    return cleaned


def clean_structure_mask_with_gap_suppression(structure_mask):
    mask = ensure_binary_mask(structure_mask)

    # 1. 局部桥接
    bridge_kernel = cv2.getStructuringElement(
        cv2.MORPH_RECT,
        (BRIDGE_KERNEL, BRIDGE_KERNEL)
    )

    mask = cv2.dilate(
        mask,
        bridge_kernel,
        iterations=BRIDGE_ITER
    )

    logs.append("局部桥接 dilate kernel={} iterations={}".format(
        BRIDGE_KERNEL,
        BRIDGE_ITER
    ))

    # 2. 闭运算
    close_kernel = cv2.getStructuringElement(
        cv2.MORPH_RECT,
        (CLOSE_KERNEL, CLOSE_KERNEL)
    )

    mask = cv2.morphologyEx(
        mask,
        cv2.MORPH_CLOSE,
        close_kernel,
        iterations=CLOSE_ITER
    )

    logs.append("闭运算 kernel={} iterations={}".format(
        CLOSE_KERNEL,
        CLOSE_ITER
    ))

    # 3. 弱开运算
    open_kernel = cv2.getStructuringElement(
        cv2.MORPH_RECT,
        (OPEN_KERNEL, OPEN_KERNEL)
    )

    mask = cv2.morphologyEx(
        mask,
        cv2.MORPH_OPEN,
        open_kernel,
        iterations=OPEN_ITER
    )

    logs.append("弱开运算 kernel={} iterations={}".format(
        OPEN_KERNEL,
        OPEN_ITER
    ))

    # 4. 连通域过滤
    mask = filter_small_components(mask, MIN_COMPONENT_AREA)

    # 5. 轻微回缩
    if ERODE_BACK_KERNEL > 1 and ERODE_BACK_ITER > 0:
        erode_kernel = cv2.getStructuringElement(
            cv2.MORPH_RECT,
            (ERODE_BACK_KERNEL, ERODE_BACK_KERNEL)
        )

        mask = cv2.erode(
            mask,
            erode_kernel,
            iterations=ERODE_BACK_ITER
        )

        logs.append("轻微回缩 erode kernel={} iterations={}".format(
            ERODE_BACK_KERNEL,
            ERODE_BACK_ITER
        ))

    mask[mask > 0] = 255
    return mask


# ============================================================
# 骨架化
# ============================================================

def skeletonize_with_skimage(mask):
    try:
        from skimage.morphology import skeletonize

        binary = mask > 0
        skel = skeletonize(binary)
        skel_u8 = skel.astype(np.uint8) * 255

        logs.append("骨架化方式: skimage.morphology.skeletonize")
        return skel_u8

    except Exception as e:
        logs.append("skimage 骨架化不可用，使用 OpenCV 备用算法。原因: {}".format(str(e)))
        return None


def skeletonize_with_opencv(mask):
    img = ensure_binary_mask(mask)
    img[img > 0] = 255

    skel = np.zeros(img.shape, np.uint8)
    element = cv2.getStructuringElement(cv2.MORPH_CROSS, (3, 3))

    iteration = 0

    while True:
        opened = cv2.morphologyEx(img, cv2.MORPH_OPEN, element)
        temp = cv2.subtract(img, opened)
        eroded = cv2.erode(img, element)
        skel = cv2.bitwise_or(skel, temp)
        img = eroded.copy()

        iteration += 1

        if cv2.countNonZero(img) == 0:
            break

        if iteration > 10000:
            logs.append("OpenCV 骨架化迭代过多，提前终止。")
            break

    logs.append("骨架化方式: OpenCV morphology skeleton, iterations={}".format(iteration))
    return skel


def skeletonize_mask(mask):
    mask = ensure_binary_mask(mask)

    skel = skeletonize_with_skimage(mask)

    if skel is None:
        skel = skeletonize_with_opencv(mask)

    skel = ensure_binary_mask(skel)
    logs.append("骨架像素数量: {}".format(int(np.count_nonzero(skel))))
    return skel


def save_raw_skeleton_overlay(clean_mask, skeleton_mask, save_path):
    base = create_mask_base_bgr(clean_mask)
    skel = ensure_binary_mask(skeleton_mask)

    thickness = max(1, int(RAW_SKELETON_THICKNESS))

    if thickness > 1:
        kernel = cv2.getStructuringElement(
            cv2.MORPH_ELLIPSE,
            (thickness, thickness)
        )
        draw_mask = cv2.dilate(skel, kernel, iterations=1)
    else:
        draw_mask = skel

    base[draw_mask > 0] = RED_COLOR
    save_image(save_path, base)


# ============================================================
# 骨架图矢量化
# ============================================================

NEIGHBORS_8 = [
    (-1, -1), (0, -1), (1, -1),
    (-1,  0),          (1,  0),
    (-1,  1), (0,  1), (1,  1)
]


def get_skeleton_points_set(skeleton_mask):
    ys, xs = np.where(skeleton_mask > 0)
    return set(zip(xs.tolist(), ys.tolist()))


def get_neighbors(pt, point_set):
    x, y = pt
    result = []

    for dx, dy in NEIGHBORS_8:
        q = (x + dx, y + dy)
        if q in point_set:
            result.append(q)

    return result


def edge_key(a, b):
    return tuple(sorted([a, b]))


def trace_path_from_keynode(start, nxt, point_set, key_nodes, visited_edges):
    path = [start, nxt]

    visited_edges.add(edge_key(start, nxt))

    prev = start
    cur = nxt

    while True:
        if cur in key_nodes and cur != start:
            break

        nbs = get_neighbors(cur, point_set)

        candidates = []

        for nb in nbs:
            if nb == prev:
                continue

            ek = edge_key(cur, nb)

            if ek in visited_edges:
                continue

            candidates.append(nb)

        if len(candidates) == 0:
            break

        next_pt = candidates[0]
        visited_edges.add(edge_key(cur, next_pt))
        path.append(next_pt)

        prev = cur
        cur = next_pt

    return path


def trace_loop_from_edge(a, b, point_set, visited_edges):
    path = [a, b]
    visited_edges.add(edge_key(a, b))

    prev = a
    cur = b

    while True:
        nbs = get_neighbors(cur, point_set)

        candidates = []

        for nb in nbs:
            if nb == prev:
                continue

            ek = edge_key(cur, nb)

            if ek in visited_edges:
                continue

            candidates.append(nb)

        if len(candidates) == 0:
            break

        next_pt = candidates[0]
        visited_edges.add(edge_key(cur, next_pt))

        path.append(next_pt)

        if next_pt == a:
            break

        prev = cur
        cur = next_pt

        if len(path) > len(point_set) + 5:
            break

    return path


def vectorize_skeleton(skeleton_mask):
    skel = ensure_binary_mask(skeleton_mask)
    point_set = get_skeleton_points_set(skel)

    if not point_set:
        logs.append("骨架点为空。")
        return []

    key_nodes = set()

    for pt in point_set:
        degree = len(get_neighbors(pt, point_set))

        if degree != 2:
            key_nodes.add(pt)

    logs.append("骨架图节点总数: {}".format(len(point_set)))
    logs.append("拓扑关键节点数量: {}".format(len(key_nodes)))

    visited_edges = set()
    paths = []

    # 从关键节点出发追踪
    for kn in key_nodes:
        nbs = get_neighbors(kn, point_set)

        for nb in nbs:
            ek = edge_key(kn, nb)

            if ek in visited_edges:
                continue

            path = trace_path_from_keynode(
                kn,
                nb,
                point_set,
                key_nodes,
                visited_edges
            )

            if len(path) >= 2:
                paths.append(path)

    # 处理纯环或未访问边
    for pt in list(point_set):
        nbs = get_neighbors(pt, point_set)

        for nb in nbs:
            ek = edge_key(pt, nb)

            if ek in visited_edges:
                continue

            path = trace_loop_from_edge(
                pt,
                nb,
                point_set,
                visited_edges
            )

            if len(path) >= 2:
                paths.append(path)

    logs.append("骨架追踪得到路径数量: {}".format(len(paths)))
    return paths


# ============================================================
# RDP 简化与正交化
# ============================================================

def point_line_distance(pt, a, b):
    px, py = pt
    ax, ay = a
    bx, by = b

    dx = bx - ax
    dy = by - ay

    if dx == 0 and dy == 0:
        return math.hypot(px - ax, py - ay)

    t = ((px - ax) * dx + (py - ay) * dy) / float(dx * dx + dy * dy)
    t = max(0.0, min(1.0, t))

    qx = ax + t * dx
    qy = ay + t * dy

    return math.hypot(px - qx, py - qy)


def rdp(points, epsilon):
    if points is None or len(points) < 3:
        return points

    start = points[0]
    end = points[-1]

    max_dist = -1.0
    index = -1

    for i in range(1, len(points) - 1):
        d = point_line_distance(points[i], start, end)

        if d > max_dist:
            max_dist = d
            index = i

    if max_dist > epsilon:
        left = rdp(points[:index + 1], epsilon)
        right = rdp(points[index:], epsilon)

        return left[:-1] + right
    else:
        return [start, end]


def segment_length(seg):
    (x1, y1), (x2, y2) = seg
    return math.hypot(x2 - x1, y2 - y1)


def orthogonalize_segment(p1, p2):
    x1, y1 = p1
    x2, y2 = p2

    dx = x2 - x1
    dy = y2 - y1

    if abs(dx) >= abs(dy):
        y = int(round((y1 + y2) * 0.5))
        return ((int(round(x1)), y), (int(round(x2)), y))
    else:
        x = int(round((x1 + x2) * 0.5))
        return ((x, int(round(y1))), (x, int(round(y2))))


def paths_to_orthogonal_segments(paths):
    segments = []

    for path in paths:
        if len(path) < 2:
            continue

        simplified = rdp(path, RDP_EPSILON_PX)

        if simplified is None or len(simplified) < 2:
            continue

        for i in range(len(simplified) - 1):
            seg = orthogonalize_segment(
                simplified[i],
                simplified[i + 1]
            )

            if segment_length(seg) >= MIN_SEGMENT_LENGTH_PX:
                segments.append(seg)

    logs.append("RDP + 正交化后初始线段数量: {}".format(len(segments)))
    return segments


# ============================================================
# 中心线后处理：吸附、合并、桥接、过滤
# ============================================================

def normalize_segment_direction(seg):
    (x1, y1), (x2, y2) = seg

    if abs(x2 - x1) >= abs(y2 - y1):
        if x1 <= x2:
            return ((x1, y1), (x2, y2))
        else:
            return ((x2, y2), (x1, y1))
    else:
        if y1 <= y2:
            return ((x1, y1), (x2, y2))
        else:
            return ((x2, y2), (x1, y1))


def classify_segment(seg):
    (x1, y1), (x2, y2) = seg

    if abs(x2 - x1) >= abs(y2 - y1):
        return "h"
    else:
        return "v"


def snap_segment_vertices(segments, tol):
    if not segments:
        return []

    points = []

    for seg in segments:
        points.append(seg[0])
        points.append(seg[1])

    used = [False] * len(points)
    snapped_map = {}

    for i, p in enumerate(points):
        if used[i]:
            continue

        cluster = [i]
        used[i] = True

        cx = float(p[0])
        cy = float(p[1])

        changed = True

        while changed:
            changed = False

            for j, q in enumerate(points):
                if used[j]:
                    continue

                d = math.hypot(q[0] - cx, q[1] - cy)

                if d <= tol:
                    used[j] = True
                    cluster.append(j)

                    xs = [points[idx][0] for idx in cluster]
                    ys = [points[idx][1] for idx in cluster]

                    cx = sum(xs) / float(len(xs))
                    cy = sum(ys) / float(len(ys))

                    changed = True

        snapped_pt = (int(round(cx)), int(round(cy)))

        for idx in cluster:
            snapped_map[points[idx]] = snapped_pt

    out = []

    for seg in segments:
        a = snapped_map.get(seg[0], seg[0])
        b = snapped_map.get(seg[1], seg[1])

        if a != b and segment_length((a, b)) >= MIN_SEGMENT_LENGTH_PX:
            out.append((a, b))

    logs.append("端点吸附: before={}, after={}, tol={}".format(
        len(segments),
        len(out),
        tol
    ))

    return out


def merge_horizontal_segments(h_segments):
    if not h_segments:
        return []

    items = []

    for seg in h_segments:
        seg = normalize_segment_direction(seg)
        (x1, y1), (x2, y2) = seg

        y = 0.5 * (y1 + y2)
        xa = min(x1, x2)
        xb = max(x1, x2)

        items.append([y, xa, xb])

    items.sort(key=lambda x: (x[0], x[1]))

    used = [False] * len(items)
    merged = []

    for i in range(len(items)):
        if used[i]:
            continue

        y, xa, xb = items[i]
        used[i] = True

        changed = True

        while changed:
            changed = False

            for j in range(len(items)):
                if used[j]:
                    continue

                y2, xa2, xb2 = items[j]

                if abs(y2 - y) > MERGE_COORD_TOL:
                    continue

                gap = max(xa2 - xb, xa - xb2, 0)

                if gap <= MERGE_GAP_TOL:
                    len1 = max(1.0, xb - xa)
                    len2 = max(1.0, xb2 - xa2)

                    y = (y * len1 + y2 * len2) / (len1 + len2)
                    xa = min(xa, xa2)
                    xb = max(xb, xb2)

                    used[j] = True
                    changed = True

        yy = int(round(y))
        merged.append(((int(round(xa)), yy), (int(round(xb)), yy)))

    return merged


def merge_vertical_segments(v_segments):
    if not v_segments:
        return []

    items = []

    for seg in v_segments:
        seg = normalize_segment_direction(seg)
        (x1, y1), (x2, y2) = seg

        x = 0.5 * (x1 + x2)
        ya = min(y1, y2)
        yb = max(y1, y2)

        items.append([x, ya, yb])

    items.sort(key=lambda x: (x[0], x[1]))

    used = [False] * len(items)
    merged = []

    for i in range(len(items)):
        if used[i]:
            continue

        x, ya, yb = items[i]
        used[i] = True

        changed = True

        while changed:
            changed = False

            for j in range(len(items)):
                if used[j]:
                    continue

                x2, ya2, yb2 = items[j]

                if abs(x2 - x) > MERGE_COORD_TOL:
                    continue

                gap = max(ya2 - yb, ya - yb2, 0)

                if gap <= MERGE_GAP_TOL:
                    len1 = max(1.0, yb - ya)
                    len2 = max(1.0, yb2 - ya2)

                    x = (x * len1 + x2 * len2) / (len1 + len2)
                    ya = min(ya, ya2)
                    yb = max(yb, yb2)

                    used[j] = True
                    changed = True

        xx = int(round(x))
        merged.append(((xx, int(round(ya))), (xx, int(round(yb)))))

    return merged


def merge_collinear_segments(segments):
    h_segments = []
    v_segments = []

    for seg in segments:
        if classify_segment(seg) == "h":
            h_segments.append(seg)
        else:
            v_segments.append(seg)

    merged_h = merge_horizontal_segments(h_segments)
    merged_v = merge_vertical_segments(v_segments)

    merged = merged_h + merged_v

    filtered = []

    for seg in merged:
        if segment_length(seg) >= MIN_SEGMENT_LENGTH_PX:
            filtered.append(seg)

    logs.append("共线合并: before={}, after={}, h={}, v={}".format(
        len(segments),
        len(filtered),
        len(h_segments),
        len(v_segments)
    ))

    return filtered


def bridge_near_orthogonal_endpoints(segments):
    """
    端点延伸与桥接：
    对于水平线段端点与垂直线段端点附近的正交交点，
    若距离小于 ENDPOINT_BRIDGE_TOL，则将对应端点延伸到交点。
    """
    if not ENABLE_ENDPOINT_BRIDGE:
        return segments

    if not segments:
        return []

    segs = [normalize_segment_direction(s) for s in segments]

    h_indices = []
    v_indices = []

    for idx, seg in enumerate(segs):
        if classify_segment(seg) == "h":
            h_indices.append(idx)
        else:
            v_indices.append(idx)

    # 使用可变列表
    mutable = []
    for seg in segs:
        mutable.append([list(seg[0]), list(seg[1])])

    changed_count = 0

    for hi in h_indices:
        hp1, hp2 = mutable[hi]
        hy = hp1[1]
        hx_min = min(hp1[0], hp2[0])
        hx_max = max(hp1[0], hp2[0])

        for vi in v_indices:
            vp1, vp2 = mutable[vi]
            vx = vp1[0]
            vy_min = min(vp1[1], vp2[1])
            vy_max = max(vp1[1], vp2[1])

            # 理论正交交点
            inter = (vx, hy)

            # 交点应该接近水平线段 x 范围或端点
            # 也应该接近垂直线段 y 范围或端点
            h_near = (hx_min - ENDPOINT_BRIDGE_TOL <= vx <= hx_max + ENDPOINT_BRIDGE_TOL)
            v_near = (vy_min - ENDPOINT_BRIDGE_TOL <= hy <= vy_max + ENDPOINT_BRIDGE_TOL)

            if not (h_near and v_near):
                continue

            # 水平线段两个端点到交点距离
            hd1 = math.hypot(hp1[0] - inter[0], hp1[1] - inter[1])
            hd2 = math.hypot(hp2[0] - inter[0], hp2[1] - inter[1])

            # 垂直线段两个端点到交点距离
            vd1 = math.hypot(vp1[0] - inter[0], vp1[1] - inter[1])
            vd2 = math.hypot(vp2[0] - inter[0], vp2[1] - inter[1])

            # 只延伸距离较近的端点
            if hd1 <= ENDPOINT_BRIDGE_TOL:
                hp1[0], hp1[1] = inter[0], inter[1]
                changed_count += 1
            elif hd2 <= ENDPOINT_BRIDGE_TOL:
                hp2[0], hp2[1] = inter[0], inter[1]
                changed_count += 1

            if vd1 <= ENDPOINT_BRIDGE_TOL:
                vp1[0], vp1[1] = inter[0], inter[1]
                changed_count += 1
            elif vd2 <= ENDPOINT_BRIDGE_TOL:
                vp2[0], vp2[1] = inter[0], inter[1]
                changed_count += 1

            # 更新回 mutable
            mutable[hi] = [hp1, hp2]
            mutable[vi] = [vp1, vp2]

    out = []

    for a, b in mutable:
        seg = ((int(round(a[0])), int(round(a[1]))),
               (int(round(b[0])), int(round(b[1]))))

        seg = orthogonalize_segment(seg[0], seg[1])

        if segment_length(seg) >= MIN_SEGMENT_LENGTH_PX:
            out.append(seg)

    logs.append("端点延伸与桥接: changed_endpoints={}, before={}, after={}".format(
        changed_count,
        len(segments),
        len(out)
    ))

    return out


def optimize_centerlines(segments):
    if not segments:
        logs.append("optimize_centerlines: 输入线段为空。")
        return []

    out = segments[:]

    out = snap_segment_vertices(out, SNAP_VERTEX_TOL)

    for _ in range(MERGE_ITERATIONS):
        out = merge_collinear_segments(out)
        out = snap_segment_vertices(out, SNAP_VERTEX_TOL)

    out = bridge_near_orthogonal_endpoints(out)

    out = snap_segment_vertices(out, SNAP_VERTEX_TOL)
    out = merge_collinear_segments(out)

    final = []

    for seg in out:
        if segment_length(seg) >= MIN_SEGMENT_LENGTH_PX:
            final.append(seg)

    logs.append("中心线后处理完成: initial={}, final={}".format(
        len(segments),
        len(final)
    ))

    return final


# ============================================================
# 绘制优化中心线
# ============================================================

def clip_point(pt, w, h):
    x, y = pt
    x = int(round(x))
    y = int(round(y))

    x = max(0, min(w - 1, x))
    y = max(0, min(h - 1, y))

    return (x, y)


def save_optimized_centerline_overlay(clean_mask, segments, save_path):
    base = create_mask_base_bgr(clean_mask)

    h, w = clean_mask.shape[:2]
    thickness = max(1, int(OPT_CENTERLINE_THICKNESS))

    for seg in segments:
        p1, p2 = seg

        p1 = clip_point(p1, w, h)
        p2 = clip_point(p2, w, h)

        cv2.line(
            base,
            p1,
            p2,
            RED_COLOR,
            thickness=thickness,
            lineType=cv2.LINE_AA
        )

    save_image(save_path, base)


# ============================================================
# 主流程
# ============================================================

try:
    # --------------------------------------------------------
    # 0. 输入图像与输出目录
    # --------------------------------------------------------

    if not pixpath or not os.path.exists(pixpath):
        raise Exception("输入图像路径无效或不存在: {}".format(pixpath))

    img = cv2.imread(pixpath, cv2.IMREAD_COLOR)

    if img is None:
        raise Exception("cv2.imread 读取图像失败: {}".format(pixpath))

    img_h, img_w = img.shape[:2]

    logs.append("输入图像: {}".format(pixpath))
    logs.append("图像尺寸: width={}, height={}".format(img_w, img_h))

    image_dir = os.path.dirname(os.path.abspath(pixpath))
    output_dir = os.path.join(image_dir, OUTPUT_FOLDER_NAME)

    ensure_dir(output_dir)

    logs.append("输入图片所在目录: {}".format(image_dir))
    logs.append("最终输出文件夹: {}".format(output_dir))

    # --------------------------------------------------------
    # 1. YOLO 推理
    # --------------------------------------------------------

    model = get_model(dect_Model)

    logs.append("开始 YOLO 实例分割推理...")
    logs.append("YOLO_IMGSZ={}, YOLO_CONF={}, YOLO_IOU={}".format(
        YOLO_IMGSZ,
        YOLO_CONF,
        YOLO_IOU
    ))

    results = model(
        pixpath,
        imgsz=YOLO_IMGSZ,
        conf=YOLO_CONF,
        iou=YOLO_IOU,
        verbose=False
    )

    if results is None or len(results) == 0:
        raise Exception("YOLO 推理没有返回结果。")

    result = results[0]

    logs.append("YOLO 推理完成。")

    # --------------------------------------------------------
    # 2. 构建结构性融合掩膜并清理
    # --------------------------------------------------------

    raw_class_masks = build_raw_structural_masks(
        result,
        img_w,
        img_h
    )

    dilated_class_masks = dilate_opening_masks(
        raw_class_masks
    )

    structure_mask = union_masks(
        dilated_class_masks
    )

    cleaned_structure_mask = clean_structure_mask_with_gap_suppression(
        structure_mask
    )

    # 可选保存清理后的二值掩膜，方便检查
    cleaned_mask_path = os.path.join(
        output_dir,
        "03_cleaned_structure_mask_for_skeleton.png"
    )

    save_image(
        cleaned_mask_path,
        cleaned_structure_mask
    )

    # --------------------------------------------------------
    # 3. 骨架化
    #    对应 7）前半部分
    # --------------------------------------------------------

    skeleton_mask = skeletonize_mask(
        cleaned_structure_mask
    )

    raw_skeleton_overlay_path = os.path.join(
        output_dir,
        "04_raw_skeleton_overlay.png"
    )

    save_raw_skeleton_overlay(
        cleaned_structure_mask,
        skeleton_mask,
        raw_skeleton_overlay_path
    )

    # --------------------------------------------------------
    # 4. 骨架矢量化、RDP 简化、正交化
    #    对应 7）后半部分
    # --------------------------------------------------------

    paths = vectorize_skeleton(
        skeleton_mask
    )

    initial_segments = paths_to_orthogonal_segments(
        paths
    )

    # --------------------------------------------------------
    # 5. 中心线后处理
    #    对应 8）
    # --------------------------------------------------------

    optimized_segments = optimize_centerlines(
        initial_segments
    )

    optimized_centerline_overlay_path = os.path.join(
        output_dir,
        "05_optimized_centerline_overlay.png"
    )

    save_optimized_centerline_overlay(
        cleaned_structure_mask,
        optimized_segments,
        optimized_centerline_overlay_path
    )

    # --------------------------------------------------------
    # 6. 输出
    # --------------------------------------------------------

    OUT = {
        "success": True,
        "output_dir": output_dir,
        "cleaned_structure_mask": cleaned_mask_path,
        "raw_skeleton_overlay": raw_skeleton_overlay_path,
        "optimized_centerline_overlay": optimized_centerline_overlay_path,
        "skeleton_pixel_count": int(np.count_nonzero(skeleton_mask)),
        "initial_segment_count": int(len(initial_segments)),
        "optimized_segment_count": int(len(optimized_segments)),
        "logs": logs
    }

except Exception as e:
    logs.append("执行失败: {}".format(str(e)))
    logs.append(traceback.format_exc())

    OUT = {
        "success": False,
        "error": str(e),
        "logs": logs
    }
# ----------------------------------------
python_version_13 = Watch(get_centerlines_and_process)  # graph output
draw_wall_width_pics = Python(IN[0]=seg_WWTD_Modelpath_2, IN[1]=imagepath, IN[2]=python_version)  # CPython3; frozen
# ---------- draw_wall_width_pics.python (2085 lines) ----------
# -*- coding: utf-8 -*-

# ============================================================
# Revit / Dynamo Python Node
#
# 6) 基于有效墙体区域的尺度映射
# 7) 骨架化与墙体中心线提取
# 8) 中心线后处理策略
# 9) 墙体厚度语义判别与内外墙色条表达
#
# 输出：
#   06_wall_thickness_semantic_bars.png
#
# 推荐输入：
#   IN[0] = YOLO 模型对象 或 YOLO 模型路径
#   IN[1] = 输入图片路径
#
# 可选输入方式 A：
#   IN[2] = OCR 尺寸 JSON 路径
#   IN[3] = YOLO imgsz，默认 1280
#   IN[4] = YOLO conf，默认 0.7
#   IN[5] = YOLO iou，默认 0.45
#   IN[6] = 输出子文件夹名，默认 structure_mask_process
#
# 可选输入方式 B：
#   IN[2] = YOLO imgsz
#   IN[3] = YOLO conf
#   IN[4] = YOLO iou
#   IN[5] = OCR 尺寸 JSON 路径，可选
#   IN[6] = 输出子文件夹名，可选
# ============================================================


import os
import re
import json
import math
import traceback

import cv2
import numpy as np

try:
    from ultralytics import YOLO
except Exception:
    YOLO = None


# ============================================================
# 日志
# ============================================================

logs = []
logs.append("=== 当前运行的是墙厚语义色条绘制节点 V1 ===")


# ============================================================
# 输入解析
# ============================================================

try:
    dect_Model = IN[0]
except:
    dect_Model = None

try:
    pixpath = IN[1]
except:
    pixpath = ""


def is_number_like(v):
    try:
        float(v)
        return True
    except:
        return False


def is_json_path(v):
    try:
        s = str(v).strip()
        return s.lower().endswith(".json")
    except:
        return False


# 默认参数
dims_json_path = ""
YOLO_IMGSZ = 1280
YOLO_CONF = 0.7
YOLO_IOU = 0.45
OUTPUT_FOLDER_NAME = "structure_mask_process"

# 兼容两种输入排布
try:
    in2 = IN[2]
except:
    in2 = None

try:
    in3 = IN[3]
except:
    in3 = None

try:
    in4 = IN[4]
except:
    in4 = None

try:
    in5 = IN[5]
except:
    in5 = None

try:
    in6 = IN[6]
except:
    in6 = None


if is_json_path(in2):
    # 输入方式 A
    dims_json_path = str(in2).strip()

    if is_number_like(in3):
        YOLO_IMGSZ = int(float(in3))

    if is_number_like(in4):
        YOLO_CONF = float(in4)

    if is_number_like(in5):
        YOLO_IOU = float(in5)

    if in6 is not None:
        OUTPUT_FOLDER_NAME = str(in6).strip() or "structure_mask_process"

else:
    # 输入方式 B
    if is_number_like(in2):
        YOLO_IMGSZ = int(float(in2))

    if is_number_like(in3):
        YOLO_CONF = float(in3)

    if is_number_like(in4):
        YOLO_IOU = float(in4)

    if is_json_path(in5):
        dims_json_path = str(in5).strip()

    if in6 is not None:
        OUTPUT_FOLDER_NAME = str(in6).strip() or "structure_mask_process"


# 防止误传完整 json 路径作为输出文件夹
OUTPUT_FOLDER_NAME = os.path.basename(OUTPUT_FOLDER_NAME)
OUTPUT_FOLDER_NAME = OUTPUT_FOLDER_NAME.replace(".json", "")
OUTPUT_FOLDER_NAME = OUTPUT_FOLDER_NAME.replace(".txt", "")
OUTPUT_FOLDER_NAME = OUTPUT_FOLDER_NAME.replace(".png", "")
OUTPUT_FOLDER_NAME = OUTPUT_FOLDER_NAME.replace(".jpg", "")
OUTPUT_FOLDER_NAME = OUTPUT_FOLDER_NAME.replace(".jpeg", "")

if not OUTPUT_FOLDER_NAME:
    OUTPUT_FOLDER_NAME = "structure_mask_process"


# ============================================================
# 参数配置
# ============================================================

STRUCTURAL_CLASS_KEYS = ["wall", "door", "window", "tdoor"]

# 门窗类局部膨胀
OPENING_DILATE_KERNEL = 9
OPENING_DILATE_ITER = 1

# 形态学清理
BRIDGE_KERNEL = 5
BRIDGE_ITER = 1

CLOSE_KERNEL = 7
CLOSE_ITER = 1

OPEN_KERNEL = 3
OPEN_ITER = 1

ERODE_BACK_KERNEL = 3
ERODE_BACK_ITER = 1

MIN_COMPONENT_AREA = 80

# 骨架和线段参数
RDP_EPSILON_PX = 4.0
MIN_SEGMENT_LENGTH_PX = 10.0

SNAP_VERTEX_TOL = 8.0
MERGE_COORD_TOL = 8.0
MERGE_GAP_TOL = 24.0
MERGE_ITERATIONS = 2

ENABLE_ENDPOINT_BRIDGE = True
ENDPOINT_BRIDGE_TOL = 20.0

# OCR 尺寸通常偏向轴线尺寸，而分割 mask 更接近外轮廓。
# 这里沿用原逻辑，给总尺寸加一个墙厚经验补偿。
AXIS_DIM_CORRECTION_MM = 200.0

# Revit 墙类型对应厚度
EXTERIOR_WALL_MM = 200.0
INTERIOR_WALL_MM = 138.0
WALL_THICKNESS_THRESHOLD_MM = (EXTERIOR_WALL_MM + INTERIOR_WALL_MM) / 2.0

# 如果没有 OCR 尺寸 JSON，则采用像素宽度假定值
ASSUMED_EXTERIOR_WALL_PX = 20.0
ASSUMED_INTERIOR_WALL_PX = 14.0
WALL_THICKNESS_THRESHOLD_PX = (ASSUMED_EXTERIOR_WALL_PX + ASSUMED_INTERIOR_WALL_PX) / 2.0

# 外边界邻近性阈值
OUTER_BOUNDARY_NEAR_MM = 180.0
OUTER_BOUNDARY_NEAR_PX_FALLBACK = 18.0

# 法向厚度采样最大扫描距离
MAX_THICKNESS_SCAN_PX = 80

# 每条墙段采样点数量
THICKNESS_SAMPLE_COUNT = 9

# 绘制色条厚度
EXTERIOR_DRAW_THICKNESS_PX = 20
INTERIOR_DRAW_THICKNESS_PX = 14

# 颜色，OpenCV BGR
EXTERIOR_COLOR = (0, 0, 255)       # 红色，外墙
INTERIOR_COLOR = (255, 255, 0)     # 青色，内墙
UNKNOWN_COLOR = (0, 255, 255)      # 黄色，未知或兜底

# 背景样式
BACKGROUND_DARK_GRAY = True


# ============================================================
# 基础工具函数
# ============================================================

def ensure_dir(folder):
    if folder and not os.path.exists(folder):
        os.makedirs(folder)


def save_image(path, img):
    ensure_dir(os.path.dirname(path))
    ok = cv2.imwrite(path, img)
    if not ok:
        raise Exception("cv2.imwrite 保存失败: {}".format(path))
    logs.append("已保存图像: {}".format(path))


def normalize_class_name(name):
    if name is None:
        return ""
    return str(name).strip().lower()


def classify_structural_class(class_name):
    """
    将模型类别名映射到结构性候选类别：
    C_s = {Wall, Door, Window, TDoor}
    """
    n = normalize_class_name(class_name)

    if not n:
        return None

    # TDoor 优先，避免被 Door 捕获
    for kw in ["tdoor", "double door", "double-door", "double_door", "双开门", "双扇门", "双门"]:
        if kw in n:
            return "tdoor"

    for kw in ["window", "windows", "窗", "窗户", "飘窗"]:
        if kw in n:
            return "window"

    for kw in ["door", "single door", "single-door", "single_door", "门", "单开门", "单扇门"]:
        if kw in n:
            return "door"

    for kw in ["wall", "basic wall", "bearing wall", "shear wall", "墙", "墙体", "基本墙", "承重墙", "剪力墙"]:
        if kw in n:
            return "wall"

    return None


def get_model(model_input):
    if model_input is None:
        raise Exception("IN[0] 为空，请传入 YOLO 模型对象或模型路径。")

    if not isinstance(model_input, str):
        if hasattr(model_input, "predict") or hasattr(model_input, "__call__"):
            logs.append("检测到 IN[0] 是已加载模型对象，直接使用。")
            return model_input

    model_path = str(model_input).strip()

    if not model_path:
        raise Exception("模型路径为空。")

    if not os.path.exists(model_path):
        raise Exception("YOLO 模型路径不存在: {}".format(model_path))

    if YOLO is None:
        raise Exception("无法导入 ultralytics.YOLO，请检查 Python 环境。")

    logs.append("开始加载 YOLO 模型: {}".format(model_path))
    model = YOLO(model_path)
    logs.append("YOLO 模型加载完成。")
    return model


def safe_get_class_name(names, cls_id):
    try:
        if isinstance(names, dict):
            return names.get(int(cls_id), str(cls_id))
        return names[int(cls_id)]
    except:
        return str(cls_id)


def ensure_binary_mask(mask):
    arr = np.asarray(mask)

    if len(arr.shape) == 2:
        gray = arr
    elif len(arr.shape) == 3:
        c = arr.shape[2]
        if c == 1:
            gray = arr[:, :, 0]
        elif c == 3:
            gray = cv2.cvtColor(arr, cv2.COLOR_BGR2GRAY)
        elif c == 4:
            gray = cv2.cvtColor(arr, cv2.COLOR_BGRA2GRAY)
        else:
            raise Exception("不支持的通道数: {}".format(arr.shape))
    else:
        raise Exception("不支持的图像维度: {}".format(arr.shape))

    out = gray.astype(np.uint8)
    out[out > 0] = 255
    return out


# ============================================================
# OCR 尺寸 JSON 读取
# ============================================================

def extract_number_from_value(v):
    """
    从值中提取数字。
    支持：
    12000
    "12000"
    "12000mm"
    "12.5m"
    """
    if v is None:
        return None

    if isinstance(v, (int, float)):
        return float(v)

    s = str(v)

    m = re.search(r"[-+]?\d*\.?\d+", s)

    if not m:
        return None

    num = float(m.group(0))

    # 如果字符串中包含 m 且不包含 mm，认为是米，转 mm
    low = s.lower()
    if "mm" not in low and "m" in low:
        num = num * 1000.0

    return num


def recursive_find_dimension_values(obj, results):
    """
    尝试从任意 JSON 结构中寻找横向、纵向尺寸。
    """
    if isinstance(obj, dict):
        for k, v in obj.items():
            lk = str(k).lower()

            val = extract_number_from_value(v)

            if val is not None:
                if any(key in lk for key in [
                    "horizontal_length", "horizontallength", "length_x",
                    "x_length", "lx", "width_real", "real_width",
                    "horizontal", "横向", "总宽", "宽度"
                ]):
                    results["x_candidates"].append(val)

                if any(key in lk for key in [
                    "vertical_length", "verticallength", "length_y",
                    "y_length", "ly", "height_real", "real_height",
                    "vertical", "纵向", "总高", "高度"
                ]):
                    results["y_candidates"].append(val)

            recursive_find_dimension_values(v, results)

    elif isinstance(obj, list):
        for item in obj:
            recursive_find_dimension_values(item, results)


def read_ocr_dimensions_mm(json_path):
    """
    返回：
        Lx_mm, Ly_mm
    如果读取失败，返回 None, None
    """
    if not json_path:
        logs.append("未提供 OCR 尺寸 JSON，将使用像素宽度假定阈值。")
        return None, None

    if not os.path.exists(json_path):
        logs.append("OCR 尺寸 JSON 不存在: {}，将使用像素宽度假定阈值。".format(json_path))
        return None, None

    try:
        with open(json_path, "r") as f:
            data = json.load(f)

        results = {
            "x_candidates": [],
            "y_candidates": []
        }

        recursive_find_dimension_values(data, results)

        x_candidates = [v for v in results["x_candidates"] if v and v > 0]
        y_candidates = [v for v in results["y_candidates"] if v and v > 0]

        Lx = None
        Ly = None

        if x_candidates:
            # 通常取最大横向尺寸
            Lx = max(x_candidates)

        if y_candidates:
            # 通常取最大纵向尺寸
            Ly = max(y_candidates)

        logs.append("OCR 尺寸候选 x: {}".format(str(x_candidates)))
        logs.append("OCR 尺寸候选 y: {}".format(str(y_candidates)))

        if Lx is not None and Ly is not None:
            logs.append("读取 OCR 尺寸成功: Lx={} mm, Ly={} mm".format(Lx, Ly))
        else:
            logs.append("OCR 尺寸读取不完整，将使用像素宽度假定阈值。")

        return Lx, Ly

    except Exception as e:
        logs.append("读取 OCR 尺寸 JSON 失败: {}".format(str(e)))
        return None, None


# ============================================================
# 结构掩膜构建
# ============================================================

def empty_class_masks(h, w):
    return {
        "wall": np.zeros((h, w), dtype=np.uint8),
        "door": np.zeros((h, w), dtype=np.uint8),
        "window": np.zeros((h, w), dtype=np.uint8),
        "tdoor": np.zeros((h, w), dtype=np.uint8)
    }


def fill_polygon_to_mask(mask, contour_pts, width, height):
    pts = np.array(contour_pts, dtype=np.int32)

    if pts is None or len(pts) < 3:
        return False

    pts[:, 0] = np.clip(pts[:, 0], 0, width - 1)
    pts[:, 1] = np.clip(pts[:, 1], 0, height - 1)

    cv2.fillPoly(mask, [pts], 255)

    return True


def build_raw_structural_masks(result, width, height):
    class_masks = empty_class_masks(height, width)

    if result is None:
        logs.append("YOLO result is None。")
        return class_masks

    if result.masks is None:
        logs.append("YOLO result.masks is None，没有实例分割 mask。")
        return class_masks

    masks_xy = result.masks.xy

    if result.boxes is not None and result.boxes.cls is not None:
        cls_ids = result.boxes.cls.cpu().numpy().astype(int)
    else:
        cls_ids = np.zeros(len(masks_xy), dtype=np.int32)

    names = result.names

    logs.append("YOLO 类别映射: {}".format(str(names)))
    logs.append("YOLO 实例 mask 数量: {}".format(len(masks_xy)))

    count_dict = {
        "wall": 0,
        "door": 0,
        "window": 0,
        "tdoor": 0,
        "ignored": 0
    }

    for i, contour_pts in enumerate(masks_xy):
        try:
            if i >= len(cls_ids):
                count_dict["ignored"] += 1
                continue

            cls_id = int(cls_ids[i])
            class_name = safe_get_class_name(names, cls_id)
            structural_key = classify_structural_class(class_name)

            if structural_key is None:
                count_dict["ignored"] += 1
                continue

            ok = fill_polygon_to_mask(
                class_masks[structural_key],
                contour_pts,
                width,
                height
            )

            if ok:
                count_dict[structural_key] += 1
            else:
                count_dict["ignored"] += 1

        except Exception as e:
            count_dict["ignored"] += 1
            logs.append("处理实例失败 idx={}: {}".format(i, str(e)))

    logs.append("结构性类别统计: {}".format(str(count_dict)))
    return class_masks


def dilate_opening_masks(raw_class_masks):
    out = {}

    for key in STRUCTURAL_CLASS_KEYS:
        out[key] = raw_class_masks[key].copy()

    kernel = cv2.getStructuringElement(
        cv2.MORPH_RECT,
        (OPENING_DILATE_KERNEL, OPENING_DILATE_KERNEL)
    )

    for key in ["door", "window", "tdoor"]:
        out[key] = cv2.dilate(
            raw_class_masks[key],
            kernel,
            iterations=OPENING_DILATE_ITER
        )

    logs.append("门窗局部膨胀 kernel={} iterations={}".format(
        OPENING_DILATE_KERNEL,
        OPENING_DILATE_ITER
    ))

    return out


def union_masks(class_masks):
    h, w = class_masks["wall"].shape[:2]
    merged = np.zeros((h, w), dtype=np.uint8)

    for key in STRUCTURAL_CLASS_KEYS:
        merged[class_masks[key] > 0] = 255

    return merged


def filter_small_components(mask, min_area):
    mask = ensure_binary_mask(mask)

    num_labels, labels, stats, _ = cv2.connectedComponentsWithStats(
        mask,
        connectivity=8
    )

    cleaned = np.zeros_like(mask, dtype=np.uint8)

    kept = 0
    removed = 0

    for label_id in range(1, num_labels):
        area = stats[label_id, cv2.CC_STAT_AREA]

        if area >= min_area:
            cleaned[labels == label_id] = 255
            kept += 1
        else:
            removed += 1

    logs.append("连通域过滤: kept={}, removed={}, min_area={}".format(
        kept,
        removed,
        min_area
    ))

    return cleaned


def clean_structure_mask_with_gap_suppression(structure_mask):
    mask = ensure_binary_mask(structure_mask)

    bridge_kernel = cv2.getStructuringElement(
        cv2.MORPH_RECT,
        (BRIDGE_KERNEL, BRIDGE_KERNEL)
    )

    mask = cv2.dilate(
        mask,
        bridge_kernel,
        iterations=BRIDGE_ITER
    )

    close_kernel = cv2.getStructuringElement(
        cv2.MORPH_RECT,
        (CLOSE_KERNEL, CLOSE_KERNEL)
    )

    mask = cv2.morphologyEx(
        mask,
        cv2.MORPH_CLOSE,
        close_kernel,
        iterations=CLOSE_ITER
    )

    open_kernel = cv2.getStructuringElement(
        cv2.MORPH_RECT,
        (OPEN_KERNEL, OPEN_KERNEL)
    )

    mask = cv2.morphologyEx(
        mask,
        cv2.MORPH_OPEN,
        open_kernel,
        iterations=OPEN_ITER
    )

    mask = filter_small_components(mask, MIN_COMPONENT_AREA)

    if ERODE_BACK_KERNEL > 1 and ERODE_BACK_ITER > 0:
        erode_kernel = cv2.getStructuringElement(
            cv2.MORPH_RECT,
            (ERODE_BACK_KERNEL, ERODE_BACK_KERNEL)
        )

        mask = cv2.erode(
            mask,
            erode_kernel,
            iterations=ERODE_BACK_ITER
        )

    mask[mask > 0] = 255

    logs.append("结构掩膜清理完成。")

    return mask


# ============================================================
# 有效墙体区域外接框与尺度映射
# ============================================================

def get_mask_bbox(binary_mask):
    mask = ensure_binary_mask(binary_mask)

    ys, xs = np.where(mask > 0)

    if len(xs) == 0 or len(ys) == 0:
        return None

    min_x = int(np.min(xs))
    max_x = int(np.max(xs))
    min_y = int(np.min(ys))
    max_y = int(np.max(ys))

    bbox = {
        "min_x": min_x,
        "max_x": max_x,
        "min_y": min_y,
        "max_y": max_y,
        "width": int(max_x - min_x + 1),
        "height": int(max_y - min_y + 1)
    }

    logs.append("有效结构掩膜 bbox: {}".format(str(bbox)))

    return bbox


def compute_scale_from_bbox_and_ocr(mask_bbox, Lx_mm, Ly_mm):
    """
    根据有效结构掩膜外接框计算 mm/px。
    若 OCR 尺寸不可用，返回 None。
    """
    if mask_bbox is None:
        return None, None, None

    if Lx_mm is None or Ly_mm is None:
        logs.append("OCR 尺寸不可用，无法计算真实 mm/px。")
        return None, None, None

    Wp = float(mask_bbox["width"])
    Hp = float(mask_bbox["height"])

    if Wp <= 0 or Hp <= 0:
        return None, None, None

    # 轴线尺寸到外轮廓尺寸的经验补偿
    Lx_corr = float(Lx_mm) + AXIS_DIM_CORRECTION_MM
    Ly_corr = float(Ly_mm) + AXIS_DIM_CORRECTION_MM

    sx = Lx_corr / Wp
    sy = Ly_corr / Hp
    s_avg = 0.5 * (sx + sy)

    logs.append("尺度映射: Lx_corr={}mm, Ly_corr={}mm, Wp={}px, Hp={}px".format(
        Lx_corr,
        Ly_corr,
        Wp,
        Hp
    ))
    logs.append("尺度因子: sx={} mm/px, sy={} mm/px, avg={} mm/px".format(
        sx,
        sy,
        s_avg
    ))

    return sx, sy, s_avg


# ============================================================
# 骨架化
# ============================================================

def skeletonize_with_skimage(mask):
    try:
        from skimage.morphology import skeletonize

        binary = mask > 0
        skel = skeletonize(binary)
        skel_u8 = skel.astype(np.uint8) * 255

        logs.append("骨架化方式: skimage.morphology.skeletonize")

        return skel_u8

    except Exception as e:
        logs.append("skimage 骨架化不可用，使用 OpenCV 备用算法。原因: {}".format(str(e)))
        return None


def skeletonize_with_opencv(mask):
    img = ensure_binary_mask(mask)
    img[img > 0] = 255

    skel = np.zeros(img.shape, np.uint8)
    element = cv2.getStructuringElement(cv2.MORPH_CROSS, (3, 3))

    iteration = 0

    while True:
        opened = cv2.morphologyEx(img, cv2.MORPH_OPEN, element)
        temp = cv2.subtract(img, opened)
        eroded = cv2.erode(img, element)
        skel = cv2.bitwise_or(skel, temp)
        img = eroded.copy()

        iteration += 1

        if cv2.countNonZero(img) == 0:
            break

        if iteration > 10000:
            logs.append("OpenCV 骨架化迭代过多，提前终止。")
            break

    logs.append("骨架化方式: OpenCV morphology skeleton, iterations={}".format(iteration))

    return skel


def skeletonize_mask(mask):
    mask = ensure_binary_mask(mask)

    skel = skeletonize_with_skimage(mask)

    if skel is None:
        skel = skeletonize_with_opencv(mask)

    skel = ensure_binary_mask(skel)

    logs.append("骨架像素数量: {}".format(int(np.count_nonzero(skel))))

    return skel


# ============================================================
# 骨架图矢量化
# ============================================================

NEIGHBORS_8 = [
    (-1, -1), (0, -1), (1, -1),
    (-1,  0),          (1,  0),
    (-1,  1), (0,  1), (1,  1)
]


def get_skeleton_points_set(skeleton_mask):
    ys, xs = np.where(skeleton_mask > 0)
    return set(zip(xs.tolist(), ys.tolist()))


def get_neighbors(pt, point_set):
    x, y = pt
    out = []

    for dx, dy in NEIGHBORS_8:
        q = (x + dx, y + dy)
        if q in point_set:
            out.append(q)

    return out


def edge_key(a, b):
    return tuple(sorted([a, b]))


def trace_path_from_keynode(start, nxt, point_set, key_nodes, visited_edges):
    path = [start, nxt]
    visited_edges.add(edge_key(start, nxt))

    prev = start
    cur = nxt

    while True:
        if cur in key_nodes and cur != start:
            break

        nbs = get_neighbors(cur, point_set)

        candidates = []

        for nb in nbs:
            if nb == prev:
                continue

            ek = edge_key(cur, nb)

            if ek in visited_edges:
                continue

            candidates.append(nb)

        if not candidates:
            break

        next_pt = candidates[0]
        visited_edges.add(edge_key(cur, next_pt))
        path.append(next_pt)

        prev = cur
        cur = next_pt

    return path


def trace_loop_from_edge(a, b, point_set, visited_edges):
    path = [a, b]
    visited_edges.add(edge_key(a, b))

    prev = a
    cur = b

    while True:
        nbs = get_neighbors(cur, point_set)

        candidates = []

        for nb in nbs:
            if nb == prev:
                continue

            ek = edge_key(cur, nb)

            if ek in visited_edges:
                continue

            candidates.append(nb)

        if not candidates:
            break

        next_pt = candidates[0]
        visited_edges.add(edge_key(cur, next_pt))
        path.append(next_pt)

        if next_pt == a:
            break

        prev = cur
        cur = next_pt

        if len(path) > len(point_set) + 5:
            break

    return path


def vectorize_skeleton(skeleton_mask):
    skel = ensure_binary_mask(skeleton_mask)
    point_set = get_skeleton_points_set(skel)

    if not point_set:
        return []

    key_nodes = set()

    for pt in point_set:
        degree = len(get_neighbors(pt, point_set))

        if degree != 2:
            key_nodes.add(pt)

    logs.append("骨架图节点总数: {}".format(len(point_set)))
    logs.append("拓扑关键节点数量: {}".format(len(key_nodes)))

    visited_edges = set()
    paths = []

    for kn in key_nodes:
        nbs = get_neighbors(kn, point_set)

        for nb in nbs:
            ek = edge_key(kn, nb)

            if ek in visited_edges:
                continue

            path = trace_path_from_keynode(
                kn,
                nb,
                point_set,
                key_nodes,
                visited_edges
            )

            if len(path) >= 2:
                paths.append(path)

    for pt in list(point_set):
        nbs = get_neighbors(pt, point_set)

        for nb in nbs:
            ek = edge_key(pt, nb)

            if ek in visited_edges:
                continue

            path = trace_loop_from_edge(
                pt,
                nb,
                point_set,
                visited_edges
            )

            if len(path) >= 2:
                paths.append(path)

    logs.append("骨架追踪得到路径数量: {}".format(len(paths)))

    return paths


# ============================================================
# RDP 简化与正交化
# ============================================================

def point_line_distance(pt, a, b):
    px, py = pt
    ax, ay = a
    bx, by = b

    dx = bx - ax
    dy = by - ay

    if dx == 0 and dy == 0:
        return math.hypot(px - ax, py - ay)

    t = ((px - ax) * dx + (py - ay) * dy) / float(dx * dx + dy * dy)
    t = max(0.0, min(1.0, t))

    qx = ax + t * dx
    qy = ay + t * dy

    return math.hypot(px - qx, py - qy)


def rdp(points, epsilon):
    if points is None or len(points) < 3:
        return points

    start = points[0]
    end = points[-1]

    max_dist = -1.0
    index = -1

    for i in range(1, len(points) - 1):
        d = point_line_distance(points[i], start, end)

        if d > max_dist:
            max_dist = d
            index = i

    if max_dist > epsilon:
        left = rdp(points[:index + 1], epsilon)
        right = rdp(points[index:], epsilon)

        return left[:-1] + right
    else:
        return [start, end]


def segment_length(seg):
    (x1, y1), (x2, y2) = seg
    return math.hypot(x2 - x1, y2 - y1)


def classify_segment(seg):
    (x1, y1), (x2, y2) = seg

    if abs(x2 - x1) >= abs(y2 - y1):
        return "h"
    else:
        return "v"


def orthogonalize_segment(p1, p2):
    x1, y1 = p1
    x2, y2 = p2

    dx = x2 - x1
    dy = y2 - y1

    if abs(dx) >= abs(dy):
        y = int(round((y1 + y2) * 0.5))
        return ((int(round(x1)), y), (int(round(x2)), y))
    else:
        x = int(round((x1 + x2) * 0.5))
        return ((x, int(round(y1))), (x, int(round(y2))))


def paths_to_orthogonal_segments(paths):
    segments = []

    for path in paths:
        if len(path) < 2:
            continue

        simplified = rdp(path, RDP_EPSILON_PX)

        if simplified is None or len(simplified) < 2:
            continue

        for i in range(len(simplified) - 1):
            seg = orthogonalize_segment(
                simplified[i],
                simplified[i + 1]
            )

            if segment_length(seg) >= MIN_SEGMENT_LENGTH_PX:
                segments.append(seg)

    logs.append("RDP + 正交化后初始线段数量: {}".format(len(segments)))

    return segments


# ============================================================
# 中心线后处理
# ============================================================

def normalize_segment_direction(seg):
    (x1, y1), (x2, y2) = seg

    if classify_segment(seg) == "h":
        if x1 <= x2:
            return ((x1, y1), (x2, y2))
        else:
            return ((x2, y2), (x1, y1))
    else:
        if y1 <= y2:
            return ((x1, y1), (x2, y2))
        else:
            return ((x2, y2), (x1, y1))


def snap_segment_vertices(segments, tol):
    if not segments:
        return []

    points = []

    for seg in segments:
        points.append(seg[0])
        points.append(seg[1])

    used = [False] * len(points)
    snapped_map = {}

    for i, p in enumerate(points):
        if used[i]:
            continue

        cluster = [i]
        used[i] = True

        cx = float(p[0])
        cy = float(p[1])

        changed = True

        while changed:
            changed = False

            for j, q in enumerate(points):
                if used[j]:
                    continue

                d = math.hypot(q[0] - cx, q[1] - cy)

                if d <= tol:
                    used[j] = True
                    cluster.append(j)

                    xs = [points[idx][0] for idx in cluster]
                    ys = [points[idx][1] for idx in cluster]

                    cx = sum(xs) / float(len(xs))
                    cy = sum(ys) / float(len(ys))

                    changed = True

        snapped_pt = (int(round(cx)), int(round(cy)))

        for idx in cluster:
            snapped_map[points[idx]] = snapped_pt

    out = []

    for seg in segments:
        a = snapped_map.get(seg[0], seg[0])
        b = snapped_map.get(seg[1], seg[1])

        if a != b and segment_length((a, b)) >= MIN_SEGMENT_LENGTH_PX:
            out.append((a, b))

    return out


def merge_horizontal_segments(h_segments):
    if not h_segments:
        return []

    items = []

    for seg in h_segments:
        seg = normalize_segment_direction(seg)
        (x1, y1), (x2, y2) = seg

        y = 0.5 * (y1 + y2)
        xa = min(x1, x2)
        xb = max(x1, x2)

        items.append([y, xa, xb])

    items.sort(key=lambda x: (x[0], x[1]))

    used = [False] * len(items)
    merged = []

    for i in range(len(items)):
        if used[i]:
            continue

        y, xa, xb = items[i]
        used[i] = True

        changed = True

        while changed:
            changed = False

            for j in range(len(items)):
                if used[j]:
                    continue

                y2, xa2, xb2 = items[j]

                if abs(y2 - y) > MERGE_COORD_TOL:
                    continue

                gap = max(xa2 - xb, xa - xb2, 0)

                if gap <= MERGE_GAP_TOL:
                    len1 = max(1.0, xb - xa)
                    len2 = max(1.0, xb2 - xa2)

                    y = (y * len1 + y2 * len2) / (len1 + len2)
                    xa = min(xa, xa2)
                    xb = max(xb, xb2)

                    used[j] = True
                    changed = True

        yy = int(round(y))
        merged.append(((int(round(xa)), yy), (int(round(xb)), yy)))

    return merged


def merge_vertical_segments(v_segments):
    if not v_segments:
        return []

    items = []

    for seg in v_segments:
        seg = normalize_segment_direction(seg)
        (x1, y1), (x2, y2) = seg

        x = 0.5 * (x1 + x2)
        ya = min(y1, y2)
        yb = max(y1, y2)

        items.append([x, ya, yb])

    items.sort(key=lambda x: (x[0], x[1]))

    used = [False] * len(items)
    merged = []

    for i in range(len(items)):
        if used[i]:
            continue

        x, ya, yb = items[i]
        used[i] = True

        changed = True

        while changed:
            changed = False

            for j in range(len(items)):
                if used[j]:
                    continue

                x2, ya2, yb2 = items[j]

                if abs(x2 - x) > MERGE_COORD_TOL:
                    continue

                gap = max(ya2 - yb, ya - yb2, 0)

                if gap <= MERGE_GAP_TOL:
                    len1 = max(1.0, yb - ya)
                    len2 = max(1.0, yb2 - ya2)

                    x = (x * len1 + x2 * len2) / (len1 + len2)
                    ya = min(ya, ya2)
                    yb = max(yb, yb2)

                    used[j] = True
                    changed = True

        xx = int(round(x))
        merged.append(((xx, int(round(ya))), (xx, int(round(yb)))))

    return merged


def merge_collinear_segments(segments):
    h_segments = []
    v_segments = []

    for seg in segments:
        if classify_segment(seg) == "h":
            h_segments.append(seg)
        else:
            v_segments.append(seg)

    merged = merge_horizontal_segments(h_segments) + merge_vertical_segments(v_segments)

    filtered = []

    for seg in merged:
        if segment_length(seg) >= MIN_SEGMENT_LENGTH_PX:
            filtered.append(seg)

    return filtered


def bridge_near_orthogonal_endpoints(segments):
    if not ENABLE_ENDPOINT_BRIDGE:
        return segments

    if not segments:
        return []

    segs = [normalize_segment_direction(s) for s in segments]

    h_indices = []
    v_indices = []

    for idx, seg in enumerate(segs):
        if classify_segment(seg) == "h":
            h_indices.append(idx)
        else:
            v_indices.append(idx)

    mutable = []

    for seg in segs:
        mutable.append([list(seg[0]), list(seg[1])])

    changed_count = 0

    for hi in h_indices:
        hp1, hp2 = mutable[hi]
        hy = hp1[1]
        hx_min = min(hp1[0], hp2[0])
        hx_max = max(hp1[0], hp2[0])

        for vi in v_indices:
            vp1, vp2 = mutable[vi]
            vx = vp1[0]
            vy_min = min(vp1[1], vp2[1])
            vy_max = max(vp1[1], vp2[1])

            inter = (vx, hy)

            h_near = hx_min - ENDPOINT_BRIDGE_TOL <= vx <= hx_max + ENDPOINT_BRIDGE_TOL
            v_near = vy_min - ENDPOINT_BRIDGE_TOL <= hy <= vy_max + ENDPOINT_BRIDGE_TOL

            if not (h_near and v_near):
                continue

            hd1 = math.hypot(hp1[0] - inter[0], hp1[1] - inter[1])
            hd2 = math.hypot(hp2[0] - inter[0], hp2[1] - inter[1])
            vd1 = math.hypot(vp1[0] - inter[0], vp1[1] - inter[1])
            vd2 = math.hypot(vp2[0] - inter[0], vp2[1] - inter[1])

            if hd1 <= ENDPOINT_BRIDGE_TOL:
                hp1[0], hp1[1] = inter[0], inter[1]
                changed_count += 1
            elif hd2 <= ENDPOINT_BRIDGE_TOL:
                hp2[0], hp2[1] = inter[0], inter[1]
                changed_count += 1

            if vd1 <= ENDPOINT_BRIDGE_TOL:
                vp1[0], vp1[1] = inter[0], inter[1]
                changed_count += 1
            elif vd2 <= ENDPOINT_BRIDGE_TOL:
                vp2[0], vp2[1] = inter[0], inter[1]
                changed_count += 1

            mutable[hi] = [hp1, hp2]
            mutable[vi] = [vp1, vp2]

    out = []

    for a, b in mutable:
        seg = ((int(round(a[0])), int(round(a[1]))),
               (int(round(b[0])), int(round(b[1]))))

        seg = orthogonalize_segment(seg[0], seg[1])

        if segment_length(seg) >= MIN_SEGMENT_LENGTH_PX:
            out.append(seg)

    logs.append("端点延伸与桥接 changed_endpoints={}".format(changed_count))

    return out


def optimize_centerlines(segments):
    if not segments:
        return []

    out = segments[:]

    out = snap_segment_vertices(out, SNAP_VERTEX_TOL)

    for _ in range(MERGE_ITERATIONS):
        out = merge_collinear_segments(out)
        out = snap_segment_vertices(out, SNAP_VERTEX_TOL)

    out = bridge_near_orthogonal_endpoints(out)
    out = snap_segment_vertices(out, SNAP_VERTEX_TOL)
    out = merge_collinear_segments(out)

    final = []

    for seg in out:
        if segment_length(seg) >= MIN_SEGMENT_LENGTH_PX:
            final.append(seg)

    logs.append("中心线后处理完成: initial={}, final={}".format(
        len(segments),
        len(final)
    ))

    return final


# ============================================================
# 墙厚采样与内外墙判别
# ============================================================

def clip_xy(x, y, w, h):
    x = int(round(x))
    y = int(round(y))
    x = max(0, min(w - 1, x))
    y = max(0, min(h - 1, y))
    return x, y


def sample_points_on_segment(seg, sample_count):
    (x1, y1), (x2, y2) = seg

    pts = []

    if sample_count <= 1:
        pts.append(((x1 + x2) * 0.5, (y1 + y2) * 0.5))
        return pts

    # 避开端点，减少交汇区影响
    for i in range(sample_count):
        t = (i + 1) / float(sample_count + 1)
        x = x1 + (x2 - x1) * t
        y = y1 + (y2 - y1) * t
        pts.append((x, y))

    return pts


def measure_mask_width_at_point(mask, x, y, orientation):
    """
    对水平墙段，沿竖直方向测量掩膜连续宽度。
    对竖直墙段，沿水平方向测量掩膜连续宽度。
    """
    mask = ensure_binary_mask(mask)
    h, w = mask.shape[:2]

    x, y = clip_xy(x, y, w, h)

    if mask[y, x] == 0:
        # 若中心点不在前景，尝试局部找最近前景点
        found = False
        for r in range(1, 6):
            for yy in range(max(0, y - r), min(h, y + r + 1)):
                for xx in range(max(0, x - r), min(w, x + r + 1)):
                    if mask[yy, xx] > 0:
                        x, y = xx, yy
                        found = True
                        break
                if found:
                    break
            if found:
                break

        if not found:
            return None

    count_pos = 0
    count_neg = 0

    if orientation == "h":
        # 沿 y 方向上下扫描
        for step in range(1, MAX_THICKNESS_SCAN_PX + 1):
            yy = y + step
            if yy >= h:
                break
            if mask[yy, x] > 0:
                count_pos += 1
            else:
                break

        for step in range(1, MAX_THICKNESS_SCAN_PX + 1):
            yy = y - step
            if yy < 0:
                break
            if mask[yy, x] > 0:
                count_neg += 1
            else:
                break

    else:
        # 沿 x 方向左右扫描
        for step in range(1, MAX_THICKNESS_SCAN_PX + 1):
            xx = x + step
            if xx >= w:
                break
            if mask[y, xx] > 0:
                count_pos += 1
            else:
                break

        for step in range(1, MAX_THICKNESS_SCAN_PX + 1):
            xx = x - step
            if xx < 0:
                break
            if mask[y, xx] > 0:
                count_neg += 1
            else:
                break

    width_px = count_neg + 1 + count_pos

    return float(width_px)


def estimate_segment_thickness_px(mask, seg):
    orientation = classify_segment(seg)
    pts = sample_points_on_segment(seg, THICKNESS_SAMPLE_COUNT)

    vals = []

    for x, y in pts:
        v = measure_mask_width_at_point(
            mask,
            x,
            y,
            orientation
        )

        if v is not None and v > 0:
            vals.append(v)

    if not vals:
        return None

    vals = sorted(vals)

    med = float(np.median(np.array(vals, dtype=np.float32)))

    return med


def distance_to_bbox_boundary_px(pt, bbox):
    x, y = pt

    d_left = abs(x - bbox["min_x"])
    d_right = abs(bbox["max_x"] - x)
    d_top = abs(y - bbox["min_y"])
    d_bottom = abs(bbox["max_y"] - y)

    return min(d_left, d_right, d_top, d_bottom)


def is_near_outer_boundary(seg, bbox, outer_near_px):
    pts = sample_points_on_segment(seg, 5)

    distances = []

    for p in pts:
        distances.append(distance_to_bbox_boundary_px(p, bbox))

    if not distances:
        return False

    min_d = min(distances)

    return min_d <= outer_near_px


def classify_wall_kind_for_segment(mask, seg, bbox, sx_mm_per_px, sy_mm_per_px, avg_mm_per_px):
    """
    输出：
        {
            "kind": "exterior" / "interior",
            "thickness_px": xxx,
            "thickness_mm": xxx or None,
            "near_outer": True / False
        }
    """
    orientation = classify_segment(seg)

    thickness_px = estimate_segment_thickness_px(mask, seg)

    if thickness_px is None:
        thickness_px = 0.0

    thickness_mm = None

    if sx_mm_per_px is not None and sy_mm_per_px is not None:
        if orientation == "h":
            thickness_mm = thickness_px * sy_mm_per_px
        else:
            thickness_mm = thickness_px * sx_mm_per_px

    if avg_mm_per_px is not None and avg_mm_per_px > 0:
        outer_near_px = OUTER_BOUNDARY_NEAR_MM / avg_mm_per_px
    else:
        outer_near_px = OUTER_BOUNDARY_NEAR_PX_FALLBACK

    near_outer = False

    if bbox is not None:
        near_outer = is_near_outer_boundary(
            seg,
            bbox,
            outer_near_px
        )

    if thickness_mm is not None:
        is_exterior_by_thickness = thickness_mm >= WALL_THICKNESS_THRESHOLD_MM
    else:
        is_exterior_by_thickness = thickness_px >= WALL_THICKNESS_THRESHOLD_PX

    # 最终判别：厚度判别 OR 外边界邻近性
    if is_exterior_by_thickness or near_outer:
        kind = "exterior"
    else:
        kind = "interior"

    return {
        "kind": kind,
        "orientation": orientation,
        "thickness_px": thickness_px,
        "thickness_mm": thickness_mm,
        "near_outer": near_outer,
        "outer_near_px": outer_near_px
    }


# ============================================================
# 绘图
# ============================================================

def create_wall_thickness_canvas(clean_mask):
    mask = ensure_binary_mask(clean_mask)
    h, w = mask.shape[:2]

    if BACKGROUND_DARK_GRAY:
        canvas = np.zeros((h, w, 3), dtype=np.uint8)
        canvas[mask > 0] = (45, 45, 45)
    else:
        canvas = cv2.cvtColor(mask, cv2.COLOR_GRAY2BGR)

    return canvas


def clip_point(pt, w, h):
    x, y = pt
    x = int(round(x))
    y = int(round(y))

    x = max(0, min(w - 1, x))
    y = max(0, min(h - 1, y))

    return (x, y)


def draw_wall_thickness_semantic_bars(clean_mask, optimized_segments, bbox, sx, sy, s_avg):
    canvas = create_wall_thickness_canvas(clean_mask)
    h, w = clean_mask.shape[:2]

    wall_infos = []

    exterior_count = 0
    interior_count = 0

    # 先画内墙，再画外墙，外墙视觉上更突出
    draw_items = []

    for idx, seg in enumerate(optimized_segments):
        info = classify_wall_kind_for_segment(
            clean_mask,
            seg,
            bbox,
            sx,
            sy,
            s_avg
        )

        info["index"] = idx
        info["segment"] = seg

        wall_infos.append(info)

        if info["kind"] == "exterior":
            exterior_count += 1
        else:
            interior_count += 1

        draw_items.append((seg, info))

    # 内墙先画
    for seg, info in draw_items:
        if info["kind"] != "interior":
            continue

        p1 = clip_point(seg[0], w, h)
        p2 = clip_point(seg[1], w, h)

        cv2.line(
            canvas,
            p1,
            p2,
            INTERIOR_COLOR,
            thickness=INTERIOR_DRAW_THICKNESS_PX,
            lineType=cv2.LINE_AA
        )

    # 外墙后画
    for seg, info in draw_items:
        if info["kind"] != "exterior":
            continue

        p1 = clip_point(seg[0], w, h)
        p2 = clip_point(seg[1], w, h)

        cv2.line(
            canvas,
            p1,
            p2,
            EXTERIOR_COLOR,
            thickness=EXTERIOR_DRAW_THICKNESS_PX,
            lineType=cv2.LINE_AA
        )

    logs.append("墙体类型判别统计: exterior={}, interior={}".format(
        exterior_count,
        interior_count
    ))

    return canvas, wall_infos


def make_wall_thickness_legend():
    width = 760
    height = 150

    img = np.zeros((height, width, 3), dtype=np.uint8)

    cv2.line(
        img,
        (40, 45),
        (220, 45),
        EXTERIOR_COLOR,
        thickness=EXTERIOR_DRAW_THICKNESS_PX,
        lineType=cv2.LINE_AA
    )

    cv2.putText(
        img,
        "Exterior Wall  200mm",
        (250, 55),
        cv2.FONT_HERSHEY_SIMPLEX,
        0.8,
        (255, 255, 255),
        2,
        cv2.LINE_AA
    )

    cv2.line(
        img,
        (40, 105),
        (220, 105),
        INTERIOR_COLOR,
        thickness=INTERIOR_DRAW_THICKNESS_PX,
        lineType=cv2.LINE_AA
    )

    cv2.putText(
        img,
        "Interior Wall  138mm",
        (250, 115),
        cv2.FONT_HERSHEY_SIMPLEX,
        0.8,
        (255, 255, 255),
        2,
        cv2.LINE_AA
    )

    return img


# ============================================================
# 主流程
# ============================================================

try:
    # --------------------------------------------------------
    # 0. 输入图像与输出目录
    # --------------------------------------------------------

    if not pixpath or not os.path.exists(pixpath):
        raise Exception("输入图像路径无效或不存在: {}".format(pixpath))

    img = cv2.imread(pixpath, cv2.IMREAD_COLOR)

    if img is None:
        raise Exception("cv2.imread 读取图像失败: {}".format(pixpath))

    img_h, img_w = img.shape[:2]

    logs.append("输入图像: {}".format(pixpath))
    logs.append("图像尺寸: width={}, height={}".format(img_w, img_h))

    image_dir = os.path.dirname(os.path.abspath(pixpath))
    output_dir = os.path.join(image_dir, OUTPUT_FOLDER_NAME)

    ensure_dir(output_dir)

    logs.append("输入图片所在目录: {}".format(image_dir))
    logs.append("最终输出文件夹: {}".format(output_dir))

    logs.append("dims_json_path: {}".format(dims_json_path))
    logs.append("YOLO_IMGSZ={}, YOLO_CONF={}, YOLO_IOU={}".format(
        YOLO_IMGSZ,
        YOLO_CONF,
        YOLO_IOU
    ))

    # --------------------------------------------------------
    # 1. OCR 尺寸读取
    # --------------------------------------------------------

    Lx_mm, Ly_mm = read_ocr_dimensions_mm(dims_json_path)

    # --------------------------------------------------------
    # 2. YOLO 推理
    # --------------------------------------------------------

    model = get_model(dect_Model)

    logs.append("开始 YOLO 实例分割推理...")

    results = model(
        pixpath,
        imgsz=YOLO_IMGSZ,
        conf=YOLO_CONF,
        iou=YOLO_IOU,
        verbose=False
    )

    if results is None or len(results) == 0:
        raise Exception("YOLO 推理没有返回结果。")

    result = results[0]

    logs.append("YOLO 推理完成。")

    # --------------------------------------------------------
    # 3. 结构性类别融合 + 门窗膨胀 + 掩膜清理
    # --------------------------------------------------------

    raw_class_masks = build_raw_structural_masks(
        result,
        img_w,
        img_h
    )

    dilated_class_masks = dilate_opening_masks(
        raw_class_masks
    )

    structure_mask = union_masks(
        dilated_class_masks
    )

    cleaned_structure_mask = clean_structure_mask_with_gap_suppression(
        structure_mask
    )

    cleaned_mask_path = os.path.join(
        output_dir,
        "03_cleaned_structure_mask_for_wall_thickness.png"
    )

    save_image(
        cleaned_mask_path,
        cleaned_structure_mask
    )

    # --------------------------------------------------------
    # 4. 基于有效结构掩膜 bbox 的尺度映射
    # --------------------------------------------------------

    bbox = get_mask_bbox(cleaned_structure_mask)

    sx_mm_per_px, sy_mm_per_px, avg_mm_per_px = compute_scale_from_bbox_and_ocr(
        bbox,
        Lx_mm,
        Ly_mm
    )

    # --------------------------------------------------------
    # 5. 骨架化
    # --------------------------------------------------------

    skeleton_mask = skeletonize_mask(
        cleaned_structure_mask
    )

    # --------------------------------------------------------
    # 6. 骨架矢量化 + 正交化 + 中心线后处理
    # --------------------------------------------------------

    paths = vectorize_skeleton(
        skeleton_mask
    )

    initial_segments = paths_to_orthogonal_segments(
        paths
    )

    optimized_segments = optimize_centerlines(
        initial_segments
    )

    # --------------------------------------------------------
    # 7. 墙厚采样 + 内外墙判别 + 不同厚度色条绘制
    # --------------------------------------------------------

    wall_bar_img, wall_infos = draw_wall_thickness_semantic_bars(
        cleaned_structure_mask,
        optimized_segments,
        bbox,
        sx_mm_per_px,
        sy_mm_per_px,
        avg_mm_per_px
    )

    wall_bar_path = os.path.join(
        output_dir,
        "06_wall_thickness_semantic_bars.png"
    )

    save_image(
        wall_bar_path,
        wall_bar_img
    )

    # --------------------------------------------------------
    # 8. 图例
    # --------------------------------------------------------

    legend_img = make_wall_thickness_legend()

    legend_path = os.path.join(
        output_dir,
        "06_wall_thickness_semantic_bars_legend.png"
    )

    save_image(
        legend_path,
        legend_img
    )

    # --------------------------------------------------------
    # 9. 输出墙段判别信息 JSON，方便检查
    # --------------------------------------------------------

    wall_infos_jsonable = []

    for info in wall_infos:
        thickness_mm = info.get("thickness_mm", None)

        if thickness_mm is not None:
            thickness_mm = float(thickness_mm)

        wall_infos_jsonable.append({
            "index": int(info.get("index", -1)),
            "kind": info.get("kind", ""),
            "orientation": info.get("orientation", ""),
            "segment": [
                [int(info["segment"][0][0]), int(info["segment"][0][1])],
                [int(info["segment"][1][0]), int(info["segment"][1][1])]
            ],
            "thickness_px": float(info.get("thickness_px", 0.0)),
            "thickness_mm": thickness_mm,
            "near_outer": bool(info.get("near_outer", False)),
            "outer_near_px": float(info.get("outer_near_px", 0.0))
        })

    wall_info_path = os.path.join(
        output_dir,
        "06_wall_thickness_semantic_bars_info.json"
    )

    with open(wall_info_path, "w") as f:
        json.dump(
            {
                "bbox": bbox,
                "Lx_mm": Lx_mm,
                "Ly_mm": Ly_mm,
                "sx_mm_per_px": sx_mm_per_px,
                "sy_mm_per_px": sy_mm_per_px,
                "avg_mm_per_px": avg_mm_per_px,
                "exterior_wall_mm": EXTERIOR_WALL_MM,
                "interior_wall_mm": INTERIOR_WALL_MM,
                "wall_thickness_threshold_mm": WALL_THICKNESS_THRESHOLD_MM,
                "assumed_exterior_wall_px": ASSUMED_EXTERIOR_WALL_PX,
                "assumed_interior_wall_px": ASSUMED_INTERIOR_WALL_PX,
                "wall_thickness_threshold_px": WALL_THICKNESS_THRESHOLD_PX,
                "wall_infos": wall_infos_jsonable
            },
            f,
            ensure_ascii=False,
            indent=2
        )

    logs.append("已保存墙厚判别信息 JSON: {}".format(wall_info_path))

    # --------------------------------------------------------
    # 10. OUT
    # --------------------------------------------------------

    OUT = {
        "success": True,
        "output_dir": output_dir,
        "cleaned_structure_mask": cleaned_mask_path,
        "wall_thickness_semantic_bars": wall_bar_path,
        "legend": legend_path,
        "wall_info_json": wall_info_path,
        "bbox": bbox,
        "Lx_mm": Lx_mm,
        "Ly_mm": Ly_mm,
        "sx_mm_per_px": sx_mm_per_px,
        "sy_mm_per_px": sy_mm_per_px,
        "avg_mm_per_px": avg_mm_per_px,
        "initial_segment_count": int(len(initial_segments)),
        "optimized_segment_count": int(len(optimized_segments)),
        "wall_info_count": int(len(wall_infos)),
        "logs": logs
    }

except Exception as e:
    logs.append("执行失败: {}".format(str(e)))
    logs.append(traceback.format_exc())

    OUT = {
        "success": False,
        "error": str(e),
        "logs": logs
    }
# ----------------------------------------
python_version_14 = Watch(draw_wall_width_pics)  # graph output
wall_paths = Filename("..\tests\structure_mask_process\06_wall_thickness_semantic_bars.png")
choose_walls_fordw = Python(IN[0]=modelpath, IN[1]=imagepath, IN[2]=wall_paths, IN[3]=python_version_4)  # CPython3; frozen
# ---------- choose_walls_fordw.python (648 lines) ----------
# -*- coding: utf-8 -*-

import os
import json
import math
import traceback
import cv2
import numpy as np

try:
    from ultralytics import YOLO
except:
    YOLO = None

# ---------------- Revit / Dynamo ----------------
try:
    import clr
    clr.AddReference("RevitServices")
    from RevitServices.Persistence import DocumentManager

    clr.AddReference("RevitAPI")
    from Autodesk.Revit.DB import FilteredElementCollector, Wall, XYZ

    doc = DocumentManager.Instance.CurrentDBDocument
except Exception:
    doc = None

logs = []
logs.append("=== 当前运行的是检测框中心点投影宿主墙可视化节点 V2 ===")

# ============================================================
# 输入
# ============================================================
try:
    dect_Model = IN[0]
except:
    dect_Model = None

try:
    pixpath = IN[1]
except:
    pixpath = ""

try:
    wall_mask_img_path = str(IN[2]).strip()
except:
    wall_mask_img_path = ""

try:
    seg_meta_json_path = str(IN[3]).strip()
except:
    seg_meta_json_path = ""

try:
    fallback_scale = float(IN[4])
except:
    fallback_scale = 1.0

try:
    YOLO_CONF = float(IN[5])
except:
    YOLO_CONF = 0.3

try:
    YOLO_IOU = float(IN[6])
except:
    YOLO_IOU = 0.45

try:
    YOLO_IMGSZ = int(IN[7])
except:
    YOLO_IMGSZ = 640

OUTPUT_FOLDER_NAME = "structure_mask_process"

TARGET_WINDOW_CLASS_NAME = "window"
TARGET_DOOR_CLASS_NAME = "twosidedoor"

MAX_HOST_WALL_SEARCH_DIST_FT = 6.0

CENTER_POINT_RADIUS = 8
PROJECT_POINT_RADIUS = 14
PROJECT_POINT_RING_RADIUS = 20
HOST_WALL_MARKER_RADIUS = 8
HOST_WALL_MARKER_INTERVAL_PX = 34
HOST_WALL_MARKER_ALPHA = 0.24
CENTER_TO_PROJECT_LINE_THICKNESS = 3
BBOX_LINE_THICKNESS = 2

COLOR_PALETTE = [
    (0, 255, 0),
    (255, 0, 255),
    (0, 165, 255),
    (255, 0, 0),
    (128, 0, 255),
    (0, 255, 255),
    (255, 128, 0),
    (80, 255, 120),
    (180, 80, 255),
    (255, 80, 80),
]

# ============================================================
# seg_meta / 坐标参数
# ============================================================
bbox_min_x = None
bbox_min_y = None
bbox_width = None
bbox_height = None
scale_x_ft_per_px = None
scale_y_ft_per_px = None

origin = XYZ(0, 0, 0)

# fallback
pixelWidth = 1600
pixelHeight = 1200
widthFt = fallback_scale
scaleX = widthFt / pixelWidth if pixelWidth > 0 else 0.0
scaleY = widthFt * (pixelHeight / float(pixelWidth)) / pixelHeight if pixelWidth > 0 and pixelHeight > 0 else 0.0

# ============================================================
# 工具函数
# ============================================================

def ensure_dir(folder):
    if folder and not os.path.exists(folder):
        os.makedirs(folder)

def save_image(path, img):
    ensure_dir(os.path.dirname(path))
    ok = cv2.imwrite(path, img)
    if not ok:
        raise Exception("cv2.imwrite 保存失败: {}".format(path))
    logs.append("已保存图像: {}".format(path))

def sanitize_name(name):
    if not name:
        return "Unknown"
    return str(name).strip()

def load_json_multi_encoding(path):
    if not path:
        logs.append("seg_meta_json_path为空")
        return None

    if not os.path.exists(path):
        logs.append("seg_meta_json_path不存在: {}".format(path))
        return None

    encodings = ["utf-8", "utf-8-sig", "gbk"]
    last_err = None

    for enc in encodings:
        try:
            with open(path, "r", encoding=enc) as f:
                data = json.load(f)
            logs.append("读取 seg_meta_json 成功: {} (encoding={})".format(path, enc))
            return data
        except Exception as e:
            last_err = e

    logs.append("读取 seg_meta_json 失败: {}".format(str(last_err)))
    return None

def get_model(model_input):
    if model_input is None:
        raise Exception("IN[0] 为空，请传入 YOLO 模型对象或模型路径。")

    if not isinstance(model_input, str):
        if hasattr(model_input, "predict") or hasattr(model_input, "__call__"):
            logs.append("检测到 IN[0] 是已加载模型对象，直接使用。")
            return model_input

    model_path = str(model_input).strip()

    if not model_path:
        raise Exception("模型路径为空。")

    if not os.path.exists(model_path):
        raise Exception("YOLO 模型路径不存在: {}".format(model_path))

    if YOLO is None:
        raise Exception("无法导入 ultralytics.YOLO，请检查环境。")

    logs.append("开始加载 YOLO 模型: {}".format(model_path))
    model = YOLO(model_path)
    logs.append("YOLO 模型加载完成。")
    return model

def pix_to_revit(x, y):
    global bbox_min_x, bbox_min_y, bbox_height
    global scale_x_ft_per_px, scale_y_ft_per_px
    global origin, scaleX, scaleY, pixelHeight

    try:
        if bbox_min_x is not None and bbox_min_y is not None and bbox_height is not None \
           and scale_x_ft_per_px is not None and scale_y_ft_per_px is not None:
            local_x = x - bbox_min_x
            local_y = y - bbox_min_y
            revit_x = origin.X + local_x * scale_x_ft_per_px
            revit_y = origin.Y + (bbox_height - local_y) * scale_y_ft_per_px
            return XYZ(revit_x, revit_y, origin.Z)
        else:
            revit_x = origin.X + x * scaleX
            revit_y = origin.Y + (pixelHeight - y) * scaleY
            return XYZ(revit_x, revit_y, origin.Z)
    except Exception:
        revit_x = origin.X + x * scaleX
        revit_y = origin.Y + (pixelHeight - y) * scaleY
        return XYZ(revit_x, revit_y, origin.Z)

def revit_to_pix(pt):
    global bbox_min_x, bbox_min_y, bbox_height
    global scale_x_ft_per_px, scale_y_ft_per_px
    global origin, scaleX, scaleY, pixelHeight

    try:
        if bbox_min_x is not None and bbox_min_y is not None and bbox_height is not None \
           and scale_x_ft_per_px is not None and scale_y_ft_per_px is not None:
            local_x = (pt.X - origin.X) / scale_x_ft_per_px
            local_y_from_bottom = (pt.Y - origin.Y) / scale_y_ft_per_px
            local_y = bbox_height - local_y_from_bottom
            x = bbox_min_x + local_x
            y = bbox_min_y + local_y
            return (float(x), float(y))
        else:
            x = (pt.X - origin.X) / scaleX if abs(scaleX) > 1e-12 else 0.0
            y = pixelHeight - (pt.Y - origin.Y) / scaleY if abs(scaleY) > 1e-12 else 0.0
            return (float(x), float(y))
    except Exception:
        x = (pt.X - origin.X) / scaleX if abs(scaleX) > 1e-12 else 0.0
        y = pixelHeight - (pt.Y - origin.Y) / scaleY if abs(scaleY) > 1e-12 else 0.0
        return (float(x), float(y))

def get_wall_curve(wall):
    try:
        loc = wall.Location
        if loc and hasattr(loc, "Curve"):
            return loc.Curve
    except:
        pass
    return None

def point_to_curve_distance_2d(pt, curve):
    try:
        p0 = curve.GetEndPoint(0)
        p1 = curve.GetEndPoint(1)

        vx = p1.X - p0.X
        vy = p1.Y - p0.Y
        wx = pt.X - p0.X
        wy = pt.Y - p0.Y

        len2 = vx * vx + vy * vy
        if len2 < 1e-12:
            return None, None, None

        t = (wx * vx + wy * vy) / len2

        proj_x = p0.X + t * vx
        proj_y = p0.Y + t * vy
        proj_pt = XYZ(proj_x, proj_y, pt.Z)

        dx = pt.X - proj_x
        dy = pt.Y - proj_y
        dist = math.sqrt(dx * dx + dy * dy)

        return dist, proj_pt, t
    except:
        return None, None, None

def find_nearest_wall(doc, pt, max_dist_ft=6.0):
    nearest_wall = None
    nearest_curve = None
    nearest_proj_pt = None
    best_dist = 1e18
    best_t = None

    walls = FilteredElementCollector(doc).OfClass(Wall).ToElements()

    checked = 0
    valid = 0

    for wall in walls:
        try:
            checked += 1
            curve = get_wall_curve(wall)
            if curve is None:
                continue

            p0 = curve.GetEndPoint(0)
            p1 = curve.GetEndPoint(1)
            wall_len = math.sqrt((p1.X - p0.X) ** 2 + (p1.Y - p0.Y) ** 2)
            if wall_len < 1e-6:
                continue

            dist, proj_pt, t = point_to_curve_distance_2d(pt, curve)
            if dist is None:
                continue

            # 只要求投影在线段上，放宽过滤，尽量贴近原放置代码
            if t < 0.0 or t > 1.0:
                continue

            if dist <= max_dist_ft:
                valid += 1
                if dist < best_dist:
                    best_dist = dist
                    nearest_wall = wall
                    nearest_curve = curve
                    nearest_proj_pt = proj_pt
                    best_t = t
        except:
            continue

    logs.append("宿主墙搜索: checked={}, valid={}, best_dist={}".format(
        checked,
        valid,
        best_dist if best_dist < 1e18 else None
    ))

    return nearest_wall, nearest_curve, nearest_proj_pt, best_dist, best_t

def safe_get_class_name(names, cls_id):
    try:
        if isinstance(names, dict):
            return names.get(int(cls_id), str(cls_id))
        return names[int(cls_id)]
    except:
        return str(cls_id)

def classify_target(name):
    n = sanitize_name(name).strip().lower()
    if n == TARGET_WINDOW_CLASS_NAME:
        return "window"
    if n == TARGET_DOOR_CLASS_NAME:
        return "tdoor"
    return None

def clip_point(pt, w, h):
    x, y = pt
    x = int(round(x))
    y = int(round(y))
    x = max(0, min(w - 1, x))
    y = max(0, min(h - 1, y))
    return (x, y)

def draw_transparent_wall_markers(img, p1, p2, color):
    h, w = img.shape[:2]
    p1 = clip_point(p1, w, h)
    p2 = clip_point(p2, w, h)

    x1, y1 = p1
    x2, y2 = p2
    dx = x2 - x1
    dy = y2 - y1
    length = math.sqrt(dx * dx + dy * dy)
    if length < 1:
        return img

    count = max(2, int(length / float(HOST_WALL_MARKER_INTERVAL_PX)))
    overlay = img.copy()

    for i in range(count + 1):
        t = i / float(count)
        x = int(round(x1 + dx * t))
        y = int(round(y1 + dy * t))
        cv2.circle(overlay, (x, y), HOST_WALL_MARKER_RADIUS, color, -1, cv2.LINE_AA)

    out = cv2.addWeighted(overlay, HOST_WALL_MARKER_ALPHA, img, 1.0 - HOST_WALL_MARKER_ALPHA, 0)
    return out

def draw_item(img, item, color):
    h, w = img.shape[:2]

    cx = clip_point(item["center_pix"], w, h)
    px = clip_point(item["projection_pix"], w, h)

    x1, y1, x2, y2 = item["bbox"]
    p1 = clip_point((x1, y1), w, h)
    p2 = clip_point((x2, y2), w, h)

    cv2.rectangle(img, p1, p2, color, BBOX_LINE_THICKNESS, cv2.LINE_AA)
    cv2.line(img, cx, px, color, CENTER_TO_PROJECT_LINE_THICKNESS, cv2.LINE_AA)

    cv2.circle(img, cx, CENTER_POINT_RADIUS + 3, (255, 255, 255), -1, cv2.LINE_AA)
    cv2.circle(img, cx, CENTER_POINT_RADIUS, color, -1, cv2.LINE_AA)

    cv2.circle(img, px, PROJECT_POINT_RING_RADIUS, color, 4, cv2.LINE_AA)
    cv2.circle(img, px, PROJECT_POINT_RADIUS, color, -1, cv2.LINE_AA)
    cv2.circle(img, px, 5, (255, 255, 255), -1, cv2.LINE_AA)

    label = "{}{}".format("W" if item["kind"] == "window" else "TD", item["index"])
    tx = max(0, min(w - 80, px[0] + 12))
    ty = max(20, min(h - 5, px[1] - 12))

    cv2.putText(img, label, (tx, ty), cv2.FONT_HERSHEY_SIMPLEX, 0.65, (0, 0, 0), 4, cv2.LINE_AA)
    cv2.putText(img, label, (tx, ty), cv2.FONT_HERSHEY_SIMPLEX, 0.65, color, 2, cv2.LINE_AA)

    return img

# ============================================================
# 主流程
# ============================================================
try:
    if doc is None:
        raise Exception("当前 Revit doc 为空，请在 Revit Dynamo 环境中运行。")

    if not pixpath or not os.path.exists(pixpath):
        raise Exception("输入原始平面图路径无效或不存在: {}".format(pixpath))

    pix_img = cv2.imread(pixpath, cv2.IMREAD_COLOR)
    if pix_img is None:
        raise Exception("cv2.imread 读取原始平面图失败: {}".format(pixpath))

    pixel_h, pixel_w = pix_img.shape[:2]
    pixelWidth = pixel_w
    pixelHeight = pixel_h

    logs.append("输入原始平面图: {}".format(pixpath))
    logs.append("原始图像尺寸: width={}, height={}".format(pixel_w, pixel_h))

    image_dir = os.path.dirname(os.path.abspath(pixpath))
    output_dir = os.path.join(image_dir, OUTPUT_FOLDER_NAME)
    ensure_dir(output_dir)
    logs.append("输出文件夹: {}".format(output_dir))

    if (not wall_mask_img_path) or (not os.path.exists(wall_mask_img_path)):
        auto_mask = os.path.join(output_dir, "06_wall_thickness_semantic_bars.png")
        if os.path.exists(auto_mask):
            wall_mask_img_path = auto_mask

    if wall_mask_img_path and os.path.exists(wall_mask_img_path):
        base_img = cv2.imread(wall_mask_img_path, cv2.IMREAD_COLOR)
        if base_img is None:
            base_img = pix_img.copy()
            logs.append("读取墙体遮罩图失败，回退到原图。")
        else:
            logs.append("读取墙体遮罩图成功: {}".format(wall_mask_img_path))
    else:
        base_img = pix_img.copy()
        logs.append("未提供有效墙体遮罩图，使用原始图像作为底图。")

    if base_img.shape[1] != pixel_w or base_img.shape[0] != pixel_h:
        base_img = cv2.resize(base_img, (pixel_w, pixel_h), interpolation=cv2.INTER_LINEAR)
        logs.append("底图已 resize 到原图尺寸。")

    # 读取 seg_meta
    seg_meta = load_json_multi_encoding(seg_meta_json_path)
    if seg_meta and seg_meta.get("ok", False):
        try:
            bbox_info = seg_meta.get("wall_bbox_px", None)
            scale_info = seg_meta.get("scale", {})

            if bbox_info:
                bbox_min_x = bbox_info.get("min_x", None)
                bbox_min_y = bbox_info.get("min_y", None)
                bbox_width = bbox_info.get("width", None)
                bbox_height = bbox_info.get("height", None)

            scale_x_ft_per_px = scale_info.get("scale_x_ft_per_px", None)
            scale_y_ft_per_px = scale_info.get("scale_y_ft_per_px", None)

            dbg = seg_meta.get("debug", {})
            if "pixelWidth" in dbg:
                pixelWidth = dbg.get("pixelWidth", pixelWidth)
            if "pixelHeight" in dbg:
                pixelHeight = dbg.get("pixelHeight", pixelHeight)

            logs.append("坐标映射 use_bbox_mapping=True")
        except Exception as e:
            logs.append("解析 seg_meta 失败: {}".format(str(e)))
    else:
        logs.append("seg_meta 无效，使用 fallback 整图 scale")

    logs.append("bbox_min_x={}, bbox_min_y={}, bbox_width={}, bbox_height={}".format(
        bbox_min_x, bbox_min_y, bbox_width, bbox_height
    ))
    logs.append("scale_x_ft_per_px={}, scale_y_ft_per_px={}".format(
        scale_x_ft_per_px, scale_y_ft_per_px
    ))

    model = get_model(dect_Model)

    logs.append("开始 YOLO 检测推理...")
    logs.append("YOLO_IMGSZ={}, YOLO_CONF={}, YOLO_IOU={}".format(
        YOLO_IMGSZ, YOLO_CONF, YOLO_IOU
    ))

    result_list = model(
        source=pixpath,
        save=False,
        conf=YOLO_CONF,
        iou=YOLO_IOU,
        imgsz=YOLO_IMGSZ,
        verbose=False
    )

    if result_list is None or len(result_list) == 0:
        raise Exception("YOLO 检测没有返回结果。")

    result = result_list[0]
    boxes = result.boxes
    xyxy = boxes.xyxy.cpu().numpy() if boxes is not None and boxes.xyxy is not None else np.empty((0, 4))
    cls_ids = boxes.cls.cpu().numpy().astype(int) if boxes is not None and boxes.cls is not None else np.array([], dtype=int)
    confs = boxes.conf.cpu().numpy() if boxes is not None and boxes.conf is not None else np.ones((len(xyxy),), dtype=np.float32)
    names = result.names

    logs.append("检测框数量: {}".format(len(xyxy)))
    logs.append("类别映射: {}".format(str(names)))

    detections = []
    for i, bbox in enumerate(xyxy):
        try:
            class_id = cls_ids[i]
            class_name = sanitize_name(safe_get_class_name(names, class_id))
            kind = classify_target(class_name)
            if kind is None:
                continue

            x1, y1, x2, y2 = bbox
            cx = 0.5 * (x1 + x2)
            cy = 0.5 * (y1 + y2)

            detections.append({
                "raw_index": i,
                "kind": kind,
                "class_name": class_name,
                "conf": float(confs[i]),
                "bbox": [float(x1), float(y1), float(x2), float(y2)],
                "center_pix": (float(cx), float(cy))
            })
        except Exception as e:
            logs.append("解析检测框失败 idx={}: {}".format(i, str(e)))

    logs.append("严格筛选后窗/双开门数量: {}".format(len(detections)))

    processed_items = []

    for idx, det in enumerate(detections):
        try:
            cx, cy = det["center_pix"]
            revit_center_pt = pix_to_revit(cx, cy)

            nearest_wall, nearest_curve, nearest_proj_pt, best_dist, best_t = find_nearest_wall(
                doc,
                revit_center_pt,
                max_dist_ft=MAX_HOST_WALL_SEARCH_DIST_FT
            )

            if nearest_wall is None or nearest_proj_pt is None:
                logs.append("检测项 {} 未找到有效宿主墙，跳过绘制。class={}, conf={}".format(
                    idx, det["class_name"], det["conf"]
                ))
                continue

            proj_pix = revit_to_pix(nearest_proj_pt)

            wall_p0 = nearest_curve.GetEndPoint(0)
            wall_p1 = nearest_curve.GetEndPoint(1)
            wall_p0_pix = revit_to_pix(wall_p0)
            wall_p1_pix = revit_to_pix(wall_p1)

            item = {
                "index": idx + 1,
                "kind": det["kind"],
                "class_name": det["class_name"],
                "conf": det["conf"],
                "bbox": det["bbox"],
                "center_pix": det["center_pix"],
                "projection_pix": proj_pix,
                "wall_p0_pix": wall_p0_pix,
                "wall_p1_pix": wall_p1_pix,
                "host_wall_id": nearest_wall.Id.IntegerValue,
                "host_distance_ft": best_dist,
                "host_t": best_t
            }
            processed_items.append(item)

            logs.append("检测项 {}: class={}, conf={:.3f}, center_pix=({:.1f},{:.1f}), proj_pix=({:.1f},{:.1f}), host_wall_id={}, dist_ft={:.4f}".format(
                idx,
                det["class_name"],
                det["conf"],
                cx, cy,
                proj_pix[0], proj_pix[1],
                item["host_wall_id"],
                best_dist if best_dist is not None else -1.0
            ))
        except Exception as e:
            logs.append("检测项 {} 投影处理失败: {}".format(idx, str(e)))

    logs.append("成功完成投影的窗/双开门数量: {}".format(len(processed_items)))

    draw_img = base_img.copy()

    for i, item in enumerate(processed_items):
        color = COLOR_PALETTE[i % len(COLOR_PALETTE)]
        draw_img = draw_transparent_wall_markers(
            draw_img,
            item["wall_p0_pix"],
            item["wall_p1_pix"],
            color
        )

    for i, item in enumerate(processed_items):
        color = COLOR_PALETTE[i % len(COLOR_PALETTE)]
        draw_img = draw_item(draw_img, item, color)

    out_path = os.path.join(output_dir, "07_detection_projection_host_wall.png")
    save_image(out_path, draw_img)

    info_path = os.path.join(output_dir, "07_detection_projection_host_wall_info.json")
    with open(info_path, "w") as f:
        json.dump({
            "source_image": pixpath,
            "count": len(processed_items),
            "items": processed_items
        }, f, ensure_ascii=False, indent=2)

    legend = np.zeros((130, 900, 3), dtype=np.uint8)
    cv2.circle(legend, (60, 42), PROJECT_POINT_RADIUS, COLOR_PALETTE[0], -1, cv2.LINE_AA)
    cv2.circle(legend, (60, 42), PROJECT_POINT_RING_RADIUS, COLOR_PALETTE[0], 4, cv2.LINE_AA)
    cv2.putText(legend, "Projected point on host wall", (100, 50), cv2.FONT_HERSHEY_SIMPLEX, 0.75, (255,255,255), 2, cv2.LINE_AA)
    cv2.circle(legend, (60, 95), CENTER_POINT_RADIUS, COLOR_PALETTE[1], -1, cv2.LINE_AA)
    cv2.putText(legend, "Original bbox center; faint dots indicate corresponding host wall", (100, 103), cv2.FONT_HERSHEY_SIMPLEX, 0.75, (255,255,255), 2, cv2.LINE_AA)

    legend_path = os.path.join(output_dir, "07_detection_projection_host_wall_legend.png")
    save_image(legend_path, legend)

    OUT = {
        "success": True,
        "output_dir": output_dir,
        "projection_visualization": out_path,
        "legend": legend_path,
        "projection_info_json": info_path,
        "processed_count": int(len(processed_items)),
        "logs": logs
    }

except Exception as e:
    logs.append("执行失败: {}".format(str(e)))
    logs.append(traceback.format_exc())
    OUT = {
        "success": False,
        "error": str(e),
        "logs": logs
    }
# ----------------------------------------
python_version_15 = Watch(choose_walls_fordw)  # graph output
imagepath_8 = Filename("..\tests\a3室2厅1厨2卫-120.49㎡-南 北-103104688478.jpg")
wall_paths_2 = Filename("..\tests\structure_mask_process\06_wall_thickness_semantic_bars.png")
python_script_8 = Python(IN[0]=modelpath_3, IN[1]=imagepath_8, IN[2]=wall_paths_2, IN[3]=python_version_4, IN[4]=furnture_Info_Json_Path)  # CPython3; frozen
# ---------- python_script_8.python (1584 lines) ----------
# -*- coding: utf-8 -*-

# ============================================================
# Revit + Dynamo Python Node
#
# 基于姿态估计结果绘制：
#   1. 家具姿态方向图
#   2. 单开门宿主墙候选筛选图（第九张）
#   3. 单开门最终放置示意图（第十张）
#
# 输出：
#   08_furniture_pose_direction.png
#   09_singledoor_host_wall_selection.png
#   10_singledoor_final_placement.png
#
# 输入：
#   IN[0] = pose YOLO model path 或模型对象
#   IN[1] = 原始图片路径
#   IN[2] = 06_wall_thickness_semantic_bars.png 路径，可选
#   IN[3] = seg_meta.json 路径，可选
#   IN[4] = class_config.json 路径，可选
#   IN[5] = fallback_scale，可选，默认 1.0
#   IN[6] = conf，可选，默认 0.3
#   IN[7] = iou，可选，默认 0.45
#   IN[8] = imgsz，可选，默认 1280
# ============================================================

import os
import json
import math
import traceback

import cv2
import numpy as np

try:
    from ultralytics import YOLO
except Exception:
    YOLO = None


# ============================================================
# Revit / Dynamo
# ============================================================

try:
    import clr

    clr.AddReference("RevitServices")
    from RevitServices.Persistence import DocumentManager

    clr.AddReference("RevitAPI")
    from Autodesk.Revit.DB import FilteredElementCollector, Wall, XYZ

    doc = DocumentManager.Instance.CurrentDBDocument

except Exception:
    doc = None


# ============================================================
# 日志
# ============================================================

logs = []
logs.append("=== 当前运行的是姿态估计家具与单开门可视化节点 V2 ===")


# ============================================================
# 输入
# ============================================================

try:
    pose_Model = IN[0]
except:
    pose_Model = None

try:
    pixpath = str(IN[1]).strip()
except:
    pixpath = ""

try:
    wall_mask_img_path = str(IN[2]).strip()
except:
    wall_mask_img_path = ""

try:
    seg_meta_json_path = str(IN[3]).strip()
except:
    seg_meta_json_path = ""

try:
    class_config_json_path = str(IN[4]).strip()
except:
    class_config_json_path = ""

try:
    fallback_scale = float(IN[5])
except:
    fallback_scale = 1.0

try:
    YOLO_CONF = float(IN[6])
except:
    YOLO_CONF = 0.3

try:
    YOLO_IOU = float(IN[7])
except:
    YOLO_IOU = 0.45

try:
    YOLO_IMGSZ = int(IN[8])
except:
    YOLO_IMGSZ = 1280


# ============================================================
# 默认配置
# ============================================================

OUTPUT_FOLDER_NAME = "structure_mask_process"

DEFAULT_CLASS_CONFIG = {
    "Bed": {
        "family_name": "Bed",
        "type_name": "Bed",
        "rotate": True,
        "kp_start_idx": 0,
        "kp_end_idx": 1,
        "area_filter": True,
        "family_default_axis": "Y",
        "placement_mode": "free"
    },
    "BedSingle": {
        "family_name": "BedSingle",
        "type_name": "BedSingle",
        "rotate": True,
        "kp_start_idx": 0,
        "kp_end_idx": 1,
        "area_filter": False,
        "family_default_axis": "Y",
        "placement_mode": "free"
    },
    "CookingCounter": {
        "family_name": "CookingCounter",
        "type_name": "CookingCounter",
        "rotate": True,
        "kp_start_idx": 0,
        "kp_end_idx": 1,
        "area_filter": False,
        "family_default_axis": "Y",
        "placement_mode": "free"
    },
    "Cabinet": {
        "family_name": "Cabinet",
        "type_name": "Cabinet",
        "rotate": True,
        "kp_start_idx": 0,
        "kp_end_idx": 1,
        "area_filter": False,
        "family_default_axis": "Y",
        "placement_mode": "free"
    },
    "DiningTable": {
        "family_name": "DiningTable",
        "type_name": "DiningTable",
        "rotate": True,
        "kp_start_idx": 0,
        "kp_end_idx": 1,
        "area_filter": False,
        "family_default_axis": "Y",
        "placement_mode": "free"
    },
    "DiningTables": {
        "family_name": "DiningTables",
        "type_name": "DiningTables",
        "rotate": False,
        "area_filter": False,
        "placement_mode": "free"
    },
    "Sofa": {
        "family_name": "Sofa",
        "type_name": "Sofa",
        "rotate": True,
        "kp_start_idx": 0,
        "kp_end_idx": 1,
        "area_filter": False,
        "family_default_axis": "Y",
        "placement_mode": "free"
    },
    "TVStand": {
        "family_name": "TVStand",
        "type_name": "TVStand",
        "rotate": True,
        "kp_start_idx": 0,
        "kp_end_idx": 1,
        "area_filter": False,
        "family_default_axis": "Y",
        "placement_mode": "free"
    },
    "Toilet": {
        "family_name": "Toilet",
        "type_name": "Toilet",
        "rotate": True,
        "kp_start_idx": 0,
        "kp_end_idx": 1,
        "area_filter": False,
        "family_default_axis": "Y",
        "placement_mode": "free"
    },
    "LeftDoor": {
        "family_name": "LeftDoor",
        "type_name": "LeftDoor",
        "rotate": False,
        "kp_start_idx": 0,
        "kp_end_idx": 1,
        "area_filter": False,
        "placement_mode": "door_hosted",
        "door_max_host_wall_dist_ft": 4.0,
        "door_min_perp_score": 0.35,
        "door_min_end_clearance_ft": 0.45,
        "door_end_clearance_ratio": 0.25,
        "door_insert_reference": "bbox_center",
        "door_insert_offset_along_ft": 0.0,
        "door_insert_offset_normal_ft": 0.0,
        "door_try_candidate_count": 8,
        "door_geometry_match": True
    },
    "RightDoor": {
        "family_name": "RightDoor",
        "type_name": "RightDoor",
        "rotate": False,
        "kp_start_idx": 0,
        "kp_end_idx": 1,
        "area_filter": False,
        "placement_mode": "door_hosted",
        "door_max_host_wall_dist_ft": 4.0,
        "door_min_perp_score": 0.35,
        "door_min_end_clearance_ft": 0.45,
        "door_end_clearance_ratio": 0.25,
        "door_insert_reference": "bbox_center",
        "door_insert_offset_along_ft": 0.0,
        "door_insert_offset_normal_ft": 0.0,
        "door_try_candidate_count": 8,
        "door_geometry_match": True
    }
}


# ============================================================
# 绘图参数
# ============================================================

FURNITURE_POSE_ARROW_THICKNESS = 8
FURNITURE_DEFAULT_ARROW_THICKNESS = 10
FURNITURE_ARROW_TIP_LENGTH = 0.25
FURNITURE_BBOX_THICKNESS = 2

DOOR_BBOX_THICKNESS = 2
DOOR_KP_RADIUS = 7
DOOR_CENTER_RADIUS = 8
DOOR_PROJECT_RADIUS = 13
DOOR_PROJECT_RING_RADIUS = 18

# 第九张：门扇姿态箭头略细
DOOR_LEAF_ARROW_THICKNESS_HOST = 5

# 第十张：最终放置门扇色条更粗
DOOR_FINAL_FRAME_THICKNESS = 4
DOOR_FINAL_LEAF_THICKNESS = 12
DOOR_FINAL_INSERT_RADIUS = 11

HOST_WALL_MARKER_RADIUS = 8
HOST_WALL_MARKER_INTERVAL_PX = 34
HOST_WALL_MARKER_ALPHA = 0.18
HOST_WALL_MARKER_ALPHA_BEST = 0.30

TEXT_SCALE = 0.65
TEXT_THICKNESS = 2

AREA_FILTER_RATIO = 0.33

COLOR_PALETTE = [
    (0, 255, 0),
    (255, 0, 255),
    (0, 165, 255),
    (255, 0, 0),
    (128, 0, 255),
    (0, 255, 255),
    (255, 128, 0),
    (80, 255, 120),
    (180, 80, 255),
    (255, 80, 80),
    (60, 180, 255),
    (200, 255, 80),
]


# ============================================================
# 基础工具
# ============================================================

def ensure_dir(folder):
    if folder and not os.path.exists(folder):
        os.makedirs(folder)


def save_image(path, img):
    ensure_dir(os.path.dirname(path))
    ok = cv2.imwrite(path, img)
    if not ok:
        raise Exception("cv2.imwrite 保存失败: {}".format(path))
    logs.append("已保存图像: {}".format(path))


def norm_str(s):
    if s is None:
        return ""
    return str(s).strip().lower()


def load_json_multi_encoding(path, label):
    if not path:
        logs.append("{}为空".format(label))
        return None

    if not os.path.exists(path):
        logs.append("{}不存在: {}".format(label, path))
        return None

    encodings = ["utf-8", "utf-8-sig", "gbk"]
    last_err = None

    for enc in encodings:
        try:
            with open(path, "r", encoding=enc) as f:
                data = json.load(f)
            logs.append("读取{}成功: {} encoding={}".format(label, path, enc))
            return data
        except Exception as e:
            last_err = e

    logs.append("读取{}失败: {}".format(label, str(last_err)))
    return None


def load_class_config(path):
    data = load_json_multi_encoding(path, "class_config_json_path")

    if isinstance(data, dict) and len(data) > 0:
        logs.append("使用外部 CLASS_CONFIG，共{}类".format(len(data)))
        return data

    logs.append("使用内置 DEFAULT_CLASS_CONFIG，共{}类".format(len(DEFAULT_CLASS_CONFIG)))
    return DEFAULT_CLASS_CONFIG


def get_model(model_input):
    if model_input is None:
        raise Exception("IN[0]为空，请输入姿态估计模型对象或模型路径。")

    if not isinstance(model_input, str):
        if hasattr(model_input, "predict") or hasattr(model_input, "__call__"):
            logs.append("检测到 IN[0] 为已加载模型对象，直接使用。")
            return model_input

    model_path = str(model_input).strip()

    if not model_path:
        raise Exception("模型路径为空。")

    if not os.path.exists(model_path):
        raise Exception("模型路径不存在: {}".format(model_path))

    if YOLO is None:
        raise Exception("无法导入 ultralytics.YOLO，请检查 Python 环境。")

    logs.append("开始加载 YOLO 姿态模型: {}".format(model_path))
    model = YOLO(model_path)
    logs.append("YOLO 姿态模型加载完成。")

    return model


def safe_get_class_name(names, cls_id):
    try:
        if isinstance(names, dict):
            return names.get(int(cls_id), str(cls_id))
        return names[int(cls_id)]
    except:
        return str(cls_id)


def clip_point(pt, w, h):
    x, y = pt
    x = int(round(x))
    y = int(round(y))
    x = max(0, min(w - 1, x))
    y = max(0, min(h - 1, y))
    return (x, y)


def darker_color(color, factor=0.55):
    b, g, r = color
    return (
        int(max(0, min(255, b * factor))),
        int(max(0, min(255, g * factor))),
        int(max(0, min(255, r * factor)))
    )


def draw_text_with_outline(img, text, pos, color, scale=0.65):
    x, y = pos

    cv2.putText(
        img,
        text,
        (int(x), int(y)),
        cv2.FONT_HERSHEY_SIMPLEX,
        scale,
        (0, 0, 0),
        TEXT_THICKNESS + 2,
        cv2.LINE_AA
    )

    cv2.putText(
        img,
        text,
        (int(x), int(y)),
        cv2.FONT_HERSHEY_SIMPLEX,
        scale,
        color,
        TEXT_THICKNESS,
        cv2.LINE_AA
    )


def draw_transparent_arrow(img, p1, p2, color, thickness=8, alpha=0.35, tip_length=0.25):
    overlay = img.copy()

    cv2.arrowedLine(
        overlay,
        p1,
        p2,
        color,
        thickness=thickness,
        line_type=cv2.LINE_AA,
        tipLength=tip_length
    )

    out = cv2.addWeighted(overlay, alpha, img, 1.0 - alpha, 0)
    img[:, :, :] = out[:, :, :]


def draw_transparent_wall_markers(img, p1, p2, color, alpha=0.25, radius=8):
    h, w = img.shape[:2]

    p1 = clip_point(p1, w, h)
    p2 = clip_point(p2, w, h)

    x1, y1 = p1
    x2, y2 = p2
    dx = x2 - x1
    dy = y2 - y1

    length = math.sqrt(dx * dx + dy * dy)
    if length < 1:
        return img

    count = max(2, int(length / float(HOST_WALL_MARKER_INTERVAL_PX)))
    overlay = img.copy()

    for i in range(count + 1):
        t = i / float(count)
        x = int(round(x1 + dx * t))
        y = int(round(y1 + dy * t))
        cv2.circle(overlay, (x, y), radius, color, -1, cv2.LINE_AA)

    out = cv2.addWeighted(overlay, alpha, img, 1.0 - alpha, 0)
    return out


# ============================================================
# 坐标映射
# ============================================================

class PixelRevitMapper(object):
    def __init__(self, image_width, image_height, fallback_width_ft, seg_meta):
        self.image_width = int(image_width)
        self.image_height = int(image_height)

        self.origin_x = 0.0
        self.origin_y = 0.0
        self.origin_z = 0.0

        self.bbox_min_x = None
        self.bbox_min_y = None
        self.bbox_width = None
        self.bbox_height = None

        self.scale_x_ft_per_px = None
        self.scale_y_ft_per_px = None

        self.use_bbox_mapping = False

        if self.image_width > 0:
            self.fallback_scale_x = float(fallback_width_ft) / float(self.image_width)
        else:
            self.fallback_scale_x = 1.0

        self.fallback_scale_y = self.fallback_scale_x

        if isinstance(seg_meta, dict):
            self.load_from_seg_meta(seg_meta)

        if self.scale_x_ft_per_px is None:
            self.scale_x_ft_per_px = self.fallback_scale_x

        if self.scale_y_ft_per_px is None:
            self.scale_y_ft_per_px = self.fallback_scale_y

        logs.append("坐标映射 use_bbox_mapping={}".format(self.use_bbox_mapping))
        logs.append("bbox_min_x={}, bbox_min_y={}, bbox_width={}, bbox_height={}".format(
            self.bbox_min_x,
            self.bbox_min_y,
            self.bbox_width,
            self.bbox_height
        ))
        logs.append("scale_x_ft_per_px={}, scale_y_ft_per_px={}".format(
            self.scale_x_ft_per_px,
            self.scale_y_ft_per_px
        ))

    def load_from_seg_meta(self, meta):
        try:
            bbox = meta.get("wall_bbox_px", None)
            if bbox is None:
                bbox = meta.get("bbox", None)

            if isinstance(bbox, dict):
                min_x = bbox.get("min_x", bbox.get("x_min", None))
                min_y = bbox.get("min_y", bbox.get("y_min", None))
                width = bbox.get("width", None)
                height = bbox.get("height", None)

                if width is None:
                    max_x = bbox.get("max_x", bbox.get("x_max", None))
                    if max_x is not None and min_x is not None:
                        width = float(max_x) - float(min_x)

                if height is None:
                    max_y = bbox.get("max_y", bbox.get("y_max", None))
                    if max_y is not None and min_y is not None:
                        height = float(max_y) - float(min_y)

                if min_x is not None and min_y is not None and width is not None and height is not None:
                    self.bbox_min_x = float(min_x)
                    self.bbox_min_y = float(min_y)
                    self.bbox_width = float(width)
                    self.bbox_height = float(height)
                    self.use_bbox_mapping = True

            scale_info = meta.get("scale", {})
            sx = scale_info.get("scale_x_ft_per_px", None)
            sy = scale_info.get("scale_y_ft_per_px", None)

            if sx is None:
                sx = meta.get("scale_x_ft_per_px", None)
            if sy is None:
                sy = meta.get("scale_y_ft_per_px", None)

            if sx is not None:
                self.scale_x_ft_per_px = float(sx)
            if sy is not None:
                self.scale_y_ft_per_px = float(sy)

            dbg = meta.get("debug", {})
            if "pixelWidth" in dbg:
                self.image_width = int(dbg.get("pixelWidth"))
            if "pixelHeight" in dbg:
                self.image_height = int(dbg.get("pixelHeight"))

        except Exception as e:
            logs.append("解析 seg_meta 失败，将使用 fallback 映射: {}".format(str(e)))

    def pix_to_revit(self, x, y):
        x = float(x)
        y = float(y)

        if self.use_bbox_mapping and self.bbox_min_x is not None and self.bbox_min_y is not None and self.bbox_height is not None:
            local_x = x - self.bbox_min_x
            local_y = y - self.bbox_min_y

            revit_x = self.origin_x + local_x * self.scale_x_ft_per_px
            revit_y = self.origin_y + (self.bbox_height - local_y) * self.scale_y_ft_per_px
            return XYZ(revit_x, revit_y, self.origin_z)

        revit_x = self.origin_x + x * self.scale_x_ft_per_px
        revit_y = self.origin_y + (self.image_height - y) * self.scale_y_ft_per_px
        return XYZ(revit_x, revit_y, self.origin_z)

    def revit_to_pix(self, pt):
        if self.use_bbox_mapping and self.bbox_min_x is not None and self.bbox_min_y is not None and self.bbox_height is not None:
            local_x = (pt.X - self.origin_x) / self.scale_x_ft_per_px
            local_y_from_bottom = (pt.Y - self.origin_y) / self.scale_y_ft_per_px
            local_y = self.bbox_height - local_y_from_bottom

            x = self.bbox_min_x + local_x
            y = self.bbox_min_y + local_y
            return (float(x), float(y))

        x = (pt.X - self.origin_x) / self.scale_x_ft_per_px
        y = self.image_height - (pt.Y - self.origin_y) / self.scale_y_ft_per_px
        return (float(x), float(y))


# ============================================================
# Revit 墙体几何工具
# ============================================================

def xyz_sub(a, b):
    return XYZ(a.X - b.X, a.Y - b.Y, a.Z - b.Z)


def xyz_add(a, b):
    return XYZ(a.X + b.X, a.Y + b.Y, a.Z + b.Z)


def xyz_mul(v, s):
    return XYZ(v.X * s, v.Y * s, v.Z * s)


def xyz_len2d(v):
    return math.sqrt(v.X * v.X + v.Y * v.Y)


def xyz_norm2d(v):
    l = xyz_len2d(v)
    if l < 1e-9:
        return None
    return XYZ(v.X / l, v.Y / l, 0)


def dot2d(a, b):
    return a.X * b.X + a.Y * b.Y


def dist2d(a, b):
    dx = a.X - b.X
    dy = a.Y - b.Y
    return math.sqrt(dx * dx + dy * dy)


def clamp(v, a, b):
    return max(a, min(b, v))


def get_wall_curve(wall):
    try:
        loc = wall.Location
        if loc and hasattr(loc, "Curve"):
            return loc.Curve
    except:
        pass
    return None


def get_wall_direction_unit(curve):
    try:
        p0 = curve.GetEndPoint(0)
        p1 = curve.GetEndPoint(1)
        return xyz_norm2d(xyz_sub(p1, p0))
    except:
        return None


def get_wall_normal_unit_2d(wall_dir):
    if wall_dir is None:
        return None
    return XYZ(-wall_dir.Y, wall_dir.X, 0)


def point_to_line_segment_projection_2d(pt, p0, p1):
    vx = p1.X - p0.X
    vy = p1.Y - p0.Y
    wx = pt.X - p0.X
    wy = pt.Y - p0.Y

    vv = vx * vx + vy * vy
    if vv < 1e-12:
        return {
            "proj": XYZ(p0.X, p0.Y, pt.Z),
            "dist": dist2d(pt, p0),
            "t_raw": 0.0,
            "t": 0.0,
            "inside": False,
            "length": 0.0,
            "end_clearance": 0.0
        }

    t_raw = (wx * vx + wy * vy) / vv
    t = clamp(t_raw, 0.0, 1.0)
    proj = XYZ(p0.X + t * vx, p0.Y + t * vy, pt.Z)

    length = math.sqrt(vv)
    inside = t_raw >= -0.02 and t_raw <= 1.02

    if inside:
        end_clearance = min(t * length, (1.0 - t) * length)
    else:
        end_clearance = -min(abs(t_raw), abs(t_raw - 1.0)) * length

    return {
        "proj": proj,
        "dist": dist2d(pt, proj),
        "t_raw": t_raw,
        "t": t,
        "inside": inside,
        "length": length,
        "end_clearance": end_clearance
    }


def get_all_walls(doc):
    if doc is None:
        return []
    try:
        return list(FilteredElementCollector(doc).OfClass(Wall).ToElements())
    except Exception:
        return []


# ============================================================
# 姿态结果解析
# ============================================================

def get_pose_keypoints_xy(result):
    try:
        if result.keypoints is None:
            return None

        if hasattr(result.keypoints, "xy") and result.keypoints.xy is not None:
            return result.keypoints.xy.cpu().numpy()

        if hasattr(result.keypoints, "data") and result.keypoints.data is not None:
            data = result.keypoints.data.cpu().numpy()
            return data[:, :, :2]
    except:
        return None

    return None


def run_pose_inference(model, image_path):
    logs.append("开始 YOLO Pose 推理...")
    logs.append("YOLO_IMGSZ={}, YOLO_CONF={}, YOLO_IOU={}".format(
        YOLO_IMGSZ, YOLO_CONF, YOLO_IOU
    ))

    results = model(
        source=image_path,
        save=False,
        conf=YOLO_CONF,
        iou=YOLO_IOU,
        imgsz=YOLO_IMGSZ,
        verbose=False
    )

    if results is None or len(results) == 0:
        raise Exception("姿态估计模型没有返回结果。")

    result = results[0]

    if result.boxes is None:
        return [], {}

    boxes = result.boxes
    xyxy = boxes.xyxy.cpu().numpy() if boxes.xyxy is not None else np.empty((0, 4))
    cls_ids = boxes.cls.cpu().numpy().astype(int) if boxes.cls is not None else np.array([], dtype=int)
    confs = boxes.conf.cpu().numpy() if boxes.conf is not None else np.ones((len(xyxy),), dtype=np.float32)

    names = result.names
    kps_xy = get_pose_keypoints_xy(result)

    instances = []

    for i, bbox in enumerate(xyxy):
        try:
            cls_id = int(cls_ids[i])
            class_name = safe_get_class_name(names, cls_id)

            x1, y1, x2, y2 = bbox.tolist()
            cx = 0.5 * (x1 + x2)
            cy = 0.5 * (y1 + y2)

            if kps_xy is not None and i < len(kps_xy):
                keypoints = kps_xy[i]
            else:
                keypoints = np.empty((0, 2), dtype=np.float32)

            instances.append({
                "index": i,
                "class_name": str(class_name),
                "conf": float(confs[i]),
                "bbox": [float(x1), float(y1), float(x2), float(y2)],
                "center_pix": [float(cx), float(cy)],
                "keypoints": keypoints
            })
        except Exception as e:
            logs.append("解析姿态实例失败 idx={}: {}".format(i, str(e)))

    logs.append("姿态估计实例数量: {}".format(len(instances)))
    logs.append("类别映射: {}".format(str(names)))

    return instances, names


def get_kp_pair(instance, cfg):
    kps = instance.get("keypoints", None)

    if kps is None or len(kps) == 0:
        return None, None

    ks = int(cfg.get("kp_start_idx", 0))
    ke = int(cfg.get("kp_end_idx", 1))

    if ks < 0 or ke < 0 or ks >= len(kps) or ke >= len(kps):
        return None, None

    p1 = kps[ks]
    p2 = kps[ke]

    if p1 is None or p2 is None:
        return None, None

    x1, y1 = float(p1[0]), float(p1[1])
    x2, y2 = float(p2[0]), float(p2[1])

    if abs(x1) < 1e-6 and abs(y1) < 1e-6:
        return None, None
    if abs(x2) < 1e-6 and abs(y2) < 1e-6:
        return None, None
    if math.hypot(x2 - x1, y2 - y1) < 2.0:
        return None, None

    return (x1, y1), (x2, y2)


def compute_class_area_threshold(instances, class_name):
    areas = []

    for ins in instances:
        if ins.get("class_name", "") != class_name:
            continue

        x1, y1, x2, y2 = ins["bbox"]
        area = max(0.0, x2 - x1) * max(0.0, y2 - y1)

        if area > 0:
            areas.append(area)

    if not areas:
        return 0.0, 0.0

    median_area = float(np.median(np.array(areas, dtype=np.float32)))
    threshold = median_area * AREA_FILTER_RATIO
    return median_area, threshold


# ============================================================
# 单开门宿主墙评分
# ============================================================

def remap_dist_score(dist, max_dist):
    if max_dist <= 1e-9:
        return 0.0
    return clamp(1.0 - dist / max_dist, 0.0, 1.0)


def build_door_candidates(instance, cfg, mapper, walls):
    kp_start, kp_end = get_kp_pair(instance, cfg)
    if kp_start is None or kp_end is None:
        return []

    sx, sy = kp_start
    ex, ey = kp_end

    cx, cy = instance["center_pix"]

    Qs = mapper.pix_to_revit(sx, sy)
    Qe = mapper.pix_to_revit(ex, ey)
    Qb = mapper.pix_to_revit(cx, cy)

    leaf_vec = xyz_sub(Qe, Qs)
    leaf_dir = xyz_norm2d(leaf_vec)
    if leaf_dir is None:
        return []

    max_dist = float(cfg.get("door_max_host_wall_dist_ft", 4.0))
    min_perp_score = float(cfg.get("door_min_perp_score", 0.35))
    min_end_clearance = float(cfg.get("door_min_end_clearance_ft", 0.45))
    end_clearance_ratio = float(cfg.get("door_end_clearance_ratio", 0.25))

    insert_ref = str(cfg.get("door_insert_reference", "bbox_center")).strip().lower()
    offset_along = float(cfg.get("door_insert_offset_along_ft", 0.0))
    offset_normal = float(cfg.get("door_insert_offset_normal_ft", 0.0))

    if insert_ref in ["kp_start", "start", "hinge", "s"]:
        Qref = Qs
    elif insert_ref in ["leaf_mid", "kp_mid", "mid"]:
        Qref = XYZ((Qs.X + Qe.X) * 0.5, (Qs.Y + Qe.Y) * 0.5, Qs.Z)
    else:
        Qref = Qb

    candidates = []

    for wall in walls:
        try:
            curve = get_wall_curve(wall)
            if curve is None:
                continue

            p0 = curve.GetEndPoint(0)
            p1 = curve.GetEndPoint(1)

            wall_dir = get_wall_direction_unit(curve)
            if wall_dir is None:
                continue

            wall_normal = get_wall_normal_unit_2d(wall_dir)

            proj_ref = point_to_line_segment_projection_2d(Qref, p0, p1)
            proj_s = point_to_line_segment_projection_2d(Qs, p0, p1)
            proj_b = point_to_line_segment_projection_2d(Qb, p0, p1)

            if not proj_ref["inside"]:
                continue

            wall_len = proj_ref["length"]
            if wall_len < 1e-6:
                continue

            required_clearance = max(min_end_clearance, wall_len * end_clearance_ratio * 0.05)
            if proj_ref["end_clearance"] < required_clearance:
                continue

            dist_ref = proj_ref["dist"]
            dist_s = proj_s["dist"]
            dist_b = proj_b["dist"]

            if min(dist_ref, dist_s, dist_b) > max_dist:
                continue

            perp_score = 1.0 - abs(dot2d(wall_dir, leaf_dir))
            if perp_score < min_perp_score:
                continue

            d_s_score = remap_dist_score(dist_s, max_dist)
            d_b_score = remap_dist_score(dist_b, max_dist)
            d_ref_score = remap_dist_score(dist_ref, max_dist)
            end_score = clamp(proj_ref["end_clearance"] / max(min_end_clearance, 1e-6), 0.0, 1.0)

            score = (
                0.30 * d_s_score +
                0.20 * d_b_score +
                0.20 * d_ref_score +
                0.25 * perp_score +
                0.05 * end_score
            )

            insert_pt = proj_ref["proj"]

            if offset_along != 0.0:
                insert_pt = xyz_add(insert_pt, xyz_mul(wall_dir, offset_along))

            if offset_normal != 0.0 and wall_normal is not None:
                insert_pt = xyz_add(insert_pt, xyz_mul(wall_normal, offset_normal))

            candidates.append({
                "wall": wall,
                "curve": curve,
                "insert_pt": insert_pt,
                "proj_ref": proj_ref,
                "proj_s": proj_s,
                "proj_b": proj_b,
                "wall_dir": wall_dir,
                "wall_normal": wall_normal,
                "leaf_dir": leaf_dir,
                "score": score,
                "dist_ref": dist_ref,
                "dist_s": dist_s,
                "dist_b": dist_b,
                "perp_score": perp_score,
                "end_score": end_score,
                "t": proj_ref["t"],
                "wall_len": wall_len
            })
        except Exception:
            continue

    candidates.sort(key=lambda c: c["score"], reverse=True)
    try_count = int(cfg.get("door_try_candidate_count", 8))
    candidates = candidates[:max(1, try_count)]

    return candidates


# ============================================================
# 绘制家具图
# ============================================================

def draw_furniture_direction_image(base_img, furniture_items):
    img = base_img.copy()
    h, w = img.shape[:2]

    for idx, item in enumerate(furniture_items):
        color = COLOR_PALETTE[idx % len(COLOR_PALETTE)]
        muted = darker_color(color, 0.55)

        x1, y1, x2, y2 = item["bbox"]
        p_box1 = clip_point((x1, y1), w, h)
        p_box2 = clip_point((x2, y2), w, h)

        cv2.rectangle(img, p_box1, p_box2, color, FURNITURE_BBOX_THICKNESS, cv2.LINE_AA)

        bx = 0.5 * (x1 + x2)
        by_bottom = y2 - 0.18 * (y2 - y1)
        by_top = y1 + 0.18 * (y2 - y1)

        p_default_start = clip_point((bx, by_bottom), w, h)
        p_default_end = clip_point((bx, by_top), w, h)

        draw_transparent_arrow(
            img,
            p_default_start,
            p_default_end,
            muted,
            thickness=FURNITURE_DEFAULT_ARROW_THICKNESS,
            alpha=0.32,
            tip_length=0.22
        )

        kp_start = item["kp_start"]
        kp_end = item["kp_end"]

        p_pose_start = clip_point(kp_start, w, h)
        p_pose_end = clip_point(kp_end, w, h)

        cv2.circle(img, p_pose_start, 7, color, -1, cv2.LINE_AA)
        cv2.circle(img, p_pose_end, 7, (255, 255, 255), -1, cv2.LINE_AA)
        cv2.circle(img, p_pose_end, 4, color, -1, cv2.LINE_AA)

        cv2.arrowedLine(
            img,
            p_pose_start,
            p_pose_end,
            color,
            thickness=FURNITURE_POSE_ARROW_THICKNESS,
            line_type=cv2.LINE_AA,
            tipLength=FURNITURE_ARROW_TIP_LENGTH
        )

        label = "{}{}".format(item["class_name"], idx + 1)
        tx = max(5, min(w - 200, int(x1)))
        ty = max(22, min(h - 5, int(y1) - 8))
        draw_text_with_outline(img, label, (tx, ty), color, scale=0.55)

    return img


# ============================================================
# 绘制单开门宿主墙候选筛选图（第九张）
# ============================================================

def draw_door_host_selection_image(base_img, door_items):
    img = base_img.copy()
    h, w = img.shape[:2]

    # 先画候选宿主墙集合：同一个门实例使用同一种颜色
    # 所有 candidates 都画成同色半透明点串；best 额外更明显一些
    for idx, item in enumerate(door_items):
        color = COLOR_PALETTE[idx % len(COLOR_PALETTE)]

        candidate_walls = item.get("candidate_walls_pix", [])
        best_wall = item.get("best_wall_pix", None)

        for cw in candidate_walls:
            img = draw_transparent_wall_markers(
                img,
                cw["p0"],
                cw["p1"],
                color,
                alpha=HOST_WALL_MARKER_ALPHA,
                radius=HOST_WALL_MARKER_RADIUS
            )

        if best_wall is not None:
            img = draw_transparent_wall_markers(
                img,
                best_wall["p0"],
                best_wall["p1"],
                color,
                alpha=HOST_WALL_MARKER_ALPHA_BEST,
                radius=HOST_WALL_MARKER_RADIUS + 1
            )

    # 再画门本体信息
    for idx, item in enumerate(door_items):
        color = COLOR_PALETTE[idx % len(COLOR_PALETTE)]

        x1, y1, x2, y2 = item["bbox"]
        p1 = clip_point((x1, y1), w, h)
        p2 = clip_point((x2, y2), w, h)

        cv2.rectangle(img, p1, p2, color, DOOR_BBOX_THICKNESS, cv2.LINE_AA)

        center = clip_point(item["center_pix"], w, h)
        kp_s = clip_point(item["kp_start"], w, h)
        kp_e = clip_point(item["kp_end"], w, h)
        proj = clip_point(item["insert_pix"], w, h)

        cv2.circle(img, center, DOOR_CENTER_RADIUS + 3, (255, 255, 255), -1, cv2.LINE_AA)
        cv2.circle(img, center, DOOR_CENTER_RADIUS, color, -1, cv2.LINE_AA)

        cv2.circle(img, kp_s, DOOR_KP_RADIUS + 3, (0, 0, 0), -1, cv2.LINE_AA)
        cv2.circle(img, kp_s, DOOR_KP_RADIUS, color, -1, cv2.LINE_AA)

        cv2.circle(img, kp_e, DOOR_KP_RADIUS + 3, (255, 255, 255), -1, cv2.LINE_AA)
        cv2.circle(img, kp_e, DOOR_KP_RADIUS, color, -1, cv2.LINE_AA)

        # 第九张：更细一些的姿态箭头
        cv2.arrowedLine(
            img,
            kp_s,
            kp_e,
            color,
            thickness=DOOR_LEAF_ARROW_THICKNESS_HOST,
            line_type=cv2.LINE_AA,
            tipLength=0.23
        )

        cv2.line(img, center, proj, color, thickness=3, lineType=cv2.LINE_AA)

        cv2.circle(img, proj, DOOR_PROJECT_RING_RADIUS, color, 4, cv2.LINE_AA)
        cv2.circle(img, proj, DOOR_PROJECT_RADIUS, color, -1, cv2.LINE_AA)
        cv2.circle(img, proj, 5, (255, 255, 255), -1, cv2.LINE_AA)

        label = "{}{}  cand={}  best={:.2f}".format(
            "LD" if item["class_name"] == "LeftDoor" else "RD",
            idx + 1,
            len(item.get("candidate_walls_pix", [])),
            item.get("host_score", 0.0)
        )

        tx = max(5, min(w - 260, proj[0] + 12))
        ty = max(22, min(h - 5, proj[1] - 12))
        draw_text_with_outline(img, label, (tx, ty), color, scale=0.58)

    return img


# ============================================================
# 绘制单开门最终放置示意图（第十张）
# 不再保留候选宿主墙半透明点
# ============================================================

def draw_door_final_placement_image(base_img, door_items):
    img = base_img.copy()
    h, w = img.shape[:2]

    for idx, item in enumerate(door_items):
        color = COLOR_PALETTE[idx % len(COLOR_PALETTE)]

        x1, y1, x2, y2 = item["bbox"]
        p_box1 = clip_point((x1, y1), w, h)
        p_box2 = clip_point((x2, y2), w, h)

        cv2.rectangle(img, p_box1, p_box2, color, DOOR_FINAL_FRAME_THICKNESS, cv2.LINE_AA)

        insert_pt = clip_point(item["insert_pix"], w, h)

        cv2.circle(img, insert_pt, DOOR_FINAL_INSERT_RADIUS + 4, (255, 255, 255), -1, cv2.LINE_AA)
        cv2.circle(img, insert_pt, DOOR_FINAL_INSERT_RADIUS, color, -1, cv2.LINE_AA)

        sx, sy = item["kp_start"]
        ex, ey = item["kp_end"]

        vx = ex - sx
        vy = ey - sy
        length = math.sqrt(vx * vx + vy * vy)

        if length < 1.0:
            continue

        ux = vx / length
        uy = vy / length

        box_w = abs(x2 - x1)
        box_h = abs(y2 - y1)
        leaf_len = min(max(length, min(box_w, box_h) * 0.55), max(box_w, box_h) * 1.05)

        start_x = insert_pt[0]
        start_y = insert_pt[1]
        end_x = start_x + ux * leaf_len
        end_y = start_y + uy * leaf_len

        p_leaf_start = clip_point((start_x, start_y), w, h)
        p_leaf_end = clip_point((end_x, end_y), w, h)

        cv2.arrowedLine(
            img,
            p_leaf_start,
            p_leaf_end,
            color,
            thickness=DOOR_FINAL_LEAF_THICKNESS,
            line_type=cv2.LINE_AA,
            tipLength=0.24
        )

        label = "{}{} placed".format(
            "LeftDoor" if item["class_name"] == "LeftDoor" else "RightDoor",
            idx + 1
        )

        tx = max(5, min(w - 260, int(x1)))
        ty = max(22, min(h - 5, int(y2) + 22))
        draw_text_with_outline(img, label, (tx, ty), color, scale=0.6)

    return img


# ============================================================
# 图例
# ============================================================

def make_legend_image():
    img = np.zeros((250, 1180, 3), dtype=np.uint8)

    c1 = COLOR_PALETTE[0]
    c2 = COLOR_PALETTE[1]

    cv2.arrowedLine(img, (45, 42), (180, 42), c1, 8, cv2.LINE_AA, tipLength=0.25)
    cv2.putText(
        img,
        "Furniture pose arrow: keypoint start -> keypoint end",
        (220, 50),
        cv2.FONT_HERSHEY_SIMPLEX,
        0.72,
        (255, 255, 255),
        2,
        cv2.LINE_AA
    )

    overlay = img.copy()
    cv2.arrowedLine(overlay, (45, 92), (180, 92), darker_color(c1, 0.55), 10, cv2.LINE_AA, tipLength=0.22)
    img = cv2.addWeighted(overlay, 0.35, img, 0.65, 0)
    cv2.putText(
        img,
        "Furniture default direction: bottom -> top inside bbox, same color but darker and transparent",
        (220, 100),
        cv2.FONT_HERSHEY_SIMPLEX,
        0.72,
        (255, 255, 255),
        2,
        cv2.LINE_AA
    )

    # 第九张图例：候选墙集合
    overlay2 = img.copy()
    for xx in range(45, 180, 22):
        cv2.circle(overlay2, (xx, 150), 8, c2, -1, cv2.LINE_AA)
    img = cv2.addWeighted(overlay2, 0.25, img, 0.75, 0)
    cv2.circle(img, (112, 150), 15, c2, -1, cv2.LINE_AA)
    cv2.circle(img, (112, 150), 20, c2, 4, cv2.LINE_AA)
    cv2.putText(
        img,
        "09: same-color transparent dotted walls = candidate host-wall set; solid large point = best projected insertion point",
        (220, 158),
        cv2.FONT_HERSHEY_SIMPLEX,
        0.72,
        (255, 255, 255),
        2,
        cv2.LINE_AA
    )

    cv2.arrowedLine(img, (45, 208), (180, 208), c2, 12, cv2.LINE_AA, tipLength=0.24)
    cv2.putText(
        img,
        "10: final single-door placement, no candidate host-wall dots retained",
        (220, 216),
        cv2.FONT_HERSHEY_SIMPLEX,
        0.72,
        (255, 255, 255),
        2,
        cv2.LINE_AA
    )

    return img


# ============================================================
# 主流程
# ============================================================

try:
    if doc is None:
        raise Exception("当前 Revit doc 为空，请确认在 Revit + Dynamo 环境中运行。")

    if not pixpath or not os.path.exists(pixpath):
        raise Exception("输入原始图片路径无效或不存在: {}".format(pixpath))

    pix_img = cv2.imread(pixpath, cv2.IMREAD_COLOR)
    if pix_img is None:
        raise Exception("cv2.imread 读取原图失败: {}".format(pixpath))

    img_h, img_w = pix_img.shape[:2]

    logs.append("输入原始图像: {}".format(pixpath))
    logs.append("图像尺寸: width={}, height={}".format(img_w, img_h))

    image_dir = os.path.dirname(os.path.abspath(pixpath))
    output_dir = os.path.join(image_dir, OUTPUT_FOLDER_NAME)
    ensure_dir(output_dir)
    logs.append("输出目录: {}".format(output_dir))

    if not wall_mask_img_path or not os.path.exists(wall_mask_img_path):
        auto_path = os.path.join(output_dir, "06_wall_thickness_semantic_bars.png")
        if os.path.exists(auto_path):
            wall_mask_img_path = auto_path
            logs.append("自动找到墙体遮罩图: {}".format(wall_mask_img_path))

    if wall_mask_img_path and os.path.exists(wall_mask_img_path):
        base_img = cv2.imread(wall_mask_img_path, cv2.IMREAD_COLOR)
        if base_img is None:
            logs.append("读取墙体遮罩图失败，使用原图作为底图。")
            base_img = pix_img.copy()
        else:
            logs.append("读取墙体遮罩图成功: {}".format(wall_mask_img_path))
    else:
        logs.append("未提供墙体遮罩图，使用原图作为底图。")
        base_img = pix_img.copy()

    if base_img.shape[1] != img_w or base_img.shape[0] != img_h:
        base_img = cv2.resize(base_img, (img_w, img_h), interpolation=cv2.INTER_LINEAR)
        logs.append("底图尺寸与原图不同，已 resize 到原图尺寸。")

    class_config = load_class_config(class_config_json_path)
    seg_meta = load_json_multi_encoding(seg_meta_json_path, "seg_meta_json_path")

    mapper = PixelRevitMapper(img_w, img_h, fallback_scale, seg_meta)

    walls = get_all_walls(doc)
    logs.append("当前 Revit 文档墙体数量: {}".format(len(walls)))

    model = get_model(pose_Model)
    instances, names = run_pose_inference(model, pixpath)

    area_threshold_by_class = {}
    for cname, cfg in class_config.items():
        if bool(cfg.get("area_filter", False)):
            med, th = compute_class_area_threshold(instances, cname)
            area_threshold_by_class[cname] = {"median": med, "threshold": th}
            logs.append("类别{}面积过滤: median={}, threshold={}".format(cname, med, th))

    furniture_items = []
    door_items_raw = []
    skipped = []

    for ins in instances:
        cname = ins["class_name"]

        if cname not in class_config:
            skipped.append({"class_name": cname, "reason": "class_not_in_config"})
            continue

        cfg = class_config[cname]
        mode = str(cfg.get("placement_mode", "free")).strip().lower()

        x1, y1, x2, y2 = ins["bbox"]
        area = max(0.0, x2 - x1) * max(0.0, y2 - y1)

        if bool(cfg.get("area_filter", False)):
            th = area_threshold_by_class.get(cname, {}).get("threshold", 0.0)
            if th > 0 and area < th:
                skipped.append({
                    "class_name": cname,
                    "reason": "area_filter",
                    "area": area,
                    "threshold": th
                })
                continue

        kp_start, kp_end = get_kp_pair(ins, cfg)

        if mode == "free":
            if kp_start is None or kp_end is None:
                skipped.append({"class_name": cname, "reason": "no_valid_keypoints_for_furniture"})
                continue

            furniture_items.append({
                "class_name": cname,
                "conf": ins["conf"],
                "bbox": ins["bbox"],
                "center_pix": ins["center_pix"],
                "kp_start": kp_start,
                "kp_end": kp_end
            })

        elif mode == "door_hosted":
            if cname not in ["LeftDoor", "RightDoor"]:
                skipped.append({"class_name": cname, "reason": "door_hosted_but_not_single_door"})
                continue

            if kp_start is None or kp_end is None:
                skipped.append({"class_name": cname, "reason": "no_valid_keypoints_for_door"})
                continue

            door_items_raw.append({
                "instance": ins,
                "config": cfg,
                "kp_start": kp_start,
                "kp_end": kp_end
            })

    logs.append("家具可视化实例数量: {}".format(len(furniture_items)))
    logs.append("单开门候选实例数量: {}".format(len(door_items_raw)))

    door_items = []

    for idx, d in enumerate(door_items_raw):
        ins = d["instance"]
        cfg = d["config"]

        candidates = build_door_candidates(ins, cfg, mapper, walls)

        if not candidates:
            logs.append("单开门 idx={} class={} 未找到有效宿主墙候选。".format(
                idx, ins["class_name"]
            ))
            continue

        best = candidates[0]

        # 候选墙集合像素化
        candidate_walls_pix = []
        for cand in candidates:
            curve = cand["curve"]
            p0 = curve.GetEndPoint(0)
            p1 = curve.GetEndPoint(1)

            candidate_walls_pix.append({
                "wall_id": cand["wall"].Id.IntegerValue,
                "p0": mapper.revit_to_pix(p0),
                "p1": mapper.revit_to_pix(p1),
                "score": float(cand["score"])
            })

        best_curve = best["curve"]
        best_p0 = best_curve.GetEndPoint(0)
        best_p1 = best_curve.GetEndPoint(1)

        item = {
            "index": idx,
            "class_name": ins["class_name"],
            "conf": ins["conf"],
            "bbox": ins["bbox"],
            "center_pix": tuple(ins["center_pix"]),
            "kp_start": d["kp_start"],
            "kp_end": d["kp_end"],
            "insert_pix": mapper.revit_to_pix(best["insert_pt"]),
            "host_wall_id": best["wall"].Id.IntegerValue,
            "host_score": float(best["score"]),
            "host_dist_ref": float(best["dist_ref"]),
            "host_dist_s": float(best["dist_s"]),
            "host_dist_b": float(best["dist_b"]),
            "perp_score": float(best["perp_score"]),
            "host_t": float(best["t"]),
            "candidate_count": len(candidates),

            # 第九张：候选墙集合
            "candidate_walls_pix": candidate_walls_pix,

            # 第九张：最佳墙单独标识
            "best_wall_pix": {
                "p0": mapper.revit_to_pix(best_p0),
                "p1": mapper.revit_to_pix(best_p1),
                "wall_id": best["wall"].Id.IntegerValue
            }
        }

        door_items.append(item)

        logs.append(
            "单开门 idx={} class={} best_wall={} score={:.3f} candidates={}".format(
                idx,
                ins["class_name"],
                item["host_wall_id"],
                item["host_score"],
                item["candidate_count"]
            )
        )

    logs.append("成功完成宿主墙筛选的单开门数量: {}".format(len(door_items)))

    # 08
    furniture_img = draw_furniture_direction_image(base_img, furniture_items)
    furniture_path = os.path.join(output_dir, "08_furniture_pose_direction.png")
    save_image(furniture_path, furniture_img)

    # 09
    door_host_img = draw_door_host_selection_image(base_img, door_items)
    door_host_path = os.path.join(output_dir, "09_singledoor_host_wall_selection.png")
    save_image(door_host_path, door_host_img)

    # 10：注意这里用 base_img 重新绘制，不保留第九张的候选墙点
    door_final_img = draw_door_final_placement_image(base_img, door_items)
    door_final_path = os.path.join(output_dir, "10_singledoor_final_placement.png")
    save_image(door_final_path, door_final_img)

    legend_img = make_legend_image()
    legend_path = os.path.join(output_dir, "08_09_10_pose_visualization_legend.png")
    save_image(legend_path, legend_img)

    def jsonable_item(item):
        out = {}
        for k, v in item.items():
            if isinstance(v, tuple):
                out[k] = [float(x) for x in v]
            elif isinstance(v, list):
                out[k] = v
            elif isinstance(v, np.ndarray):
                out[k] = v.tolist()
            elif isinstance(v, (int, float, str, bool)) or v is None:
                out[k] = v
            else:
                try:
                    out[k] = float(v)
                except:
                    out[k] = str(v)
        return out

    info = {
        "source_image": pixpath,
        "base_wall_mask": wall_mask_img_path,
        "seg_meta_json_path": seg_meta_json_path,
        "class_config_json_path": class_config_json_path,
        "furniture_count": len(furniture_items),
        "single_door_count": len(door_items),
        "furniture_items": [jsonable_item(x) for x in furniture_items],
        "door_items": [jsonable_item(x) for x in door_items],
        "skipped": skipped
    }

    info_path = os.path.join(output_dir, "08_09_10_pose_visualization_info.json")
    with open(info_path, "w", encoding="utf-8") as f:
        json.dump(info, f, ensure_ascii=False, indent=2)

    logs.append("已保存可视化信息 JSON: {}".format(info_path))

    OUT = {
        "success": True,
        "output_dir": output_dir,
        "furniture_pose_direction": furniture_path,
        "single_door_host_wall_selection": door_host_path,
        "single_door_final_placement": door_final_path,
        "legend": legend_path,
        "info_json": info_path,
        "furniture_count": int(len(furniture_items)),
        "single_door_count": int(len(door_items)),
        "skipped_count": int(len(skipped)),
        "logs": logs
    }

except Exception as e:
    logs.append("执行失败: {}".format(str(e)))
    logs.append(traceback.format_exc())

    OUT = {
        "success": False,
        "error": str(e),
        "logs": logs
    }
# ----------------------------------------
