# Dynamo graph xin1.dyn (Dynamo 3.0.3.7597)

restart = BoolSelector(false)  # graph input
python_script = Python(IN[0]=restart)  # CPython3
# ---------- python_script.python (2 lines) ----------
import sys
OUT = sys.version, sys.path
# ----------------------------------------
python_paths = CodeBlock(i=python_script) { i[1]; }
python_paths_2 = Watch(python_paths)  # graph output
python_version = CodeBlock(i=python_script) { i[0]; }
python_version_2 = Watch(python_version)  # graph output
python_script_2 = Python(IN[0]=restart)  # CPython3; frozen; unwired: IN[1]
# ---------- python_script_2.python (26 lines) ----------
# 加载 Python Standard 和 DesignScript 库
import sys
import clr
clr.AddReference('ProtoGeometry')
from Autodesk.DesignScript.Geometry import *
sys.path.append("C:/Users/Lenovo/anaconda3/envs/revitenv/Lib/site-packages")
import numpy as np
import torch
import cv2
from ultralytics import YOLO

# 该节点的输入内容将存储为 IN 变量中的一个列表。
dataEnteringNode = IN                            
# 将代码放在该行下面                          
yolo_seg = YOLO("E:/yanjiu/hou_pracs_on/Testings/Saves/yolov8l-seg.pt",task = "seg")

filepath = "E:/yanjiu/revitss/tests/jiedao.jpg"
newpath = "E:/yanjiu/revitss/tests/jiedao_seg.jpg"

seg_result = yolo_seg(source = filepath,save = False,conf = 0.3,iou = 0.45,imgsz = 640)
cv2.imwrite(newpath,seg_result[0].plot())



# 将输出内容指定给 OUT 变量。
OUT = torch.__version__
# ----------------------------------------
python_version_3 = Watch(python_script_2)  # graph output
imagepath = Filename("E:\yanjiu\revitss\tests\jiedao.jpg")
file_from_path = FileObject(path=imagepath)
readFromFile = Image.ReadFromFile(file=file_from_path)
watch_image = WatchImageCore(image=readFromFile)  # frozen
python_script_3 = Python(IN[0]=readFromFile, IN[1]=imagepath)  # CPython3; frozen
# ---------- python_script_3.python (28 lines) ----------
# 加载 Python Standard 和 DesignScript 库
import sys
import clr
clr.AddReference('ProtoGeometry')
from Autodesk.DesignScript.Geometry import *
sys.path.append("C:/Users/Lenovo/anaconda3/envs/revitenv/Lib/site-packages")
import numpy as np
import torch
import cv2
from ultralytics import YOLO

# 该节点的输入内容将存储为 IN 变量中的一个列表。
dataEnteringNode = IN 
piximage = IN[0]
pixpath = IN[1]                           
# 将代码放在该行下面                          
yolo_seg = YOLO("E:/yanjiu/hou_pracs_on/Testings/Saves/yolov8l-seg.pt",task = "seg")

filepath = "E:/yanjiu/revitss/tests/jiedao.jpg"
newpath = "E:/yanjiu/revitss/tests/jiedao_seg.jpg"

seg_result = yolo_seg(source = pixpath,save = False,conf = 0.3,iou = 0.45,imgsz = 640)
cv2.imwrite(newpath,seg_result[0].plot())



# 将输出内容指定给 OUT 变量。
OUT = newpath
# ----------------------------------------
file_from_path_2 = FileObject(path=python_script_3)
readFromFile_2 = Image.ReadFromFile(file=file_from_path_2)
watch_image_2 = WatchImageCore(image=readFromFile_2)
imagepath_2 = Filename("..\tests\2室2厅1厨1卫-74.38㎡-南 北-103103288208.jpg")
file_from_path_3 = FileObject(path=imagepath_2)
readFromFile_3 = Image.ReadFromFile(file=file_from_path_3)
watch_image_3 = WatchImageCore(image=readFromFile_3)
modelpath = Filename("E:\yanjiu\hou_pracs_on\Testings\Saves\best_detect1.pt")
python_script_4 = Python(IN[0]=modelpath, IN[1]=imagepath_2)  # CPython3; frozen
# ---------- python_script_4.python (104 lines) ----------
# 加载 Python Standard 和 DesignScript 库
import sys
import clr
clr.AddReference('ProtoGeometry')
from Autodesk.DesignScript.Geometry import *
import Autodesk.DesignScript.Geometry as DS
import Revit
from Revit.Elements import *
import System
sys.path.append("C:/Users/Lenovo/anaconda3/envs/revitenv/Lib/site-packages")
clr.AddReference('RevitAPI')
clr.AddReference('RevitAPIUI')
from Autodesk.Revit.DB import *
from Autodesk.Revit.UI import *

clr.AddReference('RevitServices')
from RevitServices.Persistence import DocumentManager
from RevitServices.Transactions import TransactionManager

clr.AddReference('RevitNodes')
import Revit
clr.ImportExtensions(Revit.Elements)
clr.ImportExtensions(Revit.GeometryConversion)
#
import numpy as np
import torch
import cv2
from ultralytics import YOLO

dataEnteringNode = IN 
dect_Model = IN[0]
pixpath = IN[1]
#params
origin = XYZ(0, 0, 0)   
widthFt = 10.0
pixelWidth = 1600   
pixelHeight = 1200                          
#                         
yolo_dect = YOLO(dect_Model,task = "detect")
newpath = "E:/yanjiu/revitss/tests/jjianzhu_dect.jpg"

dect_result = yolo_dect(source = pixpath,save = False,conf = 0.3,iou = 0.45,imgsz = 640)
cv2.imwrite(newpath,dect_result[0].plot())
#tempouts = []
#tempouts.append(newpath)
#tempouts.extend(dect_result)
scaleX = widthFt / pixelWidth
scaleY = widthFt * (pixelHeight / pixelWidth) / pixelHeight  

result = dect_result[0]        
boxes = result.boxes
xyxy = boxes.xyxy.cpu().numpy() 

doc = DocumentManager.Instance.CurrentDBDocument
app = doc.Application
TransactionManager.Instance.EnsureInTransaction(doc)

created_lines = []
dyn_lines = [] 
dyn_faces = [] 

def pix_to_revit(x, y):
    revit_x = origin.X + x * scaleX
    revit_y = origin.Y + (pixelHeight - y) * scaleY  # 翻转 Y 轴
    return XYZ(revit_x, revit_y, origin.Z)
plane = Plane.CreateByNormalAndOrigin(XYZ.BasisZ, origin)
sketch_plane = SketchPlane.Create(doc, plane)

for bbox in xyxy:
    x1, y1, x2, y2 = bbox  # 左上角 (x1,y1), 右下角 (x2,y2)
    
    # 计算四个角点的 Revit 坐标
    pt1 = pix_to_revit(x1, y1)  # 左上
    pt2 = pix_to_revit(x2, y1)  # 右上
    pt3 = pix_to_revit(x2, y2)  # 右下
    pt4 = pix_to_revit(x1, y2)  # 左下
    
    # 创建四条线
    lines = [
        Line.CreateBound(pt1, pt2),
        Line.CreateBound(pt2, pt3),
        Line.CreateBound(pt3, pt4),
        Line.CreateBound(pt4, pt1)
    ]
    
    # 创建模型线并添加到列表
    for line in lines:
        model_curve = doc.Create.NewModelCurve(line, sketch_plane)
        created_lines.append(model_curve)
        start_dyn = line.GetEndPoint(0).ToPoint()
        end_dyn = line.GetEndPoint(1).ToPoint()
        dyn_line = DS.Line.ByStartPointEndPoint(start_dyn, end_dyn)
        dyn_lines.append(dyn_line)
    poly = DS.PolyCurve.ByJoinedCurves(dyn_lines, 0.001)
    if poly.IsClosed:
        surface = DS.Surface.ByPatch(poly)
        dyn_faces.append(surface)
    

TransactionManager.Instance.TransactionTaskDone()
doc.Regenerate()
# Outss
#OUT = [created_lines, dyn_lines]
OUT = dyn_faces
# ----------------------------------------
imagepath_3 = Filename("..\tests\2室2厅1厨1卫-74.8㎡-南 西-103110719609.jpg")
scale = DoubleInput(57)
modelpath_2 = Filename("..\..\hou_pracs_on\Testings\Saves\best_seg2.pt")
number = DoubleInput(9.94)
exe_path = Filename("C:\Users\Lenovo\anaconda3\envs\revitenv\python.exe")
script_path = Filename("..\..\hou_pracs_on\revit_paddleocr_tests\jsons\ocr_runner.py")
string = StringInput("E:\yanjiu\hou_pracs_on\revit_paddleocr_tests\jsons")
json_path = Filename("..\..\hou_pracs_on\revit_paddleocr_tests\jsons\Test1.json")
read_length_export2Json = Python(IN[0]=imagepath_2, IN[1]=exe_path, IN[2]=script_path, IN[3]=string, IN[4]=json_path)  # CPython3
# ---------- read_length_export2Json.python (217 lines) ----------
# 加载 Python Standard 和 DesignScript 库
import sys
import clr
clr.AddReference('ProtoGeometry')
from Autodesk.DesignScript.Geometry import *

import os
import json
import subprocess
import shutil
import re

# IN[0] = 原始图片长路径（不能动）
# IN[1] = revitenv python.exe 路径
# IN[2] = ocr_runner.py 路径
# IN[3] = 临时工作目录，例如 E:\temp_ocr
# IN[4] = json 输出路径，例如 E:\temp_ocr\ocr_result.json

src_image_path = IN[0]
python_exe = IN[1]
script_path = IN[2]
work_dir = IN[3]
output_json = IN[4]

def ensure_dir(path):
    if not os.path.exists(path):
        os.makedirs(path)

def classify_text(text):
    t = (text or "").strip()

    room_keywords = ["客厅", "卧室", "厨房", "卫生间", "阳台", "餐厅", "书房", "主卧", "次卧"]
    if any(k in t for k in room_keywords):
        return "room_name"

    if re.match(r'^\d+(\.\d+)?\s*(m²|m2|㎡)$', t, re.I):
        return "area"

    if re.match(r'^\d+(\.\d+)?$', t):
        return "number"

    # 含尺寸链常见符号/字母/数字
    if re.search(r'[\dKk→—\-米]+', t):
        nums = extract_dimension_numbers(t)
        if len(nums) >= 2:
            return "dimension_chain"
        elif len(nums) == 1:
            return "dimension_like"

    return "other"

def normalize_area_text(text):
    t = (text or "").strip()
    t = t.replace("㎡", "m²")
    t = re.sub(r'(?i)m2', 'm²', t)
    return t

def extract_dimension_numbers(text):
    """
    从类似 'K1280→1325→1905—→K3390—715' 中提取数字序列
    返回 [1280,1325,1905,3390,715]
    """
    if not text:
        return []
    nums = re.findall(r'\d+(?:\.\d+)?', text)
    result = []
    for n in nums:
        try:
            if "." in n:
                result.append(float(n))
            else:
                result.append(int(n))
        except:
            pass
    return result

def is_valid_item(item):
    text = (item.get("text") or "").strip()
    score = float(item.get("score", 0))
    kind = item.get("kind", "other")

    if not text:
        return False

    # 不同类型不同阈值
    if kind == "room_name":
        return score >= 0.75
    elif kind == "area":
        return score >= 0.75
    elif kind == "number":
        return score >= 0.85
    elif kind == "dimension_chain":
        # 尺寸链可以稍微放宽，因为经常混入符号
        return score >= 0.70 or len(item.get("dimension_numbers", [])) >= 2
    elif kind == "dimension_like":
        return score >= 0.75
    else:
        return score >= 0.75

def poly_center(poly):
    try:
        xs = [p[0] for p in poly]
        ys = [p[1] for p in poly]
        return [sum(xs) / float(len(xs)), sum(ys) / float(len(ys))]
    except:
        return None

try:
    ensure_dir(work_dir)

    # 固定复制输出图像
    test_image_path = os.path.join(work_dir, "Test1.jpg")

    # 直接复制文件，最稳
    shutil.copyfile(src_image_path, test_image_path)

    # 调外部 python
    cmd = [python_exe, script_path, test_image_path, output_json]

    p = subprocess.Popen(
        cmd,
        stdout=subprocess.PIPE,
        stderr=subprocess.PIPE,
        shell=False
    )
    stdout, stderr = p.communicate()

    stdout_text = stdout.decode("utf-8", errors="ignore")
    stderr_text = stderr.decode("utf-8", errors="ignore")

    if not os.path.exists(output_json):
        OUT = {
            "ok": False,
            "error": "output_json not found",
            "src_image_path": src_image_path,
            "test_image_path": test_image_path,
            "cmd": cmd,
            "stdout": stdout_text,
            "stderr": stderr_text
        }
    else:
        with open(output_json, "r", encoding="utf-8") as f:
            data = json.load(f)

        if not data.get("ok", False):
            OUT = {
                "ok": False,
                "src_image_path": src_image_path,
                "test_image_path": test_image_path,
                "cmd": cmd,
                "stdout": stdout_text,
                "stderr": stderr_text,
                "json": data
            }
        else:
            items = data.get("items", [])
            processed_items = []

            for item in items:
                text = (item.get("text") or "").strip()
                score = float(item.get("score", 0))
                poly = item.get("poly", None)

                clean_text = normalize_area_text(text)
                kind = classify_text(clean_text)
                dim_nums = extract_dimension_numbers(clean_text)
                center = poly_center(poly) if isinstance(poly, list) else None

                item2 = {
                    "text": text,
                    "clean_text": clean_text,
                    "score": score,
                    "poly": poly,
                    "center": center,
                    "kind": kind,
                    "dimension_numbers": dim_nums
                }

                item2["valid"] = is_valid_item(item2)
                processed_items.append(item2)

            valid_items = [x for x in processed_items if x["valid"]]
            invalid_items = [x for x in processed_items if not x["valid"]]

            room_items = [x for x in valid_items if x["kind"] == "room_name"]
            area_items = [x for x in valid_items if x["kind"] == "area"]
            number_items = [x for x in valid_items if x["kind"] == "number"]
            dimension_chain_items = [x for x in valid_items if x["kind"] == "dimension_chain"]
            dimension_like_items = [x for x in valid_items if x["kind"] == "dimension_like"]
            other_items = [x for x in valid_items if x["kind"] == "other"]

            OUT = {
                "ok": True,
                "src_image_path": src_image_path,
                "test_image_path": test_image_path,
                "output_json": output_json,
                "cmd": cmd,
                "stdout": stdout_text,
                "stderr": stderr_text,
                "all_items": processed_items,
                "valid_items": valid_items,
                "invalid_items": invalid_items,
                "room_items": room_items,
                "area_items": area_items,
                "number_items": number_items,
                "dimension_chain_items": dimension_chain_items,
                "dimension_like_items": dimension_like_items,
                "other_items": other_items
            }
            OUT = output_json

except Exception as e:
    OUT = {
        "ok": False,
        "error": str(e),
        "src_image_path": src_image_path
    }
# ----------------------------------------
layout_Process_data_JsonPath = Filename("..\..\hou_pracs_on\revit_paddleocr_tests\jsons\Test1_dims.json")
wash_json_2_Length = Python(IN[0]=read_length_export2Json, IN[1]=layout_Process_data_JsonPath)  # CPython3
# ---------- wash_json_2_Length.python (265 lines) ----------
# 加载 Python Standard 和 DesignScript 库
import sys
import clr
clr.AddReference('ProtoGeometry')
from Autodesk.DesignScript.Geometry import *
#-----------------------
import json
import re
import os

ocr_json_path = IN[0]
result_json_path = IN[1]

def ensure_dir_of_file(file_path):
    folder = os.path.dirname(file_path)
    if folder and not os.path.exists(folder):
        os.makedirs(folder)

def get_poly(item):
    return item.get("poly", None)

def get_center(item):
    poly = get_poly(item)
    if poly:
        xs = [p[0] for p in poly]
        ys = [p[1] for p in poly]
        return sum(xs) / float(len(xs)), sum(ys) / float(len(ys))
    return None, None

def get_width_height(item):
    poly = get_poly(item)
    if not poly:
        return None, None
    xs = [p[0] for p in poly]
    ys = [p[1] for p in poly]
    return max(xs) - min(xs), max(ys) - min(ys)

def infer_axis(item):
    w, h = get_width_height(item)
    if w is None or h is None:
        return "unknown"
    if w >= h * 1.5:
        return "horizontal"
    elif h >= w * 1.5:
        return "vertical"
    else:
        return "unknown"

def extract_numbers_from_text(text):
    nums = re.findall(r'\d+(?:\.\d+)?', text or "")
    result = []
    for n in nums:
        try:
            v = float(n)
            if 100 <= v <= 50000:
                # 尽量转 int，便于后续使用
                if abs(v - int(v)) < 1e-6:
                    result.append(int(v))
                else:
                    result.append(v)
        except:
            pass
    return result

def classify_text(text):
    nums = extract_numbers_from_text(text)
    if len(nums) >= 2:
        return "dimension_chain"
    elif len(nums) == 1:
        return "number"
    return "other"

def is_valid_dimension_item(item):
    text = str(item.get("text", "")).strip()
    score = float(item.get("score", 0))
    kind = classify_text(text)
    nums = extract_numbers_from_text(text)

    if len(nums) == 0:
        return False

    if kind in ["number", "dimension_chain"] and score >= 0.75:
        return True

    return False

def build_processed_items(items):
    result = []
    for item in items:
        text = str(item.get("text", "")).strip()
        nums = extract_numbers_from_text(text)
        kind = classify_text(text)
        center = get_center(item)

        result.append({
            "text": text,
            "score": float(item.get("score", 0)),
            "poly": item.get("poly", None),
            "center": center,
            "kind": kind,
            "dimension_numbers": nums,
            "valid": is_valid_dimension_item(item)
        })
    return result

def group_items(items, axis, tol=60):
    groups = []

    for item in items:
        x, y = item.get("center", (None, None))
        if x is None:
            continue

        coord = y if axis == "horizontal" else x

        found = None
        for g in groups:
            if abs(g["coord"] - coord) <= tol:
                found = g
                break

        if found is None:
            found = {"axis": axis, "coord": coord, "items": []}
            groups.append(found)

        found["items"].append(item)

    # 更新组坐标
    for g in groups:
        vals = []
        for it in g["items"]:
            x, y = it.get("center", (None, None))
            vals.append(y if axis == "horizontal" else x)
        if vals:
            g["coord"] = sum(vals) / float(len(vals))

    return groups

def dedup_group_numbers(group, axis):
    entries = []

    for item in group["items"]:
        nums = item.get("dimension_numbers", [])
        x, y = item.get("center", (None, None))
        pos = x if axis == "horizontal" else y

        for n in nums:
            entries.append({
                "value": n,
                "pos": pos,
                "text": item.get("text", "")
            })

    entries = sorted(entries, key=lambda e: e["pos"] if e["pos"] is not None else 0)

    deduped = []
    for e in entries:
        duplicated = False
        for d in deduped:
            same_value = (d["value"] == e["value"])
            close_pos = False
            if d["pos"] is not None and e["pos"] is not None:
                close_pos = abs(d["pos"] - e["pos"]) <= 20
            if same_value and close_pos:
                duplicated = True
                break
        if not duplicated:
            deduped.append(e)

    return deduped

def summarize_group(group, axis):
    deduped = dedup_group_numbers(group, axis)
    values = [e["value"] for e in deduped]

    texts = []
    seen = set()
    for item in group["items"]:
        t = item.get("text", "")
        if t not in seen:
            texts.append(t)
            seen.add(t)

    return {
        "axis": axis,
        "coord": group["coord"],
        "count": len(group["items"]),
        "values": values,
        "sum": sum(values) if values else None,
        "texts": texts
    }

try:
    with open(ocr_json_path, "r", encoding="utf-8") as f:
        data = json.load(f)

    if not data.get("ok", False):
        result_data = {
            "ok": False,
            "error": "ocr json not ok",
            "source_json": ocr_json_path
        }
    else:
        raw_items = data.get("items", [])
        items = build_processed_items(raw_items)

        dim_items = [it for it in items if it["valid"]]

        horizontal_items = [it for it in dim_items if infer_axis(it) == "horizontal"]
        vertical_items = [it for it in dim_items if infer_axis(it) == "vertical"]

        horizontal_groups = [summarize_group(g, "horizontal") for g in group_items(horizontal_items, "horizontal", 60)]
        vertical_groups = [summarize_group(g, "vertical") for g in group_items(vertical_items, "vertical", 60)]

        horizontal_groups = [g for g in horizontal_groups if g["sum"] is not None]
        vertical_groups = [g for g in vertical_groups if g["sum"] is not None]

        horizontal_groups = sorted(horizontal_groups, key=lambda g: g["sum"], reverse=True)
        vertical_groups = sorted(vertical_groups, key=lambda g: g["sum"], reverse=True)

        horizontal_main = horizontal_groups[0] if horizontal_groups else None
        vertical_main = vertical_groups[0] if vertical_groups else None

        result_data = {
            "ok": True,
            "source_json": ocr_json_path,
            "result": {
                "horizontal_length": horizontal_main["sum"] if horizontal_main else None,
                "vertical_length": vertical_main["sum"] if vertical_main else None,
                "horizontal_candidates": [g["sum"] for g in horizontal_groups],
                "vertical_candidates": [g["sum"] for g in vertical_groups],
                "horizontal_segments": horizontal_main["values"] if horizontal_main else [],
                "vertical_segments": vertical_main["values"] if vertical_main else [],
                "horizontal_coord": horizontal_main["coord"] if horizontal_main else None,
                "vertical_coord": vertical_main["coord"] if vertical_main else None
            },
            "debug": {
                "horizontal_groups": horizontal_groups,
                "vertical_groups": vertical_groups
            }
        }

    ensure_dir_of_file(result_json_path)
    with open(result_json_path, "w", encoding="utf-8") as f:
        json.dump(result_data, f, ensure_ascii=False, indent=2)

    # Dynamo 输出尽量简单
    OUT = result_json_path

except Exception as e:
    err = {
        "ok": False,
        "error": str(e),
        "source_json": ocr_json_path,
        "result_json_path": result_json_path
    }

    try:
        ensure_dir_of_file(result_json_path)
        with open(result_json_path, "w", encoding="utf-8") as f:
            json.dump(err, f, ensure_ascii=False, indent=2)
    except:
        pass

    OUT = result_json_path
# ----------------------------------------
python_version_4 = Watch(wash_json_2_Length)  # graph output
seg_meta_Json_Path = Filename("..\..\hou_pracs_on\revit_paddleocr_tests\jsons\seg_meta.json")
python_script_5 = Python(IN[0]=modelpath_2, IN[1]=imagepath_2, IN[2]=number, IN[3]=scale, IN[4]=python_version_4, IN[5]=seg_meta_Json_Path)  # CPython3
# ---------- python_script_5.python (1309 lines) ----------
# 加载 Python Standard和 DesignScript 库
#--------------------
import sys
import clr
clr.AddReference('ProtoGeometry')
from Autodesk.DesignScript.Geometry import *
import Autodesk.DesignScript.Geometry as DS
import Revit
from Revit.Elements import *
import System
sys.path.append("C:/Users/Lenovo/anaconda3/envs/revitenv/Lib/site-packages")
clr.AddReference('RevitAPI')
clr.AddReference('RevitAPIUI')
from Autodesk.Revit.DB import *
from Autodesk.Revit.UI import *

clr.AddReference('RevitServices')
from RevitServices.Persistence import DocumentManager
from RevitServices.Transactions import TransactionManager

clr.AddReference('RevitNodes')
import Revit
clr.ImportExtensions(Revit.Elements)
clr.ImportExtensions(Revit.GeometryConversion)

import re
import math
import json
import os
import traceback
import numpy as np
import torch
import cv2

from scipy.spatial import Voronoi
from scipy import ndimage
from shapely.geometry import Polygon, LineString, MultiLineString
from shapely.ops import linemerge
from shapely.ops import unary_union, split
from shapely.geometry import Point as ShpPoint
from shapely.geometry import Polygon as ShpPolygon
from shapely.geometry import MultiPolygon as ShpMultiPolygon
from shapely.geometry import Point as ShpPoint
from shapely.geometry import MultiLineString
from shapely.ops import linemerge
from skimage.morphology import skeletonize
from ultralytics import YOLO

dataEnteringNode = IN 

# =========================
# 输入
# =========================
dect_Model = IN[0]
pixpath = IN[1]
height = IN[2]
scale = IN[3]   # 保留作fallback
dims_json_path = IN[4]   # 新增：OCR尺寸结果json
seg_meta_json_path = IN[5]  # 新增：本节点输出json

#debug_scale
scale = 10
# =========================
# 参数
# =========================
origin = XYZ(0, 0, 0)   
widthFt = scale
pixelWidth = 1600   
pixelHeight = 1200 
DENSIFY_DIST = 0.5  
EPS = 1e-6

TARGET_WALL_TYPE_NAME = "基本墙 200mm"
TARGET_LEVEL_NAME = "标高 2"

newpath = "E:/yanjiu/revitss/tests/jjianzhu_seg.jpg"

# fallback 初始比例（当dims_json失败时使用）
scaleX = widthFt / pixelWidth if pixelWidth > 0 else 0.0
scaleY = widthFt * (pixelHeight / pixelWidth) / pixelHeight if pixelWidth > 0 and pixelHeight > 0 else 0.0

# 全局比例和bbox，供 pix_to_revit 使用
bbox_info_global = None
scale_x_ft_per_px_global = None
scale_y_ft_per_px_global = None

logs = []

# =========================
# 工具函数
# =========================
def ensure_dir_of_file(file_path):
    folder = os.path.dirname(file_path)
    if folder and not os.path.exists(folder):
        os.makedirs(folder)

def pix_to_revit(x, y):
    """
    优先使用：墙体bbox局部坐标 + OCR真实尺寸得到的比例
    fallback：原来的整图scale
    """
    global bbox_info_global, scale_x_ft_per_px_global, scale_y_ft_per_px_global

    try:
        if bbox_info_global is not None and scale_x_ft_per_px_global is not None and scale_y_ft_per_px_global is not None:
            min_x = bbox_info_global["min_x"]
            min_y = bbox_info_global["min_y"]
            bbox_h = bbox_info_global["height"]

            local_x = x - min_x
            local_y = y - min_y

            revit_x = origin.X + local_x * scale_x_ft_per_px_global
            revit_y = origin.Y + (bbox_h - local_y) * scale_y_ft_per_px_global
            return XYZ(revit_x, revit_y, origin.Z)
    except:
        pass

    revit_x = origin.X + x * scaleX
    revit_y = origin.Y + (pixelHeight - y) * scaleY
    return XYZ(revit_x, revit_y, origin.Z)

def sanitize_name(name):
    if not name:
        return "Unknown"
    cleaned = re.sub(r'[\x00-\x1f\x7f]', '', name)
    if not cleaned.strip():
        return "Unnamed"
    return cleaned

def get_mask_bbox(binary_mask, logs):
    """
    提取二值墙体mask的外接框
    """
    if binary_mask is None:
        logs.append("get_mask_bbox失败: binary_mask is None")
        return None

    ys, xs = np.where(binary_mask > 0)
    if len(xs) == 0 or len(ys) == 0:
        logs.append("get_mask_bbox失败: 墙体mask为空")
        return None

    min_x = int(np.min(xs))
    max_x = int(np.max(xs))
    min_y = int(np.min(ys))
    max_y = int(np.max(ys))

    bbox = {
        "min_x": min_x,
        "min_y": min_y,
        "max_x": max_x,
        "max_y": max_y,
        "width": int(max_x - min_x + 1),
        "height": int(max_y - min_y + 1)
    }
    logs.append("墙体mask bbox: {}".format(str(bbox)))
    return bbox

# 你必须根据自己的模型类别名修改这里
WALL_CLASS_NAMES = set(["wall", "Wall", "墙体"])
WALL_CLASS_KEYWORDS = [
    "wall",
    "Wall",
    "basic wall",
    "bearing wall",
    "non-bearing wall",
    "shear wall",
    "墙",
    "墙体",
    "基本墙",
    "基本墙 200mm",
    "承重墙",
    "非承重墙",
    "剪力墙"
]

def normalize_class_name(name):
    if name is None:
        return ""
    return str(name).strip().lower()

def is_wall_class(name):
    n = normalize_class_name(name)
    if not n:
        return False
    for kw in WALL_CLASS_KEYWORDS:
        if kw.lower() in n:
            return True
    return False

def ensure_polygon(geom):
    """
    将 geometry 尽量转成一个有效 Polygon
    如果是 MultiPolygon，则取面积最大的一个
    """
    if geom is None or geom.is_empty:
        return None
    try:
        if not geom.is_valid:
            geom = geom.buffer(0)
    except:
        pass
    if geom is None or geom.is_empty:
        return None

    if isinstance(geom, ShpPolygon):
        return geom

    if isinstance(geom, ShpMultiPolygon):
        polys = [g for g in geom.geoms if g is not None and not g.is_empty]
        if not polys:
            return None
        polys.sort(key=lambda p: p.area, reverse=True)
        return polys[0]

    return None

def contour_to_polygon(contour_pts):
    """
    contour_pts: YOLO mask contour pixel points
    转成shapely polygon（Revit坐标系）
    """
    revit_pts = [pix_to_revit(pt[0], pt[1]) for pt in contour_pts]
    if len(revit_pts) < 3:
        return None
    coords = [(p.X, p.Y) for p in revit_pts]
    if coords[0] != coords[-1]:
        coords.append(coords[0])
    poly = ShpPolygon(coords)
    poly = ensure_polygon(poly)
    return poly

def line_long_enough(line_geom, min_len=0.1):
    if line_geom is None or line_geom.is_empty:
        return False
    try:
        return line_geom.length >= min_len
    except:
        return False

def snap_line_to_axis(line_geom):
    """
    对线段做水平/垂直吸附
    """
    if line_geom is None or line_geom.is_empty:
        return None
    coords = list(line_geom.coords)
    if len(coords) < 2:
        return None
    x1, y1 = coords[0]
    x2, y2 = coords[-1]
    dx = x2 - x1
    dy = y2 - y1
    if abs(dx) >= abs(dy):
        ym = 0.5 * (y1 + y2)
        return LineString([(x1, ym), (x2, ym)])
    else:
        xm = 0.5 * (x1 + x2)
        return LineString([(xm, y1), (xm, y2)])

def longest_linestring_from_intersection(inter):
    """
    从 intersection 结果中取最长的 LineString
    """
    if inter is None or inter.is_empty:
        return None
    if inter.geom_type == "LineString":
        return inter
    if inter.geom_type == "MultiLineString":
        lines = [g for g in inter.geoms if g.length > 1e-4]
        if not lines:
            return None
        lines.sort(key=lambda g: g.length, reverse=True)
        return lines[0]
    return None

def estimate_centerline_from_polygon(poly):
    """
    稳定版中心线初始化
    """
    if poly is None or poly.is_empty:
        return None, None

    poly = ensure_polygon(poly)
    if poly is None:
        return None, None

    if poly.area < 1e-5:
        return None, None

    try:
        mrr = poly.minimum_rotated_rectangle
    except:
        return None, None

    mrr = ensure_polygon(mrr)
    if mrr is None:
        return None, None

    rect_coords = list(mrr.exterior.coords)[:-1]
    if len(rect_coords) != 4:
        return None, None

    edges = []
    for i in range(4):
        p1 = rect_coords[i]
        p2 = rect_coords[(i + 1) % 4]
        length = ((p2[0]-p1[0])**2 + (p2[1]-p1[1])**2) ** 0.5
        edges.append((p1, p2, length))

    edges_sorted = sorted(edges, key=lambda e: e[2], reverse=True)
    long_edge = edges_sorted[0]

    long_len = long_edge[2]
    if long_len < 0.1:
        return None, None

    p1, p2, _ = long_edge
    dx = p2[0] - p1[0]
    dy = p2[1] - p1[1]
    norm = (dx*dx + dy*dy) ** 0.5
    if norm < EPS:
        return None, None
    ux = dx / norm
    uy = dy / norm

    c = poly.centroid
    minx, miny, maxx, maxy = poly.bounds
    diag = ((maxx-minx)**2 + (maxy-miny)**2) ** 0.5 + 10.0

    raw_line = LineString([
        (c.x - ux * diag, c.y - uy * diag),
        (c.x + ux * diag, c.y + uy * diag)
    ])

    inter = raw_line.intersection(poly)
    centerline = longest_linestring_from_intersection(inter)
    if centerline is None:
        return None, None

    centerline = snap_line_to_axis(centerline)
    if centerline is None or centerline.length < 0.1:
        return None, None

    thickness = poly.area / max(centerline.length, EPS)

    if thickness < 0.05:
        thickness = 0.05
    if thickness > 2.0:
        thickness = 2.0

    return centerline, thickness

def merge_close_vertices(segments, delta):
    pts = []
    for seg in segments:
        coords = list(seg['line'].coords)
        pts.append(coords[0])
        pts.append(coords[-1])

    if not pts:
        return segments

    clusters = []
    for p in pts:
        assigned = False
        for cluster in clusters:
            cx, cy, plist = cluster
            d2 = (p[0]-cx)**2 + (p[1]-cy)**2
            if d2 < delta * delta:
                plist.append(p)
                nx = sum(pp[0] for pp in plist) / len(plist)
                ny = sum(pp[1] for pp in plist) / len(plist)
                cluster[0] = nx
                cluster[1] = ny
                assigned = True
                break
        if not assigned:
            clusters.append([p[0], p[1], [p]])

    def snap_point(p):
        best = p
        best_d = 1e18
        for cx, cy, plist in clusters:
            d2 = (p[0]-cx)**2 + (p[1]-cy)**2
            if d2 < best_d:
                best_d = d2
                best = (cx, cy)
        return best

    new_segments = []
    for seg in segments:
        coords = list(seg['line'].coords)
        p1 = snap_point(coords[0])
        p2 = snap_point(coords[-1])
        if ((p1[0]-p2[0])**2 + (p1[1]-p2[1])**2) ** 0.5 < 0.1:
            continue
        new_line = LineString([p1, p2])
        new_segments.append({
            'line': snap_line_to_axis(new_line),
            'thickness': seg['thickness'],
            'name': seg['name']
        })
    return new_segments

def point_to_segment_distance(pt, a, b):
    px, py = pt
    ax, ay = a
    bx, by = b
    dx = bx - ax
    dy = by - ay
    if abs(dx) < EPS and abs(dy) < EPS:
        return ((px-ax)**2 + (py-ay)**2)**0.5, a, 0.0

    t = ((px-ax)*dx + (py-ay)*dy) / (dx*dx + dy*dy)
    t_clamped = max(0.0, min(1.0, t))
    qx = ax + t_clamped * dx
    qy = ay + t_clamped * dy
    dist = ((px-qx)**2 + (py-qy)**2)**0.5
    return dist, (qx, qy), t_clamped

def split_segments_by_near_vertices(segments, delta):
    if not segments:
        return segments

    vertices = []
    for seg in segments:
        coords = list(seg['line'].coords)
        vertices.append(coords[0])
        vertices.append(coords[-1])

    new_segments = []
    for idx, seg in enumerate(segments):
        coords = list(seg['line'].coords)
        a = coords[0]
        b = coords[-1]
        split_pts = []

        for v in vertices:
            if v == a or v == b:
                continue
            dist, proj, t = point_to_segment_distance(v, a, b)
            if dist < delta and t > 0.01 and t < 0.99:
                split_pts.append((t, v))

        if not split_pts:
            new_segments.append(seg)
        else:
            split_pts.sort(key=lambda x: x[0])
            chain = [a] + [v for _, v in split_pts] + [b]
            for p1, p2 in zip(chain[:-1], chain[1:]):
                if ((p1[0]-p2[0])**2 + (p1[1]-p2[1])**2) ** 0.5 < 0.1:
                    continue
                new_line = snap_line_to_axis(LineString([p1, p2]))
                new_segments.append({
                    'line': new_line,
                    'thickness': seg['thickness'],
                    'name': seg['name']
                })
    return new_segments

def merge_collinear_segments(segments, gap_tol=0.3):
    if not segments:
        return segments

    horizontal = []
    vertical = []
    others = []

    for seg in segments:
        coords = list(seg['line'].coords)
        x1, y1 = coords[0]
        x2, y2 = coords[-1]
        if abs(y2 - y1) < 1e-6:
            xmin = min(x1, x2)
            xmax = max(x1, x2)
            horizontal.append((y1, xmin, xmax, seg))
        elif abs(x2 - x1) < 1e-6:
            ymin = min(y1, y2)
            ymax = max(y1, y2)
            vertical.append((x1, ymin, ymax, seg))
        else:
            others.append(seg)

    result = []

    by_y = {}
    for y, xmin, xmax, seg in horizontal:
        yk = round(y, 3)
        by_y.setdefault(yk, []).append((xmin, xmax, seg))

    for yk, arr in by_y.items():
        arr.sort(key=lambda x: x[0])
        cur_x1, cur_x2, cur_seg = arr[0]
        thick = cur_seg['thickness']
        name = cur_seg['name']
        for nx1, nx2, nseg in arr[1:]:
            if nx1 <= cur_x2 + gap_tol:
                cur_x2 = max(cur_x2, nx2)
                thick = (thick + nseg['thickness']) / 2.0
            else:
                result.append({
                    'line': LineString([(cur_x1, yk), (cur_x2, yk)]),
                    'thickness': thick,
                    'name': name
                })
                cur_x1, cur_x2, cur_seg = nx1, nx2, nseg
                thick = cur_seg['thickness']
                name = cur_seg['name']
        result.append({
            'line': LineString([(cur_x1, yk), (cur_x2, yk)]),
            'thickness': thick,
            'name': name
        })

    by_x = {}
    for x, ymin, ymax, seg in vertical:
        xk = round(x, 3)
        by_x.setdefault(xk, []).append((ymin, ymax, seg))

    for xk, arr in by_x.items():
        arr.sort(key=lambda x: x[0])
        cur_y1, cur_y2, cur_seg = arr[0]
        thick = cur_seg['thickness']
        name = cur_seg['name']
        for ny1, ny2, nseg in arr[1:]:
            if ny1 <= cur_y2 + gap_tol:
                cur_y2 = max(cur_y2, ny2)
                thick = (thick + nseg['thickness']) / 2.0
            else:
                result.append({
                    'line': LineString([(xk, cur_y1), (xk, cur_y2)]),
                    'thickness': thick,
                    'name': name
                })
                cur_y1, cur_y2, cur_seg = ny1, ny2, nseg
                thick = cur_seg['thickness']
                name = cur_seg['name']
        result.append({
            'line': LineString([(xk, cur_y1), (xk, cur_y2)]),
            'thickness': thick,
            'name': name
        })

    result.extend(others)
    return result

def optimize_wall_centerlines(candidates, iter_count=1, enable_merge_collinear=True):
    if not candidates:
        return []

    segs = candidates[:]

    if enable_merge_collinear:
        segs = merge_collinear_segments_strict(segs, coord_tol=0.08, gap_tol=0.35)

    for _ in range(iter_count):
        if not segs:
            break

        avg_t = sum(s['thickness'] for s in segs) / max(len(segs), 1)
        delta = 0.20 * avg_t
        if delta < 0.03:
            delta = 0.03
        if delta > 0.12:
            delta = 0.12

        segs = merge_close_vertices(segs, delta)
        segs = split_segments_by_near_vertices(segs, delta)

    cleaned = []
    for s in segs:
        try:
            if s['line'] is None or s['line'].is_empty:
                continue
            if s['line'].length < 0.08:
                continue
            cleaned.append(s)
        except:
            continue

    return cleaned

def get_wall_type_by_name(doc, type_name):
    wall_type_collector = FilteredElementCollector(doc).OfClass(WallType)
    found = None
    for wt in wall_type_collector:
        if wt.Kind == WallKind.Basic:
            name_param = wt.get_Parameter(BuiltInParameter.SYMBOL_NAME_PARAM)
            if name_param and name_param.AsString() == type_name:
                found = wt
                break
    if found:
        return found
    for wt in wall_type_collector:
        if wt.Kind == WallKind.Basic:
            return wt
    return None

def build_global_wall_mask(result, pixelWidth, pixelHeight, logs):
    wall_mask = np.zeros((pixelHeight, pixelWidth), dtype=np.uint8)

    if result.masks is None:
        logs.append("result.masks is None")
        return wall_mask

    masks_xy = result.masks.xy
    cls_ids = result.boxes.cls.cpu().numpy().astype(int)
    names = result.names

    logs.append("总mask数量: {}".format(len(masks_xy)))

    for i, contour_pts in enumerate(masks_xy):
        try:
            if i >= len(cls_ids):
                continue
            class_id = cls_ids[i]
            class_name = names[class_id]

            if not is_wall_class(class_name):
                continue

            pts = np.array(contour_pts, dtype=np.int32)
            if len(pts) < 3:
                continue

            pts[:, 0] = np.clip(pts[:, 0], 0, pixelWidth - 1)
            pts[:, 1] = np.clip(pts[:, 1], 0, pixelHeight - 1)

            cv2.fillPoly(wall_mask, [pts], 255)

        except Exception as e:
            logs.append("合成墙mask失败 idx={}: {}".format(i, str(e)))
            continue

    return wall_mask

def clean_wall_mask(binary_mask, logs):
    mask = binary_mask.copy()

    kernel_close = cv2.getStructuringElement(cv2.MORPH_RECT, (5, 5))
    kernel_open = cv2.getStructuringElement(cv2.MORPH_RECT, (3, 3))

    mask = cv2.morphologyEx(mask, cv2.MORPH_CLOSE, kernel_close)
    mask = cv2.morphologyEx(mask, cv2.MORPH_OPEN, kernel_open)

    num_labels, labels, stats, _ = cv2.connectedComponentsWithStats(mask, connectivity=8)
    cleaned = np.zeros_like(mask)

    for i in range(1, num_labels):
        area = stats[i, cv2.CC_STAT_AREA]
        if area >= 50:
            cleaned[labels == i] = 255

    logs.append("墙mask清理完成")
    return cleaned

def estimate_wall_width_pixels(binary_mask, logs):
    if binary_mask is None or binary_mask.max() == 0:
        logs.append("墙宽估计失败：mask为空")
        return 6.0

    dist = cv2.distanceTransform(binary_mask, cv2.DIST_L2, 5)
    vals = dist[dist > 0]
    if len(vals) == 0:
        logs.append("墙宽估计失败：distanceTransform为空")
        return 6.0

    wall_width_px = max(2.0, 2.0 * np.median(vals))
    logs.append("估计墙宽像素值: {:.2f}".format(wall_width_px))
    return wall_width_px

def skeletonize_wall_mask(binary_mask, logs):
    try:
        from skimage.morphology import skeletonize
        skel = skeletonize(binary_mask > 0)
        logs.append("使用 skimage.skeletonize 成功")
        return skel.astype(np.uint8)
    except Exception as e:
        logs.append("skimage骨架失败，改用fallback: {}".format(str(e)))
        return skeletonize_fallback(binary_mask, logs)

def skeletonize_fallback(binary_mask, logs):
    img = (binary_mask > 0).astype(np.uint8) * 255
    size = np.size(img)
    skel = np.zeros(img.shape, np.uint8)

    element = cv2.getStructuringElement(cv2.MORPH_CROSS, (3, 3))
    done = False

    while not done:
        eroded = cv2.erode(img, element)
        temp = cv2.dilate(eroded, element)
        temp = cv2.subtract(img, temp)
        skel = cv2.bitwise_or(skel, temp)
        img = eroded.copy()

        zeros = size - cv2.countNonZero(img)
        if zeros == size:
            done = True

    logs.append("fallback skeletonize 成功")
    return (skel > 0).astype(np.uint8)

def get_neighbors_8(x, y, w, h):
    nbs = []
    for dy in [-1, 0, 1]:
        for dx in [-1, 0, 1]:
            if dx == 0 and dy == 0:
                continue
            nx = x + dx
            ny = y + dy
            if 0 <= nx < w and 0 <= ny < h:
                nbs.append((nx, ny))
    return nbs

def extract_skeleton_graph(skel, logs):
    h, w = skel.shape
    skel_pts = set()
    for y in range(h):
        xs = np.where(skel[y] > 0)[0]
        for x in xs:
            skel_pts.add((x, y))

    if not skel_pts:
        logs.append("骨架为空")
        return [], []

    degree = {}
    for (x, y) in skel_pts:
        cnt = 0
        for nx, ny in get_neighbors_8(x, y, w, h):
            if (nx, ny) in skel_pts:
                cnt += 1
        degree[(x, y)] = cnt

    nodes = [p for p, d in degree.items() if d != 2]

    if not nodes:
        nodes = list(skel_pts)

    node_set = set(nodes)
    visited_edges = set()
    edges = []

    for node in nodes:
        x0, y0 = node
        for nx, ny in get_neighbors_8(x0, y0, w, h):
            if (nx, ny) not in skel_pts:
                continue

            edge_key = tuple(sorted([node, (nx, ny)]))
            if edge_key in visited_edges:
                continue

            path = [node, (nx, ny)]
            prev = node
            curr = (nx, ny)

            while True:
                visited_edges.add(tuple(sorted([prev, curr])))

                if curr in node_set and curr != node:
                    break

                nbrs = []
                for tx, ty in get_neighbors_8(curr[0], curr[1], w, h):
                    if (tx, ty) in skel_pts and (tx, ty) != prev:
                        nbrs.append((tx, ty))

                if len(nbrs) == 0:
                    break
                if len(nbrs) > 1:
                    break

                nxt = nbrs[0]
                path.append(nxt)
                prev = curr
                curr = nxt

            if len(path) >= 2:
                edges.append(path)

    logs.append("骨架图提取完成: nodes={}, edges={}".format(len(nodes), len(edges)))
    return nodes, edges

def simplify_path_to_axis_lines(path, wall_mask, pixelWidth, pixelHeight, logs, min_len_px=8):
    result_lines = []

    sub_paths = split_path_by_direction(path, turn_threshold=2)
    for sub in sub_paths:
        try:
            fitted = fit_axis_line_from_mask(
                sub, wall_mask, pixelWidth, pixelHeight, min_len_px=min_len_px
            )
            if fitted is None:
                continue

            p1, p2, ori = fitted
            line_geom = pixel_line_to_revit_linestring(p1, p2)
            if line_geom is None:
                continue

            if line_geom.length < 0.08:
                continue

            result_lines.append(line_geom)

        except Exception as e:
            logs.append("子段拟合失败: {}".format(str(e)))
            continue

    return result_lines

def extract_wall_centerlines_from_global_mask(result, pixelWidth, pixelHeight, logs):
    wall_mask = build_global_wall_mask(result, pixelWidth, pixelHeight, logs)
    if wall_mask.max() == 0:
        logs.append("没有墙类mask被写入全局墙图")
        return [], 0.3

    cleaned_mask = clean_wall_mask(wall_mask, logs)
    wall_width_px = estimate_wall_width_pixels(cleaned_mask, logs)

    skel = skeletonize_wall_mask(cleaned_mask, logs)
    nodes, edges = extract_skeleton_graph(skel, logs)

    if not edges:
        logs.append("骨架没有边")
        # 优先使用真实比例
        wall_width_ft = wall_width_px * (scale_x_ft_per_px_global if scale_x_ft_per_px_global else scaleX)
        return [], wall_width_ft

    wall_width_ft = wall_width_px * (scale_x_ft_per_px_global if scale_x_ft_per_px_global else scaleX)
    candidates = []

    for idx, path in enumerate(edges):
        try:
            line_list = simplify_path_to_axis_lines(
                path, cleaned_mask, pixelWidth, pixelHeight, logs, min_len_px=max(6, int(wall_width_px))
            )

            for line_geom in line_list:
                candidates.append({
                    'line': line_geom,
                    'thickness': wall_width_ft,
                    'name': "Wall"
                })

        except Exception as e:
            logs.append("路径{}转中心线失败: {}".format(idx, str(e)))
            continue

    logs.append("全局提取中心线候选数量: {}".format(len(candidates)))
    return candidates, wall_width_ft

def merge_collinear_segments_strict(segments, coord_tol=0.08, gap_tol=0.25):
    if not segments:
        return segments

    horizontal = []
    vertical = []
    others = []

    for seg in segments:
        coords = list(seg['line'].coords)
        x1, y1 = coords[0]
        x2, y2 = coords[-1]

        if abs(y2 - y1) <= coord_tol:
            y = 0.5 * (y1 + y2)
            xmin, xmax = min(x1, x2), max(x1, x2)
            horizontal.append((y, xmin, xmax, seg))
        elif abs(x2 - x1) <= coord_tol:
            x = 0.5 * (x1 + x2)
            ymin, ymax = min(y1, y2), max(y1, y2)
            vertical.append((x, ymin, ymax, seg))
        else:
            others.append(seg)

    merged = []

    horizontal.sort(key=lambda t: (round(t[0], 2), t[1]))
    used = [False] * len(horizontal)
    for i in range(len(horizontal)):
        if used[i]:
            continue
        y, x1, x2, seg = horizontal[i]
        thick = seg['thickness']
        name = seg['name']

        for j in range(i + 1, len(horizontal)):
            if used[j]:
                continue
            y2, xx1, xx2, seg2 = horizontal[j]
            if abs(y2 - y) <= coord_tol and xx1 <= x2 + gap_tol:
                x2 = max(x2, xx2)
                thick = 0.5 * (thick + seg2['thickness'])
                used[j] = True

        merged.append({
            'line': LineString([(x1, y), (x2, y)]),
            'thickness': thick,
            'name': name
        })

    vertical.sort(key=lambda t: (round(t[0], 2), t[1]))
    used = [False] * len(vertical)
    for i in range(len(vertical)):
        if used[i]:
            continue
        x, y1, y2, seg = vertical[i]
        thick = seg['thickness']
        name = seg['name']

        for j in range(i + 1, len(vertical)):
            if used[j]:
                continue
            x2, yy1, yy2, seg2 = vertical[j]
            if abs(x2 - x) <= coord_tol and yy1 <= y2 + gap_tol:
                y2 = max(y2, yy2)
                thick = 0.5 * (thick + seg2['thickness'])
                used[j] = True

        merged.append({
            'line': LineString([(x, y1), (x, y2)]),
            'thickness': thick,
            'name': name
        })

    merged.extend(others)
    return merged

def split_path_by_direction(path, turn_threshold=2):
    if not path or len(path) < 3:
        return [path] if path else []

    segments = []
    current = [path[0], path[1]]

    def major_dir(p1, p2):
        dx = p2[0] - p1[0]
        dy = p2[1] - p1[1]
        if abs(dx) >= abs(dy):
            return "h"
        else:
            return "v"

    prev_dir = major_dir(path[0], path[1])

    for i in range(2, len(path)):
        d = major_dir(path[i-1], path[i])

        if d == prev_dir:
            current.append(path[i])
        else:
            if len(current) <= turn_threshold and segments:
                segments[-1].extend(current[1:])
                current = [segments[-1][-1], path[i]]
            else:
                segments.append(current)
                current = [path[i-1], path[i]]
            prev_dir = d

    if current:
        if len(current) <= turn_threshold and segments:
            segments[-1].extend(current[1:])
        else:
            segments.append(current)

    cleaned = []
    for seg in segments:
        if seg and len(seg) >= 2:
            cleaned.append(seg)

    return cleaned

def fit_axis_line_from_mask(sub_path, wall_mask, pixelWidth, pixelHeight, min_len_px=8):
    if not sub_path or len(sub_path) < 2:
        return None

    xs = [p[0] for p in sub_path]
    ys = [p[1] for p in sub_path]

    x_min = max(0, int(min(xs)))
    x_max = min(pixelWidth - 1, int(max(xs)))
    y_min = max(0, int(min(ys)))
    y_max = min(pixelHeight - 1, int(max(ys)))

    dx = x_max - x_min
    dy = y_max - y_min

    if dx >= dy:
        mids = []
        for x in range(x_min, x_max + 1):
            ys_in = np.where(wall_mask[:, x] > 0)[0]
            ys_local = ys_in[(ys_in >= y_min - 8) & (ys_in <= y_max + 8)]
            if len(ys_local) >= 2:
                y_top = np.min(ys_local)
                y_bot = np.max(ys_local)
                y_mid = 0.5 * (y_top + y_bot)
                mids.append((x, y_mid))

        if len(mids) < 2:
            return None

        xs2 = [p[0] for p in mids]
        ys2 = [p[1] for p in mids]

        x1 = min(xs2)
        x2 = max(xs2)
        y = float(np.median(ys2))

        if (x2 - x1) < min_len_px:
            return None

        return ((x1, y), (x2, y), "h")

    else:
        mids = []
        for y in range(y_min, y_max + 1):
            xs_in = np.where(wall_mask[y, :] > 0)[0]
            xs_local = xs_in[(xs_in >= x_min - 8) & (xs_in <= x_max + 8)]
            if len(xs_local) >= 2:
                x_left = np.min(xs_local)
                x_right = np.max(xs_local)
                x_mid = 0.5 * (x_left + x_right)
                mids.append((x_mid, y))

        if len(mids) < 2:
            return None

        xs2 = [p[0] for p in mids]
        ys2 = [p[1] for p in mids]

        y1 = min(ys2)
        y2 = max(ys2)
        x = float(np.median(xs2))

        if (y2 - y1) < min_len_px:
            return None

        return ((x, y1), (x, y2), "v")

def pixel_line_to_revit_linestring(p1, p2):
    rp1 = pix_to_revit(p1[0], p1[1])
    rp2 = pix_to_revit(p2[0], p2[1])
    if rp1.DistanceTo(rp2) < 0.1:
        return None
    return LineString([(rp1.X, rp1.Y), (rp2.X, rp2.Y)])

# =========================
# 运行YOLO分割
# =========================
yolo_seg = YOLO(dect_Model, task="seg")
seg_result = yolo_seg(source=pixpath, save=False, conf=0.3, iou=0.45, imgsz=640)
cv2.imwrite(newpath, seg_result[0].plot())

result = seg_result[0]
boxes = result.boxes
xyxy = boxes.xyxy.cpu().numpy() if boxes is not None else np.empty((0,4))
cls_ids = boxes.cls.cpu().numpy().astype(int) if boxes is not None else np.array([], dtype=int)
names = result.names

# =========================
# 读取OCR尺寸JSON
# =========================
dims_data = None
horizontal_length_mm = None
vertical_length_mm = None

try:
    with open(dims_json_path, "r", encoding="utf-8") as f:
        dims_data = json.load(f)

    if dims_data.get("ok", False):
        # 兼容两种结构：1) result包裹 2) 直接平铺
        if "result" in dims_data:
            horizontal_length_mm = dims_data["result"].get("horizontal_length", None)
            vertical_length_mm = dims_data["result"].get("vertical_length", None)
        else:
            horizontal_length_mm = dims_data.get("horizontal_length", None)
            vertical_length_mm = dims_data.get("vertical_length", None)

    logs.append("读取dims_json成功: horizontal={} mm, vertical={} mm".format(
        str(horizontal_length_mm), str(vertical_length_mm)
    ))
except Exception as e:
    logs.append("读取dims_json失败: {}".format(str(e)))

# =========================
# 先做全局墙mask -> bbox -> scale
# =========================
global_wall_mask = build_global_wall_mask(result, pixelWidth, pixelHeight, logs)
cleaned_global_wall_mask = clean_wall_mask(global_wall_mask, logs)
bbox_info = get_mask_bbox(cleaned_global_wall_mask, logs)

scale_x_mm_per_px = None
scale_y_mm_per_px = None
scale_avg_mm_per_px = None
scale_x_ft_per_px = None
scale_y_ft_per_px = None
scale_avg_ft_per_px = None

if bbox_info is not None and horizontal_length_mm is not None and vertical_length_mm is not None:
    try:
        bbox_w = bbox_info["width"]
        bbox_h = bbox_info["height"]

        if bbox_w > 0 and bbox_h > 0:
            scale_x_mm_per_px = float(horizontal_length_mm) / float(bbox_w)
            scale_y_mm_per_px = float(vertical_length_mm) / float(bbox_h)
            scale_avg_mm_per_px = (scale_x_mm_per_px + scale_y_mm_per_px) / 2.0

            mm_to_ft = 1.0 / 304.8
            scale_x_ft_per_px = scale_x_mm_per_px * mm_to_ft
            scale_y_ft_per_px = scale_y_mm_per_px * mm_to_ft
            scale_avg_ft_per_px = scale_avg_mm_per_px * mm_to_ft

            bbox_info_global = bbox_info
            scale_x_ft_per_px_global = scale_x_ft_per_px
            scale_y_ft_per_px_global = scale_y_ft_per_px

            logs.append("scale_x_mm_per_px={:.6f}".format(scale_x_mm_per_px))
            logs.append("scale_y_mm_per_px={:.6f}".format(scale_y_mm_per_px))
            logs.append("scale_avg_mm_per_px={:.6f}".format(scale_avg_mm_per_px))
            logs.append("scale_x_ft_per_px={:.6f}".format(scale_x_ft_per_px))
            logs.append("scale_y_ft_per_px={:.6f}".format(scale_y_ft_per_px))
        else:
            logs.append("bbox宽高无效，无法计算scale")
    except Exception as e:
        logs.append("scale计算失败: {}".format(str(e)))
else:
    logs.append("bbox或真实尺寸缺失，使用fallback整图scale")

# =========================
# Revit文档对象
# =========================
doc = DocumentManager.Instance.CurrentDBDocument
app = doc.Application

# --- 获取墙类型 ---
wall_type = None
wall_type_collector = FilteredElementCollector(doc).OfClass(WallType)

for wt in wall_type_collector:
    if wt.Kind == WallKind.Basic:
        name_param = wt.get_Parameter(BuiltInParameter.SYMBOL_NAME_PARAM)
        if name_param and name_param.AsString() == TARGET_WALL_TYPE_NAME:
            wall_type = wt
            break

if wall_type is None:
    for wt in wall_type_collector:
        if wt.Kind == WallKind.Basic:
            wall_type = wt
            break

if wall_type is None:
    raise Exception("项目中找不到任何基本墙类型！")

# --- 获取标高 ---
level = None
level_collector = FilteredElementCollector(doc).OfClass(Level)
for lvl in level_collector:
    name_param = lvl.get_Parameter(BuiltInParameter.LEVEL_NAME)
    if name_param and name_param.AsString() == TARGET_LEVEL_NAME:
        level = lvl
        break

if level is None:
    level = level_collector.FirstElement()
    if level is None:
        raise Exception("项目中找不到任何标高！")

TransactionManager.Instance.EnsureInTransaction(doc)

created_lines = []
dyn_lines = []
dyn_faces = [] 
created_shapes = []
created_walls = []
wall_candidates = []

thickness = height
wallHeight = height

plane = Plane.CreateByNormalAndOrigin(XYZ.BasisZ, origin)
sketch_plane = SketchPlane.Create(doc, plane)

DEFAULT_WALL_WIDTH = 0.3

# =========================
# 提取中心线并创建墙
# =========================
if result.masks is not None:
    logs.append("YOLO类别映射: {}".format(str(result.names)))

    wall_candidates, default_wall_thickness = extract_wall_centerlines_from_global_mask(
        result, pixelWidth, pixelHeight, logs
    )

    logs.append("初始墙候选数量: {}".format(len(wall_candidates)))

    optimized_walls = optimize_wall_centerlines(
        wall_candidates,
        iter_count=1,
        enable_merge_collinear=False
    )

    logs.append("优化后墙数量: {}".format(len(optimized_walls)))

    for idx, w in enumerate(optimized_walls):
        try:
            line_geom = w['line']
            thickness_val = w['thickness']
            name = w['name']

            coords = list(line_geom.coords)
            if len(coords) < 2:
                logs.append("墙{}失败：coords不足".format(idx))
                continue

            start_pt = XYZ(coords[0][0], coords[0][1], 0)
            end_pt = XYZ(coords[-1][0], coords[-1][1], 0)

            if start_pt.DistanceTo(end_pt) < 0.1:
                logs.append("墙{}失败：线太短".format(idx))
                continue

            revit_line = Line.CreateBound(start_pt, end_pt)

            logs.append("准备创建墙{}: len={:.3f}, thickness={:.3f}".format(
                idx, revit_line.Length, thickness_val
            ))

            wall = Wall.Create(doc, revit_line, wall_type.Id, level.Id, wallHeight, 0, False, False)

            try:
                param = wall.get_Parameter(BuiltInParameter.WALL_ATTR_WIDTH_PARAM)
                if param and not param.IsReadOnly:
                    param.Set(thickness_val)
            except Exception as e2:
                logs.append("墙{}宽度设置失败(可忽略): {}".format(idx, str(e2)))

            try:
                wall.Name = sanitize_name(name)
            except:
                pass

            created_walls.append(wall.ToDSType(True))
            logs.append("墙{}创建成功".format(idx))

        except Exception as e:
            logs.append("墙{}创建失败: {}".format(idx, str(e)))
            logs.append(traceback.format_exc())
            continue
else:
    logs.append("result.masks is None，没有分割mask")

# =========================
# 提交事务
# =========================
TransactionManager.Instance.TransactionTaskDone()
doc.Regenerate()

# =========================
# 写 seg_meta_json
# =========================
seg_meta = {
    "ok": True,
    "image_path": pixpath,
    "seg_vis_path": newpath,
    "dims_json_path": dims_json_path,
    "wall_bbox_px": bbox_info,
    "real_size_mm": {
        "horizontal_length": horizontal_length_mm,
        "vertical_length": vertical_length_mm
    },
    "scale": {
        "scale_x_mm_per_px": scale_x_mm_per_px,
        "scale_y_mm_per_px": scale_y_mm_per_px,
        "scale_avg_mm_per_px": scale_avg_mm_per_px,
        "scale_x_ft_per_px": scale_x_ft_per_px,
        "scale_y_ft_per_px": scale_y_ft_per_px,
        "scale_avg_ft_per_px": scale_avg_ft_per_px
    },
    "debug": {
        "pixelWidth": pixelWidth,
        "pixelHeight": pixelHeight,
        "wall_count": len(created_walls),
        "mask_count": len(result.masks.xy) if result.masks is not None else 0,
        "class_names": result.names,
        "log_count": len(logs)
    }
}

try:
    ensure_dir_of_file(seg_meta_json_path)
    with open(seg_meta_json_path, "w", encoding="utf-8") as f:
        json.dump(seg_meta, f, ensure_ascii=False, indent=2)
    logs.append("seg_meta_json已写出: {}".format(seg_meta_json_path))
except Exception as e:
    logs.append("seg_meta_json写出失败: {}".format(str(e)))

# =========================
# 输出
# =========================
OUT = newpath, created_walls, seg_meta_json_path, logs
# ----------------------------------------
python_version_5 = Watch(python_script_5)  # graph output
python_version_6 = CodeBlock(i=python_version_5) { i[2]; }
python_version_7 = Watch(python_version_6)  # graph output
python_script_6 = Python(IN[0]=modelpath, IN[1]=imagepath_2, IN[2]=scale, IN[3]=python_version_7)  # CPython3
# ---------- python_script_6.python (259 lines) ----------
# 加载PythonStandard 和 DesignScript 库
import sys
import clr
clr.AddReference('ProtoGeometry')
from Autodesk.DesignScript.Geometry import *
import Autodesk.DesignScript.Geometry as DS
import Revit
from Revit.Elements import *
import System
sys.path.append("C:/Users/Lenovo/anaconda3/envs/revitenv/Lib/site-packages")
clr.AddReference('RevitAPI')
clr.AddReference('RevitAPIUI')
from Autodesk.Revit.DB import *
from Autodesk.Revit.UI import *

clr.AddReference('RevitServices')
from RevitServices.Persistence import DocumentManager
from RevitServices.Transactions import TransactionManager

clr.AddReference('RevitNodes')
import Revit
clr.ImportExtensions(Revit.Elements)
clr.ImportExtensions(Revit.GeometryConversion)

import re
import json
import os
import numpy as np
import torch
import cv2
from ultralytics import YOLO

dataEnteringNode = IN 

# =========================
# 输入
# =========================
dect_Model = IN[0]
pixpath = IN[1]
scale = IN[2]              # 保留作fallback
seg_meta_json_path = IN[3] # 新增：读取分割得到的缩放与bbox信息

# =========================
# 参数
# =========================
origin = XYZ(0, 0, 0)   
widthFt = scale
pixelWidth = 1600   
pixelHeight = 1200

newpath = "E:/yanjiu/revitss/tests/jjianzhu_dect.jpg"

# fallback 比例（只有在seg_meta读取失败时才使用）
scaleX = widthFt / pixelWidth if pixelWidth > 0 else 0.0
scaleY = widthFt * (pixelHeight / pixelWidth) / pixelHeight if pixelWidth > 0 and pixelHeight > 0 else 0.0

# seg_meta读取到的参数
bbox_info = None
bbox_min_x = None
bbox_min_y = None
bbox_width = None
bbox_height = None
scale_x_ft_per_px = None
scale_y_ft_per_px = None

logs = []

# =========================
# 工具函数
# =========================
def sanitize_name(name):
    if not name:
        return "Unknown"
    cleaned = re.sub(r'[\x00-\x1f\x7f]', '', str(name))
    if not cleaned.strip():
        return "Unnamed"
    return cleaned

def load_seg_meta(seg_meta_json_path, logs):
    if seg_meta_json_path is None:
        logs.append("seg_meta_json_path为空")
        return None

    try:
        with open(seg_meta_json_path, "r", encoding="utf-8") as f:
            data = json.load(f)
        logs.append("读取seg_meta_json成功: {}".format(seg_meta_json_path))
        return data
    except Exception as e:
        logs.append("读取seg_meta_json失败: {}".format(str(e)))
        return None

def pix_to_revit(x, y):
    """
    优先使用seg_meta中的 bbox + scale
    与墙体分割/建墙使用同一坐标映射方式
    """
    global bbox_min_x, bbox_min_y, bbox_width, bbox_height
    global scale_x_ft_per_px, scale_y_ft_per_px
    global origin, scaleX, scaleY, pixelHeight

    try:
        if bbox_min_x is not None and bbox_min_y is not None and bbox_height is not None \
           and scale_x_ft_per_px is not None and scale_y_ft_per_px is not None:

            local_x = x - bbox_min_x
            local_y = y - bbox_min_y

            revit_x = origin.X + local_x * scale_x_ft_per_px
            revit_y = origin.Y + (bbox_height - local_y) * scale_y_ft_per_px
            return XYZ(revit_x, revit_y, origin.Z)
    except:
        pass

    # fallback：原整图映射
    revit_x = origin.X + x * scaleX
    revit_y = origin.Y + (pixelHeight - y) * scaleY
    return XYZ(revit_x, revit_y, origin.Z)

# =========================
# 读取seg_meta
# =========================
seg_meta = load_seg_meta(seg_meta_json_path, logs)

if seg_meta and seg_meta.get("ok", False):
    try:
        bbox_info = seg_meta.get("wall_bbox_px", None)
        scale_info = seg_meta.get("scale", {})

        if bbox_info:
            bbox_min_x = bbox_info.get("min_x", None)
            bbox_min_y = bbox_info.get("min_y", None)
            bbox_width = bbox_info.get("width", None)
            bbox_height = bbox_info.get("height", None)

        scale_x_ft_per_px = scale_info.get("scale_x_ft_per_px", None)
        scale_y_ft_per_px = scale_info.get("scale_y_ft_per_px", None)

        dbg = seg_meta.get("debug", {})
        if "pixelWidth" in dbg and "pixelHeight" in dbg:
            pixelWidth = dbg.get("pixelWidth", pixelWidth)
            pixelHeight = dbg.get("pixelHeight", pixelHeight)

        logs.append("bbox_info={}".format(str(bbox_info)))
        logs.append("scale_x_ft_per_px={}".format(str(scale_x_ft_per_px)))
        logs.append("scale_y_ft_per_px={}".format(str(scale_y_ft_per_px)))
        logs.append("pixelWidth={}, pixelHeight={}".format(pixelWidth, pixelHeight))
    except Exception as e:
        logs.append("解析seg_meta失败: {}".format(str(e)))
else:
    logs.append("seg_meta无效，使用fallback整图scale")

# =========================
# 运行YOLO检测
# =========================
yolo_dect = YOLO(dect_Model, task="detect")
dect_result = yolo_dect(source=pixpath, save=False, conf=0.3, iou=0.45, imgsz=640)
cv2.imwrite(newpath, dect_result[0].plot())

result = dect_result[0]
boxes = result.boxes
xyxy = boxes.xyxy.cpu().numpy() if boxes is not None else np.empty((0, 4))
cls_ids = boxes.cls.cpu().numpy().astype(int) if boxes is not None else np.array([], dtype=int)
names = result.names

logs.append("检测框数量: {}".format(len(xyxy)))
logs.append("类别映射: {}".format(str(names)))

# =========================
# Revit文档对象
# =========================
doc = DocumentManager.Instance.CurrentDBDocument
app = doc.Application
TransactionManager.Instance.EnsureInTransaction(doc)

created_lines = []
dyn_lines = []
dyn_faces = [] 
created_shapes = []

plane = Plane.CreateByNormalAndOrigin(XYZ.BasisZ, origin)
sketch_plane = SketchPlane.Create(doc, plane)

# =========================
# 创建检测框
# =========================
for i, bbox in enumerate(xyxy):
    try:
        x1, y1, x2, y2 = bbox

        pt1 = pix_to_revit(x1, y1)  # 左上
        pt2 = pix_to_revit(x2, y1)  # 右上
        pt3 = pix_to_revit(x2, y2)  # 右下
        pt4 = pix_to_revit(x1, y2)  # 左下

        dyn_pt1 = pt1.ToPoint()
        dyn_pt2 = pt2.ToPoint()
        dyn_pt3 = pt3.ToPoint()
        dyn_pt4 = pt4.ToPoint()

        lines = [
            Line.CreateBound(pt1, pt2),
            Line.CreateBound(pt2, pt3),
            Line.CreateBound(pt3, pt4),
            Line.CreateBound(pt4, pt1)
        ]

        for line in lines:
            model_curve = doc.Create.NewModelCurve(line, sketch_plane)
            created_lines.append(model_curve)

            start_dyn = line.GetEndPoint(0).ToPoint()
            end_dyn = line.GetEndPoint(1).ToPoint()
            dyn_line = DS.Line.ByStartPointEndPoint(start_dyn, end_dyn)
            dyn_lines.append(dyn_line)

        points = [dyn_pt1, dyn_pt2, dyn_pt3, dyn_pt4]
        poly = DS.PolyCurve.ByPoints(points, connectLastToFirst=True)
        if poly.IsClosed:
            surface = DS.Surface.ByPatch(poly)
            dyn_faces.append(surface)

        curve_loop = CurveLoop()
        curve_loop.Append(Line.CreateBound(pt1, pt2))
        curve_loop.Append(Line.CreateBound(pt2, pt3))
        curve_loop.Append(Line.CreateBound(pt3, pt4))
        curve_loop.Append(Line.CreateBound(pt4, pt1))

        thickness = 0.001
        solid = GeometryCreationUtilities.CreateExtrusionGeometry(
            [curve_loop], XYZ.BasisZ, thickness)

        direct_shape = DirectShape.CreateElement(doc, ElementId(BuiltInCategory.OST_GenericModel))
        direct_shape.SetShape([solid])

        class_id = cls_ids[i]
        class_name = names[class_id]
        safe_name = sanitize_name(class_name)
        direct_shape.Name = "YOLO_" + safe_name
        created_shapes.append(direct_shape)

        logs.append("检测框{}创建成功: class={}, bbox=({}, {}, {}, {})".format(
            i, safe_name, x1, y1, x2, y2
        ))

    except Exception as e:
        logs.append("检测框{}创建失败: {}".format(i, str(e)))
        continue

# =========================
# 提交事务
# =========================
TransactionManager.Instance.TransactionTaskDone()
doc.Regenerate()

# =========================
# 输出
# =========================
OUT = newpath, created_shapes, logs
# ----------------------------------------
python_version_8 = CodeBlock(i=python_script_6) { i[0]; }
file_from_path_4 = FileObject(path=python_version_8)
readFromFile_4 = Image.ReadFromFile(file=file_from_path_4)
watch_image_4 = WatchImageCore(image=readFromFile_4)
file_from_path_5 = FileObject(path=imagepath_2)
readFromFile_5 = Image.ReadFromFile(file=file_from_path_5)
watch_image_5 = WatchImageCore(image=readFromFile_5)
imagepath_4 = Filename("E:\yanjiu\revitss\tests\2室2厅1厨1卫-93.64㎡-南 北-103100368214.jpg")
python_script_7 = Python(IN[0]=modelpath_2, IN[1]=imagepath_2, IN[2]=number)  # CPython3; frozen
# ---------- python_script_7.python (133 lines) ----------
# 加载Python Standard 和 DesignScript 库
import sys
import clr
clr.AddReference('ProtoGeometry')
from Autodesk.DesignScript.Geometry import *
import Autodesk.DesignScript.Geometry as DS
import Revit
from Revit.Elements import *
import System
sys.path.append("C:/Users/Lenovo/anaconda3/envs/revitenv/Lib/site-packages")
clr.AddReference('RevitAPI')
clr.AddReference('RevitAPIUI')
from Autodesk.Revit.DB import *
from Autodesk.Revit.UI import *

clr.AddReference('RevitServices')
from RevitServices.Persistence import DocumentManager
from RevitServices.Transactions import TransactionManager

clr.AddReference('RevitNodes')
import Revit
clr.ImportExtensions(Revit.Elements)
clr.ImportExtensions(Revit.GeometryConversion)
#
import re
import numpy as np
import torch
import cv2
from ultralytics import YOLO

dataEnteringNode = IN 
dect_Model = IN[0]
pixpath = IN[1]
height = IN[2]
#params
origin = XYZ(0, 0, 0)   
widthFt = 10.0
pixelWidth = 1600   
pixelHeight = 1200                          
#                         
yolo_seg = YOLO(dect_Model,task = "seg")
newpath = "E:/yanjiu/revitss/tests/jjianzhu_seg.jpg"

seg_result = yolo_seg(source = pixpath,save = False,conf = 0.3,iou = 0.45,imgsz = 640)
cv2.imwrite(newpath,seg_result[0].plot())
#tempouts = []
#tempouts.append(newpath)
#tempouts.extend(dect_result)
scaleX = widthFt / pixelWidth
scaleY = widthFt * (pixelHeight / pixelWidth) / pixelHeight  

result = seg_result[0]        
boxes = result.boxes
xyxy = boxes.xyxy.cpu().numpy() 
cls_ids = boxes.cls.cpu().numpy().astype(int)  # 类别索引 (N,)
names = result.names  

doc = DocumentManager.Instance.CurrentDBDocument
app = doc.Application
TransactionManager.Instance.EnsureInTransaction(doc)

created_lines = []
dyn_lines = []
dyn_faces = [] 
created_shapes = []


def pix_to_revit(x, y):
    revit_x = origin.X + x * scaleX
    revit_y = origin.Y + (pixelHeight - y) * scaleY  # 翻转 Y 轴
    return XYZ(revit_x, revit_y, origin.Z)
def sanitize_name(name):
    # 如果名称为空，返回默认名称
    if not name:
        return "Unknown"
    # 移除控制字符（ASCII 0-31，除了tab? 但最好全部移除）
    # 允许常见字符：字母、数字、空格、下划线、连字符、中文等
    # 保留所有打印字符，移除控制字符
    cleaned = re.sub(r'[\x00-\x1f\x7f]', '', name)
    # 如果清理后为空，则返回默认名
    if not cleaned.strip():
        return "Unnamed"
    return cleaned

plane = Plane.CreateByNormalAndOrigin(XYZ.BasisZ, origin)
sketch_plane = SketchPlane.Create(doc, plane)

result = seg_result[0]
if result.masks is not None:
    masks_xy = result.masks.xy               # 列表，每个元素是 (N,2) 的像素坐标
    cls_ids = result.boxes.cls.cpu().numpy().astype(int)   
    names = result.names
    
    for i, contour_pts in enumerate(masks_xy):
        # 将像素点转换为 Revit 点
        revit_pts = [pix_to_revit(pt[0], pt[1]) for pt in contour_pts]
        
        if len(revit_pts) < 3:
            continue
            
        # 创建 CurveLoop
        curve_loop = CurveLoop()
        for j in range(len(revit_pts) - 1):
            line = Line.CreateBound(revit_pts[j], revit_pts[j+1])
            curve_loop.Append(line)
        # 闭合：最后一点到第一点
        line_close = Line.CreateBound(revit_pts[-1], revit_pts[0])
        curve_loop.Append(line_close)
        thickness = height
        
        try:
            solid = GeometryCreationUtilities.CreateExtrusionGeometry(
                [curve_loop], XYZ.BasisZ, thickness)
        except:
            # 如果轮廓无效（如自交），跳过此对象
            continue
        
        direct_shape = DirectShape.CreateElement(doc, ElementId(BuiltInCategory.OST_GenericModel))
        direct_shape.SetShape([solid])
        
        class_id = cls_ids[i]
        class_name = names[class_id]
        safe_name = sanitize_name(class_name)
        direct_shape.Name = safe_name
        
        created_shapes.append(direct_shape)

# others upgrades
TransactionManager.Instance.TransactionTaskDone()
doc.Regenerate()
# Outs
#OUT = [created_lines, dyn_lines]
OUT = newpath,created_shapes
# ----------------------------------------
python_script_8 = Python(IN[0]=modelpath, IN[1]=imagepath_2, IN[2]=scale)  # CPython3; frozen
# ---------- python_script_8.python (142 lines) ----------
# 加载PythonStandard 和 DesignScript 库
import sys
import clr
clr.AddReference('ProtoGeometry')
from Autodesk.DesignScript.Geometry import *
import Autodesk.DesignScript.Geometry as DS
import Revit
from Revit.Elements import *
import System
sys.path.append("C:/Users/Lenovo/anaconda3/envs/revitenv/Lib/site-packages")
clr.AddReference('RevitAPI')
clr.AddReference('RevitAPIUI')
from Autodesk.Revit.DB import *
from Autodesk.Revit.UI import *

clr.AddReference('RevitServices')
from RevitServices.Persistence import DocumentManager
from RevitServices.Transactions import TransactionManager

clr.AddReference('RevitNodes')
import Revit
clr.ImportExtensions(Revit.Elements)
clr.ImportExtensions(Revit.GeometryConversion)
#
import re
import numpy as np
import torch
import cv2
from ultralytics import YOLO

dataEnteringNode = IN 
dect_Model = IN[0]
pixpath = IN[1]
scale = IN[2]
#params
origin = XYZ(0, 0, 0)   
widthFt = scale
pixelWidth = 1600   
pixelHeight = 1200                          
#                         
yolo_dect = YOLO(dect_Model,task = "detect")
newpath = "E:/yanjiu/revitss/tests/jjianzhu_dect.jpg"

dect_result = yolo_dect(source = pixpath,save = False,conf = 0.3,iou = 0.45,imgsz = 640)
cv2.imwrite(newpath,dect_result[0].plot())
#tempouts = []
#tempouts.append(newpath)
#tempouts.extend(dect_result)
scaleX = widthFt / pixelWidth
scaleY = widthFt * (pixelHeight / pixelWidth) / pixelHeight  

result = dect_result[0]        
boxes = result.boxes
xyxy = boxes.xyxy.cpu().numpy() 
cls_ids = boxes.cls.cpu().numpy().astype(int)  # 类别索引 (N,)
names = result.names  

doc = DocumentManager.Instance.CurrentDBDocument
app = doc.Application
TransactionManager.Instance.EnsureInTransaction(doc)

created_lines = []
dyn_lines = []
dyn_faces = [] 
created_shapes = []

def pix_to_revit(x, y):
    revit_x = origin.X + x * scaleX
    revit_y = origin.Y + (pixelHeight - y) * scaleY  # 翻转 Y 轴
    return XYZ(revit_x, revit_y, origin.Z)
def sanitize_name(name):
    # 如果名称为空，返回默认名称
    if not name:
        return "Unknown"
    # 移除控制字符（ASCII 0-31，除了tab? 但最好全部移除）
    # 允许常见字符：字母、数字、空格、下划线、连字符、中文等
    # 保留所有打印字符，移除控制字符
    cleaned = re.sub(r'[\x00-\x1f\x7f]', '', name)
    # 如果清理后为空，则返回默认名
    if not cleaned.strip():
        return "Unnamed"
    return cleaned

plane = Plane.CreateByNormalAndOrigin(XYZ.BasisZ, origin)
sketch_plane = SketchPlane.Create(doc, plane)

for i, bbox in enumerate(xyxy):
    x1, y1, x2, y2 = bbox  # 左上角 (x1,y1), 右下角 (x2,y2)
    
    # 计算四个角点的 Revit 坐标
    pt1 = pix_to_revit(x1, y1)  # 左上
    pt2 = pix_to_revit(x2, y1)  # 右上
    pt3 = pix_to_revit(x2, y2)  # 右下
    pt4 = pix_to_revit(x1, y2)  # 左下
   
    dyn_pt1 = pt1.ToPoint()
    dyn_pt2 = pt2.ToPoint()
    dyn_pt3 = pt3.ToPoint()
    dyn_pt4 = pt4.ToPoint()
    # 创建四条线
    lines = [
        Line.CreateBound(pt1, pt2),
        Line.CreateBound(pt2, pt3),
        Line.CreateBound(pt3, pt4),
        Line.CreateBound(pt4, pt1)
    ]
    
    # 创建模型线并添加到列表
    for line in lines:
        model_curve = doc.Create.NewModelCurve(line, sketch_plane)
        created_lines.append(model_curve)
        start_dyn = line.GetEndPoint(0).ToPoint()
        end_dyn = line.GetEndPoint(1).ToPoint()
        dyn_line = DS.Line.ByStartPointEndPoint(start_dyn, end_dyn)
        dyn_lines.append(dyn_line)
    points = [dyn_pt1, dyn_pt2, dyn_pt3, dyn_pt4]
    poly = DS.PolyCurve.ByPoints(points, connectLastToFirst=True)
    if poly.IsClosed:
        surface = DS.Surface.ByPatch(poly)
        dyn_faces.append(surface)
    curve_loop = CurveLoop()
    curve_loop.Append(Line.CreateBound(pt1, pt2))
    curve_loop.Append(Line.CreateBound(pt2, pt3))
    curve_loop.Append(Line.CreateBound(pt3, pt4))
    curve_loop.Append(Line.CreateBound(pt4, pt1))
    
    thickness = 0.001  # 可根据需要调整
    solid = GeometryCreationUtilities.CreateExtrusionGeometry(
        [curve_loop], XYZ.BasisZ, thickness)
    direct_shape = DirectShape.CreateElement(doc, ElementId(BuiltInCategory.OST_GenericModel))
    direct_shape.SetShape([solid])
    class_id = cls_ids[i]
    class_name = names[class_id]
    safe_name = sanitize_name(class_name)
    direct_shape.Name = "YOLO_" + safe_name
    created_shapes.append(direct_shape)    

TransactionManager.Instance.TransactionTaskDone()
doc.Regenerate()
# Outs
#OUT = [created_lines, dyn_lines]
OUT = newpath,created_shapes
# ----------------------------------------
python_version_9 = Watch(python_script_8)  # graph output
python_version_10 = CodeBlock(i=python_version_9) { i[1][18]; }
geometry = Element.Geometry(element=python_version_10)  # frozen
isClosed = Curve.IsClosed(curve=geometry)
python_paths_3 = Watch(isClosed)  # graph output
family_types = FamilyTypes("Cabinet:Cabinet")
python_script_9 = Python(IN[0]=family_types)  # CPython3; frozen
# ---------- python_script_9.python (34 lines) ----------
#加载PythonStandard和DesignScript库
import sys
import clr
clr.AddReference( 'ProtoGeometry')
from Autodesk.DesignScript.Geometry import *
#加载RevitAPI
clr.AddReference('RevitAPI')
from Autodesk.Revit.DB import *
#加载RevitNodes
clr.AddReference('RevitNodes')
import Revit
clr.ImportExtensions(Revit.Elements)
#加载Revitservices
clr.AddReference('RevitServices')
from RevitServices.Persistence import DocumentManager
from RevitServices.Transactions import TransactionManager
#该节点的输入内容将存储为IN变量中的一个列表。
famtype=UnwrapElement(IN[0])
#将代码放在该行下面
doc = DocumentManager.Instance.CurrentDBDocument
TransactionManager.Instance.EnsureInTransaction(doc)
if not famtype.IsActive:
    famtype.Activate()
faminstances = []

for x in range(0,16000,1600):
    
    x = UnitUtils.ConvertToInternalUnits(x, UnitTypeId.Millimeters)
    f = doc.Create.NewFamilyInstance(XYZ(0,x,0), famtype, Structure.StructuralType.NonStructural)
    faminstances.append(f.ToDSType(True))

TransactionManager.Instance.TransactionTaskDone()
#将输出内容指定给OUT变量。
OUT = faminstances
# ----------------------------------------
number_2 = DoubleInput(1)
string_from_object = FromObject(object=number_2)
number_3 = DoubleInput(2)
string_from_object_2 = FromObject(object=number_3)  # frozen
list_create = List.Create(item0=string_from_object, item1=string_from_object_2)
family_types_2 = FamilyTypes("桌:1830 x 915mm")
list_create_2 = List.Create(item0=family_types, item1=family_types_2)
byKeysValues = DesignScript.Builtin.Dictionary.ByKeysValues(keys=list_create, values=list_create_2)
watch = Watch(byKeysValues)
file_from_path_6 = FileObject(path=imagepath_2)
readFromFile_6 = Image.ReadFromFile(file=file_from_path_6)
watch_image_6 = WatchImageCore(image=readFromFile_6)
modelpath_3 = Filename("..\..\hou_pracs_on\Testings\Saves\best_dir2.pt")
python_script_10 = Python(IN[0]=modelpath_3, IN[1]=imagepath_2, IN[2]=scale, IN[5]=python_version_7)  # CPython3; unwired: IN[3], IN[4]
# ---------- python_script_10.python (587 lines) ----------
# 加载 PythonStandard 和 DesignScript 库
import sys
import clr
clr.AddReference('ProtoGeometry')
from Autodesk.DesignScript.Geometry import *
import Autodesk.DesignScript.Geometry as DS
import Revit
from Revit.Elements import *
import System
sys.path.append("C:/Users/Lenovo/anaconda3/envs/revitenv/Lib/site-packages")
clr.AddReference('RevitAPI')
clr.AddReference('RevitAPIUI')
from Autodesk.Revit.DB import *
from Autodesk.Revit.UI import *

clr.AddReference('RevitServices')
from RevitServices.Persistence import DocumentManager
from RevitServices.Transactions import TransactionManager

clr.AddReference('RevitNodes')
import Revit
clr.ImportExtensions(Revit.Elements)
clr.ImportExtensions(Revit.GeometryConversion)

import math
import re
import json
import os
import numpy as np
import torch
import cv2
from ultralytics import YOLO

dataEnteringNode = IN 

# =========================
# 输入
# =========================
pose_Model = IN[0]
pixpath = IN[1]
scale = IN[2]   # 保留作fallback
target_family_name = IN[3] if len(IN) > 3 else "Bed"
target_type_name = IN[4] if len(IN) > 4 else "Only_Bed"
seg_meta_json_path = IN[5] if len(IN) > 5 else None

# =========================
# 参数
# =========================
origin = XYZ(0, 0, 0)   
widthFt = scale
pixelWidth = 1600   
pixelHeight = 1200

# 读取seg_meta后填充
bbox_info = None
bbox_min_x = None
bbox_min_y = None
bbox_width = None
bbox_height = None
scale_x_ft_per_px = None
scale_y_ft_per_px = None

logs = []

# =========================
# 配置
# =========================
CLASS_CONFIG = {
    "Bed": {
        "family_name": "Bed",
        "type_name": "Bed",
        "rotate": True,
        "kp_start_idx": 0,
        "kp_end_idx": 1,
        "area_filter": True,
        "family_default_axis": "Y"
    },
    "CookingCounter": {
        "family_name": "CookingCounter",
        "type_name": "CookingCounter",
        "rotate": True,
        "kp_start_idx": 0,
        "kp_end_idx": 1,
        "area_filter": False,
        "family_default_axis": "Y"
    },
    "Cabinet": {
        "family_name": "Cabinet",
        "type_name": "Cabinet",
        "rotate": True,
        "kp_start_idx": 0,
        "kp_end_idx": 1,
        "area_filter": False,
        "family_default_axis": "Y"
    },
    "DiningTable": {
        "family_name": "DiningTable",
        "type_name": "DiningTable",
        "rotate": True,
        "kp_start_idx": 0,
        "kp_end_idx": 1,
        "area_filter": False,
        "family_default_axis": "Y"
    },
    "DiningTables": {
        "family_name": "DiningTables",
        "type_name": "DiningTables",
        "rotate": False,
        "area_filter": False,
        "family_default_axis": "Y"
    },
    "Sofa": {
        "family_name": "Sofa",
        "type_name": "Sofa",
        "rotate": True,
        "kp_start_idx": 0,
        "kp_end_idx": 1,
        "area_filter": False,
        "family_default_axis": "Y"
    },
    "TVStand": {
        "family_name": "TVStand",
        "type_name": "TVStand",
        "rotate": True,
        "kp_start_idx": 0,
        "kp_end_idx": 1,
        "area_filter": False,
        "family_default_axis": "Y"
    },
    "Toilet": {
        "family_name": "Toilet",
        "type_name": "Toilet",
        "rotate": True,
        "kp_start_idx": 0,
        "kp_end_idx": 1,
        "area_filter": False,
        "family_default_axis": "Y"
    }
}

# =========================
# 工具函数
# =========================
def norm_str(s):
    if s is None:
        return ""
    return str(s).strip().lower()

def sanitize_name(name):
    if not name:
        return "Unknown"
    cleaned = re.sub(r'[\x00-\x1f\x7f]', '', str(name))
    if not cleaned.strip():
        return "Unnamed"
    return cleaned

def load_seg_meta(seg_meta_json_path, logs):
    if not seg_meta_json_path:
        logs.append("seg_meta_json_path为空，将使用fallback scale")
        return None
    try:
        with open(seg_meta_json_path, "r", encoding="utf-8") as f:
            data = json.load(f)
        logs.append("读取seg_meta_json成功: {}".format(seg_meta_json_path))
        return data
    except Exception as e:
        logs.append("读取seg_meta_json失败: {}".format(str(e)))
        return None

def pix_to_revit(x, y):
    """
    优先使用seg_meta中的 bbox + scale
    与墙体和检测节点保持一致
    """
    global bbox_min_x, bbox_min_y, bbox_width, bbox_height
    global scale_x_ft_per_px, scale_y_ft_per_px
    global origin, widthFt, pixelWidth, pixelHeight

    try:
        if bbox_min_x is not None and bbox_min_y is not None and bbox_height is not None \
           and scale_x_ft_per_px is not None and scale_y_ft_per_px is not None:

            local_x = x - bbox_min_x
            local_y = y - bbox_min_y

            revit_x = origin.X + local_x * scale_x_ft_per_px
            revit_y = origin.Y + (bbox_height - local_y) * scale_y_ft_per_px
            return XYZ(revit_x, revit_y, origin.Z)
    except:
        pass

    # fallback
    scaleX = widthFt / pixelWidth if pixelWidth > 0 else 0.0
    scaleY = widthFt * (float(pixelHeight) / float(pixelWidth)) / pixelHeight if pixelWidth > 0 and pixelHeight > 0 else 0.0
    revit_x = origin.X + x * scaleX
    revit_y = origin.Y + (pixelHeight - y) * scaleY
    return XYZ(revit_x, revit_y, origin.Z)

def get_level(doc):
    av = doc.ActiveView
    try:
        if hasattr(av, "GenLevel") and av.GenLevel:
            return av.GenLevel
    except:
        pass
    levels = FilteredElementCollector(doc).OfClass(Level).ToElements()
    if levels and len(levels) > 0:
        return levels[0]
    return None

def find_family_symbol(doc, family_name=None, type_name=None):
    collector = FilteredElementCollector(doc).OfClass(FamilySymbol)
    for fs in collector:
        try:
            fam_name = fs.Family.Name if fs.Family else None
            p = fs.get_Parameter(BuiltInParameter.SYMBOL_NAME_PARAM)
            typ_name = p.AsString() if p else fs.Name

            family_ok = True if family_name is None else (fam_name == family_name)
            type_ok = True if type_name is None else (typ_name == type_name)

            if family_ok and type_ok:
                return fs
        except:
            pass
    return None

def angle_from_vector(vec, family_default_axis="X"):
    vx = vec.X
    vy = vec.Y
    angle = math.atan2(vy, vx)

    if family_default_axis == "Y":
        angle -= math.pi / 2.0

    return angle

def build_symbol_lookup(doc):
    lookup = {}
    collector = FilteredElementCollector(doc).OfClass(FamilySymbol)
    for fs in collector:
        try:
            fam_name = fs.Family.Name if fs.Family else ""
            p = fs.get_Parameter(BuiltInParameter.SYMBOL_NAME_PARAM)
            typ_name = p.AsString() if p else fs.Name
            key = (norm_str(fam_name), norm_str(typ_name))
            lookup[key] = fs
        except:
            pass
    return lookup

def get_symbol_from_lookup(symbol_lookup, family_name, type_name):
    key = (norm_str(family_name), norm_str(type_name))
    if key in symbol_lookup:
        return symbol_lookup[key]
    return None

def compute_class_area_threshold(boxes, cls_ids, names, class_name, scale_ratio=0.33):
    areas = []
    for i, bbox in enumerate(boxes):
        cls_name = names[int(cls_ids[i])] if len(cls_ids) > i else ""
        if cls_name != class_name:
            continue

        x1, y1, x2, y2 = bbox
        area = max(0, (x2 - x1)) * max(0, (y2 - y1))
        areas.append(area)

    if len(areas) == 0:
        return 0.0, 0.0

    median_area = float(np.median(areas))
    min_area = median_area * scale_ratio
    return median_area, min_area

def ensure_symbol_active(doc, symbol):
    if symbol and not symbol.IsActive:
        symbol.Activate()
        doc.Regenerate()

def create_family_instance(doc, center_pt, symbol, level):
    try:
        instance = doc.Create.NewFamilyInstance(
            center_pt,
            symbol,
            level,
            StructuralType.NonStructural
        )
    except:
        instance = doc.Create.NewFamilyInstance(
            center_pt,
            symbol,
            doc.ActiveView
        )
    return instance

def get_angle_from_keypoints(start_pt, end_pt, family_default_axis="Y"):
    vec = XYZ(
        start_pt.X - end_pt.X,
        start_pt.Y - end_pt.Y,
        0
    )

    if vec.GetLength() < 1e-6:
        return None

    angle = math.atan2(vec.Y, vec.X)

    if family_default_axis == "Y":
        angle -= math.pi / 2.0

    return angle

def rotate_instance(doc, instance, center_pt, angle):
    axis_end = XYZ(center_pt.X, center_pt.Y, center_pt.Z + 1.0)
    axis = Line.CreateBound(center_pt, axis_end)
    ElementTransformUtils.RotateElement(doc, instance.Id, axis, angle)

# =========================
# 读取seg_meta
# =========================
seg_meta = load_seg_meta(seg_meta_json_path, logs)

if seg_meta and seg_meta.get("ok", False):
    try:
        bbox_info = seg_meta.get("wall_bbox_px", None)
        scale_info = seg_meta.get("scale", {})
        dbg = seg_meta.get("debug", {})

        if bbox_info:
            bbox_min_x = bbox_info.get("min_x", None)
            bbox_min_y = bbox_info.get("min_y", None)
            bbox_width = bbox_info.get("width", None)
            bbox_height = bbox_info.get("height", None)

        scale_x_ft_per_px = scale_info.get("scale_x_ft_per_px", None)
        scale_y_ft_per_px = scale_info.get("scale_y_ft_per_px", None)

        if "pixelWidth" in dbg and "pixelHeight" in dbg:
            pixelWidth = dbg.get("pixelWidth", pixelWidth)
            pixelHeight = dbg.get("pixelHeight", pixelHeight)

        logs.append("bbox_info={}".format(str(bbox_info)))
        logs.append("scale_x_ft_per_px={}".format(str(scale_x_ft_per_px)))
        logs.append("scale_y_ft_per_px={}".format(str(scale_y_ft_per_px)))
        logs.append("pixelWidth={}, pixelHeight={}".format(pixelWidth, pixelHeight))
    except Exception as e:
        logs.append("解析seg_meta失败: {}".format(str(e)))
else:
    logs.append("seg_meta无效，使用fallback整图scale")

# =========================
# 运行姿态估计
# =========================
yolo_pose = YOLO(pose_Model, task="pose")
newpath = "E:/yanjiu/revitss/tests/jjianzhu_pose.jpg"

pose_results = yolo_pose(
    source=pixpath,
    save=False,
    conf=0.3,
    iou=0.45,
    imgsz=640
)
cv2.imwrite(newpath, pose_results[0].plot())

result = pose_results[0]
boxes = result.boxes.xyxy.cpu().numpy() if result.boxes is not None else []
cls_ids = result.boxes.cls.cpu().numpy().astype(int) if result.boxes is not None else []
confs = result.boxes.conf.cpu().numpy() if result.boxes is not None else []
names = result.names
kps_xy = None
if result.keypoints is not None and result.keypoints.xy is not None:
    kps_xy = result.keypoints.xy.cpu().numpy()

# =========================
# Revit对象
# =========================
doc = DocumentManager.Instance.CurrentDBDocument
app = doc.Application
TransactionManager.Instance.EnsureInTransaction(doc)

level = get_level(doc)
symbol_lookup = build_symbol_lookup(doc)

bed_median_area, bed_min_area = compute_class_area_threshold(
    boxes, cls_ids, names, "Bed", 0.33
)

# process areas
bed_indices = []
bed_areas = []
for i, bbox in enumerate(boxes):
    cls_name = names[int(cls_ids[i])] if len(cls_ids) > i else ""
    if cls_name != "Bed":
        continue

    x1, y1, x2, y2 = bbox
    area = max(0, (x2 - x1)) * max(0, (y2 - y1))
    bed_indices.append(i)
    bed_areas.append(area)

if len(bed_areas) > 0:
    median_bed_area = float(np.median(bed_areas))
    min_area_threshold = median_bed_area * 0.33
else:
    median_bed_area = 0.0
    min_area_threshold = 0.0

created_lines = []
dyn_lines = []
dyn_faces = [] 
created_shapes = []
created_instances = []
debug_info = []
missing_family_types = []
skipped_unconfigured_classes = []

plane = Plane.CreateByNormalAndOrigin(XYZ.BasisZ, origin)
sketch_plane = SketchPlane.Create(doc, plane)

for cls_name, cfg in CLASS_CONFIG.items():
    symbol = get_symbol_from_lookup(
        symbol_lookup,
        cfg.get("family_name"),
        cfg.get("type_name")
    )
    if symbol:
        ensure_symbol_active(doc, symbol)

# =========================
# 放置实例
# =========================
for i, bbox in enumerate(boxes):
    cls_name = names[int(cls_ids[i])] if len(cls_ids) > i else ""
    conf = confs[i] if len(confs) > i else 0.0

    # 1. 配置中未定义的类，跳过
    if cls_name not in CLASS_CONFIG:
        skipped_unconfigured_classes.append({
            "index": i,
            "class": cls_name,
            "reason": "class_not_configured"
        })
        continue

    cfg = CLASS_CONFIG[cls_name]
    family_name = cfg.get("family_name")
    type_name = cfg.get("type_name")
    need_rotate = cfg.get("rotate", False)
    family_default_axis = cfg.get("family_default_axis", "Y")

    # 2. 查找对应族类型
    symbol = get_symbol_from_lookup(symbol_lookup, family_name, type_name)
    if symbol is None:
        missing_family_types.append({
            "index": i,
            "class": cls_name,
            "family_name": family_name,
            "type_name": type_name,
            "reason": "family_symbol_not_found"
        })
        continue

    # 3. 中心点
    x1, y1, x2, y2 = bbox
    cx = (x1 + x2) / 2.0
    cy = (y1 + y2) / 2.0
    center_pt = pix_to_revit(cx, cy)

    # 4. 面积过滤
    area = max(0, (x2 - x1)) * max(0, (y2 - y1))
    if cfg.get("area_filter", False):
        if cls_name == "Bed" and bed_min_area > 0 and area < bed_min_area:
            debug_info.append({
                "index": i,
                "class": cls_name,
                "reason": "filtered_small_area",
                "area": area,
                "threshold": bed_min_area
            })
            continue

    # 5. 创建实例
    try:
        instance = create_family_instance(doc, center_pt, symbol, level)
    except Exception as e:
        debug_info.append({
            "index": i,
            "class": cls_name,
            "reason": "create_instance_failed",
            "error": str(e)
        })
        continue

    rotated = False
    angle = None
    start_pt = None
    end_pt = None

    # 6. 如果该类需要旋转，尝试读取关键点
    if need_rotate:
        kp_start_idx = cfg.get("kp_start_idx", None)
        kp_end_idx = cfg.get("kp_end_idx", None)

        if kps_xy is not None and i < len(kps_xy) and kp_start_idx is not None and kp_end_idx is not None:
            kp = kps_xy[i]

            if len(kp) > max(kp_start_idx, kp_end_idx):
                sx, sy = kp[kp_start_idx]
                ex, ey = kp[kp_end_idx]

                start_pt = pix_to_revit(sx, sy)
                end_pt = pix_to_revit(ex, ey)

                angle = get_angle_from_keypoints(
                    start_pt,
                    end_pt,
                    family_default_axis
                )

                if angle is not None:
                    try:
                        rotate_instance(doc, instance, center_pt, angle)
                        rotated = True
                    except Exception as e:
                        debug_info.append({
                            "index": i,
                            "class": cls_name,
                            "reason": "rotate_failed",
                            "error": str(e)
                        })
                else:
                    debug_info.append({
                        "index": i,
                        "class": cls_name,
                        "reason": "zero_direction_vector"
                    })
            else:
                debug_info.append({
                    "index": i,
                    "class": cls_name,
                    "reason": "insufficient_keypoints"
                })
        else:
            debug_info.append({
                "index": i,
                "class": cls_name,
                "reason": "no_keypoints_for_rotation"
            })

    created_instances.append(instance.ToDSType(False))
    debug_info.append({
        "index": i,
        "class": cls_name,
        "family_name": family_name,
        "type_name": type_name,
        "center_xyz": [center_pt.X, center_pt.Y, center_pt.Z],
        "bbox_px": [float(x1), float(y1), float(x2), float(y2)],
        "area": area,
        "rotated": rotated,
        "angle_rad": angle,
        "angle_deg": angle * 180.0 / math.pi if angle is not None else None,
        "conf": float(conf),
        "kp_start_xyz": [start_pt.X, start_pt.Y, start_pt.Z] if start_pt else None,
        "kp_end_xyz": [end_pt.X, end_pt.Y, end_pt.Z] if end_pt else None
    })

# =========================
# 提交事务
# =========================
TransactionManager.Instance.TransactionTaskDone()
doc.Regenerate()

OUT = {
    "preview_image": newpath,
    "created_instances": created_instances,
    "debug_info": debug_info,
    "missing_family_types": missing_family_types,
    "skipped_unconfigured_classes": skipped_unconfigured_classes,
    "bed_area_threshold": {
        "median_area": bed_median_area,
        "min_area": bed_min_area
    },
    "seg_meta_json_path": seg_meta_json_path,
    "logs": logs
}
# ----------------------------------------
python_version_11 = CodeBlock(i=python_script_10) { i[0]; }
file_from_path_7 = FileObject(path=python_version_11)
readFromFile_7 = Image.ReadFromFile(file=file_from_path_7)
watch_image_7 = WatchImageCore(image=readFromFile_7)
python_script_11 = Python(IN[0]=modelpath_2, IN[1]=imagepath_2, IN[2]=number, IN[3]=scale)  # CPython3; frozen
# ---------- python_script_11.python (996 lines) ----------
# 加载 Python  Standard 和 DesignScript 库
import sys
import clr
clr.AddReference('ProtoGeometry')
from Autodesk.DesignScript.Geometry import *
import Autodesk.DesignScript.Geometry as DS
import Revit
from Revit.Elements import *
import System
sys.path.append("C:/Users/Lenovo/anaconda3/envs/revitenv/Lib/site-packages")
clr.AddReference('RevitAPI')
clr.AddReference('RevitAPIUI')
from Autodesk.Revit.DB import *
from Autodesk.Revit.UI import *

clr.AddReference('RevitServices')
from RevitServices.Persistence import DocumentManager
from RevitServices.Transactions import TransactionManager

clr.AddReference('RevitNodes')
import Revit
clr.ImportExtensions(Revit.Elements)
clr.ImportExtensions(Revit.GeometryConversion)
#
import re
import math
from scipy.spatial import Voronoi
from shapely.geometry import Polygon, LineString, MultiLineString
from shapely.ops import linemerge
from shapely.ops import unary_union, split
from shapely.geometry import Point as ShpPoint
from scipy import ndimage
from skimage.morphology import skeletonize

import traceback
from shapely.geometry import Polygon as ShpPolygon
from shapely.geometry import MultiPolygon as ShpMultiPolygon
from shapely.geometry import Point as ShpPoint
from shapely.geometry import MultiLineString
from shapely.ops import linemerge
import numpy as np
import torch
import cv2
from ultralytics import YOLO

dataEnteringNode = IN 
dect_Model = IN[0]
pixpath = IN[1]
height = IN[2]
scale = IN[3]
#params
origin = XYZ(0, 0, 0)   
widthFt = scale
pixelWidth = 1600   
pixelHeight = 1200 
DENSIFY_DIST = 0.5  
EPS = 1e-6
#
TARGET_WALL_TYPE_NAME = "基本墙 200mm"   # 项目中存在的墙类型名称
TARGET_LEVEL_NAME = "标高 2"                            
#                         
yolo_seg = YOLO(dect_Model,task = "seg")
newpath = "E:/yanjiu/revitss/tests/jjianzhu_seg.jpg"

seg_result = yolo_seg(source = pixpath,save = False,conf = 0.3,iou = 0.45,imgsz = 640)
cv2.imwrite(newpath,seg_result[0].plot())
#tempouts = []
#tempouts.append(newpath)
#tempouts.extend(dect_result)
scaleX = widthFt / pixelWidth
scaleY = widthFt * (pixelHeight / pixelWidth) / pixelHeight  

result = seg_result[0]        
boxes = result.boxes
xyxy = boxes.xyxy.cpu().numpy() 
cls_ids = boxes.cls.cpu().numpy().astype(int)  # 类别索引 (N,)
names = result.names  

doc = DocumentManager.Instance.CurrentDBDocument
app = doc.Application
TransactionManager.Instance.EnsureInTransaction(doc)

# 按名称查找
wall_type = None
wall_type_collector = FilteredElementCollector(doc).OfClass(WallType)

# 先按名称查找基本 墙
for wt in wall_type_collector:
    if wt.Kind == WallKind.Basic:  # 只考虑基本墙
        name_param = wt.get_Parameter(BuiltInParameter.SYMBOL_NAME_PARAM)
        if name_param and name_param.AsString() == TARGET_WALL_TYPE_NAME:
            wall_type = wt
            break

# 如果没找到指定名称的基本墙，则取第一个基本墙
if wall_type is None:
    for wt in wall_type_collector:
        if wt.Kind == WallKind.Basic:
            wall_type = wt
            break

if wall_type is None:
    raise Exception("项目中找不到任何基本墙类型！")

# --- 获取目标标高 ---
level = None
level_collector = FilteredElementCollector(doc).OfClass(Level)
for lvl in level_collector:
    # 标高名称参数
    name_param = lvl.get_Parameter(BuiltInParameter.LEVEL_NAME)
    if name_param and name_param.AsString() == TARGET_LEVEL_NAME:
        level = lvl
        break
if level is None:
    level = level_collector.FirstElement()
    if level is None:
        raise Exception("项目中找不到任何标高！")


TransactionManager.Instance.EnsureInTransaction(doc)

created_lines = []
dyn_lines = []
dyn_faces = [] 
created_shapes = []
created_walls = []
wall_candidates = []

logs = []

thickness = height
wallHeight = height

def pix_to_revit(x, y):
    revit_x = origin.X + x * scaleX
    revit_y = origin.Y + (pixelHeight - y) * scaleY  # 翻转 Y 轴
    return XYZ(revit_x, revit_y, origin.Z)
def sanitize_name(name):
    # 如果名称为空，返回默认名称
    if not name:
        return "Unknown"
    # 移除控制字符（ASCII 0-31，除了tab? 但最好全部移除）
    # 允许常见字符：字母、数字、空格、下划线、连字符、中文等
    # 保留所有打印字符，移除控制字符
    cleaned = re.sub(r'[\x00-\x1f\x7f]', '', name)
    # 如果清理后为空，则返回默认名
    if not cleaned.strip():
        return "Unnamed"
    return cleaned
##
EPS = 1e-6

# 你必须根据自己的模型类别名修改这里
# 比如如果你的墙类别是 "wall" 或 "墙体" 或 "wall_line"，就在这里加上
WALL_CLASS_NAMES = set(["wall", "Wall", "墙体"])
WALL_CLASS_KEYWORDS = [
    "wall",
    "Wall",
    "basic wall",
    "bearing wall",
    "non-bearing wall",
    "shear wall",
    "墙",
    "墙体",
    "基本墙",
    "基本墙 200mm",
    "承重墙",
    "非承重墙",
    "剪力墙"
]

def normalize_class_name(name):
    if name is None:
        return ""
    return str(name).strip().lower()

def is_wall_class(name):
    n = normalize_class_name(name)
    if not n:
        return False
    for kw in WALL_CLASS_KEYWORDS:
        if kw.lower() in n:
            return True
    return False
    

def ensure_polygon(geom):
    """
    将 geometry 尽量转成一个有效 Polygon
    如果是 MultiPolygon，则取面积最大的一个
    """
    if geom is None or geom.is_empty:
        return None
    try:
        if not geom.is_valid:
            geom = geom.buffer(0)
    except:
        pass
    if geom is None or geom.is_empty:
        return None

    if isinstance(geom, ShpPolygon):
        return geom

    if isinstance(geom, ShpMultiPolygon):
        polys = [g for g in geom.geoms if g is not None and not g.is_empty]
        if not polys:
            return None
        polys.sort(key=lambda p: p.area, reverse=True)
        return polys[0]

    return None

def contour_to_polygon(contour_pts):
    """
    contour_pts: YOLO mask contour pixel points
    转成shapely polygon（Revit坐标系）
    """
    revit_pts = [pix_to_revit(pt[0], pt[1]) for pt in contour_pts]
    if len(revit_pts) < 3:
        return None
    coords = [(p.X, p.Y) for p in revit_pts]
    if coords[0] != coords[-1]:
        coords.append(coords[0])
    poly = ShpPolygon(coords)
    poly = ensure_polygon(poly)
    return poly

def line_long_enough(line_geom, min_len=0.1):
    if line_geom is None or line_geom.is_empty:
        return False
    try:
        return line_geom.length >= min_len
    except:
        return False

def snap_line_to_axis(line_geom):
    """
    对线段做水平/垂直吸附，作为 Lalignment 的工程近似
    """
    if line_geom is None or line_geom.is_empty:
        return None
    coords = list(line_geom.coords)
    if len(coords) < 2:
        return None
    x1, y1 = coords[0]
    x2, y2 = coords[-1]
    dx = x2 - x1
    dy = y2 - y1
    if abs(dx) >= abs(dy):
        ym = 0.5 * (y1 + y2)
        return LineString([(x1, ym), (x2, ym)])
    else:
        xm = 0.5 * (x1 + x2)
        return LineString([(xm, y1), (xm, y2)])

def longest_linestring_from_intersection(inter):
    """
    从 intersection 结果中取最长的 LineString
    """
    if inter is None or inter.is_empty:
        return None
    if inter.geom_type == "LineString":
        return inter
    if inter.geom_type == "MultiLineString":
        lines = [g for g in inter.geoms if g.length > 1e-4]
        if not lines:
            return None
        lines.sort(key=lambda g: g.length, reverse=True)
        return lines[0]
    return None

def estimate_centerline_from_polygon(poly):
    """
    稳定版中心线初始化：
    1) 取最小外接旋转矩形
    2) 判断主方向
    3) 通过polygon质心沿主方向打一条长线
    4) 与polygon求交得到中心段
    5) 用 area / centerline_length 估计厚度
    """
    if poly is None or poly.is_empty:
        return None, None

    poly = ensure_polygon(poly)
    if poly is None:
        return None, None

    if poly.area < 1e-5:
        return None, None

    try:
        mrr = poly.minimum_rotated_rectangle
    except:
        return None, None

    mrr = ensure_polygon(mrr)
    if mrr is None:
        return None, None

    rect_coords = list(mrr.exterior.coords)[:-1]
    if len(rect_coords) != 4:
        return None, None

    edges = []
    for i in range(4):
        p1 = rect_coords[i]
        p2 = rect_coords[(i + 1) % 4]
        length = ((p2[0]-p1[0])**2 + (p2[1]-p1[1])**2) ** 0.5
        edges.append((p1, p2, length))

    # 按边长排序
    edges_sorted = sorted(edges, key=lambda e: e[2], reverse=True)
    long_edge = edges_sorted[0]
    short_edge = edges_sorted[-1]

    long_len = long_edge[2]
    short_len = short_edge[2]

    if long_len < 0.1:
        return None, None

    # 主方向
    p1, p2, _ = long_edge
    dx = p2[0] - p1[0]
    dy = p2[1] - p1[1]
    norm = (dx*dx + dy*dy) ** 0.5
    if norm < EPS:
        return None, None
    ux = dx / norm
    uy = dy / norm

    # 过质心打一条足够长的线
    c = poly.centroid
    minx, miny, maxx, maxy = poly.bounds
    diag = ((maxx-minx)**2 + (maxy-miny)**2) ** 0.5 + 10.0

    raw_line = LineString([
        (c.x - ux * diag, c.y - uy * diag),
        (c.x + ux * diag, c.y + uy * diag)
    ])

    # 与polygon相交，取最长线段作为中心线
    inter = raw_line.intersection(poly)
    centerline = longest_linestring_from_intersection(inter)
    if centerline is None:
        return None, None

    centerline = snap_line_to_axis(centerline)
    if centerline is None or centerline.length < 0.1:
        return None, None

    # 厚度估计：面积 / 中心线长度
    thickness = poly.area / max(centerline.length, EPS)

    # 防止异常值
    if thickness < 0.05:
        thickness = 0.05
    if thickness > 2.0:
        thickness = 2.0

    return centerline, thickness

def merge_close_vertices(segments, delta):
    """
    论文4.5 condition x:
    两节点距离 < δx，则合并
    对线段端点进行统一吸附
    """
    pts = []
    for seg in segments:
        coords = list(seg['line'].coords)
        pts.append(coords[0])
        pts.append(coords[-1])

    if not pts:
        return segments

    clusters = []
    for p in pts:
        assigned = False
        for cluster in clusters:
            cx, cy, plist = cluster
            d2 = (p[0]-cx)**2 + (p[1]-cy)**2
            if d2 < delta * delta:
                plist.append(p)
                nx = sum(pp[0] for pp in plist) / len(plist)
                ny = sum(pp[1] for pp in plist) / len(plist)
                cluster[0] = nx
                cluster[1] = ny
                assigned = True
                break
        if not assigned:
            clusters.append([p[0], p[1], [p]])

    def snap_point(p):
        best = p
        best_d = 1e18
        for cx, cy, plist in clusters:
            d2 = (p[0]-cx)**2 + (p[1]-cy)**2
            if d2 < best_d:
                best_d = d2
                best = (cx, cy)
        return best

    new_segments = []
    for seg in segments:
        coords = list(seg['line'].coords)
        p1 = snap_point(coords[0])
        p2 = snap_point(coords[-1])
        if ((p1[0]-p2[0])**2 + (p1[1]-p2[1])**2) ** 0.5 < 0.1:
            continue
        new_line = LineString([p1, p2])
        new_segments.append({
            'line': snap_line_to_axis(new_line),
            'thickness': seg['thickness'],
            'name': seg['name']
        })
    return new_segments

def point_to_segment_distance(pt, a, b):
    """
    点到线段距离
    """
    px, py = pt
    ax, ay = a
    bx, by = b
    dx = bx - ax
    dy = by - ay
    if abs(dx) < EPS and abs(dy) < EPS:
        return ((px-ax)**2 + (py-ay)**2)**0.5, a, 0.0

    t = ((px-ax)*dx + (py-ay)*dy) / (dx*dx + dy*dy)
    t_clamped = max(0.0, min(1.0, t))
    qx = ax + t_clamped * dx
    qy = ay + t_clamped * dy
    dist = ((px-qx)**2 + (py-qy)**2)**0.5
    return dist, (qx, qy), t_clamped

def split_segments_by_near_vertices(segments, delta):
    """
    论文4.5 condition y:
    若顶点到边距离 < δy，则把点插入边
    """
    if not segments:
        return segments

    vertices = []
    for seg in segments:
        coords = list(seg['line'].coords)
        vertices.append(coords[0])
        vertices.append(coords[-1])

    new_segments = []
    for idx, seg in enumerate(segments):
        coords = list(seg['line'].coords)
        a = coords[0]
        b = coords[-1]
        split_pts = []

        for v in vertices:
            if v == a or v == b:
                continue
            dist, proj, t = point_to_segment_distance(v, a, b)
            if dist < delta and t > 0.01 and t < 0.99:
                split_pts.append((t, v))

        if not split_pts:
            new_segments.append(seg)
        else:
            split_pts.sort(key=lambda x: x[0])
            chain = [a] + [v for _, v in split_pts] + [b]
            for p1, p2 in zip(chain[:-1], chain[1:]):
                if ((p1[0]-p2[0])**2 + (p1[1]-p2[1])**2) ** 0.5 < 0.1:
                    continue
                new_line = snap_line_to_axis(LineString([p1, p2]))
                new_segments.append({
                    'line': new_line,
                    'thickness': seg['thickness'],
                    'name': seg['name']
                })
    return new_segments

def merge_collinear_segments(segments, gap_tol=0.3):
    """
    合并同一直线上的相邻短线段
    """
    if not segments:
        return segments

    horizontal = []
    vertical = []
    others = []

    for seg in segments:
        coords = list(seg['line'].coords)
        x1, y1 = coords[0]
        x2, y2 = coords[-1]
        if abs(y2 - y1) < 1e-6:
            xmin = min(x1, x2)
            xmax = max(x1, x2)
            horizontal.append((y1, xmin, xmax, seg))
        elif abs(x2 - x1) < 1e-6:
            ymin = min(y1, y2)
            ymax = max(y1, y2)
            vertical.append((x1, ymin, ymax, seg))
        else:
            others.append(seg)

    result = []

    # 水平
    by_y = {}
    for y, xmin, xmax, seg in horizontal:
        yk = round(y, 3)
        by_y.setdefault(yk, []).append((xmin, xmax, seg))

    for yk, arr in by_y.items():
        arr.sort(key=lambda x: x[0])
        cur_x1, cur_x2, cur_seg = arr[0]
        thick = cur_seg['thickness']
        name = cur_seg['name']
        for nx1, nx2, nseg in arr[1:]:
            if nx1 <= cur_x2 + gap_tol:
                cur_x2 = max(cur_x2, nx2)
                thick = (thick + nseg['thickness']) / 2.0
            else:
                result.append({
                    'line': LineString([(cur_x1, yk), (cur_x2, yk)]),
                    'thickness': thick,
                    'name': name
                })
                cur_x1, cur_x2, cur_seg = nx1, nx2, nseg
                thick = cur_seg['thickness']
                name = cur_seg['name']
        result.append({
            'line': LineString([(cur_x1, yk), (cur_x2, yk)]),
            'thickness': thick,
            'name': name
        })

    # 垂直
    by_x = {}
    for x, ymin, ymax, seg in vertical:
        xk = round(x, 3)
        by_x.setdefault(xk, []).append((ymin, ymax, seg))

    for xk, arr in by_x.items():
        arr.sort(key=lambda x: x[0])
        cur_y1, cur_y2, cur_seg = arr[0]
        thick = cur_seg['thickness']
        name = cur_seg['name']
        for ny1, ny2, nseg in arr[1:]:
            if ny1 <= cur_y2 + gap_tol:
                cur_y2 = max(cur_y2, ny2)
                thick = (thick + nseg['thickness']) / 2.0
            else:
                result.append({
                    'line': LineString([(xk, cur_y1), (xk, cur_y2)]),
                    'thickness': thick,
                    'name': name
                })
                cur_y1, cur_y2, cur_seg = ny1, ny2, nseg
                thick = cur_seg['thickness']
                name = cur_seg['name']
        result.append({
            'line': LineString([(xk, cur_y1), (xk, cur_y2)]),
            'thickness': thick,
            'name': name
        })

    result.extend(others)
    return result

def optimize_wall_centerlines(candidates, iter_count=1, enable_merge_collinear=False):
    """
    更保守的4.5实现：
    - condition x: 近节点合并
    - condition y: 点靠近边则插入边
    - 默认不做共线合并，避免把不同墙段错误合并
    """
    if not candidates:
        return []

    segs = candidates[:]

    for _ in range(iter_count):
        if not segs:
            break

        avg_t = sum(s['thickness'] for s in segs) / max(len(segs), 1)

        # 这里把delta调小，避免误合并
        delta = 0.25 * avg_t
        if delta < 0.03:
            delta = 0.03
        if delta > 0.15:
            delta = 0.15

        segs = merge_close_vertices(segs, delta)
        segs = split_segments_by_near_vertices(segs, delta)

        if enable_merge_collinear:
            segs = merge_collinear_segments(segs, gap_tol=delta * 0.5)

    cleaned = []
    for s in segs:
        try:
            if s['line'] is None or s['line'].is_empty:
                continue
            if s['line'].length < 0.1:
                continue
            cleaned.append(s)
        except:
            continue

    return cleaned


def get_wall_type_by_name(doc, type_name):
    wall_type_collector = FilteredElementCollector(doc).OfClass(WallType)
    found = None
    for wt in wall_type_collector:
        if wt.Kind == WallKind.Basic:
            name_param = wt.get_Parameter(BuiltInParameter.SYMBOL_NAME_PARAM)
            if name_param and name_param.AsString() == type_name:
                found = wt
                break
    if found:
        return found
    for wt in wall_type_collector:
        if wt.Kind == WallKind.Basic:
            return wt
    return None
#@#
def build_global_wall_mask(result, pixelWidth, pixelHeight, logs):
    """
    将所有墙类mask合成为一张整体二值图
    返回 uint8 二值图，墙=255，背景=0
    """
    wall_mask = np.zeros((pixelHeight, pixelWidth), dtype=np.uint8)

    if result.masks is None:
        logs.append("result.masks is None")
        return wall_mask

    masks_xy = result.masks.xy
    cls_ids = result.boxes.cls.cpu().numpy().astype(int)
    names = result.names

    logs.append("总mask数量: {}".format(len(masks_xy)))

    for i, contour_pts in enumerate(masks_xy):
        try:
            if i >= len(cls_ids):
                continue
            class_id = cls_ids[i]
            class_name = names[class_id]

            if not is_wall_class(class_name):
                continue

            pts = np.array(contour_pts, dtype=np.int32)
            if len(pts) < 3:
                continue

            # 限制在图像范围内
            pts[:, 0] = np.clip(pts[:, 0], 0, pixelWidth - 1)
            pts[:, 1] = np.clip(pts[:, 1], 0, pixelHeight - 1)

            cv2.fillPoly(wall_mask, [pts], 255)

        except Exception as e:
            logs.append("合成墙mask失败 idx={}: {}".format(i, str(e)))
            continue

    return wall_mask
#--
def clean_wall_mask(binary_mask, logs):
    """
    形态学清理：
    - 闭运算补缝
    - 开运算去噪
    - 移除小连通域
    """
    mask = binary_mask.copy()

    kernel_close = cv2.getStructuringElement(cv2.MORPH_RECT, (5, 5))
    kernel_open = cv2.getStructuringElement(cv2.MORPH_RECT, (3, 3))

    mask = cv2.morphologyEx(mask, cv2.MORPH_CLOSE, kernel_close)
    mask = cv2.morphologyEx(mask, cv2.MORPH_OPEN, kernel_open)

    num_labels, labels, stats, _ = cv2.connectedComponentsWithStats(mask, connectivity=8)
    cleaned = np.zeros_like(mask)

    for i in range(1, num_labels):
        area = stats[i, cv2.CC_STAT_AREA]
        if area >= 50:  # 可调
            cleaned[labels == i] = 255

    logs.append("墙mask清理完成")
    return cleaned


def estimate_wall_width_pixels(binary_mask, logs):
    """
    用距离变换估计墙宽像素值
    厚度 ~= 2 * skeleton点处的距离变换值
    简化做法：用墙区域整体距离变换的中位数*2
    """
    if binary_mask is None or binary_mask.max() == 0:
        logs.append("墙宽估计失败：mask为空")
        return 6.0

    dist = cv2.distanceTransform(binary_mask, cv2.DIST_L2, 5)
    vals = dist[dist > 0]
    if len(vals) == 0:
        logs.append("墙宽估计失败：distanceTransform为空")
        return 6.0

    wall_width_px = max(2.0, 2.0 * np.median(vals))
    logs.append("估计墙宽像素值: {:.2f}".format(wall_width_px))
    return wall_width_px
#-
def skeletonize_wall_mask(binary_mask, logs):
    """
    骨架提取，返回0/1图
    """
    try:
        from skimage.morphology import skeletonize
        skel = skeletonize(binary_mask > 0)
        logs.append("使用 skimage.skeletonize 成功")
        return skel.astype(np.uint8)
    except Exception as e:
        logs.append("skimage骨架失败，改用fallback: {}".format(str(e)))
        return skeletonize_fallback(binary_mask, logs)
#-
def get_neighbors_8(x, y, w, h):
    nbs = []
    for dy in [-1, 0, 1]:
        for dx in [-1, 0, 1]:
            if dx == 0 and dy == 0:
                continue
            nx = x + dx
            ny = y + dy
            if 0 <= nx < w and 0 <= ny < h:
                nbs.append((nx, ny))
    return nbs


def extract_skeleton_graph(skel, logs):
    """
    从骨架图提取节点和边
    节点 = 度数 != 2 的骨架像素（端点或交点）
    边 = 节点之间的像素路径
    """
    h, w = skel.shape
    skel_pts = set()
    for y in range(h):
        xs = np.where(skel[y] > 0)[0]
        for x in xs:
            skel_pts.add((x, y))

    if not skel_pts:
        logs.append("骨架为空")
        return [], []

    degree = {}
    for (x, y) in skel_pts:
        cnt = 0
        for nx, ny in get_neighbors_8(x, y, w, h):
            if (nx, ny) in skel_pts:
                cnt += 1
        degree[(x, y)] = cnt

    nodes = [p for p, d in degree.items() if d != 2]

    # 如果没有明显节点（纯单线），取骨架端点或任意两个端点
    if not nodes:
        nodes = list(skel_pts)

    node_set = set(nodes)
    visited_edges = set()
    edges = []

    for node in nodes:
        x0, y0 = node
        for nx, ny in get_neighbors_8(x0, y0, w, h):
            if (nx, ny) not in skel_pts:
                continue

            edge_key = tuple(sorted([node, (nx, ny)]))
            if edge_key in visited_edges:
                continue

            path = [node, (nx, ny)]
            prev = node
            curr = (nx, ny)

            while True:
                visited_edges.add(tuple(sorted([prev, curr])))

                if curr in node_set and curr != node:
                    break

                nbrs = []
                for tx, ty in get_neighbors_8(curr[0], curr[1], w, h):
                    if (tx, ty) in skel_pts and (tx, ty) != prev:
                        nbrs.append((tx, ty))

                if len(nbrs) == 0:
                    break
                if len(nbrs) > 1:
                    # 到交点了
                    break

                nxt = nbrs[0]
                path.append(nxt)
                prev = curr
                curr = nxt

            if len(path) >= 2:
                edges.append(path)

    logs.append("骨架图提取完成: nodes={}, edges={}".format(len(nodes), len(edges)))
    return nodes, edges
#-
def simplify_path_to_axis_line(path, wall_width_px, logs):
    """
    将骨架路径简化成水平/垂直中心线
    """
    if not path or len(path) < 2:
        return None

    xs = [p[0] for p in path]
    ys = [p[1] for p in path]

    x1, x2 = min(xs), max(xs)
    y1, y2 = min(ys), max(ys)

    dx = x2 - x1
    dy = y2 - y1

    # 太短则跳过
    if max(dx, dy) < max(3, wall_width_px):
        return None

    if dx >= dy:
        # 水平墙
        y_mean = sum(ys) / float(len(ys))
        p1 = pix_to_revit(x1, y_mean)
        p2 = pix_to_revit(x2, y_mean)
    else:
        # 垂直墙
        x_mean = sum(xs) / float(len(xs))
        p1 = pix_to_revit(x_mean, y1)
        p2 = pix_to_revit(x_mean, y2)

    if p1.DistanceTo(p2) < 0.1:
        return None

    return LineString([(p1.X, p1.Y), (p2.X, p2.Y)])
#-
def extract_wall_centerlines_from_global_mask(result, pixelWidth, pixelHeight, logs):
    """
    全局墙图 -> 骨架 -> 中心线候选
    """
    wall_mask = build_global_wall_mask(result, pixelWidth, pixelHeight, logs)
    if wall_mask.max() == 0:
        logs.append("没有墙类mask被写入全局墙图")
        return [], 0.3

    cleaned_mask = clean_wall_mask(wall_mask, logs)
    wall_width_px = estimate_wall_width_pixels(cleaned_mask, logs)

    skel = skeletonize_wall_mask(cleaned_mask, logs)
    nodes, edges = extract_skeleton_graph(skel, logs)

    if not edges:
        logs.append("骨架没有边")
        return [], wall_width_px

    candidates = []
    wall_width_ft = wall_width_px * scaleX  # 像素厚度转Revit长度

    for idx, path in enumerate(edges):
        try:
            line_geom = simplify_path_to_axis_line(path, wall_width_px, logs)
            if line_geom is None:
                continue
            if line_geom.length < 0.2:
                continue

            candidates.append({
                'line': line_geom,
                'thickness': wall_width_ft,
                'name': "Wall"
            })
        except Exception as e:
            logs.append("路径{}转中心线失败: {}".format(idx, str(e)))
            continue

    logs.append("全局提取中心线候选数量: {}".format(len(candidates)))
    return candidates, wall_width_ft


#@#




plane = Plane.CreateByNormalAndOrigin(XYZ.BasisZ, origin)
sketch_plane = SketchPlane.Create(doc, plane)
#
DEFAULT_WALL_WIDTH = 0.3  # 英尺：你后面最好用真实墙宽估计替换它

if result.masks is not None:
    logs.append("YOLO类别映射: {}".format(str(result.names)))

    wall_candidates, default_wall_thickness = extract_wall_centerlines_from_global_mask(
        result, pixelWidth, pixelHeight, logs
    )

    logs.append("初始墙候选数量: {}".format(len(wall_candidates)))

    # 这里先做保守版4.5优化：只做节点合并、点插边，不做激进共线合并
    optimized_walls = optimize_wall_centerlines(
        wall_candidates,
        iter_count=1,
        enable_merge_collinear=False
    )

    logs.append("优化后墙数量: {}".format(len(optimized_walls)))

    for idx, w in enumerate(optimized_walls):
        try:
            line_geom = w['line']
            thickness_val = w['thickness']
            name = w['name']

            coords = list(line_geom.coords)
            if len(coords) < 2:
                logs.append("墙{}失败：coords不足".format(idx))
                continue

            start_pt = XYZ(coords[0][0], coords[0][1], 0)
            end_pt = XYZ(coords[-1][0], coords[-1][1], 0)

            if start_pt.DistanceTo(end_pt) < 0.1:
                logs.append("墙{}失败：线太短".format(idx))
                continue

            revit_line = Line.CreateBound(start_pt, end_pt)

            logs.append("准备创建墙{}: len={:.3f}, thickness={:.3f}".format(
                idx, revit_line.Length, thickness_val
            ))

            wall = Wall.Create(doc, revit_line, wall_type.Id, level.Id, wallHeight, 0, False, False)

            try:
                param = wall.get_Parameter(BuiltInParameter.WALL_ATTR_WIDTH_PARAM)
                if param and not param.IsReadOnly:
                    param.Set(thickness_val)
            except Exception as e2:
                logs.append("墙{}宽度设置失败(可忽略): {}".format(idx, str(e2)))

            try:
                wall.Name = name
            except:
                pass

            created_walls.append(wall.ToDSType(True))
            logs.append("墙{}创建成功".format(idx))

        except Exception as e:
            logs.append("墙{}创建失败: {}".format(idx, str(e)))
            logs.append(traceback.format_exc())
            continue
else:
    logs.append("result.masks is None，没有分割mask")
            

        
        
        



# others upgrades __
TransactionManager.Instance.TransactionTaskDone()
doc.Regenerate()
# Outs
#OUT = [created_lines, dyn_lines]
OUT = created_walls,logs
# ----------------------------------------
python_version_12 = Watch(python_script_11)  # graph output
python_script_12 = Python(IN[0]=modelpath_2, IN[1]=imagepath_2, IN[2]=number, IN[3]=scale)  # CPython3; frozen
# ---------- python_script_12.python (1198 lines) ----------
# 加载 Python Standard 和 DesignScript 库
import sys
import clr
clr.AddReference('ProtoGeometry')
from Autodesk.DesignScript.Geometry import *
import Autodesk.DesignScript.Geometry as DS
import Revit
from Revit.Elements import *
import System
sys.path.append("C:/Users/Lenovo/anaconda3/envs/revitenv/Lib/site-packages")
clr.AddReference('RevitAPI')
clr.AddReference('RevitAPIUI')
from Autodesk.Revit.DB import *
from Autodesk.Revit.UI import *

clr.AddReference('RevitServices')
from RevitServices.Persistence import DocumentManager
from RevitServices.Transactions import TransactionManager

clr.AddReference('RevitNodes')
import Revit
clr.ImportExtensions(Revit.Elements)
clr.ImportExtensions(Revit.GeometryConversion)
#
import re
import math
from scipy.spatial import Voronoi
from shapely.geometry import Polygon, LineString, MultiLineString
from shapely.ops import linemerge
from shapely.ops import unary_union, split
from shapely.geometry import Point as ShpPoint
from scipy import ndimage
from skimage.morphology import skeletonize

import traceback
from shapely.geometry import Polygon as ShpPolygon
from shapely.geometry import MultiPolygon as ShpMultiPolygon
from shapely.geometry import Point as ShpPoint
from shapely.geometry import MultiLineString
from shapely.ops import linemerge
import numpy as np
import torch
import cv2
from ultralytics import YOLO

dataEnteringNode = IN 
dect_Model = IN[0]
pixpath = IN[1]
height = IN[2]
scale = IN[3]
#params
origin = XYZ(0, 0, 0)   
widthFt = scale
pixelWidth = 1600   
pixelHeight = 1200 
DENSIFY_DIST = 0.5  
EPS = 1e-6
#
TARGET_WALL_TYPE_NAME = "基本墙 200mm"   # 项目中存在的墙类型名称
TARGET_LEVEL_NAME = "标高 2"                            
#                         
yolo_seg = YOLO(dect_Model,task = "seg")
newpath = "E:/yanjiu/revitss/tests/jjianzhu_seg.jpg"

seg_result = yolo_seg(source = pixpath,save = False,conf = 0.3,iou = 0.45,imgsz = 640)
cv2.imwrite(newpath,seg_result[0].plot())
#tempouts = []
#tempouts.append(newpath)
#tempouts.extend(dect_result)
scaleX = widthFt / pixelWidth
scaleY = widthFt * (pixelHeight / pixelWidth) / pixelHeight  

result = seg_result[0]        
boxes = result.boxes
xyxy = boxes.xyxy.cpu().numpy() 
cls_ids = boxes.cls.cpu().numpy().astype(int)  # 类别索引 (N,)
names = result.names  

doc = DocumentManager.Instance.CurrentDBDocument
app = doc.Application
TransactionManager.Instance.EnsureInTransaction(doc)

# 按名称查找
wall_type = None
wall_type_collector = FilteredElementCollector(doc).OfClass(WallType)

# 先按名称查找基本 墙
for wt in wall_type_collector:
    if wt.Kind == WallKind.Basic:  # 只考虑基本墙
        name_param = wt.get_Parameter(BuiltInParameter.SYMBOL_NAME_PARAM)
        if name_param and name_param.AsString() == TARGET_WALL_TYPE_NAME:
            wall_type = wt
            break

# 如果没找到指定名称的基本墙，则取第一个基本墙
if wall_type is None:
    for wt in wall_type_collector:
        if wt.Kind == WallKind.Basic:
            wall_type = wt
            break

if wall_type is None:
    raise Exception("项目中找不到任何基本墙类型！")

# --- 获取目标标高 ---
level = None
level_collector = FilteredElementCollector(doc).OfClass(Level)
for lvl in level_collector:
    # 标高名称参数
    name_param = lvl.get_Parameter(BuiltInParameter.LEVEL_NAME)
    if name_param and name_param.AsString() == TARGET_LEVEL_NAME:
        level = lvl
        break
if level is None:
    level = level_collector.FirstElement()
    if level is None:
        raise Exception("项目中找不到任何标高！")


TransactionManager.Instance.EnsureInTransaction(doc)

created_lines = []
dyn_lines = []
dyn_faces = [] 
created_shapes = []
created_walls = []
wall_candidates = []

logs = []

thickness = height
wallHeight = height

def pix_to_revit(x, y):
    revit_x = origin.X + x * scaleX
    revit_y = origin.Y + (pixelHeight - y) * scaleY  # 翻转 Y 轴
    return XYZ(revit_x, revit_y, origin.Z)
def sanitize_name(name):
    # 如果名称为空，返回默认名称
    if not name:
        return "Unknown"
    # 移除控制字符（ASCII 0-31，除了tab? 但最好全部移除）
    # 允许常见字符：字母、数字、空格、下划线、连字符、中文等
    # 保留所有打印字符，移除控制字符
    cleaned = re.sub(r'[\x00-\x1f\x7f]', '', name)
    # 如果清理后为空，则返回默认名
    if not cleaned.strip():
        return "Unnamed"
    return cleaned
##
EPS = 1e-6

# 你必须根据自己的模型类别名修改这里
# 比如如果你的墙类别是 "wall" 或 "墙体" 或 "wall_line"，就在这里加上
WALL_CLASS_NAMES = set(["wall", "Wall", "墙体"])
WALL_CLASS_KEYWORDS = [
    "wall",
    "Wall",
    "basic wall",
    "bearing wall",
    "non-bearing wall",
    "shear wall",
    "墙",
    "墙体",
    "基本墙",
    "基本墙 200mm",
    "承重墙",
    "非承重墙",
    "剪力墙"
]

def normalize_class_name(name):
    if name is None:
        return ""
    return str(name).strip().lower()

def is_wall_class(name):
    n = normalize_class_name(name)
    if not n:
        return False
    for kw in WALL_CLASS_KEYWORDS:
        if kw.lower() in n:
            return True
    return False
    

def ensure_polygon(geom):
    """
    将 geometry 尽量转成一个有效 Polygon
    如果是 MultiPolygon，则取面积最大的一个
    """
    if geom is None or geom.is_empty:
        return None
    try:
        if not geom.is_valid:
            geom = geom.buffer(0)
    except:
        pass
    if geom is None or geom.is_empty:
        return None

    if isinstance(geom, ShpPolygon):
        return geom

    if isinstance(geom, ShpMultiPolygon):
        polys = [g for g in geom.geoms if g is not None and not g.is_empty]
        if not polys:
            return None
        polys.sort(key=lambda p: p.area, reverse=True)
        return polys[0]

    return None

def contour_to_polygon(contour_pts):
    """
    contour_pts: YOLO mask contour pixel points
    转成shapely polygon（Revit坐标系）
    """
    revit_pts = [pix_to_revit(pt[0], pt[1]) for pt in contour_pts]
    if len(revit_pts) < 3:
        return None
    coords = [(p.X, p.Y) for p in revit_pts]
    if coords[0] != coords[-1]:
        coords.append(coords[0])
    poly = ShpPolygon(coords)
    poly = ensure_polygon(poly)
    return poly

def line_long_enough(line_geom, min_len=0.1):
    if line_geom is None or line_geom.is_empty:
        return False
    try:
        return line_geom.length >= min_len
    except:
        return False

def snap_line_to_axis(line_geom):
    """
    对线段做水平/垂直吸附，作为 Lalignment 的工程近似
    """
    if line_geom is None or line_geom.is_empty:
        return None
    coords = list(line_geom.coords)
    if len(coords) < 2:
        return None
    x1, y1 = coords[0]
    x2, y2 = coords[-1]
    dx = x2 - x1
    dy = y2 - y1
    if abs(dx) >= abs(dy):
        ym = 0.5 * (y1 + y2)
        return LineString([(x1, ym), (x2, ym)])
    else:
        xm = 0.5 * (x1 + x2)
        return LineString([(xm, y1), (xm, y2)])

def longest_linestring_from_intersection(inter):
    """
    从 intersection 结果中取最长的 LineString
    """
    if inter is None or inter.is_empty:
        return None
    if inter.geom_type == "LineString":
        return inter
    if inter.geom_type == "MultiLineString":
        lines = [g for g in inter.geoms if g.length > 1e-4]
        if not lines:
            return None
        lines.sort(key=lambda g: g.length, reverse=True)
        return lines[0]
    return None

def estimate_centerline_from_polygon(poly):
    """
    稳定版中心线初始化：
    1) 取最小外接旋转矩形
    2) 判断主方向
    3) 通过polygon质心沿主方向打一条长线
    4) 与polygon求交得到中心段
    5) 用 area / centerline_length 估计厚度
    """
    if poly is None or poly.is_empty:
        return None, None

    poly = ensure_polygon(poly)
    if poly is None:
        return None, None

    if poly.area < 1e-5:
        return None, None

    try:
        mrr = poly.minimum_rotated_rectangle
    except:
        return None, None

    mrr = ensure_polygon(mrr)
    if mrr is None:
        return None, None

    rect_coords = list(mrr.exterior.coords)[:-1]
    if len(rect_coords) != 4:
        return None, None

    edges = []
    for i in range(4):
        p1 = rect_coords[i]
        p2 = rect_coords[(i + 1) % 4]
        length = ((p2[0]-p1[0])**2 + (p2[1]-p1[1])**2) ** 0.5
        edges.append((p1, p2, length))

    # 按边长排序
    edges_sorted = sorted(edges, key=lambda e: e[2], reverse=True)
    long_edge = edges_sorted[0]
    short_edge = edges_sorted[-1]

    long_len = long_edge[2]
    short_len = short_edge[2]

    if long_len < 0.1:
        return None, None

    # 主方向
    p1, p2, _ = long_edge
    dx = p2[0] - p1[0]
    dy = p2[1] - p1[1]
    norm = (dx*dx + dy*dy) ** 0.5
    if norm < EPS:
        return None, None
    ux = dx / norm
    uy = dy / norm

    # 过质心打一条足够长的线
    c = poly.centroid
    minx, miny, maxx, maxy = poly.bounds
    diag = ((maxx-minx)**2 + (maxy-miny)**2) ** 0.5 + 10.0

    raw_line = LineString([
        (c.x - ux * diag, c.y - uy * diag),
        (c.x + ux * diag, c.y + uy * diag)
    ])

    # 与polygon相交，取最长线段作为中心线
    inter = raw_line.intersection(poly)
    centerline = longest_linestring_from_intersection(inter)
    if centerline is None:
        return None, None

    centerline = snap_line_to_axis(centerline)
    if centerline is None or centerline.length < 0.1:
        return None, None

    # 厚度估计：面积 / 中心线长度
    thickness = poly.area / max(centerline.length, EPS)

    # 防止异常值
    if thickness < 0.05:
        thickness = 0.05
    if thickness > 2.0:
        thickness = 2.0

    return centerline, thickness

def merge_close_vertices(segments, delta):
    """
    论文4.5 condition x:
    两节点距离 < δx，则合并
    对线段端点进行统一吸附
    """
    pts = []
    for seg in segments:
        coords = list(seg['line'].coords)
        pts.append(coords[0])
        pts.append(coords[-1])

    if not pts:
        return segments

    clusters = []
    for p in pts:
        assigned = False
        for cluster in clusters:
            cx, cy, plist = cluster
            d2 = (p[0]-cx)**2 + (p[1]-cy)**2
            if d2 < delta * delta:
                plist.append(p)
                nx = sum(pp[0] for pp in plist) / len(plist)
                ny = sum(pp[1] for pp in plist) / len(plist)
                cluster[0] = nx
                cluster[1] = ny
                assigned = True
                break
        if not assigned:
            clusters.append([p[0], p[1], [p]])

    def snap_point(p):
        best = p
        best_d = 1e18
        for cx, cy, plist in clusters:
            d2 = (p[0]-cx)**2 + (p[1]-cy)**2
            if d2 < best_d:
                best_d = d2
                best = (cx, cy)
        return best

    new_segments = []
    for seg in segments:
        coords = list(seg['line'].coords)
        p1 = snap_point(coords[0])
        p2 = snap_point(coords[-1])
        if ((p1[0]-p2[0])**2 + (p1[1]-p2[1])**2) ** 0.5 < 0.1:
            continue
        new_line = LineString([p1, p2])
        new_segments.append({
            'line': snap_line_to_axis(new_line),
            'thickness': seg['thickness'],
            'name': seg['name']
        })
    return new_segments

def point_to_segment_distance(pt, a, b):
    """
    点到线段距离
    """
    px, py = pt
    ax, ay = a
    bx, by = b
    dx = bx - ax
    dy = by - ay
    if abs(dx) < EPS and abs(dy) < EPS:
        return ((px-ax)**2 + (py-ay)**2)**0.5, a, 0.0

    t = ((px-ax)*dx + (py-ay)*dy) / (dx*dx + dy*dy)
    t_clamped = max(0.0, min(1.0, t))
    qx = ax + t_clamped * dx
    qy = ay + t_clamped * dy
    dist = ((px-qx)**2 + (py-qy)**2)**0.5
    return dist, (qx, qy), t_clamped

def split_segments_by_near_vertices(segments, delta):
    """
    论文4.5 condition y:
    若顶点到边距离 < δy，则把点插入边
    """
    if not segments:
        return segments

    vertices = []
    for seg in segments:
        coords = list(seg['line'].coords)
        vertices.append(coords[0])
        vertices.append(coords[-1])

    new_segments = []
    for idx, seg in enumerate(segments):
        coords = list(seg['line'].coords)
        a = coords[0]
        b = coords[-1]
        split_pts = []

        for v in vertices:
            if v == a or v == b:
                continue
            dist, proj, t = point_to_segment_distance(v, a, b)
            if dist < delta and t > 0.01 and t < 0.99:
                split_pts.append((t, v))

        if not split_pts:
            new_segments.append(seg)
        else:
            split_pts.sort(key=lambda x: x[0])
            chain = [a] + [v for _, v in split_pts] + [b]
            for p1, p2 in zip(chain[:-1], chain[1:]):
                if ((p1[0]-p2[0])**2 + (p1[1]-p2[1])**2) ** 0.5 < 0.1:
                    continue
                new_line = snap_line_to_axis(LineString([p1, p2]))
                new_segments.append({
                    'line': new_line,
                    'thickness': seg['thickness'],
                    'name': seg['name']
                })
    return new_segments

def merge_collinear_segments(segments, gap_tol=0.3):
    """
    合并同一直线上的相邻短线段
    """
    if not segments:
        return segments

    horizontal = []
    vertical = []
    others = []

    for seg in segments:
        coords = list(seg['line'].coords)
        x1, y1 = coords[0]
        x2, y2 = coords[-1]
        if abs(y2 - y1) < 1e-6:
            xmin = min(x1, x2)
            xmax = max(x1, x2)
            horizontal.append((y1, xmin, xmax, seg))
        elif abs(x2 - x1) < 1e-6:
            ymin = min(y1, y2)
            ymax = max(y1, y2)
            vertical.append((x1, ymin, ymax, seg))
        else:
            others.append(seg)

    result = []

    # 水平
    by_y = {}
    for y, xmin, xmax, seg in horizontal:
        yk = round(y, 3)
        by_y.setdefault(yk, []).append((xmin, xmax, seg))

    for yk, arr in by_y.items():
        arr.sort(key=lambda x: x[0])
        cur_x1, cur_x2, cur_seg = arr[0]
        thick = cur_seg['thickness']
        name = cur_seg['name']
        for nx1, nx2, nseg in arr[1:]:
            if nx1 <= cur_x2 + gap_tol:
                cur_x2 = max(cur_x2, nx2)
                thick = (thick + nseg['thickness']) / 2.0
            else:
                result.append({
                    'line': LineString([(cur_x1, yk), (cur_x2, yk)]),
                    'thickness': thick,
                    'name': name
                })
                cur_x1, cur_x2, cur_seg = nx1, nx2, nseg
                thick = cur_seg['thickness']
                name = cur_seg['name']
        result.append({
            'line': LineString([(cur_x1, yk), (cur_x2, yk)]),
            'thickness': thick,
            'name': name
        })

    # 垂直
    by_x = {}
    for x, ymin, ymax, seg in vertical:
        xk = round(x, 3)
        by_x.setdefault(xk, []).append((ymin, ymax, seg))

    for xk, arr in by_x.items():
        arr.sort(key=lambda x: x[0])
        cur_y1, cur_y2, cur_seg = arr[0]
        thick = cur_seg['thickness']
        name = cur_seg['name']
        for ny1, ny2, nseg in arr[1:]:
            if ny1 <= cur_y2 + gap_tol:
                cur_y2 = max(cur_y2, ny2)
                thick = (thick + nseg['thickness']) / 2.0
            else:
                result.append({
                    'line': LineString([(xk, cur_y1), (xk, cur_y2)]),
                    'thickness': thick,
                    'name': name
                })
                cur_y1, cur_y2, cur_seg = ny1, ny2, nseg
                thick = cur_seg['thickness']
                name = cur_seg['name']
        result.append({
            'line': LineString([(xk, cur_y1), (xk, cur_y2)]),
            'thickness': thick,
            'name': name
        })

    result.extend(others)
    return result

def optimize_wall_centerlines(candidates, iter_count=1, enable_merge_collinear=True):
    if not candidates:
        return []

    segs = candidates[:]

    # 先严格共线合并一次，把被切碎的小段拼回去
    if enable_merge_collinear:
        segs = merge_collinear_segments_strict(segs, coord_tol=0.08, gap_tol=0.35)

    for _ in range(iter_count):
        if not segs:
            break

        avg_t = sum(s['thickness'] for s in segs) / max(len(segs), 1)
        delta = 0.20 * avg_t
        if delta < 0.03:
            delta = 0.03
        if delta > 0.12:
            delta = 0.12

        segs = merge_close_vertices(segs, delta)
        segs = split_segments_by_near_vertices(segs, delta)

    cleaned = []
    for s in segs:
        try:
            if s['line'] is None or s['line'].is_empty:
                continue
            if s['line'].length < 0.08:
                continue
            cleaned.append(s)
        except:
            continue

    return cleaned



def get_wall_type_by_name(doc, type_name):
    wall_type_collector = FilteredElementCollector(doc).OfClass(WallType)
    found = None
    for wt in wall_type_collector:
        if wt.Kind == WallKind.Basic:
            name_param = wt.get_Parameter(BuiltInParameter.SYMBOL_NAME_PARAM)
            if name_param and name_param.AsString() == type_name:
                found = wt
                break
    if found:
        return found
    for wt in wall_type_collector:
        if wt.Kind == WallKind.Basic:
            return wt
    return None
#@#
def build_global_wall_mask(result, pixelWidth, pixelHeight, logs):
    """
    将所有墙类mask合成为一张整体二值图
    返回 uint8 二值图，墙=255，背景=0
    """
    wall_mask = np.zeros((pixelHeight, pixelWidth), dtype=np.uint8)

    if result.masks is None:
        logs.append("result.masks is None")
        return wall_mask

    masks_xy = result.masks.xy
    cls_ids = result.boxes.cls.cpu().numpy().astype(int)
    names = result.names

    logs.append("总mask数量: {}".format(len(masks_xy)))

    for i, contour_pts in enumerate(masks_xy):
        try:
            if i >= len(cls_ids):
                continue
            class_id = cls_ids[i]
            class_name = names[class_id]

            if not is_wall_class(class_name):
                continue

            pts = np.array(contour_pts, dtype=np.int32)
            if len(pts) < 3:
                continue

            # 限制在图像范围内
            pts[:, 0] = np.clip(pts[:, 0], 0, pixelWidth - 1)
            pts[:, 1] = np.clip(pts[:, 1], 0, pixelHeight - 1)

            cv2.fillPoly(wall_mask, [pts], 255)

        except Exception as e:
            logs.append("合成墙mask失败 idx={}: {}".format(i, str(e)))
            continue

    return wall_mask
#--
def clean_wall_mask(binary_mask, logs):
    """
    形态学清理：
    - 闭运算补缝
    - 开运算去噪
    - 移除小连通域
    """
    mask = binary_mask.copy()

    kernel_close = cv2.getStructuringElement(cv2.MORPH_RECT, (5, 5))
    kernel_open = cv2.getStructuringElement(cv2.MORPH_RECT, (3, 3))

    mask = cv2.morphologyEx(mask, cv2.MORPH_CLOSE, kernel_close)
    mask = cv2.morphologyEx(mask, cv2.MORPH_OPEN, kernel_open)

    num_labels, labels, stats, _ = cv2.connectedComponentsWithStats(mask, connectivity=8)
    cleaned = np.zeros_like(mask)

    for i in range(1, num_labels):
        area = stats[i, cv2.CC_STAT_AREA]
        if area >= 50:  # 可调
            cleaned[labels == i] = 255

    logs.append("墙mask清理完成")
    return cleaned


def estimate_wall_width_pixels(binary_mask, logs):
    """
    用距离变换估计墙宽像素值
    厚度 ~= 2 * skeleton点处的距离变换值
    简化做法：用墙区域整体距离变换的中位数*2
    """
    if binary_mask is None or binary_mask.max() == 0:
        logs.append("墙宽估计失败：mask为空")
        return 6.0

    dist = cv2.distanceTransform(binary_mask, cv2.DIST_L2, 5)
    vals = dist[dist > 0]
    if len(vals) == 0:
        logs.append("墙宽估计失败：distanceTransform为空")
        return 6.0

    wall_width_px = max(2.0, 2.0 * np.median(vals))
    logs.append("估计墙宽像素值: {:.2f}".format(wall_width_px))
    return wall_width_px
#-
def skeletonize_wall_mask(binary_mask, logs):
    """
    骨架提取，返回0/1图
    """
    try:
        from skimage.morphology import skeletonize
        skel = skeletonize(binary_mask > 0)
        logs.append("使用 skimage.skeletonize 成功")
        return skel.astype(np.uint8)
    except Exception as e:
        logs.append("skimage骨架失败，改用fallback: {}".format(str(e)))
        return skeletonize_fallback(binary_mask, logs)
#-
def get_neighbors_8(x, y, w, h):
    nbs = []
    for dy in [-1, 0, 1]:
        for dx in [-1, 0, 1]:
            if dx == 0 and dy == 0:
                continue
            nx = x + dx
            ny = y + dy
            if 0 <= nx < w and 0 <= ny < h:
                nbs.append((nx, ny))
    return nbs


def extract_skeleton_graph(skel, logs):
    """
    从骨架图提取节点和边
    节点 = 度数 != 2 的骨架像素（端点或交点）
    边 = 节点之间的像素路径
    """
    h, w = skel.shape
    skel_pts = set()
    for y in range(h):
        xs = np.where(skel[y] > 0)[0]
        for x in xs:
            skel_pts.add((x, y))

    if not skel_pts:
        logs.append("骨架为空")
        return [], []

    degree = {}
    for (x, y) in skel_pts:
        cnt = 0
        for nx, ny in get_neighbors_8(x, y, w, h):
            if (nx, ny) in skel_pts:
                cnt += 1
        degree[(x, y)] = cnt

    nodes = [p for p, d in degree.items() if d != 2]

    # 如果没有明显节点（纯单线），取骨架端点或任意两个端点
    if not nodes:
        nodes = list(skel_pts)

    node_set = set(nodes)
    visited_edges = set()
    edges = []

    for node in nodes:
        x0, y0 = node
        for nx, ny in get_neighbors_8(x0, y0, w, h):
            if (nx, ny) not in skel_pts:
                continue

            edge_key = tuple(sorted([node, (nx, ny)]))
            if edge_key in visited_edges:
                continue

            path = [node, (nx, ny)]
            prev = node
            curr = (nx, ny)

            while True:
                visited_edges.add(tuple(sorted([prev, curr])))

                if curr in node_set and curr != node:
                    break

                nbrs = []
                for tx, ty in get_neighbors_8(curr[0], curr[1], w, h):
                    if (tx, ty) in skel_pts and (tx, ty) != prev:
                        nbrs.append((tx, ty))

                if len(nbrs) == 0:
                    break
                if len(nbrs) > 1:
                    # 到交点了
                    break

                nxt = nbrs[0]
                path.append(nxt)
                prev = curr
                curr = nxt

            if len(path) >= 2:
                edges.append(path)

    logs.append("骨架图提取完成: nodes={}, edges={}".format(len(nodes), len(edges)))
    return nodes, edges
#-
def simplify_path_to_axis_lines(path, wall_mask, pixelWidth, pixelHeight, logs, min_len_px=8):
    """
    一条骨架路径 -> 多条更精确的水平/垂直中心线
    关键：先按拐点拆段，再对每段做局部中线拟合
    """
    result_lines = []

    sub_paths = split_path_by_direction(path, turn_threshold=2)
    for sub in sub_paths:
        try:
            fitted = fit_axis_line_from_mask(
                sub, wall_mask, pixelWidth, pixelHeight, min_len_px=min_len_px
            )
            if fitted is None:
                continue

            p1, p2, ori = fitted
            line_geom = pixel_line_to_revit_linestring(p1, p2)
            if line_geom is None:
                continue

            if line_geom.length < 0.08:
                continue

            result_lines.append(line_geom)

        except Exception as e:
            logs.append("子段拟合失败: {}".format(str(e)))
            continue

    return result_lines

#-
def extract_wall_centerlines_from_global_mask(result, pixelWidth, pixelHeight, logs):
    wall_mask = build_global_wall_mask(result, pixelWidth, pixelHeight, logs)
    if wall_mask.max() == 0:
        logs.append("没有墙类mask被写入全局墙图")
        return [], 0.3

    cleaned_mask = clean_wall_mask(wall_mask, logs)
    wall_width_px = estimate_wall_width_pixels(cleaned_mask, logs)

    skel = skeletonize_wall_mask(cleaned_mask, logs)
    nodes, edges = extract_skeleton_graph(skel, logs)

    if not edges:
        logs.append("骨架没有边")
        return [], wall_width_px * scaleX

    wall_width_ft = wall_width_px * scaleX
    candidates = []

    for idx, path in enumerate(edges):
        try:
            line_list = simplify_path_to_axis_lines(
                path, cleaned_mask, pixelWidth, pixelHeight, logs, min_len_px=max(6, int(wall_width_px))
            )

            for line_geom in line_list:
                candidates.append({
                    'line': line_geom,
                    'thickness': wall_width_ft,
                    'name': "Wall"
                })

        except Exception as e:
            logs.append("路径{}转中心线失败: {}".format(idx, str(e)))
            continue

    logs.append("全局提取中心线候选数量: {}".format(len(candidates)))
    return candidates, wall_width_ft
#-
def merge_collinear_segments_strict(segments, coord_tol=0.08, gap_tol=0.25):
    if not segments:
        return segments

    horizontal = []
    vertical = []
    others = []

    for seg in segments:
        coords = list(seg['line'].coords)
        x1, y1 = coords[0]
        x2, y2 = coords[-1]

        if abs(y2 - y1) <= coord_tol:
            y = 0.5 * (y1 + y2)
            xmin, xmax = min(x1, x2), max(x1, x2)
            horizontal.append((y, xmin, xmax, seg))
        elif abs(x2 - x1) <= coord_tol:
            x = 0.5 * (x1 + x2)
            ymin, ymax = min(y1, y2), max(y1, y2)
            vertical.append((x, ymin, ymax, seg))
        else:
            others.append(seg)

    merged = []

    # merge horizontal
    horizontal.sort(key=lambda t: (round(t[0], 2), t[1]))
    used = [False] * len(horizontal)
    for i in range(len(horizontal)):
        if used[i]:
            continue
        y, x1, x2, seg = horizontal[i]
        thick = seg['thickness']
        name = seg['name']

        for j in range(i + 1, len(horizontal)):
            if used[j]:
                continue
            y2, xx1, xx2, seg2 = horizontal[j]
            if abs(y2 - y) <= coord_tol and xx1 <= x2 + gap_tol:
                x2 = max(x2, xx2)
                thick = 0.5 * (thick + seg2['thickness'])
                used[j] = True

        merged.append({
            'line': LineString([(x1, y), (x2, y)]),
            'thickness': thick,
            'name': name
        })

    # merge vertical
    vertical.sort(key=lambda t: (round(t[0], 2), t[1]))
    used = [False] * len(vertical)
    for i in range(len(vertical)):
        if used[i]:
            continue
        x, y1, y2, seg = vertical[i]
        thick = seg['thickness']
        name = seg['name']

        for j in range(i + 1, len(vertical)):
            if used[j]:
                continue
            x2, yy1, yy2, seg2 = vertical[j]
            if abs(x2 - x) <= coord_tol and yy1 <= y2 + gap_tol:
                y2 = max(y2, yy2)
                thick = 0.5 * (thick + seg2['thickness'])
                used[j] = True

        merged.append({
            'line': LineString([(x, y1), (x, y2)]),
            'thickness': thick,
            'name': name
        })

    merged.extend(others)
    return merged

#-
def split_path_by_direction(path, turn_threshold=2):
    """
    将骨架路径按方向变化拆分成多个近似直线子段
    path: [(x,y), ...]
    返回: [sub_path1, sub_path2, ...]
    """
    if not path or len(path) < 3:
        return [path] if path else []

    segments = []
    current = [path[0], path[1]]

    def major_dir(p1, p2):
        dx = p2[0] - p1[0]
        dy = p2[1] - p1[1]
        if abs(dx) >= abs(dy):
            return "h"
        else:
            return "v"

    prev_dir = major_dir(path[0], path[1])

    for i in range(2, len(path)):
        d = major_dir(path[i-1], path[i])

        if d == prev_dir:
            current.append(path[i])
        else:
            # 防止锯齿导致频繁切换：长度太短则并回去
            if len(current) <= turn_threshold and segments:
                segments[-1].extend(current[1:])
                current = [segments[-1][-1], path[i]]
            else:
                segments.append(current)
                current = [path[i-1], path[i]]
            prev_dir = d

    if current:
        if len(current) <= turn_threshold and segments:
            segments[-1].extend(current[1:])
        else:
            segments.append(current)

    # 去掉太短段
    cleaned = []
    for seg in segments:
        if seg and len(seg) >= 2:
            cleaned.append(seg)

    return cleaned

#-
def fit_axis_line_from_mask(sub_path, wall_mask, pixelWidth, pixelHeight, min_len_px=8):
    """
    对单个骨架子段，从墙mask边界反推更准确的中心线
    返回: ((x1,y1),(x2,y2), orientation) 或 None
    """
    if not sub_path or len(sub_path) < 2:
        return None

    xs = [p[0] for p in sub_path]
    ys = [p[1] for p in sub_path]

    x_min = max(0, int(min(xs)))
    x_max = min(pixelWidth - 1, int(max(xs)))
    y_min = max(0, int(min(ys)))
    y_max = min(pixelHeight - 1, int(max(ys)))

    dx = x_max - x_min
    dy = y_max - y_min

    # 判断主方向
    if dx >= dy:
        # 水平段：逐列扫描上下边界，取中心
        mids = []
        for x in range(x_min, x_max + 1):
            ys_in = np.where(wall_mask[:, x] > 0)[0]
            ys_local = ys_in[(ys_in >= y_min - 8) & (ys_in <= y_max + 8)]
            if len(ys_local) >= 2:
                y_top = np.min(ys_local)
                y_bot = np.max(ys_local)
                y_mid = 0.5 * (y_top + y_bot)
                mids.append((x, y_mid))

        if len(mids) < 2:
            return None

        xs2 = [p[0] for p in mids]
        ys2 = [p[1] for p in mids]

        x1 = min(xs2)
        x2 = max(xs2)
        y = float(np.median(ys2))

        if (x2 - x1) < min_len_px:
            return None

        return ((x1, y), (x2, y), "h")

    else:
        # 垂直段：逐行扫描左右边界，取中心
        mids = []
        for y in range(y_min, y_max + 1):
            xs_in = np.where(wall_mask[y, :] > 0)[0]
            xs_local = xs_in[(xs_in >= x_min - 8) & (xs_in <= x_max + 8)]
            if len(xs_local) >= 2:
                x_left = np.min(xs_local)
                x_right = np.max(xs_local)
                x_mid = 0.5 * (x_left + x_right)
                mids.append((x_mid, y))

        if len(mids) < 2:
            return None

        xs2 = [p[0] for p in mids]
        ys2 = [p[1] for p in mids]

        y1 = min(ys2)
        y2 = max(ys2)
        x = float(np.median(xs2))

        if (y2 - y1) < min_len_px:
            return None

        return ((x, y1), (x, y2), "v")
#-
def pixel_line_to_revit_linestring(p1, p2):
    rp1 = pix_to_revit(p1[0], p1[1])
    rp2 = pix_to_revit(p2[0], p2[1])
    if rp1.DistanceTo(rp2) < 0.1:
        return None
    return LineString([(rp1.X, rp1.Y), (rp2.X, rp2.Y)])

#-

#@#




plane = Plane.CreateByNormalAndOrigin(XYZ.BasisZ, origin)
sketch_plane = SketchPlane.Create(doc, plane)
#
DEFAULT_WALL_WIDTH = 0.3  # 英尺：你后面最好用真实墙宽估计替换它

if result.masks is not None:
    logs.append("YOLO类别映射: {}".format(str(result.names)))

    wall_candidates, default_wall_thickness = extract_wall_centerlines_from_global_mask(
        result, pixelWidth, pixelHeight, logs
    )

    logs.append("初始墙候选数量: {}".format(len(wall_candidates)))

    # 这里先做保守版4.5优化：只做节点合并、点插边，不做激进共线合并
    optimized_walls = optimize_wall_centerlines(
        wall_candidates,
        iter_count=1,
        enable_merge_collinear=False
    )

    logs.append("优化后墙数量: {}".format(len(optimized_walls)))

    for idx, w in enumerate(optimized_walls):
        try:
            line_geom = w['line']
            thickness_val = w['thickness']
            name = w['name']

            coords = list(line_geom.coords)
            if len(coords) < 2:
                logs.append("墙{}失败：coords不足".format(idx))
                continue

            start_pt = XYZ(coords[0][0], coords[0][1], 0)
            end_pt = XYZ(coords[-1][0], coords[-1][1], 0)

            if start_pt.DistanceTo(end_pt) < 0.1:
                logs.append("墙{}失败：线太短".format(idx))
                continue

            revit_line = Line.CreateBound(start_pt, end_pt)

            logs.append("准备创建墙{}: len={:.3f}, thickness={:.3f}".format(
                idx, revit_line.Length, thickness_val
            ))

            wall = Wall.Create(doc, revit_line, wall_type.Id, level.Id, wallHeight, 0, False, False)

            try:
                param = wall.get_Parameter(BuiltInParameter.WALL_ATTR_WIDTH_PARAM)
                if param and not param.IsReadOnly:
                    param.Set(thickness_val)
            except Exception as e2:
                logs.append("墙{}宽度设置失败(可忽略): {}".format(idx, str(e2)))

            try:
                wall.Name = name
            except:
                pass

            created_walls.append(wall.ToDSType(True))
            logs.append("墙{}创建成功".format(idx))

        except Exception as e:
            logs.append("墙{}创建失败: {}".format(idx, str(e)))
            logs.append(traceback.format_exc())
            continue
else:
    logs.append("result.masks is None，没有分割mask")
            

        
        
        



# others upgrades __
TransactionManager.Instance.TransactionTaskDone()
doc.Regenerate()
# Outs
#OUT = [created_lines, dyn_lines]
OUT = newpath,created_walls,logs
# ----------------------------------------
python_version_13 = Watch(python_script_12)  # graph output
python_script_13 = Python()  # CPython3; frozen; unwired: IN[0]
# ---------- python_script_13.python (30 lines) ----------
import clr
clr.AddReference('RevitAPI')
from Autodesk.Revit.DB import *

clr.AddReference('RevitServices')
from RevitServices.Persistence import DocumentManager

doc = DocumentManager.Instance.CurrentDBDocument

symbols_info = []

collector = FilteredElementCollector(doc).OfClass(FamilySymbol)

for fs in collector:
    try:
        cat_name = fs.Category.Name if fs.Category else "NoCategory"
        fam_name = fs.Family.Name if fs.Family else "NoFamily"
        
        type_name = ""
        p = fs.get_Parameter(BuiltInParameter.SYMBOL_NAME_PARAM)
        if p:
            type_name = p.AsString()
        else:
            type_name = fs.Name

        symbols_info.append((cat_name, fam_name, type_name, fs.Id.IntegerValue))
    except Exception as e:
        symbols_info.append(("ERROR", str(e)))

OUT = symbols_info
# ----------------------------------------
python_version_14 = Watch(python_script_13)  # graph output
python_version_15 = Watch(python_script_10)  # graph output
python_script_14 = Python(IN[0]=modelpath_3, IN[1]=imagepath_2, IN[2]=scale)  # CPython3; frozen
# ---------- python_script_14.python (494 lines) ----------
# 加载 PythonStandard 和 DesignScript 库
import sys
import clr
clr.AddReference('ProtoGeometry')
from Autodesk.DesignScript.Geometry import *
import Autodesk.DesignScript.Geometry as DS
import Revit
from Revit.Elements import *
import System
sys.path.append("C:/Users/Lenovo/anaconda3/envs/revitenv/Lib/site-packages")
clr.AddReference('RevitAPI')
clr.AddReference('RevitAPIUI')
from Autodesk.Revit.DB import *
from Autodesk.Revit.UI import *

clr.AddReference('RevitServices')
from RevitServices.Persistence import DocumentManager
from RevitServices.Transactions import TransactionManager

clr.AddReference('RevitNodes')
import Revit
clr.ImportExtensions(Revit.Elements)
clr.ImportExtensions(Revit.GeometryConversion)
#
import math
import re
import numpy as np
import torch
import cv2
from ultralytics import YOLO

dataEnteringNode = IN 
pose_Model = IN[0]
pixpath = IN[1]
scale = IN[2]
target_family_name = IN[3] if len(IN) > 3 else "Bed"
target_type_name = IN[4] if len(IN) > 4 else "Only_Bed"
#params
origin = XYZ(0, 0, 0)   
widthFt = scale
pixelWidth = 1600   
pixelHeight = 1200                          
#配置      
CLASS_CONFIG = {
    "Bed": {
        "family_name": "Bed",
        "type_name": "Bed",   # 如果你想放 Only_Bed，就改成 "Only_Bed"
        "rotate": True,
        "kp_start_idx": 0,
        "kp_end_idx": 1,
        "area_filter": True,
        "family_default_axis": "Y"
    },
    "CookingCounter": {
        "family_name": "CookingCounter",
        "type_name": "CookingCounter",
        "rotate": True,
        "kp_start_idx": 0,
        "kp_end_idx": 1,
        "area_filter": False,
        "family_default_axis": "Y"
    },
    "Cabinet": {
        "family_name": "Cabinet",
        "type_name": "Cabinet",
        "rotate": True,
        "kp_start_idx": 0,
        "kp_end_idx": 1,
        "area_filter": False,
        "family_default_axis": "Y"
    },
    "DiningTable": {
        "family_name": "DiningTable",
        "type_name": "DiningTable",
        "rotate": True,
        "kp_start_idx": 0,
        "kp_end_idx": 1,
        "area_filter": False,
        "family_default_axis": "Y"
    },
    "DiningTables": {
        "family_name": "DiningTables",
        "type_name": "DiningTables",
        "rotate": False,
        "area_filter": False,
        "family_default_axis": "Y"
    },
    "Sofa": {
        "family_name": "Sofa",
        "type_name": "Sofa",
        "rotate": True,
        "kp_start_idx": 0,
        "kp_end_idx": 1,
        "area_filter": False,
        "family_default_axis": "Y"
    },
    "TVStand": {
        "family_name": "TVStand",
        "type_name": "TVStand",
        "rotate": True,
        "kp_start_idx": 0,
        "kp_end_idx": 1,
        "area_filter": False,
        "family_default_axis": "Y"
    },
    "Toilet": {
        "family_name": "Toilet",
        "type_name": "Toilet",
        "rotate": True,
        "kp_start_idx": 0,
        "kp_end_idx": 1,
        "area_filter": False,
        "family_default_axis": "Y"
    }
}
#--funcs
def norm_str(s):
    if s is None:
        return ""
    return str(s).strip().lower()
#-

def sanitize_name(name):
    # 如果名称为空，返回默认名称
    if not name:
        return "Unknown"
    # 移除控制字符（ASCII 0-31，除了tab? 但最好全部移除）
    # 允许常见字符：字母、数字、空格、下划线、连字符、中文等
    # 保留所有打印字符，移除控制字符
    cleaned = re.sub(r'[\x00-\x1f\x7f]', '', name)
    # 如果清理后为空，则返回默认名
    if not cleaned.strip():
        return "Unnamed"
    return cleaned
#-
def pix_to_revit(x, y):
    scaleX = widthFt / pixelWidth
    scaleY = widthFt * (float(pixelHeight) / float(pixelWidth)) / pixelHeight
    revit_x = origin.X + x * scaleX
    revit_y = origin.Y + (pixelHeight - y) * scaleY
    return XYZ(revit_x, revit_y, origin.Z)
    
def get_level(doc):
    av = doc.ActiveView
    try:
        if hasattr(av, "GenLevel") and av.GenLevel:
            return av.GenLevel
    except:
        pass
    levels = FilteredElementCollector(doc).OfClass(Level).ToElements()
    if levels and len(levels) > 0:
        return levels[0]
    return None

def find_family_symbol(doc, family_name=None, type_name=None):
    collector = FilteredElementCollector(doc).OfClass(FamilySymbol)
    
    for fs in collector:
        try:
            fam_name = fs.Family.Name if fs.Family else None
            
            p = fs.get_Parameter(BuiltInParameter.SYMBOL_NAME_PARAM)
            typ_name = p.AsString() if p else fs.Name

            family_ok = True if family_name is None else (fam_name == family_name)
            type_ok = True if type_name is None else (typ_name == type_name)

            if family_ok and type_ok:
                return fs
        except:
            pass
    return None


def angle_from_vector(vec, family_default_axis="X"):
    """
    vec: XYZ，目标朝向向量（平面内）
    family_default_axis:
        "X" 表示族默认朝向为 +X
        "Y" 表示族默认朝向为 +Y
    """
    vx = vec.X
    vy = vec.Y
    angle = math.atan2(vy, vx)

    if family_default_axis == "Y":
        angle -= math.pi / 2.0

    return angle
#--
def build_symbol_lookup(doc):
    lookup = {}
    collector = FilteredElementCollector(doc).OfClass(FamilySymbol)
    for fs in collector:
        try:
            fam_name = fs.Family.Name if fs.Family else ""
            p = fs.get_Parameter(BuiltInParameter.SYMBOL_NAME_PARAM)
            typ_name = p.AsString() if p else fs.Name
            key = (norm_str(fam_name), norm_str(typ_name))
            lookup[key] = fs
        except:
            pass
    return lookup
#-
def get_symbol_from_lookup(symbol_lookup, family_name, type_name):
    key = (norm_str(family_name), norm_str(type_name))
    if key in symbol_lookup:
        return symbol_lookup[key]
    return None

def compute_class_area_threshold(boxes, cls_ids, names, class_name, scale_ratio=0.33):
    areas = []
    for i, bbox in enumerate(boxes):
        cls_name = names[int(cls_ids[i])] if len(cls_ids) > i else ""
        if cls_name != class_name:
            continue

        x1, y1, x2, y2 = bbox
        area = max(0, (x2 - x1)) * max(0, (y2 - y1))
        areas.append(area)

    if len(areas) == 0:
        return 0.0, 0.0

    median_area = float(np.median(areas))
    min_area = median_area * scale_ratio
    return median_area, min_area

def ensure_symbol_active(doc, symbol):
    if symbol and not symbol.IsActive:
        symbol.Activate()
        doc.Regenerate()

def create_family_instance(doc, center_pt, symbol, level):
    try:
        instance = doc.Create.NewFamilyInstance(
            center_pt,
            symbol,
            level,
            StructuralType.NonStructural
        )
    except:
        instance = doc.Create.NewFamilyInstance(
            center_pt,
            symbol,
            doc.ActiveView
        )
    return instance

def get_angle_from_keypoints(start_pt, end_pt, family_default_axis="Y"):
    vec = XYZ(
        start_pt.X - end_pt.X,
        start_pt.Y - end_pt.Y,
        0
    )

    if vec.GetLength() < 1e-6:
        return None

    angle = math.atan2(vec.Y, vec.X)

    if family_default_axis == "Y":
        angle -= math.pi / 2.0

    return angle

def rotate_instance(doc, instance, center_pt, angle):
    axis_end = XYZ(center_pt.X, center_pt.Y, center_pt.Z + 1.0)
    axis = Line.CreateBound(center_pt, axis_end)
    ElementTransformUtils.RotateElement(doc, instance.Id, axis, angle)


#配置                   
yolo_pose = YOLO(pose_Model, task="pose")
newpath = "E:/yanjiu/revitss/tests/jjianzhu_pose.jpg"

pose_results = yolo_pose(
    source=pixpath,
    save=False,
    conf=0.3,
    iou=0.45,
    imgsz=640)
cv2.imwrite(newpath,pose_results[0].plot())

#scaleX = widthFt / pixelWidth
#scaleY = widthFt * (pixelHeight / pixelWidth) / pixelHeight  

result = pose_results[0]       
boxes = result.boxes.xyxy.cpu().numpy() if result.boxes is not None else []
cls_ids = result.boxes.cls.cpu().numpy().astype(int) if result.boxes is not None else []
confs = result.boxes.conf.cpu().numpy() if result.boxes is not None else []
names = result.names
kps_xy = None
if result.keypoints is not None and result.keypoints.xy is not None:
    kps_xy = result.keypoints.xy.cpu().numpy()

doc = DocumentManager.Instance.CurrentDBDocument
app = doc.Application
TransactionManager.Instance.EnsureInTransaction(doc)
level = get_level(doc)
symbol_lookup = build_symbol_lookup(doc)
bed_median_area, bed_min_area = compute_class_area_threshold(
    boxes, cls_ids, names, "Bed", 0.33
)

#process areas
bed_indices = []
bed_areas = []
for i, bbox in enumerate(boxes):
    cls_name = names[int(cls_ids[i])] if len(cls_ids) > i else ""
    if cls_name != "Bed":
        continue

    x1, y1, x2, y2 = bbox
    area = max(0, (x2 - x1)) * max(0, (y2 - y1))
    bed_indices.append(i)
    bed_areas.append(area)

if len(bed_areas) > 0:
    median_bed_area = float(np.median(bed_areas))
    min_area_threshold = median_bed_area * 0.33
else:
    median_bed_area = 0.0
    min_area_threshold = 0.0


#---
created_lines = []
dyn_lines = []
dyn_faces = [] 
created_shapes = []
created_instances = []
debug_info = []
missing_family_types = []
skipped_unconfigured_classes = []
#-


##
plane = Plane.CreateByNormalAndOrigin(XYZ.BasisZ, origin)
sketch_plane = SketchPlane.Create(doc, plane)
for cls_name, cfg in CLASS_CONFIG.items():
    symbol = get_symbol_from_lookup(
        symbol_lookup,
        cfg.get("family_name"),
        cfg.get("type_name")
    )
    if symbol:
        ensure_symbol_active(doc, symbol)
#-
for i, bbox in enumerate(boxes):
    cls_name = names[int(cls_ids[i])] if len(cls_ids) > i else ""
    conf = confs[i] if len(confs) > i else 0.0

    # 1. 配置中未定义的类，跳过
    if cls_name not in CLASS_CONFIG:
        skipped_unconfigured_classes.append({
            "index": i,
            "class": cls_name,
            "reason": "class_not_configured"
        })
        continue

    cfg = CLASS_CONFIG[cls_name]
    family_name = cfg.get("family_name")
    type_name = cfg.get("type_name")
    need_rotate = cfg.get("rotate", False)
    family_default_axis = cfg.get("family_default_axis", "Y")

    # 2. 查找对应族类型
    symbol = get_symbol_from_lookup(symbol_lookup, family_name, type_name)
    if symbol is None:
        missing_family_types.append({
            "index": i,
            "class": cls_name,
            "family_name": family_name,
            "type_name": type_name,
            "reason": "family_symbol_not_found"
        })
        continue

    # 3. 中心点
    x1, y1, x2, y2 = bbox
    cx = (x1 + x2) / 2.0
    cy = (y1 + y2) / 2.0
    center_pt = pix_to_revit(cx, cy)

    # 4. 面积过滤（目前只给 Bed）
    area = max(0, (x2 - x1)) * max(0, (y2 - y1))
    if cfg.get("area_filter", False):
        if cls_name == "Bed" and bed_min_area > 0 and area < bed_min_area:
            debug_info.append({
                "index": i,
                "class": cls_name,
                "reason": "filtered_small_area",
                "area": area,
                "threshold": bed_min_area
            })
            continue

    # 5. 先创建实例
    try:
        instance = create_family_instance(doc, center_pt, symbol, level)
    except Exception as e:
        debug_info.append({
            "index": i,
            "class": cls_name,
            "reason": "create_instance_failed",
            "error": str(e)
        })
        continue

    rotated = False
    angle = None

    # 6. 如果该类需要旋转，尝试读取关键点
    if need_rotate:
        kp_start_idx = cfg.get("kp_start_idx", None)
        kp_end_idx = cfg.get("kp_end_idx", None)

        if kps_xy is not None and i < len(kps_xy) and kp_start_idx is not None and kp_end_idx is not None:
            kp = kps_xy[i]

            if len(kp) > max(kp_start_idx, kp_end_idx):
                sx, sy = kp[kp_start_idx]
                ex, ey = kp[kp_end_idx]

                start_pt = pix_to_revit(sx, sy)
                end_pt = pix_to_revit(ex, ey)

                angle = get_angle_from_keypoints(
                    start_pt,
                    end_pt,
                    family_default_axis
                )

                if angle is not None:
                    try:
                        rotate_instance(doc, instance, center_pt, angle)
                        rotated = True
                    except Exception as e:
                        debug_info.append({
                            "index": i,
                            "class": cls_name,
                            "reason": "rotate_failed",
                            "error": str(e)
                        })
                else:
                    debug_info.append({
                        "index": i,
                        "class": cls_name,
                        "reason": "zero_direction_vector"
                    })
            else:
                debug_info.append({
                    "index": i,
                    "class": cls_name,
                    "reason": "insufficient_keypoints"
                })
        else:
            debug_info.append({
                "index": i,
                "class": cls_name,
                "reason": "no_keypoints_for_rotation"
            })

    created_instances.append(instance.ToDSType(False))
    debug_info.append({
        "index": i,
        "class": cls_name,
        "family_name": family_name,
        "type_name": type_name,
        "center": center_pt,
        "area": area,
        "rotated": rotated,
        "angle_rad": angle,
        "angle_deg": angle * 180.0 / math.pi if angle is not None else None,
        "conf": conf
    })

TransactionManager.Instance.TransactionTaskDone()
doc.Regenerate()

OUT = {
    "preview_image": newpath,
    "created_instances": created_instances,
    "debug_info": debug_info,
    "missing_family_types": missing_family_types,
    "skipped_unconfigured_classes": skipped_unconfigured_classes,
    "bed_area_threshold": {
        "median_area": bed_median_area,
        "min_area": bed_min_area
    }
}
# ----------------------------------------
python_version_16 = CodeBlock(i=python_version_5) { i[0]; }
file_from_path_8 = FileObject(path=python_version_16)
readFromFile_8 = Image.ReadFromFile(file=file_from_path_8)
watch_image_8 = WatchImageCore(image=readFromFile_8)
python_script_15 = Python(IN[0]=modelpath_3, IN[1]=imagepath_2, IN[2]=scale)  # CPython3; frozen
# ---------- python_script_15.python (283 lines) ----------
# 加载  PythonStandard 和 DesignScript 库
import sys
import clr
clr.AddReference('ProtoGeometry')
from Autodesk.DesignScript.Geometry import *
import Autodesk.DesignScript.Geometry as DS
import Revit
from Revit.Elements import *
import System
sys.path.append("C:/Users/Lenovo/anaconda3/envs/revitenv/Lib/site-packages")
clr.AddReference('RevitAPI')
clr.AddReference('RevitAPIUI')
from Autodesk.Revit.DB import *
from Autodesk.Revit.UI import *

clr.AddReference('RevitServices')
from RevitServices.Persistence import DocumentManager
from RevitServices.Transactions import TransactionManager

clr.AddReference('RevitNodes')
import Revit
clr.ImportExtensions(Revit.Elements)
clr.ImportExtensions(Revit.GeometryConversion)
#
import math
import re
import numpy as np
import torch
import cv2
from ultralytics import YOLO

dataEnteringNode = IN 
pose_Model = IN[0]
pixpath = IN[1]
scale = IN[2]
target_family_name = IN[3] if len(IN) > 3 else "Bed"
target_type_name = IN[4] if len(IN) > 4 else "Only_Bed"
#params
origin = XYZ(0, 0, 0)   
widthFt = scale
pixelWidth = 1600   
pixelHeight = 1200                          
#                         
yolo_pose = YOLO(pose_Model, task="pose")
newpath = "E:/yanjiu/revitss/tests/jjianzhu_pose.jpg"

pose_results = yolo_pose(
    source=pixpath,
    save=False,
    conf=0.3,
    iou=0.45,
    imgsz=640)
cv2.imwrite(newpath,pose_results[0].plot())

scaleX = widthFt / pixelWidth
scaleY = widthFt * (pixelHeight / pixelWidth) / pixelHeight  

result = pose_results[0]       
boxes = result.boxes.xyxy.cpu().numpy() if result.boxes is not None else []
cls_ids = result.boxes.cls.cpu().numpy().astype(int) if result.boxes is not None else []
names = result.names
kps_xy = None
if result.keypoints is not None and result.keypoints.xy is not None:
    kps_xy = result.keypoints.xy.cpu().numpy()

doc = DocumentManager.Instance.CurrentDBDocument
app = doc.Application
TransactionManager.Instance.EnsureInTransaction(doc)

#process areas
bed_indices = []
bed_areas = []
for i, bbox in enumerate(boxes):
    cls_name = names[int(cls_ids[i])] if len(cls_ids) > i else ""
    if cls_name != "Bed":
        continue

    x1, y1, x2, y2 = bbox
    area = max(0, (x2 - x1)) * max(0, (y2 - y1))
    bed_indices.append(i)
    bed_areas.append(area)

if len(bed_areas) > 0:
    median_bed_area = float(np.median(bed_areas))
    min_area_threshold = median_bed_area * 0.33
else:
    median_bed_area = 0.0
    min_area_threshold = 0.0


#---
created_lines = []
dyn_lines = []
dyn_faces = [] 
created_shapes = []

def pix_to_revit(x, y):
    revit_x = origin.X + x * scaleX
    revit_y = origin.Y + (pixelHeight - y) * scaleY  # 翻转 Y 轴
    return XYZ(revit_x, revit_y, origin.Z)
def sanitize_name(name):
    # 如果名称为空，返回默认名称
    if not name:
        return "Unknown"
    # 移除控制字符（ASCII 0-31，除了tab? 但最好全部移除）
    # 允许常见字符：字母、数字、空格、下划线、连字符、中文等
    # 保留所有打印字符，移除控制字符
    cleaned = re.sub(r'[\x00-\x1f\x7f]', '', name)
    # 如果清理后为空，则返回默认名
    if not cleaned.strip():
        return "Unnamed"
    return cleaned
#-
def pix_to_revit(x, y):
    revit_x = origin.X + x * scaleX
    revit_y = origin.Y + (pixelHeight - y) * scaleY
    return XYZ(revit_x, revit_y, origin.Z)

def get_level(doc):
    av = doc.ActiveView
    try:
        if hasattr(av, "GenLevel") and av.GenLevel:
            return av.GenLevel
    except:
        pass

    levels = FilteredElementCollector(doc).OfClass(Level).ToElements()
    if levels and len(levels) > 0:
        return levels[0]
    return None

def find_family_symbol(doc, family_name=None, type_name=None):
    collector = FilteredElementCollector(doc).OfClass(FamilySymbol)
    
    for fs in collector:
        try:
            fam_name = fs.Family.Name if fs.Family else None
            
            p = fs.get_Parameter(BuiltInParameter.SYMBOL_NAME_PARAM)
            typ_name = p.AsString() if p else fs.Name

            family_ok = True if family_name is None else (fam_name == family_name)
            type_ok = True if type_name is None else (typ_name == type_name)

            if family_ok and type_ok:
                return fs
        except:
            pass
    return None


def angle_from_vector(vec, family_default_axis="X"):
    """
    vec: XYZ，目标朝向向量（平面内）
    family_default_axis:
        "X" 表示族默认朝向为 +X
        "Y" 表示族默认朝向为 +Y
    """
    vx = vec.X
    vy = vec.Y
    angle = math.atan2(vy, vx)

    if family_default_axis == "Y":
        angle -= math.pi / 2.0

    return angle



##
plane = Plane.CreateByNormalAndOrigin(XYZ.BasisZ, origin)
sketch_plane = SketchPlane.Create(doc, plane)
BEDS_IDX = 0
BEDE_IDX = 1

# 如果你的模型里还有多个类别，建议只处理 Bed 类
# 假设类别名叫 "Bed"
TARGET_CLASS_NAME = "Bed"

symbol = find_family_symbol(doc, target_family_name, target_type_name)
level = get_level(doc)

created_instances = []
debug_info = []

if symbol is None:
    OUT = "未找到族类型或族名称：{}".format(family_name)
else:
    TransactionManager.Instance.EnsureInTransaction(doc)

    if not symbol.IsActive:
        symbol.Activate()
        doc.Regenerate()

    for i, bbox in enumerate(boxes):
        # 过滤床类别
        cls_name = names[int(cls_ids[i])] if len(cls_ids) > i else ""
        if cls_name != TARGET_CLASS_NAME:
            continue

        x1, y1, x2, y2 = bbox
        cx = (x1 + x2) / 2.0
        cy = (y1 + y2) / 2.0
        center_pt = pix_to_revit(cx, cy)
        area = max(0, (x2 - x1)) * max(0, (y2 - y1))
        if area < min_area_threshold:
            debug_info.append({
            "index": i,
            "reason": "filtered_small_area",
            "area": area,
            "threshold": min_area_threshold
        })
            continue

        # 取关键点
        if kps_xy is None or i >= len(kps_xy):
            debug_info.append("第{}个目标无关键点".format(i))
            continue

        kp = kps_xy[i]

        if len(kp) <= max(BEDS_IDX, BEDE_IDX):
            debug_info.append("第{}个目标关键点数量不足".format(i))
            continue

        sx, sy = kp[BEDS_IDX]
        ex, ey = kp[BEDE_IDX]

        bedS_pt = pix_to_revit(sx, sy)
        bedE_pt = pix_to_revit(ex, ey)

        # 朝向：终点 -> 起点，即 BedE -> BedS
        vec = XYZ(
    bedS_pt.X - bedE_pt.X,
    bedS_pt.Y - bedE_pt.Y,
    0
)


        # 排除零向量
        if vec.GetLength() < 1e-6:
            debug_info.append("第{}个床关键点方向向量过短，跳过旋转".format(i))
            vec = XYZ.BasisX

        angle = math.atan2(vec.Y, vec.X) - math.pi / 2.0

        # 创建床族实 例
        # 普通模型家具通常这样创建
        try:
            instance = doc.Create.NewFamilyInstance(
                center_pt,
                symbol,
                level,
                StructuralType.NonStructural
            )
        except:
            # 某些基于视图的族可能需要这种方式
            instance = doc.Create.NewFamilyInstance(
                center_pt,
                symbol,
                doc.ActiveView
            )

        # 旋转
        axis_end = XYZ(center_pt.X, center_pt.Y, center_pt.Z + 1.0)
        axis = Line.CreateBound(center_pt, axis_end)
        ElementTransformUtils.RotateElement(doc, instance.Id, axis, angle)
         

        created_instances.append(instance.ToDSType(False))
        debug_info.append({
            "index": i,
            "class": cls_name,
            "center": center_pt,
            "BedS": bedS_pt,
            "BedE": bedE_pt,
            "angle_rad": angle,
            "angle_deg": angle * 180.0 / math.pi
        })

    TransactionManager.Instance.TransactionTaskDone()
doc.Regenerate()
OUT = newpath,created_instances, debug_info
# ----------------------------------------
python_version_17 = Watch(python_script_15)  # graph output
python_version_18 = Watch(python_version_16)  # graph output
readFromFile_9 = Image.ReadFromFile(file=file_from_path_8)
python_paths_4 = Watch(python_script_6)  # graph output
